# Grasshopper definition colors.gh (Grasshopper 1.0.8)
# Copyright: GNU Lesser General Public License Version 3
# plug-ins: ColorPlus

panel = Panel("""0
0.5
1""")
panel_2 = Panel("""#001117
#7B827D
#F7F3E3""")
number_slider = Slider(8, range=0..15)
panel_3 = Panel("""0
0.33
0.66
1""")
panel_4 = Panel("""0
0.25
0.5
0.75
1""")
expression = Expression(Expression="1/10")
expression_2 = Expression(Expression="1/7")
expression_3 = Expression(Expression="1/6")
expression_4 = Expression(Expression="1/9")
expression_5 = Expression(Expression="1/8")
panel_5 = Panel("""10
9
8
7
6""")
panel_6 = Panel("""#001117
#3E494A
#B9BAB0
#F7F3E3""")
panel_7 = Panel("""dark
dark-grey
grey
light-grey
light""")
col = Colour("#001117")
col_2 = Colour("#f7f3e3")
expression_6 = Expression(x=panel_5, Expression="x+1")
merge = Merge(Data1=expression, Data2=expression_4, Data3=expression_5, Data4=expression_2, Data5=expression_3)
expression_7 = Expression(x=number_slider, Expression="1/(x-1)")
panel_9 = Panel("""0
0.16
0.33
0.5
0.66
0.83
1.0""")
panel_10 = Panel("""0
0.125
0.25
0.375
0.5
0.625
0.75
0.875
1""")
panel_11 = Panel("1")
panel_12 = Panel("""#001117
#243235
#7B827D
#D3D2C5
#F7F3E3""")
panel_13 = Panel(merge)
panel_14 = Panel("""dark
dark-dark-grey
dark-grey-grey
grey
light-grey-grey
light-light-grey
light""")
series = Series(Start=0, Step=1, Count=expression_6)
series_2 = Series(Start=0, Step=merge, Count=expression_6)
panel_15 = Panel("""#001117
#091A1F
#243235
#4C5756
#7B827D
#ABADA4
#D3D2C5
#EEEADB
#F7F3E3""")
series_3 = Series(Start=0, Step=expression_7, Count=number_slider)
panel_17 = Panel("""0
0.14
0.29
0.43
0.57
0.71
0.86
1.0""")
panel_18 = Panel("""0
0.2
0.4
0.6
0.8
1""")
concat = Concatenate(FragmentA=series, FragmentB="-", FragmentC=graft(panel_5))
trim = TrimTree(Tree=series_2, Depth=1)
panel_19 = Panel("""dark
0.1
0.2
0.3
0.4
grey
0.6
0.7
0.8
0.9
light""")
concat_2 = Concatenate()
panel_21 = Panel("""#001117
#0C1C21
#2E3C3D
#606966
#979B94
#C9C8BD
#EBE8D9
#F7F3E3""")
panel_22 = Panel("""#001117
#18272A
#555F5D
#A2A59D
#DFDDD0
#F7F3E3""")
panel_23 = Panel("""#001117
#112025
#3E494A
#7B827D
#B9BAB0
#E6E4D5
#F7F3E3""")
gradient = Gradient(LowerLimit=0, UpperLimit=1, Parameter=series_3, stops=[0: RGB(0, 17, 23), 1: RGB(247, 243, 227)])
pt = ConstructPoint(XCoordinate=trim, YCoordinate=0, ZCoordinate=0)
trim_2 = TrimTree(Tree=concat, Depth=1)
panel_24 = Panel("""0
0.11
0.22
0.33
0.44
0.55
0.66
0.77
0.88
1""")
panel_25 = Panel("""0
0.1
0.2
0.3
0.4
0.5
0.6
0.7
0.8
0.9
1.0""")
cullpt = CullDuplicates(Points=pt, Tolerance="0.0001", CullMode=3)  # -> Points, Indices, Valence
panel_26 = Panel(concat)
panel_27 = Panel("""#001117
#06171C
#18272A
#334041
#555F5D
#7B827D
#A2A59D
#C4C4B9
#DFDDD0
#F1EDDE
#F7F3E3""")
item = ListItem(List=trim_2, Index=cullpt.Indices, Wrap=True)
panel_28 = Panel("""#001117
#07181D
#1D2B2F
#3E494A
#666E6B
#91968F
#B9BBB0
#DAD9CB
#F0ECDD
#F7F3E3""")
pdecon = Deconstruct(Point=cullpt.Points)  # -> XComponent, YComponent, ZComponent
sort = SortList(Keys=pdecon.XComponent, ValuesA=item)  # -> Keys, ValuesA
col_3 = Colour(gradient)
tohex = ToHex(Color=col_3)
panel_30 = Panel(series_3)
txt = Text(tohex)
panel_31 = Panel(txt)

panel_32 = Panel("""0
0.142857
0.285714
0.428571
0.571429
0.714286
0.857143
1.0""")
panel_34 = Panel("""dark
dark-6-7
dark-5-7
dark-4-7
light-4-7
light-5-7
light-6-7
light""")
panel_35 = Panel("""dark
grey
light""")
panel_36 = Panel("""0
0.1
0.111111
0.125
0.142857
0.166667
0.2
0.222222
0.25
0.285714
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""")
panel_39 = Panel("""d-d-d-d
d-d-d-g
d-d-g-g
d-g-g-g
g-g-g-g
l-g-g-g
l-l-g-g
l-l-l-g
l-l-l-l""")
panel_40 = Panel("""0
1/10
1/9
1/8
1/7
1/6
1/5
2/9
1/4
2/7
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""")
panel_41 = Panel("""dark-dark
dark-grey
grey-grey
light-grey
light-light""")
panel_42 = Panel("""dark
grey-100
dark-8-9
d-d-d-g
dark-6-7
dark-dark-grey
grey-200
dark-7-9
dark-grey
dark-5-7
grey-300
dark-dark-grey
d-g-g-g
grey-400
dark-4-7
dark-5-9
grey
light-5-9
light-4-7
grey-600
l-g-g-g
light-grey-grey
grey-700
light-5-7
light-grey
light-7-9
grey-800
light-light-grey
light-6-7
l-l-l-g
light-8-9
grey-900
light""")
panel_45 = Panel("""dark
dark-8-9
dark-7-9
dark-6-9
dark-5-9
light-5-9
light-6-9
light-7-9
light-8-9
light""")
panel_46 = Panel("""dark-dark-dark
dark-dark-grey
dark-grey-grey
grey-grey-grey
light-grey-grey
light-light-grey
light-light-light""")
panel_47 = Panel("""#001117
#06171c
#07181d
#091a1f
#0c1c21
#112025
#18272a
#1d2b2f
#243235
#2e3c3d
#334041
#3e494a
#4c5756
#555f5d
#606966
#666e6b
#7b827d
#91968f
#979b94
#a2a59d
#abada4
#b9bbb0
#c4c4b9
#c9c8bd
#d3d2c5
#dad9cb
#dfddd0
#e6e4d5
#ebe8d9
#eeeadb
#f0ecdd
#f1edde
#f7f3e3""")
panel_49 = Panel("""grey-50
grey-100
grey-200
grey-300
grey-400
grey-500
grey-600
grey-700
grey-800
grey-900
grey-950""")
