# Grasshopper definition tests.gh (Grasshopper 1.0.8)
# Copyright: GNU Lesser General Public License Version 3
# plug-ins: RhinoCodePluginGH, semio

# ----
# Point missing
# Direction missing
por = ModelPort()  # -> Port, Id, Point, Direction, Locators

spt = ModelScreenPoint()  # -> ScreenPoint, X, Y

# ----
# Group missing
loc = ModelLocator()  # -> Locator, Group, Subgroup

# ----
# Url missing
rep = ModelRepresentation()  # -> Representation, Url, Mime, Lod, Tags

# ----
# Connected equal Connecting
con = ModelConnection()  # -> Connection, ConnectedPieceId, ConnectedPieceTypePortId, ConnectingPieceId, ConnectingPieceTypePortId, Rotation, Tilt, Offset

# ----
# Constructors
# Name missing
qal = ModelQuality()  # -> Quality, Name, Value, Unit, Definition

# ----
# Type Name missing
pce = ModelPiece()  # -> Piece, Id, TypeName, TypeVariant, Plane, ScreenPoint

# ----
# Name missing
# Port missing
# Representation missing
typ = ModelType()  # -> Type, Name, Description, Icon, Variant, Unit, Ports, Representations, Qualities

panel = Panel("""Top
Front
Right
Perspective""")

# ----
# Name missing
dsn = ModelDesign()  # -> Design, Name, Description, Icon, Variant, Unit, Pieces, Connections, Qualities

bridge_rotation = Slider(0, range=-360..360)
tambour_rotation = Slider(10, range=-360..360)
capsule_rotation = Slider(5, range=-360..360)
capsule_tilt = Slider(20, range=-360..360)
bridge_tilt = Slider(0, range=-360..360)
bridge_offset = Slider(0, range=-10..10)
tambour_tilt = Slider(15, range=-360..360)
tambour_offset = Slider(1, range=-10..10)
capsule_offset = Slider(0.5, range=-10..10)
cylindric_tambour = BooleanToggle(False)
ellipsoid_capsule = BooleanToggle(False)
list = ValueList({"Full": 0, "Towers": 1, "First Tower": 2, "Second Tower": 3, "Chain": 4, "Module": 5, "Y": 6, "Self": 7}, selected="Full")

# ---- group: Parameters
run = BooleanToggle(True)
futuristic = BooleanToggle(False)
list_2 = ValueList({"1to500", "1to200"}, selected="1to500")
list_3 = ValueList({"Full": 0, "First Tower": 1, "Second Tower": 2}, selected="Full")

# ----
custom_plane = BooleanToggle(True)

# ----
# Name missing
kit = ModelKit()  # -> Kit, Name, Description, Icon, Url, Homepage, Types, Designs

filter = StreamFilter(Gate=cylindric_tambour, Stream0="Tambour", Stream1="Cylindric Tambour")
filter_2 = StreamFilter(Gate=ellipsoid_capsule, Stream0="Capsule", Stream1="Ellipsoid Capsule")
pt = ConstructPoint(XCoordinate=Slider(5, range=-10..10), YCoordinate=Slider(-7, range=-10..10), ZCoordinate=Slider(8, range=-10..10))
pt_2 = ConstructPoint(
    XCoordinate=Slider(-0.4, range=-10..10),
    YCoordinate=Slider(-4.5, range=-10..10),
    ZCoordinate=Slider(-1.1, range=-10..10))
pt_3 = ConstructPoint(XCoordinate=Slider(3.2, range=-10..10), YCoordinate=Slider(-4.1, range=-10..10), ZCoordinate=Slider(-2.2, range=-10..10))
panel_2 = Panel("NameToooooooooooooooooLoooooooooooooooooooooonggggggggggggggggggg")
pl_3pt = Plane3Pt(PointA=pt, PointB=pt_2, PointC=pt_3)
panel_3 = Panel(pl_3pt)
xy = XYPlane(Origin=Point(0, 0, 0))
panel_4 = Panel("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")
panel_5 = Panel("IdToooooooooooooooooooooooooooooooooooooooLooooooooooooooooooooooooooooooooooooooooooooooooooongggggggggggggggggggggggggggggggggg")
filter_3 = StreamFilter(Gate=custom_plane, Stream0=xy, Stream1=pl_3pt)

# ----
# Id too long
pt_4 = ConstructPoint(XCoordinate=0, YCoordinate=0, ZCoordinate=0)
vec = VectorXYZ(XComponent=0, YComponent=0, ZComponent=0)  # -> Vector, Length
por_2 = ModelPort(Id=panel_5, Point=pt_4, Direction=vec.Vector)  # -> Port, Id, Point, Direction, Locators

# ----
# Description too long
pt_5 = ConstructPoint(XCoordinate=0, YCoordinate=0, ZCoordinate=0)
vec_2 = VectorXYZ(XComponent=0, YComponent=0, ZComponent=0)  # -> Vector, Length
rep_2 = ModelRepresentation(Url="https://url")  # -> Representation, Url, Mime, Lod, Tags
por_3 = ModelPort(Point=pt_5, Direction=vec_2.Vector)  # -> Port, Id, Point, Direction, Locators
typ_2 = ModelType(Name="Name", Description=panel_4, Representations=rep_2.Representation, Ports=por_3.Port)  # -> Type, Name, Description, Icon, Variant, Unit, Representations, Ports, Qualities

# ----
# Lod too long
rep_3 = ModelRepresentation(Url="https://url", Mime="https://url", Lod=panel_2)  # -> Representation, Url, Mime, Lod, Tags

# ----
# Url too long
rep_4 = ModelRepresentation(Url="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")  # -> Representation, Url, Mime, Lod, Tags

genes = GenePool(Decimals=0, Maximum=8, Minimum=1, Value=[1, 6, 2, 8, 3, 4, 7, 5])
panel_6 = Panel("""c1
c2
c3
c4
c5
c6
c7
c8""")
panel_7 = Panel("""sl0_d0
sl0_d1
sl0_d2
sl0_d3
sl1_d0
sl1_d1
sl2_d0
sl2_d1""")
pce_2 = ModelPiece(Id="t", TypeName=filter, Plane=filter_3)  # -> Piece, Id, TypeName, TypeVariant, Plane, ScreenPoint
pce_3 = ModelPiece(Id=panel_6, TypeName=filter_2, TypeVariant=genes)  # -> Piece, Id, TypeName, TypeVariant, Plane, ScreenPoint
con_2 = ModelConnection(
    ConnectedPieceId=pce_2.Id,
    ConnectedPieceTypePortId=panel_7,
    ConnectingPieceId=pce_3.Id,
    Rotation=capsule_rotation,
    Tilt=capsule_tilt,
    Offset=capsule_offset)  # -> Connection, ConnectedPieceId, ConnectedPieceTypePortId, ConnectingPieceId, ConnectingPieceTypePortId, Rotation, Tilt, Offset
merge = Merge(Data2=con_2.Connection)
merge_2 = Merge(Data1=pce_2.Piece, Data2=pce_3.Piece)
dsn_2 = ModelDesign(Name="Test", Variant="Module", Pieces=merge_2, Connections=merge)  # -> Design, Name, Description, Icon, Variant, Unit, Pieces, Connections, Qualities

panel_8 = Panel("The second tower (eleven storey) of the Nakagin Capule Tower.")

# ----
# Props
# Tag too long
rep_5 = ModelRepresentation(Url="https://url", Mime="https://url", Tags=panel_2)  # -> Representation, Url, Mime, Lod, Tags

# ----
# Id too long
pce_4 = ModelPiece(Id=panel_5, TypeName="Name")  # -> Piece, Id, TypeName, TypeVariant, Plane, ScreenPoint

panel_9 = Panel("""b1
b2""")
pce_5 = ModelPiece(Id=panel_9, TypeName="Bridge", Plane=filter_3)  # -> Piece, Id, TypeName, TypeVariant, Plane, ScreenPoint
item = ListItem(List=pce_5.Id, Index=0, Wrap=True)  # -> Item, Item1
panel_10 = Panel("w")
con_3 = ModelConnection(
    ConnectedPieceId=item.Item,
    ConnectedPieceTypePortId="e",
    ConnectingPieceId=item.Item1,
    ConnectingPieceTypePortId="e",
    Rotation=bridge_rotation,
    Tilt=bridge_tilt,
    Offset=bridge_offset)  # -> Connection, ConnectedPieceId, ConnectedPieceTypePortId, ConnectingPieceId, ConnectingPieceTypePortId, Rotation, Tilt, Offset
dsn_3 = ModelDesign(Name=filter_3, Variant="Self", Pieces=pce_5.Piece, Connections=con_3.Connection)  # -> Design, Name, Description, Icon, Variant, Unit, Pieces, Connections, Qualities

# ----
# Description too long
pce_6 = ModelPiece(TypeName="Name")  # -> Piece, Id, TypeName, TypeVariant, Plane, ScreenPoint
dsn_4 = ModelDesign(Name="Name", Description=panel_4, Pieces=pce_6.Piece)  # -> Design, Name, Description, Icon, Variant, Unit, Pieces, Connections, Qualities

# ----
# Mime too long
rep_6 = ModelRepresentation(Url="https://url", Mime=panel_5)  # -> Representation, Url, Mime, Lod, Tags

genes_2 = GenePool(Decimals=0, Maximum=10, Minimum=0, Value=[3, 6, 9])
X = UnitX(Factor="10")
typ_3 = ModelType()  # -> Type, Name, Description, Icon, Variant, Unit, Representations, Ports, Qualities
por_4 = ModelPort(Port=typ_3.Ports)  # -> Port, Id, Point, Direction, Locators

# ----
# Description too long
kit_2 = ModelKit(Name="Name", Description=panel_4)  # -> Kit, Name, Description, Icon, Url, Homepage, Types, Designs

plcoord = PlaneCoordinates(Point=X, System=filter_3)  # -> XCoordinate, YCoordinate, ZCoordinate
vec_3 = VectorXYZ(XComponent=plcoord.XCoordinate, YComponent=plcoord.YCoordinate, ZComponent=plcoord.ZCoordinate)  # -> Vector, Length
move = Move(Geometry=filter_3, Motion=vec_3.Vector)  # -> Geometry, Transform
ty = Type(null)
ty_2 = Type(null)
ty_3 = Type(null)
ty_4 = Type(null)

series = Series(Start=0, Step=1, Count=Slider(20, range=0..100))
trim = TrimTree(Tree=series, Depth=1)
concat = Concatenate(FragmentA="t", FragmentB=trim)
pce_7 = ModelPiece(Id=concat, TypeName=filter)  # -> Piece, Id, TypeName, TypeVariant, Plane, ScreenPoint
split = SplitList(List=pce_7.Piece, Index="1")  # -> ListA, ListB
trim_2 = TrimTree(Tree=split.ListB, Depth=1)
trim_3 = TrimTree(Tree=split.ListA, Depth=1)
pce_8 = ModelPiece(Piece=trim_3, Plane=filter_3)  # -> Piece, Id, TypeName, TypeVariant, Plane, ScreenPoint
merge_3 = Merge(Data1=pce_8.Piece, Data2=trim_2)
lincons = LinearConnections(pc=merge_3, cdpo="t", cgpo="b", rotation=tambour_rotation, tilt=tambour_tilt, offset=tambour_offset)
dsn_5 = ModelDesign(Name="Test", Description="A chain of tambours", Icon="🔗", Variant="Chain", Pieces=merge_3, Connections=lincons)  # -> Design, Name, Description, Icon, Variant, Unit, Pieces, Connections, Qualities

merge_4 = Merge(Data1=ty, Data2=ty_2, Data3=ty_3, Data4=ty_4)
typ_4 = ModelType(Type=merge_4)  # -> Type, Name, Description, Icon, Variant, Unit, Representations, Ports, Qualities
panel_11 = Panel("https://github.com/usalu/semio")
ty_5 = Type(null)
ty_6 = Type(null)
ty_7 = Type(null)
ty_8 = Type(null)
ty_9 = Type(null)
ty_10 = Type(null)
ty_11 = Type(null)
ty_12 = Type(null)
ty_13 = Type(null)
ty_14 = Type(null)
ty_15 = Type(null)
ty_16 = Type(null)
ty_17 = Type(null)
mime = Mime({".stl": "model/stl", ".obj": "model/obj", ".glb": "model/gltf-binary", ".gltf": "model/gltf+json", ".3dm": "model/vnd.3dm", ".speckle": "model/vnd.speckle+json", ".png": "image/png", ".jpg": "image/jpeg", ".jpeg": "image/jpeg", ".svg": "image/svg+xml", ".pdf": "application/pdf", ".zip": "application/zip", ".json": "application/json", ".csv": "text/csv", ".txt": "text/plain"}, selected=".3dm")

# ----
# Connected equal Connecting
pce_9 = ModelPiece(Id="0", TypeName="Name")  # -> Piece, Id, TypeName, TypeVariant, Plane, ScreenPoint
pce_10 = ModelPiece(Id="0", TypeName="Name")  # -> Piece, Id, TypeName, TypeVariant, Plane, ScreenPoint
con_4 = ModelConnection(ConnectedPieceId=pce_10.Id, ConnectingPieceId=pce_9.Id)  # -> Connection, ConnectedPieceId, ConnectedPieceTypePortId, ConnectingPieceId, ConnectingPieceTypePortId, Rotation, Tilt, Offset

merge_5 = Merge(Data1=ty_5, Data2=ty_6)
merge_6 = Merge(Data1=ty_15, Data2=ty_17, Data3=ty_16)
merge_7 = Merge(Data1=ty_9, Data2=ty_10, Data3=ty_11, Data4=ty_12, Data5=ty_13, Data6=ty_14, Data7=ty_7, Data8=ty_8)
panel_12 = Panel("C:\git\semio\python\engine\debug\kit")
txt = EncodeText(Text=panel_12)
panel_13 = Panel(txt)
ty_18 = Type(null)
ty_19 = Type(null)
curdir = CurrentDirectory()  # -> PD, D, P, S
# ---------- curdir: Python ----------
# Component Information
# --------------------------------------------------------------------------------------------
if ghenv.Component.RunCount < 2:
    # General
    # --------------------------------------------------------------------------------------------
    __author__ = "Ueli Saluz"
    __version__ = "2024.07.26"

    ghenv.Component.Name = "CurrentDirectory"
    ghenv.Component.NickName = "CurDir"
    ghenv.Component.Description = "Current directory of the current grasshopper file."
    ghenv.Component.Message = "VER 1.1"
    ghenv.Component.Category = "Params"
    ghenv.Component.SubCategory = "Util"

    # Outputs
    # --------------------------------------------------------------------------------------------
    outputIndex = 0

    ghenv.Component.Params.Output[outputIndex].Name = "ParentDirectory"
    ghenv.Component.Params.Output[outputIndex].NickName = "PD"
    ghenv.Component.Params.Output[outputIndex].Description = "Parent directory of the current directory."
    outputIndex += 1

    ghenv.Component.Params.Output[outputIndex].Name = "Directory"
    ghenv.Component.Params.Output[outputIndex].NickName = "D"
    ghenv.Component.Params.Output[outputIndex].Description = "Directory of the current grasshopper file."
    outputIndex += 1

    ghenv.Component.Params.Output[outputIndex].Name = "Path"
    ghenv.Component.Params.Output[outputIndex].NickName = "P"
    ghenv.Component.Params.Output[outputIndex].Description = "Path of the current grasshopper file."
    outputIndex += 1

    ghenv.Component.Params.Output[outputIndex].Name = "Separator"
    ghenv.Component.Params.Output[outputIndex].NickName = "S"
    ghenv.Component.Params.Output[outputIndex].Description = "Separator of the current system."
    outputIndex += 1

# Imports
# --------------------------------------------------------------------------------------------
from os.path import dirname, abspath
from os import sep

# Solver - Run with trees to enhance performance drastically
# --------------------------------------------------------------------------------------------
if __name__ == "__main__":
    P = ghenv.Component.OnPingDocument().FilePath
    D = dirname(P)
    PD = dirname(D)
    S = sep
# ---------- end curdir ----------
merge_8 = Merge(Data1=merge_5, Data2=ty_18, Data3=ty_19, Data4=merge_6, Data5=merge_4, Data6=merge_7)
concat_2 = Concatenate(FragmentD=panel_11, FragmentA="/releases/download/", FragmentB="r24.09-1", FragmentC="/examples.zip")
concat_3 = Concatenate(FragmentA=panel_11, FragmentB="/tree/", FragmentC="r24.09-1", FragmentD="/examples/metabolism")

# ----
# In=Out (Serialization must be the same)
panel_14 = Panel("C:\git\semio\python\engine\debug\kit")
toggle = BooleanToggle(True)
kit_3 = DeleteKit(Url=panel_14, Run=toggle)
kt = Kit("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")
expression = Expression(x=toggle, y=kit_3, Expression="x")
kit_4 = SerializeKit(Kit=kt)
kit_5 = CreateKit(Kit=kt, Uri=panel_14, Run=expression)
expression_2 = Expression(x=toggle, y=kit_5, Expression="x")
kit_6 = LoadKit(Url=panel_14, Run=expression_2)  # -> Kit, Success
kit_7 = SerializeKit(Kit=kit_6.Kit)
expression_3 = Expression(x=kit_4, y=kit_7, Expression="x=y")
must_be_true = Panel(expression_3)

sep = Text(curdir.S)
prefix = Text("C:\git\semio\examples\metabolism")
typ_5 = ModelType(Type=merge_8)  # -> Type, Name, Description, Icon, Variant, Unit, Representations, Ports, Qualities
panel_15 = Panel("C:\git\semio\python\engine\debug\entity2.json")

# ----
# Piece not part
pce_11 = ModelPiece(Id="0", TypeName="Name")  # -> Piece, Id, TypeName, TypeVariant, Plane, ScreenPoint
pce_12 = ModelPiece(Id="1", TypeName="SecondName")  # -> Piece, Id, TypeName, TypeVariant, Plane, ScreenPoint
con_5 = ModelConnection(ConnectedPieceId=pce_11.Id, ConnectingPieceId=pce_12.Id)  # -> Connection, ConnectedPieceId, ConnectedPieceTypePortId, ConnectingPieceId, ConnectingPieceTypePortId, Rotation, Tilt, Offset
dsn_6 = ModelDesign(Name="Name", Connections=con_5.Connection)  # -> Design, Name, Description, Icon, Variant, Unit, Pieces, Connections, Qualities

kit_8 = DeleteKit(Url=panel_12, Run=Toggle(False))
kit_9 = LoadKit(Url=panel_12, Run=Toggle(False))  # -> Kit, Success
typ_6 = PutType(Type=merge_8, Uri=panel_12, Run=Toggle(False))
typ_7 = RemoveType(TypeName=typ_5.Name, TypeVariant=typ_5.Variant, Uri=panel_12, Run=Toggle(False))
typ_8 = SerializeType()
kit_10 = ModelKit(Kit=kit_9.Kit)  # -> Kit, Name, Description, Icon, Url, Homepage, Types, Designs
file = ReadFile(File=panel_15, PerLineParse=False)  # disabled
trim_4 = TrimTree(Tree=kit_10.Types, Depth=1)
trim_5 = TrimTree(Tree=kit_10.Designs, Depth=1)
dsn_7 = ModelDesign(Design=trim_5)  # -> Design, Name, Description, Icon, Variant, Unit, Pieces, Connections, Qualities
qal_2 = ModelQuality(Quality=dsn_7.Qualities)  # -> Quality, Name, Value, Unit, Definition
typ_9 = ModelType(Type=trim_4)  # -> Type, Name, Description, Icon, Variant, Unit, Representations, Ports, Qualities
con_6 = ModelConnection(Connection=dsn_7.Connections)  # -> Connection, ConnectedPieceId, ConnectedPieceTypePortId, ConnectingPieceId, ConnectingPieceTypePortId, Rotation, Tilt, Offset
pce_13 = ModelPiece(Piece=dsn_7.Pieces)  # -> Piece, Id, TypeName, TypeVariant, Plane, ScreenPoint
rep_7 = ModelRepresentation(Representation=typ_9.Representations)  # -> Representation, Url, Mime, Lod, Tags
por_5 = ModelPort(Port=typ_9.Ports)  # -> Port, Id, Point, Direction, Locators
qal_3 = ModelQuality(Quality=typ_9.Qualities)  # -> Quality, Name, Value, Unit, Definition
loc_2 = ModelLocator(Locator=por_5.Locators)  # -> Locator, Group, Subgroup
item_2 = ListItem(List=trim_5, Index=0, Wrap=True)
panel_16 = Panel(rep_7.Lod)
dn = Design(item_2)
ty_20 = Type(trim_4)
dsn_8 = ModelDesign(Design=dn)  # -> Design, Name, Description, Icon, Variant, Unit, Pieces, Connections, Qualities
typ_10 = ModelType(Type=ty_20)  # -> Type, Name, Description, Icon, Variant, Unit, Representations, Ports, Qualities
trim_6 = TrimTree(Tree=dsn_8.Pieces, Depth=1)
trim_7 = TrimTree(Tree=dsn_8.Connections, Depth=1)
trim_8 = TrimTree(Tree=dn, Depth=1)

genes_3 = GenePool(Decimals=0, Maximum=8, Minimum=0, Value=[0, 0, 0, 0, 0, 0, 0, 0, 0])
genes_4 = GenePool(Decimals=0, Maximum=8, Minimum=0, Value=[6, 6, 6, 6, 6, 6, 6, 6, 6])
genes_5 = GenePool(Decimals=0, Maximum=8, Minimum=0, Value=[6, 0, 0, 6, 0, 3, 6, 6, 0])
genes_6 = GenePool(Decimals=0, Maximum=8, Minimum=0, Value=[0, 1, 2, 3, 4, 5, 6, 7, 8])

xy_2 = XYPlane(Origin=Point(0, 0, 0))
pce_14 = ModelPiece(Id="b", TypeName="Base", Plane=filter_3)  # -> Piece, Id, TypeName, TypeVariant, Plane, ScreenPoint
core = Panel("c")
bottom = Panel("b")
concat_4 = Concatenate(FragmentA=core, FragmentC="0")
concat_5 = Concatenate(FragmentA=core, FragmentC="1")
top = Panel("t")
neg = Negative(Value="-90")
neg_2 = Negative(Value="-9")
addition = Addition(A="-90", B=neg_2)
addition_2 = Addition(A="-90", B=neg_2)
filter_4 = StreamFilter(Gate=futuristic, Stream0="-90", Stream1=addition)
filter_5 = StreamFilter(Gate=futuristic, Stream0="-90", Stream1=addition_2)
neg_3 = Negative(Value=filter_4)

genes_7 = GenePool(Decimals=0, Maximum=8, Minimum=0, Value=[6, 0, 0, 0, 6, 6, 0, 6, 0, 6, 3])
genes_8 = GenePool(Decimals=0, Maximum=8, Minimum=0, Value=[0, 0, 0, 0, 0, 0, 0, 0, 0, 0, 0])
genes_9 = GenePool(Decimals=0, Maximum=8, Minimum=0, Value=[6, 6, 6, 6, 6, 6, 6, 6, 6, 6, 6])
genes_10 = GenePool(Decimals=0, Maximum=8, Minimum=0, Value=[8, 8, 8, 8, 8, 8, 8, 8, 8, 8, 8])
concat_6 = Concatenate(FragmentA="b", FragmentB="_", FragmentC=concat_5)
tower = Tower(
    number_of_floors="11",
    shaftpieceid=concat_6,
    capsulepatternnorthwest=genes_9,
    capsulepatternsoutheast=genes_10,
    capsulepatternsouthwest=genes_7,
    capsulepatternnortheast=genes_8,
    capsulerotation=capsule_rotation,
    capsuletilt=capsule_tilt,
    capsuleoffset=capsule_offset,
    tambourrotation=tambour_rotation,
    tambourtilt=tambour_tilt,
    tambouroffset=tambour_offset)  # -> pc_2, co_2, tambour_pc_2, tambour_co_2, first_tambour_id_2, last_tambour_id_2, capsule_pc_2, caspule_co_2

concat_7 = Concatenate(FragmentA="b", FragmentB="_", FragmentC=concat_4)
tower_2 = Tower(
    number_of_floors="9",
    shaftpieceid=concat_7,
    capsulepatternnorthwest=genes_3,
    capsulepatternsoutheast=genes_3,
    capsulepatternsouthwest=genes_3,
    capsulepatternnortheast=genes_3,
    capsulerotation=capsule_rotation,
    capsuletilt=capsule_tilt,
    capsuleoffset=capsule_offset,
    tambourrotation=tambour_rotation,
    tambourtilt=tambour_tilt,
    tambouroffset=tambour_offset)  # -> pc_2, co_2, tambour_pc_2, tambour_co_2, first_tambour_id_2, last_tambour_id_2, capsule_pc_2, caspule_co_2

concat_8 = Concatenate(FragmentD="ci", FragmentC="_", FragmentB=tower.last_tambour_id_2)
concat_9 = Concatenate(FragmentD="ci", FragmentC="_", FragmentB=tower_2.last_tambour_id_2)
pce_15 = ModelPiece(Id=concat_8, TypeName="Capital")  # -> Piece, Id, TypeName, TypeVariant, Plane, ScreenPoint
pce_16 = ModelPiece(Id=concat_9, TypeName="Capital")  # -> Piece, Id, TypeName, TypeVariant, Plane, ScreenPoint
con_7 = ModelConnection(
    ConnectedPieceId=pce_14.Id,
    ConnectedPieceTypePortId=concat_4,
    ConnectingPieceId=tower_2.first_tambour_id_2,
    ConnectingPieceTypePortId=bottom,
    Rotation=filter_5)  # -> Connection, ConnectedPieceId, ConnectedPieceTypePortId, ConnectingPieceId, ConnectingPieceTypePortId, Rotation, Tilt, Offset
con_8 = ModelConnection(
    ConnectedPieceId=pce_14.Id,
    ConnectedPieceTypePortId=concat_5,
    ConnectingPieceId=tower.first_tambour_id_2,
    ConnectingPieceTypePortId=bottom,
    Rotation=neg)  # -> Connection, ConnectedPieceId, ConnectedPieceTypePortId, ConnectingPieceId, ConnectingPieceTypePortId, Rotation, Tilt, Offset
con_9 = ModelConnection(ConnectedPieceId=tower.last_tambour_id_2, ConnectedPieceTypePortId=top, ConnectingPieceId=pce_15.Id, Rotation="-90")  # -> Connection, ConnectedPieceId, ConnectedPieceTypePortId, ConnectingPieceId, ConnectingPieceTypePortId, Rotation, Tilt, Offset
con_10 = ModelConnection(ConnectedPieceId=tower_2.last_tambour_id_2, ConnectedPieceTypePortId=top, ConnectingPieceId=pce_16.Id, Rotation=neg_3)  # -> Connection, ConnectedPieceId, ConnectedPieceTypePortId, ConnectingPieceId, ConnectingPieceTypePortId, Rotation, Tilt, Offset

merge_9 = Merge(Data1=pce_14.Piece, Data2=pce_16.Piece, Data3=pce_15.Piece)
merge_10 = Merge(Data1=con_7.Connection, Data2=con_8.Connection, Data3=con_10.Connection, Data4=con_9.Connection)
merge_11 = Merge(Data1=tower_2.pc_2, Data2=tower.pc_2)
merge_12 = Merge(Data1=tower_2.co_2, Data2=tower.co_2)
merge_13 = Merge(Data1=merge_10, Data2=merge_12)
merge_14 = Merge(Data1=merge_9, Data2=merge_11)
dsn_9 = ModelDesign(
    Name="Capsule Tower",
    Description="The first tower (nine storey) of the Nakagin Capule Tower.",
    Variant="9",
    Pieces=tower_2.pc_2,
    Connections=tower_2.co_2)  # -> Design, Name, Description, Icon, Variant, Unit, Pieces, Connections, Qualities
dsn_10 = ModelDesign(Name="Capsule Tower", Description=panel_8, Variant="11", Pieces=tower.pc_2, Connections=tower.co_2)  # -> Design, Name, Description, Icon, Variant, Unit, Pieces, Connections, Qualities
dsn_11 = ModelDesign(
    Name="Nakagin Capsule Tower",
    Description="The former Nakagin Capsule Tower from Tokyio.",
    Pieces=merge_14,
    Connections=merge_13)  # -> Design, Name, Description, Icon, Variant, Unit, Pieces, Connections, Qualities
trim_9 = TrimTree(Tree=dsn_9.Connections, Depth=1)
trim_10 = TrimTree(Tree=dsn_9.Pieces, Depth=1)
trim_11 = TrimTree(Tree=dsn_10.Connections, Depth=1)
trim_12 = TrimTree(Tree=dsn_10.Pieces, Depth=1)
addbridges = AddBridges(dn=dsn_11.Design, levels=genes_2)
split_2 = SplitList(List=trim_10, Index="1")  # -> ListA, ListB
split_3 = SplitList(List=trim_12, Index="1")  # -> ListA, ListB
trim_13 = TrimTree(Tree=split_2.ListB, Depth=1)
trim_14 = TrimTree(Tree=split_2.ListA, Depth=1)
trim_15 = TrimTree(Tree=split_3.ListA, Depth=1)
trim_16 = TrimTree(Tree=split_3.ListB, Depth=1)
pce_17 = ModelPiece(Piece=trim_14, Plane=filter_3)  # -> Piece, Id, TypeName, TypeVariant, Plane, ScreenPoint
pce_18 = ModelPiece(Piece=trim_15, Plane=move.Geometry)  # -> Piece, Id, TypeName, TypeVariant, Plane, ScreenPoint
merge_15 = Merge(Data1=pce_17.Piece, Data2=trim_13)
merge_16 = Merge(Data1=pce_18.Piece, Data2=trim_16)
merge_17 = Merge(Data1=merge_15, Data2=merge_16)
merge_18 = Merge(Data1=trim_9, Data2=trim_11)
dsn_12 = ModelDesign(Name="Capsule Tower", Pieces=merge_17, Connections=merge_18)  # -> Design, Name, Description, Icon, Variant, Unit, Pieces, Connections, Qualities
kit_11 = ModelKit(
    Name="Metabolism",
    Description="Everything for metabolistic architecture.",
    Url=concat_2,
    Homepage=concat_3,
    Types=merge_8,
    Designs=addbridges)  # -> Kit, Name, Description, Icon, Url, Homepage, Types, Designs
dsn_13 = ModelDesign(Design=addbridges)  # -> Design, Name, Description, Icon, Variant, Unit, Pieces, Connections, Qualities
kit_12 = CreateKit(Kit=kit_11.Kit, Uri=panel_12, Run=Toggle(False))
dsn_14 = PutDesign(Design=dsn_9.Design, Uri=panel_12, Run=Toggle(False))
dsn_15 = RemoveDesign(DesignName=dsn_13.Name, DesignVariant=dsn_13.Variant, Uri=panel_12, Run=Toggle(False))
kit_13 = SerializeKit(Kit=kit_11.Kit)

genes_11 = GenePool(Decimals=0, Maximum=8, Minimum=1, Value=[8, 8])
panel_17 = Panel("""sl2_d0
sl2_d1""")
panel_18 = Panel("""c1
c2""")
pce_19 = ModelPiece(Id="t", TypeName=filter, TypeVariant="First Storey", Plane=filter_3)  # -> Piece, Id, TypeName, TypeVariant, Plane, ScreenPoint
pce_20 = ModelPiece(Id=panel_18, TypeName=filter_2, TypeVariant=genes_11)  # -> Piece, Id, TypeName, TypeVariant, Plane, ScreenPoint
concat_10 = Concatenate(FragmentA=panel_17)
con_11 = ModelConnection(
    ConnectedPieceId=pce_19.Id,
    ConnectedPieceTypePortId=concat_10,
    ConnectingPieceId=pce_20.Id,
    Rotation=capsule_rotation,
    Tilt=capsule_tilt,
    Offset=capsule_offset)  # -> Connection, ConnectedPieceId, ConnectedPieceTypePortId, ConnectingPieceId, ConnectingPieceTypePortId, Rotation, Tilt, Offset

item_3 = ListItem(List=pce_20.Piece, Index=0, Wrap=True)  # -> Item, Item1
item_4 = ListItem(List=con_11.Connection, Index=0, Wrap=True)  # -> Item, Item1

merge_19 = Merge(Data1=pce_19.Piece, Data2=item_3.Item, Data3=item_3.Item1)
merge_20 = Merge(Data1=item_4.Item, Data2=item_4.Item1)
dsn_16 = ModelDesign(Name=filter_3, Variant="Y", Pieces=merge_19, Connections=merge_20)  # -> Design, Name, Description, Icon, Variant, Unit, Pieces, Connections, Qualities

filter_6 = StreamFilter(
    Gate=list,
    Stream0=addbridges,
    Stream1=dsn_12.Design,
    Stream2=dsn_9.Design,
    Stream3=dsn_10.Design,
    Stream4=dsn_5.Design,
    Stream5=dsn_2.Design,
    Stream6=dsn_16.Design,
    Stream7=dsn_3.Design)
rpltyp = ReplaceType(dn=filter_6, old_na="Tambour", new_na="Cylindric Tambour")
filter_7 = StreamFilter(Gate=cylindric_tambour, Stream0=filter_6, Stream1=rpltyp)
cluster = Cluster(dn=filter_7, ty=merge_8, mm=mime, lod="1to200", tags="volume")  # -> ur_2, plane_2
rep_8 = ReplaceText(Text=cluster.ur_2, Find="/", Replace=sep, RecursiveReplace=False)
item_5 = ListItem(List=cluster.plane_2, Index=0, Wrap=True)  # -> Item, Item1
pflip = FlipPlane(Plane=item_5.Item1, ReverseX=Toggle(False), ReverseY=False, SwapAxes=True)
replace = ReplaceItems(List=cluster.plane_2, Item=pflip, Indices="1", Wrap=False)
concat_11 = Concatenate(FragmentA=prefix, FragmentB=sep, FragmentC=rep_8)
trim_17 = TrimTree(Tree=replace, Depth=1)
fltdsn = FlattenDesign(Design=filter_7, Types=merge_8)
load_geometry = Geo(path=concat_11, pln=cluster.plane_2)
dsn_17 = SerializeDesign(Design=fltdsn)
geo = Geometry(load_geometry)
bbox = BoundingBox(Content=flatten(geo), Plane=PlaneXY(0, 0, 0), UnionBox=True)  # -> Box, Box_2
zoom2bb = ZoomToBoundingBox(N=panel, BB=bbox.Box, S=Slider(0, range=-2..2), R=Button())  # -> F, SBB; inputs BB: Box, R: Boolean
# ---------- zoom2bb: Python ----------
#Component Information
#--------------------------------------------------------------------------------------------
if ghenv.Component.RunCount<2:
    #General
    #--------------------------------------------------------------------------------------------
    __author__ = "Ueli Saluz"
    __version__ = "2022.05.21"
    
    ghenv.Component.Name = "ZoomToBoundingBox"
    ghenv.Component.NickName = "Zoom2BB"
    ghenv.Component.Description = "Zoom the view of a Rhino viewport to a bounding box."
    ghenv.Component.Message = "VER 1.0"
    ghenv.Component.Category = "Display"
    ghenv.Component.SubCategory = "Camera"
    
     #Inputs
    #--------------------------------------------------------------------------------------------
    inputIndex=0
    
    ghenv.Component.Params.Input[inputIndex].Name = "Name"
    ghenv.Component.Params.Input[inputIndex].NickName = "N"
    ghenv.Component.Params.Input[inputIndex].Description = "Name of the viewport"
    ghenv.Component.Params.Input[inputIndex].Optional = False
    inputIndex+=1
    
    ghenv.Component.Params.Input[inputIndex].Name = "BoundingBox"
    ghenv.Component.Params.Input[inputIndex].NickName = "BB"
    ghenv.Component.Params.Input[inputIndex].Description = ""
    ghenv.Component.Params.Input[inputIndex].Optional = False
    inputIndex+=1
    
    ghenv.Component.Params.Input[inputIndex].Name = "ScaleFactor"
    ghenv.Component.Params.Input[inputIndex].NickName = "S"
    ghenv.Component.Params.Input[inputIndex].Description = "A factor for the extension of the bounding box." \
    +"0 means 0 extension, a positive number makes the bounding box larger a negative smaller. The amount is proportional to the length."
    ghenv.Component.Params.Input[inputIndex].Optional = False
    inputIndex+=1
   
    
    ghenv.Component.Params.Input[inputIndex].Name = "Run"
    ghenv.Component.Params.Input[inputIndex].NickName = "R"
    ghenv.Component.Params.Input[inputIndex].Description = "Zoom to the given bounding box."
    ghenv.Component.Params.Input[inputIndex].Optional = False
    inputIndex+=1
    
    #Outputs
    #--------------------------------------------------------------------------------------------
    outputIndex=0
    
    ghenv.Component.Params.Output[outputIndex].Name = "Finished"
    ghenv.Component.Params.Output[outputIndex].NickName = "F"
    ghenv.Component.Params.Output[outputIndex].Description = "Sends True when finished. Just to trigger other depending components."
    outputIndex+=1
    
    ghenv.Component.Params.Output[outputIndex].Name = "ScaledBoundingBox"
    ghenv.Component.Params.Output[outputIndex].NickName = "SBB"
    ghenv.Component.Params.Output[outputIndex].Description = "The scaled bounding box."
    outputIndex+=1


#Imports
#--------------------------------------------------------------------------------------------
from Rhino import RhinoDoc
from Rhino.Geometry import Box

#Solver - Run with trees to enhance performance drastically
#--------------------------------------------------------------------------------------------
if __name__ == "__main__":
    
    vp = RhinoDoc.ActiveDoc.Views.Find(N, False).ActiveViewport
    if R:
        box = BB
        bb = BB.BoundingBox
        bb.Inflate(S*box.X.Length,S*box.Y.Length,S*box.Z.Length)
        vp.ZoomBoundingBox(bb)
        SBB = bb
    F = True
# ---------- end zoom2bb ----------
py3 = Python3Script(path=panel_15, content=dsn_17, run=Toggle(False))  # -> out; inputs path: String, content: String
# ---------- py3: Python ----------
if run:
    with open(path, 'w', encoding='utf-8') as f:
        f.write(content)
# ---------- end py3 ----------
semio_preview = SemioPrv(geo=flatten(geo))

# ==== cluster Tower
floor = Panel("f")
number_of_floors = ClusterInput()
shaftpieceid = ClusterInput()
capsulepatternnorthwest = ClusterInput()
capsulepatternsoutheast = ClusterInput()
capsulepatternsouthwest = ClusterInput()
capsulepatternnortheast = ClusterInput()
capsulerotation = ClusterInput()
capsuletilt = ClusterInput()
capsuleoffset = ClusterInput()
tambourrotation = ClusterInput()
tambourtilt = ClusterInput()
tambouroffset = ClusterInput()
diagramtambourstart = ClusterInput()
diagramcapsulestarts = ClusterInput()
diagramverticaldirection = ClusterInput()
panel = Panel("""0
0
1
0
1
0
2
3
3""")
panel_2 = Panel("""2
3
3
0
0
1
0
0
1""")
merge = Merge(Data1="1", Data2="3", Data3="5", Data4="7")
merge_2 = Merge(Data1="2", Data2="4", Data3="6", Data4="8")
split_level = Panel("sl")
door = Panel("d")
number_of_floors_2 = Integer(number_of_floors)
shaftpieceid_2 = Text(shaftpieceid)
capsulepatternnorthwest_2 = Integer(capsulepatternnorthwest)
item = ListItem(List=panel, Index=capsulepatternnorthwest_2, Wrap=True)
item_2 = ListItem(List=panel_2, Index=capsulepatternnorthwest_2, Wrap=True)
item_3 = ListItem(List=merge, Index=item, Wrap=True)
item_4 = ListItem(List=merge_2, Index=item_2, Wrap=True)
capsulepatternsoutheast_2 = Integer(capsulepatternsoutheast)
item_5 = ListItem(List=panel_2, Index=capsulepatternsoutheast_2, Wrap=True)
item_6 = ListItem(List=panel, Index=capsulepatternsoutheast_2, Wrap=True)
item_7 = ListItem(List=merge, Index=item_6, Wrap=True)
item_8 = ListItem(List=merge_2, Index=item_5, Wrap=True)
capsulepatternsouthwest_2 = Integer(capsulepatternsouthwest)
item_9 = ListItem(List=panel, Index=capsulepatternsouthwest_2, Wrap=True)
item_10 = ListItem(List=panel_2, Index=capsulepatternsouthwest_2, Wrap=True)
item_11 = ListItem(List=merge, Index=item_9, Wrap=True)
item_12 = ListItem(List=merge_2, Index=item_10, Wrap=True)
capsulepatternnortheast_2 = Integer(capsulepatternnortheast)
item_13 = ListItem(List=panel, Index=capsulepatternnortheast_2, Wrap=True)
item_14 = ListItem(List=panel_2, Index=capsulepatternnortheast_2, Wrap=True)
item_15 = ListItem(List=merge_2, Index=item_14, Wrap=True)
item_16 = ListItem(List=merge, Index=item_13, Wrap=True)
capsulerotation_2 = Number(capsulerotation)
capsuleoffset_2 = Number(capsuleoffset)
tambourrotation_2 = Number(tambourrotation)
tambourtilt_2 = Number(tambourtilt)
tambouroffset_2 = Number(tambouroffset)
diagramtambourstart_2 = ScreenPoint(diagramtambourstart)
model_screen_point = ModelScreenPoint(ScreenPoint=diagramtambourstart_2)  # -> ScreenPoint, X, Y
diagramcapsulestarts_2 = ScreenPoint(diagramcapsulestarts)
item_17 = ListItem(List=diagramcapsulestarts_2, Index=0, Wrap=True)  # -> Item, Item1, Item2, Item3, Item4, Item5, Item6, Item7
model_screen_point_2 = ModelScreenPoint(ScreenPoint=item_17.Item)  # -> ScreenPoint, X, Y
model_screen_point_3 = ModelScreenPoint(ScreenPoint=item_17.Item2)  # -> ScreenPoint, X, Y
model_screen_point_4 = ModelScreenPoint(ScreenPoint=item_17.Item4)  # -> ScreenPoint, X, Y
model_screen_point_5 = ModelScreenPoint(ScreenPoint=item_17.Item1)  # -> ScreenPoint, X, Y
model_screen_point_6 = ModelScreenPoint(ScreenPoint=item_17.Item6)  # -> ScreenPoint, X, Y
model_screen_point_7 = ModelScreenPoint(ScreenPoint=item_17.Item3)  # -> ScreenPoint, X, Y
model_screen_point_8 = ModelScreenPoint(ScreenPoint=item_17.Item5)  # -> ScreenPoint, X, Y
model_screen_point_9 = ModelScreenPoint(ScreenPoint=item_17.Item7)  # -> ScreenPoint, X, Y
diagramverticaldirection_2 = Integer(diagramverticaldirection)
series = Series(Start=model_screen_point.Y, Step=diagramverticaldirection_2, Count=number_of_floors_2)
series_2 = Series(Start=model_screen_point_2.Y, Step=diagramverticaldirection_2, Count=number_of_floors_2)
series_3 = Series(Start=model_screen_point_3.Y, Step=diagramverticaldirection_2, Count=number_of_floors_2)
series_4 = Series(Start=model_screen_point_4.Y, Step=diagramverticaldirection_2, Count=number_of_floors_2)
series_5 = Series(Start=model_screen_point_5.Y, Step=diagramverticaldirection_2, Count=number_of_floors_2)
series_6 = Series(Start=model_screen_point_6.Y, Step=diagramverticaldirection_2, Count=number_of_floors_2)
series_7 = Series(Start=model_screen_point_7.Y, Step=diagramverticaldirection_2, Count=number_of_floors_2)
series_8 = Series(Start=model_screen_point_8.Y, Step=diagramverticaldirection_2, Count=number_of_floors_2)
series_9 = Series(Start=model_screen_point_9.Y, Step=diagramverticaldirection_2, Count=number_of_floors_2)
trim = TrimTree(Tree=series, Depth=1)
trim_2 = TrimTree(Tree=series_2, Depth=1)
trim_3 = TrimTree(Tree=series_3, Depth=1)
trim_4 = TrimTree(Tree=series_4, Depth=1)
trim_5 = TrimTree(Tree=series_5, Depth=1)
trim_6 = TrimTree(Tree=series_6, Depth=1)
trim_7 = TrimTree(Tree=series_7, Depth=1)
trim_8 = TrimTree(Tree=series_8, Depth=1)
trim_9 = TrimTree(Tree=series_9, Depth=1)
rev = ReverseList(List=trim)
rev_2 = ReverseList(List=trim_2)
rev_3 = ReverseList(List=trim_3)
rev_4 = ReverseList(List=trim_4)
rev_5 = ReverseList(List=trim_5)
rev_6 = ReverseList(List=trim_7)
rev_7 = ReverseList(List=trim_6)
rev_8 = ReverseList(List=trim_8)
rev_9 = ReverseList(List=trim_9)
model_screen_point_10 = ModelScreenPoint(ScreenPoint=model_screen_point.ScreenPoint, Y=rev)  # -> ScreenPoint, X, Y
model_screen_point_11 = ModelScreenPoint(ScreenPoint=model_screen_point_2.ScreenPoint, Y=rev_2)  # -> ScreenPoint, X, Y
model_screen_point_12 = ModelScreenPoint(ScreenPoint=model_screen_point_3.ScreenPoint, Y=rev_3)  # -> ScreenPoint, X, Y
model_screen_point_13 = ModelScreenPoint(ScreenPoint=model_screen_point_4.ScreenPoint, Y=rev_4)  # -> ScreenPoint, X, Y
model_screen_point_14 = ModelScreenPoint(ScreenPoint=model_screen_point_5.ScreenPoint, Y=rev_5)  # -> ScreenPoint, X, Y
model_screen_point_15 = ModelScreenPoint(ScreenPoint=model_screen_point_6.ScreenPoint, Y=rev_7)  # -> ScreenPoint, X, Y
model_screen_point_16 = ModelScreenPoint(ScreenPoint=model_screen_point_7.ScreenPoint, Y=rev_6)  # -> ScreenPoint, X, Y
model_screen_point_17 = ModelScreenPoint(ScreenPoint=model_screen_point_8.ScreenPoint, Y=rev_8)  # -> ScreenPoint, X, Y
model_screen_point_18 = ModelScreenPoint(ScreenPoint=model_screen_point_9.ScreenPoint, Y=rev_9)  # -> ScreenPoint, X, Y
capsuletilt_2 = Number(capsuletilt)
bottom = Panel("b")
capsulevariantnorthright = Integer(item_15)
capsulevariantwestright = Integer(item_4)
capsulevariantsouthright = Integer(item_12)
capsulevariantsouthleft = Integer(item_7)
capsulevarianteastleft = Integer(item_16)
capsulevariantwestleft = Integer(item_11)
capsulevarianteastright = Integer(item_8)
capsulevariantnorthleft = Integer(item_3)
top = Panel("t")

series_10 = Series(Start=0, Step=1, Count=number_of_floors_2)
trim_10 = TrimTree(Tree=series_10, Depth=1)
concat = Concatenate(FragmentA=floor, FragmentB=trim_10)
concat_2 = Concatenate(FragmentD="t", FragmentE="_", FragmentA=concat, FragmentF="_", FragmentG=shaftpieceid_2)
lito3p = ListInto3Parts(ListToSlice=concat_2, StartIndex="1", EndIndex="-1")  # -> FilteredList, ItemsBefore, ItemsAfter; inputs ListToSlice: tree, StartIndex: tree of Int32, EndIndex: tree of Int32
# ---------- lito3p: Python ----------
if ghenv.Component.RunCount<2:
    __author__ = "Ueli Saluz"
    __version__ = "2020.05.28"
    
    ghenv.Component.Name = "ListInto3Parts"
    ghenv.Component.NickName = "LiTo3P"
    ghenv.Component.Description = "Slice list into 3 parts. All lists are sliced with the same indices. End index = 0 = length(list)."
    ghenv.Component.Message = "VER 1.6"

from System import Object
from Grasshopper import DataTree

def filterList(listToFilter,startIndex,endIndex):
    # Return: FilteredList, Before, After
    if (((startIndex == 0) or (startIndex is None)) and ((endIndex == 0) or (endIndex is None))) or (endIndex <= startIndex and endIndex > 0):
        return (listToFilter,None,None)
    elif (startIndex == 0) or (startIndex is None):
        return (listToFilter[:endIndex],None,listToFilter[endIndex:])
    elif (endIndex == 0) or (endIndex is None):
        print 1
        return (listToFilter[:startIndex],listToFilter[startIndex:],None)
    else:
        return (listToFilter[startIndex:endIndex],listToFilter[:startIndex],listToFilter[endIndex:])

if __name__ == "__main__":
    FilteredList = DataTree[Object]()
    ItemsBefore = DataTree[Object]()
    ItemsAfter = DataTree[Object]()
    
    for path in ListToSlice.Paths:
        listBranch = ListToSlice.Branch(path)
        pyList = list(listBranch)   #Convert .Net List to Python
        try: #terrible way of writing code but if I set the list to list access the performance decreases massivly due to many calls
            startIndex = StartIndex.Branch(path)
            startIndex = startIndex[0]
        except Exception:
            try:
                startIndex = StartIndex.Branch(0)
                startIndex = startIndex[0]
            except Exception:
                startIndex = 0
        try:
            endIndex = EndIndex.Branch(path)
            endIndex = endIndex[0]
        except Exception:
            try:
                endIndex = EndIndex.Branch(0)
                endIndex = endIndex[0]
            except Exception:
                endIndex = len(pyList)
        filtList=filterList(pyList,startIndex,endIndex)
        if filtList[0]:
            FilteredList.AddRange(filtList[0],path)
        if filtList[1]:
            ItemsBefore.AddRange(filtList[1],path)
        if filtList[2]:
            ItemsAfter.AddRange(filtList[2],path)
# ---------- end lito3p ----------
pce = ModelPiece(Id=lito3p.FilteredList, TypeName="Tambour")  # -> Piece, Id, TypeName, TypeVariant, RootPlane, DiagramScreenPoint
pce_2 = ModelPiece(Id=lito3p.ItemsBefore, TypeName="Tambour", TypeVariant="First Storey")  # -> Piece, Id, TypeName, TypeVariant, RootPlane, DiagramScreenPoint
expression = Expression(x=number_of_floors_2, Expression="x=1")
pce_3 = ModelPiece(Id=lito3p.ItemsAfter, TypeName="Tambour", TypeVariant="Last Storey")  # -> Piece, Id, TypeName, TypeVariant, RootPlane, DiagramScreenPoint
merge_3 = Merge(Data1=pce_2.Piece, Data2=pce.Piece, Data3=pce_3.Piece)
pce_4 = ModelPiece(Id=concat_2, TypeName="Tambour")  # -> Piece, Id, TypeName, TypeVariant, RootPlane, DiagramScreenPoint
filter = StreamFilter(Gate=expression, Stream0=merge_3, Stream1=pce_4.Id)
pce_5 = ModelPiece(Piece=filter, TypeName="Tambour", DiagramScreenPoint=model_screen_point_10.ScreenPoint)  # -> Piece, Id, TypeName, TypeVariant, RootPlane, DiagramScreenPoint
tambour_pc = Piece(pce_5.Piece)

concat_3 = Concatenate(FragmentA=split_level, FragmentB="0")
concat_4 = Concatenate(FragmentA=door, FragmentB="0")
concat_5 = Concatenate(FragmentA=concat_3, FragmentC="_", FragmentB=concat_4)
concat_6 = Concatenate(FragmentF="cs", FragmentA="_", FragmentD=concat_5, FragmentB="_", FragmentC=concat_2)
pce_6 = ModelPiece(
    Id=concat_6,
    TypeName="Capsule",
    TypeVariant=capsulevarianteastleft,
    DiagramScreenPoint=model_screen_point_11.ScreenPoint)  # -> Piece, Id, TypeName, TypeVariant, RootPlane, DiagramScreenPoint
con = ModelConnection(
    ConnectedPieceId=pce_5.Id,
    ConnectedPieceTypePortId=concat_5,
    ConnectingPieceId=pce_6.Id,
    Rotation=capsulerotation_2,
    Tilt=capsuletilt_2,
    Offset=capsuleoffset_2)  # -> Connection, ConnectedPieceId, ConnectedPieceTypePortId, ConnectingPieceId, ConnectingPieceTypePortId, Rotation, Tilt, Offset

concat_7 = Concatenate(FragmentA=door, FragmentB="1")
concat_8 = Concatenate(FragmentA=split_level, FragmentB="0")
concat_9 = Concatenate(FragmentA=concat_8, FragmentC="_", FragmentB=concat_7)
concat_10 = Concatenate(FragmentF="cs", FragmentA="_", FragmentD=concat_9, FragmentB="_", FragmentC=concat_2)
pce_7 = ModelPiece(
    Id=concat_10,
    TypeName="Capsule",
    TypeVariant=capsulevariantnorthright,
    DiagramScreenPoint=model_screen_point_11.ScreenPoint)  # -> Piece, Id, TypeName, TypeVariant, RootPlane, DiagramScreenPoint
con_2 = ModelConnection(
    ConnectedPieceId=pce_5.Id,
    ConnectedPieceTypePortId=concat_9,
    ConnectingPieceId=pce_7.Id,
    Rotation=capsulerotation_2,
    Tilt=capsuletilt_2,
    Offset=capsuleoffset_2)  # -> Connection, ConnectedPieceId, ConnectedPieceTypePortId, ConnectingPieceId, ConnectingPieceTypePortId, Rotation, Tilt, Offset

concat_11 = Concatenate(FragmentA=split_level, FragmentB="0")
concat_12 = Concatenate(FragmentA=door, FragmentB="2")
concat_13 = Concatenate(FragmentA=concat_11, FragmentC="_", FragmentB=concat_12)
concat_14 = Concatenate(FragmentF="cs", FragmentA="_", FragmentD=concat_13, FragmentB="_", FragmentC=concat_2)
pce_8 = ModelPiece(
    Id=concat_14,
    TypeName="Capsule",
    TypeVariant=capsulevariantnorthleft,
    DiagramScreenPoint=model_screen_point_11.ScreenPoint)  # -> Piece, Id, TypeName, TypeVariant, RootPlane, DiagramScreenPoint
con_3 = ModelConnection(
    ConnectedPieceId=pce_5.Id,
    ConnectedPieceTypePortId=concat_13,
    ConnectingPieceId=pce_8.Id,
    Rotation=capsulerotation_2,
    Tilt=capsuletilt_2,
    Offset=capsuleoffset_2)  # -> Connection, ConnectedPieceId, ConnectedPieceTypePortId, ConnectingPieceId, ConnectingPieceTypePortId, Rotation, Tilt, Offset

concat_15 = Concatenate(FragmentA=door, FragmentB="3")
concat_16 = Concatenate(FragmentA=split_level, FragmentB="0")
concat_17 = Concatenate(FragmentA=concat_16, FragmentC="_", FragmentB=concat_15)
concat_18 = Concatenate(FragmentF="cs", FragmentA="_", FragmentD=concat_17, FragmentB="_", FragmentC=concat_2)
pce_9 = ModelPiece(
    Id=concat_18,
    TypeName="Capsule",
    TypeVariant=capsulevariantwestright,
    DiagramScreenPoint=model_screen_point_11.ScreenPoint)  # -> Piece, Id, TypeName, TypeVariant, RootPlane, DiagramScreenPoint
con_4 = ModelConnection(
    ConnectedPieceId=pce_5.Id,
    ConnectedPieceTypePortId=concat_17,
    ConnectingPieceId=pce_9.Id,
    Rotation=capsulerotation_2,
    Tilt=capsuletilt_2,
    Offset=capsuleoffset_2)  # -> Connection, ConnectedPieceId, ConnectedPieceTypePortId, ConnectingPieceId, ConnectingPieceTypePortId, Rotation, Tilt, Offset

concat_19 = Concatenate(FragmentA=split_level, FragmentB="1")
concat_20 = Concatenate(FragmentA=door, FragmentB="0")
concat_21 = Concatenate(FragmentA=concat_19, FragmentC="_", FragmentB=concat_20)
concat_22 = Concatenate(FragmentF="cs", FragmentA="_", FragmentD=concat_21, FragmentB="_", FragmentC=concat_2)
pce_10 = ModelPiece(
    Id=concat_22,
    TypeName="Capsule",
    TypeVariant=capsulevariantwestleft,
    DiagramScreenPoint=model_screen_point_11.ScreenPoint)  # -> Piece, Id, TypeName, TypeVariant, RootPlane, DiagramScreenPoint
con_5 = ModelConnection(
    ConnectedPieceId=pce_5.Id,
    ConnectedPieceTypePortId=concat_21,
    ConnectingPieceId=pce_10.Id,
    Rotation=capsulerotation_2,
    Tilt=capsuletilt_2,
    Offset=capsuleoffset_2)  # -> Connection, ConnectedPieceId, ConnectedPieceTypePortId, ConnectingPieceId, ConnectingPieceTypePortId, Rotation, Tilt, Offset

concat_23 = Concatenate(FragmentA=door, FragmentB="1")
concat_24 = Concatenate(FragmentA=split_level, FragmentB="1")
concat_25 = Concatenate(FragmentA=concat_24, FragmentC="_", FragmentB=concat_23)
concat_26 = Concatenate(FragmentF="cs", FragmentA="_", FragmentD=concat_25, FragmentB="_", FragmentC=concat_2)
pce_11 = ModelPiece(
    Id=concat_26,
    TypeName="Capsule",
    TypeVariant=capsulevariantsouthright,
    DiagramScreenPoint=model_screen_point_11.ScreenPoint)  # -> Piece, Id, TypeName, TypeVariant, RootPlane, DiagramScreenPoint
con_6 = ModelConnection(
    ConnectedPieceId=pce_5.Id,
    ConnectedPieceTypePortId=concat_25,
    ConnectingPieceId=pce_11.Id,
    Rotation=capsulerotation_2,
    Tilt=capsuletilt_2,
    Offset=capsuleoffset_2)  # -> Connection, ConnectedPieceId, ConnectedPieceTypePortId, ConnectingPieceId, ConnectingPieceTypePortId, Rotation, Tilt, Offset

shift = ShiftList(List=pce_5.Id, Shift="-1", Wrap="F")
shift_2 = ShiftList(List=pce_5.Id, Shift=1, Wrap="F")
trim_11 = TrimTree(Tree=shift_2, Depth=1)
trim_12 = TrimTree(Tree=shift, Depth=1)
con_7 = ModelConnection(
    ConnectedPieceId=trim_12,
    ConnectedPieceTypePortId=top,
    ConnectingPieceId=trim_11,
    ConnectingPieceTypePortId=bottom,
    Rotation=tambourrotation_2,
    Tilt=tambourtilt_2,
    Offset=tambouroffset_2)  # -> Connection, ConnectedPieceId, ConnectedPieceTypePortId, ConnectingPieceId, ConnectingPieceTypePortId, Rotation, Tilt, Offset
filter_2 = StreamFilter(Gate=expression, Stream0=con_7.Connection)
tambour_co = Connection(filter_2)

item_18 = ListItem(List=tambour_pc, Index=0, Wrap=True)  # -> Item1, Item

concat_27 = Concatenate(FragmentA=split_level, FragmentB="2")
concat_28 = Concatenate(FragmentA=door, FragmentB="0")
concat_29 = Concatenate(FragmentA=concat_27, FragmentC="_", FragmentB=concat_28)
concat_30 = Concatenate(FragmentF="cs", FragmentA="_", FragmentD=concat_29, FragmentB="_", FragmentC=concat_2)
pce_12 = ModelPiece(
    Id=concat_30,
    TypeName="Capsule",
    TypeVariant=capsulevariantsouthleft,
    DiagramScreenPoint=model_screen_point_11.ScreenPoint)  # -> Piece, Id, TypeName, TypeVariant, RootPlane, DiagramScreenPoint
con_8 = ModelConnection(
    ConnectedPieceId=pce_5.Id,
    ConnectedPieceTypePortId=concat_29,
    ConnectingPieceId=pce_12.Id,
    Rotation=capsulerotation_2,
    Tilt=capsuletilt_2,
    Offset=capsuleoffset_2)  # -> Connection, ConnectedPieceId, ConnectedPieceTypePortId, ConnectingPieceId, ConnectingPieceTypePortId, Rotation, Tilt, Offset

concat_31 = Concatenate(FragmentA=split_level, FragmentB="2")
concat_32 = Concatenate(FragmentA=door, FragmentB="1")
concat_33 = Concatenate(FragmentA=concat_31, FragmentC="_", FragmentB=concat_32)
concat_34 = Concatenate(FragmentF="cs", FragmentA="_", FragmentD=concat_33, FragmentB="_", FragmentC=concat_2)
pce_13 = ModelPiece(
    Id=concat_34,
    TypeName="Capsule",
    TypeVariant=capsulevarianteastright,
    DiagramScreenPoint=model_screen_point_11.ScreenPoint)  # -> Piece, Id, TypeName, TypeVariant, RootPlane, DiagramScreenPoint
con_9 = ModelConnection(
    ConnectedPieceId=pce_5.Id,
    ConnectedPieceTypePortId=concat_33,
    ConnectingPieceId=pce_13.Id,
    Rotation=capsulerotation_2,
    Tilt=capsuletilt_2,
    Offset=capsuleoffset_2)  # -> Connection, ConnectedPieceId, ConnectedPieceTypePortId, ConnectingPieceId, ConnectingPieceTypePortId, Rotation, Tilt, Offset

merge_4 = Merge(
    Data1=pce_6.Piece,
    Data2=pce_7.Piece,
    Data3=pce_8.Piece,
    Data4=pce_9.Piece,
    Data5=pce_10.Piece,
    Data6=pce_11.Piece,
    Data7=pce_12.Piece,
    Data8=pce_13.Piece)
merge_5 = Merge(
    Data1=con.Connection,
    Data2=con_2.Connection,
    Data3=con_3.Connection,
    Data4=con_4.Connection,
    Data5=con_5.Connection,
    Data6=con_6.Connection,
    Data7=con_8.Connection,
    Data8=con_9.Connection)
capsule_pc = Piece(merge_4)
caspule_co = Connection(merge_5)
merge_6 = Merge(Data1=tambour_co, Data2=caspule_co)
merge_7 = Merge(Data1=tambour_pc, Data2=capsule_pc)
pce_14 = ModelPiece(Piece=item_18.Item)  # -> Piece, Id, TypeName, TypeVariant, RootPlane, DiagramScreenPoint
tambour_pc_2 = ClusterOutput(tambour_pc)
tambour_co_2 = ClusterOutput(tambour_co)
capsule_pc_2 = ClusterOutput(capsule_pc)
caspule_co_2 = ClusterOutput(caspule_co)
co = Connection(merge_6)
co_2 = ClusterOutput(co)
pc = Piece(merge_7)
pc_2 = ClusterOutput(pc)
pce_15 = ModelPiece(Piece=item_18.Item1)  # -> Piece, Id, TypeName, TypeVariant, RootPlane, DiagramScreenPoint
first_tambour_id = Text(pce_14.Id)
first_tambour_id_2 = ClusterOutput(first_tambour_id)
last_tambour_id = Text(pce_15.Id)
last_tambour_id_2 = ClusterOutput(last_tambour_id)

# ==== cluster AddBridges
dn = ClusterInput()
levels = ClusterInput()
dn_2 = Design(dn)
levels_2 = Integer(levels)
expression = Expression(x=levels_2, Expression="x-1")
concat = Concatenate(
    FragmentA="cs_",
    FragmentD="sl",
    FragmentH="0",
    FragmentI="_d",
    FragmentJ="1",
    FragmentB="_t_f",
    FragmentC=expression,
    FragmentE="_b_c",
    FragmentF="1")
concat_2 = Concatenate(
    FragmentA="cs_",
    FragmentD="sl",
    FragmentH="0",
    FragmentI="_d",
    FragmentJ="2",
    FragmentB="_t_f",
    FragmentC=expression,
    FragmentE="_b_c",
    FragmentF="0")
merge = Merge(Data1=concat_2, Data2=concat)
rmvpcedsn = RemovePiecesInDesign(dn=dn_2, ids=merge)  # -> dn_4, pc_2, co_2
dsn = ModelDesign(Design=rmvpcedsn.dn_4)  # -> Design, Name, Description, Icon, Variant, Unit, Pieces, Connections, Qualities
lng = ListLength(List=levels_2)
split = SplitList(List=rmvpcedsn.pc_2, Index=lng)  # -> ListA, ListB
split_2 = SplitList(List=rmvpcedsn.co_2, Index=lng)  # -> ListA, ListB
trim = TrimTree(Tree=dsn.Pieces, Depth=1)
trim_2 = TrimTree(Tree=dsn.Connections, Depth=1)
concat_3 = Concatenate(
    FragmentA="br_",
    FragmentD="sl",
    FragmentH="0",
    FragmentI="_d",
    FragmentJ="2",
    FragmentB="_t_f",
    FragmentC=expression,
    FragmentE="_b_c",
    FragmentF="0")
trim_3 = TrimTree(Tree=split.ListA, Depth=1)
trim_4 = TrimTree(Tree=split_2.ListA, Depth=1)
pce = ModelPiece(Piece=trim_3, Id=concat_3, TypeName="Bridge")  # -> Piece, Id, TypeName, TypeVariant, RootPlane, DiagramScreenPoint
con = ModelConnection(Connection=trim_4, ConnectingPieceId=pce.Id, ConnectingPieceTypePortId="e")  # -> Connection, ConnectedPieceId, ConnectedPieceTypePortId, ConnectingPieceId, ConnectingPieceTypePortId, Rotation, Tilt, Offset
merge_2 = Merge(Data1=trim_2, Data2=con.Connection)
merge_3 = Merge(Data1=trim, Data2=pce.Piece)
dsn_2 = ModelDesign(Design=dsn.Design, Pieces=merge_3, Connections=merge_2)  # -> Design, Name, Description, Icon, Variant, Unit, Pieces, Connections, Qualities
dn_3 = Design(dsn_2.Design)
dn_4 = ClusterOutput(dn_3)

# ==== cluster Geo
path = ClusterInput()
pln = ClusterInput()
path_2 = FilePath(path)

pln_2 = Plane(graft(pln))
cset = CreateSet(List=path_2)  # -> Set, Map
panel = Panel("*")
_3dm = Import3DM(File=graft(cset.Set), Layer="*", Name="*")
lng = ListLength(List=cset.Set)
expression = Expression(x=lng, Expression="x>1")
trim = TrimTree(Tree=_3dm, Depth=1)
filter = StreamFilter(Gate=expression, Stream0=_3dm, Stream1=trim)
tstat = TreeStatistics(Tree=filter)  # -> Paths, Length, Count
item = ListItem(List=tstat.Paths, Index=cset.Map, Wrap=True)
branch = TreeBranch(Tree=filter, Path=item, MaintainPaths=False)
match = MatchTree(Tree=branch, Guide=pln_2)
mtchanc = MatchAncestor(AT=pln_2, CT=graft(match))  # -> MAT; inputs AT: tree, CT: tree
# ---------- mtchanc: Python ----------
if ghenv.Component.RunCount<2:
    __author__ = "Ueli Saluz"
    __version__ = "2022.04.25"
    
    ghenv.Component.Name = "Match Ancestor"
    ghenv.Component.NickName = "MtchAnc"
    ghenv.Component.Description = "Duplicates all elements of an ancestor tree to match the amount of elements in the child tree."
    ghenv.Component.Message = "VER 1.1"
    
    ghenv.Component.Params.Input[0].Name = "AncestorTree"
    ghenv.Component.Params.Input[0].NickName = "AT"
    ghenv.Component.Params.Input[0].Description = "Ancestor tree that data will the duplicated until it matches the child tree"
    ghenv.Component.Params.Input[0].Optional = False
    
    ghenv.Component.Params.Input[1].Name = "ChildTree"
    ghenv.Component.Params.Input[1].NickName = "CT"
    ghenv.Component.Params.Input[1].Description = "Child tree that branches will the guide to duplicat the data of the ancestor tree"
    ghenv.Component.Params.Input[0].Optional = False
    
    ghenv.Component.Params.Output[0].Name = "MatchedAncestorTree"
    ghenv.Component.Params.Output[0].NickName = "MAT"
    ghenv.Component.Params.Output[0].Description = "Matched ancestor tree with the amount of items and the branch paths of the child tree"

from System import Object
from Grasshopper import DataTree

"""Returns a new tree with the ancestor data being duplicated along all child branches which where child paths of that ancestor.
    Inputs:
        ancestorTree: Ancestor tree that data will the duplicated until it matches the child tree
        childTree: Child tree that branches will the guide to duplicat the data of the ancestor tree
    Output:
        matchedAncestorTree: Matched ancestor tree with the amount of items and the branch paths of the child tree"""
def MatchAncestorTreeToChildTree (ancestorTree, childTree):
    
    matchedAncestorTree = DataTree[Object]()
    dummy = 0
    for i,pathAncestor in enumerate(ancestorTree.Paths):
        branch = ancestorTree.Branch(pathAncestor)
        if len(branch)!=1:
            raise Exception("Ancestor must be grafted and containing one item per branch")
        #The item to be duplicated
        item = branch[0]
        for j,pathChild in enumerate(childTree.Paths):
            #Returns a tuple and not like in the documentation described a bool with a pointer to the int to store the generations
            checkAncestor = pathChild.IsAncestor(pathAncestor,dummy)
            if(checkAncestor[0]):
                matchedAncestorTree.AddRange([item]*childTree.Branch(pathChild).Count,pathChild)
    return matchedAncestorTree

if __name__ == "__main__":
    MAT = MatchAncestorTreeToChildTree (AT,CT)
# ---------- end mtchanc ----------
trim_2 = TrimTree(Tree=mtchanc, Depth=1)
pl2pl = MoveObjectPlaneToPlane(G=match, S=PlaneXY(0, 0, 0), T=trim_2)  # -> TG, T; inputs S: Plane, T: Plane
# ---------- pl2pl: Python ----------
#Component Information
#--------------------------------------------------------------------------------------------
if ghenv.Component.RunCount<2:
    #General
    #--------------------------------------------------------------------------------------------
    __author__ = "Ueli Saluz"
    __version__ = "2023.02.12"
    
    ghenv.Component.Name = "MoveObjectPlaneToPlane"
    ghenv.Component.NickName = "Pl2Pl"
    ghenv.Component.Description = "Moves abitrary geometry from a source plane to a target plane."
    ghenv.Component.Message = "VER 1.2"
    ghenv.Component.Category = "Transform"
    ghenv.Component.SubCategory = "Euclidean"
    
     #Inputs
    #--------------------------------------------------------------------------------------------
    inputIndex=0
    
    ghenv.Component.Params.Input[inputIndex].Name = "Geometry"
    ghenv.Component.Params.Input[inputIndex].NickName = "G"
    ghenv.Component.Params.Input[inputIndex].Description = "Geometry to move."
    ghenv.Component.Params.Input[inputIndex].Optional = False
    inputIndex+=1
    
    ghenv.Component.Params.Input[inputIndex].Name = "SourcePlane"
    ghenv.Component.Params.Input[inputIndex].NickName = "S"
    ghenv.Component.Params.Input[inputIndex].Description = "Source plane of object."
    ghenv.Component.Params.Input[inputIndex].Optional = False
    inputIndex+=1
    
    ghenv.Component.Params.Input[inputIndex].Name = "TargetPlane"
    ghenv.Component.Params.Input[inputIndex].NickName = "T"
    ghenv.Component.Params.Input[inputIndex].Description = "Target plane of object."
    ghenv.Component.Params.Input[inputIndex].Optional = False
    inputIndex+=1
    
    #Outputs
    #--------------------------------------------------------------------------------------------
    outputIndex=0
    
    ghenv.Component.Params.Output[outputIndex].Name = "TranslatedGeometry"
    ghenv.Component.Params.Output[outputIndex].NickName = "TG"
    ghenv.Component.Params.Output[outputIndex].Description = "Translated geometry in target plane."
    outputIndex+=1
    
    ghenv.Component.Params.Output[outputIndex].Name = "Trasnform"
    ghenv.Component.Params.Output[outputIndex].NickName = "T"
    ghenv.Component.Params.Output[outputIndex].Description = "Transform describing translation form source to target plane."
    outputIndex+=1


#Imports
#--------------------------------------------------------------------------------------------
import Rhino.Geometry.Transform as trsf

def MvObjPlnToPln (geo,plnObj,plnDest):
    transform = trsf.PlaneToPlane(plnObj,plnDest)
    geo.Transform(transform)
    return (geo,transform)

TG, T = MvObjPlnToPln(G,S,T)
# ---------- end pl2pl ----------
geo = Geometry(pl2pl.TG)

geo_2 = ClusterOutput(geo)

# ==== cluster Cluster
ty = ClusterInput()
dn = ClusterInput()
mm = ClusterInput()
lod = ClusterInput()
tags = ClusterInput()
ty_2 = Type(ty)
mm_2 = Mime(mm)
tags_2 = Tags(tags)
dn_2 = Design(dn)
lod_2 = Lod(lod)
fltdsn = FlattenDesign(Design=dn_2, Type=ty_2)
dsn = ModelDesign(Design=fltdsn)  # -> Design, Name, Description, Icon, Variant, Unit, Pieces, Connections, Qualities
typ = ModelType(Type=ty_2)  # -> Type, Name, Description, Icon, Variant, Unit, Representations, Ports, Qualities
trim = TrimTree(Tree=dsn.Pieces, Depth=1)
tstat = TreeStatistics(Tree=typ.Representations)  # -> Paths, Length, Count
pce = ModelPiece(Piece=trim)  # -> Piece, Id, TypeName, TypeVariant, Plane, ScreenPoint
lng = ListLength(List=ty_2)
expression = Expression(x=graft(pce.TypeName), y=typ.Name, Expression="x=y")
expression_2 = Expression(x=graft(pce.TypeVariant), y=typ.Variant, Expression="x=y")
series = Series(Start=0, Step=1, Count=lng)
and = GateAnd(A=expression, B=expression_2)
trim_2 = TrimTree(Tree=series, Depth=1)
cull = CullPattern(List=ty_2, CullPattern=and)
txt = Text(cull)
txt_2 = Text(ty_2)
expression_3 = Expression(x=txt, y=txt_2, Expression="x=y")
cull_2 = CullPattern(List=trim_2, CullPattern=expression_3)
trim_3 = TrimTree(Tree=cull_2, Depth=1)
item = ListItem(List=tstat.Paths, Index=trim_3, Wrap=True)
branch = TreeBranch(Tree=typ.Representations, Path=item, MaintainPaths=False)
mrg_p = MergeSeperatlyPrepend(x=branch)  # -> Mrgd; inputs x: tree
# ---------- mrg_p: Python ----------
if ghenv.Component.RunCount<2:
    __author__ = "Ueli Saluz"
    __version__ = "2020.05.28"
    
    ghenv.Component.Name = "MergeSeperatly(Prepend)"
    ghenv.Component.NickName = "Mrg(P)"
    ghenv.Component.Description = "Merge inputs seperatly on a new path. Prepend index of input parameter for distincting."
    ghenv.Component.Message = "VER 1.0"

from System import Object
from Grasshopper import DataTree
from Grasshopper.Kernel import GH_ParamAccess as Access

if __name__ == "__main__":
    Mrgd = DataTree[Object]()
    access = Access()
    
    for input in ghenv.Component.Params.Input:  #set all Inputaccess to Tree Access
        input.Access = access.tree
    
    for i,input in enumerate(ghenv.Component.Params.Input):
        for j,source in enumerate(input.Sources):
            for path in source.VolatileData.Paths:
                Mrgd.AddRange(source.VolatileData[path],path.PrependElement(i))
# ---------- end mrg_p ----------
rep = ModelRepresentation(Representation=mrg_p)  # -> Representation, Url, Mime, Lod, Tags
expression_4 = Expression(x=rep.Mime, y=mm_2, Expression="x=y")
cull_3 = CullPattern(List=rep.Representation, CullPattern=expression_4)
rep_2 = ModelRepresentation(Representation=cull_3)  # -> Representation, Url, Mime, Lod, Tags
expression_5 = Expression(x=rep_2.Lod, y=lod_2, Expression="x=y")
cull_4 = CullPattern(List=rep_2.Representation, CullPattern=expression_5)
trim_4 = TrimTree(Tree=cull_4, Depth=1)
rep_3 = ModelRepresentation(Representation=trim_4)  # -> Representation, Url, Mime, Lod, Tags
plane = Plane(pce.Plane)
ur = Url(rep_3.Url)
plane_2 = ClusterOutput(plane)
ur_2 = ClusterOutput(ur)

# ==== cluster LinearConnections: Create an array of linear connections where the connecting port is always connecting to the connected port.
pc = ClusterInput()
cdpo = ClusterInput()
cgpo = ClusterInput()
rotation = ClusterInput()
tilt = ClusterInput()
offset = ClusterInput()
pc_2 = Piece(pc)
rotation_2 = Rotation(rotation)
tilt_2 = Tilt(tilt)
offset_2 = Offset(offset)
cdpo_2 = ConnectedPieceTypePortId(cdpo)
cgpo_2 = ConnectingPieceTypePortId(cgpo)
shift = ShiftList(List=pc_2, Shift=1, Wrap=invert(True))
shift_2 = ShiftList(List=pc_2, Shift="-1", Wrap=invert(True))
trim = TrimTree(Tree=shift, Depth=1)
trim_2 = TrimTree(Tree=shift_2, Depth=1)
pce = ModelPiece(Piece=trim)  # -> Piece, Id, TypeName, TypeVariant, RootPlane, DiagramScreenPoint
pce_2 = ModelPiece(Piece=trim_2)  # -> Piece, Id, TypeName, TypeVariant, RootPlane, DiagramScreenPoint
con = ModelConnection(
    ConnectedPieceId=pce_2.Id,
    ConnectedPieceTypePortId=cdpo_2,
    ConnectingPieceId=pce.Id,
    ConnectingPieceTypePortId=cgpo_2,
    Rotation=rotation_2,
    Tilt=tilt_2,
    Offset=offset_2)  # -> Connection, ConnectedPieceId, ConnectedPieceTypePortId, ConnectingPieceId, ConnectingPieceTypePortId, Rotation, Tilt, Offset
co = Connection(con.Connection)
co_2 = ClusterOutput(co)

# ==== cluster SemioPrv: semio styled preview of geometry.
geo = ClusterInput()
geo_2 = Geometry(flatten(geo))
debrep = DeconstructBrep(Brep=geo_2)  # -> Faces, Edges, Vertices
preview = CustomPreview(Geometry=flatten(debrep.Edges), Material=ColourSwatch(SwatchColor=RGB(0, 0, 0)))
preview_2 = CustomPreview(Geometry=flatten(geo_2), Material=ColourSwatch(SwatchColor=RGB(255, 255, 255)))

# ==== cluster ReplaceType: Replace a type (name) in a design. All variants stay the same and must exist in the new type.
new_na = ClusterInput()
dn = ClusterInput()
old_na = ClusterInput()
new_na_2 = Text(new_na)
dn_2 = Design(dn)
old_na_2 = Text(old_na)
dsn = ModelDesign(Design=dn_2)  # -> Design, Name, Description, Icon, Variant, Unit, Pieces, Connections, Qualities
trim = TrimTree(Tree=dsn.Pieces, Depth=1)
lng = ListLength(List=trim)
pce = ModelPiece(Piece=trim)  # -> Piece, Id, TypeName, TypeVariant, RootPlane, DiagramScreenPoint
series = Series(Start=0, Step=1, Count=lng)
expression = Expression(x=pce.TypeName, y=old_na_2, Expression="x=y")
trim_2 = TrimTree(Tree=series, Depth=1)
dispatch = Dispatch(List=pce.Piece, DispatchPattern=expression)  # -> ListA, ListB
dispatch_2 = Dispatch(List=trim_2, DispatchPattern=expression)  # -> ListA, ListB
pce_2 = ModelPiece(Piece=dispatch.ListA, TypeName=new_na_2)  # -> Piece, Id, TypeName, TypeVariant, RootPlane, DiagramScreenPoint
replace = ReplaceItems(List=trim, Item=pce_2.Piece, Indices=dispatch_2.ListA, Wrap=False)
trim_3 = TrimTree(Tree=replace, Depth=1)
dsn_2 = ModelDesign(Design=dsn.Design, Pieces=trim_3)  # -> Design, Name, Description, Icon, Variant, Unit, Pieces, Connections, Qualities
dn_3 = Design(dsn_2.Design)
dn_4 = ClusterOutput(dn_3)

# ==== cluster RemovePiecesInDesign: Delete all pieces (and all associated connections) from a design.
dn = ClusterInput()
ids = ClusterInput()
dn_2 = Design(dn)
ids_2 = Text(ids)
dsn = ModelDesign(Design=dn_2)  # -> Design, Name, Description, Icon, Variant, Unit, Pieces, Connections, Qualities

trim = TrimTree(Tree=dsn.Pieces, Depth=1)
pce = ModelPiece(Piece=trim)  # -> Piece, Id, TypeName, TypeVariant, RootPlane, DiagramScreenPoint
expression = Expression(x=graft(pce.Id), y=ids_2, Expression="x=y")
ma = MassAddition(Input=expression)  # -> Result, PartialResults
trim_2 = TrimTree(Tree=ma.Result, Depth=1)
dispatch = Dispatch(List=trim, DispatchPattern=trim_2)  # -> ListA, ListB

trim_3 = TrimTree(Tree=dsn.Connections, Depth=1)
con = ModelConnection(Connection=trim_3)  # -> Connection, ConnectedPieceId, ConnectedPieceTypePortId, ConnectingPieceId, ConnectingPieceTypePortId, Rotation, Tilt, Offset
expression_2 = Expression(x=graft(con.ConnectingPieceId), y=ids_2, Expression="x=y")
expression_3 = Expression(x=graft(con.ConnectedPieceId), y=ids_2, Expression="x=y")
ma_2 = MassAddition(Input=expression_2)  # -> Result, PartialResults
ma_3 = MassAddition(Input=expression_3)  # -> Result, PartialResults
or = GateOr(A=ma_3.Result, B=ma_2.Result)
trim_4 = TrimTree(Tree=or, Depth=1)
dispatch_2 = Dispatch(List=trim_3, DispatchPattern=trim_4)  # -> ListA, ListB

dsn_2 = ModelDesign(Design=dsn.Design, Pieces=dispatch.ListB, Connections=dispatch_2.ListB)  # -> Design, Name, Description, Icon, Variant, Unit, Pieces, Connections, Qualities
dn_3 = Design(dsn_2.Design)
pc = Piece(dispatch.ListA)
co = Connection(dispatch_2.ListA)
dn_4 = ClusterOutput(dn_3)
pc_2 = ClusterOutput(pc)
co_2 = ClusterOutput(co)
