# Grasshopper definition bridge.gh (Grasshopper 1.0.7)
# plug-ins: Semio

# Outputs ->
number_slider = Slider(0.5, range=0..1)
genes = GenePool(Decimals=0, Maximum=100, Minimum=0, Value=70)
# Parameters:
number_slider_2 = Slider(300, range=0..1000)
number_slider_3 = Slider(359, range=0..1000)
pt = ConstructPoint(XCoordinate=0, YCoordinate=0, ZCoordinate=Slider(300, range=0..1000))
pt_2 = ConstructPoint(
    XCoordinate=Slider(84, range=-1000..1000),
    YCoordinate=Slider(51, range=-1000..1000),
    ZCoordinate=Slider(125, range=-1000..1000))
panel = Panel("Right")
connection_ports = GetString("Left", AtLeast=0, AtMost=1, TreeAccess=False)
connection_bias_u = GetNumber(number_slider, AtLeast=1, AtMost=1, Maximum=1.797693135e+308, Minimum=-1.797693135e+308, TreeAccess=False)
connection_point = GetPoint(AtLeast=0, AtMost=1, Realtime=True, TreeAccess=False)
connection_bias_gap = GetNumber(Slider(5, range=0..100), AtLeast=0, AtMost=1, Maximum=1.797693135e+308, Minimum=-1.797693135e+308, TreeAccess=False)
platformheight = GetNumber(Slider(20, range=0..100), AtLeast=1, AtMost=1, Maximum=1.797693135e+308, Minimum=-1.797693135e+308, TreeAccess=False)
# External
#      |
#      v
leftlength = GetNumber(number_slider_2, AtLeast=1, AtMost=1, Maximum=1.797693135e+308, Minimum=-1.797693135e+308, TreeAccess=False)
rightlength = GetNumber(number_slider_2, AtLeast=1, AtMost=1, Maximum=1.797693135e+308, Minimum=-1.797693135e+308, TreeAccess=False)
gap = GetNumber(Slider(25, range=0..100), AtLeast=1, AtMost=1, Maximum=1.797693135e+308, Minimum=-1.797693135e+308, TreeAccess=False)
width = GetNumber(Slider(250, range=0..1000), AtLeast=1, AtMost=1, Maximum=1.797693135e+308, Minimum=-1.797693135e+308, TreeAccess=False)
height = GetNumber(Slider(250, range=0..1000), AtLeast=1, AtMost=1, Maximum=1.797693135e+308, Minimum=-1.797693135e+308, TreeAccess=False)
primaryframediameter = GetNumber(Slider(10, range=0..100), AtLeast=1, AtMost=1, Maximum=1.797693135e+308, Minimum=-1.797693135e+308, TreeAccess=False)
secondaryframediameter = GetNumber(Slider(8, range=0..100), AtLeast=1, AtMost=1, Maximum=1.797693135e+308, Minimum=-1.797693135e+308, TreeAccess=False)
tertiaryframediameter = GetNumber(Slider(6, range=0..100), AtLeast=1, AtMost=1, Maximum=1.797693135e+308, Minimum=-1.797693135e+308, TreeAccess=False)
parapetheight = GetNumber(Slider(125, range=0..1000), AtLeast=1, AtMost=1, Maximum=1.797693135e+308, Minimum=-1.797693135e+308, TreeAccess=False)
parapetsegmentsheight = GetNumber(genes, AtLeast=1, AtMost=1, Maximum=1.797693135e+308, Minimum=-1.797693135e+308, TreeAccess=False)
leftaddition = GetBoolean(Toggle(True), AtLeast=1, AtMost=1, FalseValue="False", TreeAccess=False, TrueValue="True")
rightaddition = GetBoolean(Toggle(False), AtLeast=1, AtMost=1, FalseValue="False", TreeAccess=False, TrueValue="True")
additionlength = GetNumber(Slider(250, range=0..1000), AtLeast=1, AtMost=1, Maximum=1.797693135e+308, Minimum=-1.797693135e+308, TreeAccess=False)
additionwidth = GetNumber(Slider(125, range=0..1000), AtLeast=1, AtMost=1, Maximum=1.797693135e+308, Minimum=-1.797693135e+308, TreeAccess=False)
addition = Addition(A=leftlength, B=gap)
# Local ->
neg = Negative(Value=width)
neg_2 = Negative(Value=width)
addition_2 = Addition(A=leftlength, B=gap)
addition_3 = Addition(A=leftlength, B=rightlength, C=gap)
expression = Expression(x=width, Expression="x/2")
cluster = Cluster(
    length=leftlength,
    width=width,
    height=height,
    parapetheight=parapetheight,
    parapetsegmentsheight=parapetsegmentsheight,
    addition=leftaddition,
    additionlength=additionlength,
    additionwidth=additionwidth,
    rodprimarydiameter=primaryframediameter,
    rodsecondarydiameter=secondaryframediameter,
    rodtertiarydiameter=tertiaryframediameter)  # -> volume_2, volumeside_2, rods_2, base_2
cluster_2 = Cluster(
    length=rightlength,
    width=width,
    height=height,
    parapetheight=parapetheight,
    parapetsegmentsheight=parapetsegmentsheight,
    addition=rightaddition,
    additionlength=additionlength,
    additionwidth=additionwidth,
    rodprimarydiameter=primaryframediameter,
    rodsecondarydiameter=secondaryframediameter,
    rodtertiarydiameter=tertiaryframediameter)  # -> volume_2, volumeside_2, rods_2, base_2
contains = Contains(L=connection_ports, I="Left")  # -> R; inputs L: list, I: list
# ---------- contains: Python ----------
#Component Information
#--------------------------------------------------------------------------------------------
if ghenv.Component.RunCount<2:
    #General
    #--------------------------------------------------------------------------------------------
    __author__ = "Ueli Saluz"
    __version__ = "2023.02.04"
    
    ghenv.Component.Name = "Contains"
    ghenv.Component.NickName = "Contains"
    ghenv.Component.Description = "True if list contains one of the items."
    ghenv.Component.Message = "VER 1.0"
    ghenv.Component.Category = "Set"
    ghenv.Component.SubCategory = "List"
    
     #Inputs
    #--------------------------------------------------------------------------------------------
    inputIndex=0
    
    ghenv.Component.Params.Input[inputIndex].Name = "List"
    ghenv.Component.Params.Input[inputIndex].NickName = "L"
    ghenv.Component.Params.Input[inputIndex].Description = ""
    ghenv.Component.Params.Input[inputIndex].Optional = False
    inputIndex+=1
    
    ghenv.Component.Params.Input[inputIndex].Name = "Items"
    ghenv.Component.Params.Input[inputIndex].NickName = "I"
    ghenv.Component.Params.Input[inputIndex].Description = ""
    ghenv.Component.Params.Input[inputIndex].Optional = False
    inputIndex+=1
    
    #Outputs
    #--------------------------------------------------------------------------------------------
    outputIndex=0
    
    ghenv.Component.Params.Output[outputIndex].Name = "Contains"
    ghenv.Component.Params.Output[outputIndex].NickName = "R"
    ghenv.Component.Params.Output[outputIndex].Description = ""
    outputIndex+=1

R = False
for i in I:
    if i in L:
        R = True
# ---------- end contains ----------
contains_2 = Contains(L=connection_ports, I="Right")  # -> R; inputs L: list, I: list; same code as contains
dom = ConstructDomain(DomainStart=addition_2, DomainEnd=addition_3)
valueor0 = ValueOr0(value=contains)
valueor0_2 = ValueOr0(value=contains_2)
neg_3 = Negative(Value=expression)
box = DomainBox(Base=PlaneXY(0, 0, 0), X=addition_3, Y=neg, Z=height)
box_2 = DomainBox(Base=PlaneXY(0, 0, 0), X=dom, Y=neg, Z=height)
Y = UnitY(Factor=neg_3)
xy = XYPlane(Origin=Point(0, 0, 0))
X = UnitX(Factor=rightlength)
volumemain = Box(box)
volumeright = Box(box_2)
area = Area(Geometry=cluster_2.volume_2)  # -> Area, Centroid
neg_4 = Negative(Value=platformheight)
dom_2 = ConstructDomain(DomainStart=leftlength, DomainEnd=addition)
sunion = SolidUnion(Breps=cluster_2.rods_2)
move = Move(Geometry=xy, Motion=Y)  # -> Geometry, Transform
yz = YZPlane(Origin=area.Centroid)
Z = UnitZ(Factor=neg_4)
rectangle = Rectangle(Plane=PlaneXY(0, 0, 0), XSize=dom_2, YSize=neg_2, Radius=0)  # -> Rectangle, Length
mirror = Mirror(Geometry=sunion, Plane=yz)  # -> Geometry, Transform
mirror_2 = Mirror(Geometry=cluster_2.base_2, Plane=yz)  # -> Geometry, Transform
extr = Extrude(Base=cluster.base_2, Direction=Z)
X_2 = UnitX(Factor=addition)
addition_4 = Addition(A=X_2, B=X)
move_2 = Move(Geometry=move.Geometry, Motion=addition_4)  # -> Geometry, Transform
srf = Surface(rectangle.Rectangle)
rotate = Rotate(Geometry=move_2.Geometry, Angle=degrees("180"), Plane=move_2.Geometry)  # -> Geometry, Transform
filter = StreamFilter(Gate=valueor0_2, Stream0=move.Geometry, Stream1=rotate.Geometry)
filter_2 = StreamFilter(Gate=valueor0, Stream0=filter, Stream1=move.Geometry)
move_3 = Move(Geometry=mirror.Geometry, Motion=X_2)  # -> Geometry, Transform
move_4 = Move(Geometry=mirror_2.Geometry, Motion=X_2)  # -> Geometry, Transform
merge = Merge(Data1=cluster.rods_2, Data2=extr)
null = NullItem(Item=filter_2)  # -> NullFlags, InvalidFlags, Description
filter_3 = StreamFilter(Gate=null.NullFlags, Stream0=filter_2, Stream1=move.Geometry)
extr_2 = Extrude(Base=move_4.Geometry, Direction=Z)
sunion_2 = SolidUnion(Breps=merge)
merge_2 = Merge(Data1=move_3.Geometry, Data2=extr_2)
pt_3 = Point(filter_3)
sunion_3 = SolidUnion(Breps=merge_2)
merge_3 = Merge(Data1=sunion_2, Data2=sunion_3)
brep = Brep(merge_3)
merge_4 = Merge(Data1=srf, Data2=brep)
geo = Geometry(merge_4)
serialize = Serialize(Input=geo)
representation = ConstructRepresentation(Body=serialize, Concepts="All")
merge_5 = Merge(Data1=representation)
connection_point_2 = Point(pt_3)
compress = Compress(Input=merge_5)
representations = Text(compress)
context_bake = ContextBake(CONNECTIONPOINT=connection_point_2)
context_print = ContextPrint(REPRESENTATIONS=representations)
rods = Brep(cluster.rods_2)

# ==== cluster ValueOr0
value = ClusterInput()
value_2 = Number(value)
null = NullItem(Item=value_2)  # -> NullFlags, InvalidFlags, Description
filter = StreamFilter(Gate=null.NullFlags, Stream0=value_2, Stream1="0")
valueor0 = Number(filter)
valueor0_2 = ClusterOutput(valueor0)

# ==== cluster Cluster
length = ClusterInput()
width = ClusterInput()
height = ClusterInput()
parapetheight = ClusterInput()
parapetsegmentsheight = ClusterInput()
additionlength = ClusterInput()
additionwidth = ClusterInput()
rodprimarydiameter = ClusterInput()
rodsecondarydiameter = ClusterInput()
rodtertiarydiameter = ClusterInput()
addition = ClusterInput()
width_2 = Number(width)
parapetheight_2 = Number(parapetheight)
additionwidth_2 = Number(additionwidth)
rodprimarydiameter_2 = Number(rodprimarydiameter)
length_2 = Number(length)
height_2 = Number(height)
parapetsegmentsheight_2 = Number(parapetsegmentsheight)
addition_2 = Boolean(addition)
additionlength_2 = Number(additionlength)
rodsecondarydiameter_2 = Number(rodsecondarydiameter)
rodtertiarydiameter_2 = Number(rodtertiarydiameter)
neg = Negative(Value=width_2)
addition_3 = Addition(A=width_2, B=additionlength_2)
expression = Expression(x=rodprimarydiameter_2, Expression="x*Sqrt(2)")
expression_2 = Expression(x=rodprimarydiameter_2, Expression="x/2")
expression_3 = Expression(x=rodsecondarydiameter_2, Expression="x/2")
neg_2 = Negative(Value=addition_3)
neg_3 = Negative(Value=expression_2)
subtraction = Subtraction(A=additionwidth_2, B=expression_2, C=expression_3)
addition_4 = Addition(A=expression_2, B=length_2)
addition_5 = Addition(A=neg, B=rodprimarydiameter_2)
addition_6 = Addition(A=neg_2, B=expression_2, C=expression_3)
expression_4 = Expression(x=neg, y=expression_2, Expression="x+2*y")
subtraction_2 = Subtraction(A=height_2, B=expression)
expression_5 = Expression(x=addition_4, y=expression_2, Expression="x-2*y")

dom = ConstructDomain(DomainStart=neg_3, DomainEnd=expression_4)
dom_2 = ConstructDomain(DomainStart=expression_2, DomainEnd=expression_5)
dom_3 = ConstructDomain(DomainStart=neg, DomainEnd=neg_2)
dom_4 = ConstructDomain(DomainStart=addition_5, DomainEnd=addition_6)
dom_5 = ConstructDomain(DomainStart=expression_2, DomainEnd=subtraction)
box = DomainBox(Base=PlaneXY(0, 0, 0), X=length_2, Y=neg, Z=height_2)
box_2 = DomainBox(Base=PlaneXY(0, 0, 0), X=dom_2, Y=dom, Z=subtraction_2)
box_3 = DomainBox(Base=PlaneXY(0, 0, 0), X=additionwidth_2, Y=dom_3, Z=height_2)
box_4 = DomainBox(Base=PlaneXY(0, 0, 0), X=dom_5, Y=dom_4, Z=subtraction_2)
volumesideinner = Box(box_4)
volumeinner = Box(box_2)
volumeside = Box(box_3)
volume = Box(box)

volumeinner_2 = Box(box_2)
volume_2 = ClusterOutput(volume)
volumeside_2 = ClusterOutput(volumeside)

debrep = DeconstructBrep(Brep=volumeside)  # -> Faces, Edges, Vertices
debrep_2 = DeconstructBrep(Brep=volume)  # -> Faces, Edges, Vertices
trim = TrimTree(Tree=debrep.Faces, Depth=1)
trim_2 = TrimTree(Tree=debrep_2.Faces, Depth=1)
trim_3 = TrimTree(Tree=debrep_2.Vertices, Depth=1)
item = ListItem(List=trim, Index=0, Wrap=True)  # -> Item2, Item1, Item
item_2 = ListItem(List=trim_2, Index=0, Wrap=True)  # -> Item2, Item1, Item
item_3 = ListItem(List=trim_3, Index=0, Wrap=True)
merge = Merge(Data1=item_2.Item2, Data2=item.Item2)
join = BrepJoin(Breps=merge)  # -> Breps, Closed
fmerge = MergeFaces(Brep=join.Breps)  # -> Breps, Before, After
filter = StreamFilter(Gate=addition_2, Stream0=item_2.Item2, Stream1=fmerge.Breps)
base = Brep(filter)

debrep_3 = DeconstructBrep(Brep=volumesideinner)  # -> Faces, Edges, Vertices
debrep_4 = DeconstructBrep(Brep=volumeinner)  # -> Faces, Edges, Vertices
trim_4 = TrimTree(Tree=debrep_3.Faces, Depth=1)
trim_5 = TrimTree(Tree=debrep_3.Vertices, Depth=1)
trim_6 = TrimTree(Tree=debrep_4.Faces, Depth=1)
trim_7 = TrimTree(Tree=debrep_4.Vertices, Depth=1)
trim_8 = TrimTree(Tree=debrep_4.Edges, Depth=1)
item_4 = ListItem(List=trim_4, Index=0, Wrap=True)  # -> Item2, Item1, Item
item_5 = ListItem(List=trim_5, Index=0, Wrap=True)  # -> Item, Item1, Item2
item_6 = ListItem(List=trim_6, Index=0, Wrap=True)  # -> Item2, Item1, Item
item_7 = ListItem(List=trim_8, Index=0, Wrap=True)  # -> Item, Item1, Item2, Item3, Item4, Item5, Item6, Item7
item_8 = ListItem(List=trim_7, Index=0, Wrap=True)  # -> Item, Item1, Item2
merge_2 = Merge(Data1=item_6.Item2, Data2=item_4.Item2)
join_2 = BrepJoin(Breps=merge_2)  # -> Breps, Closed
fmerge_2 = MergeFaces(Brep=join_2.Breps)  # -> Breps, Before, After
baseleft = Brep(fmerge_2.Breps)

base_2 = ClusterOutput(base)
explode = Explode(Curve=baseleft, Recursive=True)  # -> Segments, Vertices
trim_9 = TrimTree(Tree=explode.Segments, Depth=1)
rodcaptype = Integer(Slider(1, range=0..2))

rodmainprimarydiameter = Number(rodprimarydiameter_2)
area = Area(Geometry=volumeinner_2)  # -> Area, Centroid
debrep_5 = DeconstructBrep(Brep=volumeinner_2)  # -> Faces, Edges, Vertices
trim_10 = TrimTree(Tree=debrep_5.Vertices, Depth=1)
trim_11 = TrimTree(Tree=debrep_5.Edges, Depth=1)
item_9 = ListItem(List=trim_10, Index=0, Wrap=True)  # -> Item1, Item, Item1_2, Item2, Item3, Item4
item_10 = ListItem(List=trim_11, Index=0, Wrap=True)  # -> Item4, Item3, Item2, Item1, Item
ln = Line(StartPoint=item_9.Item1, EndPoint=item_9.Item2)
ln_2 = Line(StartPoint=item_9.Item4, EndPoint=item_9.Item1_2)
merge_3 = Merge(Data1=item_10.Item1, Data2=ln)
merge_4 = Merge(Data1=item_10.Item4, Data2=ln_2)
join_3 = JoinCurves(Curves=merge_3, Preserve=False)
join_4 = JoinCurves(Curves=merge_4, Preserve=False)
trim_12 = TrimTree(Tree=join_3, Depth=1)
trim_13 = TrimTree(Tree=join_4, Depth=1)
expression_6 = Expression(x=rodmainprimarydiameter, Expression="x/2")
merge_5 = Merge(Data1=trim_12, Data2=trim_13)
pipe = Pipe(Curve=merge_5, Radius=expression_6, Caps=rodcaptype)
trim_14 = TrimTree(Tree=pipe, Depth=1)
mainframe = Brep(trim_14)

intermediateposts = Integer(Slider(1, range=0..10))
item_11 = ListItem(List=trim_9, Index=0, Wrap=True)  # -> Item1, Item, Item1_2, Item2
expression_7 = Expression(x=intermediateposts, Expression="x+1")
divide = DivideCurve(Curve=item_11.Item1_2, Count=expression_7, Kinks=False)  # -> Points, Tangents, Parameters
crv_cp = CurveClosestPoint(Point=item_8.Item, Curve=item_11.Item1)  # -> Point, Parameter, Distance
divide_2 = DivideCurve(Curve=item_7.Item2, Count=expression_7, Kinks=False)  # -> Points, Tangents, Parameters
trim_15 = TrimTree(Tree=divide.Points, Depth=1)
shatter = Shatter(Curve=item_11.Item1, Parameters=crv_cp.Parameter)
trim_16 = TrimTree(Tree=divide_2.Points, Depth=1)
lito3p = ListInto3Parts(ListToSlice=trim_15, StartIndex="1", EndIndex="-1")  # -> FilteredList, ItemsBefore, ItemsAfter; inputs ListToSlice: tree, StartIndex: tree of Int32, EndIndex: tree of Int32
# ---------- lito3p: Python ----------
if ghenv.Component.RunCount<2:
    __author__ = "Ueli Saluz"
    __version__ = "2020.05.28"
    
    ghenv.Component.Name = "ListInto3Parts"
    ghenv.Component.NickName = "LiTo3P"
    ghenv.Component.Description = "Slice list into 3 parts. All lists are sliced with the same indices. End index = 0 = length(list)."
    ghenv.Component.Message = "VER 1.6"

from System import Object
from Grasshopper import DataTree

def filterList(listToFilter,startIndex,endIndex):
    # Return: FilteredList, Before, After
    if (((startIndex == 0) or (startIndex is None)) and ((endIndex == 0) or (endIndex is None))) or (endIndex <= startIndex and endIndex > 0):
        return (listToFilter,None,None)
    elif (startIndex == 0) or (startIndex is None):
        return (listToFilter[:endIndex],None,listToFilter[endIndex:])
    elif (endIndex == 0) or (endIndex is None):
        print 1
        return (listToFilter[:startIndex],listToFilter[startIndex:],None)
    else:
        return (listToFilter[startIndex:endIndex],listToFilter[:startIndex],listToFilter[endIndex:])

if __name__ == "__main__":
    FilteredList = DataTree[Object]()
    ItemsBefore = DataTree[Object]()
    ItemsAfter = DataTree[Object]()
    
    for path in ListToSlice.Paths:
        listBranch = ListToSlice.Branch(path)
        pyList = list(listBranch)   #Convert .Net List to Python
        try: #terrible way of writing code but if I set the list to list access the performance decreases massivly due to many calls
            startIndex = StartIndex.Branch(path)
            startIndex = startIndex[0]
        except Exception:
            try:
                startIndex = StartIndex.Branch(0)
                startIndex = startIndex[0]
            except Exception:
                startIndex = 0
        try:
            endIndex = EndIndex.Branch(path)
            endIndex = endIndex[0]
        except Exception:
            try:
                endIndex = EndIndex.Branch(0)
                endIndex = endIndex[0]
            except Exception:
                endIndex = len(pyList)
        filtList=filterList(pyList,startIndex,endIndex)
        if filtList[0]:
            FilteredList.AddRange(filtList[0],path)
        if filtList[1]:
            ItemsBefore.AddRange(filtList[1],path)
        if filtList[2]:
            ItemsAfter.AddRange(filtList[2],path)
# ---------- end lito3p ----------
trim_17 = TrimTree(Tree=shatter, Depth=1)
lito3p_2 = ListInto3Parts(ListToSlice=trim_16, StartIndex="1", EndIndex="-1")  # -> FilteredList, ItemsBefore, ItemsAfter; inputs ListToSlice: tree, StartIndex: tree of Int32, EndIndex: tree of Int32; same code as lito3p
item_12 = ListItem(List=trim_17, Index=0, Wrap=True)  # -> Item, Item1
divide_3 = DivideCurve(Curve=item_12.Item1, Count=expression_7, Kinks=False)  # -> Points, Tangents, Parameters
trim_18 = TrimTree(Tree=divide_3.Points, Depth=1)
lito3p_3 = ListInto3Parts(ListToSlice=trim_18, StartIndex="1", EndIndex="-1")  # -> FilteredList, ItemsBefore, ItemsAfter; inputs ListToSlice: tree, StartIndex: tree of Int32, EndIndex: tree of Int32; same code as lito3p
divide_4 = DivideCurve(Curve=item_7.Item, Count=expression_7, Kinks=False)  # -> Points, Tangents, Parameters
trim_19 = TrimTree(Tree=divide_4.Points, Depth=1)
merge_6 = Merge(
    Data1=lito3p_3.FilteredList,
    Data2=item_5.Item,
    Data3=item_5.Item1,
    Data4=lito3p.FilteredList,
    Data5=item_5.Item2,
    Data6=item_9.Item1_2)
merge_7 = Merge(Data1=item_12.Item1, Data2=item_11.Item, Data3=item_11.Item1_2, Data4=item_11.Item2)
Z = UnitZ(Factor=parapetheight_2)
lito3p_4 = ListInto3Parts(ListToSlice=trim_19, StartIndex="1", EndIndex=-1)  # -> FilteredList, ItemsBefore, ItemsAfter; inputs ListToSlice: tree, StartIndex: tree of Int32, EndIndex: tree of Int32; same code as lito3p
line = LineSDL(Start=merge_6, Direction=Z, Length=parapetheight_2)
join_5 = JoinCurves(Curves=merge_7, Preserve=False)
move = Move(Geometry=item_7.Item2, Motion=Z)  # -> Geometry, Transform
line_2 = LineSDL(Start=item_8.Item2, Direction=Z, Length=parapetheight_2)
trim_20 = TrimTree(Tree=join_5, Depth=1)
lito3p_5 = ListInto3Parts(ListToSlice=line, EndIndex="-1")  # -> FilteredList, ItemsBefore, ItemsAfter; inputs ListToSlice: tree, StartIndex: tree of Int32, EndIndex: tree of Int32; same code as lito3p
merge_8 = Merge(Data1=move.Geometry, Data2=line_2)
line_3 = LineSDL(Start=lito3p_2.FilteredList, Direction=Z, Length=parapetheight_2)
Z_2 = UnitZ(Factor=parapetsegmentsheight_2)
move_2 = Move(Geometry=trim_20, Motion=Z)  # -> Geometry, Transform
line_4 = LineSDL(Start=lito3p_4.FilteredList, Direction=Z, Length=parapetheight_2)
line_5 = LineSDL(Start=lito3p_4.ItemsAfter, Direction=Z, Length=parapetheight_2)
join_6 = JoinCurves(Curves=merge_8, Preserve=False)
move_3 = Move(Geometry=trim_20, Motion=Z_2)  # -> Geometry, Transform
merge_9 = Merge(Data1=move_2.Geometry, Data2=lito3p_5.ItemsAfter)
trim_21 = TrimTree(Tree=join_6, Depth=1)
move_4 = Move(Geometry=item_7.Item2, Motion=Z_2)  # -> Geometry, Transform
move_5 = Move(Geometry=item_7.Item, Motion=Z)  # -> Geometry, Transform
join_7 = JoinCurves(Curves=merge_9, Preserve=False)
merge_10 = Merge(Data1=move_5.Geometry, Data2=line_5)
pipe_2 = Pipe(Curve=item_7.Item7, Radius=expression_6, Caps=rodcaptype)
expression_8 = Expression(x=rodtertiarydiameter_2, Expression="x/2")
pipe_3 = Pipe(Curve=line_3, Radius=expression_8, Caps=rodcaptype)
expression_9 = Expression(x=rodsecondarydiameter_2, Expression="x/2")
pipe_4 = Pipe(Curve=trim_21, Radius=expression_9, Caps=rodcaptype)
expression_10 = Expression(x=rodtertiarydiameter_2, Expression="x/2")
pipe_5 = Pipe(Curve=move_3.Geometry, Radius=expression_10, Caps=rodcaptype)
pipe_6 = Pipe(Curve=move_4.Geometry, Radius=expression_10, Caps=rodcaptype)
trim_22 = TrimTree(Tree=join_7, Depth=1)
trim_23 = TrimTree(Tree=pipe_5, Depth=1)
trim_24 = TrimTree(Tree=pipe_3, Depth=1)
trim_25 = TrimTree(Tree=pipe_4, Depth=1)
trim_26 = TrimTree(Tree=pipe_2, Depth=1)
trim_27 = TrimTree(Tree=pipe_6, Depth=1)
join_8 = JoinCurves(Curves=merge_10, Preserve=False)
pipe_7 = Pipe(Curve=trim_22, Radius=expression_9, Caps=rodcaptype)
pipe_8 = Pipe(Curve=lito3p_5.FilteredList, Radius=expression_8, Caps=rodcaptype)
pipe_9 = Pipe(Curve=lito3p_5.FilteredList, Radius=expression_10, Caps=rodcaptype)
railsecondarysupplement = Brep(trim_23)
railsecondaryposts = Brep(trim_24)
move_6 = Move(Geometry=item_7.Item, Motion=Z_2)  # -> Geometry, Transform
trim_28 = TrimTree(Tree=join_8, Depth=1)
primaryrail = Brep(trim_25)
railsecondarysupplement_2 = Brep(trim_27)
trim_29 = TrimTree(Tree=pipe_7, Depth=1)
primarybar = Brep(trim_26)
trim_30 = TrimTree(Tree=pipe_8, Depth=1)
trim_31 = TrimTree(Tree=pipe_9, Depth=1)
pipe_10 = Pipe(Curve=trim_28, Radius=expression_9, Caps=rodcaptype)
pipe_11 = Pipe(Curve=line_4, Radius=expression_8, Caps=rodcaptype)
pipe_12 = Pipe(Curve=move_6.Geometry, Radius=expression_10, Caps=rodcaptype)
primaryrail_2 = Brep(trim_29)
railsecondary = Brep(trim_30)
railsecondaryposts_2 = Brep(trim_31)
merge_11 = Merge(Data1=primaryrail, Data2=railsecondaryposts, Data3=railsecondarysupplement_2)
trim_32 = TrimTree(Tree=pipe_10, Depth=1)
trim_33 = TrimTree(Tree=pipe_11, Depth=1)
trim_34 = TrimTree(Tree=pipe_12, Depth=1)
merge_12 = Merge(Data1=primarybar, Data2=mainframe)
merge_13 = Merge(Data1=primaryrail_2, Data2=railsecondary, Data3=railsecondaryposts_2, Data4=railsecondarysupplement)
railsecondarysupplement_3 = Brep(trim_34)
railsecondaryposts_3 = Brep(trim_33)
primaryrail_3 = Brep(trim_32)
merge_14 = Merge(Data1=primaryrail_3, Data2=railsecondaryposts_3, Data3=railsecondarysupplement_3)
filter_2 = StreamFilter(Gate=addition_2, Stream0=merge_14, Stream1=merge_13)
merge_15 = Merge(Data1=merge_12, Data2=merge_11, Data3=filter_2)
rods = Brep(merge_15)
rods_2 = ClusterOutput(rods)
