# Grasshopper definition helloworld.gh (Grasshopper 1.0.7)
# plug-ins: semio

parameter = ConstructParameter(Name="Text", Value="World")
plan = ConstructPlan(Parameters=parameter)  # -> Plan, Hash

# ---- group: Hello
sobject = ConstructSobject()

# ----
sobject_2 = ConstructSobject(Plan=plan.Plan)
layout = ConstructLayout()
layout_design = LayoutDesign(Url="https://localhost:2999", Run=False)
