# Grasshopper definition capital.gh (Grasshopper 1.0.7)
# plug-ins: semio, eleFront

number_slider = Slider(550, range=0..1000)
list = ValueList({"north east", "south east", "south west", "north west"}, selected="north west")
panel = Panel("""north east
south east
south west
north west""")
# ^
#                  |
# Preview    ->
# Parameters:
safe = Button()
# External
#       |
#       v
peak = GetString(list, AtLeast=1, AtMost=1, TreeAccess=False)
itemindex = ItemIndex(L=panel, I=peak)  # -> i; inputs L: list
# ---------- itemindex: Python ----------
#Component Information
#--------------------------------------------------------------------------------------------
if ghenv.Component.RunCount<2:
    #General
    #--------------------------------------------------------------------------------------------
    __author__ = "Ueli Saluz"
    __version__ = "2022.11.18"
    
    ghenv.Component.Name = "ItemIndex"
    ghenv.Component.NickName = "ItemIndex"
    ghenv.Component.Description = "A better IdemIndex"
    ghenv.Component.Message = "VER 1.0"
    ghenv.Component.Category = "Set"
    ghenv.Component.SubCategory = "List"
    
     #Inputs
    #--------------------------------------------------------------------------------------------
    inputIndex=0
    
    ghenv.Component.Params.Input[inputIndex].Name = "List"
    ghenv.Component.Params.Input[inputIndex].NickName = "L"
    ghenv.Component.Params.Input[inputIndex].Description = "Input1 is..."
    ghenv.Component.Params.Input[inputIndex].Optional = False
    inputIndex+=1
    
    ghenv.Component.Params.Input[inputIndex].Name = "Item"
    ghenv.Component.Params.Input[inputIndex].NickName = "I"
    ghenv.Component.Params.Input[inputIndex].Description = "Input2 is..."
    ghenv.Component.Params.Input[inputIndex].Optional = False
    inputIndex+=1
    
    #Outputs
    #--------------------------------------------------------------------------------------------
    outputIndex=0
    
    ghenv.Component.Params.Output[outputIndex].Name = "Index"
    ghenv.Component.Params.Output[outputIndex].NickName = "i"
    ghenv.Component.Params.Output[outputIndex].Description = "Output1 is..."
    outputIndex+=1

i = L.index(I)
# ---------- end itemindex ----------
length = GetNumber(number_slider, AtLeast=1, AtMost=1, Maximum=1.797693135e+308, Minimum=-1.797693135e+308, TreeAccess=False)
lowerheight = GetNumber(Slider(100, range=0..100), AtLeast=1, AtMost=1, Maximum=1.797693135e+308, Minimum=-1.797693135e+308, TreeAccess=False)
width = GetNumber(number_slider, AtLeast=1, AtMost=1, Maximum=1.797693135e+308, Minimum=-1.797693135e+308, TreeAccess=False)
wallthickness = GetNumber(Slider(30, range=0..100), AtLeast=1, AtMost=1, Maximum=1.797693135e+308, Minimum=-1.797693135e+308, TreeAccess=False)
height = GetNumber(Slider(1150, range=0..10000), AtLeast=1, AtMost=1, Maximum=1.797693135e+308, Minimum=-1.797693135e+308, TreeAccess=False)
sideheight = GetNumber(Slider(550, range=0..1000), AtLeast=1, AtMost=1, Maximum=1.797693135e+308, Minimum=-1.797693135e+308, TreeAccess=False)
valueor0 = ValueOr0(value=itemindex)
expression = Expression(x=length, Expression="x/100")
expression_2 = Expression(x=width, Expression="x/100")
expression_3 = Expression(x=height, Expression="x/100")
expression_4 = Expression(x=sideheight, Expression="x/100")
expression_5 = Expression(x=lowerheight, Expression="x/100")
expression_6 = Expression(x=wallthickness, Expression="x/100")

# ----
# Outputs   ->
#                 |
#                 v
panel_2 = Panel("south west")
merge = Merge(
    Data1=panel_2,
    Data2=expression,
    Data3=expression_2,
    Data4=expression_2,
    Data5=expression_4,
    Data6=expression_5,
    Data7=expression_6)
panel_3 = Panel("""peak
length
width
height
height side
height low
wall thickness""")
panel_4 = Panel(merge)
panel_5 = Panel("""m
m
m
m
m
m""")
qlt = ModelQuality(Name=panel_3, Value=panel_4, Unit=panel_5)  # -> Quality, Name, Value, Unit

xy = XYPlane(Origin=Point(0, 0, 0))

curdir = CurrentDirectory()  # -> D, P, S
# ---------- curdir: Python ----------
#Component Information
#--------------------------------------------------------------------------------------------
if ghenv.Component.RunCount<2:
    #General
    #--------------------------------------------------------------------------------------------
    __author__ = "Ueli Saluz"
    __version__ = "2023.09.29"
    
    ghenv.Component.Name = "CurrentDirectory"
    ghenv.Component.NickName = "CurDir"
    ghenv.Component.Description = "Current directory of the current grasshopper file."
    ghenv.Component.Message = "VER 1.0"
    ghenv.Component.Category = "Params"
    ghenv.Component.SubCategory = "Util"
    
    #Outputs
    #--------------------------------------------------------------------------------------------
    outputIndex=0
    
    ghenv.Component.Params.Output[outputIndex].Name = "Directory"
    ghenv.Component.Params.Output[outputIndex].NickName = "D"
    ghenv.Component.Params.Output[outputIndex].Description = "Directory of the current grasshopper file."
    outputIndex+=1
    
    ghenv.Component.Params.Output[outputIndex].Name = "Path"
    ghenv.Component.Params.Output[outputIndex].NickName = "P"
    ghenv.Component.Params.Output[outputIndex].Description = "Path of the current grasshopper file."
    outputIndex+=1
    
    ghenv.Component.Params.Output[outputIndex].Name = "Separator"
    ghenv.Component.Params.Output[outputIndex].NickName = "S"
    ghenv.Component.Params.Output[outputIndex].Description = "Separator of the current system."
    outputIndex+=1

#Imports
#--------------------------------------------------------------------------------------------
from os.path import dirname
from os import sep

#Solver - Run with trees to enhance performance drastically
#--------------------------------------------------------------------------------------------
if __name__ == "__main__":
    P = ghenv.Component.OnPingDocument().FilePath
    D = dirname(P)
    S = sep
# ---------- end curdir ----------
concat = Concatenate(FragmentC="representations", FragmentD=curdir.S, FragmentA="capital")
concat_2 = Concatenate(FragmentA=concat, FragmentB="_", FragmentE="1to500", FragmentG="_", FragmentF="volume")
concat_3 = Concatenate(FragmentA=concat, FragmentB="_", FragmentE="1to200", FragmentG="_", FragmentF="volume")
concat_4 = Concatenate(FragmentA=concat, FragmentB=".glb")
concat_5 = Concatenate(FragmentA=concat_2, FragmentB=".3dm")
concat_6 = Concatenate(FragmentA=concat_3, FragmentB=".3dm")
rep = ModelRepresentation(Url=concat_4)  # -> Representation, Url, LevelOfDetail, Tags
rep_2 = ModelRepresentation(Url=concat_5, LevelOfDetail="1to500", Tags="volume")  # -> Representation, Url, LevelOfDetail, Tags
rep_3 = ModelRepresentation(Url=concat_6, LevelOfDetail="1to200", Tags="volume")  # -> Representation, Url, LevelOfDetail, Tags

_2d = _2D(x=expression_2)
_2d_2 = _2D(x=expression)
subtraction = Subtraction(A=expression_3, B=expression_5)
Z = UnitZ(Factor=expression_3)
rectangle = Rectangle(Plane=xy, XSize=_2d_2, YSize=_2d, Radius=0)  # -> Rectangle, Length
merge_2 = Merge(Data1="0", Data2=expression_4, Data3=subtraction, Data4=expression_4)
move = Move(Geometry=rectangle.Rectangle, Motion=Z)  # -> Geometry, Transform
debrep = DeconstructBrep(Brep=move.Geometry)  # -> Faces, Edges, Vertices
rulesrf = RuledSurface(CurveA=rectangle.Rectangle, CurveB=move.Geometry)
neg = Negative(Value=merge_2)
Z_2 = UnitZ(Factor=neg)
cap = CapHoles(Brep=rulesrf)
trim = TrimTree(Tree=debrep.Vertices, Depth=1)
move_2 = Move(Geometry=trim, Motion=Z_2)  # -> Geometry, Transform
item = ListItem(List=move_2.Geometry, Index=0, Wrap=True)  # -> Item, Item1, Item2, Item3
srf4pt = _4PointSurface(CornerA=item.Item, CornerB=item.Item1, CornerC=item.Item2, CornerD=item.Item3)

# ----
# Local ->
neg_2 = Negative(Value=expression_6)
offset = OffsetCurve(Curve=move.Geometry, Distance=neg_2, Corners=1)
trim_2 = TrimTree(Tree=offset, Depth=1)
Z_3 = UnitZ(Factor=expression_3)
rulesrf_2 = RuledSurface(CurveA=move.Geometry, CurveB=trim_2)
rev = Reverse(Vector=Z_3)
extr = Extrude(Base=rulesrf_2, Direction=rev)

por = ModelPort(Plane=xy, Specifiers="bottom")  # -> Port, Plane, Specifiers

merge_3 = Merge(Data1=rep.Representation, Data2=rep_2.Representation, Data3=rep_3.Representation)
typ = ModelType(
    Name="Capital",
    Description="An efficient core with many doors.",
    Icon="🎓",
    Representations=merge_3,
    Ports=por.Port,
    Qualities=qlt.Quality)  # -> Type, Name, Description, Icon, Variant, Unit, Representations, Ports, Qualities
typ_2 = RemoveType(TypeName=typ.Name, TypeVariant=typ.Variant, Run=safe)
or = GateOr(A=safe, B=typ_2)
typ_3 = AddType(Type=typ.Type, Run=or)

split = SplitBrep(Brep=srf4pt, Cutter=extr)
split_2 = SplitBrep(Brep=extr, Cutter=srf4pt)
item_2 = ListItem(List=split, Index=0, Wrap=True)  # -> Item, Item1
item_3 = ListItem(List=split_2, Index=0, Wrap=True)  # -> Item, Item1
merge_4 = Merge(Data1=item_2.Item, Data2=item_3.Item1)
join = BrepJoin(Breps=merge_4)  # -> Breps, Closed
trim_3 = TrimTree(Tree=join.Breps, Depth=1)
panel_6 = Panel("""180
90
0
270""")
item_4 = ListItem(List=panel_6, Index=valueor0, Wrap=True)
rotate = Rotate(Geometry=trim_3, Angle=degrees(item_4), Plane=PlaneXY(0, 0, 0))  # -> Geometry, Transform
capital1to200 = Brep(rotate.Geometry)

split_3 = SplitBrep(Brep=cap, Cutter=srf4pt)
item_5 = ListItem(List=split_3, Index=0, Wrap=True)  # -> Item, Item1
capex = CapHolesEx(Brep=item_5.Item1)  # -> Brep, Caps, Solid
transform = Transform(Geometry=capex.Brep, Transform=rotate.Transform)
capital1to500 = Brep(transform)

expression_7 = Expression(x="volume", y=capital1to500, Expression="x")
ef_layer = EleFrontLayer(FullPath=expression_7)  # -> Layer, FullPath, Hidden, Locked, DisplayColour, MaterialName, Linetype, PrintColour, PrintWidth
concat_7 = Concatenate(FragmentA=curdir.D, FragmentB=curdir.S, FragmentC=rep_2.Url)
concat_8 = Concatenate(FragmentA=curdir.D, FragmentB=curdir.S, FragmentC=rep_3.Url)
ef_att = EleFrontAttributes(Layer=ef_layer.Layer)  # -> Attributes, Keys, Values, Name, Layer, ColourSource, DisplayColour, MaterialSource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
merge_5 = Merge(Data1=capital1to200)
merge_6 = Merge(Data1=ef_att.Attributes)
merge_7 = Merge(Data1=capital1to500)
merge_8 = Merge(Data1=ef_att.Attributes)
baketofile = BakeObjectsToFile(
    FilePath=concat_7,
    Geometry=merge_7,
    Attributes=merge_8,
    Bake=safe,
    networkMode=False,
    ValueTable_networkMode=True,
    overwriteMode="Overwrite",
    preset="Safest")
baketofile_2 = BakeObjectsToFile(
    FilePath=concat_8,
    Geometry=merge_5,
    Attributes=merge_6,
    Bake=safe,
    networkMode=False,
    ValueTable_networkMode=True,
    overwriteMode="Overwrite",
    preset="Safest")

typ_4 = SerializeType(Type=typ.Type)
type = Text(typ_4)
context_bake = ContextBake(Geometry=type)

# ==== cluster _2D
x = ClusterInput()
expression = Expression(x=x, Expression="x/2")
neg = Negative(Value=expression)
dom = ConstructDomain(DomainStart=neg, DomainEnd=expression)
I = ClusterOutput(dom)

# ==== cluster ValueOr0
value = ClusterInput()
value_2 = Number(value)
null = NullItem(Item=value_2)  # -> NullFlags, InvalidFlags, Description
filter = StreamFilter(Gate=null.NullFlags, Stream0=value_2, Stream1="0")
valueor0 = Number(filter)
valueor0_2 = ClusterOutput(valueor0)
