# Grasshopper definition capsule-speckle.gh (Grasshopper 1.0.7)
# plug-ins: Speckle 2

# https://app.speckle.systems/explorer
# 
# {
#   activeUser {
#     projects {
#       items {
#         models {
#           items {
#             id
#             name
#           }
#         }
#       }
#     }
#   }
# }
curdir = CurrentDirectory()  # -> PD, D, P, S
# ---------- curdir: Python ----------
# Component Information
# --------------------------------------------------------------------------------------------
if ghenv.Component.RunCount < 2:
    # General
    # --------------------------------------------------------------------------------------------
    __author__ = "Ueli Saluz"
    __version__ = "2024.07.26"

    ghenv.Component.Name = "CurrentDirectory"
    ghenv.Component.NickName = "CurDir"
    ghenv.Component.Description = "Current directory of the current grasshopper file."
    ghenv.Component.Message = "VER 1.1"
    ghenv.Component.Category = "Params"
    ghenv.Component.SubCategory = "Util"

    # Outputs
    # --------------------------------------------------------------------------------------------
    outputIndex = 0

    ghenv.Component.Params.Output[outputIndex].Name = "ParentDirectory"
    ghenv.Component.Params.Output[outputIndex].NickName = "PD"
    ghenv.Component.Params.Output[outputIndex].Description = "Parent directory of the current directory."
    outputIndex += 1

    ghenv.Component.Params.Output[outputIndex].Name = "Directory"
    ghenv.Component.Params.Output[outputIndex].NickName = "D"
    ghenv.Component.Params.Output[outputIndex].Description = "Directory of the current grasshopper file."
    outputIndex += 1

    ghenv.Component.Params.Output[outputIndex].Name = "Path"
    ghenv.Component.Params.Output[outputIndex].NickName = "P"
    ghenv.Component.Params.Output[outputIndex].Description = "Path of the current grasshopper file."
    outputIndex += 1

    ghenv.Component.Params.Output[outputIndex].Name = "Separator"
    ghenv.Component.Params.Output[outputIndex].NickName = "S"
    ghenv.Component.Params.Output[outputIndex].Description = "Separator of the current system."
    outputIndex += 1

# Imports
# --------------------------------------------------------------------------------------------
from os.path import dirname, abspath
from os import sep

# Solver - Run with trees to enhance performance drastically
# --------------------------------------------------------------------------------------------
if __name__ == "__main__":
    P = ghenv.Component.OnPingDocument().FilePath
    D = dirname(P)
    PD = dirname(D)
    S = sep
# ---------- end curdir ----------
# mutation DeleteModel($input: DeleteModelInput!) {
#   modelMutations {
#     delete(input: $input)
#   }
# }
# 
# {
#   "input": {
#     "projectId": "e7de1a2f8f",
#     "id": ""
#   }
# }
# Outputs   ->
#                 |
#                 v
panel = Panel("volume")
series = Series(Start="1", Step=1, Count="8")
concat = Concatenate(FragmentA=curdir.PD, FragmentB=curdir.S, FragmentC="representations")
trim = TrimTree(Tree=series, Depth=1)
concat_2 = Concatenate(FragmentA=concat, FragmentB=curdir.S, FragmentC="capsule")
panel_2 = Panel("""1to500
1to200""")
concat_3 = Concatenate(FragmentA=concat_2, FragmentB="_", FragmentC=trim)
concat_4 = Concatenate(FragmentA=graft(concat_3), FragmentC="_", FragmentB=panel_2)
concat_5 = Concatenate(FragmentA=concat_3, FragmentB=".3dm")  # -> graft(Result)
concat_6 = Concatenate(FragmentA=concat_4, FragmentC="_", FragmentB="volume")
concat_7 = Concatenate(FragmentA=concat_6, FragmentB=".3dm")
merge = Merge(Data1=concat_5, Data2=concat_7)
trim_2 = TrimTree(Tree=merge, Depth=1)
panel_3 = Panel(trim_2)
panel_4 = Panel("""True
False
True""")
panel_5 = Panel("""b3c20db970
6f52c1e6b1
45ab357369
35296b2470
e6c366306e
f16baa9eba
dd564c0e68
9442aab847
29526c7d12
2e5ee46295
b3a9105a14
ff37b776dd
fc4aea84b4
b7243eed93
5004160f7d
02d90f65c0
b8c26ca1c9
a6e1f7d736
c5e7e776cc
0da1e26dff
a3b1c730a1
fa6f77ead5
c696cc23a3
532cc5697c""")
dispatch = Dispatch(List=trim_2, DispatchPattern=panel_4)  # -> ListA, ListB
_3dm = Import3DM(File=dispatch.ListB, Layer="window", Name="*")
_3dm_2 = Import3DM(File=dispatch.ListB, Layer="shell", Name="*")
_3dm_3 = Import3DM(File=dispatch.ListB, Layer="door", Name="*")
_3dm_4 = Import3DM(File=dispatch.ListA, Layer=panel, Name="*")
cso = CreateSpeckleObject(Volume=_3dm_4, selectedKitName="Objects")
cso_2 = CreateSpeckleObject(Shell=_3dm_2, Door=_3dm_3, Window=_3dm, selectedKitName="Objects")
clean = CleanTree(RemoveNulls=True, RemoveInvalid=True, RemoveEmpty="T", Tree=cso)
clean_2 = CleanTree(RemoveNulls=True, RemoveInvalid=True, RemoveEmpty="T", Tree=cso_2)
trim_3 = TrimTree(Tree=clean_2, Depth=1)
trim_4 = TrimTree(Tree=clean, Depth=1)
dispatch_2 = Dispatch(List=trim_4, DispatchPattern=[True, False])  # -> ListA, ListB
merge_2 = Merge(Data1=graft(dispatch_2.ListA), Data2=graft(trim_3), Data3=graft(dispatch_2.ListB))
trim_5 = TrimTree(Tree=merge_2, Depth=1)  # -> graft(Tree)
concat_8 = Concatenate(FragmentA="https://app.speckle.systems/projects/e7de1a2f8f/models/", FragmentB=panel_5)  # -> graft(Result)
bang = ExplodeTree(Data=concat_8)  # -> Branch0, Branch1, Branch2, Branch3, Branch4, Branch5, Branch6, Branch7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
bang_2 = ExplodeTree(Data=trim_5)  # -> Branch0, Branch1, Branch2, Branch3, Branch4, Branch5, Branch6, Branch7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
send = Send(
    Stream=bang.Branch0,
    Data=bang_2.Branch0,
    AutoSend=False,
    BaseId="3b42f447e43b6af45f6783af376f4cd5",
    CurrentComponentState="up_to_date",
    KitName="Objects",
    OutputWrappers="https://app.speckle.systems\te7de1a2f8f\t433b4b98f3",
    UseDefaultCache=True,
    selectedKitName="Objects")
send_2 = Send(
    Stream=bang.Branch3,
    Data=bang_2.Branch3,
    AutoSend=False,
    BaseId="ad8927e83e5a32f25ddac6b1e3050226",
    CurrentComponentState="expired",
    KitName="Objects",
    OutputWrappers="https://app.speckle.systems\te7de1a2f8f\tdc8c1bd061",
    UseDefaultCache=True,
    selectedKitName="Objects")
send_3 = Send(
    Stream=bang.Branch6,
    Data=bang_2.Branch6,
    AutoSend=False,
    BaseId="4378f388df04bba2706aecf89db4f635",
    CurrentComponentState="up_to_date",
    KitName="Objects",
    OutputWrappers="https://app.speckle.systems\te7de1a2f8f\t9d0c379d10",
    UseDefaultCache=True,
    selectedKitName="Objects")
send_4 = Send(
    Stream=bang.Branch12,
    Data=bang_2.Branch12,
    AutoSend=False,
    BaseId="c31bedfb9aec055ed0fd24c9de38d4a3",
    CurrentComponentState="up_to_date",
    KitName="Objects",
    OutputWrappers="https://app.speckle.systems\te7de1a2f8f\t669fae4816",
    UseDefaultCache=True,
    selectedKitName="Objects")
send_5 = Send(
    Stream=bang.Branch18,
    Data=bang_2.Branch18,
    AutoSend=False,
    BaseId="71e40983b48e2267a66c6adebeaa54ac",
    CurrentComponentState="up_to_date",
    KitName="Objects",
    OutputWrappers="https://app.speckle.systems\te7de1a2f8f\t521e866ac6",
    UseDefaultCache=True,
    selectedKitName="Objects")
send_6 = Send(
    Stream=bang.Branch9,
    Data=bang_2.Branch9,
    AutoSend=False,
    BaseId="2220ddcf2ccf7dc17fac0516f677a9c9",
    CurrentComponentState="up_to_date",
    KitName="Objects",
    OutputWrappers="https://app.speckle.systems\te7de1a2f8f\tf0d9172377",
    UseDefaultCache=True,
    selectedKitName="Objects")
send_7 = Send(
    Stream=bang.Branch15,
    Data=bang_2.Branch15,
    AutoSend=False,
    BaseId="d41258c5ae9da4c3f03af1be56f3336f",
    CurrentComponentState="up_to_date",
    KitName="Objects",
    OutputWrappers="https://app.speckle.systems\te7de1a2f8f\tcb98b9fed6",
    UseDefaultCache=True,
    selectedKitName="Objects")
send_8 = Send(
    Stream=bang.Branch21,
    Data=bang_2.Branch21,
    AutoSend=False,
    BaseId="65e5d881d267c0c21baa4a1565ae3c95",
    CurrentComponentState="up_to_date",
    KitName="Objects",
    OutputWrappers="https://app.speckle.systems\te7de1a2f8f\td14d808898",
    UseDefaultCache=True,
    selectedKitName="Objects")
send_9 = Send(
    Stream=concat_8,
    Data=trim_5,
    AutoSend=False,
    CurrentComponentState="up_to_date",
    KitName="Objects",
    UseDefaultCache=True,
    selectedKitName="Objects")  # disabled
send_10 = Send(
    Stream=bang.Branch1,
    Data=bang_2.Branch1,
    AutoSend=False,
    BaseId="b1f973a595372dd2237a7e559214bfe2",
    CurrentComponentState="up_to_date",
    KitName="Objects",
    OutputWrappers="https://app.speckle.systems\te7de1a2f8f\tb255c9b6b3",
    UseDefaultCache=True,
    selectedKitName="Objects")
send_11 = Send(
    Stream=bang.Branch4,
    Data=bang_2.Branch4,
    AutoSend=False,
    BaseId="ad8927e83e5a32f25ddac6b1e3050226",
    CurrentComponentState="expired",
    KitName="Objects",
    OutputWrappers="https://app.speckle.systems\te7de1a2f8f\tdc8c1bd061",
    UseDefaultCache=True,
    selectedKitName="Objects")
send_12 = Send(
    Stream=bang.Branch7,
    Data=bang_2.Branch7,
    AutoSend=False,
    BaseId="638de490dd1162f4aaf95a9137b557de",
    CurrentComponentState="up_to_date",
    KitName="Objects",
    OutputWrappers="https://app.speckle.systems\te7de1a2f8f\t8b166ebb33",
    UseDefaultCache=True,
    selectedKitName="Objects")
send_13 = Send(
    Stream=bang.Branch10,
    Data=bang_2.Branch10,
    AutoSend=False,
    BaseId="322e4f2a30077588df4aa16f3f79e31c",
    CurrentComponentState="up_to_date",
    KitName="Objects",
    OutputWrappers="https://app.speckle.systems\te7de1a2f8f\t6af26bb462",
    UseDefaultCache=True,
    selectedKitName="Objects")
send_14 = Send(
    Stream=bang.Branch13,
    Data=bang_2.Branch13,
    AutoSend=False,
    BaseId="279efc5d74020046ec642f167f082284",
    CurrentComponentState="up_to_date",
    KitName="Objects",
    OutputWrappers="https://app.speckle.systems\te7de1a2f8f\t9c54bd194d",
    UseDefaultCache=True,
    selectedKitName="Objects")
send_15 = Send(
    Stream=bang.Branch16,
    Data=bang_2.Branch16,
    AutoSend=False,
    BaseId="860efa16c3ee09d8cbd35822150aa8ad",
    CurrentComponentState="up_to_date",
    KitName="Objects",
    OutputWrappers="https://app.speckle.systems\te7de1a2f8f\t2d3604828c",
    UseDefaultCache=True,
    selectedKitName="Objects")
send_16 = Send(
    Stream=bang.Branch19,
    Data=bang_2.Branch19,
    AutoSend=False,
    BaseId="ad80cf7e6bc34b6e1d2d8f1b8a7664bd",
    CurrentComponentState="up_to_date",
    KitName="Objects",
    OutputWrappers="https://app.speckle.systems\te7de1a2f8f\t05a392a329",
    UseDefaultCache=True,
    selectedKitName="Objects")
send_17 = Send(
    Stream=bang.Branch22,
    Data=bang_2.Branch22,
    AutoSend=False,
    BaseId="dca148403483c93b0b36b166d176992f",
    CurrentComponentState="up_to_date",
    KitName="Objects",
    OutputWrappers="https://app.speckle.systems\te7de1a2f8f\tbaca132240",
    UseDefaultCache=True,
    selectedKitName="Objects")
send_18 = Send(
    Stream=bang.Branch5,
    Data=bang_2.Branch5,
    AutoSend=False,
    BaseId="ad8927e83e5a32f25ddac6b1e3050226",
    CurrentComponentState="expired",
    KitName="Objects",
    OutputWrappers="https://app.speckle.systems\te7de1a2f8f\tdc8c1bd061",
    UseDefaultCache=True,
    selectedKitName="Objects")
send_19 = Send(
    Stream=bang.Branch2,
    Data=bang_2.Branch2,
    AutoSend=False,
    BaseId="bd9c06a2db308c4affb8fa9817186308",
    CurrentComponentState="up_to_date",
    KitName="Objects",
    OutputWrappers="https://app.speckle.systems\te7de1a2f8f\tcf0329dbd8",
    UseDefaultCache=True,
    selectedKitName="Objects")
send_20 = Send(
    Stream=bang.Branch11,
    Data=bang_2.Branch11,
    AutoSend=False,
    BaseId="1d8389dc14d37b292ae90c5751148979",
    CurrentComponentState="up_to_date",
    KitName="Objects",
    OutputWrappers="https://app.speckle.systems\te7de1a2f8f\te363f58d78",
    UseDefaultCache=True,
    selectedKitName="Objects")
send_21 = Send(
    Stream=bang.Branch17,
    Data=bang_2.Branch17,
    AutoSend=False,
    BaseId="343f36bbc912d00420a14ba1aafede6b",
    CurrentComponentState="up_to_date",
    KitName="Objects",
    OutputWrappers="https://app.speckle.systems\te7de1a2f8f\t405e10e597",
    UseDefaultCache=True,
    selectedKitName="Objects")
send_22 = Send(
    Stream=bang.Branch23,
    Data=bang_2.Branch23,
    AutoSend=False,
    BaseId="dc78a17bf1ebcc9839f7db1b8116030f",
    CurrentComponentState="up_to_date",
    KitName="Objects",
    OutputWrappers="https://app.speckle.systems\te7de1a2f8f\ta69897b4e1",
    UseDefaultCache=True,
    selectedKitName="Objects")
send_23 = Send(
    Stream=bang.Branch8,
    Data=bang_2.Branch8,
    AutoSend=False,
    BaseId="eafa42eda353225e7a0b1d98629dcc7a",
    CurrentComponentState="up_to_date",
    KitName="Objects",
    OutputWrappers="https://app.speckle.systems\te7de1a2f8f\tdf3de042ab",
    UseDefaultCache=True,
    selectedKitName="Objects")
send_24 = Send(
    Stream=bang.Branch14,
    Data=bang_2.Branch14,
    AutoSend=False,
    BaseId="c21a868a5626e23985d96665fbf50a31",
    CurrentComponentState="up_to_date",
    KitName="Objects",
    OutputWrappers="https://app.speckle.systems\te7de1a2f8f\tedd125a722",
    UseDefaultCache=True,
    selectedKitName="Objects")
send_25 = Send(
    Stream=bang.Branch20,
    Data=bang_2.Branch20,
    AutoSend=False,
    BaseId="c50ea2d20eb791bece2349a18b4909fe",
    CurrentComponentState="up_to_date",
    KitName="Objects",
    OutputWrappers="https://app.speckle.systems\te7de1a2f8f\t7d9e5c3ba3",
    UseDefaultCache=True,
    selectedKitName="Objects")
