# Grasshopper definition shaft.gh (Grasshopper 1.0.7)
# plug-ins: eleFront, semio

number_slider = Slider(0, range=0..3)
save_representation = BooleanToggle(False)
filter = StreamFilter(Gate=number_slider, Stream0="9", Stream1="11", Stream2="6", Stream3="8")
filter_2 = StreamFilter(Gate=number_slider, Stream0="west", Stream1="east", Stream2="west", Stream3="east")
icon_export = BooleanToggle(False)
save = BooleanToggle(False)
loop_slider = PythonScript(
    SliderToModify=number_slider,
    Min="0",
    Max="3",
    stepSize="1",
    Delay=Slider(0, range=0..1),
    Run=Toggle(False),
    Reset=Button())  # inputs Run: Boolean, Reset: Boolean
# ---------- loop_slider: Python ----------
import time

def updateSliderInput(inputName,min,max,value,decimalPlace=2):
    for input in ghenv.Component.Params.Input:
        for source in input.Sources:
            if input.Name == str(inputName):
                source.Slider.DecimalPlaces = decimalPlace
                source.Slider.Minimum = min
                source.Slider.Maximum = max
                source.Slider.Value = value
                source.ExpireSolution(True)

def countDecimal(number):
    string= str(number)
    return string[::-1].find('.')

if Run == True:
    if SliderToModify < Max:
        time.sleep(Delay)
        updateSliderInput("SliderToModify",Min,Max,SliderToModify+stepSize,countDecimal(stepSize))
if Reset == True:
    updateSliderInput("SliderToModify",Min,Max,Min)
# ---------- end loop_slider ----------
and = GateAnd(A=save, B=save_representation)
and_2 = GateAnd(A=save, B=icon_export)
number_slider_2 = Slider(9, range=0..20)
expression = Expression(x=Slider(550, range=0..1000), Expression="x/100")
expression_2 = Expression(x=Slider(275, range=0..1000), Expression="x/100")
list = ValueList({"North": "north", "East": "east", "South": "south", "West": "west"}, selected="West")
# ^
#                  |
# Preview    ->
# ^
#  |
# <- Meta
# Parameters:
# <- Variants
#   |
#   v
curdir = CurrentDirectory()  # -> PD, D, P, S
# ---------- curdir: Python ----------
# Component Information
# --------------------------------------------------------------------------------------------
if ghenv.Component.RunCount < 2:
    # General
    # --------------------------------------------------------------------------------------------
    __author__ = "Ueli Saluz"
    __version__ = "2024.07.26"

    ghenv.Component.Name = "CurrentDirectory"
    ghenv.Component.NickName = "CurDir"
    ghenv.Component.Description = "Current directory of the current grasshopper file."
    ghenv.Component.Message = "VER 1.1"
    ghenv.Component.Category = "Params"
    ghenv.Component.SubCategory = "Util"

    # Outputs
    # --------------------------------------------------------------------------------------------
    outputIndex = 0

    ghenv.Component.Params.Output[outputIndex].Name = "ParentDirectory"
    ghenv.Component.Params.Output[outputIndex].NickName = "PD"
    ghenv.Component.Params.Output[outputIndex].Description = "Parent directory of the current directory."
    outputIndex += 1

    ghenv.Component.Params.Output[outputIndex].Name = "Directory"
    ghenv.Component.Params.Output[outputIndex].NickName = "D"
    ghenv.Component.Params.Output[outputIndex].Description = "Directory of the current grasshopper file."
    outputIndex += 1

    ghenv.Component.Params.Output[outputIndex].Name = "Path"
    ghenv.Component.Params.Output[outputIndex].NickName = "P"
    ghenv.Component.Params.Output[outputIndex].Description = "Path of the current grasshopper file."
    outputIndex += 1

    ghenv.Component.Params.Output[outputIndex].Name = "Separator"
    ghenv.Component.Params.Output[outputIndex].NickName = "S"
    ghenv.Component.Params.Output[outputIndex].Description = "Separator of the current system."
    outputIndex += 1

# Imports
# --------------------------------------------------------------------------------------------
from os.path import dirname, abspath
from os import sep

# Solver - Run with trees to enhance performance drastically
# --------------------------------------------------------------------------------------------
if __name__ == "__main__":
    P = ghenv.Component.OnPingDocument().FilePath
    D = dirname(P)
    PD = dirname(D)
    S = sep
# ---------- end curdir ----------
# External
#       |
#       v
width_m = GetNumber(expression, AtLeast=1, AtMost=1, Maximum=1.797693135e+308, Minimum=-1.797693135e+308, TreeAccess=False)
floors = GetNumber(filter, AtLeast=1, AtMost=1, Maximum=1.797693135e+308, Minimum=-1.797693135e+308, TreeAccess=False)
floor_height_m = GetNumber(expression_2, AtLeast=1, AtMost=1, Maximum=1.797693135e+308, Minimum=-1.797693135e+308, TreeAccess=False)
platform = GetString(filter_2, AtLeast=1, AtMost=1, TreeAccess=False)

series = Series(Start=0, Step=1, Count=floors)
trim = TrimTree(Tree=series, Depth=1)
dup = DuplicateData(Data=graft(trim), Number="8", Order=True)
trim_2 = TrimTree(Tree=dup, Depth=1)
trim_3 = TrimTree(Tree=trim_2, Depth=1)
loc = ModelLocator(Group="floor", Subgroup=trim_3)  # -> Locator, Group, Subgroup
concat = Concatenate(FragmentA="f", FragmentB="-", FragmentC=trim_3)

series_2 = Series(Start="1", Step=1, Count="2")
dup_2 = DuplicateData(Data="0", Number="4", Order=True)
trim_4 = TrimTree(Tree=series_2, Depth=1)  # -> graft(Tree)
trim_5 = TrimTree(Tree=dup_2, Depth=1)
dup_3 = DuplicateData(Data=trim_4, Number="2", Order=True)  # -> flatten(Data)
merge = Merge(Data1=trim_5, Data2=dup_3)
dup_4 = DuplicateData(Data=merge, Number=floors, Order=True)
trim_6 = TrimTree(Tree=dup_4, Depth=1)
loc_2 = ModelLocator(Group="split level", Subgroup=trim_6)  # -> Locator, Group, Subgroup
concat_2 = Concatenate(FragmentA="sl", FragmentB="-", FragmentC=trim_6)

panel = Panel("""main
side""")
equals = Equality(FirstNumber=trim_6, SecondNumber="0")  # -> Equality, Inequality
item = ListItem(List=panel, Index=equals.Equality, Wrap=True)
loc_3 = ModelLocator(Group="platform", Subgroup=item)  # -> Locator, Group, Subgroup

expression_3 = Expression(x=Slider(20, range=0..100), Expression="x/100")

variant = Integer(number_slider)
expression_4 = Expression(x=variant, Expression="x+1")
concat_3 = Concatenate(FragmentC="representations", FragmentD=curdir.S, FragmentA="shaft", FragmentB="_", FragmentE=expression_4)
concat_4 = Concatenate(FragmentA=concat_3, FragmentB="_", FragmentE="1to500", FragmentG="_", FragmentF="volume")
concat_5 = Concatenate(FragmentA=concat_3, FragmentB="_", FragmentE="1to200", FragmentG="_", FragmentF="volume")
concat_6 = Concatenate(FragmentA=concat_4, FragmentB=".3dm")
concat_7 = Concatenate(FragmentA=concat_3, FragmentB=".glb")
concat_8 = Concatenate(FragmentA=concat_5, FragmentB=".3dm")
rep = ModelRepresentation(Url=concat_6, LevelOfDetail="1to500", Tags="volume")  # -> Representation, Url, LevelOfDetail, Tags
rep_2 = ModelRepresentation(Url=concat_8, LevelOfDetail="1to200", Tags="volume")  # -> Representation, Url, LevelOfDetail, Tags
rep_3 = ModelRepresentation(Url=concat_7)  # -> Representation, Url, LevelOfDetail, Tags

slab_thickness_m = Number(expression_3)

panel_2 = Panel(" storey core with an elevator in the center, the main platform on the ")
panel_3 = Panel(", and on the other corners side platforms with two doors. The stairs are between the first and the last door of the platform.")
concat_9 = Concatenate(FragmentH="An efficient ", FragmentG=floors, FragmentA=panel_2, FragmentB=platform, FragmentC=panel_3)

expression_5 = Expression(x=Slider(30, range=0..100), Expression="x/100")
expression_6 = Expression(x=Slider(80, range=0..200), Expression="x/100")
expression_7 = Expression(x=Slider(200, range=0..1000), Expression="x/100")
expression_8 = Expression(x=Slider(115, range=0..1000), Expression="x/100")
wall_thickness_m = Number(expression_5)
door_width_m = Number(expression_6)
door_height_m = Number(expression_7)
door_offset_m = Number(expression_8)

# ----
# Local ->
expression_9 = Expression(x=floors, Expression="x+1")
panel_4 = Panel("""north
east
south
west""")
itemindex = ItemIndex(L=panel_4, I=platform)  # -> i; inputs L: list
# ---------- itemindex: Python ----------
#Component Information
#--------------------------------------------------------------------------------------------
if ghenv.Component.RunCount<2:
    #General
    #--------------------------------------------------------------------------------------------
    __author__ = "Ueli Saluz"
    __version__ = "2022.11.18"
    
    ghenv.Component.Name = "ItemIndex"
    ghenv.Component.NickName = "ItemIndex"
    ghenv.Component.Description = "A better IdemIndex"
    ghenv.Component.Message = "VER 1.0"
    ghenv.Component.Category = "Set"
    ghenv.Component.SubCategory = "List"
    
     #Inputs
    #--------------------------------------------------------------------------------------------
    inputIndex=0
    
    ghenv.Component.Params.Input[inputIndex].Name = "List"
    ghenv.Component.Params.Input[inputIndex].NickName = "L"
    ghenv.Component.Params.Input[inputIndex].Description = "Input1 is..."
    ghenv.Component.Params.Input[inputIndex].Optional = False
    inputIndex+=1
    
    ghenv.Component.Params.Input[inputIndex].Name = "Item"
    ghenv.Component.Params.Input[inputIndex].NickName = "I"
    ghenv.Component.Params.Input[inputIndex].Description = "Input2 is..."
    ghenv.Component.Params.Input[inputIndex].Optional = False
    inputIndex+=1
    
    #Outputs
    #--------------------------------------------------------------------------------------------
    outputIndex=0
    
    ghenv.Component.Params.Output[outputIndex].Name = "Index"
    ghenv.Component.Params.Output[outputIndex].NickName = "i"
    ghenv.Component.Params.Output[outputIndex].Description = "Output1 is..."
    outputIndex+=1

i = L.index(I)
# ---------- end itemindex ----------
int = Integer(expression_9)
multiplication = Multiplication(A=int, B=floor_height_m)
valueor0 = ValueOr0(value=itemindex)
coreheight = Number(multiplication)
expression_10 = Expression(x=valueor0, Expression="-((x+2)*90)%360")
dom = ConstructDomain(DomainStart=0, DomainEnd=coreheight)
_2d = _2D(x=width_m)
box = DomainBox(Base=PlaneXY(0, 0, 0), X=_2d, Y=_2d, Z=dom)
corevolume = Box(box)
rectangle = Rectangle(Plane=PlaneXY(0, 0, 0), XSize=_2d, YSize=_2d, Radius=0)  # -> Rectangle, Length
debrep = DeconstructBrep(Brep=corevolume)  # -> Faces, Edges, Vertices
trim_7 = TrimTree(Tree=debrep.Faces, Depth=1)
item_2 = ListItem(List=trim_7, Index=0, Wrap=True)  # -> Item, Item1, Item2, Item3, Item4
base = Surface(item_2.Item4)
explode = Explode(Curve=base, Recursive=True)  # -> Segments, Vertices
trim_8 = TrimTree(Tree=explode.Segments, Depth=1)
join = JoinCurves(Curves=explode.Segments, Preserve=False)
expression_11 = Expression(x=width_m, Expression="x/2")
expression_12 = Expression(x=door_width_m, Expression="x/2")
trim_9 = TrimTree(Tree=join, Depth=1)
curvepoint = PointOnCurve(trim_8, parameter=0.5)
subtraction = Subtraction(A=expression_11, B=expression_12, C=door_offset_m, D=wall_thickness_m)
crv_cp = CurveClosestPoint(Point=curvepoint, Curve=trim_8)  # -> Point, Parameter, Distance
addition = Addition(A=crv_cp.Parameter, B=subtraction)
subtraction_2 = Subtraction(A=crv_cp.Parameter, B=subtraction)
eval = EvaluateCurve(Curve=trim_8, Parameter=addition)  # -> Point, Tangent, Angle
eval_2 = EvaluateCurve(Curve=trim_8, Parameter=subtraction_2)  # -> Point, Tangent, Angle
shift = ShiftList(List=eval_2.Point, Shift=1, Wrap=True)
trim_10 = TrimTree(Tree=shift, Depth=1)
merge_2 = Merge(Data1=graft(eval.Point), Data2=graft(trim_10))

expression_13 = Expression(x=floor_height_m, Expression="x/3")
lng = ListLength(List=trim_8)
dup_5 = DuplicateData(Data=expression_13, Number=lng, Order=True)
trim_11 = TrimTree(Tree=dup_5, Depth=1)
expression_14 = Expression(x=int, Expression="(x-1)*4")
replace = ReplaceItems(List=trim_11, Item="0", Indices="1", Wrap=False)
repeat = RepeatData(Data=replace, Length=expression_14)
trim_12 = TrimTree(Tree=repeat, Depth=1)
ma = MassAddition(Input=trim_12)  # -> Result, PartialResults
flip = FlipMatrix(Data=ma.PartialResults)
doorheights = Number(flip)
Z = UnitZ(Factor=doorheights)
trim_13 = TrimTree(Tree=Z, Depth=1)
cset = CreateSet(List=trim_13)  # -> Set, graft(Map)
path = ConstructPath(Indices=cset.Map)
trim_14 = TrimTree(Tree=path, Depth=1)

l2o = List2Object(L=merge_2)  # -> O; inputs L: tree
# ---------- l2o: Python ----------
#Component Information
#--------------------------------------------------------------------------------------------
if ghenv.Component.RunCount<2:
    #General
    #--------------------------------------------------------------------------------------------
    __author__ = "Ueli Saluz"
    __version__ = "2022.04.24"
    
    ghenv.Component.Name = "List2Object"
    ghenv.Component.NickName = "L2O"
    ghenv.Component.Description = "Wraps a list of objects into a list object."
    ghenv.Component.Message = "VER 1.0"
    ghenv.Component.Category = "Sets"
    ghenv.Component.SubCategory = "Tree"
    
     #Inputs
    #--------------------------------------------------------------------------------------------
    inputIndex=0
    
    ghenv.Component.Params.Input[inputIndex].Name = "List"
    ghenv.Component.Params.Input[inputIndex].NickName = "L"
    ghenv.Component.Params.Input[inputIndex].Description = "Tree with lists to wrap."
    ghenv.Component.Params.Input[inputIndex].Optional = False
    inputIndex+=1
    

    #Outputs
    #--------------------------------------------------------------------------------------------
    outputIndex=0
    
    ghenv.Component.Params.Output[outputIndex].Name =  "ListObject" 
    ghenv.Component.Params.Output[outputIndex].NickName = "O"
    ghenv.Component.Params.Output[outputIndex].Description = "Python list object as single item."
    outputIndex+=1


#Imports
#--------------------------------------------------------------------------------------------
from System import Object
from Grasshopper import DataTree

#Solver - Run with trees to enhance performance drastically
#--------------------------------------------------------------------------------------------
if __name__ == "__main__":
    
    #Initialize trees
    #--------------------------------------------------------------------------------------------
    TreeToWrap = DataTree[Object]()
    
    #Data matching
    #--------------------------------------------------------------------------------------------
    for path in L.Paths:
        listBranch = L.Branch(path)
        TreeToWrap.Add(listBranch,path)
    
     #Assign trees to output
    #--------------------------------------------------------------------------------------------
    O = TreeToWrap
# ---------- end l2o ----------
trim_15 = TrimTree(Tree=l2o, Depth=1)
repeat_2 = RepeatData(Data=trim_15, Length=expression_14)
trim_16 = TrimTree(Tree=repeat_2, Depth=1)
o2l = Object2List(O=trim_16)  # -> L; inputs O: tree
# ---------- o2l: Python ----------
#Component Information
#--------------------------------------------------------------------------------------------
if ghenv.Component.RunCount<2:
    #General
    #--------------------------------------------------------------------------------------------
    __author__ = "Ueli Saluz"
    __version__ = "2022.04.24"
    
    ghenv.Component.Name = "Object2List"
    ghenv.Component.NickName = "O2L"
    ghenv.Component.Description = "Unwraps a list of objects into a list object."
    ghenv.Component.Message = "VER 1.0"
    ghenv.Component.Category = "Sets"
    ghenv.Component.SubCategory = "Tree"
    
     #Inputs
    #--------------------------------------------------------------------------------------------
    inputIndex=0
    
    ghenv.Component.Params.Input[inputIndex].Name = "ListObject"
    ghenv.Component.Params.Input[inputIndex].NickName = "O"
    ghenv.Component.Params.Input[inputIndex].Description = "A python list object that will be unwrapped into a Grasshopper list."
    ghenv.Component.Params.Input[inputIndex].Optional = False
    inputIndex+=1
    

    #Outputs
    #--------------------------------------------------------------------------------------------
    outputIndex=0
    
    ghenv.Component.Params.Output[outputIndex].Name =  "List"
    ghenv.Component.Params.Output[outputIndex].NickName = "L"
    ghenv.Component.Params.Output[outputIndex].Description = "The unwrapped list."
    outputIndex+=1


#Imports
#--------------------------------------------------------------------------------------------
from System import Object
from Grasshopper import DataTree

#Solver - Run with trees to enhance performance drastically
#--------------------------------------------------------------------------------------------
if __name__ == "__main__":
    
    #Initialize trees
    #--------------------------------------------------------------------------------------------
    OriginalTree = DataTree[Object]()
    
    #Data matching
    #--------------------------------------------------------------------------------------------
    for path in O.Paths:
        listBranch = O.Branch(path)
        for i,listItem in enumerate(listBranch):
            OriginalTree.AddRange(list(listItem),path.AppendElement(i))
    
     #Assign trees to output
    #--------------------------------------------------------------------------------------------
    L = OriginalTree
# ---------- end o2l ----------
match = MatchTree(Tree=Z, Guide=o2l)
move = Move(Geometry=o2l, Motion=match)  # -> Geometry, Transform
crv_cp_2 = CurveClosestPoint(Point=move.Geometry, Curve=trim_9)  # -> Point, Parameter, Distance
eval_3 = EvaluateCurve(Curve=trim_9, Parameter=crv_cp_2.Parameter)  # -> Point, Tangent, Angle
rev = Reverse(Vector=eval_3.Tangent)
line = LineSDL(Start=eval_3.Point, Direction=Vector(0, 0, 1), Length=1)
vrot = Rotate(Vector=rev, Axis=line, Angle=degrees("90"))
pl = ConstructPlane(Origin=eval_3.Point, XAxis=rev, YAxis=vrot)
move_2 = Move(Geometry=pl, Motion=Z)  # -> Geometry, Transform
rotate = Rotate(Geometry=move_2.Geometry, Angle=degrees(expression_10), Plane=PlaneXY(0, 0, 0))  # -> Geometry, Transform
neg = Negative(Value=expression_13)
relblbrch = RelabelBranches(TreeToMatch=rotate.Geometry, ListOfPaths=trim_14)  # -> RelabeledTree; inputs TreeToMatch: tree, ListOfPaths: list
# ---------- relblbrch: Python ----------
if ghenv.Component.RunCount<2:
    __author__ = "Your name"
    __version__ = "2000.00.00"
    
    ghenv.Component.Name = "RelabelBranches"
    ghenv.Component.NickName = "ReLblBrch"
    ghenv.Component.Description = "Relabel all the paths of the branches with a list of new paths. The amount of branches must match with the size of the list of pahts"
    ghenv.Component.Message = "VER 1.0"
    
    ghenv.Component.Params.Input[0].NickName = "TreeToMatch"
    ghenv.Component.Params.Input[1].NickName = "ListOfPaths"
    
    ghenv.Component.Params.Input[0].Description = "Tree that should be relabeled."
    ghenv.Component.Params.Input[1].Description = "List of paths to use for new branch paths."
    
    ghenv.Component.Params.Output[0].NickName = "RelabeledTree"
    ghenv.Component.Params.Output[0].Description = "Relabeled tree where all the paths of the branches have been replaced with new paths."

from System import Object
from Grasshopper import DataTree

def relabelBranchesWithLstOfPths (tree, paths):
    newTree = DataTree[Object]()
    for i,path in enumerate(tree.Paths):
        items = tree.Branch(path)
        for data in items:
            newTree.Add(data,paths[i])
    return newTree

if __name__ == "__main__":
    RelabeledTree = relabelBranchesWithLstOfPths(TreeToMatch,ListOfPaths)
# ---------- end relblbrch ----------
addition_2 = Addition(A=neg, B=slab_thickness_m)
Z_2 = UnitZ(Factor=addition_2)
move_3 = Move(Geometry=relblbrch, Motion=Z_2)  # -> Geometry, Transform
entranceplanes = Plane(move_3.Geometry)

series_3 = Series(Start=0, Step=1, Count="4")
series_4 = Series(Start=0, Step=1, Count="2")
trim_17 = TrimTree(Tree=series_3, Depth=1)
trim_18 = TrimTree(Tree=series_4, Depth=1)
lng_2 = ListLength(List=flatten(entranceplanes))
merge_3 = Merge(Data1=trim_17, Data2=trim_18, Data3=trim_18)
repeat_3 = RepeatData(Data=merge_3, Length=lng_2)
trim_19 = TrimTree(Tree=repeat_3, Depth=1)
loc_4 = ModelLocator(Group="door", Subgroup=trim_19)  # -> Locator, Group, Subgroup
concat_10 = Concatenate(FragmentA="d", FragmentB="-", FragmentC=trim_19)

pt = ConstructPoint(XCoordinate=0, YCoordinate=0, ZCoordinate=0)
Z_3 = UnitZ(Factor=coreheight)
Z_4 = UnitZ(Factor=1)
rev_2 = Reverse(Vector=Z_4)
move_4 = Move(Geometry=pt, Motion=Z_3)  # -> Geometry, Transform
por = ModelPort(Id="b", Point=pt, Direction=rev_2, Locators="bottom")  # -> Port, Id, Point, Direction, Locators
por_2 = ModelPort(Id="t", Point=move_4.Geometry, Direction=Z_4, Locators="top")  # -> Port, Id, Point, Direction, Locators

maintenance_expenses_month_eff_m² = Slider(3.5, range=0..10)
construction_area_factor = Slider(0.2, range=0..1)
construction_cost_eff_m² = Slider(9000, range=0..10000)

deplane = DeconstructPlane(Plane=entranceplanes)  # -> Origin, XAxis, YAxis, ZAxis
pl_2 = ConstructPlane(Origin=deplane.Origin, XAxis=deplane.XAxis, YAxis=deplane.ZAxis)
_2d_2 = _2D(x=door_width_m)
rectangle_2 = Rectangle(Plane=pl_2, XSize=_2d_2, YSize=door_height_m, Radius=0)  # -> Rectangle, Length
doors = Rectangle(rectangle_2.Rectangle)

expression_15 = Expression(x=valueor0, Expression="(-x)*2")
panel_5 = Panel("""west
south
south
east
east
north
north
west""")
door_tree = Data(doors)
lng_3 = ListLength(List=flatten(door_tree))
shift_2 = ShiftList(List=panel_5, Shift=expression_15, Wrap=True)
repeat_4 = RepeatData(Data=flatten(shift_2), Length=lng_3)
tstat = TreeStatistics(Tree=door_tree)  # -> Paths, Length, Count
trim_20 = TrimTree(Tree=repeat_4, Depth=1)
partition = PartitionList(List=trim_20, Size=tstat.Length)
match_2 = MatchTree(Tree=partition, Guide=door_tree)
loc_5 = ModelLocator(Group="facade", Subgroup=match_2)  # -> flatten(Locator), Group, Subgroup

entranceplanes_2 = Plane(flatten(entranceplanes))
merge_4 = Merge(
    Data1=graft(loc.Locator),
    Data2=graft(loc_2.Locator),
    Data3=graft(loc_4.Locator),
    Data4=graft(loc_5.Locator),
    Data5=graft(loc_3.Locator))
concat_11 = Concatenate(FragmentA=concat, FragmentB="#", FragmentC=concat_2, FragmentD="#", FragmentE=concat_10)  # -> graft(Result)
por_3 = ModelPort(Port=graft(entranceplanes_2), Id=concat_11, Locators=merge_4)  # -> Port, Id, Point, Direction, Locators
trim_21 = TrimTree(Tree=por_3.Port, Depth=1)

doors_2 = Rectangle(flatten(doors))
corevolume_2 = Box(corevolume)
expression_16 = Expression(x="doors", y=doors_2, Expression="x")
expression_17 = Expression(x="volume", y=corevolume_2, Expression="x")
merge_5 = Merge(Data1=expression_17, Data2=expression_16)
merge_6 = Merge(Data1=corevolume_2, Data2=doors_2)
ef_layer = EleFrontLayer(FullPath=merge_5)  # -> Layer, FullPath, Hidden, Locked, DisplayColour, MaterialName, Linetype, PrintColour, PrintWidth
concat_12 = Concatenate(FragmentA=curdir.PD, FragmentB=curdir.S, FragmentC=rep.Url)
concat_13 = Concatenate(FragmentA=curdir.PD, FragmentB=curdir.S, FragmentC=rep_2.Url)
ef_att = EleFrontAttributes(Layer=ef_layer.Layer)  # -> Attributes, Keys, Values, Name, Layer, ColourSource, DisplayColour, MaterialSource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
baketofile = BakeObjectsToFile(
    FilePath=concat_12,
    Geometry=merge_6,
    Attributes=ef_att.Attributes,
    Bake=and,
    networkMode=False,
    ValueTable_networkMode=True,
    overwriteMode="Overwrite",
    preset="Safest")
baketofile_2 = BakeObjectsToFile(
    FilePath=concat_13,
    Geometry=merge_6,
    Attributes=ef_att.Attributes,
    Bake=and,
    networkMode=False,
    ValueTable_networkMode=True,
    overwriteMode="Overwrite",
    preset="Safest")

panel_6 = Panel("Parallel")  # disabled

rec = Rectangle({Plane=Plane(origin=(853.3612491, 852.5312947, 866.3069427), x=(0.7071067812, -0.7071067812, 0), y=(-0.4082482905, -0.4082482905, 0.8164965809)), Size=Domain2(u=-52.32632723..52.32632723, v=-27.88533994..27.88533994)})
merge_7 = Merge(Data1=corevolume_2, Data2=doors_2)
m2d_parallel = Make2DParallelView(Projection=rec)
make2d = Make2D(Geometry=merge_7, View=m2d_parallel, TangentEdges="T", TangentSeams=False, AutoComputeMake2D=True)  # -> VisibleCurves, VisibleIndex, VisibleType, HiddenCurves, HiddenIndex, HiddenType
trim_22 = TrimTree(Tree=make2d.VisibleCurves, Depth=1)
shaft = Geometry(trim_22)

expression_18 = Expression(x="shaft", y=shaft, Expression="x")
concat_14 = Concatenate(FragmentC="icons", FragmentD=curdir.S, FragmentA="shaft", FragmentB="_", FragmentE=expression_4)
merge_8 = Merge(Data1=expression_18)
merge_9 = Merge(Data1=shaft)
concat_15 = Concatenate(FragmentA=concat_14, FragmentB=".3dm")
ef_layer_2 = EleFrontLayer(FullPath=merge_8)  # -> Layer, FullPath, Hidden, Locked, DisplayColour, MaterialName, Linetype, PrintColour, PrintWidth
concat_16 = Concatenate(FragmentA=curdir.PD, FragmentB=curdir.S, FragmentC=concat_15)
ef_att_2 = EleFrontAttributes(Layer=ef_layer_2.Layer)  # -> Attributes, Keys, Values, Name, Layer, ColourSource, DisplayColour, MaterialSource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
baketofile_3 = BakeObjectsToFile(
    FilePath=concat_16,
    Geometry=merge_9,
    Attributes=ef_att_2.Attributes,
    Bake=and_2,
    networkMode=False,
    ValueTable_networkMode=True,
    overwriteMode="Overwrite",
    preset="Safest")

concat_17 = Concatenate(FragmentA=concat_14, FragmentB=".svg")
concat_18 = Concatenate(FragmentA=curdir.PD, FragmentB=curdir.S, FragmentC=concat_17)
file = ReadFile(File=concat_18, PerLineParse=False)
txt = EncodeText(Text=file)
concat_19 = Concatenate(FragmentA="data:image/svg+xml;base64,", FragmentB=txt)

m2d_rhino = Make2DRhinoView(Name=panel_6, Clip=True)  # disabled
number_slider_3 = Slider(876, range=0..1000)  # disabled
construction_area_factor_2 = Number(construction_area_factor)
construction_cost_eff_m²_2 = Number(construction_cost_eff_m²)
maintenance_expenses_month_eff_m²_2 = Number(maintenance_expenses_month_eff_m²)
view_rectangle = ViewRectangle(view=m2d_rhino)  # disabled
number_slider_4 = Slider(0.5, range=0..1)
item_3 = CherryPicker(entranceplanes, ListIndex=0)
previewplane = PreviewPlane_2(plane=view_rectangle, axis_length=number_slider_3)  # disabled
previewplane_2 = PreviewPlane(plane=graft(entranceplanes), axis_length=number_slider_4)  # -> X_2, Y_2, Z_2
previewplane_3 = PreviewPlane(plane=graft(item_3), axis_length=number_slider_4)  # -> X_2, Y_2, Z_2
merge_10 = Merge(Data1=previewplane_2.X_2, Data2=previewplane_2.Y_2, Data3=previewplane_2.Z_2)
heating_energy_demand_kwh_m²a = Number(Slider(20, range=0..200))
cooling_energy_demand_kwh_m²a = Number(Slider(10, range=0..200))
construction_global_warming_potential_kg = Number(Slider(1500, range=0..2000))  # "Construction Global Warming Potential [kgCO2e/eff. m²]"
technical_equipment_energy_demand_kwh_m² = Number(Slider(20, range=0..200))  # "Technical Equipment Energy Demand[kWh/m²a]"

maintenance_expenses_month_eff_m²_3 = Number(maintenance_expenses_month_eff_m²_2)
# Outputs   ->
#                 |
#                 v
construction_global_warming_potential_kg_2 = Number(construction_global_warming_potential_kg)  # "Construction Global Warming Potential [kgCO2e/eff. m²]"
technical_equipment_energy_demand_kwh_m²_2 = Number(technical_equipment_energy_demand_kwh_m²)  # "Technical Equipment Energy Demand[kWh/m²a]"
construction_area_factor_3 = Number(construction_area_factor_2)
heating_energy_demand_kwh_m²a_2 = Number(heating_energy_demand_kwh_m²a)
cooling_energy_demand_kwh_m²a_2 = Number(cooling_energy_demand_kwh_m²a)
area = Area(Geometry=rectangle.Rectangle)  # -> Area, Centroid
construction_cost_eff_m²_3 = Number(construction_cost_eff_m²_2)
expression_19 = Expression(x=construction_area_factor_3, Expression="1-x")
multiplication_2 = Multiplication(A=area.Area, B=floors)
multiplication_3 = Multiplication(A=multiplication_2, B=expression_19)
multiplication_4 = Multiplication(A=multiplication_3, B=maintenance_expenses_month_eff_m²_3)
expression_20 = Expression(x=multiplication_4, Expression="x*12")
multiplication_5 = Multiplication(A=heating_energy_demand_kwh_m²a_2, B=multiplication_3)
multiplication_6 = Multiplication(A=cooling_energy_demand_kwh_m²a_2, B=multiplication_3)
multiplication_7 = Multiplication(A=multiplication_3, B=construction_cost_eff_m²_3)
multiplication_8 = Multiplication(A=technical_equipment_energy_demand_kwh_m²_2, B=multiplication_3)
multiplication_9 = Multiplication(B=construction_global_warming_potential_kg_2)
roundmult = RoundToMultiple(N=multiplication_3, M="0.01")  # -> R; inputs N: tree, M: tree
# ---------- roundmult: Python ----------
#Component Information
#--------------------------------------------------------------------------------------------
if ghenv.Component.RunCount<2:
    #General
    #--------------------------------------------------------------------------------------------
    __author__ = "YOUR NAME"
    __version__ = "2000.00.00"
    
    ghenv.Component.Name = "Round to Multiple"
    ghenv.Component.NickName = "RoundMult"
    ghenv.Component.Description = "Rounds a number to the nearest specified multiple."
    ghenv.Component.Message = "VER 1.0"
    ghenv.Component.Category = "Math"
    ghenv.Component.SubCategory = "Arithmetic"
    
     #Inputs
    #--------------------------------------------------------------------------------------------
    inputIndex=0
    
    ghenv.Component.Params.Input[inputIndex].Name = "Number"
    ghenv.Component.Params.Input[inputIndex].NickName = "N"
    ghenv.Component.Params.Input[inputIndex].Description = "Number to round."
    ghenv.Component.Params.Input[inputIndex].Optional = False
    inputIndex+=1
    
    ghenv.Component.Params.Input[inputIndex].Name = "Multiple"
    ghenv.Component.Params.Input[inputIndex].NickName = "M"
    ghenv.Component.Params.Input[inputIndex].Description = "Multiple to round to."
    ghenv.Component.Params.Input[inputIndex].Optional = False
    inputIndex+=1
    
    #Outputs
    #--------------------------------------------------------------------------------------------
    outputIndex=0
    
    ghenv.Component.Params.Output[outputIndex].Name = "Rounded"
    ghenv.Component.Params.Output[outputIndex].NickName = "R"
    ghenv.Component.Params.Output[outputIndex].Description = "Number rounded to the nearest specified multiple."
    outputIndex+=1


#Imports
#--------------------------------------------------------------------------------------------
from System import Object
from Grasshopper import DataTree
import math


#The Component function - Business logic only (e.g. working without trees)
#--------------------------------------------------------------------------------------------
"""Function that this component is computing.
    Inputs:
        number: The number to round.
        multiple: The multiple to round to.
    Output:
        rounded: The number rounded to the nearest specified multiple."""
def RoundToMultiple(number, multiple):
    rounded = math.ceil(number / multiple) * multiple
    return rounded

#Solver - Run with trees to enhance performance drastically
#--------------------------------------------------------------------------------------------
if __name__ == "__main__":
    
    #Initialize trees
    #--------------------------------------------------------------------------------------------
    RoundedTree = DataTree[Object]()
    
    #Data matching
    #--------------------------------------------------------------------------------------------
    for path in N.Paths:
        numberBranch = N.Branch(path)
        for i, number in enumerate(numberBranch):
            multiple = M.Branch(path)[i]
            rounded = RoundToMultiple(number, multiple)
            RoundedTree.Add(rounded, path)
    
     #Assign trees to output
    #--------------------------------------------------------------------------------------------
    R = RoundedTree
# ---------- end roundmult ----------
round = Round(Number=multiplication_7)  # -> Nearest, Floor, Ceiling
round_2 = Round(Number=multiplication_5)  # -> Nearest, Floor, Ceiling
round_3 = Round(Number=multiplication_6)  # -> Nearest, Floor, Ceiling
round_4 = Round(Number=multiplication_8)  # -> Nearest, Floor, Ceiling
round_5 = Round(Number=expression_20)  # -> Nearest, Floor, Ceiling
round_6 = Round(Number=multiplication_9)  # -> Nearest, Floor, Ceiling
merge_11 = Merge(
    Data1=width_m,
    Data2=floors,
    Data3=floor_height_m,
    Data4=platform,
    Data5=door_width_m,
    Data6=door_height_m,
    Data7=door_offset_m,
    Data8=roundmult,
    Data9=round.Nearest,
    Data10=round_2.Nearest,
    Data11=round_3.Nearest,
    Data12=round_4.Nearest,
    Data13=round_5.Nearest,
    Data14=round_6.Nearest)
panel_7 = Panel("""width
storeys
floor height
platform
door width
door height
door offset
effective floor area
construction cost
heating energy demand
cooling energy demand
technical equipment energy demand
maintenance expenses
construction global warming potential""")
panel_8 = Panel("""https://identifier.buildingsmart.org/uri/buildingsmart/ifc/4.3/prop/Width 
https://identifier.buildingsmart.org/uri/buildingsmart/ifc/4.3/class/IfcBuildingStorey
https://identifier.buildingsmart.org/uri/buildingsmart/ifc/4.3/prop/GrossHeight




https://identifier.buildingsmart.org/uri/buildingsmart/ifc/4.3/prop/NetFloorArea

https://identifier.buildingsmart.org/uri/buildingsmart/ifc/4.3/prop/EnergyConsumption
https://identifier.buildingsmart.org/uri/buildingsmart/ifc/4.3/prop/EnergyConsumption
https://identifier.buildingsmart.org/uri/buildingsmart/ifc/4.3/prop/EnergyConsumption

https://identifier.buildingsmart.org/uri/etim/etim/9.0/prop/EF016979""")
panel_9 = Panel(merge_11)
panel_10 = Panel("""m

m

m
m
m
m²
€
kWh/a
kWh/a
kWh/a
€/a
kgCO2e""")
qlt = ModelQuality(Name=panel_7, Value=panel_9, Unit=panel_10, Definition=panel_8)  # -> Quality, Name, Value, Unit, Definition

merge_12 = Merge(Data1=por.Port, Data2=por_2.Port, Data3=trim_21)
merge_13 = Merge(Data1=rep_3.Representation, Data2=rep.Representation, Data3=rep_2.Representation)
concat_20 = Concatenate(FragmentB=expression_4)
typ = ModelType(
    Name="Shaft",
    Description=concat_9,
    Icon=concat_19,
    Variant=expression_4,
    Representations=merge_13,
    Ports=merge_12,
    Qualities=qlt.Quality)  # -> Type, Name, Description, Icon, Variant, Unit, Representations, Ports, Qualities
typ_2 = RemoveType(TypeName=typ.Name, TypeVariant=typ.Variant, Run=save)
or = GateOr(A=save, B=typ_2)
typ_3 = AddType(Type=typ.Type, Run=or)

typ_4 = SerializeType(Type=typ.Type)
type = Text(typ_4)
context_bake = ContextBake(Geometry=type)

# ==== cluster _2D
x = ClusterInput()
expression = Expression(x=x, Expression="x/2")
neg = Negative(Value=expression)
dom = ConstructDomain(DomainStart=neg, DomainEnd=expression)
I = ClusterOutput(dom)

# ==== cluster ValueOr0
value = ClusterInput()
value_2 = Number(value)
null = NullItem(Item=value_2)  # -> NullFlags, InvalidFlags, Description
filter = StreamFilter(Gate=null.NullFlags, Stream0=value_2, Stream1="0")
valueor0 = Number(filter)
valueor0_2 = ClusterOutput(valueor0)

# ==== cluster PreviewPlane: Preview a plane with axis colors and naming.
axis_length = ClusterInput()
plane = ClusterInput()
axis_length_2 = Number(axis_length)
plane_2 = Plane(plane)
deplane = DeconstructPlane(Plane=plane_2)  # -> Origin, XAxis, YAxis, ZAxis
line = LineSDL(Start=deplane.Origin, Direction=deplane.YAxis, Length=axis_length_2)
line_2 = LineSDL(Start=deplane.Origin, Direction=deplane.XAxis, Length=axis_length_2)
line_3 = LineSDL(Start=deplane.Origin, Direction=deplane.ZAxis, Length=axis_length_2)
swatch = ColourSwatch(SwatchColor=RGB(235, 52, 79))
swatch_2 = ColourSwatch(SwatchColor=RGB(0, 166, 157))
swatch_3 = ColourSwatch(SwatchColor=RGB(240, 117, 24))
end = EndPoints(Curve=line_2)  # -> Start, End
end_2 = EndPoints(Curve=line)  # -> Start, End
end_3 = EndPoints(Curve=line_3)  # -> Start, End
tag = TextTag(Location=end.End, Text="X", Colour=swatch)
tag_2 = TextTag(Location=end_2.End, Text="Y", Colour=swatch_2)
tag_3 = TextTag(Location=end_3.End, Text="Z", Colour=swatch_3)
preview = CustomPreview(Geometry=line_2, Material=swatch)
preview_2 = CustomPreview(Geometry=line, Material=swatch_2)
preview_3 = CustomPreview(Geometry=line_3, Material=swatch_3)
X = Line(line_2)
Y = Line(line)
Z = Line(line_3)
X_2 = ClusterOutput(X)
Y_2 = ClusterOutput(Y)
Z_2 = ClusterOutput(Z)

# ==== cluster PreviewPlane_2: Preview a plane with axis colors and naming.
axis_length = ClusterInput()
plane = ClusterInput()
axis_length_2 = Number(axis_length)
plane_2 = Plane(plane)
deplane = DeconstructPlane(Plane=plane_2)  # -> Origin, XAxis, YAxis, ZAxis
line = LineSDL(Start=deplane.Origin, Direction=deplane.YAxis, Length=axis_length_2)
line_2 = LineSDL(Start=deplane.Origin, Direction=deplane.XAxis, Length=axis_length_2)
line_3 = LineSDL(Start=deplane.Origin, Direction=deplane.ZAxis, Length=axis_length_2)
swatch = ColourSwatch(SwatchColor=RGB(235, 52, 79))
swatch_2 = ColourSwatch(SwatchColor=RGB(0, 166, 157))
swatch_3 = ColourSwatch(SwatchColor=RGB(240, 117, 24))
end = EndPoints(Curve=line_2)  # -> Start, End
end_2 = EndPoints(Curve=line)  # -> Start, End
end_3 = EndPoints(Curve=line_3)  # -> Start, End
tag = TextTag(Location=end.End, Text="X", Colour=swatch)
tag_2 = TextTag(Location=end_2.End, Text="Y", Colour=swatch_2)
tag_3 = TextTag(Location=end_3.End, Text="Z", Colour=swatch_3)
preview = CustomPreview(Geometry=line_2, Material=swatch)
preview_2 = CustomPreview(Geometry=line, Material=swatch_2)
preview_3 = CustomPreview(Geometry=line_3, Material=swatch_3)

# ==== cluster ViewRectangle
view = ClusterInput()
view_2 = Data(view)
nickname = NAME(view=view_2)  # -> c, x, y, z, h, w
# ---------- nickname: Python ----------
uselss, c, x, y, z = view.GetCameraFrame()
h = view.FrustumHeight
w = view.FrustumWidth
# ---------- end nickname ----------
rev = Reverse(Vector=nickname.x)
rev_2 = Reverse(Vector=nickname.y)
pl = ConstructPlane(Origin=nickname.c, XAxis=rev, YAxis=nickname.y)
_2d = _2D(x=nickname.w)
_2d_2 = _2D(x=nickname.h)
rectangle = Rectangle(Plane=pl, XSize=_2d, YSize=_2d_2, Radius=0)  # -> Rectangle, Length
rec = Rectangle(rectangle.Rectangle)
rec_2 = ClusterOutput(rec)
