# Grasshopper definition shaft.gh (Grasshopper 1.0.7)
# plug-ins: semio, eleFront

number_slider = Slider(0, range=0..1)
safe = Button()
filter = StreamFilter(Gate=number_slider, Stream0="9", Stream1="11")
filter_2 = StreamFilter(Gate=number_slider, Stream0="left", Stream1="right")
number_slider_2 = Slider(9, range=0..20)
# ^
#                  |
# Preview    ->
# Parameters:
number_slider_3 = Slider(550, range=0..1000)
list = ValueList({"Front": "front", "Right": "right", "Bottom": "bottom", "Left": "left"}, selected="Right")
# External
#       |
#       v
width = GetNumber(number_slider_3, AtLeast=1, AtMost=1, Maximum=1.797693135e+308, Minimum=-1.797693135e+308, TreeAccess=False)
floorheight = GetNumber(Slider(275, range=0..1000), AtLeast=1, AtMost=1, Maximum=1.797693135e+308, Minimum=-1.797693135e+308, TreeAccess=False)
platform = GetString(filter_2, AtLeast=1, AtMost=1, TreeAccess=False)
wallthickness = GetNumber(Slider(30, range=0..100), AtLeast=1, AtMost=1, Maximum=1.797693135e+308, Minimum=-1.797693135e+308, TreeAccess=False)
doorwidth = GetNumber(Slider(80, range=0..200), AtLeast=1, AtMost=1, Maximum=1.797693135e+308, Minimum=-1.797693135e+308, TreeAccess=False)
dooroffset = GetNumber(Slider(115, range=0..1000), AtLeast=1, AtMost=1, Maximum=1.797693135e+308, Minimum=-1.797693135e+308, TreeAccess=False)
doorheight = GetNumber(Slider(200, range=0..1000), AtLeast=1, AtMost=1, Maximum=1.797693135e+308, Minimum=-1.797693135e+308, TreeAccess=False)
floors = GetNumber(filter, AtLeast=1, AtMost=1, Maximum=1.797693135e+308, Minimum=-1.797693135e+308, TreeAccess=False)

series = Series(Start="1", Step=1, Count="2")
dup = DuplicateData(Data="0", Number="4", Order=True)
trim = TrimTree(Tree=series, Depth=1)  # -> graft(Tree)
trim_2 = TrimTree(Tree=dup, Depth=1)
dup_2 = DuplicateData(Data=trim, Number="2", Order=True)  # -> flatten(Data)
merge = Merge(Data1=trim_2, Data2=dup_2)
dup_3 = DuplicateData(Data=merge, Number=floors, Order=True)
trim_3 = TrimTree(Tree=dup_3, Depth=1)
spc = ModelSpecifier(Context="split level", Group=trim_3)  # -> Specifier, Context, Group

# ----
# Local ->
expression = Expression(x=width, Expression="x/100")
expression_2 = Expression(x=floorheight, Expression="x/100")
expression_3 = Expression(x=wallthickness, Expression="x/100")
expression_4 = Expression(x=doorwidth, Expression="x/100")
expression_5 = Expression(x=doorheight, Expression="x/100")
expression_6 = Expression(x=dooroffset, Expression="x/100")

series_2 = Series(Start=0, Step=1, Count=floors)
trim_4 = TrimTree(Tree=series_2, Depth=1)
dup_4 = DuplicateData(Data=graft(trim_4), Number="8", Order=True)
trim_5 = TrimTree(Tree=dup_4, Depth=1)
trim_6 = TrimTree(Tree=trim_5, Depth=1)
spc_2 = ModelSpecifier(Context="floor", Group=trim_6)  # -> Specifier, Context, Group

expression_7 = Expression(x=floors, Expression="x+1")
panel = Panel("""front
right
bottom
left""")
itemindex = ItemIndex(L=panel, I=platform)  # -> i; inputs L: list
# ---------- itemindex: Python ----------
#Component Information
#--------------------------------------------------------------------------------------------
if ghenv.Component.RunCount<2:
    #General
    #--------------------------------------------------------------------------------------------
    __author__ = "Ueli Saluz"
    __version__ = "2022.11.18"
    
    ghenv.Component.Name = "ItemIndex"
    ghenv.Component.NickName = "ItemIndex"
    ghenv.Component.Description = "A better IdemIndex"
    ghenv.Component.Message = "VER 1.0"
    ghenv.Component.Category = "Set"
    ghenv.Component.SubCategory = "List"
    
     #Inputs
    #--------------------------------------------------------------------------------------------
    inputIndex=0
    
    ghenv.Component.Params.Input[inputIndex].Name = "List"
    ghenv.Component.Params.Input[inputIndex].NickName = "L"
    ghenv.Component.Params.Input[inputIndex].Description = "Input1 is..."
    ghenv.Component.Params.Input[inputIndex].Optional = False
    inputIndex+=1
    
    ghenv.Component.Params.Input[inputIndex].Name = "Item"
    ghenv.Component.Params.Input[inputIndex].NickName = "I"
    ghenv.Component.Params.Input[inputIndex].Description = "Input2 is..."
    ghenv.Component.Params.Input[inputIndex].Optional = False
    inputIndex+=1
    
    #Outputs
    #--------------------------------------------------------------------------------------------
    outputIndex=0
    
    ghenv.Component.Params.Output[outputIndex].Name = "Index"
    ghenv.Component.Params.Output[outputIndex].NickName = "i"
    ghenv.Component.Params.Output[outputIndex].Description = "Output1 is..."
    outputIndex+=1

i = L.index(I)
# ---------- end itemindex ----------
int = Integer(expression_7)
multiplication = Multiplication(A=int, B=expression_2)
valueor0 = ValueOr0(value=itemindex)
coreheight = Number(multiplication)
expression_8 = Expression(x=valueor0, Expression="-((x+2)*90)%360")
dom = ConstructDomain(DomainStart=0, DomainEnd=coreheight)
_2d = _2D(x=expression)
box = DomainBox(Base=PlaneXY(0, 0, 0), X=_2d, Y=_2d, Z=dom)
corevolume = Box(box)
debrep = DeconstructBrep(Brep=corevolume)  # -> Faces, Edges, Vertices
trim_7 = TrimTree(Tree=debrep.Faces, Depth=1)
item = ListItem(List=trim_7, Index=0, Wrap=True)  # -> Item, Item1, Item2, Item3, Item4
base = Surface(item.Item4)
explode = Explode(Curve=base, Recursive=True)  # -> Segments, Vertices
trim_8 = TrimTree(Tree=explode.Segments, Depth=1)
join = JoinCurves(Curves=explode.Segments, Preserve=False)
expression_9 = Expression(x=expression, Expression="x/2")
expression_10 = Expression(x=expression_4, Expression="x/2")
trim_9 = TrimTree(Tree=join, Depth=1)
curvepoint = PointOnCurve(trim_8, parameter=0.5)
subtraction = Subtraction(A=expression_9, B=expression_10, C=expression_6, D=expression_3)
crv_cp = CurveClosestPoint(Point=curvepoint, Curve=trim_8)  # -> Point, Parameter, Distance
addition = Addition(A=crv_cp.Parameter, B=subtraction)
subtraction_2 = Subtraction(A=crv_cp.Parameter, B=subtraction)
eval = EvaluateCurve(Curve=trim_8, Parameter=addition)  # -> Point, Tangent, Angle
eval_2 = EvaluateCurve(Curve=trim_8, Parameter=subtraction_2)  # -> Point, Tangent, Angle
shift = ShiftList(List=eval_2.Point, Shift=1, Wrap=True)
trim_10 = TrimTree(Tree=shift, Depth=1)
merge_2 = Merge(Data1=graft(eval.Point), Data2=graft(trim_10))

expression_11 = Expression(x=expression_2, Expression="x/3")
lng = ListLength(List=trim_8)
dup_5 = DuplicateData(Data=expression_11, Number=lng, Order=True)
trim_11 = TrimTree(Tree=dup_5, Depth=1)
expression_12 = Expression(x=int, Expression="(x-1)*4")
replace = ReplaceItems(List=trim_11, Item="0", Indices="1", Wrap=False)
repeat = RepeatData(Data=replace, Length=expression_12)
trim_12 = TrimTree(Tree=repeat, Depth=1)
ma = MassAddition(Input=trim_12)  # -> Result, PartialResults
flip = FlipMatrix(Data=ma.PartialResults)
doorheights = Number(flip)
Z = UnitZ(Factor=doorheights)
trim_13 = TrimTree(Tree=Z, Depth=1)
cset = CreateSet(List=trim_13)  # -> Set, graft(Map)
path = ConstructPath(Indices=cset.Map)
trim_14 = TrimTree(Tree=path, Depth=1)

variant = Integer(number_slider)
curdir = CurrentDirectory()  # -> D, P, S
# ---------- curdir: Python ----------
#Component Information
#--------------------------------------------------------------------------------------------
if ghenv.Component.RunCount<2:
    #General
    #--------------------------------------------------------------------------------------------
    __author__ = "Ueli Saluz"
    __version__ = "2023.09.29"
    
    ghenv.Component.Name = "CurrentDirectory"
    ghenv.Component.NickName = "CurDir"
    ghenv.Component.Description = "Current directory of the current grasshopper file."
    ghenv.Component.Message = "VER 1.0"
    ghenv.Component.Category = "Params"
    ghenv.Component.SubCategory = "Util"
    
    #Outputs
    #--------------------------------------------------------------------------------------------
    outputIndex=0
    
    ghenv.Component.Params.Output[outputIndex].Name = "Directory"
    ghenv.Component.Params.Output[outputIndex].NickName = "D"
    ghenv.Component.Params.Output[outputIndex].Description = "Directory of the current grasshopper file."
    outputIndex+=1
    
    ghenv.Component.Params.Output[outputIndex].Name = "Path"
    ghenv.Component.Params.Output[outputIndex].NickName = "P"
    ghenv.Component.Params.Output[outputIndex].Description = "Path of the current grasshopper file."
    outputIndex+=1
    
    ghenv.Component.Params.Output[outputIndex].Name = "Separator"
    ghenv.Component.Params.Output[outputIndex].NickName = "S"
    ghenv.Component.Params.Output[outputIndex].Description = "Separator of the current system."
    outputIndex+=1

#Imports
#--------------------------------------------------------------------------------------------
from os.path import dirname
from os import sep

#Solver - Run with trees to enhance performance drastically
#--------------------------------------------------------------------------------------------
if __name__ == "__main__":
    P = ghenv.Component.OnPingDocument().FilePath
    D = dirname(P)
    S = sep
# ---------- end curdir ----------
expression_13 = Expression(x=variant, Expression="x+1")
concat = Concatenate(
    FragmentC="representations",
    FragmentD=curdir.S,
    FragmentA="shaft",
    FragmentB="_",
    FragmentE=expression_13,
    FragmentF="_")
concat_2 = Concatenate(FragmentA=concat, FragmentE="1to500", FragmentG="_", FragmentF="volume")
concat_3 = Concatenate(FragmentA=concat, FragmentE="1to200", FragmentG="_", FragmentF="volume")
concat_4 = Concatenate(FragmentA=concat_2, FragmentB=".3dm")
concat_5 = Concatenate(FragmentA=concat_3, FragmentB=".3dm")
rep = ModelRepresentation(Url=concat_4, LevelOfDetail="1to500", Tags="volume")  # -> Representation, Url, LevelOfDetail, Tags
rep_2 = ModelRepresentation(Url=concat_5, LevelOfDetail="1to200", Tags="volume")  # -> Representation, Url, LevelOfDetail, Tags

merge_3 = Merge(
    Data1=expression,
    Data2=floors,
    Data3=expression_2,
    Data4=platform,
    Data5=expression_4,
    Data6=expression_5,
    Data7=expression_6)
panel_2 = Panel("""width
storeys
floor height
platform
door width
door height
door offset""")
panel_3 = Panel(merge_3)
panel_4 = Panel("""m

m

m
m
m""")
qlt = ModelQuality(Name=panel_2, Value=panel_3, Unit=panel_4)  # -> Quality, Name, Value, Unit

slab_thickness = Number(Slider(20, range=0..100))
expression_14 = Expression(x=slab_thickness, Expression="x/100")

l2o = List2Object(L=merge_2)  # -> O; inputs L: tree
# ---------- l2o: Python ----------
#Component Information
#--------------------------------------------------------------------------------------------
if ghenv.Component.RunCount<2:
    #General
    #--------------------------------------------------------------------------------------------
    __author__ = "Ueli Saluz"
    __version__ = "2022.04.24"
    
    ghenv.Component.Name = "List2Object"
    ghenv.Component.NickName = "L2O"
    ghenv.Component.Description = "Wraps a list of objects into a list object."
    ghenv.Component.Message = "VER 1.0"
    ghenv.Component.Category = "Sets"
    ghenv.Component.SubCategory = "Tree"
    
     #Inputs
    #--------------------------------------------------------------------------------------------
    inputIndex=0
    
    ghenv.Component.Params.Input[inputIndex].Name = "List"
    ghenv.Component.Params.Input[inputIndex].NickName = "L"
    ghenv.Component.Params.Input[inputIndex].Description = "Tree with lists to wrap."
    ghenv.Component.Params.Input[inputIndex].Optional = False
    inputIndex+=1
    

    #Outputs
    #--------------------------------------------------------------------------------------------
    outputIndex=0
    
    ghenv.Component.Params.Output[outputIndex].Name =  "ListObject" 
    ghenv.Component.Params.Output[outputIndex].NickName = "O"
    ghenv.Component.Params.Output[outputIndex].Description = "Python list object as single item."
    outputIndex+=1


#Imports
#--------------------------------------------------------------------------------------------
from System import Object
from Grasshopper import DataTree

#Solver - Run with trees to enhance performance drastically
#--------------------------------------------------------------------------------------------
if __name__ == "__main__":
    
    #Initialize trees
    #--------------------------------------------------------------------------------------------
    TreeToWrap = DataTree[Object]()
    
    #Data matching
    #--------------------------------------------------------------------------------------------
    for path in L.Paths:
        listBranch = L.Branch(path)
        TreeToWrap.Add(listBranch,path)
    
     #Assign trees to output
    #--------------------------------------------------------------------------------------------
    O = TreeToWrap
# ---------- end l2o ----------
trim_15 = TrimTree(Tree=l2o, Depth=1)
repeat_2 = RepeatData(Data=trim_15, Length=expression_12)
trim_16 = TrimTree(Tree=repeat_2, Depth=1)
o2l = Object2List(O=trim_16)  # -> L; inputs O: tree
# ---------- o2l: Python ----------
#Component Information
#--------------------------------------------------------------------------------------------
if ghenv.Component.RunCount<2:
    #General
    #--------------------------------------------------------------------------------------------
    __author__ = "Ueli Saluz"
    __version__ = "2022.04.24"
    
    ghenv.Component.Name = "Object2List"
    ghenv.Component.NickName = "O2L"
    ghenv.Component.Description = "Unwraps a list of objects into a list object."
    ghenv.Component.Message = "VER 1.0"
    ghenv.Component.Category = "Sets"
    ghenv.Component.SubCategory = "Tree"
    
     #Inputs
    #--------------------------------------------------------------------------------------------
    inputIndex=0
    
    ghenv.Component.Params.Input[inputIndex].Name = "ListObject"
    ghenv.Component.Params.Input[inputIndex].NickName = "O"
    ghenv.Component.Params.Input[inputIndex].Description = "A python list object that will be unwrapped into a Grasshopper list."
    ghenv.Component.Params.Input[inputIndex].Optional = False
    inputIndex+=1
    

    #Outputs
    #--------------------------------------------------------------------------------------------
    outputIndex=0
    
    ghenv.Component.Params.Output[outputIndex].Name =  "List"
    ghenv.Component.Params.Output[outputIndex].NickName = "L"
    ghenv.Component.Params.Output[outputIndex].Description = "The unwrapped list."
    outputIndex+=1


#Imports
#--------------------------------------------------------------------------------------------
from System import Object
from Grasshopper import DataTree

#Solver - Run with trees to enhance performance drastically
#--------------------------------------------------------------------------------------------
if __name__ == "__main__":
    
    #Initialize trees
    #--------------------------------------------------------------------------------------------
    OriginalTree = DataTree[Object]()
    
    #Data matching
    #--------------------------------------------------------------------------------------------
    for path in O.Paths:
        listBranch = O.Branch(path)
        for i,listItem in enumerate(listBranch):
            OriginalTree.AddRange(list(listItem),path.AppendElement(i))
    
     #Assign trees to output
    #--------------------------------------------------------------------------------------------
    L = OriginalTree
# ---------- end o2l ----------
match = MatchTree(Tree=Z, Guide=o2l)
move = Move(Geometry=o2l, Motion=match)  # -> Geometry, Transform
crv_cp_2 = CurveClosestPoint(Point=move.Geometry, Curve=trim_9)  # -> Point, Parameter, Distance
eval_3 = EvaluateCurve(Curve=trim_9, Parameter=crv_cp_2.Parameter)  # -> Point, Tangent, Angle
rev = Reverse(Vector=eval_3.Tangent)
line = LineSDL(Start=eval_3.Point, Direction=Vector(0, 0, 1), Length=1)
vrot = Rotate(Vector=rev, Axis=line, Angle=degrees("90"))
pl = ConstructPlane(Origin=eval_3.Point, XAxis=rev, YAxis=vrot)
move_2 = Move(Geometry=pl, Motion=Z)  # -> Geometry, Transform
rotate = Rotate(Geometry=move_2.Geometry, Angle=degrees(expression_8), Plane=PlaneXY(0, 0, 0))  # -> Geometry, Transform
neg = Negative(Value=expression_11)
relblbrch = RelabelBranches(TreeToMatch=rotate.Geometry, ListOfPaths=trim_14)  # -> RelabeledTree; inputs TreeToMatch: tree, ListOfPaths: list
# ---------- relblbrch: Python ----------
if ghenv.Component.RunCount<2:
    __author__ = "Your name"
    __version__ = "2000.00.00"
    
    ghenv.Component.Name = "RelabelBranches"
    ghenv.Component.NickName = "ReLblBrch"
    ghenv.Component.Description = "Relabel all the paths of the branches with a list of new paths. The amount of branches must match with the size of the list of pahts"
    ghenv.Component.Message = "VER 1.0"
    
    ghenv.Component.Params.Input[0].NickName = "TreeToMatch"
    ghenv.Component.Params.Input[1].NickName = "ListOfPaths"
    
    ghenv.Component.Params.Input[0].Description = "Tree that should be relabeled."
    ghenv.Component.Params.Input[1].Description = "List of paths to use for new branch paths."
    
    ghenv.Component.Params.Output[0].NickName = "RelabeledTree"
    ghenv.Component.Params.Output[0].Description = "Relabeled tree where all the paths of the branches have been replaced with new paths."

from System import Object
from Grasshopper import DataTree

def relabelBranchesWithLstOfPths (tree, paths):
    newTree = DataTree[Object]()
    for i,path in enumerate(tree.Paths):
        items = tree.Branch(path)
        for data in items:
            newTree.Add(data,paths[i])
    return newTree

if __name__ == "__main__":
    RelabeledTree = relabelBranchesWithLstOfPths(TreeToMatch,ListOfPaths)
# ---------- end relblbrch ----------
addition_2 = Addition(A=neg, B=expression_14)
Z_2 = UnitZ(Factor=addition_2)
move_3 = Move(Geometry=relblbrch, Motion=Z_2)  # -> Geometry, Transform
entranceplanes = Plane(move_3.Geometry)

# ----
# Outputs   ->
#                 |
#                 v
panel_5 = Panel("2")
series_3 = Series(Start=0, Step=1, Count="4")
series_4 = Series(Start=0, Step=1, Count=panel_5)
trim_17 = TrimTree(Tree=series_3, Depth=1)
trim_18 = TrimTree(Tree=series_4, Depth=1)
lng_2 = ListLength(List=flatten(entranceplanes))
merge_4 = Merge(Data1=trim_17, Data2=trim_18, Data3=trim_18)
repeat_3 = RepeatData(Data=merge_4, Length=lng_2)
trim_19 = TrimTree(Tree=repeat_3, Depth=1)
spc_3 = ModelSpecifier(Context="door", Group=trim_19)  # -> Specifier, Context, Group

entranceplanes_2 = Plane(flatten(entranceplanes))
merge_5 = Merge(Data1=graft(spc_2.Specifier), Data2=graft(spc.Specifier), Data3=graft(spc_3.Specifier))
por = ModelPort(Plane=graft(entranceplanes_2), Specifiers=merge_5)  # -> flatten(Port), Plane, Specifiers

xy = XYPlane(Origin=Point(0, 0, 0))
Z_3 = UnitZ(Factor=coreheight)
move_4 = Move(Geometry=xy, Motion=Z_3)  # -> Geometry, Transform
por_2 = ModelPort(Plane=xy, Specifiers="bottom")  # -> Port, Plane, Specifiers
por_3 = ModelPort(Plane=move_4.Geometry, Specifiers="top")  # -> Port, Plane, Specifiers

previewplane = PreviewPlane(plane=graft(entranceplanes), axis_length=Slider(0.5, range=0..1))  # -> X_2, Y_2, Z_2
concat_6 = Concatenate(FragmentA=curdir.D, FragmentB=curdir.S, FragmentC=rep.Url)
merge_6 = Merge(Data1=previewplane.X_2, Data2=previewplane.Y_2, Data3=previewplane.Z_2)

deplane = DeconstructPlane(Plane=entranceplanes)  # -> Origin, XAxis, YAxis, ZAxis
pl_2 = ConstructPlane(Origin=deplane.Origin, XAxis=deplane.XAxis, YAxis=deplane.ZAxis)
_2d_2 = _2D(x=expression_4)
rectangle = Rectangle(Plane=pl_2, XSize=_2d_2, YSize=expression_5, Radius=0)  # -> Rectangle, Length
doors = Rectangle(rectangle.Rectangle)

merge_7 = Merge(Data1=rep.Representation, Data2=rep_2.Representation)
merge_8 = Merge(Data1=por_2.Port, Data2=por_3.Port, Data3=por.Port)

concat_7 = Concatenate(FragmentA="🛗", FragmentB=expression_13)
typ = ModelType(
    Name="Shaft",
    Description="An efficient core with many doors.",
    Icon=concat_7,
    Variant=expression_13,
    Representations=merge_7,
    Ports=merge_8,
    Qualities=qlt.Quality)  # -> Type, Name, Description, Icon, Variant, Unit, Representations, Ports, Qualities

typ_2 = RemoveType(TypeName=typ.Name, TypeVariant=typ.Variant, Run=safe)
or = GateOr(A=safe, B=typ_2)
typ_3 = AddType(Type=typ.Type, Run=or)

typ_4 = SerializeType(Type=typ.Type)
type = Text(typ_4)
context_bake = ContextBake(Geometry=type)

doors_2 = Rectangle(flatten(doors))
corevolume_2 = Box(corevolume)
expression_15 = Expression(x="volume", y=corevolume_2, Expression="x")
merge_9 = Merge(Data1=corevolume_2, Data2=doors_2)
concat_8 = Concatenate(FragmentA=curdir.D, FragmentB=curdir.S, FragmentC=rep_2.Url)

expression_16 = Expression(x="doors", y=doors_2, Expression="x")
merge_10 = Merge(Data1=expression_15, Data2=expression_16)

ef_layer = EleFrontLayer(FullPath=merge_10)  # -> Layer, FullPath, Hidden, Locked, DisplayColour, MaterialName, Linetype, PrintColour, PrintWidth
ef_att = EleFrontAttributes(Layer=ef_layer.Layer)  # -> Attributes, Keys, Values, Name, Layer, ColourSource, DisplayColour, MaterialSource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
baketofile = BakeObjectsToFile(
    FilePath=concat_6,
    Geometry=merge_9,
    Attributes=ef_att.Attributes,
    Bake=safe,
    networkMode=False,
    ValueTable_networkMode=True,
    overwriteMode="Overwrite",
    preset="Safest")
baketofile_2 = BakeObjectsToFile(
    FilePath=concat_8,
    Geometry=merge_9,
    Attributes=ef_att.Attributes,
    Bake=safe,
    networkMode=False,
    ValueTable_networkMode=True,
    overwriteMode="Overwrite",
    preset="Safest")

# ==== cluster _2D
x = ClusterInput()
expression = Expression(x=x, Expression="x/2")
neg = Negative(Value=expression)
dom = ConstructDomain(DomainStart=neg, DomainEnd=expression)
I = ClusterOutput(dom)

# ==== cluster ValueOr0
value = ClusterInput()
value_2 = Number(value)
null = NullItem(Item=value_2)  # -> NullFlags, InvalidFlags, Description
filter = StreamFilter(Gate=null.NullFlags, Stream0=value_2, Stream1="0")
valueor0 = Number(filter)
valueor0_2 = ClusterOutput(valueor0)

# ==== cluster PreviewPlane: Preview a plane with axis colors and naming.
axis_length = ClusterInput()
plane = ClusterInput()
axis_length_2 = Number(axis_length)
plane_2 = Plane(plane)
deplane = DeconstructPlane(Plane=plane_2)  # -> Origin, XAxis, YAxis, ZAxis
line = LineSDL(Start=deplane.Origin, Direction=deplane.YAxis, Length=axis_length_2)
line_2 = LineSDL(Start=deplane.Origin, Direction=deplane.XAxis, Length=axis_length_2)
line_3 = LineSDL(Start=deplane.Origin, Direction=deplane.ZAxis, Length=axis_length_2)
swatch = ColourSwatch(SwatchColor=RGB(235, 52, 79))
swatch_2 = ColourSwatch(SwatchColor=RGB(0, 166, 157))
swatch_3 = ColourSwatch(SwatchColor=RGB(240, 117, 24))
end = EndPoints(Curve=line_2)  # -> Start, End
end_2 = EndPoints(Curve=line)  # -> Start, End
end_3 = EndPoints(Curve=line_3)  # -> Start, End
tag = TextTag(Location=end.End, Text="X", Colour=swatch)
tag_2 = TextTag(Location=end_2.End, Text="Y", Colour=swatch_2)
tag_3 = TextTag(Location=end_3.End, Text="Z", Colour=swatch_3)
preview = CustomPreview(Geometry=line_2, Material=swatch)
preview_2 = CustomPreview(Geometry=line, Material=swatch_2)
preview_3 = CustomPreview(Geometry=line_3, Material=swatch_3)
X = Line(line_2)
Y = Line(line)
Z = Line(line_3)
X_2 = ClusterOutput(X)
Y_2 = ClusterOutput(Y)
Z_2 = ClusterOutput(Z)
