# Grasshopper definition test.gh (Grasshopper 1.0.7)
# plug-ins: Semio.Grasshopper, LunchBox, Pufferfish

number_slider = Slider(32, range=0..1000)
platotetra = PlatonicTetrahedron(Plane=PlaneXY(0, 0, 0), Radius=number_slider, Truncation=0)
debrep = DeconstructBrep(Brep=platotetra)  # -> Faces, Edges, Vertices
trim = TrimTree(Tree=debrep.Faces, Depth=1)
join = BrepJoin(Breps=trim)  # -> Breps, Closed
panel = Panel("""T
T
F
F""")
rot3d = Rotate3D(Geometry=join.Breps, Angle=degrees(Slider(275, range=0..360)), Center="20,20,20", Axis="0.1,0.3,0.5")  # -> Geometry, Transform
scale = Scale(Geometry=rot3d.Geometry, Center=Point(0, 0, 0), Factor=number_slider)  # -> Geometry, Transform
debrep_2 = DeconstructBrep(Brep=scale.Geometry)  # -> Faces, Edges, Vertices
trim_2 = TrimTree(Tree=debrep_2.Faces, Depth=1)
area = Area(Geometry=trim_2)  # -> Area, Centroid
srf_cp = SurfaceClosestPoint(Point=area.Centroid, Surface=trim_2)  # -> Point, UVPoint, Distance
evalsrf = EvaluateSurface(Surface=trim_2, Point=srf_cp.UVPoint)  # -> Point, Normal, UDirection, VDirection, Frame
deplane = DeconstructPlane(Plane=evalsrf.Frame)  # -> Origin, XAxis, YAxis, ZAxis
pl = ConstructPlane(Origin=deplane.Origin, XAxis=deplane.XAxis, YAxis=deplane.ZAxis)
subset = SubList(List=pl, Domain="3", Wrap=True)  # -> List, Index
trim_3 = TrimTree(Tree=subset.List, Depth=1)
dispatch = Dispatch(List=trim_3, DispatchPattern=panel)  # -> ListA, ListB
pflip = FlipPlane(Plane=dispatch.ListB, ReverseX="T", ReverseY="T", SwapAxes="F")
merge = Merge(Data1=dispatch.ListA, Data2=pflip)
geo = Geometry(scale.Geometry)
pln = Plane(merge)

number_slider_2 = Slider(32, range=0..1000)
box = DomainBox(Base=PlaneXY(0, 0, 0), X=number_slider_2, Y=number_slider_2, Z=number_slider_2)
rot3d_2 = Rotate3D(Geometry=box, Angle=degrees(Slider(129, range=0..360)), Center="20,20,20", Axis="0.1,0.3,0.5")  # -> Geometry, Transform
debrep_3 = DeconstructBrep(Brep=rot3d_2.Geometry)  # -> Faces, Edges, Vertices
panel_2 = Panel("""T
T
F
F""")
trim_4 = TrimTree(Tree=debrep_3.Faces, Depth=1)
join_2 = BrepJoin(Breps=trim_4)  # -> Breps, Closed
scale_2 = Scale(Geometry=join_2.Breps, Center=Point(0, 0, 0), Factor=number_slider_2)  # -> Geometry, Transform
debrep_4 = DeconstructBrep(Brep=scale_2.Geometry)  # -> Faces, Edges, Vertices
trim_5 = TrimTree(Tree=debrep_4.Faces, Depth=1)
evalsrf_2 = EvaluateSurface(Surface=reparameterize(trim_5), Point="0.5,0.5")  # -> Point, Normal, UDirection, VDirection, Frame
deplane_2 = DeconstructPlane(Plane=evalsrf_2.Frame)  # -> Origin, XAxis, YAxis, ZAxis
pl_2 = ConstructPlane(Origin=deplane_2.Origin, XAxis=deplane_2.XAxis, YAxis=deplane_2.ZAxis)
subset_2 = SubList(List=pl_2, Domain="3", Wrap=True)  # -> List, Index
trim_6 = TrimTree(Tree=subset_2.List, Depth=1)
dispatch_2 = Dispatch(List=trim_6, DispatchPattern=panel_2)  # -> ListA, ListB
pflip_2 = FlipPlane(Plane=dispatch_2.ListB, ReverseX="T", ReverseY="T", SwapAxes="F")
merge_2 = Merge(Data1=dispatch_2.ListA, Data2=pflip_2)
pln_2 = Plane(merge_2)
geo_2 = Geometry(scale_2.Geometry)

toggle = BooleanToggle(True)
filter = StreamFilter(Gate=toggle, Stream0=pln, Stream1=pln_2)
filter_2 = StreamFilter(Gate=toggle, Stream0=geo, Stream1=geo_2)
geo_3 = Geometry(filter_2)
pln_3 = Plane(filter)
previewplane = PreviewPlane(plane=pln_3, axis_length=Slider(295, range=0..1000))
preview = CustomPreview(Geometry=geo_3, Material=ColourSwatch(SwatchColor=RGB(84, 99, 94)))
panel_3 = Panel("""q
r
s
t""")
tag = TextTag(Location=pln_3, Text=panel_3, Colour=ColourSwatch(SwatchColor=RGB(255, 175, 255)))
spc = ModelSpecifier(Context="side", Group=panel_3)  # -> Specifier, Context, Group
filter_3 = StreamFilter(Gate=toggle, Stream0="tetrahedron", Stream1="box")
pce = ModelPiece(Id="1", TypeName=filter_3)  # -> Piece, Id, TypeName, TypeQualities
pce_2 = ModelPiece(Id="1a", TypeName=filter_3)  # -> Piece, Id, TypeName, TypeQualities
pce_3 = ModelPiece(Id="a", TypeName=filter_3)  # -> Piece, Id, TypeName, TypeQualities
pce_4 = ModelPiece(Id="1a1", TypeName=filter_3)  # -> Piece, Id, TypeName, TypeQualities
pce_5 = ModelPiece(Id="1ab", TypeName=filter_3)  # -> Piece, Id, TypeName, TypeQualities
pce_6 = ModelPiece(Id="1b", TypeName=filter_3)  # -> Piece, Id, TypeName, TypeQualities
pce_7 = ModelPiece(Id="b", TypeName=filter_3)  # -> Piece, Id, TypeName, TypeQualities
pce_8 = ModelPiece(Id="1b1", TypeName=filter_3)  # -> Piece, Id, TypeName, TypeQualities
dir = Directory(D="..\..\examples\metabolism")  # -> AP, Pa
# ---------- dir: Python ----------
#Component Information
#--------------------------------------------------------------------------------------------
if ghenv.Component.RunCount<2:
    #General
    #--------------------------------------------------------------------------------------------
    __author__ = "Ueli Saluz"
    __version__ = "2024.01.30"
    
    ghenv.Component.Name = "Directory"
    ghenv.Component.NickName = "Dir"
    ghenv.Component.Description = "Attributes of a directory."
    ghenv.Component.Message = "VER 1.0"
    ghenv.Component.Category = "Params"
    ghenv.Component.SubCategory = "Util"
    
    #Inputs
    #--------------------------------------------------------------------------------------------
    inputIndex=0
    
    ghenv.Component.Params.Input[inputIndex].Name = "Directory"
    ghenv.Component.Params.Input[inputIndex].NickName = "D"
    ghenv.Component.Params.Input[inputIndex].Description = "Path for a directory"
    inputIndex+=1
    
    #Outputs
    #--------------------------------------------------------------------------------------------
    outputIndex=0
    
    ghenv.Component.Params.Output[outputIndex].Name = "AbsolutePath"
    ghenv.Component.Params.Output[outputIndex].NickName = "AP"
    ghenv.Component.Params.Output[outputIndex].Description = "Absolute path."
    outputIndex+=1
    
    ghenv.Component.Params.Output[outputIndex].Name = "Parent"
    ghenv.Component.Params.Output[outputIndex].NickName = "Pa"
    ghenv.Component.Params.Output[outputIndex].Description = "Parent"
    outputIndex+=1

#Imports
#--------------------------------------------------------------------------------------------
from os.path import dirname, abspath, join
from os import sep, pardir

#Solver - Run with trees to enhance performance drastically
#--------------------------------------------------------------------------------------------
if __name__ == "__main__":
    AP = abspath(D)
    Pa = abspath(join(D, pardir))
# ---------- end dir ----------
curdir = CurrentDirectory()  # -> D, P, S
# ---------- curdir: Python ----------
#Component Information
#--------------------------------------------------------------------------------------------
if ghenv.Component.RunCount<2:
    #General
    #--------------------------------------------------------------------------------------------
    __author__ = "Ueli Saluz"
    __version__ = "2023.09.29"
    
    ghenv.Component.Name = "CurrentDirectory"
    ghenv.Component.NickName = "CurDir"
    ghenv.Component.Description = "Current directory of the current grasshopper file."
    ghenv.Component.Message = "VER 1.0"
    ghenv.Component.Category = "Params"
    ghenv.Component.SubCategory = "Util"
    
    #Outputs
    #--------------------------------------------------------------------------------------------
    outputIndex=0
    
    ghenv.Component.Params.Output[outputIndex].Name = "Directory"
    ghenv.Component.Params.Output[outputIndex].NickName = "D"
    ghenv.Component.Params.Output[outputIndex].Description = "Directory of the current grasshopper file."
    outputIndex+=1
    
    ghenv.Component.Params.Output[outputIndex].Name = "Path"
    ghenv.Component.Params.Output[outputIndex].NickName = "P"
    ghenv.Component.Params.Output[outputIndex].Description = "Path of the current grasshopper file."
    outputIndex+=1
    
    ghenv.Component.Params.Output[outputIndex].Name = "Separator"
    ghenv.Component.Params.Output[outputIndex].NickName = "S"
    ghenv.Component.Params.Output[outputIndex].Description = "Separator of the current system."
    outputIndex+=1

#Imports
#--------------------------------------------------------------------------------------------
from os.path import dirname
from os import sep

#Solver - Run with trees to enhance performance drastically
#--------------------------------------------------------------------------------------------
if __name__ == "__main__":
    P = ghenv.Component.OnPingDocument().FilePath
    D = dirname(P)
    S = sep
# ---------- end curdir ----------
item = ListItem(List=spc.Specifier, Index=0, Wrap=True)  # -> Item, Item1, Item2, Item3
sde = ModelSide(PieceId=pce_2.Id, PieceTypePortSpecifiers=item.Item1)  # -> Side, PieceId, PieceTypePortSpecifiers
sde_2 = ModelSide(PieceId=pce_5.Id, PieceTypePortSpecifiers=item.Item3)  # -> Side, PieceId, PieceTypePortSpecifiers
sde_3 = ModelSide(PieceId=pce_4.Id, PieceTypePortSpecifiers=item.Item1)  # -> Side, PieceId, PieceTypePortSpecifiers
sde_4 = ModelSide(PieceId=pce_3.Id, PieceTypePortSpecifiers=item.Item3)  # -> Side, PieceId, PieceTypePortSpecifiers
sde_5 = ModelSide(PieceId=pce_5.Id, PieceTypePortSpecifiers=item.Item2)  # -> Side, PieceId, PieceTypePortSpecifiers
sde_6 = ModelSide(PieceId=pce_3.Id, PieceTypePortSpecifiers=item.Item)  # -> Side, PieceId, PieceTypePortSpecifiers
atr = ModelAttraction(AttractingSide=sde.Side, AttractedSide=sde_2.Side)  # -> Attraction, AttractingSide, AttractedSide
atr_2 = ModelAttraction(AttractingSide=sde_3.Side, AttractedSide=sde_4.Side)  # -> Attraction, AttractingSide, AttractedSide
atr_3 = ModelAttraction(AttractingSide=sde_5.Side, AttractedSide=sde_6.Side)  # -> Attraction, AttractingSide, AttractedSide
sde_7 = ModelSide(PieceId=pce.Id, PieceTypePortSpecifiers=item.Item2)  # -> Side, PieceId, PieceTypePortSpecifiers
sde_8 = ModelSide(PieceId=pce_2.Id, PieceTypePortSpecifiers=item.Item)  # -> Side, PieceId, PieceTypePortSpecifiers
sde_9 = ModelSide(PieceId=pce.Id, PieceTypePortSpecifiers=item.Item1)  # -> Side, PieceId, PieceTypePortSpecifiers
sde_10 = ModelSide(PieceId=pce_6.Id, PieceTypePortSpecifiers=item.Item3)  # -> Side, PieceId, PieceTypePortSpecifiers
sde_11 = ModelSide(PieceId=pce_5.Id, PieceTypePortSpecifiers=item.Item1)  # -> Side, PieceId, PieceTypePortSpecifiers
sde_12 = ModelSide(PieceId=pce_7.Id, PieceTypePortSpecifiers=item.Item3)  # -> Side, PieceId, PieceTypePortSpecifiers
sde_13 = ModelSide(PieceId=pce_2.Id, PieceTypePortSpecifiers=item.Item2)  # -> Side, PieceId, PieceTypePortSpecifiers
sde_14 = ModelSide(PieceId=pce_4.Id, PieceTypePortSpecifiers=item.Item)  # -> Side, PieceId, PieceTypePortSpecifiers
sde_15 = ModelSide(PieceId=pce_6.Id, PieceTypePortSpecifiers=item.Item2)  # -> Side, PieceId, PieceTypePortSpecifiers
sde_16 = ModelSide(PieceId=pce_5.Id, PieceTypePortSpecifiers=item.Item)  # -> Side, PieceId, PieceTypePortSpecifiers
sde_17 = ModelSide(PieceId=pce_8.Id, PieceTypePortSpecifiers=item.Item2)  # -> Side, PieceId, PieceTypePortSpecifiers
sde_18 = ModelSide(PieceId=pce_7.Id, PieceTypePortSpecifiers=item.Item)  # -> Side, PieceId, PieceTypePortSpecifiers
sde_19 = ModelSide(PieceId=pce_6.Id, PieceTypePortSpecifiers=item.Item1)  # -> Side, PieceId, PieceTypePortSpecifiers
sde_20 = ModelSide(PieceId=pce_8.Id, PieceTypePortSpecifiers=item.Item3)  # -> Side, PieceId, PieceTypePortSpecifiers
por = ModelPort(Plane=graft(pln_3), Specifiers=graft(spc.Specifier))  # -> Port, Plane, Specifiers
geo_4 = Geometry(geo_3)
kit = LoadKit(Directory="../../examples/metabolism", Run=Toggle(True))  # -> Name, Explanation, Icon, Url, Types, Formations
concat = Concatenate(FragmentA=filter_3, FragmentB=curdir.S, FragmentC="geometry.3dm")
atr_4 = ModelAttraction(AttractingSide=sde_7.Side, AttractedSide=sde_8.Side)  # -> Attraction, AttractingSide, AttractedSide
atr_5 = ModelAttraction(AttractingSide=sde_9.Side, AttractedSide=sde_10.Side)  # -> Attraction, AttractingSide, AttractedSide
item_2 = ListItem(List=pln_3, Index=0, Wrap=True)  # -> Item, Item1, Item2, Item3
atr_6 = ModelAttraction(AttractingSide=sde_11.Side, AttractedSide=sde_12.Side)  # -> Attraction, AttractingSide, AttractedSide
atr_7 = ModelAttraction(AttractingSide=sde_13.Side, AttractedSide=sde_14.Side)  # -> Attraction, AttractingSide, AttractedSide
atr_8 = ModelAttraction(AttractingSide=sde_15.Side, AttractedSide=sde_16.Side)  # -> Attraction, AttractingSide, AttractedSide
atr_9 = ModelAttraction(AttractingSide=sde_17.Side, AttractedSide=sde_18.Side)  # -> Attraction, AttractingSide, AttractedSide
atr_10 = ModelAttraction(AttractingSide=sde_19.Side, AttractedSide=sde_20.Side)  # -> Attraction, AttractingSide, AttractedSide
panel_4 = Panel("""q
r
s
t""")
rep = ModelRepresentation(Url=concat)  # -> Representation, Url, LevelOfDetail, Tags
trim_7 = TrimTree(Tree=kit.Types, Depth=1)
trim_8 = TrimTree(Tree=kit.Formations, Depth=1)
item_3 = ListItem(List=trim_8, Index=0, Wrap=True)
trim_9 = TrimTree(Tree=por.Port, Depth=1)
pl2pl = MoveObjectPlaneToPlane(G=geo_4, S=PlaneXY(0, 0, 0), T=item_2.Item)  # -> TG, T; inputs S: Plane, T: Plane
# ---------- pl2pl: Python ----------
#Component Information
#--------------------------------------------------------------------------------------------
if ghenv.Component.RunCount<2:
    #General
    #--------------------------------------------------------------------------------------------
    __author__ = "Ueli Saluz"
    __version__ = "2023.02.12"
    
    ghenv.Component.Name = "MoveObjectPlaneToPlane"
    ghenv.Component.NickName = "Pl2Pl"
    ghenv.Component.Description = "Moves abitrary geometry from a source plane to a target plane."
    ghenv.Component.Message = "VER 1.2"
    ghenv.Component.Category = "Transform"
    ghenv.Component.SubCategory = "Euclidean"
    
     #Inputs
    #--------------------------------------------------------------------------------------------
    inputIndex=0
    
    ghenv.Component.Params.Input[inputIndex].Name = "Geometry"
    ghenv.Component.Params.Input[inputIndex].NickName = "G"
    ghenv.Component.Params.Input[inputIndex].Description = "Geometry to move."
    ghenv.Component.Params.Input[inputIndex].Optional = False
    inputIndex+=1
    
    ghenv.Component.Params.Input[inputIndex].Name = "SourcePlane"
    ghenv.Component.Params.Input[inputIndex].NickName = "S"
    ghenv.Component.Params.Input[inputIndex].Description = "Source plane of object."
    ghenv.Component.Params.Input[inputIndex].Optional = False
    inputIndex+=1
    
    ghenv.Component.Params.Input[inputIndex].Name = "TargetPlane"
    ghenv.Component.Params.Input[inputIndex].NickName = "T"
    ghenv.Component.Params.Input[inputIndex].Description = "Target plane of object."
    ghenv.Component.Params.Input[inputIndex].Optional = False
    inputIndex+=1
    
    #Outputs
    #--------------------------------------------------------------------------------------------
    outputIndex=0
    
    ghenv.Component.Params.Output[outputIndex].Name = "TranslatedGeometry"
    ghenv.Component.Params.Output[outputIndex].NickName = "TG"
    ghenv.Component.Params.Output[outputIndex].Description = "Translated geometry in target plane."
    outputIndex+=1
    
    ghenv.Component.Params.Output[outputIndex].Name = "Trasnform"
    ghenv.Component.Params.Output[outputIndex].NickName = "T"
    ghenv.Component.Params.Output[outputIndex].Description = "Transform describing translation form source to target plane."
    outputIndex+=1


#Imports
#--------------------------------------------------------------------------------------------
import Rhino.Geometry.Transform as trsf

def MvObjPlnToPln (geo,plnObj,plnDest):
    transform = trsf.PlaneToPlane(plnObj,plnDest)
    geo.Transform(transform)
    return (geo,transform)

TG, T = MvObjPlnToPln(G,S,T)
# ---------- end pl2pl ----------
pl2pl_2 = MoveObjectPlaneToPlane(G=geo_4, S=PlaneXY(0, 0, 0), T=item_2.Item2)  # -> TG, T; inputs S: Plane, T: Plane; same code as pl2pl
panel_5 = Panel(item_2.Item)
panel_6 = Panel(item_2.Item2)
typ = Type(Type=trim_7)  # -> Type, Name, Explanation, Icon, Representations, Ports, Qualities
merge_3 = Merge(
    Data1=atr_4.Attraction,
    Data2=atr.Attraction,
    Data3=atr_2.Attraction,
    Data4=atr_3.Attraction,
    Data5=atr_5.Attraction,
    Data6=atr_7.Attraction,
    Data7=atr_6.Attraction,
    Data8=atr_8.Attraction,
    Data9=atr_10.Attraction,
    Data10=atr_9.Attraction)
for = Formation(Formation=item_3)  # -> Formation, Name, Explanation, Icon, Pieces, Attractions, Qualities
panel_7 = Panel(kit.Name)
merge_4 = Merge(
    Data1=pce.Piece,
    Data2=pce_2.Piece,
    Data3=pce_6.Piece,
    Data4=pce_4.Piece,
    Data5=pce_8.Piece,
    Data6=pce_3.Piece,
    Data7=pce_7.Piece,
    Data8=pce_5.Piece)
panel_8 = Panel(kit.Url)
panel_9 = Panel(kit.Explanation)
panel_10 = Panel("../../examples/metabolism2")
typ_2 = ModelType(Name=filter_3, Representations=rep.Representation, Ports=trim_9)  # -> Type, Name, Explanation, Icon, Representations, Ports, Qualities
inverse = InverseTransform(Transform=pl2pl_2.T)
matrix = TransformMatrix(inverse, Digits=3)
typ_3 = Type(Type=trim_7)  # -> Type, Name, Explanation, Icon, Representations, Ports, Qualities
for_2 = Formation(Formation=trim_8)  # -> Formation, Name, Explanation, Icon, Pieces, Attractions, Qualities
matrix_2 = TransformMatrix(pl2pl.T, Digits=3)
for_3 = ModelFormation(Name="formation1", Pieces=merge_4, Attractions=merge_3)  # -> Formation, Name, Explanation, Icon, Pieces, Attractions, Qualities
merge_5 = Merge(Data1=inverse, Data2=pl2pl.T)
rp = Representation(flatten(Tree({0;0}: ["""{
  "url": "shaft/geometry.3dm",
  "lod": "1to100",
  "tags": [
    "simple"
  ]
}"""], {0;1}: ["""{
  "url": "capsules/standard/geometry.3dm",
  "lod": "1to100",
  "tags": [
    "simple"
  ]
}"""], {0;2}: ["""{
  "url": "capsules/mirrored/geometry.3dm",
  "lod": "1to100",
  "tags": [
    "simple"
  ]
}"""])))
xy = XYPlane(Origin=Point(0, 0, 0))
F = Formation([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])
ty = Type([null x3])
panel_11 = Panel(for_2.Explanation)
atr_11 = Attraction(Attraction=for_2.Attractions)  # -> Attraction, AttractingSide, AttractedSide
panel_12 = Panel(for_2.Name)
rep_2 = Representation(Representation=typ_3.Representations)  # -> Representation, Url, LevelOfDetail, Tags
por_2 = Port(Port=typ_3.Ports)  # -> Port, Plane, Specifiers
qlt = Quality(Quality=typ_3.Qualities)  # -> Quality, Name, Value, Unit
pce_9 = Piece(Piece=for_2.Pieces)  # -> Piece, Id, TypeName, TypeQualities
panel_13 = Panel(typ_3.Name)
panel_14 = Panel(typ_3.Explanation)
typ_4 = RemoveType(TypeName=graft(typ.Name), TypeQualities=typ.Qualities, Directory=panel_10, Run=Toggle(False))
mtrans = MassTransform(Transforms=merge_5)  # -> MassTransform, PartialTransforms
transform = Transform(Geometry=xy, Transform=mtrans.MassTransform)
kit_2 = CreateKit(Name="metabolism2", Directory=panel_10, Run=Toggle(False))
kit_3 = DeleteKit(Directory=panel_10, Run=Toggle(False))
typ_5 = AddType(Type=trim_7, Directory=panel_10, Run=Toggle(False))
for_4 = SerializeFormation(Formation=for_3.Formation)
toggle_2 = BooleanToggle(True)
typ_6 = SerializeType(Type=typ_2.Type)
matrix_3 = TransformMatrix(mtrans.MassTransform, Digits=3)
concat_2 = Concatenate(FragmentA="../../examples/", FragmentB="kit1")
panel_15 = Panel(rep_2.Url)
spc_2 = Specifier(Specifier=por_2.Specifiers)  # -> Specifier, Context, Group
panel_16 = Panel(pce_9.Id)
qlt_2 = Quality(Quality=pce_9.TypeQualities)  # -> Quality, Name, Value, Unit
sde_21 = Side(Side=atr_11.AttractingSide)  # -> Side, PieceId, PieceTypePortSpecifiers
sde_22 = Side(Side=atr_11.AttractedSide)  # -> Side, PieceId, PieceTypePortSpecifiers
panel_17 = Panel(qlt.Name)
panel_18 = Panel(transform)
transform_2 = Transform(Geometry=geo_4, Transform=mtrans.MassTransform)
panel_19 = Panel(kit_3)
dectxt = DecodeText(EncodedText=typ_6)
panel_20 = Panel(typ_5)
panel_21 = Panel(typ_4)
dectxt_2 = DecodeText(EncodedText=for_4)
for_5 = RemoveFormation(FormationName=for_3.Name, Directory=concat_2, Run=toggle_2)
kit_4 = CreateKit(Name="kit1", Types=typ_2.Type, Formations=for_3.Formation, Directory=concat_2, Run=Toggle(False))
scn = GetScene(FormationName="formation1", Directory=concat_2, Run=toggle_2)
panel_22 = Panel(spc_2.Context)
panel_23 = Panel(pce_9.TypeName)
panel_24 = Panel(qlt_2.Name)
panel_25 = Panel(dectxt)
for_6 = AddFormation(Formation=item_3, Directory=panel_10, Run=Toggle(False))
panel_26 = Panel(qlt.Value)
for_7 = RemoveFormation(FormationName=for.Name, FormationQualities=for.Qualities, Directory=panel_10, Run=Toggle(False))
kit_5 = LoadKit(Directory=panel_10, Run=Button(ExpressionNormal="True", ExpressionPressed="False"))  # -> Name, Explanation, Icon, Url, Types, Formations
spc_3 = Specifier(Specifier=sde_21.PieceTypePortSpecifiers)  # -> Specifier, Context, Group
typ_7 = RemoveType(TypeName=typ_2.Name, Directory=concat_2, Run=for_5)
panel_27 = Panel(spc_2.Group)
scn_2 = FilterScene(Scene=scn)  # -> Representations, Planes, PiecesIds, ParentsPiecesIds
spc_4 = Specifier(Specifier=sde_22.PieceTypePortSpecifiers)  # -> Specifier, Context, Group
panel_28 = Panel(for_6)
panel_29 = Panel(qlt.Unit)
panel_30 = Panel(kit_5.Types)
panel_31 = Panel(kit_5.Formations)
panel_32 = Panel(qlt_2.Value)
panel_33 = Panel(for_7)
panel_34 = Panel(spc_3.Context)
typ_8 = AddType(Type=typ_2.Type, Directory=concat_2, Run=typ_7)
panel_35 = Panel(por_2.Plane)
panel_36 = Panel(rep_2.LevelOfDetail)
panel_37 = Panel(spc_4.Context)
kit_6 = LoadKit(Directory=concat_2, Run=Toggle(True))  # -> Name, Explanation, Icon, Url, Types, Formations
typ_9 = ModelType(Type=kit_6.Types)  # -> Type, Name, Explanation, Icon, Representations, Ports, Qualities
por_3 = ModelPort(Port=typ_9.Ports)  # -> Port, Plane, Specifiers
subset_3 = SubList(List=scn_2.Planes, Domain=Slider(7, range=0..7), Wrap=True)  # -> List, Index
panel_38 = Panel(pln_3)
panel_39 = Panel(por_3.Plane)
for_8 = AddFormation(Formation=for_3.Formation, Directory=concat_2, Run=typ_8)
panel_40 = Panel(spc_3.Group)
panel_41 = Panel(spc_4.Group)
panel_42 = Panel(rep_2.Tags)
trim_10 = TrimTree(Tree=subset_3.List, Depth=1)
panel_43 = Panel(dectxt_2)
panel_44 = Panel(qlt_2.Unit)
scn_3 = SerializeScene(Scene=scn)
pl2pl_3 = MoveObjectPlaneToPlane(G=geo_3, S=PlaneXY(0, 0, 0), T=trim_10)  # -> TG, T; inputs S: Plane, T: Plane; same code as pl2pl
panel_45 = Panel(sde_21.PieceId)
panel_46 = Panel(sde_22.PieceId)
dectxt_3 = DecodeText(EncodedText=scn_3)
toggle_3 = BooleanToggle(True)
toggle_4 = BooleanToggle(True)
toggle_5 = BooleanToggle(True)
item_4 = ListItem(List=flatten(qlt_2.Quality), Index=0, Wrap=True)
item_5 = ListItem(List=trim_7, Index=0, Wrap=True)
panel_47 = Panel(dectxt_3)
typ_10 = SerializeType(Type=item_5)
qlt_3 = SerializeQuality(Quality=item_4, Run=toggle_3)
for_9 = SerializeFormation(Formation=trim_8)
typ_11 = DeserializeType(Text=typ_10)
qlt_4 = DeserializeQuality(Text=qlt_3)
for_10 = DeserializeFormation(Text=for_9)
for_11 = ModelFormation(Formation=for_10)  # -> Formation, Name, Explanation, Icon, Pieces, Attractions, Qualities
typ_12 = SerializeType(Type=typ_11)
qlt_5 = SerializeQuality(Quality=qlt_4, Run=toggle_3)
pce_10 = ModelPiece(Piece=for_11.Pieces)  # -> Piece, Id, TypeName, TypeQualities
for_12 = SerializeFormation(Formation=for_10)
eq = NAME(t1=qlt_3, t2=qlt_5)  # -> r
# ---------- eq: Python ----------
r = t1==t2
# ---------- end eq ----------
eq_2 = NAME(t1=typ_10, t2=typ_12)  # -> r; same code as eq
eq_3 = NAME(t1=for_9, t2=for_12)  # -> r; same code as eq
panel_48 = Panel(pce_10.TypeQualities)
panel_49 = Panel(eq_2)
panel_50 = Panel(eq)
panel_51 = Panel(eq_3)

# ==== cluster PreviewPlane: Preview a plane with axis colors and naming.
axis_length = ClusterInput()
plane = ClusterInput()
axis_length_2 = Number(axis_length)
plane_2 = Plane(plane)
deplane = DeconstructPlane(Plane=plane_2)  # -> Origin, XAxis, YAxis, ZAxis
line = LineSDL(Start=deplane.Origin, Direction=deplane.YAxis, Length=axis_length_2)
line_2 = LineSDL(Start=deplane.Origin, Direction=deplane.XAxis, Length=axis_length_2)
line_3 = LineSDL(Start=deplane.Origin, Direction=deplane.ZAxis, Length=axis_length_2)
swatch = ColourSwatch(SwatchColor=RGB(235, 52, 79))
swatch_2 = ColourSwatch(SwatchColor=RGB(0, 166, 157))
swatch_3 = ColourSwatch(SwatchColor=RGB(240, 117, 24))
end = EndPoints(Curve=line_2)  # -> Start, End
end_2 = EndPoints(Curve=line)  # -> Start, End
end_3 = EndPoints(Curve=line_3)  # -> Start, End
tag = TextTag(Location=end.End, Text="X", Colour=swatch)
tag_2 = TextTag(Location=end_2.End, Text="Y", Colour=swatch_2)
tag_3 = TextTag(Location=end_3.End, Text="Z", Colour=swatch_3)
preview = CustomPreview(Geometry=line_2, Material=swatch)
preview_2 = CustomPreview(Geometry=line, Material=swatch_2)
preview_3 = CustomPreview(Geometry=line_3, Material=swatch_3)
