# Grasshopper definition base.gh (Grasshopper 1.0.7)
# plug-ins: Semio

image_resource = ImageResource("C:\Git\Studium\PhD\semio\examples\nakagincapsuletower\floorplan.png")
north_not_properly_places = Vector(Vector(0.922262801, -0.3865634823, 0))
# Outputs ->
number_slider = Slider(0.5, range=0..1)
context_not_properly_places = Curve([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])
plot = Curve(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)
pt = ConstructPoint(XCoordinate=0, YCoordinate=0, ZCoordinate=0)
# Parameters:
amp = Amplitude(Vector=north_not_properly_places, Amplitude=Slider(1000, range=0..1000))
list = ValueList({"Front", "Side"}, selected="Front")
list_2 = ValueList({"Back", "Side"}, selected="Back")
pt_2 = ConstructPoint(XCoordinate=0, YCoordinate=0, ZCoordinate=Slider(300, range=0..1000))
pt_3 = ConstructPoint(
    XCoordinate=Slider(84, range=-1000..1000),
    YCoordinate=Slider(51, range=-1000..1000),
    ZCoordinate=Slider(125, range=-1000..1000))
panel = Panel("Bottom")
panel_2 = Panel("Door")
panel_3 = Panel(" ")
panel_4 = Panel("Top")
vdisex = VectorDisplayEx(Point=pt, Vector=amp, Colour=RGB(0, 0, 0), Width=2)
connection_ports = GetString("Side", AtLeast=0, AtMost=1, TreeAccess=False)
connection_bias_corner = GetBoolean(Toggle(False), AtLeast=0, AtMost=1, FalseValue="False", TreeAccess=False, TrueValue="True")
# External
#      |
#      v
length = GetNumber(Slider(420, range=0..1000), AtLeast=1, AtMost=1, Maximum=1.797693135e+308, Minimum=-1.797693135e+308, TreeAccess=False)
connection_point = GetPoint(AtLeast=0, AtMost=1, Realtime=True, TreeAccess=False)
connection_bias_gap = GetNumber(Slider(5, range=0..100), AtLeast=0, AtMost=1, Maximum=1.797693135e+308, Minimum=-1.797693135e+308, TreeAccess=False)
width = GetNumber(Slider(270, range=0..1000), AtLeast=1, AtMost=1, Maximum=1.797693135e+308, Minimum=-1.797693135e+308, TreeAccess=False)
connection_bias_centroid = GetBoolean(Toggle(True), AtLeast=0, AtMost=1, FalseValue="False", TreeAccess=False, TrueValue="True")
height = GetNumber(Slider(250, range=0..1000), AtLeast=1, AtMost=1, Maximum=1.797693135e+308, Minimum=-1.797693135e+308, TreeAccess=False)
sightprotection = GetBoolean(Toggle(False), AtLeast=0, AtMost=1, FalseValue="False", TreeAccess=False, TrueValue="True")
entrance = GetString(list_2, AtLeast=0, AtMost=1, TreeAccess=False)
shellthickness = GetNumber(Slider(20, range=0..100), AtLeast=0, AtMost=1, Maximum=1.797693135e+308, Minimum=-1.797693135e+308, TreeAccess=False)
window = GetString(list, AtLeast=0, AtMost=1, TreeAccess=False)
mirror = GetBoolean(Toggle(False), AtLeast=0, AtMost=1, FalseValue="False", TreeAccess=False, TrueValue="True")
connection_bias_u = GetNumber(Slider(0.5, range=0..1), AtLeast=1, AtMost=1, Maximum=1.797693135e+308, Minimum=-1.797693135e+308, TreeAccess=False)
connection_bias_v = GetNumber(number_slider, AtLeast=1, AtMost=1, Maximum=1.797693135e+308, Minimum=-1.797693135e+308, TreeAccess=False)
and = GateAnd(B=mirror)
panel_5 = Panel("""Front
Side""")
panel_6 = Panel("""Back
Side""")
subtraction = Subtraction(A=height, B=shellthickness)
neg = Negative(Value=shellthickness)
# Local ->
_2d = _2D(x=length)
_2d_2 = _2D(x=width)
pt_4 = ConstructPoint(XCoordinate=connection_bias_u, YCoordinate=connection_bias_v, ZCoordinate=0)
null = NullItem()  # -> NullFlags, InvalidFlags, Description
geo = Geometry()
geo_2 = Geometry()
geo_3 = Geometry()
serialize = Serialize(Input=geo)
serialize_2 = Serialize(Input=geo_2)
serialize_3 = Serialize(Input=geo_3)
filter = StreamFilter(Gate=null.NullFlags)
representation = ConstructRepresentation(Body=serialize, Concepts="Wireframe")
representation_2 = ConstructRepresentation(Body=serialize_2, Concepts="Surfaces")
representation_3 = ConstructRepresentation(Body=serialize_3, Concepts="Detailed")
xy = XYPlane(Origin=Point(0, 0, 0))
pt_5 = Point(filter)
merge = Merge(Data1=representation, Data2=representation_2)
pl2pl = MoveObjectPlaneToPlane(G=pt_5, S=PlaneXY(0, 0, 0), T=xy)  # -> TG; inputs S: Plane, T: Plane
# ---------- pl2pl: Python ----------
#Component Information
#--------------------------------------------------------------------------------------------
if ghenv.Component.RunCount<2:
    #General
    #--------------------------------------------------------------------------------------------
    __author__ = "Ueli Saluz"
    __version__ = "2022.12.10"
    
    ghenv.Component.Name = "MoveObjectPlaneToPlane"
    ghenv.Component.NickName = "Pl2Pl"
    ghenv.Component.Description = "Moves abitrary geometry from a source plane to a target plane."
    ghenv.Component.Message = "VER 1.1"
    ghenv.Component.Category = "Transform"
    ghenv.Component.SubCategory = "Euclidean"
    
     #Inputs
    #--------------------------------------------------------------------------------------------
    inputIndex=0
    
    ghenv.Component.Params.Input[inputIndex].Name = "Geometry"
    ghenv.Component.Params.Input[inputIndex].NickName = "G"
    ghenv.Component.Params.Input[inputIndex].Description = "Geometry to move."
    ghenv.Component.Params.Input[inputIndex].Optional = False
    inputIndex+=1
    
    ghenv.Component.Params.Input[inputIndex].Name = "SourcePlane"
    ghenv.Component.Params.Input[inputIndex].NickName = "S"
    ghenv.Component.Params.Input[inputIndex].Description = "Source plane of object."
    ghenv.Component.Params.Input[inputIndex].Optional = False
    inputIndex+=1
    
    ghenv.Component.Params.Input[inputIndex].Name = "TargetPlane"
    ghenv.Component.Params.Input[inputIndex].NickName = "T"
    ghenv.Component.Params.Input[inputIndex].Description = "Target plane of object."
    ghenv.Component.Params.Input[inputIndex].Optional = False
    inputIndex+=1
    
    #Outputs
    #--------------------------------------------------------------------------------------------
    outputIndex=0
    
    ghenv.Component.Params.Output[outputIndex].Name = "TranslatedGeometry"
    ghenv.Component.Params.Output[outputIndex].NickName = "TG"
    ghenv.Component.Params.Output[outputIndex].Description = "Translated geometry in target plane."
    outputIndex+=1


#Imports
#--------------------------------------------------------------------------------------------
import Rhino.Geometry.Transform as trsf

def MvObjPlnToPln (geo,plnObj,plnDest):
    geo.Transform(trsf.PlaneToPlane(plnObj,plnDest))
    return geo

TG = MvObjPlnToPln(G,S,T)
# ---------- end pl2pl ----------
compress = Compress(Input=merge)
connection_point_2 = Point(pl2pl)
panel_7 = Panel(connection_point_2)
representations = Text(compress)
context_bake = ContextBake(CONNECTIONPOINT=connection_point_2)
context_print = ContextPrint(REPRESENTATIONS=representations)

# ==== cluster _2D
x = ClusterInput()
expression = Expression(x=x, Expression="x/2")
neg = Negative(Value=expression)
dom = ConstructDomain(DomainStart=neg, DomainEnd=expression)
I = ClusterOutput(dom)
