# Grasshopper definition nakagincapsuletower.gh (Grasshopper 1.0.7)
# plug-ins: Semio, Swiftlet

panel = Panel("C:\Git\Studium\PhD\semio\examples\nakagincapsuletower")
list = ValueList({"Front", "Side"}, selected="Front")
list_2 = ValueList({"Back", "Side"}, selected="Side")
parameter = ConstructParameter(Name="Length", Value=Slider(420, range=0..1000))
parameter_2 = ConstructParameter(Name="Width", Value=Slider(270, range=0..1000))
parameter_3 = ConstructParameter(Name="Height", Value=Slider(275, range=0..1000))
parameter_4 = ConstructParameter(Name="Mirror", Value=Toggle(False))
parameter_5 = ConstructParameter(Name="Entrance", Value=list_2)
parameter_6 = ConstructParameter(Name="Window", Value=list)
panel_2 = Panel("C:\Git\Studium\PhD\semio\examples\nakagincapsuletower\capsule.gh")
list_3 = ValueList({"Back", "Side"}, selected="Side")
number_slider = Slider(300, range=0..1000)
list_4 = ValueList({"Back", "Side"}, selected="Back")
parameter_7 = ConstructParameter(Name="Length", Value=Slider(440, range=0..1000))
parameter_8 = ConstructParameter(Name="Entrance", Value=list_3)
list_5 = ValueList({"Front", "Side"}, selected="Front")
capsules = Integer(Slider(5, range=0..10))
concat = Concatenate(FragmentA=panel, FragmentB="\", FragmentC="base.gh")
concat_2 = Concatenate(FragmentA=panel, FragmentB="\", FragmentC="shaft.gh")
concat_3 = Concatenate(FragmentA=panel, FragmentB="\", FragmentC="head.gh")
concat_4 = Concatenate(FragmentA=panel, FragmentB="\", FragmentC="capsule.gh")
dup = DuplicateData(Data=concat_4, Number=capsules, Order=True)
trim = TrimTree(Tree=dup, Depth=1)
parameter_9 = ConstructParameter(Name="Entrance", Value=list_4)
xy = XYPlane(Origin=Point(0, 0, 0))
Z = UnitZ(Factor=number_slider)
X = UnitX(Factor=number_slider)
merge = Merge(Data1=parameter_7, Data3=parameter_8)
parameter_10 = ConstructParameter(Name="Window", Value=list_5)
parameter_11 = ConstructParameter(Name="Mirror", Value=Toggle(True))
dup_2 = DuplicateData(Data=concat_4, Number=capsules, Order=True)
arrlinear = LinearArray(Geometry=xy, Direction=X, Count=capsules)  # -> Geometry, Transform
plan = ConstructPlan(Url=concat_4, Parameters=merge)  # -> Plan, Hash
merge_2 = Merge(Data1=parameter_9)
merge_3 = Merge(Data1=parameter_11, Data2=parameter_10)
number_slider_2 = Slider(-5, range=-1000..1000)
trim_2 = TrimTree(Tree=dup_2, Depth=1)
trim_3 = TrimTree(Tree=arrlinear.Geometry, Depth=1)
plan_2 = ConstructPlan(Url=trim, Parameters=merge_2)  # -> Plan, Hash
concat_5 = Concatenate(FragmentA=panel, FragmentB="\", FragmentC="bouleenewtoncapsule.gh")
plan_3 = ConstructPlan(Uri=trim_2, Parameters=merge_3)  # -> Plan, Hash
sobject = ConstructSobject(Pose=trim_3, Plan=plan.Plan)
link = ConstructLink(Protocol="Simple")
sobject_2 = ConstructSobject(Plan=concat_2)
sobject_3 = ConstructSobject(Plan=concat)
sobject_4 = ConstructSobject(Plan=plan_3.Plan)
connectable = ConstructConnectable(Sobject=sobject, Link=link)
sobject_5 = ConstructSobject(Plan=plan_2.Plan)
parameter_12 = ConstructParameter(Name="V", Value=Slider(1, range=0..1))
cluster = Cluster(
    X=Slider(-400, range=-1000..1000),
    Y=Slider(10, range=-1000..1000),
    Z=0,
    yaw=Slider(0, range=-360..360),
    pitch=Slider(0, range=-360..360),
    roll=Slider(0, range=-360..360))
shift = ShiftList(List=connectable, Shift="-1", Wrap="False")
shift_2 = ShiftList(List=connectable, Shift=1, Wrap="False")
shift_3 = ShiftList(List=sobject_4, Shift=1, Wrap="False")
shift_4 = ShiftList(List=sobject_4, Shift="-1", Wrap="False")
link_2 = ConstructLink(Ports="Top")
link_3 = ConstructLink(Ports="Bottom")
shift_5 = ShiftList(List=sobject_5, Shift=1, Wrap="False")
item = ListItem(List=sobject_4, Index=0, Wrap=True)
shift_6 = ShiftList(List=sobject_5, Shift="-1", Wrap="False")
link_4 = ConstructLink(Ports="Side")
layout = ConstructLayout(Sobjects=sobject_2, Assembly=sobject_2)
link_5 = ConstructLink(Ports="Side", Bias=parameter_12)
item_2 = ListItem(List=sobject_5, Index=0, Wrap=True)
layout_2 = ConstructLayout(Sobjects=sobject_3, Assembly=sobject_3)
trim_4 = TrimTree(Tree=shift, Depth=1)
trim_5 = TrimTree(Tree=shift_2, Depth=1)
trim_6 = TrimTree(Tree=shift_5, Depth=1)
trim_7 = TrimTree(Tree=shift_3, Depth=1)
trim_8 = TrimTree(Tree=shift_6, Depth=1)
trim_9 = TrimTree(Tree=shift_4, Depth=1)
panel_3 = Panel(sobject_5)
connectable_2 = ConstructConnectable(Sobject=item_2, Link=link_4)
connectable_3 = ConstructConnectable(Sobject=item, Link=link_5)
run = Boolean(Toggle(False))
server = Text("http://localhost:2999")
layout_design = LayoutDesign(Url=server, Layout=layout, Run=Toggle(True))
layout_design_2 = LayoutDesign(Url=server, Layout=layout_2, Run=Toggle(True))
connection = ConstructConnection(Connecting=trim_4, Connected=trim_5)
item_3 = ListItem(List=sobject, Index=0, Wrap=True)
connectable_4 = ConstructConnectable(Sobject=trim_9, Link=link_2)
connectable_5 = ConstructConnectable(Sobject=trim_7, Link=link_3)
merge_4 = Merge(Data1=arrlinear.Geometry)
connectable_6 = ConstructConnectable(Sobject=trim_8, Link=link_2)
connectable_7 = ConstructConnectable(Sobject=trim_6, Link=link_3)
item_4 = ListItem(List=sobject_5, Index=0, Wrap=True)
connection_2 = ConstructConnection(Connecting=connectable_3, Connected=connectable_2)
layout_3 = ConstructLayout(Sobjects=sobject, Connections=connection, Assembly=item_3)
previewplane = PreviewPlane(plane=merge_4, axis_length=Slider(200, range=0..1000))
connection_3 = ConstructConnection(Connecting=connectable_5, Connected=connectable_4)
panel_4 = Panel("Wireframe")
connection_4 = ConstructConnection(Connecting=connectable_7, Connected=connectable_6)
panel_5 = Panel("Detailed")
design = ShowDesign(Design=layout_design_2, Concepts="Detailed")
layout_design_3 = LayoutDesign(Url=server, Layout=layout_3, Run=run)
merge_5 = Merge(Data1=item_2, Data2=item)
merge_6 = Merge(Data1=connection_4, Data2=connection_2, Data3=connection_3)
merge_7 = Merge(Data1=sobject_5, Data2=sobject_4)
design_2 = ShowDesign(Design=layout_design_3, Concepts="Surfaces")
dedesign = DeconstructDesign(Design=layout_design_3)  # -> Prototypes, Elements
layout_4 = ConstructLayout(Sobjects=merge_5, Connections=connection_2, Assembly=item_2)
design_3 = ShowDesign(Design=layout_design, Concepts="Surfaces")
layout_design_4 = LayoutDesign(Url=server, Layout=layout_4, Run=Toggle(False))
deelement = DeconstructElement(Element=dedesign.Elements)  # -> SobjectId, PlanHash, Pose
layout_5 = ConstructLayout(Sobjects=merge_7, Connections=merge_6, Assembly=item_4)
design_4 = ShowDesign(Design=layout_design_4, Concepts="Surfaces")
previewplane_2 = PreviewPlane(plane=deelement.Pose, axis_length=Slider(100, range=0..1000))
layout_design_5 = LayoutDesign(Url=server, Layout=layout_5, Run=Toggle(True))
m2d_rhino = Make2DRhinoView(Name="Perspective", Clip=True)
design_5 = ShowDesign(Design=layout_design_5, Concepts="Surfaces")
number_slider_3 = Slider(0, range=0..1)
make2d = Make2D(Geometry=design_5, View=m2d_rhino, TangentEdges=False, TangentSeams=False, AutoComputeMake2D=False)  # -> VisibleCurves, VisibleIndex, VisibleType, HiddenCurves, HiddenIndex, HiddenType
m2d_parallel = Make2DParallelView()
crv = Curve(make2d.VisibleCurves)
setview = SetView()  # -> F; inputs P: Int32, L: Point3d, D: Vector3d, Up: Vector3d, R: Boolean
#   port P: 0 = Parallel view 1 = Perspective view
# ---------- setview: Python ----------
#Component Information
#--------------------------------------------------------------------------------------------
if ghenv.Component.RunCount<2:
    #General
    #--------------------------------------------------------------------------------------------
    __author__ = "Ueli Saluz"
    __version__ = "2022.05.22"
    
    ghenv.Component.Name = "SetView"
    ghenv.Component.NickName = "SetView"
    ghenv.Component.Description = "Set a camera view and projection."
    ghenv.Component.Message = "VER 1.1"
    ghenv.Component.Category = "Display"
    ghenv.Component.SubCategory = "Camera"
    
     #Inputs
    #--------------------------------------------------------------------------------------------
    inputIndex=0
    
    ghenv.Component.Params.Input[inputIndex].Name = "Name"
    ghenv.Component.Params.Input[inputIndex].NickName = "N"
    ghenv.Component.Params.Input[inputIndex].Description = "Name of the viewport"
    ghenv.Component.Params.Input[inputIndex].Optional = True
    inputIndex+=1
    
    ghenv.Component.Params.Input[inputIndex].Name = "Projection"
    ghenv.Component.Params.Input[inputIndex].NickName = "P"
    ghenv.Component.Params.Input[inputIndex].Description = "0 = Parallel view\n"+\
                                                           "1 = Perspective view"
    ghenv.Component.Params.Input[inputIndex].Optional = True
    inputIndex+=1
    
    
    ghenv.Component.Params.Input[inputIndex].Name = "CameraLocation"
    ghenv.Component.Params.Input[inputIndex].NickName = "L"
    ghenv.Component.Params.Input[inputIndex].Description = "Location of the camera."
    ghenv.Component.Params.Input[inputIndex].Optional = True
    inputIndex+=1
    
    ghenv.Component.Params.Input[inputIndex].Name = "CameraDirection"
    ghenv.Component.Params.Input[inputIndex].NickName = "D"
    ghenv.Component.Params.Input[inputIndex].Description = "Direction of the camera."
    ghenv.Component.Params.Input[inputIndex].Optional = True
    inputIndex+=1
    
    ghenv.Component.Params.Input[inputIndex].Name = "CameraUp"
    ghenv.Component.Params.Input[inputIndex].NickName = "Up"
    ghenv.Component.Params.Input[inputIndex].Description = "Up vector of the camera."
    ghenv.Component.Params.Input[inputIndex].Optional = True
    inputIndex+=1
    
    ghenv.Component.Params.Input[inputIndex].Name = "LensLength"
    ghenv.Component.Params.Input[inputIndex].NickName = "LL"
    ghenv.Component.Params.Input[inputIndex].Description = "Lens length of the camera. Only relevant if projection is perspective."
    ghenv.Component.Params.Input[inputIndex].Optional = True
    inputIndex+=1
    
    ghenv.Component.Params.Input[inputIndex].Name = "Run"
    ghenv.Component.Params.Input[inputIndex].NickName = "R"
    ghenv.Component.Params.Input[inputIndex].Description = "Zoom to the given bounding box."
    ghenv.Component.Params.Input[inputIndex].Optional = False
    inputIndex+=1
    
    #Outputs
    #--------------------------------------------------------------------------------------------
    outputIndex=0
    
    ghenv.Component.Params.Output[outputIndex].Name = "Finished"
    ghenv.Component.Params.Output[outputIndex].NickName = "F"
    ghenv.Component.Params.Output[outputIndex].Description = "Sends True when finished. Just to trigger other depending components."
    outputIndex+=1
    


#Imports
#--------------------------------------------------------------------------------------------
from Rhino import RhinoDoc
from Rhino.Geometry import Box

#Solver - Run with trees to enhance performance drastically
#--------------------------------------------------------------------------------------------
if __name__ == "__main__":
    
    if R:
        if N is not None:
            view = RhinoDoc.ActiveDoc.Views.Find(N, False)
        else:
            view = RhinoDoc.ActiveDoc.Views.ActiveView
        vp = view.ActiveViewport
        if P is not None:
            if (P==0):
                vp.ChangeToParallelProjection(True)
            else:
                vp.ChangeToPerspectiveProjection(True,LL)
        if L is not None:
            vp.SetCameraLocation(L,False)
        if D is not None:
            vp.SetCameraDirection(D,False)
        if Up is not None:
            vp.CameraUp = Up
    F = True
# ---------- end setview ----------
fjs = FormatJsonString(JSONString=sobject)
panel_6 = Panel(fjs)

# ==== cluster Cluster
X = ClusterInput()
Y = ClusterInput()
Z = ClusterInput()
yaw = ClusterInput()
pitch = ClusterInput()
roll = ClusterInput()
yawpitchroll = NAME(yaw=yaw, pitch=pitch, roll=roll)  # -> t
# ---------- yawpitchroll: Python ----------
from Rhino.Geometry import Transform
from math import radians

t = Transform.RotationZYX(radians(yaw),radians(pitch),radians(roll))
# ---------- end yawpitchroll ----------
pt = ConstructPoint(XCoordinate=X, YCoordinate=Y, ZCoordinate=Z)
xy = XYPlane(Origin=Point(0, 0, 0))
transform = Transform(Geometry=xy, Transform=yawpitchroll)
pl_origin = PlaneOrigin(Base=transform, Origin=pt)
pln = Plane(pl_origin)
pln_2 = ClusterOutput(pln)

# ==== cluster PreviewPlane: Preview a plane with axis colors and naming.
axis_length = ClusterInput()
plane = ClusterInput()
axis_length_2 = Number(axis_length)
plane_2 = Plane(plane)
deplane = DeconstructPlane(Plane=plane_2)  # -> Origin, XAxis, YAxis, ZAxis
line = LineSDL(Start=deplane.Origin, Direction=deplane.YAxis, Length=axis_length_2)
line_2 = LineSDL(Start=deplane.Origin, Direction=deplane.XAxis, Length=axis_length_2)
line_3 = LineSDL(Start=deplane.Origin, Direction=deplane.ZAxis, Length=axis_length_2)
swatch = ColourSwatch(SwatchColor=RGB(235, 52, 79))
swatch_2 = ColourSwatch(SwatchColor=RGB(0, 166, 157))
swatch_3 = ColourSwatch(SwatchColor=RGB(240, 117, 24))
end = EndPoints(Curve=line_2)  # -> Start, End
end_2 = EndPoints(Curve=line)  # -> Start, End
end_3 = EndPoints(Curve=line_3)  # -> Start, End
tag = TextTag(Location=end.End, Text="X", Colour=swatch)
tag_2 = TextTag(Location=end_2.End, Text="Y", Colour=swatch_2)
tag_3 = TextTag(Location=end_3.End, Text="Z", Colour=swatch_3)
preview = CustomPreview(Geometry=line_2, Material=swatch)
preview_2 = CustomPreview(Geometry=line, Material=swatch_2)
preview_3 = CustomPreview(Geometry=line_3, Material=swatch_3)
