# Grasshopper definition kit.gh (Grasshopper 1.0.8)
# Copyright: GNU Lesser General Public License Version 3
# plug-ins: RhinoCodePluginGH, Monoceros, semio

list = ValueList({"L_s", "L_b", "|", "⊦", "◞_s", "◞_g", "◟_s", "◟_g"}, selected="L_s")  # disabled
list_2 = ValueList({"L_s", "L_b", "|", "⊦", "◞_s", "◞_g", "◟_s", "◟_g"}, selected="L_b")  # disabled
list_3 = ValueList({"L_s", "L_b", "|", "⊦", "◞_s", "◞_g", "◟_s", "◟_g"}, selected="◟_s")
list_4 = ValueList({"L_s", "L_b", "|", "⊦", "◞_s", "◞_g", "◟_s", "◟_g"}, selected="◟_g")
list_5 = ValueList({"L_s", "L_b", "|", "⊦", "◞_s", "◞_g", "◟_s", "◟_g", "/", "%_s", "%_g"}, selected="%_s")
list_6 = ValueList({"L_s", "L_b", "|", "⊦", "◞_s", "◞_g", "◟_s", "◟_g", "/", "%_s", "%_g"}, selected="%_g")
list_7 = ValueList({"L_s", "L_b", "|", "⊦", "◞_s", "◞_g", "◟_s", "◟_g"}, selected="⊦")
city_part = CityPart_2(variant=list_5)  # -> ty_2, geo_3, volume_2, surfaces_2, building_4, green_3, cars_3, pedestrian_3
city_part_2 = CityPart_2(variant=list_6)  # -> ty_2, geo_3, volume_2, surfaces_2, building_4, green_3, cars_3, pedestrian_3
city_part_3 = CityPart_2(variant=list_7)  # -> ty_2, geo_3, volume_2, surfaces_2, building_4, green_3, cars_3, pedestrian_3
city_part_4 = CityPart(variant=list)  # -> ty_2, geo_3, volume_2, surfaces_2, building_4, green_3, cars_3, pedestrian_3; disabled
city_part_5 = CityPart_2(variant=list_2)  # -> ty_2, geo_3, volume_2, surfaces_2, building_4, green_3, cars_3, pedestrian_3; disabled
city_part_6 = CityPart_2(variant=list_3)  # -> ty_2, geo_3, volume_2, surfaces_2, building_4, green_3, cars_3, pedestrian_3
city_part_7 = CityPart_2(variant=list_4)  # -> ty_2, geo_3, volume_2, surfaces_2, building_4, green_3, cars_3, pedestrian_3
list_8 = ValueList({"L_s", "L_b", "|", "⊦", "◞_s", "◞_g", "◟_s", "◟_g"}, selected="|")
list_9 = ValueList({"L_s", "L_b", "|", "⊦", "◞_s", "◞_g", "◟_s", "◟_g", "/"}, selected="/")
list_10 = ValueList({"L_s", "L_b", "|", "⊦", "◞_s", "◞_g", "◟_s", "◟_g"}, selected="◞_s")
list_11 = ValueList({"L_s", "L_b", "|", "⊦", "◞_s", "◞_g", "◟_s", "◟_g", "/", "⁒_s", "⁒_g"}, selected="◞_g")
city_part_8 = CityPart_2(variant=list_9)  # -> ty_2, geo_3, volume_2, surfaces_2, building_4, green_3, cars_3, pedestrian_3
city_part_9 = CityPart_2(variant=list_10)  # -> ty_2, geo_3, volume_2, surfaces_2, building_4, green_3, cars_3, pedestrian_3
city_part_10 = CityPart_2(variant=list_11)  # -> ty_2, geo_3, volume_2, surfaces_2, building_4, green_3, cars_3, pedestrian_3
city_part_11 = CityPart_2(variant=list_8)  # -> ty_2, geo_3, volume_2, surfaces_2, building_4, green_3, cars_3, pedestrian_3; disabled
mrg_a = MergeSeperatlyAppend(
    x=city_part_4.geo_3,
    y=city_part_5.geo_3,
    v=city_part_9.geo_3,
    w=city_part_10.geo_3,
    s=city_part_6.geo_3,
    t=city_part_7.geo_3,
    xx=city_part_8.geo_3,
    xy=city_part.geo_3,
    xz=city_part_2.geo_3)  # -> Mrgd; inputs x: tree, y: tree, v: tree, w: tree, s: tree, t: tree, xx: tree, xy: tree, xz: tree; same code as mrg_a
merge = Merge(
    Data1=city_part_4.ty_2,
    Data2=city_part_5.ty_2,
    Data3=city_part_11.ty_2,
    Data5=city_part_9.ty_2,
    Data6=city_part_10.ty_2,
    Data7=city_part_6.ty_2,
    Data8=city_part_7.ty_2,
    Data9=city_part_8.ty_2,
    Data10=city_part.ty_2,
    Data11=city_part_2.ty_2)
number_slider = Slider(21, range=0..100)
number_slider_2 = Slider(13, range=0..100)
mods = TypesToModules(ty=merge, ob=mrg_a, D=Vector(1, 1, 1))  # -> M_3, R_3
panel = Panel("100000")
panel_2 = Panel("1000")
ty = Type(merge)
rectangle = Rectangle(Plane=PlaneXY(0, 0, 0), XSize=number_slider_2, YSize=number_slider_2, Radius=0)  # -> Rectangle, Length
S = Slot([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])
layer = ModelLayer()  # -> Layer, Name, Hidden, Locked, DisplayColour, Material, Linetype, PrintColour, PrintWidth
dam = DataDam(DataA=mods.M_3, BufferDelay=10000000, BufferMode=0)
deconmodule = DeconstructModule(Module=flatten(dam))  # -> flatten(ModuleName), ModulePartCenterPoints, Geometry, BasePlane, ModulePartDiagonal, IsCompact, IsValid, Connectors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
srf = Surface(rectangle.Rectangle)
object = ModelObject()  # -> Object, Geometry, Name, Layer, Visibility, Display, Drafting, Render
popslots = PopulateGeometryWithSlotCenters(Geometry=srf, BasePlane=PlaneXY(0, 0, 0), GridSlotDiagonal=Vector(1, 1, 1), Fill=2, Precision=0.5)
Z = UnitZ(Factor="1")
vec = VectorXYZ(XComponent=Slider(0.4, range=-1..1), YComponent=Slider(0.3, range=-1..1), ZComponent=Slider(-1, range=-1..1))  # -> Vector, Length
move = Move(Geometry=popslots, Motion=Z)  # -> Geometry, Transform
pt = ConstructPoint(XCoordinate=0, YCoordinate=0, ZCoordinate="0.5")
xy = XYPlane(Origin=Point(0, 0, 0))
slotall = ConstructSlotWithAllModulesAllowed(SlotPoint=popslots, BasePlane=pt, GridSlotDiagonal=Vector(1, 1, 1))
item = ListItem(List=slotall, Index=0, Wrap=True)
deconslot = DeconstructSlot(Slot=item, ModuleNames=deconmodule.ModuleName)  # -> Center, BasePlane, Diagonal, AllowedModuleNames, IsDeterministic, AllowsAllModules, AllowsNothing, IsValid
item_2 = ListItem(List=deconslot.AllowedModuleNames, Index=0, Wrap=True)  # -> Item, Item1, Item2, Item3
slotmodules = ConstructSlotWithListedModulesAllowed(
    SlotPoint=deconslot.Center,
    BasePlane=deconslot.BasePlane,
    GridSlotDiagonal=deconslot.Diagonal,
    AllowedModuleNames=item_2.Item3,
    Modules=flatten(dam))
replace = ReplaceItems(List=slotall, Item=slotmodules, Indices="0", Wrap=False)
wfc = MonocerosWFCSolver(
    Slots=flatten(replace),
    Modules=flatten(mods.M_3),
    Rules=flatten(mods.R_3),
    RandomSeed=Slider(40, range=0..100),
    MaxAttempts="10000",
    MaxObservations=2147483647,
    MaxTime=0,
    UseShannonEntropy=invert(False))  # -> Out, Slots, Deterministic, Contradictory, Seed, Attempts, Observations; disabled
dam_2 = DataDam(DataA=wfc.Slots, BufferDelay=10000000, BufferMode=0)
S_2 = Slot(dam_2)
deconslot_2 = DeconstructSlot(Slot=S_2)  # -> Center, BasePlane, Diagonal, AllowedModuleNames, IsDeterministic, AllowsAllModules, AllowsNothing, IsValid
txt = Text(deconslot_2.AllowedModuleNames)

pt_2 = ConstructPoint(XCoordinate=0, YCoordinate=0, ZCoordinate=0)
txt_2 = Text(ty)
constmodule = ConstructModule(ModuleName=txt_2, ModulePartPoints=pt_2, BasePlane=PlaneXY(0, 0, 0), ModulePartDiagonal=Vector(1, 1, 1))
deconmodule_2 = DeconstructModule(Module=constmodule)  # -> ModuleName, ModulePartCenterPoints, Geometry, BasePlane, ModulePartDiagonal, IsCompact, IsValid, Connectors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
lng = ListLength(List=ty)
trim = TrimTree(Tree=deconmodule_2.ModuleName, Depth=1)
txt_3 = Text(trim)
series = Series(Start=0, Step=1, Count=lng)
concat = Concatenate(FragmentA=txt_3, FragmentB="↺", FragmentC="90", FragmentD="°", FragmentE="x")
concat_2 = Concatenate(FragmentA=txt_3, FragmentB="↺", FragmentC="90", FragmentD="°", FragmentE="y")
concat_3 = Concatenate(FragmentA=txt_3, FragmentB="↺", FragmentC="90", FragmentD="°", FragmentE="z")
trim_2 = TrimTree(Tree=series, Depth=1)
concat_4 = Concatenate(FragmentA=txt_3, FragmentB="↺", FragmentC="180", FragmentD="°", FragmentE="x")
concat_5 = Concatenate(FragmentA=txt_3, FragmentB="↺", FragmentC="180", FragmentD="°", FragmentE="y")
concat_6 = Concatenate(FragmentA=txt_3, FragmentB="↺", FragmentC="180", FragmentD="°", FragmentE="z")
dup = DuplicateData(Data=graft(trim_2), Number="10", Order=True)
concat_7 = Concatenate(FragmentA=txt_3, FragmentB="↺", FragmentC="270", FragmentD="°", FragmentE="x")
concat_8 = Concatenate(FragmentA=txt_3, FragmentB="↺", FragmentC="270", FragmentD="°", FragmentE="y")
concat_9 = Concatenate(FragmentA=txt_3, FragmentB="↺", FragmentC="270", FragmentD="°", FragmentE="z")
merge_2 = Merge(
    Data1=graft(txt_3),
    Data2=graft(concat),
    Data3=graft(concat_2),
    Data4=graft(concat_3),
    Data5=graft(concat_4),
    Data6=graft(concat_5),
    Data7=graft(concat_6),
    Data8=graft(concat_7),
    Data9=graft(concat_8),
    Data10=graft(concat_9))
trim_3 = TrimTree(Tree=dup, Depth=1)
item_3 = ListItem(List=txt, Index=0, Wrap=True)
trim_4 = TrimTree(Tree=trim_3, Depth=1)
trim_5 = TrimTree(Tree=item_3, Depth=1)
trim_6 = TrimTree(Tree=merge_2, Depth=1)
keysearch = KeyValueSearch(Keys=trim_6, Values=trim_4, Search=trim_5)
expression = Expression(x=trim_5, y=merge_2, Expression="x=y")
item_4 = ListItem(List=ty, Index=keysearch, Wrap=True)
ty_2 = Type(item_4)

materialize = MaterializeSlots(Modules=flatten(dam), Slots=flatten(dam_2))  # -> Geometry, Transform
orient = Orient(Geometry=deconslot_2.Center, Source=PlaneXY(0, 0, 0), Target=deconslot_2.BasePlane)  # -> Geometry, Transform
item_5 = ListItem(List=materialize.Geometry, Index=0, Wrap=True)  # -> Item, Item1, Item2, Item3, Item4
trim_7 = TrimTree(Tree=orient.Geometry, Depth=1)
sunion = SolidUnion(Breps=flatten(item_5.Item))
join = BrepJoin(Breps=flatten(item_5.Item2))  # -> Breps, Closed
join_2 = BrepJoin(Breps=flatten(item_5.Item4))  # -> Breps, Closed
join_3 = BrepJoin(Breps=flatten(item_5.Item1))  # -> Breps, Closed
Z_2 = UnitZ(Factor="0.01")
typ = ModelType(Type=ty_2)  # -> Type, Valid, Name, Description, Icon, Image, Variant, Unit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
swatch = ColourSwatch(SwatchColor=RGBA(0, 17, 23, 128))
fmerge = MergeFaces(Brep=join.Breps)  # -> Breps, Before, After
fmerge_2 = MergeFaces(Brep=sunion)  # -> Breps, Before, After
mshadow = MeshShadow(Mesh=fmerge_2.Breps, Light=vec.Vector, Plane=PlaneXY(0, 0, 0))
runion = RegionUnion(Curves=mshadow)
srf_2 = Surface(flatten(runion))
fmerge_3 = MergeFaces(Brep=join_3.Breps)  # -> Breps, Before, After
fmerge_4 = MergeFaces(Brep=join_2.Breps)  # -> Breps, Before, After
move_2 = Move(Geometry=srf_2, Motion=Z_2)  # -> Geometry, Transform
qal = SelectQuality(ql=typ.Qualities, na="monoceros.module.center")
preview = CustomPreview(Geometry=fmerge_4.Breps, Material=ColourSwatch(SwatchColor=RGB(50, 171, 50)))
preview_2 = CustomPreview(Geometry=move_2.Geometry, Material=ColourSwatch(SwatchColor=RGBA(50, 50, 50, 148)))
geo = PreviewGeometry_2(geo=fmerge_2.Breps)
preview_3 = CustomPreview(Geometry=fmerge_3.Breps, Material=ColourSwatch(SwatchColor=RGBA(0, 17, 23, 64)))
preview_4 = CustomPreview(Geometry=fmerge.Breps, Material=swatch)
qal_2 = ModelQuality(Quality=qal)  # -> Quality, Valid, Name, graft(Value), Unit, Definition
col = Colour("#001117")
merge_3 = Merge(Data1=fmerge.Breps, Data2=fmerge_4.Breps)
xz = XZPlane(Origin=Point(0, 0, 0))
yz = YZPlane(Origin=Point(0, 0, 0))
xy_2 = XYPlane(Origin=Point(0, 0, 0))
transform = Transform(0)
preview_5 = CustomPreview(Geometry=merge_3, Material=swatch)
rotate = Rotate(Angle=degrees("90"), Plane=xy_2)  # -> Geometry, Transform
rotate_2 = Rotate(Angle=degrees("90"), Plane=yz)  # -> Geometry, Transform
rotate_3 = Rotate(Angle=degrees("90"), Plane=xz)  # -> Geometry, Transform
panel_3 = Panel("°")
vec2pt = Vector2Pt(PointA=deconslot_2.Center, PointB=qal_2.Value, Unitize=False)  # -> Vector, Length
lng_2 = ListLength(List=trim_5)
rotate_4 = Rotate(Angle=degrees("180"), Plane=xy_2)  # -> Geometry, Transform
rotate_5 = Rotate(Angle=degrees("180"), Plane=yz)  # -> Geometry, Transform
rotate_6 = Rotate(Angle=degrees("180"), Plane=xz)  # -> Geometry, Transform
series_2 = Series(Start=0, Step=1, Count=lng_2)
rotate_7 = Rotate(Angle=degrees("270"), Plane=xy_2)  # -> Geometry, Transform
rotate_8 = Rotate(Angle=degrees("270"), Plane=yz)  # -> Geometry, Transform
rotate_9 = Rotate(Angle=degrees("270"), Plane=xz)  # -> Geometry, Transform
trim_8 = TrimTree(Tree=series_2, Depth=1)
merge_4 = Merge(
    Data1=graft(transform),
    Data2=graft(rotate_2.Transform),
    Data3=graft(rotate_3.Transform),
    Data4=graft(rotate.Transform),
    Data5=graft(rotate_5.Transform),
    Data6=graft(rotate_6.Transform),
    Data7=graft(rotate_4.Transform),
    Data8=graft(rotate_8.Transform),
    Data9=graft(rotate_9.Transform),
    Data10=graft(rotate_7.Transform))
expression_2 = Expression(x=trim_8, Expression="x%9")
item_6 = ListItem(List=merge_4, Index=expression_2, Wrap=True)
c_script = CSharpScript(X=item_6)  # -> T, R, I; inputs X: Transform
# ---------- c_script: C# ----------
// Grasshopper Script Instance
#region Usings
using System;
using System.Linq;
using System.Collections;
using System.Collections.Generic;
using System.Drawing;

using Rhino;
using Rhino.Geometry;

using Grasshopper;
using Grasshopper.Kernel;
using Grasshopper.Kernel.Data;
using Grasshopper.Kernel.Types;
#endregion

public class Script_Instance : GH_ScriptInstance
{
    #region Notes
    /* 
      Members:
        RhinoDoc RhinoDocument
        GH_Document GrasshopperDocument
        IGH_Component Component
        int Iteration

      Methods (Virtual & overridable):
        Print(string text)
        Print(string format, params object[] args)
        Reflect(object obj)
        Reflect(object obj, string method_name)
    */
    #endregion

    private void RunScript(Transform X, ref object T, ref object R, ref object I)
    {
        var i = new Transform();
        T = X.TryGetInverse(out i);
        var translation = new Vector3d();
        var rotation = new Transform();
        var orthogonal = new Transform();
        var diagonal = new Vector3d();
        X.DecomposeAffine(out translation, out rotation, out orthogonal,out diagonal);
        T = translation;
        R = rotation;
        I = i;
    }
}
# ---------- end c_script ----------
xy_3 = XYPlane(Origin=trim_7)
transform_2 = Transform(Geometry=xy_3, Transform=c_script.R)
panel_4 = Panel(item_6)
pce = ModelPiece(Piece=ty_2, Id=trim_7, Plane=transform_2)  # -> Piece, Valid, Id, Description, TypeName, TypeVariant, Plane, Center, Qualities
dsn = ModelDesign(Pieces=pce.Piece)  # -> Design, Valid, Name, Description, Icon, Image, Variant, View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
dn = Design(dsn.Design)
group = Group(Geometry=mrg_a)
trim_9 = TrimTree(Tree=group, Depth=1)
mrg_a_2 = MergeSeperatlyAppend(x=mrg_a)  # -> Mrgd; inputs x: tree; same code as mrg_a
dsn_2 = ShowDesign(dn=dn, ty=merge, ob=trim_9)
object_2 = ModelObject(trim_9)
geo_2 = PreviewGeometry()

# ==== cluster CityPart
panel = Panel("""L_s
L_b
|
⊦
◞_s
◞_g
◟_s
◟_g
/
%_s
%_g""")
panel_2 = Panel(" street")
brep = Brep(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)
brep_2 = Brep(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)
brep_3 = Brep(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)
# ^                                    ^
#    |                                     |
# <-- Constants    Preview -->
# Parameters    External    Local -->
# <-- Meta               |
#      |                       v
#      v
panel_3 = Panel("g-b")
list = ValueList({"L_s", "L_b", "|", "⊦", "\_s", "\_b"}, selected="L_s")
variant = ClusterInput()
variant_2 = Text(variant)
itemindex = ItemIndex(L=panel, I=variant_2)  # -> i; inputs L: list
# ---------- itemindex: Python ----------
#Component Information
#--------------------------------------------------------------------------------------------
if ghenv.Component.RunCount<2:
    #General
    #--------------------------------------------------------------------------------------------
    __author__ = "Ueli Saluz"
    __version__ = "2022.11.18"
    
    ghenv.Component.Name = "ItemIndex"
    ghenv.Component.NickName = "ItemIndex"
    ghenv.Component.Description = "A better IdemIndex"
    ghenv.Component.Message = "VER 1.0"
    ghenv.Component.Category = "Set"
    ghenv.Component.SubCategory = "List"
    
     #Inputs
    #--------------------------------------------------------------------------------------------
    inputIndex=0
    
    ghenv.Component.Params.Input[inputIndex].Name = "List"
    ghenv.Component.Params.Input[inputIndex].NickName = "L"
    ghenv.Component.Params.Input[inputIndex].Description = "Input1 is..."
    ghenv.Component.Params.Input[inputIndex].Optional = False
    inputIndex+=1
    
    ghenv.Component.Params.Input[inputIndex].Name = "Item"
    ghenv.Component.Params.Input[inputIndex].NickName = "I"
    ghenv.Component.Params.Input[inputIndex].Description = "Input2 is..."
    ghenv.Component.Params.Input[inputIndex].Optional = False
    inputIndex+=1
    
    #Outputs
    #--------------------------------------------------------------------------------------------
    outputIndex=0
    
    ghenv.Component.Params.Output[outputIndex].Name = "Index"
    ghenv.Component.Params.Output[outputIndex].NickName = "i"
    ghenv.Component.Params.Output[outputIndex].Description = "Output1 is..."
    outputIndex+=1

i = L.index(I)
# ---------- end itemindex ----------
width = Number("1")

expression = Expression(x=width, Expression="x/2")
neg = Negative(Value=expression)
dom = ConstructDomain(DomainStart=neg, DomainEnd=expression)
dom_2 = ConstructDomain(DomainStart=neg, DomainEnd=expression)
rectangle = Rectangle(Plane=PlaneXY(0, 0, 0), XSize=dom, YSize=dom_2, Radius=0)  # -> Rectangle, Length
explode = Explode(Curve=rectangle.Rectangle, Recursive=True)  # -> Segments, Vertices
box = DomainBox(Base=PlaneXY(0, 0, 0), X=dom, Y=dom_2, Z=width)
trim = TrimTree(Tree=explode.Segments, Depth=1)
trim_2 = TrimTree(Tree=explode.Vertices, Depth=1)
item = ListItem(List=trim_2, Index=0, Wrap=True)  # -> Item, Item1, Item2
item_2 = ListItem(List=trim, Index=0, Wrap=True)  # -> Item1, Item, Item1_2, Item2
merge = Merge(Data1=item_2.Item1, Data2=item_2.Item)
merge_2 = Merge(Data1=item_2.Item1_2, Data2=item_2.Item2)
join = JoinCurves(Curves=merge, Preserve=False)
join_2 = JoinCurves(Curves=merge_2, Preserve=False)
trim_3 = TrimTree(Tree=join, Depth=1)
trim_4 = TrimTree(Tree=join_2, Depth=1)

car_proportion = Number(Slider(0.1, range=0..1))
pedestrian_proportion = Number(Slider(0.05, range=0..1))
building_width_proportion = Number(Slider(0.5, range=0..1))
addition = Addition(A=car_proportion, B=pedestrian_proportion, C=building_width_proportion)
expression_2 = Expression(x=addition, Expression="1-x")

multiplication = Multiplication(A=width, B=car_proportion)
multiplication_2 = Multiplication(A=width, B=pedestrian_proportion)
multiplication_3 = Multiplication(A=width, B=building_width_proportion)
neg_2 = Negative(Value=multiplication)
neg_3 = Negative(Value=multiplication_2)
neg_4 = Negative(Value=multiplication_3)
offset = OffsetCurve(Curve=item_2.Item1, Distance=neg_2, Corners=1)
trim_5 = TrimTree(Tree=offset, Depth=1)
offset_2 = OffsetCurve(Curve=trim_5, Distance=neg_3, Corners=1)
trim_6 = TrimTree(Tree=offset_2, Depth=1)
offset_3 = OffsetCurve(Curve=trim_6, Distance=neg_4, Corners=1)
trim_7 = TrimTree(Tree=offset_3, Depth=1)
end = EndPoints(Curve=item_2.Item1)  # -> Start, End
end_2 = EndPoints(Curve=trim_5)  # -> Start, End
end_3 = EndPoints(Curve=trim_6)  # -> Start, End
end_4 = EndPoints(Curve=trim_7)  # -> Start, End
end_5 = EndPoints(Curve=item_2.Item1_2)  # -> Start, End
ln = Line(StartPoint=end.Start, EndPoint=end_2.Start)
ln_2 = Line(StartPoint=end_2.Start, EndPoint=end_3.Start)
ln_3 = Line(StartPoint=end_3.Start, EndPoint=end_4.Start)
ln_4 = Line(StartPoint=end_4.Start, EndPoint=end_5.End)
ln_5 = Line(StartPoint=end.End, EndPoint=end_2.End)
ln_6 = Line(StartPoint=end_2.End, EndPoint=end_3.End)
ln_7 = Line(StartPoint=end_3.End, EndPoint=end_4.End)
ln_8 = Line(StartPoint=end_4.End, EndPoint=end_5.Start)
merge_3 = Merge(Data1=item_2.Item1, Data2=ln, Data3=trim_5, Data4=ln_5)
merge_4 = Merge(Data1=trim_5, Data2=ln_2, Data3=trim_6, Data4=ln_6)
merge_5 = Merge(Data1=trim_6, Data2=ln_3, Data3=trim_7, Data4=ln_7)
merge_6 = Merge(Data1=ln_4, Data2=trim_7, Data3=item_2.Item1_2, Data4=ln_8)
join_3 = JoinCurves(Curves=merge_3, Preserve=False)
join_4 = JoinCurves(Curves=merge_4, Preserve=False)
join_5 = JoinCurves(Curves=merge_5, Preserve=False)
join_6 = JoinCurves(Curves=merge_6, Preserve=False)
trim_8 = TrimTree(Tree=join_3, Depth=1)
trim_9 = TrimTree(Tree=join_4, Depth=1)
trim_10 = TrimTree(Tree=join_5, Depth=1)
trim_11 = TrimTree(Tree=join_6, Depth=1)
i_cars = Brep(trim_8)
i_pedestrian = Brep(trim_9)
i_building = Brep(trim_10)
i_backyard = Brep(trim_11)

multiplication_4 = Multiplication(A=width, B=expression_2)
multiplication_5 = Multiplication(A=width, B=building_width_proportion)
multiplication_6 = Multiplication(A=width, B=pedestrian_proportion)
neg_5 = Negative(Value=multiplication_4)
neg_6 = Negative(Value=multiplication_5)
neg_7 = Negative(Value=multiplication_6)
offset_4 = OffsetCurve(Curve=trim_3, Distance=neg_5, Corners=1)
trim_12 = TrimTree(Tree=offset_4, Depth=1)
offset_5 = OffsetCurve(Curve=trim_12, Distance=neg_6, Corners=1)
trim_13 = TrimTree(Tree=offset_5, Depth=1)
offset_6 = OffsetCurve(Curve=trim_13, Distance=neg_7, Corners=1)
trim_14 = TrimTree(Tree=offset_6, Depth=1)
end_6 = EndPoints(Curve=trim_3)  # -> Start, End
end_7 = EndPoints(Curve=trim_12)  # -> Start, End
end_8 = EndPoints(Curve=trim_13)  # -> Start, End
end_9 = EndPoints(Curve=trim_14)  # -> Start, End
end_10 = EndPoints(Curve=item_2.Item1_2)  # -> Start, End
ln_9 = Line(StartPoint=end_6.Start, EndPoint=end_7.Start)
ln_10 = Line(StartPoint=end_7.Start, EndPoint=end_8.Start)
ln_11 = Line(StartPoint=end_8.Start, EndPoint=end_9.Start)
ln_12 = Line(StartPoint=end_9.Start, EndPoint=end_10.End)
ln_13 = Line(StartPoint=end_6.End, EndPoint=end_7.End)
ln_14 = Line(StartPoint=end_7.End, EndPoint=end_8.End)
ln_15 = Line(StartPoint=end_8.End, EndPoint=end_9.End)
ln_16 = Line(StartPoint=end_9.End, EndPoint=end_10.End)
merge_7 = Merge(Data1=trim_3, Data2=ln_9, Data3=trim_12, Data4=ln_13)
merge_8 = Merge(Data1=trim_12, Data2=ln_10, Data3=trim_13, Data4=ln_14)
merge_9 = Merge(Data1=trim_13, Data2=ln_11, Data3=trim_14, Data4=ln_15)
merge_10 = Merge(Data1=ln_12, Data2=trim_14, Data3=ln_16)
join_7 = JoinCurves(Curves=merge_7, Preserve=False)
join_8 = JoinCurves(Curves=merge_8, Preserve=False)
join_9 = JoinCurves(Curves=merge_9, Preserve=False)
join_10 = JoinCurves(Curves=merge_10, Preserve=False)
trim_15 = TrimTree(Tree=join_7, Depth=1)
trim_16 = TrimTree(Tree=join_8, Depth=1)
trim_17 = TrimTree(Tree=join_9, Depth=1)
trim_18 = TrimTree(Tree=join_10, Depth=1)
l_b_building = Brep(trim_16)
l_b_pedestrian = Brep(trim_17)
l_b_cars = Brep(trim_18)
l_b_green = Brep(trim_15)

multiplication_7 = Multiplication(A=width, B=car_proportion)
multiplication_8 = Multiplication(A=width, B=pedestrian_proportion)
multiplication_9 = Multiplication(A=width, B=building_width_proportion)
neg_8 = Negative(Value=multiplication_7)
neg_9 = Negative(Value=multiplication_8)
neg_10 = Negative(Value=multiplication_9)
offset_7 = OffsetCurve(Curve=trim_3, Distance=neg_8, Corners=1)
trim_19 = TrimTree(Tree=offset_7, Depth=1)
offset_8 = OffsetCurve(Curve=trim_19, Distance=neg_9, Corners=1)
trim_20 = TrimTree(Tree=offset_8, Depth=1)
offset_9 = OffsetCurve(Curve=trim_20, Distance=neg_10, Corners=1)
trim_21 = TrimTree(Tree=offset_9, Depth=1)
end_11 = EndPoints(Curve=trim_3)  # -> Start, End
end_12 = EndPoints(Curve=trim_19)  # -> Start, End
end_13 = EndPoints(Curve=trim_20)  # -> Start, End
end_14 = EndPoints(Curve=trim_21)  # -> Start, End
end_15 = EndPoints(Curve=item_2.Item1_2)  # -> Start, End
ln_17 = Line(StartPoint=end_11.Start, EndPoint=end_12.Start)
ln_18 = Line(StartPoint=end_12.Start, EndPoint=end_13.Start)
ln_19 = Line(StartPoint=end_13.Start, EndPoint=end_14.Start)
ln_20 = Line(StartPoint=end_14.Start, EndPoint=end_15.End)
ln_21 = Line(StartPoint=end_11.End, EndPoint=end_12.End)
ln_22 = Line(StartPoint=end_12.End, EndPoint=end_13.End)
ln_23 = Line(StartPoint=end_13.End, EndPoint=end_14.End)
ln_24 = Line(StartPoint=end_14.End, EndPoint=end_15.End)
merge_11 = Merge(Data1=trim_3, Data2=ln_17, Data3=trim_19, Data4=ln_21)
merge_12 = Merge(Data1=trim_19, Data2=ln_18, Data3=trim_20, Data4=ln_22)
merge_13 = Merge(Data1=trim_20, Data2=ln_19, Data3=trim_21, Data4=ln_23)
merge_14 = Merge(Data1=ln_20, Data2=trim_21, Data3=ln_24)
join_11 = JoinCurves(Curves=merge_11, Preserve=False)
join_12 = JoinCurves(Curves=merge_12, Preserve=False)
join_13 = JoinCurves(Curves=merge_13, Preserve=False)
join_14 = JoinCurves(Curves=merge_14, Preserve=False)
trim_22 = TrimTree(Tree=join_11, Depth=1)
trim_23 = TrimTree(Tree=join_12, Depth=1)
trim_24 = TrimTree(Tree=join_13, Depth=1)
trim_25 = TrimTree(Tree=join_14, Depth=1)
l_building = Brep(trim_24)
l_cars = Brep(trim_22)
l_pedestrian = Brep(trim_23)
l_green = Brep(trim_25)

roof_height_percentage = Number(Slider(0.1, range=0..2))
building_height_proportion = Number(Slider(0.4, range=0..2))

multiplication_10 = Multiplication(A=width, B=roof_height_percentage)
multiplication_11 = Multiplication(A=width, B=building_height_proportion)
Z = UnitZ(Factor=multiplication_11)
addition_2 = Addition(A=multiplication_11, B=multiplication_10)
tweencrv = TweenCurve(CurveA=trim_20, CurveB=trim_21, Factor=0.5, BlendType=0)
Z_2 = UnitZ(Factor=addition_2)
move = Move(Geometry=trim_20, Motion=Z)  # -> Geometry, Transform
move_2 = Move(Geometry=trim_21, Motion=Z)  # -> Geometry, Transform
move_3 = Move(Geometry=tweencrv, Motion=Z_2)  # -> Geometry, Transform
merge_15 = Merge(Data1=move.Geometry, Data2=move_3.Geometry)
merge_16 = Merge(Data1=move_2.Geometry, Data2=move_3.Geometry)
loft = Loft(Curves=merge_15, Options={Adjust=False, Closed=False, LoftEnds=0, LoftSimp=0, LoftType=0, Rebuild=10, Refit=0.01})
extr = Extrude(Base=trim_20, Direction=Z)
loft_2 = Loft(Curves=merge_16, Options={Adjust=False, Closed=False, LoftEnds=0, LoftSimp=0, LoftType=0, Rebuild=10, Refit=0.01})
extr_2 = Extrude(Base=trim_21, Direction=Z)
merge_17 = Merge(Data1=l_building, Data2=extr, Data3=loft, Data4=loft_2, Data5=extr_2)
join_15 = BrepJoin(Breps=merge_17)  # -> Breps, Closed
capex = CapHolesEx(Brep=join_15.Breps)  # -> Brep, Caps, Solid
l_s_building = Brep(capex.Brep)

multiplication_12 = Multiplication(A=width, B=roof_height_percentage)
multiplication_13 = Multiplication(A=width, B=building_height_proportion)
Z_3 = UnitZ(Factor=multiplication_13)
addition_3 = Addition(A=multiplication_13, B=multiplication_12)
tweencrv_2 = TweenCurve(CurveA=trim_12, CurveB=trim_13, Factor=0.5, BlendType=0)
Z_4 = UnitZ(Factor=addition_3)
move_4 = Move(Geometry=trim_12, Motion=Z_3)  # -> Geometry, Transform
move_5 = Move(Geometry=trim_13, Motion=Z_3)  # -> Geometry, Transform
move_6 = Move(Geometry=tweencrv_2, Motion=Z_4)  # -> Geometry, Transform
merge_18 = Merge(Data1=move_4.Geometry, Data2=move_6.Geometry)
merge_19 = Merge(Data1=move_5.Geometry, Data2=move_6.Geometry)
loft_3 = Loft(Curves=merge_18, Options={Adjust=False, Closed=False, LoftEnds=0, LoftSimp=0, LoftType=0, Rebuild=10, Refit=0.01})
extr_3 = Extrude(Base=trim_12, Direction=Z_3)
loft_4 = Loft(Curves=merge_19, Options={Adjust=False, Closed=False, LoftEnds=0, LoftSimp=0, LoftType=0, Rebuild=10, Refit=0.01})
extr_4 = Extrude(Base=trim_13, Direction=Z_3)
merge_20 = Merge(Data1=l_b_building, Data2=extr_3, Data3=loft_3, Data4=loft_4, Data5=extr_4)
join_16 = BrepJoin(Breps=merge_20)  # -> Breps, Closed
capex_2 = CapHolesEx(Brep=join_16.Breps)  # -> Brep, Caps, Solid
l_b_building_2 = Brep(capex_2.Brep)

multiplication_14 = Multiplication(A=width, B=roof_height_percentage)
multiplication_15 = Multiplication(A=width, B=building_height_proportion)
Z_5 = UnitZ(Factor=multiplication_15)
addition_4 = Addition(A=multiplication_15, B=multiplication_14)
tweencrv_3 = TweenCurve(CurveA=trim_6, CurveB=trim_7, Factor=0.5, BlendType=0)
Z_6 = UnitZ(Factor=addition_4)
move_7 = Move(Geometry=trim_6, Motion=Z_5)  # -> Geometry, Transform
move_8 = Move(Geometry=trim_7, Motion=Z_5)  # -> Geometry, Transform
move_9 = Move(Geometry=tweencrv_3, Motion=Z_6)  # -> Geometry, Transform
merge_21 = Merge(Data1=move_7.Geometry, Data2=move_9.Geometry)
merge_22 = Merge(Data1=move_8.Geometry, Data2=move_9.Geometry)
loft_5 = Loft(Curves=merge_21, Options={Adjust=False, Closed=False, LoftEnds=0, LoftSimp=0, LoftType=0, Rebuild=10, Refit=0.01})
extr_5 = Extrude(Base=trim_6, Direction=Z_5)
loft_6 = Loft(Curves=merge_22, Options={Adjust=False, Closed=False, LoftEnds=0, LoftSimp=0, LoftType=0, Rebuild=10, Refit=0.01})
extr_6 = Extrude(Base=trim_7, Direction=Z_5)
merge_23 = Merge(Data1=i_building, Data2=extr_5, Data3=loft_5, Data4=loft_6, Data5=extr_6)
join_17 = BrepJoin(Breps=merge_23)  # -> Breps, Closed
capex_3 = CapHolesEx(Brep=join_17.Breps)  # -> Brep, Caps, Solid
i_building_2 = Brep(capex_3.Brep)

street_height_percentage = Number(Slider(0.2, range=0..2))
relay = Relay()
panel_4 = Panel("monoceros.connector.out")
bool = Boolean("F")
bool_2 = Boolean("T")
panel_5 = Panel("False")
merge_24 = Merge(Data1="g-b-s", Data2=" green-building-street", Data3="s-b-g", Data4=bool)
merge_25 = Merge(Data1="s-b-g", Data2=" street-building-green", Data3="g-b-s", Data4=bool)
merge_26 = Merge(Data1="s", Data2=" street-building-green", Data3="s", Data4=bool_2)
merge_27 = Merge(Data1="s-b", Data2=" street-building", Data3="b-s", Data4=bool)
merge_28 = Merge(Data1="b-s", Data2=" building-street", Data3="s-b", Data4=bool)
merge_29 = Merge(Data1="g", Data2=" green", Data3="g", Data4=bool_2)
merge_30 = Merge(Data1=panel_3, Data2=" green-building", Data3="b-g", Data4=bool)
merge_31 = Merge(Data1="b-g", Data2=" building-green", Data3=panel_3, Data4=bool)
qal = ModelQuality(Name=panel_4, Value="True")  # -> Quality, Valid, Name, Value, Unit, Definition
qal_2 = ModelQuality(Name=panel_4, Value="True")  # -> Quality, Valid, Name, Value, Unit, Definition
mrg_a = MergeSeperatlyAppend(x=merge_24, v=merge_25, y=merge_26, z=merge_27, t=merge_28, u=merge_29, w=merge_30, s=merge_31)  # -> Mrgd; inputs x: tree, v: tree, y: tree, z: tree, t: tree, u: tree, w: tree, s: tree
# ---------- mrg_a: Python ----------
if ghenv.Component.RunCount<2:
    __author__ = "Ueli Saluz"
    __version__ = "2020.05.28"
    
    ghenv.Component.Name = "MergeSeperatly(Append)"
    ghenv.Component.NickName = "Mrg(A)"
    ghenv.Component.Description = "Merge inputs seperatly on a new path. Append index of input parameter for distincting."
    ghenv.Component.Message = "VER 1.0"

from System import Object
from Grasshopper import DataTree
from Grasshopper.Kernel import GH_ParamAccess as Access

if __name__ == "__main__":
    Mrgd = DataTree[Object]()
    access = Access()
    
    for input in ghenv.Component.Params.Input:  #set all Inputaccess to Tree Access
        input.Access = access.tree
    
    for i,input in enumerate(ghenv.Component.Params.Input):
        for j,source in enumerate(input.Sources):
            for path in source.VolatileData.Paths:
                Mrgd.AddRange(source.VolatileData[path],path.AppendElement(i))
# ---------- end mrg_a ----------
merge_32 = Merge(Data1=qal.Quality, Data2=qal_2.Quality)
item_3 = ListItem(List=mrg_a, Index=0, Wrap=True)  # -> flatten(Item), flatten(Item1), flatten(Item2), flatten(Item3)

panel_6 = Panel("""1
0
5
0
2
5
4
4
3
4
7""")
item_4 = ListItem(List=panel_6, Index=itemindex, Wrap=True)
item_5 = ListItem(List=item_3.Item, Index=item_4, Wrap=True)
item_6 = ListItem(List=item_3.Item3, Index=item_4, Wrap=True)
replace = ReplaceMembers(Set=item_5, Find=item_3.Item, Replace=item_3.Item2)
item_7 = ListItem(List=item_3.Item1, Index=item_4, Wrap=True)
item_8 = ListItem(List=merge_32, Index=item_6, Wrap=True)
box_2 = EvaluateBox(Box=box, UParameter="1", VParameter="0.5", WParameter=0.5)  # -> Plane, Point, Include
concat = Concatenate(FragmentA="Bottom center of the ", FragmentB="east", FragmentC=item_7, FragmentD=" side.")
X = UnitX(Factor=1)
por = ModelPort(
    Id="e",
    Description=concat,
    Family=item_5,
    CompatibleFamilies=replace,
    Point=box_2.Point,
    Direction=X,
    T="0.25",
    Qualities=item_8)  # -> Port, Valid, Id, Description, Family, CompatibleFamilies, Point, Direction, T, Qualities

panel_7 = Panel("""0
1
0
0
1
0
0
1
7
3
6""")
item_9 = ListItem(List=panel_7, Index=itemindex, Wrap=True)
item_10 = ListItem(List=item_3.Item, Index=item_9, Wrap=True)
item_11 = ListItem(List=item_3.Item3, Index=item_9, Wrap=True)
item_12 = ListItem(List=item_3.Item1, Index=item_9, Wrap=True)
replace_2 = ReplaceMembers(Set=item_10, Find=item_3.Item, Replace=item_3.Item2)
item_13 = ListItem(List=merge_32, Index=item_11, Wrap=True)
box_3 = EvaluateBox(Box=box, UParameter="0.5", VParameter="1", WParameter=0.5)  # -> Plane, Point, Include
concat_2 = Concatenate(FragmentA="Bottom center of the ", FragmentB="north", FragmentC=item_12, FragmentD=" side.")
Y = UnitY(Factor=1)
por_2 = ModelPort(
    Port=box_3.Plane,
    Id="n",
    Description=concat_2,
    Family=item_10,
    CompatibleFamilies=replace_2,
    Direction=Y,
    T="0",
    Qualities=item_13)  # -> Port, Valid, Id, Description, Family, CompatibleFamilies, Point, Direction, T, Qualities

panel_8 = Panel("""2
4
2
0
6
3
2
5
6
4
7""")
item_14 = ListItem(List=panel_8, Index=itemindex, Wrap=True)
item_15 = ListItem(List=item_3.Item, Index=item_14, Wrap=True)
item_16 = ListItem(List=item_3.Item3, Index=item_14, Wrap=True)
replace_3 = ReplaceMembers(Set=item_15, Find=item_3.Item, Replace=item_3.Item2)
item_17 = ListItem(List=item_3.Item1, Index=item_14, Wrap=True)
item_18 = ListItem(List=merge_32, Index=item_16, Wrap=True)
box_4 = EvaluateBox(Box=box, UParameter="0", VParameter="0.5", WParameter=0.5)  # -> Plane, Point, Include
X_2 = UnitX(Factor=1)
rev = Reverse(Vector=X_2)
concat_3 = Concatenate(FragmentA="Bottom center of the ", FragmentB="west", FragmentC=item_17, FragmentD=" side.")
por_3 = ModelPort(
    Id="w",
    Description=concat_3,
    Family=item_15,
    CompatibleFamilies=replace_3,
    Point=box_4.Point,
    Direction=rev,
    T="0.75",
    Qualities=item_18)  # -> Port, Valid, Id, Description, Family, CompatibleFamilies, Point, Direction, T, Qualities

panel_9 = Panel("""2
4
1
0
4
7
3
6
4
3
6""")
item_19 = ListItem(List=panel_9, Index=itemindex, Wrap=True)
item_20 = ListItem(List=item_3.Item3, Index=item_19, Wrap=True)
item_21 = ListItem(List=item_3.Item, Index=item_19, Wrap=True)
replace_4 = ReplaceMembers(Set=item_21, Find=item_3.Item, Replace=item_3.Item2)
item_22 = ListItem(List=item_3.Item1, Index=item_19, Wrap=True)
item_23 = ListItem(List=merge_32, Index=item_20, Wrap=True)
box_5 = EvaluateBox(Box=box, UParameter="0.5", VParameter="0", WParameter=0.5)  # -> Plane, Point, Include
concat_4 = Concatenate(FragmentA="Bottom center of the ", FragmentB="south", FragmentC=item_22, FragmentD=" side.")
Y_2 = UnitY(Factor=1)
rev_2 = Reverse(Vector=Y_2)
por_4 = ModelPort(
    Id="s",
    Description=concat_4,
    Family=item_21,
    CompatibleFamilies=replace_4,
    Point=box_5.Point,
    Direction=rev_2,
    T="0.5",
    Qualities=item_23)  # -> Port, Valid, Id, Description, Family, CompatibleFamilies, Point, Direction, T, Qualities

pt = ConstructPoint(XCoordinate=0, YCoordinate=0, ZCoordinate=expression)
txt = Text(pt)
qal_3 = ModelQuality(Name="monoceros.module.center", Value=txt)  # -> Quality, Valid, Name, Value, Unit, Definition
merge_33 = Merge(Data1=por_2.Port, Data2=por.Port, Data3=por_3.Port, Data4=por_4.Port)
typ = ModelType(Name="City Part", Variant=variant_2, Ports=merge_33, Qualities=qal_3.Quality)  # -> Type, Valid, Name, Description, Icon, Image, Variant, Unit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
prv = PreviewPort(po=typ.Ports, W=2)
ty = Type(typ.Type)
ty_2 = ClusterOutput(ty)

expression_3 = Expression(x=multiplication_9, Expression="x/2")
crv = Curve(reparameterize(trim_7))
ln_25 = Line(StartPoint=item.Item, EndPoint=item.Item2)
neg_11 = Negative(Value=expression_3)
rotate = Rotate(Geometry=i_cars, Angle=degrees("90"), Plane=PlaneXY(0, 0, 0))  # -> Geometry, Transform
mirror = Mirror(Geometry=i_cars, Plane=PlaneYZ(0, 0, 0))  # -> Geometry, Transform
offset_10 = OffsetCurve(Curve=ln_25, Distance=expression_3, Corners=1)  # -> reparameterize(Curve)
offset_11 = OffsetCurve(Curve=ln_25, Distance=neg_11, Corners=1)  # -> reparameterize(Curve)
crv_2 = Curve(reparameterize(trim_6))
rotate_2 = Rotate(Geometry=i_pedestrian, Angle=degrees("90"), Plane=PlaneXY(0, 0, 0))  # -> Geometry, Transform
mirror_2 = Mirror(Geometry=i_pedestrian, Plane=PlaneYZ(0, 0, 0))  # -> Geometry, Transform
mirror_3 = Mirror(Geometry=crv_2, Plane=PlaneYZ(0, 0, 0))  # -> Geometry, Transform
crv_3 = Curve(reparameterize(item_2.Item))
crv_4 = Curve(reparameterize(item_2.Item1))
trim_26 = TrimTree(Tree=offset_11, Depth=1)
mirror_4 = Mirror(Geometry=crv, Plane=PlaneYZ(0, 0, 0))  # -> Geometry, Transform
trim_27 = TrimTree(Tree=offset_10, Depth=1)
merge_34 = Merge(Data1=mirror.Geometry, Data2=rotate.Geometry)
merge_35 = Merge(Data1=mirror_2.Geometry, Data2=rotate_2.Geometry)
llx = LineLine(Line1=trim_26, Line2=crv_4)  # -> ParamA, ParamB, PointA, PointB
llx_2 = LineLine(Line1=trim_26, Line2=mirror_4.Geometry)  # -> ParamA, ParamB, PointA, PointB
llx_3 = LineLine(Line1=trim_27, Line2=mirror_3.Geometry)  # -> ParamA, ParamB, PointA, PointB
llx_4 = LineLine(Line1=trim_27, Line2=crv_3)  # -> ParamA, ParamB, PointA, PointB
runion = RegionUnion(Curves=merge_34)
shatter = Shatter(Curve=crv_3, Parameters=llx_4.ParamB)
runion_2 = RegionUnion(Curves=merge_35)
shatter_2 = Shatter(Curve=mirror_3.Geometry, Parameters=llx_3.ParamB)
dom_3 = ConstructDomain(DomainStart=llx_4.ParamA, DomainEnd=llx_3.ParamA)
shatter_3 = Shatter(Curve=crv_4, Parameters=llx.ParamB)
shatter_4 = Shatter(Curve=mirror_4.Geometry, Parameters=llx_2.ParamB)
dom_4 = ConstructDomain(DomainStart=llx.ParamA, DomainEnd=llx_2.ParamA)
trim_28 = TrimTree(Tree=runion, Depth=1)
trim_29 = TrimTree(Tree=shatter_2, Depth=1)
trim_30 = TrimTree(Tree=shatter, Depth=1)
trim_31 = TrimTree(Tree=shatter_3, Depth=1)
trim_32 = TrimTree(Tree=shatter_4, Depth=1)
trim_33 = TrimTree(Tree=runion_2, Depth=1)
item_24 = ListItem(List=trim_31, Index=0, Wrap=True)  # -> Item, Item1
item_25 = ListItem(List=trim_29, Index=0, Wrap=True)
rdiff = RegionDifference(CurvesA=trim_33, CurvesB=trim_28)
subcrv = SubCurve(BaseCurve=trim_27, Domain=dom_3)
item_26 = ListItem(List=trim_30, Index=0, Wrap=True)
subcrv_2 = SubCurve(BaseCurve=trim_26, Domain=dom_4)
item_27 = ListItem(List=trim_32, Index=0, Wrap=True)
trim_34 = TrimTree(Tree=rdiff, Depth=1)
merge_36 = Merge(Data1=subcrv_2, Data2=item_27)
merge_37 = Merge(Data1=subcrv, Data2=item_25)
join_18 = JoinCurves(Curves=merge_36, Preserve=False)
join_19 = JoinCurves(Curves=merge_37, Preserve=False)
trim_35 = TrimTree(Tree=join_18, Depth=1)
trim_36 = TrimTree(Tree=join_19, Depth=1)
s_cars = Brep(trim_28)

expression_4 = Expression(x=multiplication_9, Expression="x/2")
ln_26 = Line(StartPoint=item.Item, EndPoint=item.Item2)
crv_5 = Curve(reparameterize(item_2.Item))
crv_6 = Curve(reparameterize(item_2.Item1_2))
neg_12 = Negative(Value=expression_4)
offset_12 = OffsetCurve(Curve=ln_26, Distance=expression_4, Corners=1)  # -> reparameterize(Curve)
offset_13 = OffsetCurve(Curve=ln_26, Distance=neg_12, Corners=1)  # -> reparameterize(Curve)
trim_37 = TrimTree(Tree=offset_13, Depth=1)
trim_38 = TrimTree(Tree=offset_12, Depth=1)
llx_5 = LineLine(Line1=trim_38, Line2=crv_5)  # -> ParamA, ParamB, PointA, PointB
llx_6 = LineLine(Line1=trim_38, Line2=crv_6)  # -> ParamA, ParamB, PointA, PointB
xz = XZPlane(Origin=Point(0, 0, 0))
dom_5 = ConstructDomain(DomainStart=llx_5.ParamA, DomainEnd=llx_6.ParamA)
shatter_5 = Shatter(Curve=crv_5, Parameters=llx_5.ParamB)
rotate_3 = Rotate(Geometry=xz, Angle=degrees("-45"), Plane=PlaneXY(0, 0, 0))  # -> Geometry, Transform
rotate_4 = Rotate(Geometry=xz, Angle=degrees("45"), Plane=PlaneXY(0, 0, 0))  # -> Geometry, Transform
subcrv_3 = SubCurve(BaseCurve=trim_38, Domain=dom_5)
trim_39 = TrimTree(Tree=shatter_5, Depth=1)
item_28 = ListItem(List=trim_39, Index=0, Wrap=True)
mirror_5 = Mirror(Geometry=item_28, Plane=rotate_3.Geometry)  # -> Geometry, Transform
mirror_6 = Mirror(Geometry=subcrv_3, Plane=rotate_4.Geometry)  # -> Geometry, Transform
merge_38 = Merge(Data1=item_28, Data2=subcrv_3, Data3=mirror_5.Geometry)
join_20 = JoinCurves(Curves=merge_38, Preserve=False)
trim_40 = TrimTree(Tree=join_20, Depth=1)
mirror_7 = Mirror(Geometry=trim_40, Plane=rotate_4.Geometry)  # -> Geometry, Transform
merge_39 = Merge(Data1=trim_40, Data2=mirror_7.Geometry)
join_21 = JoinCurves(Curves=merge_39, Preserve=False)
trim_41 = TrimTree(Tree=join_21, Depth=1)
rdiff_2 = RegionDifference(CurvesA=rectangle.Rectangle, CurvesB=trim_41)
trim_42 = TrimTree(Tree=rdiff_2, Depth=1)
item_29 = ListItem(List=trim_42, Index=0, Wrap=True)  # -> Item, Item1
rdiff_3 = RegionDifference(CurvesA=item_29.Item1, CurvesB=trim_28)
trim_43 = TrimTree(Tree=rdiff_3, Depth=1)
merge_40 = Merge(Data1=trim_34, Data2=trim_43)
runion_3 = RegionUnion(Curves=merge_40)
trim_44 = TrimTree(Tree=runion_3, Depth=1)
merge_41 = Merge(Data1=trim_28, Data2=trim_44)
runion_4 = RegionUnion(Curves=merge_41)
trim_45 = TrimTree(Tree=runion_4, Depth=1)
rdiff_4 = RegionDifference(CurvesA=trim_41, CurvesB=trim_45)
trim_46 = TrimTree(Tree=rdiff_4, Depth=1)
cars = Brep(trim_28)
pedestrian = Brep(trim_44)
building = Brep(trim_46)
green = Brep(item_29.Item)

merge_42 = Merge(Data1=trim_28, Data2=trim_34)
end_16 = EndPoints(Curve=item_26)  # -> Start, End
end_17 = EndPoints(Curve=item_24.Item1)  # -> Start, End
ln_27 = Line(StartPoint=end_16.End, EndPoint=end_17.Start)
merge_43 = Merge(Data1=item_26, Data2=item_24.Item1, Data3=ln_27)
xz_2 = XZPlane(Origin=Point(0, 0, 0))
rotate_5 = Rotate(Geometry=xz_2, Angle=degrees("45"), Plane=xz_2)  # -> Geometry, Transform
rotate_6 = Rotate(Geometry=xz_2, Angle=degrees("45"), Plane=PlaneXY(0, 0, 0))  # -> Geometry, Transform
join_22 = JoinCurves(Curves=merge_43, Preserve=False)
trim_47 = TrimTree(Tree=join_22, Depth=1)
mirror_8 = Mirror(Geometry=trim_47, Plane=rotate_5.Geometry)  # -> Geometry, Transform
mirror_9 = Mirror(Geometry=merge_42, Plane=rotate_6.Geometry)  # -> Geometry, Transform
merge_44 = Merge(Data1=graft(mirror_9.Geometry), Data2=graft(merge_42))
flip = FlipMatrix(Data=merge_44)
item_30 = ListItem(List=flip, Index=0, Wrap=True)  # -> Item, Item1
trim_48 = TrimTree(Tree=item_30.Item, Depth=1)
trim_49 = TrimTree(Tree=item_30.Item1, Depth=1)
runion_5 = RegionUnion(Curves=trim_48)
runion_6 = RegionUnion(Curves=trim_49)
trim_50 = TrimTree(Tree=runion_5, Depth=1)
trim_51 = TrimTree(Tree=runion_6, Depth=1)
item_31 = ListItem(List=trim_50, Index=0, Wrap=True)  # -> Item, Item1
item_32 = ListItem(List=trim_51, Index=0, Wrap=True)  # -> Item, Item1
srfsplit = SurfaceSplit(Surface=item_31.Item, Curves=item_31.Item1)
mirror_10 = Mirror(Geometry=trim_47, Plane=PlaneYZ(0, 0, 0))  # -> Geometry, Transform
trim_52 = TrimTree(Tree=srfsplit, Depth=1)
null = EmptyStringToNull()  # -> NT; inputs T: tree
# ---------- null: Python ----------
# Component Information
# --------------------------------------------------------------------------------------------
if ghenv.Component.RunCount < 2:
    # General
    # --------------------------------------------------------------------------------------------
    __author__ = "Ueli Saluz"
    __version__ = "2024.08.08"

    ghenv.Component.Name = "EmptyStringToNull"
    ghenv.Component.NickName = "\"\"->Null"
    ghenv.Component.Description = "Replaces empty strings with Null."
    ghenv.Component.Message = "VER 1.1"
    ghenv.Component.Category = "Sets"
    ghenv.Component.SubCategory = "Text"

    # Inputs
    # --------------------------------------------------------------------------------------------
    inputIndex = 0

    ghenv.Component.Params.Input[inputIndex].Name = "String"
    ghenv.Component.Params.Input[inputIndex].NickName = "T"
    ghenv.Component.Params.Input[inputIndex].Description = "Strings that are potentially empty."
    ghenv.Component.Params.Input[inputIndex].Optional = False
    inputIndex += 1

    # Outputs
    # --------------------------------------------------------------------------------------------
    outputIndex = 0

    ghenv.Component.Params.Output[outputIndex].Name = "NullifiedString"
    ghenv.Component.Params.Output[outputIndex].NickName = "NT"
    ghenv.Component.Params.Output[outputIndex].Description = "Original string if not empty, Null otherwise."
    outputIndex += 1

# Imports
# --------------------------------------------------------------------------------------------
from System import Object
from Grasshopper import DataTree

# Solver - Run with trees to enhance performance drastically
# --------------------------------------------------------------------------------------------
if __name__ == "__main__":
    
    # Initialize trees
    # --------------------------------------------------------------------------------------------
    NullifiedStringTree = DataTree[Object]()
    
    # Data matching
    # --------------------------------------------------------------------------------------------
    for path in T.Paths:
        stringBranch = T.Branch(path)
        for i, string in enumerate(stringBranch):
            nullifiedString = string if string != "" else None
            NullifiedStringTree.Add(nullifiedString, path)
    
    # Assign trees to output
    # --------------------------------------------------------------------------------------------
    NT = NullifiedStringTree
# ---------- end null ----------
merge_45 = Merge(Data1=mirror_10.Geometry, Data2=mirror_8.Geometry)
rdiff_5 = RegionDifference(CurvesA=rectangle.Rectangle, CurvesB=merge_45)
trim_53 = TrimTree(Tree=rdiff_5, Depth=1)
item_33 = ListItem(List=trim_52, Index=0, Wrap=True)
s_cars_2 = Brep(item_33)
s_pedestrian = Brep(item_31.Item1)
s_building = Brep(null)
s_green = Brep(null)
g_cars = Brep(null)
g_pedestrian = Brep(null)
g_green = Brep(trim_53)
group = Group(Geometry=merge_45)

g_building = Geometry(group)

expression_5 = Expression(x=multiplication_9, Expression="x/2")
ln_28 = Line(StartPoint=item.Item, EndPoint=item.Item2)
neg_13 = Negative(Value=expression_5)
offset_14 = OffsetCurve(Curve=ln_28, Distance=expression_5, Corners=1)  # -> reparameterize(Curve)
offset_15 = OffsetCurve(Curve=ln_28, Distance=neg_13, Corners=1)  # -> reparameterize(Curve)
crv_7 = Curve(reparameterize(item_2.Item))
crv_8 = Curve(reparameterize(trim_6))
trim_54 = TrimTree(Tree=offset_15, Depth=1)
crv_9 = Curve(reparameterize(item_2.Item1))
crv_10 = Curve(reparameterize(trim_7))
trim_55 = TrimTree(Tree=offset_14, Depth=1)
llx_7 = LineLine(Line1=trim_55, Line2=crv_7)  # -> ParamA, ParamB, PointA, PointB
llx_8 = LineLine(Line1=trim_54, Line2=crv_8)  # -> ParamA, ParamB, PointA, PointB
llx_9 = LineLine(Line1=trim_55, Line2=crv_10)  # -> ParamA, ParamB, PointA, PointB
llx_10 = LineLine(Line1=trim_54, Line2=crv_9)  # -> ParamA, ParamB, PointA, PointB
shatter_6 = Shatter(Curve=crv_7, Parameters=llx_7.ParamB)
shatter_7 = Shatter(Curve=crv_9, Parameters=llx_10.ParamB)
shatter_8 = Shatter(Curve=crv_10, Parameters=llx_9.ParamB)
dom_6 = ConstructDomain(DomainStart=llx_7.ParamA, DomainEnd=llx_9.ParamA)
shatter_9 = Shatter(Curve=crv_8, Parameters=llx_8.ParamB)
dom_7 = ConstructDomain(DomainStart=llx_10.ParamA, DomainEnd=llx_8.ParamA)
trim_56 = TrimTree(Tree=shatter_7, Depth=1)
trim_57 = TrimTree(Tree=shatter_8, Depth=1)
trim_58 = TrimTree(Tree=shatter_6, Depth=1)
trim_59 = TrimTree(Tree=shatter_9, Depth=1)
item_34 = ListItem(List=trim_56, Index=0, Wrap=True)  # -> Item, Item1
subcrv_4 = SubCurve(BaseCurve=trim_55, Domain=dom_6)
item_35 = ListItem(List=trim_58, Index=0, Wrap=True)
item_36 = ListItem(List=trim_57, Index=0, Wrap=True)
subcrv_5 = SubCurve(BaseCurve=trim_54, Domain=dom_7)
item_37 = ListItem(List=trim_59, Index=0, Wrap=True)  # -> Item, Item1
merge_46 = Merge(Data1=subcrv_4, Data2=item_36)
merge_47 = Merge(Data1=subcrv_5, Data2=item_37.Item)
merge_48 = Merge(Data1=item_35, Data2=subcrv_4, Data3=item_36, Data4=ln_3, Data5=item_37.Item, Data6=subcrv_5, Data7=item_34.Item1)
merge_49 = Merge(Data1=i_cars, Data2=i_pedestrian)
join_23 = JoinCurves(Curves=merge_47, Preserve=False)
join_24 = JoinCurves(Curves=merge_46, Preserve=False)
join_25 = JoinCurves(Curves=merge_48, Preserve=False)
runion_7 = RegionUnion(Curves=merge_49)
trim_60 = TrimTree(Tree=join_23, Depth=1)
offset_16 = OffsetCurve(Curve=trim_60, Distance=neg_3, Corners=1)
trim_61 = TrimTree(Tree=offset_16, Depth=1)
clx = CurveLine(Curve=trim_61, Line=item_2.Item1)  # -> Points, Params, Count
trim_62 = TrimTree(Tree=clx.Points, Depth=1)
crv_cp = CurveClosestPoint(Point=trim_62, Curve=item_2.Item1)  # -> Point, Parameter, Distance
trim_63 = TrimTree(Tree=clx.Params, Depth=1)
dom_8 = ConstructDomain(DomainStart=crv_cp.Parameter, DomainEnd=llx_10.ParamB)
subcrv_6 = SubCurve(BaseCurve=trim_61, Domain=trim_63)
subcrv_7 = SubCurve(BaseCurve=item_2.Item1, Domain=crv_cp.Parameter)
subcrv_8 = SubCurve(BaseCurve=item_2.Item1, Domain=dom_8)
merge_50 = Merge(Data1=subcrv_6, Data2=subcrv_7, Data3=ln)
merge_51 = Merge(Data1=subcrv_6, Data2=merge_47, Data3=ln_2, Data4=subcrv_8)
join_26 = JoinCurves(Curves=merge_50, Preserve=False)
join_27 = JoinCurves(Curves=merge_50, Preserve=False)
join_28 = JoinCurves(Curves=merge_51, Preserve=False)
trim_64 = TrimTree(Tree=join_24, Depth=1)
trim_65 = TrimTree(Tree=join_25, Depth=1)
rdiff_6 = RegionDifference(CurvesA=rectangle.Rectangle, CurvesB=trim_65)
trim_66 = TrimTree(Tree=join_26, Depth=1)
trim_67 = TrimTree(Tree=join_27, Depth=1)
trim_68 = TrimTree(Tree=join_28, Depth=1)
trim_69 = TrimTree(Tree=rdiff_6, Depth=1)
item_38 = ListItem(List=trim_69, Index=0, Wrap=True)  # -> Item, Item1
trim_70 = TrimTree(Tree=runion_7, Depth=1)
g_cars_2 = Brep(i_cars)
g_pedestrian_2 = Brep(i_pedestrian)
g_green_2 = Brep(item_38.Item1)

merge_52 = Merge(Data1=merge_36, Data2=merge_37, Data3=item_24.Item1, Data4=item_35, Data5=ln_10)
join_29 = JoinCurves(Curves=merge_52, Preserve=False)
trim_71 = TrimTree(Tree=join_29, Depth=1)
rdiff_7 = RegionDifference(CurvesA=rectangle.Rectangle, CurvesB=trim_71)
trim_72 = TrimTree(Tree=rdiff_7, Depth=1)
item_39 = ListItem(List=trim_72, Index=0, Wrap=True)  # -> Item, Item1
rdiff_8 = RegionDifference(CurvesA=item_39.Item1, CurvesB=trim_28)
trim_73 = TrimTree(Tree=rdiff_8, Depth=1)
merge_53 = Merge(Data1=trim_34, Data2=trim_73)
runion_8 = RegionUnion(Curves=merge_53)
trim_74 = TrimTree(Tree=runion_8, Depth=1)
s_pedestrian_2 = Brep(trim_74)
merge_54 = Merge(Data1=s_cars, Data2=s_pedestrian_2)
runion_9 = RegionUnion(Curves=merge_54)
trim_75 = TrimTree(Tree=runion_9, Depth=1)
rdiff_9 = RegionDifference(CurvesA=trim_71, CurvesB=trim_75)
trim_76 = TrimTree(Tree=rdiff_9, Depth=1)
s_building_2 = Brep(trim_76)
s_green_2 = Brep(item_39.Item)

rdiff_10 = RegionDifference(CurvesA=trim_65, CurvesB=trim_70)
trim_77 = TrimTree(Tree=rdiff_10, Depth=1)

g_building_2 = Brep(trim_77)

move_10 = Move(Geometry=trim_35, Motion=Z_5)  # -> Geometry, Transform
move_11 = Move(Geometry=trim_36, Motion=Z_5)  # -> Geometry, Transform
mirror_11 = Mirror(Geometry=tweencrv_3, Plane=PlaneYZ(0, 0, 0))  # -> Geometry, Transform
llx_11 = LineLine(Line1=ln_25, Line2=mirror_11.Geometry)  # -> ParamA, ParamB, PointA, PointB
subcrv_9 = SubCurve(BaseCurve=mirror_11.Geometry, Domain=llx_11.ParamB)
subcrv_10 = SubCurve(BaseCurve=ln_25, Domain=llx_11.ParamA)
merge_55 = Merge(Data1=subcrv_10, Data2=subcrv_9)
extr_7 = Extrude(Base=item_26, Direction=Z_6)
extr_8 = Extrude(Base=trim_35, Direction=Z_5)
extr_9 = Extrude(Base=trim_36, Direction=Z_5)
join_30 = JoinCurves(Curves=merge_55, Preserve=False)
trim_78 = TrimTree(Tree=join_30, Depth=1)
move_12 = Move(Geometry=trim_78, Motion=Z_6)  # -> Geometry, Transform
merge_56 = Merge(Data1=move_10.Geometry, Data2=move_12.Geometry)
merge_57 = Merge(Data1=move_11.Geometry, Data2=move_12.Geometry)
loft_7 = Loft(Curves=merge_56, Options={Adjust=False, Closed=False, LoftEnds=0, LoftSimp=0, LoftType=0, Rebuild=10, Refit=0.01})
loft_8 = Loft(Curves=merge_57, Options={Adjust=False, Closed=False, LoftEnds=0, LoftSimp=0, LoftType=0, Rebuild=10, Refit=0.01})
split = SplitBrep(Brep=extr_7, Cutter=loft_8)
trim_79 = TrimTree(Tree=split, Depth=1)
multiplication_16 = Multiplication(A=width, B=street_height_percentage)
item_40 = ListItem(List=trim_79, Index=0, Wrap=True)
merge_58 = Merge(Data1=extr_8, Data2=loft_7, Data3=loft_8, Data4=extr_9, Data5=s_building_2, Data6=item_40)
join_31 = BrepJoin(Breps=merge_58)  # -> Breps, Closed
Z_7 = UnitZ(Factor=multiplication_16)
capex_4 = CapHolesEx(Brep=join_31.Breps)  # -> Brep, Caps, Solid
srf = Surface(trim_75)
extr_10 = Extrude(Base=srf, Direction=Z_7)
sdiff = SolidDifference(BrepsA=capex_4.Brep, BrepsB=extr_10)
s_building_3 = Brep(sdiff)

move_13 = Move(Geometry=trim_60, Motion=Z_5)  # -> Geometry, Transform
move_14 = Move(Geometry=trim_64, Motion=Z_5)  # -> Geometry, Transform
llx_12 = LineLine(Line1=ln_28, Line2=tweencrv_3)  # -> ParamA, ParamB, PointA, PointB
subcrv_11 = SubCurve(BaseCurve=tweencrv_3, Domain=llx_12.ParamB)
subcrv_12 = SubCurve(BaseCurve=ln_28, Domain=llx_12.ParamA)
merge_59 = Merge(Data1=subcrv_12, Data2=subcrv_11)
extr_11 = Extrude(Base=item_35, Direction=Z_6)
extr_12 = Extrude(Base=trim_60, Direction=Z_5)
extr_13 = Extrude(Base=trim_64, Direction=Z_5)
join_32 = JoinCurves(Curves=merge_59, Preserve=False)
trim_80 = TrimTree(Tree=join_32, Depth=1)
move_15 = Move(Geometry=trim_80, Motion=Z_6)  # -> Geometry, Transform
merge_60 = Merge(Data1=move_13.Geometry, Data2=move_15.Geometry)
merge_61 = Merge(Data1=move_14.Geometry, Data2=move_15.Geometry)
loft_9 = Loft(Curves=merge_60, Options={Adjust=False, Closed=False, LoftEnds=0, LoftSimp=0, LoftType=0, Rebuild=10, Refit=0.01})
loft_10 = Loft(Curves=merge_61, Options={Adjust=False, Closed=False, LoftEnds=0, LoftSimp=0, LoftType=0, Rebuild=10, Refit=0.01})
split_2 = SplitBrep(Brep=extr_11, Cutter=loft_10)
trim_81 = TrimTree(Tree=split_2, Depth=1)
srf_2 = Surface(trim_70)
item_41 = ListItem(List=trim_81, Index=0, Wrap=True)
merge_62 = Merge(Data1=extr_12, Data2=loft_9, Data3=loft_10, Data4=extr_13, Data5=g_building_2, Data6=item_41)
join_33 = BrepJoin(Breps=merge_62)  # -> Breps, Closed
extr_14 = Extrude(Base=srf_2, Direction=Z_7)
capex_5 = CapHolesEx(Brep=join_33.Breps)  # -> Brep, Caps, Solid
sdiff_2 = SolidDifference(BrepsA=capex_5.Brep, BrepsB=extr_14)
fmerge = MergeFaces(Brep=sdiff_2)  # -> Breps, Before, After
g_building_3 = Brep(fmerge.Breps)

move_16 = Move(Geometry=mirror_6.Geometry, Motion=Z_5)  # -> Geometry, Transform
move_17 = Move(Geometry=subcrv_3, Motion=Z_5)  # -> Geometry, Transform
move_18 = Move(Geometry=ln_26, Motion=Z_6)  # -> Geometry, Transform
merge_63 = Merge(Data1=move_16.Geometry, Data2=move_18.Geometry)
merge_64 = Merge(Data1=move_17.Geometry, Data2=move_18.Geometry)
loft_11 = Loft(Curves=merge_63, Options={Adjust=False, Closed=False, LoftEnds=0, LoftSimp=0, LoftType=0, Rebuild=10, Refit=0.01})
loft_12 = Loft(Curves=merge_64, Options={Adjust=False, Closed=False, LoftEnds=0, LoftSimp=0, LoftType=0, Rebuild=10, Refit=0.01})
extr_15 = Extrude(Base=subcrv_3, Direction=Z_5)
extr_16 = Extrude(Base=mirror_6.Geometry, Direction=Z_5)
merge_65 = Merge(Data1=extr_16, Data2=loft_11, Data3=loft_12, Data4=extr_15, Data5=trim_41)
join_34 = BrepJoin(Breps=merge_65)  # -> Breps, Closed
srf_3 = Surface(trim_45)
extr_17 = Extrude(Base=srf_3, Direction=Z_7)
capex_6 = CapHolesEx(Brep=join_34.Breps)  # -> Brep, Caps, Solid
sdiff_3 = SolidDifference(BrepsA=capex_6.Brep, BrepsB=extr_17)
fmerge_2 = MergeFaces(Brep=sdiff_3)  # -> Breps, Before, After
building_2 = Brep(fmerge_2.Breps)

mirror_12 = Mirror(Geometry=s_cars, Plane=PlaneYZ(0, 0, 0))  # -> Geometry, Transform
mirror_13 = Mirror(Geometry=s_pedestrian_2, Plane=PlaneYZ(0, 0, 0))  # -> Geometry, Transform
mirror_14 = Mirror(Geometry=s_building_2, Plane=PlaneYZ(0, 0, 0))  # -> Geometry, Transform
mirror_15 = Mirror(Geometry=s_green_2, Plane=PlaneYZ(0, 0, 0))  # -> Geometry, Transform
s_cars_3 = Brep(mirror_12.Geometry)
s_pedestrian_3 = Brep(mirror_13.Geometry)
s_building_4 = Brep(mirror_14.Geometry)
s_green_3 = Brep(mirror_15.Geometry)
mirror_16 = Mirror(Geometry=g_cars_2, Plane=PlaneYZ(0, 0, 0))  # -> Geometry, Transform
mirror_17 = Mirror(Geometry=g_pedestrian_2, Plane=PlaneYZ(0, 0, 0))  # -> Geometry, Transform
mirror_18 = Mirror(Geometry=g_building_2, Plane=PlaneYZ(0, 0, 0))  # -> Geometry, Transform
mirror_19 = Mirror(Geometry=g_green_2, Plane=PlaneYZ(0, 0, 0))  # -> Geometry, Transform
g_cars_3 = Brep(mirror_16.Geometry)
g_pedestrian_3 = Brep(mirror_17.Geometry)
g_building_4 = Brep(mirror_18.Geometry)
g_green_3 = Brep(mirror_19.Geometry)
mirror_20 = Mirror(Geometry=s_building_3, Plane=PlaneYZ(0, 0, 0))  # -> Geometry, Transform
mirror_21 = Mirror(Geometry=g_building_3, Plane=PlaneYZ(0, 0, 0))  # -> Geometry, Transform
g_building_5 = Brep(mirror_21.Geometry)
s_building_5 = Brep(mirror_20.Geometry)

extr_18 = Extrude(Base=mirror_10.Geometry, Direction=Z_6)
explode_2 = Explode(Curve=mirror_10.Geometry, Recursive=True)  # -> Segments, Vertices
trim_82 = TrimTree(Tree=explode_2.Vertices, Depth=1)
item_42 = ListItem(List=trim_82, Index=0, Wrap=True)  # -> Item, Item1, Item2
move_19 = Move(Geometry=item_42.Item, Motion=Z_5)  # -> Geometry, Transform
move_20 = Move(Geometry=item_42.Item2, Motion=Z_5)  # -> Geometry, Transform
move_21 = Move(Geometry=item_42.Item1, Motion=Z_6)  # -> Geometry, Transform
srf4pt = _4PointSurface(CornerA=move_19.Geometry, CornerB=move_20.Geometry, CornerC=move_21.Geometry)
split_3 = SplitBrep(Brep=extr_18, Cutter=srf4pt)
trim_83 = TrimTree(Tree=split_3, Depth=1)
item_43 = ListItem(List=trim_83, Index=0, Wrap=True)
srf_4 = Surface(item_31.Item)
capex_7 = CapHolesEx(Brep=item_43)  # -> Brep, Caps, Solid
extr_19 = Extrude(Base=srf_4, Direction=Z_7)
fmerge_3 = MergeFaces(Brep=capex_7.Brep)  # -> Breps, Before, After
sdiff_4 = SolidDifference(BrepsA=fmerge_3.Breps, BrepsB=extr_19)
mirror_22 = Mirror(Geometry=fmerge_3.Breps, Plane=rotate_6.Geometry)  # -> Geometry, Transform
fmerge_4 = MergeFaces(Brep=sdiff_4)  # -> Breps, Before, After
merge_66 = Merge(Data1=fmerge_3.Breps, Data2=mirror_22.Geometry)
mirror_23 = Mirror(Geometry=fmerge_4.Breps, Plane=rotate_6.Geometry)  # -> Geometry, Transform
group_2 = Group(Geometry=merge_66)
merge_67 = Merge(Data1=fmerge_4.Breps, Data2=mirror_23.Geometry)
g_building_6 = Geometry(group_2)
group_3 = Group(Geometry=merge_67)
s_building_6 = Geometry(group_3)

filter = StreamFilter(
    Gate=itemindex,
    Stream0=l_s_building,
    Stream1=l_b_building_2,
    Stream2=i_building_2,
    Stream4=s_building_3,
    Stream5=g_building_3,
    Stream6=s_building_5,
    Stream7=g_building_5,
    Stream8=building_2,
    Stream9=s_building_6,
    Stream10=g_building_6)
filter_2 = StreamFilter(
    Gate=itemindex,
    Stream0=l_building,
    Stream1=l_b_building,
    Stream2=i_building,
    Stream4=s_building_2,
    Stream5=g_building_2,
    Stream6=s_building_4,
    Stream7=g_building_4,
    Stream8=building,
    Stream9=s_building,
    Stream10=g_building)
filter_3 = StreamFilter(
    Gate=itemindex,
    Stream0=l_green,
    Stream1=l_b_green,
    Stream2=i_backyard,
    Stream4=s_green_2,
    Stream5=g_green_2,
    Stream6=s_green_3,
    Stream7=g_green_3,
    Stream8=green,
    Stream9=s_green,
    Stream10=g_green)
filter_4 = StreamFilter(
    Gate=itemindex,
    Stream0=l_cars,
    Stream1=l_b_cars,
    Stream2=i_cars,
    Stream4=s_cars,
    Stream5=g_cars_2,
    Stream6=s_cars_3,
    Stream7=g_cars_3,
    Stream8=cars,
    Stream9=s_cars_2,
    Stream10=g_cars)
filter_5 = StreamFilter(
    Gate=itemindex,
    Stream0=l_pedestrian,
    Stream1=l_b_pedestrian,
    Stream2=i_pedestrian,
    Stream4=s_pedestrian_2,
    Stream5=g_pedestrian_2,
    Stream6=s_pedestrian_3,
    Stream7=g_pedestrian_3,
    Stream8=pedestrian,
    Stream9=s_pedestrian,
    Stream10=g_pedestrian)
building_3 = Geometry(filter_2)
green_2 = Geometry(filter_3)
cars_2 = Geometry(filter_4)
pedestrian_2 = Geometry(filter_5)
merge_68 = Merge(Data1=cars_2, Data2=pedestrian_2, Data3=green_2)
merge_69 = Merge(Data1=filter, Data2=merge_68)
geo = Geometry(merge_69)
geo_2 = PreviewGeometry(geo=geo)
volume = Geometry(filter)
surfaces = Geometry(merge_68)
geo_3 = ClusterOutput(geo)
volume_2 = ClusterOutput(volume)
surfaces_2 = ClusterOutput(surfaces)
building_4 = ClusterOutput(building_3)
green_3 = ClusterOutput(green_2)
cars_3 = ClusterOutput(cars_2)
pedestrian_3 = ClusterOutput(pedestrian_2)

# ==== cluster CityPart_2
panel = Panel("""L_s
L_b
|
⊦
◞_s
◞_g
◟_s
◟_g
/
%_s
%_g""")
panel_2 = Panel(" street")
brep = Brep(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)
brep_2 = Brep(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)
brep_3 = Brep(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)
list = ValueList({"L_s", "L_b", "|", "⊦", "\_s", "\_b"}, selected="L_s")
variant = ClusterInput()
variant_2 = Text(variant)
itemindex = ItemIndex(L=panel, I=variant_2)  # -> i; inputs L: list; same code as itemindex
width = Number("1")

expression = Expression(x=width, Expression="x/2")
neg = Negative(Value=expression)
dom = ConstructDomain(DomainStart=neg, DomainEnd=expression)
dom_2 = ConstructDomain(DomainStart=neg, DomainEnd=expression)
rectangle = Rectangle(Plane=PlaneXY(0, 0, 0), XSize=dom, YSize=dom_2, Radius=0)  # -> Rectangle, Length
explode = Explode(Curve=rectangle.Rectangle, Recursive=True)  # -> Segments, Vertices
box = DomainBox(Base=PlaneXY(0, 0, 0), X=dom, Y=dom_2, Z=width)
trim = TrimTree(Tree=explode.Segments, Depth=1)
trim_2 = TrimTree(Tree=explode.Vertices, Depth=1)
item = ListItem(List=trim_2, Index=0, Wrap=True)  # -> Item, Item1, Item2
item_2 = ListItem(List=trim, Index=0, Wrap=True)  # -> Item1, Item, Item1_2, Item2
merge = Merge(Data1=item_2.Item1, Data2=item_2.Item)
merge_2 = Merge(Data1=item_2.Item1_2, Data2=item_2.Item2)
join = JoinCurves(Curves=merge, Preserve=False)
join_2 = JoinCurves(Curves=merge_2, Preserve=False)
trim_3 = TrimTree(Tree=join, Depth=1)
trim_4 = TrimTree(Tree=join_2, Depth=1)

car_proportion = Number(Slider(0.1, range=0..1))
pedestrian_proportion = Number(Slider(0.05, range=0..1))
building_width_proportion = Number(Slider(0.5, range=0..1))
addition = Addition(A=car_proportion, B=pedestrian_proportion, C=building_width_proportion)
expression_2 = Expression(x=addition, Expression="1-x")

multiplication = Multiplication(A=width, B=car_proportion)
multiplication_2 = Multiplication(A=width, B=pedestrian_proportion)
multiplication_3 = Multiplication(A=width, B=building_width_proportion)
neg_2 = Negative(Value=multiplication)
neg_3 = Negative(Value=multiplication_2)
neg_4 = Negative(Value=multiplication_3)
offset = OffsetCurve(Curve=item_2.Item1, Distance=neg_2, Corners=1)
trim_5 = TrimTree(Tree=offset, Depth=1)
offset_2 = OffsetCurve(Curve=trim_5, Distance=neg_3, Corners=1)
trim_6 = TrimTree(Tree=offset_2, Depth=1)
offset_3 = OffsetCurve(Curve=trim_6, Distance=neg_4, Corners=1)
trim_7 = TrimTree(Tree=offset_3, Depth=1)
end = EndPoints(Curve=item_2.Item1)  # -> Start, End
end_2 = EndPoints(Curve=trim_5)  # -> Start, End
end_3 = EndPoints(Curve=trim_6)  # -> Start, End
end_4 = EndPoints(Curve=trim_7)  # -> Start, End
end_5 = EndPoints(Curve=item_2.Item1_2)  # -> Start, End
ln = Line(StartPoint=end.Start, EndPoint=end_2.Start)
ln_2 = Line(StartPoint=end_2.Start, EndPoint=end_3.Start)
ln_3 = Line(StartPoint=end_3.Start, EndPoint=end_4.Start)
ln_4 = Line(StartPoint=end_4.Start, EndPoint=end_5.End)
ln_5 = Line(StartPoint=end.End, EndPoint=end_2.End)
ln_6 = Line(StartPoint=end_2.End, EndPoint=end_3.End)
ln_7 = Line(StartPoint=end_3.End, EndPoint=end_4.End)
ln_8 = Line(StartPoint=end_4.End, EndPoint=end_5.Start)
merge_3 = Merge(Data1=item_2.Item1, Data2=ln, Data3=trim_5, Data4=ln_5)
merge_4 = Merge(Data1=trim_5, Data2=ln_2, Data3=trim_6, Data4=ln_6)
merge_5 = Merge(Data1=trim_6, Data2=ln_3, Data3=trim_7, Data4=ln_7)
merge_6 = Merge(Data1=ln_4, Data2=trim_7, Data3=item_2.Item1_2, Data4=ln_8)
join_3 = JoinCurves(Curves=merge_3, Preserve=False)
join_4 = JoinCurves(Curves=merge_4, Preserve=False)
join_5 = JoinCurves(Curves=merge_5, Preserve=False)
join_6 = JoinCurves(Curves=merge_6, Preserve=False)
trim_8 = TrimTree(Tree=join_3, Depth=1)
trim_9 = TrimTree(Tree=join_4, Depth=1)
trim_10 = TrimTree(Tree=join_5, Depth=1)
trim_11 = TrimTree(Tree=join_6, Depth=1)
i_cars = Brep(trim_8)
i_pedestrian = Brep(trim_9)
i_building = Brep(trim_10)
i_backyard = Brep(trim_11)

multiplication_4 = Multiplication(A=width, B=expression_2)
multiplication_5 = Multiplication(A=width, B=building_width_proportion)
multiplication_6 = Multiplication(A=width, B=pedestrian_proportion)
neg_5 = Negative(Value=multiplication_4)
neg_6 = Negative(Value=multiplication_5)
neg_7 = Negative(Value=multiplication_6)
offset_4 = OffsetCurve(Curve=trim_3, Distance=neg_5, Corners=1)
trim_12 = TrimTree(Tree=offset_4, Depth=1)
offset_5 = OffsetCurve(Curve=trim_12, Distance=neg_6, Corners=1)
trim_13 = TrimTree(Tree=offset_5, Depth=1)
offset_6 = OffsetCurve(Curve=trim_13, Distance=neg_7, Corners=1)
trim_14 = TrimTree(Tree=offset_6, Depth=1)
end_6 = EndPoints(Curve=trim_3)  # -> Start, End
end_7 = EndPoints(Curve=trim_12)  # -> Start, End
end_8 = EndPoints(Curve=trim_13)  # -> Start, End
end_9 = EndPoints(Curve=trim_14)  # -> Start, End
end_10 = EndPoints(Curve=item_2.Item1_2)  # -> Start, End
ln_9 = Line(StartPoint=end_6.Start, EndPoint=end_7.Start)
ln_10 = Line(StartPoint=end_7.Start, EndPoint=end_8.Start)
ln_11 = Line(StartPoint=end_8.Start, EndPoint=end_9.Start)
ln_12 = Line(StartPoint=end_9.Start, EndPoint=end_10.End)
ln_13 = Line(StartPoint=end_6.End, EndPoint=end_7.End)
ln_14 = Line(StartPoint=end_7.End, EndPoint=end_8.End)
ln_15 = Line(StartPoint=end_8.End, EndPoint=end_9.End)
ln_16 = Line(StartPoint=end_9.End, EndPoint=end_10.End)
merge_7 = Merge(Data1=trim_3, Data2=ln_9, Data3=trim_12, Data4=ln_13)
merge_8 = Merge(Data1=trim_12, Data2=ln_10, Data3=trim_13, Data4=ln_14)
merge_9 = Merge(Data1=trim_13, Data2=ln_11, Data3=trim_14, Data4=ln_15)
merge_10 = Merge(Data1=ln_12, Data2=trim_14, Data3=ln_16)
join_7 = JoinCurves(Curves=merge_7, Preserve=False)
join_8 = JoinCurves(Curves=merge_8, Preserve=False)
join_9 = JoinCurves(Curves=merge_9, Preserve=False)
join_10 = JoinCurves(Curves=merge_10, Preserve=False)
trim_15 = TrimTree(Tree=join_7, Depth=1)
trim_16 = TrimTree(Tree=join_8, Depth=1)
trim_17 = TrimTree(Tree=join_9, Depth=1)
trim_18 = TrimTree(Tree=join_10, Depth=1)
l_b_building = Brep(trim_16)
l_b_pedestrian = Brep(trim_17)
l_b_cars = Brep(trim_18)
l_b_green = Brep(trim_15)

multiplication_7 = Multiplication(A=width, B=car_proportion)
multiplication_8 = Multiplication(A=width, B=pedestrian_proportion)
multiplication_9 = Multiplication(A=width, B=building_width_proportion)
neg_8 = Negative(Value=multiplication_7)
neg_9 = Negative(Value=multiplication_8)
neg_10 = Negative(Value=multiplication_9)
offset_7 = OffsetCurve(Curve=trim_3, Distance=neg_8, Corners=1)
trim_19 = TrimTree(Tree=offset_7, Depth=1)
offset_8 = OffsetCurve(Curve=trim_19, Distance=neg_9, Corners=1)
trim_20 = TrimTree(Tree=offset_8, Depth=1)
offset_9 = OffsetCurve(Curve=trim_20, Distance=neg_10, Corners=1)
trim_21 = TrimTree(Tree=offset_9, Depth=1)
end_11 = EndPoints(Curve=trim_3)  # -> Start, End
end_12 = EndPoints(Curve=trim_19)  # -> Start, End
end_13 = EndPoints(Curve=trim_20)  # -> Start, End
end_14 = EndPoints(Curve=trim_21)  # -> Start, End
end_15 = EndPoints(Curve=item_2.Item1_2)  # -> Start, End
ln_17 = Line(StartPoint=end_11.Start, EndPoint=end_12.Start)
ln_18 = Line(StartPoint=end_12.Start, EndPoint=end_13.Start)
ln_19 = Line(StartPoint=end_13.Start, EndPoint=end_14.Start)
ln_20 = Line(StartPoint=end_14.Start, EndPoint=end_15.End)
ln_21 = Line(StartPoint=end_11.End, EndPoint=end_12.End)
ln_22 = Line(StartPoint=end_12.End, EndPoint=end_13.End)
ln_23 = Line(StartPoint=end_13.End, EndPoint=end_14.End)
ln_24 = Line(StartPoint=end_14.End, EndPoint=end_15.End)
merge_11 = Merge(Data1=trim_3, Data2=ln_17, Data3=trim_19, Data4=ln_21)
merge_12 = Merge(Data1=trim_19, Data2=ln_18, Data3=trim_20, Data4=ln_22)
merge_13 = Merge(Data1=trim_20, Data2=ln_19, Data3=trim_21, Data4=ln_23)
merge_14 = Merge(Data1=ln_20, Data2=trim_21, Data3=ln_24)
join_11 = JoinCurves(Curves=merge_11, Preserve=False)
join_12 = JoinCurves(Curves=merge_12, Preserve=False)
join_13 = JoinCurves(Curves=merge_13, Preserve=False)
join_14 = JoinCurves(Curves=merge_14, Preserve=False)
trim_22 = TrimTree(Tree=join_11, Depth=1)
trim_23 = TrimTree(Tree=join_12, Depth=1)
trim_24 = TrimTree(Tree=join_13, Depth=1)
trim_25 = TrimTree(Tree=join_14, Depth=1)
l_building = Brep(trim_24)
l_cars = Brep(trim_22)
l_pedestrian = Brep(trim_23)
l_green = Brep(trim_25)

roof_height_percentage = Number(Slider(0.1, range=0..2))
building_height_proportion = Number(Slider(0.4, range=0..2))

multiplication_10 = Multiplication(A=width, B=roof_height_percentage)
multiplication_11 = Multiplication(A=width, B=building_height_proportion)
Z = UnitZ(Factor=multiplication_11)
addition_2 = Addition(A=multiplication_11, B=multiplication_10)
tweencrv = TweenCurve(CurveA=trim_20, CurveB=trim_21, Factor=0.5, BlendType=0)
Z_2 = UnitZ(Factor=addition_2)
move = Move(Geometry=trim_20, Motion=Z)  # -> Geometry, Transform
move_2 = Move(Geometry=trim_21, Motion=Z)  # -> Geometry, Transform
move_3 = Move(Geometry=tweencrv, Motion=Z_2)  # -> Geometry, Transform
merge_15 = Merge(Data1=move.Geometry, Data2=move_3.Geometry)
merge_16 = Merge(Data1=move_2.Geometry, Data2=move_3.Geometry)
loft = Loft(Curves=merge_15, Options={Adjust=False, Closed=False, LoftEnds=0, LoftSimp=0, LoftType=0, Rebuild=10, Refit=0.01})
extr = Extrude(Base=trim_20, Direction=Z)
loft_2 = Loft(Curves=merge_16, Options={Adjust=False, Closed=False, LoftEnds=0, LoftSimp=0, LoftType=0, Rebuild=10, Refit=0.01})
extr_2 = Extrude(Base=trim_21, Direction=Z)
merge_17 = Merge(Data1=l_building, Data2=extr, Data3=loft, Data4=loft_2, Data5=extr_2)
join_15 = BrepJoin(Breps=merge_17)  # -> Breps, Closed
capex = CapHolesEx(Brep=join_15.Breps)  # -> Brep, Caps, Solid
l_s_building = Brep(capex.Brep)

multiplication_12 = Multiplication(A=width, B=roof_height_percentage)
multiplication_13 = Multiplication(A=width, B=building_height_proportion)
Z_3 = UnitZ(Factor=multiplication_13)
addition_3 = Addition(A=multiplication_13, B=multiplication_12)
tweencrv_2 = TweenCurve(CurveA=trim_12, CurveB=trim_13, Factor=0.5, BlendType=0)
Z_4 = UnitZ(Factor=addition_3)
move_4 = Move(Geometry=trim_12, Motion=Z_3)  # -> Geometry, Transform
move_5 = Move(Geometry=trim_13, Motion=Z_3)  # -> Geometry, Transform
move_6 = Move(Geometry=tweencrv_2, Motion=Z_4)  # -> Geometry, Transform
merge_18 = Merge(Data1=move_4.Geometry, Data2=move_6.Geometry)
merge_19 = Merge(Data1=move_5.Geometry, Data2=move_6.Geometry)
loft_3 = Loft(Curves=merge_18, Options={Adjust=False, Closed=False, LoftEnds=0, LoftSimp=0, LoftType=0, Rebuild=10, Refit=0.01})
extr_3 = Extrude(Base=trim_12, Direction=Z_3)
loft_4 = Loft(Curves=merge_19, Options={Adjust=False, Closed=False, LoftEnds=0, LoftSimp=0, LoftType=0, Rebuild=10, Refit=0.01})
extr_4 = Extrude(Base=trim_13, Direction=Z_3)
merge_20 = Merge(Data1=l_b_building, Data2=extr_3, Data3=loft_3, Data4=loft_4, Data5=extr_4)
join_16 = BrepJoin(Breps=merge_20)  # -> Breps, Closed
capex_2 = CapHolesEx(Brep=join_16.Breps)  # -> Brep, Caps, Solid
l_b_building_2 = Brep(capex_2.Brep)

multiplication_14 = Multiplication(A=width, B=roof_height_percentage)
multiplication_15 = Multiplication(A=width, B=building_height_proportion)
Z_5 = UnitZ(Factor=multiplication_15)
addition_4 = Addition(A=multiplication_15, B=multiplication_14)
tweencrv_3 = TweenCurve(CurveA=trim_6, CurveB=trim_7, Factor=0.5, BlendType=0)
Z_6 = UnitZ(Factor=addition_4)
move_7 = Move(Geometry=trim_6, Motion=Z_5)  # -> Geometry, Transform
move_8 = Move(Geometry=trim_7, Motion=Z_5)  # -> Geometry, Transform
move_9 = Move(Geometry=tweencrv_3, Motion=Z_6)  # -> Geometry, Transform
merge_21 = Merge(Data1=move_7.Geometry, Data2=move_9.Geometry)
merge_22 = Merge(Data1=move_8.Geometry, Data2=move_9.Geometry)
loft_5 = Loft(Curves=merge_21, Options={Adjust=False, Closed=False, LoftEnds=0, LoftSimp=0, LoftType=0, Rebuild=10, Refit=0.01})
extr_5 = Extrude(Base=trim_6, Direction=Z_5)
loft_6 = Loft(Curves=merge_22, Options={Adjust=False, Closed=False, LoftEnds=0, LoftSimp=0, LoftType=0, Rebuild=10, Refit=0.01})
extr_6 = Extrude(Base=trim_7, Direction=Z_5)
merge_23 = Merge(Data1=i_building, Data2=extr_5, Data3=loft_5, Data4=loft_6, Data5=extr_6)
join_17 = BrepJoin(Breps=merge_23)  # -> Breps, Closed
capex_3 = CapHolesEx(Brep=join_17.Breps)  # -> Brep, Caps, Solid
i_building_2 = Brep(capex_3.Brep)

street_height_percentage = Number(Slider(0.2, range=0..2))
relay = Relay()
panel_3 = Panel("monoceros.connector.out")
bool = Boolean("F")
bool_2 = Boolean("T")
panel_4 = Panel("False")
merge_24 = Merge(Data1="g-b-s", Data2=" green-building-street", Data3="s-b-g", Data4=bool)
merge_25 = Merge(Data1="s-b-g", Data2=" street-building-green", Data3="g-b-s", Data4=bool)
merge_26 = Merge(Data1="s", Data2=" street-building-green", Data3="s", Data4=bool_2)
merge_27 = Merge(Data1="s-b", Data2=" street-building", Data3="b-s", Data4=bool)
merge_28 = Merge(Data1="b-s", Data2=" building-street", Data3="s-b", Data4=bool)
merge_29 = Merge(Data1="g", Data2=" green", Data3="g", Data4=bool_2)
merge_30 = Merge(Data1="g-b", Data2=" green-building", Data3="b-g", Data4=bool)
merge_31 = Merge(Data1="b-g", Data2=" building-green", Data3="g-b", Data4=bool)
qal = ModelQuality(Name=panel_3, Value="True")  # -> Quality, Valid, Name, Value, Unit, Definition
qal_2 = ModelQuality(Name=panel_3, Value="True")  # -> Quality, Valid, Name, Value, Unit, Definition
mrg_a = MergeSeperatlyAppend(x=merge_24, v=merge_25, y=merge_26, z=merge_27, t=merge_28, u=merge_29, w=merge_30, s=merge_31)  # -> Mrgd; inputs x: tree, v: tree, y: tree, z: tree, t: tree, u: tree, w: tree, s: tree; same code as mrg_a
merge_32 = Merge(Data1=qal.Quality, Data2=qal_2.Quality)
item_3 = ListItem(List=mrg_a, Index=0, Wrap=True)  # -> flatten(Item), flatten(Item1), flatten(Item2), flatten(Item3)

panel_5 = Panel("""1
0
5
0
2
5
4
4
3
4
7""")
item_4 = ListItem(List=panel_5, Index=itemindex, Wrap=True)
item_5 = ListItem(List=item_3.Item, Index=item_4, Wrap=True)
item_6 = ListItem(List=item_3.Item3, Index=item_4, Wrap=True)
replace = ReplaceMembers(Set=item_5, Find=item_3.Item, Replace=item_3.Item2)
item_7 = ListItem(List=item_3.Item1, Index=item_4, Wrap=True)
item_8 = ListItem(List=merge_32, Index=item_6, Wrap=True)
box_2 = EvaluateBox(Box=box, UParameter="1", VParameter="0.5", WParameter=0.5)  # -> Plane, Point, Include
concat = Concatenate(FragmentA="Bottom center of the ", FragmentB="east", FragmentC=item_7, FragmentD=" side.")
X = UnitX(Factor=1)
por = ModelPort(
    Id="e",
    Description=concat,
    Family=item_5,
    CompatibleFamilies=replace,
    Point=box_2.Point,
    Direction=X,
    T="0.25",
    Qualities=item_8)  # -> Port, Valid, Id, Description, Family, CompatibleFamilies, Point, Direction, T, Qualities

panel_6 = Panel("""0
1
0
0
1
0
0
1
7
3
6""")
item_9 = ListItem(List=panel_6, Index=itemindex, Wrap=True)
item_10 = ListItem(List=item_3.Item, Index=item_9, Wrap=True)
item_11 = ListItem(List=item_3.Item3, Index=item_9, Wrap=True)
item_12 = ListItem(List=item_3.Item1, Index=item_9, Wrap=True)
replace_2 = ReplaceMembers(Set=item_10, Find=item_3.Item, Replace=item_3.Item2)
item_13 = ListItem(List=merge_32, Index=item_11, Wrap=True)
box_3 = EvaluateBox(Box=box, UParameter="0.5", VParameter="1", WParameter=0.5)  # -> Plane, Point, Include
concat_2 = Concatenate(FragmentA="Bottom center of the ", FragmentB="north", FragmentC=item_12, FragmentD=" side.")
Y = UnitY(Factor=1)
por_2 = ModelPort(
    Port=box_3.Plane,
    Id="n",
    Description=concat_2,
    Family=item_10,
    CompatibleFamilies=replace_2,
    Direction=Y,
    T="0",
    Qualities=item_13)  # -> Port, Valid, Id, Description, Family, CompatibleFamilies, Point, Direction, T, Qualities

panel_7 = Panel("""2
4
2
0
6
3
2
5
6
4
7""")
item_14 = ListItem(List=panel_7, Index=itemindex, Wrap=True)
item_15 = ListItem(List=item_3.Item, Index=item_14, Wrap=True)
item_16 = ListItem(List=item_3.Item3, Index=item_14, Wrap=True)
replace_3 = ReplaceMembers(Set=item_15, Find=item_3.Item, Replace=item_3.Item2)
item_17 = ListItem(List=item_3.Item1, Index=item_14, Wrap=True)
item_18 = ListItem(List=merge_32, Index=item_16, Wrap=True)
box_4 = EvaluateBox(Box=box, UParameter="0", VParameter="0.5", WParameter=0.5)  # -> Plane, Point, Include
X_2 = UnitX(Factor=1)
rev = Reverse(Vector=X_2)
concat_3 = Concatenate(FragmentA="Bottom center of the ", FragmentB="west", FragmentC=item_17, FragmentD=" side.")
por_3 = ModelPort(
    Id="w",
    Description=concat_3,
    Family=item_15,
    CompatibleFamilies=replace_3,
    Point=box_4.Point,
    Direction=rev,
    T="0.75",
    Qualities=item_18)  # -> Port, Valid, Id, Description, Family, CompatibleFamilies, Point, Direction, T, Qualities

panel_8 = Panel("""2
4
1
0
4
7
3
6
4
3
6""")
item_19 = ListItem(List=panel_8, Index=itemindex, Wrap=True)
item_20 = ListItem(List=item_3.Item3, Index=item_19, Wrap=True)
item_21 = ListItem(List=item_3.Item, Index=item_19, Wrap=True)
replace_4 = ReplaceMembers(Set=item_21, Find=item_3.Item, Replace=item_3.Item2)
item_22 = ListItem(List=item_3.Item1, Index=item_19, Wrap=True)
item_23 = ListItem(List=merge_32, Index=item_20, Wrap=True)
box_5 = EvaluateBox(Box=box, UParameter="0.5", VParameter="0", WParameter=0.5)  # -> Plane, Point, Include
concat_4 = Concatenate(FragmentA="Bottom center of the ", FragmentB="south", FragmentC=item_22, FragmentD=" side.")
Y_2 = UnitY(Factor=1)
rev_2 = Reverse(Vector=Y_2)
por_4 = ModelPort(
    Id="s",
    Description=concat_4,
    Family=item_21,
    CompatibleFamilies=replace_4,
    Point=box_5.Point,
    Direction=rev_2,
    T="0.5",
    Qualities=item_23)  # -> Port, Valid, Id, Description, Family, CompatibleFamilies, Point, Direction, T, Qualities

pt = ConstructPoint(XCoordinate=0, YCoordinate=0, ZCoordinate=expression)
txt = Text(pt)
qal_3 = ModelQuality(Name="monoceros.module.center", Value=txt)  # -> Quality, Valid, Name, Value, Unit, Definition
merge_33 = Merge(Data1=por_2.Port, Data2=por.Port, Data3=por_3.Port, Data4=por_4.Port)
typ = ModelType(Name="City Part", Variant=variant_2, Ports=merge_33, Qualities=qal_3.Quality)  # -> Type, Valid, Name, Description, Icon, Image, Variant, Unit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
prv = PreviewPort(po=typ.Ports, W=2)
ty = Type(typ.Type)
ty_2 = ClusterOutput(ty)

expression_3 = Expression(x=multiplication_9, Expression="x/2")
crv = Curve(reparameterize(trim_7))
ln_25 = Line(StartPoint=item.Item, EndPoint=item.Item2)
neg_11 = Negative(Value=expression_3)
rotate = Rotate(Geometry=i_cars, Angle=degrees("90"), Plane=PlaneXY(0, 0, 0))  # -> Geometry, Transform
mirror = Mirror(Geometry=i_cars, Plane=PlaneYZ(0, 0, 0))  # -> Geometry, Transform
offset_10 = OffsetCurve(Curve=ln_25, Distance=expression_3, Corners=1)  # -> reparameterize(Curve)
offset_11 = OffsetCurve(Curve=ln_25, Distance=neg_11, Corners=1)  # -> reparameterize(Curve)
crv_2 = Curve(reparameterize(trim_6))
rotate_2 = Rotate(Geometry=i_pedestrian, Angle=degrees("90"), Plane=PlaneXY(0, 0, 0))  # -> Geometry, Transform
mirror_2 = Mirror(Geometry=i_pedestrian, Plane=PlaneYZ(0, 0, 0))  # -> Geometry, Transform
mirror_3 = Mirror(Geometry=crv_2, Plane=PlaneYZ(0, 0, 0))  # -> Geometry, Transform
crv_3 = Curve(reparameterize(item_2.Item))
crv_4 = Curve(reparameterize(item_2.Item1))
trim_26 = TrimTree(Tree=offset_11, Depth=1)
mirror_4 = Mirror(Geometry=crv, Plane=PlaneYZ(0, 0, 0))  # -> Geometry, Transform
trim_27 = TrimTree(Tree=offset_10, Depth=1)
merge_34 = Merge(Data1=mirror.Geometry, Data2=rotate.Geometry)
merge_35 = Merge(Data1=mirror_2.Geometry, Data2=rotate_2.Geometry)
llx = LineLine(Line1=trim_26, Line2=crv_4)  # -> ParamA, ParamB, PointA, PointB
llx_2 = LineLine(Line1=trim_26, Line2=mirror_4.Geometry)  # -> ParamA, ParamB, PointA, PointB
llx_3 = LineLine(Line1=trim_27, Line2=mirror_3.Geometry)  # -> ParamA, ParamB, PointA, PointB
llx_4 = LineLine(Line1=trim_27, Line2=crv_3)  # -> ParamA, ParamB, PointA, PointB
runion = RegionUnion(Curves=merge_34)
shatter = Shatter(Curve=crv_3, Parameters=llx_4.ParamB)
runion_2 = RegionUnion(Curves=merge_35)
shatter_2 = Shatter(Curve=mirror_3.Geometry, Parameters=llx_3.ParamB)
dom_3 = ConstructDomain(DomainStart=llx_4.ParamA, DomainEnd=llx_3.ParamA)
shatter_3 = Shatter(Curve=crv_4, Parameters=llx.ParamB)
shatter_4 = Shatter(Curve=mirror_4.Geometry, Parameters=llx_2.ParamB)
dom_4 = ConstructDomain(DomainStart=llx.ParamA, DomainEnd=llx_2.ParamA)
trim_28 = TrimTree(Tree=runion, Depth=1)
trim_29 = TrimTree(Tree=shatter_2, Depth=1)
trim_30 = TrimTree(Tree=shatter, Depth=1)
trim_31 = TrimTree(Tree=shatter_3, Depth=1)
trim_32 = TrimTree(Tree=shatter_4, Depth=1)
trim_33 = TrimTree(Tree=runion_2, Depth=1)
item_24 = ListItem(List=trim_31, Index=0, Wrap=True)  # -> Item, Item1
item_25 = ListItem(List=trim_29, Index=0, Wrap=True)
rdiff = RegionDifference(CurvesA=trim_33, CurvesB=trim_28)
subcrv = SubCurve(BaseCurve=trim_27, Domain=dom_3)
item_26 = ListItem(List=trim_30, Index=0, Wrap=True)
subcrv_2 = SubCurve(BaseCurve=trim_26, Domain=dom_4)
item_27 = ListItem(List=trim_32, Index=0, Wrap=True)
trim_34 = TrimTree(Tree=rdiff, Depth=1)
merge_36 = Merge(Data1=subcrv_2, Data2=item_27)
merge_37 = Merge(Data1=subcrv, Data2=item_25)
join_18 = JoinCurves(Curves=merge_36, Preserve=False)
join_19 = JoinCurves(Curves=merge_37, Preserve=False)
trim_35 = TrimTree(Tree=join_18, Depth=1)
trim_36 = TrimTree(Tree=join_19, Depth=1)
s_cars = Brep(trim_28)

expression_4 = Expression(x=multiplication_9, Expression="x/2")
ln_26 = Line(StartPoint=item.Item, EndPoint=item.Item2)
crv_5 = Curve(reparameterize(item_2.Item))
crv_6 = Curve(reparameterize(item_2.Item1_2))
neg_12 = Negative(Value=expression_4)
offset_12 = OffsetCurve(Curve=ln_26, Distance=expression_4, Corners=1)  # -> reparameterize(Curve)
offset_13 = OffsetCurve(Curve=ln_26, Distance=neg_12, Corners=1)  # -> reparameterize(Curve)
trim_37 = TrimTree(Tree=offset_13, Depth=1)
trim_38 = TrimTree(Tree=offset_12, Depth=1)
llx_5 = LineLine(Line1=trim_38, Line2=crv_5)  # -> ParamA, ParamB, PointA, PointB
llx_6 = LineLine(Line1=trim_38, Line2=crv_6)  # -> ParamA, ParamB, PointA, PointB
xz = XZPlane(Origin=Point(0, 0, 0))
dom_5 = ConstructDomain(DomainStart=llx_5.ParamA, DomainEnd=llx_6.ParamA)
shatter_5 = Shatter(Curve=crv_5, Parameters=llx_5.ParamB)
rotate_3 = Rotate(Geometry=xz, Angle=degrees("-45"), Plane=PlaneXY(0, 0, 0))  # -> Geometry, Transform
rotate_4 = Rotate(Geometry=xz, Angle=degrees("45"), Plane=PlaneXY(0, 0, 0))  # -> Geometry, Transform
subcrv_3 = SubCurve(BaseCurve=trim_38, Domain=dom_5)
trim_39 = TrimTree(Tree=shatter_5, Depth=1)
item_28 = ListItem(List=trim_39, Index=0, Wrap=True)
mirror_5 = Mirror(Geometry=item_28, Plane=rotate_3.Geometry)  # -> Geometry, Transform
mirror_6 = Mirror(Geometry=subcrv_3, Plane=rotate_4.Geometry)  # -> Geometry, Transform
merge_38 = Merge(Data1=item_28, Data2=subcrv_3, Data3=mirror_5.Geometry)
join_20 = JoinCurves(Curves=merge_38, Preserve=False)
trim_40 = TrimTree(Tree=join_20, Depth=1)
mirror_7 = Mirror(Geometry=trim_40, Plane=rotate_4.Geometry)  # -> Geometry, Transform
merge_39 = Merge(Data1=trim_40, Data2=mirror_7.Geometry)
join_21 = JoinCurves(Curves=merge_39, Preserve=False)
trim_41 = TrimTree(Tree=join_21, Depth=1)
rdiff_2 = RegionDifference(CurvesA=rectangle.Rectangle, CurvesB=trim_41)
trim_42 = TrimTree(Tree=rdiff_2, Depth=1)
item_29 = ListItem(List=trim_42, Index=0, Wrap=True)  # -> Item, Item1
rdiff_3 = RegionDifference(CurvesA=item_29.Item1, CurvesB=trim_28)
trim_43 = TrimTree(Tree=rdiff_3, Depth=1)
merge_40 = Merge(Data1=trim_34, Data2=trim_43)
runion_3 = RegionUnion(Curves=merge_40)
trim_44 = TrimTree(Tree=runion_3, Depth=1)
merge_41 = Merge(Data1=trim_28, Data2=trim_44)
runion_4 = RegionUnion(Curves=merge_41)
trim_45 = TrimTree(Tree=runion_4, Depth=1)
rdiff_4 = RegionDifference(CurvesA=trim_41, CurvesB=trim_45)
trim_46 = TrimTree(Tree=rdiff_4, Depth=1)
cars = Brep(trim_28)
pedestrian = Brep(trim_44)
building = Brep(trim_46)
green = Brep(item_29.Item)

merge_42 = Merge(Data1=trim_28, Data2=trim_34)
end_16 = EndPoints(Curve=item_26)  # -> Start, End
end_17 = EndPoints(Curve=item_24.Item1)  # -> Start, End
ln_27 = Line(StartPoint=end_16.End, EndPoint=end_17.Start)
merge_43 = Merge(Data1=item_26, Data2=item_24.Item1, Data3=ln_27)
xz_2 = XZPlane(Origin=Point(0, 0, 0))
rotate_5 = Rotate(Geometry=xz_2, Angle=degrees("45"), Plane=xz_2)  # -> Geometry, Transform
rotate_6 = Rotate(Geometry=xz_2, Angle=degrees("45"), Plane=PlaneXY(0, 0, 0))  # -> Geometry, Transform
join_22 = JoinCurves(Curves=merge_43, Preserve=False)
trim_47 = TrimTree(Tree=join_22, Depth=1)
mirror_8 = Mirror(Geometry=trim_47, Plane=rotate_5.Geometry)  # -> Geometry, Transform
mirror_9 = Mirror(Geometry=merge_42, Plane=rotate_6.Geometry)  # -> Geometry, Transform
merge_44 = Merge(Data1=graft(mirror_9.Geometry), Data2=graft(merge_42))
flip = FlipMatrix(Data=merge_44)
item_30 = ListItem(List=flip, Index=0, Wrap=True)  # -> Item, Item1
trim_48 = TrimTree(Tree=item_30.Item, Depth=1)
trim_49 = TrimTree(Tree=item_30.Item1, Depth=1)
runion_5 = RegionUnion(Curves=trim_48)
runion_6 = RegionUnion(Curves=trim_49)
trim_50 = TrimTree(Tree=runion_5, Depth=1)
trim_51 = TrimTree(Tree=runion_6, Depth=1)
item_31 = ListItem(List=trim_50, Index=0, Wrap=True)  # -> Item, Item1
item_32 = ListItem(List=trim_51, Index=0, Wrap=True)  # -> Item, Item1
srfsplit = SurfaceSplit(Surface=item_31.Item, Curves=item_31.Item1)
mirror_10 = Mirror(Geometry=trim_47, Plane=PlaneYZ(0, 0, 0))  # -> Geometry, Transform
trim_52 = TrimTree(Tree=srfsplit, Depth=1)
null = EmptyStringToNull()  # -> NT; inputs T: tree; same code as null
merge_45 = Merge(Data1=mirror_10.Geometry, Data2=mirror_8.Geometry)
rdiff_5 = RegionDifference(CurvesA=rectangle.Rectangle, CurvesB=merge_45)
trim_53 = TrimTree(Tree=rdiff_5, Depth=1)
item_33 = ListItem(List=trim_52, Index=0, Wrap=True)
s_cars_2 = Brep(item_33)
s_pedestrian = Brep(item_31.Item1)
s_building = Brep(null)
s_green = Brep(null)
g_cars = Brep(null)
g_pedestrian = Brep(null)
g_green = Brep(trim_53)
group = Group(Geometry=merge_45)

g_building = Geometry(group)

expression_5 = Expression(x=multiplication_9, Expression="x/2")
ln_28 = Line(StartPoint=item.Item, EndPoint=item.Item2)
neg_13 = Negative(Value=expression_5)
offset_14 = OffsetCurve(Curve=ln_28, Distance=expression_5, Corners=1)  # -> reparameterize(Curve)
offset_15 = OffsetCurve(Curve=ln_28, Distance=neg_13, Corners=1)  # -> reparameterize(Curve)
crv_7 = Curve(reparameterize(item_2.Item))
crv_8 = Curve(reparameterize(trim_6))
trim_54 = TrimTree(Tree=offset_15, Depth=1)
crv_9 = Curve(reparameterize(item_2.Item1))
crv_10 = Curve(reparameterize(trim_7))
trim_55 = TrimTree(Tree=offset_14, Depth=1)
llx_7 = LineLine(Line1=trim_55, Line2=crv_7)  # -> ParamA, ParamB, PointA, PointB
llx_8 = LineLine(Line1=trim_54, Line2=crv_8)  # -> ParamA, ParamB, PointA, PointB
llx_9 = LineLine(Line1=trim_55, Line2=crv_10)  # -> ParamA, ParamB, PointA, PointB
llx_10 = LineLine(Line1=trim_54, Line2=crv_9)  # -> ParamA, ParamB, PointA, PointB
shatter_6 = Shatter(Curve=crv_7, Parameters=llx_7.ParamB)
shatter_7 = Shatter(Curve=crv_9, Parameters=llx_10.ParamB)
shatter_8 = Shatter(Curve=crv_10, Parameters=llx_9.ParamB)
dom_6 = ConstructDomain(DomainStart=llx_7.ParamA, DomainEnd=llx_9.ParamA)
shatter_9 = Shatter(Curve=crv_8, Parameters=llx_8.ParamB)
dom_7 = ConstructDomain(DomainStart=llx_10.ParamA, DomainEnd=llx_8.ParamA)
trim_56 = TrimTree(Tree=shatter_7, Depth=1)
trim_57 = TrimTree(Tree=shatter_8, Depth=1)
trim_58 = TrimTree(Tree=shatter_6, Depth=1)
trim_59 = TrimTree(Tree=shatter_9, Depth=1)
item_34 = ListItem(List=trim_56, Index=0, Wrap=True)  # -> Item, Item1
subcrv_4 = SubCurve(BaseCurve=trim_55, Domain=dom_6)
item_35 = ListItem(List=trim_58, Index=0, Wrap=True)
item_36 = ListItem(List=trim_57, Index=0, Wrap=True)
subcrv_5 = SubCurve(BaseCurve=trim_54, Domain=dom_7)
item_37 = ListItem(List=trim_59, Index=0, Wrap=True)  # -> Item, Item1
merge_46 = Merge(Data1=subcrv_4, Data2=item_36)
merge_47 = Merge(Data1=subcrv_5, Data2=item_37.Item)
merge_48 = Merge(Data1=item_35, Data2=subcrv_4, Data3=item_36, Data4=ln_3, Data5=item_37.Item, Data6=subcrv_5, Data7=item_34.Item1)
merge_49 = Merge(Data1=i_cars, Data2=i_pedestrian)
join_23 = JoinCurves(Curves=merge_47, Preserve=False)
join_24 = JoinCurves(Curves=merge_46, Preserve=False)
join_25 = JoinCurves(Curves=merge_48, Preserve=False)
runion_7 = RegionUnion(Curves=merge_49)
trim_60 = TrimTree(Tree=join_23, Depth=1)
offset_16 = OffsetCurve(Curve=trim_60, Distance=neg_3, Corners=1)
trim_61 = TrimTree(Tree=offset_16, Depth=1)
clx = CurveLine(Curve=trim_61, Line=item_2.Item1)  # -> Points, Params, Count
trim_62 = TrimTree(Tree=clx.Points, Depth=1)
crv_cp = CurveClosestPoint(Point=trim_62, Curve=item_2.Item1)  # -> Point, Parameter, Distance
trim_63 = TrimTree(Tree=clx.Params, Depth=1)
dom_8 = ConstructDomain(DomainStart=crv_cp.Parameter, DomainEnd=llx_10.ParamB)
subcrv_6 = SubCurve(BaseCurve=trim_61, Domain=trim_63)
subcrv_7 = SubCurve(BaseCurve=item_2.Item1, Domain=crv_cp.Parameter)
subcrv_8 = SubCurve(BaseCurve=item_2.Item1, Domain=dom_8)
merge_50 = Merge(Data1=subcrv_6, Data2=subcrv_7, Data3=ln)
merge_51 = Merge(Data1=subcrv_6, Data2=merge_47, Data3=ln_2, Data4=subcrv_8)
join_26 = JoinCurves(Curves=merge_50, Preserve=False)
join_27 = JoinCurves(Curves=merge_50, Preserve=False)
join_28 = JoinCurves(Curves=merge_51, Preserve=False)
trim_64 = TrimTree(Tree=join_24, Depth=1)
trim_65 = TrimTree(Tree=join_25, Depth=1)
rdiff_6 = RegionDifference(CurvesA=rectangle.Rectangle, CurvesB=trim_65)
trim_66 = TrimTree(Tree=join_26, Depth=1)
trim_67 = TrimTree(Tree=join_27, Depth=1)
trim_68 = TrimTree(Tree=join_28, Depth=1)
trim_69 = TrimTree(Tree=rdiff_6, Depth=1)
item_38 = ListItem(List=trim_69, Index=0, Wrap=True)  # -> Item, Item1
trim_70 = TrimTree(Tree=runion_7, Depth=1)
g_cars_2 = Brep(i_cars)
g_pedestrian_2 = Brep(i_pedestrian)
g_green_2 = Brep(item_38.Item1)

merge_52 = Merge(Data1=merge_36, Data2=merge_37, Data3=item_24.Item1, Data4=item_35, Data5=ln_10)
join_29 = JoinCurves(Curves=merge_52, Preserve=False)
trim_71 = TrimTree(Tree=join_29, Depth=1)
rdiff_7 = RegionDifference(CurvesA=rectangle.Rectangle, CurvesB=trim_71)
trim_72 = TrimTree(Tree=rdiff_7, Depth=1)
item_39 = ListItem(List=trim_72, Index=0, Wrap=True)  # -> Item, Item1
rdiff_8 = RegionDifference(CurvesA=item_39.Item1, CurvesB=trim_28)
trim_73 = TrimTree(Tree=rdiff_8, Depth=1)
merge_53 = Merge(Data1=trim_34, Data2=trim_73)
runion_8 = RegionUnion(Curves=merge_53)
trim_74 = TrimTree(Tree=runion_8, Depth=1)
s_pedestrian_2 = Brep(trim_74)
merge_54 = Merge(Data1=s_cars, Data2=s_pedestrian_2)
runion_9 = RegionUnion(Curves=merge_54)
trim_75 = TrimTree(Tree=runion_9, Depth=1)
rdiff_9 = RegionDifference(CurvesA=trim_71, CurvesB=trim_75)
trim_76 = TrimTree(Tree=rdiff_9, Depth=1)
s_building_2 = Brep(trim_76)
s_green_2 = Brep(item_39.Item)

rdiff_10 = RegionDifference(CurvesA=trim_65, CurvesB=trim_70)
trim_77 = TrimTree(Tree=rdiff_10, Depth=1)

g_building_2 = Brep(trim_77)

move_10 = Move(Geometry=trim_35, Motion=Z_5)  # -> Geometry, Transform
move_11 = Move(Geometry=trim_36, Motion=Z_5)  # -> Geometry, Transform
mirror_11 = Mirror(Geometry=tweencrv_3, Plane=PlaneYZ(0, 0, 0))  # -> Geometry, Transform
llx_11 = LineLine(Line1=ln_25, Line2=mirror_11.Geometry)  # -> ParamA, ParamB, PointA, PointB
subcrv_9 = SubCurve(BaseCurve=mirror_11.Geometry, Domain=llx_11.ParamB)
subcrv_10 = SubCurve(BaseCurve=ln_25, Domain=llx_11.ParamA)
merge_55 = Merge(Data1=subcrv_10, Data2=subcrv_9)
extr_7 = Extrude(Base=item_26, Direction=Z_6)
extr_8 = Extrude(Base=trim_35, Direction=Z_5)
extr_9 = Extrude(Base=trim_36, Direction=Z_5)
join_30 = JoinCurves(Curves=merge_55, Preserve=False)
trim_78 = TrimTree(Tree=join_30, Depth=1)
move_12 = Move(Geometry=trim_78, Motion=Z_6)  # -> Geometry, Transform
merge_56 = Merge(Data1=move_10.Geometry, Data2=move_12.Geometry)
merge_57 = Merge(Data1=move_11.Geometry, Data2=move_12.Geometry)
loft_7 = Loft(Curves=merge_56, Options={Adjust=False, Closed=False, LoftEnds=0, LoftSimp=0, LoftType=0, Rebuild=10, Refit=0.01})
loft_8 = Loft(Curves=merge_57, Options={Adjust=False, Closed=False, LoftEnds=0, LoftSimp=0, LoftType=0, Rebuild=10, Refit=0.01})
split = SplitBrep(Brep=extr_7, Cutter=loft_8)
trim_79 = TrimTree(Tree=split, Depth=1)
multiplication_16 = Multiplication(A=width, B=street_height_percentage)
item_40 = ListItem(List=trim_79, Index=0, Wrap=True)
merge_58 = Merge(Data1=extr_8, Data2=loft_7, Data3=loft_8, Data4=extr_9, Data5=s_building_2, Data6=item_40)
join_31 = BrepJoin(Breps=merge_58)  # -> Breps, Closed
Z_7 = UnitZ(Factor=multiplication_16)
capex_4 = CapHolesEx(Brep=join_31.Breps)  # -> Brep, Caps, Solid
srf = Surface(trim_75)
extr_10 = Extrude(Base=srf, Direction=Z_7)
sdiff = SolidDifference(BrepsA=capex_4.Brep, BrepsB=extr_10)
s_building_3 = Brep(sdiff)

move_13 = Move(Geometry=trim_60, Motion=Z_5)  # -> Geometry, Transform
move_14 = Move(Geometry=trim_64, Motion=Z_5)  # -> Geometry, Transform
llx_12 = LineLine(Line1=ln_28, Line2=tweencrv_3)  # -> ParamA, ParamB, PointA, PointB
subcrv_11 = SubCurve(BaseCurve=tweencrv_3, Domain=llx_12.ParamB)
subcrv_12 = SubCurve(BaseCurve=ln_28, Domain=llx_12.ParamA)
merge_59 = Merge(Data1=subcrv_12, Data2=subcrv_11)
extr_11 = Extrude(Base=item_35, Direction=Z_6)
extr_12 = Extrude(Base=trim_60, Direction=Z_5)
extr_13 = Extrude(Base=trim_64, Direction=Z_5)
join_32 = JoinCurves(Curves=merge_59, Preserve=False)
trim_80 = TrimTree(Tree=join_32, Depth=1)
move_15 = Move(Geometry=trim_80, Motion=Z_6)  # -> Geometry, Transform
merge_60 = Merge(Data1=move_13.Geometry, Data2=move_15.Geometry)
merge_61 = Merge(Data1=move_14.Geometry, Data2=move_15.Geometry)
loft_9 = Loft(Curves=merge_60, Options={Adjust=False, Closed=False, LoftEnds=0, LoftSimp=0, LoftType=0, Rebuild=10, Refit=0.01})
loft_10 = Loft(Curves=merge_61, Options={Adjust=False, Closed=False, LoftEnds=0, LoftSimp=0, LoftType=0, Rebuild=10, Refit=0.01})
split_2 = SplitBrep(Brep=extr_11, Cutter=loft_10)
trim_81 = TrimTree(Tree=split_2, Depth=1)
srf_2 = Surface(trim_70)
item_41 = ListItem(List=trim_81, Index=0, Wrap=True)
merge_62 = Merge(Data1=extr_12, Data2=loft_9, Data3=loft_10, Data4=extr_13, Data5=g_building_2, Data6=item_41)
join_33 = BrepJoin(Breps=merge_62)  # -> Breps, Closed
extr_14 = Extrude(Base=srf_2, Direction=Z_7)
capex_5 = CapHolesEx(Brep=join_33.Breps)  # -> Brep, Caps, Solid
sdiff_2 = SolidDifference(BrepsA=capex_5.Brep, BrepsB=extr_14)
fmerge = MergeFaces(Brep=sdiff_2)  # -> Breps, Before, After
g_building_3 = Brep(fmerge.Breps)

move_16 = Move(Geometry=mirror_6.Geometry, Motion=Z_5)  # -> Geometry, Transform
move_17 = Move(Geometry=subcrv_3, Motion=Z_5)  # -> Geometry, Transform
move_18 = Move(Geometry=ln_26, Motion=Z_6)  # -> Geometry, Transform
merge_63 = Merge(Data1=move_16.Geometry, Data2=move_18.Geometry)
merge_64 = Merge(Data1=move_17.Geometry, Data2=move_18.Geometry)
loft_11 = Loft(Curves=merge_63, Options={Adjust=False, Closed=False, LoftEnds=0, LoftSimp=0, LoftType=0, Rebuild=10, Refit=0.01})
loft_12 = Loft(Curves=merge_64, Options={Adjust=False, Closed=False, LoftEnds=0, LoftSimp=0, LoftType=0, Rebuild=10, Refit=0.01})
extr_15 = Extrude(Base=subcrv_3, Direction=Z_5)
extr_16 = Extrude(Base=mirror_6.Geometry, Direction=Z_5)
merge_65 = Merge(Data1=extr_16, Data2=loft_11, Data3=loft_12, Data4=extr_15, Data5=trim_41)
join_34 = BrepJoin(Breps=merge_65)  # -> Breps, Closed
srf_3 = Surface(trim_45)
extr_17 = Extrude(Base=srf_3, Direction=Z_7)
capex_6 = CapHolesEx(Brep=join_34.Breps)  # -> Brep, Caps, Solid
sdiff_3 = SolidDifference(BrepsA=capex_6.Brep, BrepsB=extr_17)
fmerge_2 = MergeFaces(Brep=sdiff_3)  # -> Breps, Before, After
building_2 = Brep(fmerge_2.Breps)

mirror_12 = Mirror(Geometry=s_cars, Plane=PlaneYZ(0, 0, 0))  # -> Geometry, Transform
mirror_13 = Mirror(Geometry=s_pedestrian_2, Plane=PlaneYZ(0, 0, 0))  # -> Geometry, Transform
mirror_14 = Mirror(Geometry=s_building_2, Plane=PlaneYZ(0, 0, 0))  # -> Geometry, Transform
mirror_15 = Mirror(Geometry=s_green_2, Plane=PlaneYZ(0, 0, 0))  # -> Geometry, Transform
s_cars_3 = Brep(mirror_12.Geometry)
s_pedestrian_3 = Brep(mirror_13.Geometry)
s_building_4 = Brep(mirror_14.Geometry)
s_green_3 = Brep(mirror_15.Geometry)
mirror_16 = Mirror(Geometry=g_cars_2, Plane=PlaneYZ(0, 0, 0))  # -> Geometry, Transform
mirror_17 = Mirror(Geometry=g_pedestrian_2, Plane=PlaneYZ(0, 0, 0))  # -> Geometry, Transform
mirror_18 = Mirror(Geometry=g_building_2, Plane=PlaneYZ(0, 0, 0))  # -> Geometry, Transform
mirror_19 = Mirror(Geometry=g_green_2, Plane=PlaneYZ(0, 0, 0))  # -> Geometry, Transform
g_cars_3 = Brep(mirror_16.Geometry)
g_pedestrian_3 = Brep(mirror_17.Geometry)
g_building_4 = Brep(mirror_18.Geometry)
g_green_3 = Brep(mirror_19.Geometry)
mirror_20 = Mirror(Geometry=s_building_3, Plane=PlaneYZ(0, 0, 0))  # -> Geometry, Transform
mirror_21 = Mirror(Geometry=g_building_3, Plane=PlaneYZ(0, 0, 0))  # -> Geometry, Transform
g_building_5 = Brep(mirror_21.Geometry)
s_building_5 = Brep(mirror_20.Geometry)

extr_18 = Extrude(Base=mirror_10.Geometry, Direction=Z_6)
explode_2 = Explode(Curve=mirror_10.Geometry, Recursive=True)  # -> Segments, Vertices
trim_82 = TrimTree(Tree=explode_2.Vertices, Depth=1)
item_42 = ListItem(List=trim_82, Index=0, Wrap=True)  # -> Item, Item1, Item2
move_19 = Move(Geometry=item_42.Item, Motion=Z_5)  # -> Geometry, Transform
move_20 = Move(Geometry=item_42.Item2, Motion=Z_5)  # -> Geometry, Transform
move_21 = Move(Geometry=item_42.Item1, Motion=Z_6)  # -> Geometry, Transform
srf4pt = _4PointSurface(CornerA=move_19.Geometry, CornerB=move_20.Geometry, CornerC=move_21.Geometry)
split_3 = SplitBrep(Brep=extr_18, Cutter=srf4pt)
trim_83 = TrimTree(Tree=split_3, Depth=1)
item_43 = ListItem(List=trim_83, Index=0, Wrap=True)
srf_4 = Surface(item_31.Item)
capex_7 = CapHolesEx(Brep=item_43)  # -> Brep, Caps, Solid
extr_19 = Extrude(Base=srf_4, Direction=Z_7)
fmerge_3 = MergeFaces(Brep=capex_7.Brep)  # -> Breps, Before, After
sdiff_4 = SolidDifference(BrepsA=fmerge_3.Breps, BrepsB=extr_19)
mirror_22 = Mirror(Geometry=fmerge_3.Breps, Plane=rotate_6.Geometry)  # -> Geometry, Transform
fmerge_4 = MergeFaces(Brep=sdiff_4)  # -> Breps, Before, After
merge_66 = Merge(Data1=fmerge_3.Breps, Data2=mirror_22.Geometry)
mirror_23 = Mirror(Geometry=fmerge_4.Breps, Plane=rotate_6.Geometry)  # -> Geometry, Transform
group_2 = Group(Geometry=merge_66)
merge_67 = Merge(Data1=fmerge_4.Breps, Data2=mirror_23.Geometry)
g_building_6 = Geometry(group_2)
group_3 = Group(Geometry=merge_67)
s_building_6 = Geometry(group_3)

filter = StreamFilter(
    Gate=itemindex,
    Stream0=l_s_building,
    Stream1=l_b_building_2,
    Stream2=i_building_2,
    Stream4=s_building_3,
    Stream5=g_building_3,
    Stream6=s_building_5,
    Stream7=g_building_5,
    Stream8=building_2,
    Stream9=s_building_6,
    Stream10=g_building_6)
filter_2 = StreamFilter(
    Gate=itemindex,
    Stream0=l_building,
    Stream1=l_b_building,
    Stream2=i_building,
    Stream4=s_building_2,
    Stream5=g_building_2,
    Stream6=s_building_4,
    Stream7=g_building_4,
    Stream8=building,
    Stream9=s_building,
    Stream10=g_building)
filter_3 = StreamFilter(
    Gate=itemindex,
    Stream0=l_green,
    Stream1=l_b_green,
    Stream2=i_backyard,
    Stream4=s_green_2,
    Stream5=g_green_2,
    Stream6=s_green_3,
    Stream7=g_green_3,
    Stream8=green,
    Stream9=s_green,
    Stream10=g_green)
filter_4 = StreamFilter(
    Gate=itemindex,
    Stream0=l_cars,
    Stream1=l_b_cars,
    Stream2=i_cars,
    Stream4=s_cars,
    Stream5=g_cars_2,
    Stream6=s_cars_3,
    Stream7=g_cars_3,
    Stream8=cars,
    Stream9=s_cars_2,
    Stream10=g_cars)
filter_5 = StreamFilter(
    Gate=itemindex,
    Stream0=l_pedestrian,
    Stream1=l_b_pedestrian,
    Stream2=i_pedestrian,
    Stream4=s_pedestrian_2,
    Stream5=g_pedestrian_2,
    Stream6=s_pedestrian_3,
    Stream7=g_pedestrian_3,
    Stream8=pedestrian,
    Stream9=s_pedestrian,
    Stream10=g_pedestrian)
building_3 = Geometry(filter_2)
green_2 = Geometry(filter_3)
cars_2 = Geometry(filter_4)
pedestrian_2 = Geometry(filter_5)
merge_68 = Merge(Data1=cars_2, Data2=pedestrian_2, Data3=green_2)
merge_69 = Merge(Data1=filter, Data2=merge_68)
geo = Geometry(merge_69)
geo_2 = PreviewGeometry(geo=geo)
volume = Geometry(filter)
surfaces = Geometry(merge_68)
geo_3 = ClusterOutput(geo)
volume_2 = ClusterOutput(volume)
surfaces_2 = ClusterOutput(surfaces)
building_4 = ClusterOutput(building_3)
green_3 = ClusterOutput(green_2)
cars_3 = ClusterOutput(cars_2)
pedestrian_3 = ClusterOutput(pedestrian_2)

# ==== cluster PreviewGeometry_2: semio styled preview of geometry.
geo = ClusterInput()
swatch = ColourSwatch(SwatchColor=RGB(255, 255, 255))
swatch_2 = ColourSwatch(SwatchColor=RGB(0, 0, 0))
geo_2 = Geometry(flatten(geo))
dispatch = CSharpScript(D=geo_2)  # -> P, C, B, M, R; same code as dispatch
clean = CleanTree(RemoveNulls=True, RemoveInvalid=True, RemoveEmpty=False, Tree=dispatch.P)
clean_2 = CleanTree(RemoveNulls=True, RemoveInvalid=True, RemoveEmpty=False, Tree=dispatch.C)
clean_3 = CleanTree(RemoveNulls=True, RemoveInvalid=True, RemoveEmpty=False, Tree=dispatch.B)
clean_4 = CleanTree(RemoveNulls=True, RemoveInvalid=True, RemoveEmpty=False, Tree=dispatch.M)
clean_5 = CleanTree(RemoveNulls=True, RemoveInvalid=True, RemoveEmpty=False, Tree=dispatch.R)
debrep = DeconstructBrep(Brep=clean_3)  # -> Faces, Edges, Vertices
preview = CustomPreview(Geometry=flatten(clean_5), Material=swatch_2)
preview_2 = CustomPreview(Geometry=flatten(clean), Material=swatch_2)
preview_3 = CustomPreview(Geometry=flatten(clean_2), Material=swatch_2)
preview_4 = CustomPreview(Geometry=flatten(debrep.Faces), Material=swatch)
preview_5 = CustomPreview(Geometry=flatten(debrep.Edges), Material=swatch_2)
preview_6 = CustomPreview(Geometry=flatten(clean_4), Material=swatch)

# ==== cluster TypesToModules: Convert semio types to Monoceros modules.
ty = ClusterInput()
ob = ClusterInput()
D = ClusterInput()
ty_2 = Type(graft(ty))
ob_2 = Data(ob)
D_2 = ModulePartDiagonal(D)
typ = ModelType(Type=ty_2)  # -> Type, Valid, Name, Description, Icon, Image, Variant, Unit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
panel = Panel("""e
n
t
w
s
b""")
ungroup = Ungroup(Group=ob_2)
trim = TrimTree(Tree=typ.Qualities, Depth=1)
trim_2 = TrimTree(Tree=typ.Ports, Depth=1)
qal = SelectQuality(ql=trim, na="monoceros.module.center")
trim_3 = TrimTree(Tree=ungroup, Depth=1)
por = SelectPort(po=trim_2, id="e")  # -> po_4, i_2
por_2 = SelectPort(po=trim_2, id="n")  # -> po_4, i_2
por_3 = SelectPort(po=trim_2, id="t")  # -> po_4, i_2
por_4 = SelectPort(po=trim_2, id="w")  # -> po_4, i_2
por_5 = SelectPort(po=trim_2, id="s")  # -> po_4, i_2
por_6 = SelectPort(po=trim_2, id="b")  # -> po_4, i_2
qal_2 = ModelQuality(Quality=qal)  # -> Quality, Valid, Name, graft(Value), Unit, Definition
merge = Merge(
    Data1=graft(por.po_4),
    Data2=graft(por_2.po_4),
    Data3=graft(por_3.po_4),
    Data4=graft(por_4.po_4),
    Data5=graft(por_5.po_4),
    Data6=graft(por_6.po_4))
txt = Text(ty_2)
constmodule = ConstructModule(ModuleName=txt, ModulePartPoints=qal_2.Value, Geometry=trim_3, BasePlane=qal_2.Value, ModulePartDiagonal=D_2)
por_7 = ModelPort(Port=merge)  # -> Port, Valid, Id, Description, Family, CompatibleFamilies, Point, Direction, T, Qualities
M = Module(constmodule)
item = ListItem(List=por_7.CompatibleFamilies, Index=0, Wrap=True)
series = Series(Start=0, Step=1, Count="6")  # -> flatten(Series)
qal_3 = SelectQuality(ql=por_7.Qualities, na="monoceros.connector.out")
chars = Characters(Text=item)  # -> reverse(Result), Unicode
null = NullItem(Item=merge)  # -> NullFlags, InvalidFlags, Description
cull = CullPattern(List=series, CullPattern=invert(null.NullFlags))
cull_2 = CullPattern(List=por_7.Point, CullPattern=invert(null.NullFlags))
cull_3 = CullPattern(List=qal_3, CullPattern=invert(null.NullFlags))
trim_4 = TrimTree(Tree=chars.Result, Depth=1)
join = TextJoin(Text=trim_4)
qal_4 = ModelQuality(Quality=cull_3)  # -> Quality, Valid, Name, Value, Unit, Definition
concat = Concatenate(FragmentA=graft(por_7.Family), FragmentC="##", FragmentB=join)
cull_4 = CullPattern(List=cull_2, CullPattern=qal_4.Value)
trim_5 = TrimTree(Tree=concat, Depth=1)
expression = Expression(x=trim_5, y="indifferent", z="##", Expression="If(x=z,y,x)")
cull_5 = CullPattern(List=expression, CullPattern=invert(null.NullFlags))
ruletyp = ConstructTypedRule(ModuleName=txt, ConnectorIndex=cull, Type=cull_5)
ruleboundpt = RuleAtBoundaryFromPoint(Modules=M, PointTag=cull_4)
trim_6 = TrimTree(Tree=ruleboundpt, Depth=1)
merge_2 = Merge(Data1=ruletyp, Data2=trim_6)
ruleindiffunused = IndifferentRulesForUnusedConnectors(Module=M, Rules=merge_2)
trim_7 = TrimTree(Tree=ruleindiffunused, Depth=1)
merge_3 = Merge(Data1=merge_2, Data2=trim_7)
mod = Mod(M=M, R=merge_3, rt=[False, False, False, False, False, False, True, True, True])  # -> M_4, R_4
item_2 = ListItem(List=mod.M_4, Index=0, Wrap=True)  # -> Item, Item1, Item2, Item3; disabled
item_3 = ListItem(List=mod.R_4, Index=0, Wrap=True)  # -> Item, Item1, Item2, Item3; disabled
trim_8 = TrimTree(Tree=mod.R_4, Depth=1)
trim_9 = TrimTree(Tree=item_3.Item, Depth=1)  # disabled
trim_10 = TrimTree(Tree=item_3.Item1, Depth=1)  # disabled
trim_11 = TrimTree(Tree=item_3.Item2, Depth=1)  # disabled
trim_12 = TrimTree(Tree=item_3.Item3, Depth=1)  # disabled
M_2 = Module(mod.M_4)
R = Rule(trim_8)
isruleexp = IsRuleExplicit(Rule=R)
dispatch = Dispatch(List=R, DispatchPattern=isruleexp)  # -> ListA, ListB
deconruletyp = DeconstructTypedRule(Rule=dispatch.ListB)  # -> ModuleName, ConnectorIndex, Type
equals = Equality(FirstNumber=deconruletyp.ConnectorIndex, SecondNumber="4")  # -> Equality, Inequality
equals_2 = Equality(FirstNumber=deconruletyp.ConnectorIndex, SecondNumber="5")  # -> Equality, Inequality
equals_3 = Equality(FirstNumber=deconruletyp.ConnectorIndex, SecondNumber="1")  # -> Equality, Inequality
equals_4 = Equality(FirstNumber=deconruletyp.ConnectorIndex, SecondNumber="2")  # -> Equality, Inequality
equals_5 = Equality(FirstNumber=deconruletyp.ConnectorIndex, SecondNumber="3")  # -> Equality, Inequality
equals_6 = Equality(FirstNumber=deconruletyp.ConnectorIndex, SecondNumber="0")  # -> Equality, Inequality
cull_6 = CullPattern(List=deconruletyp.Type, CullPattern=equals.Equality)
cull_7 = CullPattern(List=deconruletyp.Type, CullPattern=equals_2.Equality)
cull_8 = CullPattern(List=deconruletyp.ModuleName, CullPattern=equals.Equality)
cull_9 = CullPattern(List=deconruletyp.ModuleName, CullPattern=equals_2.Equality)
cull_10 = CullPattern(List=deconruletyp.Type, CullPattern=equals_3.Equality)
cull_11 = CullPattern(List=deconruletyp.Type, CullPattern=equals_4.Equality)
cull_12 = CullPattern(List=deconruletyp.Type, CullPattern=equals_5.Equality)
cull_13 = CullPattern(List=deconruletyp.ModuleName, CullPattern=equals_5.Equality)
cull_14 = CullPattern(List=deconruletyp.Type, CullPattern=equals_6.Equality)
chars_2 = Characters(Text=cull_6)  # -> reverse(Result), Unicode
chars_3 = Characters(Text=cull_7)  # -> reverse(Result), Unicode
chars_4 = Characters(Text=cull_12)  # -> reverse(Result), Unicode
cset = CreateSet(List=flatten(cull_10))  # -> Set, Map
cset_2 = CreateSet(List=flatten(cull_11))  # -> Set, Map
cset_3 = CreateSet(List=flatten(cull_14))  # -> Set, Map
join_2 = TextJoin(Text=chars_2.Result)
join_3 = TextJoin(Text=chars_3.Result)
join_4 = TextJoin(Text=chars_4.Result)
expression_2 = Expression(x=graft(cset.Set), y=flatten(join_2), Expression="x=y")
expression_3 = Expression(x=graft(cset_2.Set), y=flatten(join_3), Expression="x=y")
expression_4 = Expression(x=graft(cset_3.Set), y=flatten(join_4), Expression="x=y")
cull_15 = CullPattern(List=flatten(join_2), CullPattern=expression_2)
cull_16 = CullPattern(List=flatten(join_3), CullPattern=expression_3)
cull_17 = CullPattern(List=flatten(join_4), CullPattern=expression_4)
cull_18 = CullPattern(List=flatten(cull_8), CullPattern=expression_2)
cull_19 = CullPattern(List=flatten(cull_9), CullPattern=expression_3)
cull_20 = CullPattern(List=flatten(cull_13), CullPattern=expression_4)
ruletyp_2 = ConstructTypedRule(ModuleName=cull_18, ConnectorIndex="4", Type=cull_15)
ruletyp_3 = ConstructTypedRule(ModuleName=cull_19, ConnectorIndex="5", Type=cull_16)
ruletyp_4 = ConstructTypedRule(ModuleName=cull_20, ConnectorIndex="3", Type=cull_17)
merge_4 = Merge(Data1=graft(dispatch.ListA), Data2=R)
merge_5 = Merge(Data1=graft(ruletyp_4), Data2=graft(ruletyp_2), Data3=graft(ruletyp_3))
rule = ReplaceRule(R=flatten(merge_4), rule=flatten(merge_5))
collectrules = CollectRules(Modules=flatten(M_2), RulesAllowed=rule)
R_2 = Rule(collectrules)
R_3 = ClusterOutput(R_2)
mod_2 = Mod_2(M=item_2.Item, R=trim_9, mi=[True, True, False])  # -> M_4, R_4; disabled
mod_3 = Mod_2(M=item_2.Item1, R=trim_10, mi=[True, True, False])  # -> M_4, R_4; disabled
mod_4 = Mod_2(M=item_2.Item2, R=trim_11, mi=[True, True, False])  # -> M_4, R_4; disabled
mod_5 = Mod_2(M=item_2.Item3, R=trim_12, mi=[True, True, False])  # -> M_4, R_4; disabled
M_3 = ClusterOutput(M_2)
trim_13 = TrimTree(Tree=mod_2.R_4, Depth=1)  # disabled
trim_14 = TrimTree(Tree=mod_3.R_4, Depth=1)  # disabled
trim_15 = TrimTree(Tree=mod_4.R_4, Depth=1)  # disabled
trim_16 = TrimTree(Tree=mod_5.R_4, Depth=1)  # disabled
mrg_a = MergeSeperatlyAppend(x=mod_2.M_4, y=mod_3.M_4, z=mod_4.M_4, u=mod_5.M_4)  # -> Mrgd; inputs x: tree, y: tree, z: tree, u: tree; disabled; same code as mrg_a
mrg_a_2 = MergeSeperatlyAppend(x=trim_13, y=trim_14, z=trim_15, u=trim_16)  # -> Mrgd; inputs x: tree, y: tree, z: tree, u: tree; disabled; same code as mrg_a

# ==== cluster ShowDesign: Show a design by flattening it and selecting representations based on mime and tags. Select exactly one representation based on mime and tags. The tag matching is based on the highest Jaccard index (|∩|/|∪|). If the mime type is not given or does not exist, then all representations are used to search for closest match. If index is equally high the first representation is picked.
ob = ClusterInput()
dn = ClusterInput()
ty = ClusterInput()
mm = ClusterInput()
tags = ClusterInput()
ty_2 = Type(ty)
ob_2 = Data(ob)
dn_2 = Design(dn)
mm_2 = Mime(mm)
tags_2 = Tags(tags)
fltdsn = FlattenDesign(Design=dn_2, Type=ty_2)
ungroup = Ungroup(Group=ob_2)
dsn = ModelDesign(Design=fltdsn)  # -> Design, Valid, Name, Description, Icon, Image, Variant, View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
pce = ModelPiece(Piece=dsn.Pieces)  # -> Piece, Valid, Id, Description, TypeName, TypeVariant, Plane, Center, Qualities
trim = TrimTree(Tree=dsn.Pieces, Depth=1)
typ = SelectTypeByPiece(ty=ty_2, pc=trim)  # -> ty_4, i_2
typ_2 = ModelType(Type=typ.ty_4)  # -> Type, Valid, Name, Description, Icon, Image, Variant, Unit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
rep = SelectRepresentation(rp=typ_2.Representations, mm=mm_2, tags=tags_2)  # -> rp_5, i_2, ur_2, pa_ur_2
lng = ListLength(List=typ_2.Representations)
expression = Expression(x="0", y=typ.ty_4, Expression="x")
tstat = TreeStatistics(Tree=ty_2)  # -> Paths, Length, Count
trim_2 = TrimTree(Tree=lng, Depth=1)
merge = Merge(Data1=graft(expression), Data2=graft(rep.i_2))
tstat_2 = TreeStatistics(Tree=ob_2)  # -> Paths, Length, Count
lng_2 = ListLength(List=tstat.Paths)
expression_2 = Expression(x=trim_2, Expression="x=0")
expression_3 = Expression(x=lng_2, Expression="x>1")
bool = Boolean(invert(graft(expression_2)))
item = ListItem(List=merge, Index=bool, Wrap=True)
trim_3 = TrimTree(Tree=item, Depth=1)
i = Integer(trim_3)
item_2 = ListItem(List=tstat_2.Paths, Index=i, Wrap=True)
panel = Panel(i)
item_3 = ListItem(List=ob_2, Index=i, Wrap=True)
orient = Orient(Geometry=item_3, Source=PlaneXY(0, 0, 0), Target=pce.Plane)  # -> Geometry, Transform
go = Group(orient.Geometry)
geo = PreviewGeometry(geo=go)

# ==== cluster PreviewGeometry: semio styled preview of geometry.
geo = ClusterInput()
swatch = ColourSwatch(SwatchColor=RGB(255, 255, 255))
swatch_2 = ColourSwatch(SwatchColor=RGB(0, 0, 0))
geo_2 = Geometry(flatten(geo))
ungroup = Ungroup(Group=geo_2)
clean = CleanTree(RemoveNulls=True, RemoveInvalid=True, RemoveEmpty=invert(False), Tree=ungroup)  # -> flatten(Tree)
dispatch = CSharpScript(D=clean)  # -> P, C, B, M, R
# ---------- dispatch: C# ----------
// Grasshopper Script Instance
#region Usings
using System;
using System.Linq;
using System.Collections;
using System.Collections.Generic;
using System.Drawing;

using Rhino;
using Rhino.Geometry;

using Grasshopper;
using Grasshopper.Kernel;
using Grasshopper.Kernel.Data;
using Grasshopper.Kernel.Types;
#endregion

public class Script_Instance : GH_ScriptInstance
{
    #region Notes
    /* 
      Members:
        RhinoDoc RhinoDocument
        GH_Document GrasshopperDocument
        IGH_Component Component
        int Iteration

      Methods (Virtual & overridable):
        Print(string text)
        Print(string format, params object[] args)
        Reflect(object obj)
        Reflect(object obj, string method_name)
    */
    #endregion

    private void RunScript(
	object D,
	ref object P,
	ref object C,
	ref object B,
	ref object M,
	ref object R)
    {
        if (D is Curve) C = D; // Curve
        else if (
            D is Rhino.Geometry.Point ||
            D is PointCloud
            )
            P = D; // Point
        else if ( D is Mesh) M = D; // Mesh
        else if (
            D is Surface ||
            D is Extrusion ||
            D is SubD ||
            D is Brep
            )
            B = D; // Brep
        else R = D; // Rest
            
    }
}
# ---------- end dispatch ----------
clean_2 = CleanTree(RemoveNulls=True, RemoveInvalid=True, RemoveEmpty=False, Tree=dispatch.P)
clean_3 = CleanTree(RemoveNulls=True, RemoveInvalid=True, RemoveEmpty=False, Tree=dispatch.C)
clean_4 = CleanTree(RemoveNulls=True, RemoveInvalid=True, RemoveEmpty=False, Tree=dispatch.B)
clean_5 = CleanTree(RemoveNulls=True, RemoveInvalid=True, RemoveEmpty=False, Tree=dispatch.M)
clean_6 = CleanTree(RemoveNulls=True, RemoveInvalid=True, RemoveEmpty=False, Tree=dispatch.R)
debrep = DeconstructBrep(Brep=clean_4)  # -> Faces, Edges, Vertices
preview = CustomPreview(Geometry=flatten(clean_6), Material=swatch_2)
preview_2 = CustomPreview(Geometry=flatten(clean_2), Material=swatch_2)
preview_3 = CustomPreview(Geometry=flatten(clean_3), Material=swatch_2)
preview_4 = CustomPreview(Geometry=flatten(debrep.Faces), Material=swatch)
preview_5 = CustomPreview(Geometry=flatten(debrep.Edges), Material=swatch_2)
preview_6 = CustomPreview(Geometry=flatten(clean_5), Material=swatch)

# ==== cluster PreviewPort: Preview a port by showing the point and direction and if exists: id, family and compatible families.
po = ClusterInput()
W = ClusterInput()
W_2 = Width(W)
po_2 = Port(po)
swatch = ColourSwatch(SwatchColor=RGB(235, 52, 79))
swatch_2 = ColourSwatch(SwatchColor=RGB(250, 149, 0))
por = ModelPort(Port=po_2)  # -> Port, Valid, Id, Description, Family, CompatibleFamilies, Point, Direction, Locators, T
lng = ListLength(List=por.CompatibleFamilies)
expression = Expression(x=por.Family, Expression="x=\"\"")
cull = CullPattern(List=por.Point, CullPattern=expression)
expression_2 = Expression(x=lng, Expression="x=0")
join = TextJoin(Text=por.CompatibleFamilies, Join=",")
merge = Merge(Data1=":")
trim = TrimTree(Tree=join, Depth=1)
trim_2 = TrimTree(Tree=expression_2, Depth=1)
item = ListItem(List=merge, Index=expression, Wrap=invert(True))
concat = Concatenate(FragmentA="[", FragmentB=trim, FragmentC="]")
expression_3 = Expression(y=trim_2, Expression="x")
merge_2 = Merge(Data1=graft(concat), Data2=graft(expression_3))
item_2 = ListItem(List=merge_2, Index=graft(expression), Wrap=invert(True))
trim_3 = TrimTree(Tree=item_2, Depth=1)
concat_2 = Concatenate(FragmentA=por.Id, FragmentB=item, FragmentC=por.Family, FragmentD=trim_3)
vdisex = VectorDisplayEx(Point=por.Point, Vector=por.Direction, Colour=ColourSwatch(SwatchColor=RGB(0, 166, 157)), Width=W_2)
preview = CustomPreview(Geometry=cull, Material=swatch)
tag = TextTag(Location=por.Point, Text=concat_2, Colour=swatch)

# ==== cluster SelectQuality: Select a quality by its name. If no quality matches, null is returned.
ql = ClusterInput()
na = ClusterInput()
na_2 = Name(graft(na))
ql_2 = Quality(ql)
qal = ModelQuality(Quality=ql_2)  # -> Quality, Valid, Name, Value, Unit, Definition
expression = Expression(x=qal.Name, y=na_2, Expression="x=y")
cull = CullPattern(List=qal.Quality, CullPattern=expression)
nulltobranch = AddNullToEmptyBranch(D=cull)  # -> R; inputs D: tree
# ---------- nulltobranch: C# ----------
#region Usings
using System;
using System.Linq;
using System.Collections;
using System.Collections.Generic;
using System.Drawing;

using Rhino;
using Rhino.Geometry;

using Grasshopper;
using Grasshopper.Kernel;
using Grasshopper.Kernel.Data;
using Grasshopper.Kernel.Types;
#endregion

public class Script_Instance : GH_ScriptInstance
{

    private void RunScript(DataTree<object> D, ref object R)
    {
        foreach (GH_Path path in D.Paths)
            if (D.Branch(path).Count == 0)
                D.Add(null, path);

        R = D;
    }
}
# ---------- end nulltobranch ----------
trim = TrimTree(Tree=nulltobranch, Depth=1)
ql_3 = Quality(trim)
ql_4 = ClusterOutput(ql_3)

# ==== cluster Mod
panel = Panel("""False
False
False
False
False
False
True
True
True""")
panel_2 = Panel("""0
1
3
4""")
panel_3 = Panel("""1
2
4
5""")
panel_4 = Panel("""0
2
3
5""")
M = ClusterInput()
R = ClusterInput()
rt = ClusterInput()
M_2 = Module(graft(M))
R_2 = Rule(R)
mrg_a = MergeSeperatlyAppend(x=R_2)  # -> Mrgd; inputs x: tree; same code as mrg_a
lng = ListLength(List=mrg_a)
series = Series(Start=0, Step=1, Count=lng)
trim = TrimTree(Tree=series, Depth=1)
isruleexp = IsRuleExplicit(Rule=mrg_a)
dispatch = Dispatch(List=mrg_a, DispatchPattern=isruleexp)  # -> ListA, ListB
dispatch_2 = Dispatch(List=trim, DispatchPattern=isruleexp)  # -> ListA, ListB
deconruleexp = DeconstructExplicitRule(Rule=dispatch.ListA)  # -> SourceModuleName, SourceConnectorIndex, TargetModuleName, TargetConnectorIndex
deconruletyp = DeconstructTypedRule(Rule=dispatch.ListB)  # -> ModuleName, ConnectorIndex, Type
txt = Text(deconruletyp.ConnectorIndex)
txt_2 = Text(deconruleexp.SourceConnectorIndex)
txt_3 = Text(deconruleexp.TargetConnectorIndex)
rt_2 = Boolean(rt)
item = ListItem(List=rt_2, Index=0, Wrap=True)  # -> Item, Item1, Item2, Item3, Item4, Item5, Item6, Item7, Item8
x_90 = Boolean(item.Item)
x_180 = Boolean(item.Item1)
x_270 = Boolean(item.Item2)
y_90 = Boolean(item.Item3)
y_180 = Boolean(item.Item4)
y_270 = Boolean(item.Item5)
z_90 = Boolean(item.Item6)
z_180 = Boolean(item.Item7)
z_270 = Boolean(item.Item8)

deconmodule = DeconstructModule(Module=M_2, Rules=mrg_a)  # -> ModuleName, ModulePartCenterPoints, Geometry, BasePlane, ModulePartDiagonal, IsCompact, IsValid, Connectors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
trim_2 = TrimTree(Tree=deconmodule.ModulePartCenterPoints, Depth=1)
trim_3 = TrimTree(Tree=deconmodule.Geometry, Depth=1)
trim_4 = TrimTree(Tree=deconmodule.BasePlane, Depth=1)
trim_5 = TrimTree(Tree=deconmodule.ModulePartDiagonal, Depth=1)
trim_6 = TrimTree(Tree=deconmodule.ModuleName, Depth=1)
deplane = DeconstructPlane(Plane=trim_4)  # -> Origin, XAxis, YAxis, ZAxis
pl = ConstructPlane(Origin=deplane.Origin, XAxis=deplane.XAxis, YAxis=deplane.ZAxis)
pl_2 = ConstructPlane(Origin=deplane.Origin, XAxis=deplane.YAxis, YAxis=deplane.ZAxis)
rotate = Rotate(Geometry=trim_3, Angle=degrees("180"), Plane=pl_2)  # -> Geometry, Transform
rotate_2 = Rotate(Geometry=trim_3, Angle=degrees("90"), Plane=pl_2)  # -> Geometry, Transform
rotate_3 = Rotate(Geometry=trim_3, Angle=degrees("270"), Plane=pl_2)  # -> Geometry, Transform
concat = Concatenate(FragmentE=trim_6, FragmentA="↺", FragmentB="90", FragmentC="°", FragmentD="x")
concat_2 = Concatenate(FragmentE=trim_6, FragmentA="↺", FragmentB="270", FragmentC="°", FragmentD="x")
concat_3 = Concatenate(FragmentE=trim_6, FragmentA="↺", FragmentB="180", FragmentC="°", FragmentD="x")
constmodule = ConstructModule(ModuleName=concat_3, ModulePartPoints=trim_2, Geometry=rotate.Geometry, BasePlane=pl_2, ModulePartDiagonal=trim_5)
constmodule_2 = ConstructModule(ModuleName=concat, ModulePartPoints=trim_2, Geometry=rotate_2.Geometry, BasePlane=pl_2, ModulePartDiagonal=trim_5)
constmodule_3 = ConstructModule(ModuleName=concat_2, ModulePartPoints=trim_2, Geometry=rotate_3.Geometry, BasePlane=pl_2, ModulePartDiagonal=trim_5)
rotate_4 = Rotate(Geometry=trim_3, Angle=degrees("180"), Plane=pl)  # -> Geometry, Transform
rotate_5 = Rotate(Geometry=trim_3, Angle=degrees("90"), Plane=pl)  # -> Geometry, Transform
rotate_6 = Rotate(Geometry=trim_3, Angle=degrees("270"), Plane=pl)  # -> Geometry, Transform
concat_4 = Concatenate(FragmentE=trim_6, FragmentA="↺", FragmentB="270", FragmentC="°", FragmentD="y")
concat_5 = Concatenate(FragmentE=trim_6, FragmentA="↺", FragmentB="90", FragmentC="°", FragmentD="y")
concat_6 = Concatenate(FragmentE=trim_6, FragmentA="↺", FragmentB="180", FragmentC="°", FragmentD="y")
constmodule_4 = ConstructModule(ModuleName=concat_6, ModulePartPoints=trim_2, Geometry=rotate_4.Geometry, BasePlane=pl, ModulePartDiagonal=trim_5)
constmodule_5 = ConstructModule(ModuleName=concat_5, ModulePartPoints=trim_2, Geometry=rotate_5.Geometry, BasePlane=pl, ModulePartDiagonal=trim_5)
constmodule_6 = ConstructModule(ModuleName=concat_4, ModulePartPoints=trim_2, Geometry=rotate_6.Geometry, BasePlane=pl, ModulePartDiagonal=trim_5)
rotate_7 = Rotate(Geometry=trim_3, Angle=degrees("180"), Plane=trim_4)  # -> Geometry, Transform
rotate_8 = Rotate(Geometry=trim_3, Angle=degrees("90"), Plane=trim_4)  # -> Geometry, Transform
rotate_9 = Rotate(Geometry=trim_3, Angle=degrees("270"), Plane=trim_4)  # -> Geometry, Transform
concat_7 = Concatenate(FragmentE=trim_6, FragmentA="↺", FragmentB="90", FragmentC="°", FragmentD="z")
concat_8 = Concatenate(FragmentE=trim_6, FragmentA="↺", FragmentB="180", FragmentC="°", FragmentD="z")
concat_9 = Concatenate(FragmentE=trim_6, FragmentA="↺", FragmentB="270", FragmentC="°", FragmentD="z")
constmodule_7 = ConstructModule(ModuleName=concat_8, ModulePartPoints=trim_2, Geometry=rotate_7.Geometry, BasePlane=trim_4, ModulePartDiagonal=trim_5)
constmodule_8 = ConstructModule(ModuleName=concat_7, ModulePartPoints=trim_2, Geometry=rotate_8.Geometry, BasePlane=trim_4, ModulePartDiagonal=trim_5)
constmodule_9 = ConstructModule(ModuleName=concat_9, ModulePartPoints=trim_2, Geometry=rotate_9.Geometry, BasePlane=trim_4, ModulePartDiagonal=trim_5)
merge = Merge(
    Data1=M_2,
    Data2=constmodule_2,
    Data3=constmodule,
    Data4=constmodule_3,
    Data5=constmodule_5,
    Data6=constmodule_4,
    Data7=constmodule_6,
    Data8=constmodule_8,
    Data9=constmodule_7,
    Data10=constmodule_9)

expression = Expression(x=concat_2, y=deconruleexp.SourceModuleName, Expression="x")
expression_2 = Expression(x=deconruleexp.SourceModuleName, y=trim_6, Expression="x=y")  # -> graft(R)
expression_3 = Expression(x=concat_2, y=deconruleexp.TargetModuleName, Expression="x")
expression_4 = Expression(x=concat_2, y=deconruletyp.ModuleName, Expression="x")
merge_2 = Merge(Data1=graft(deconruleexp.SourceModuleName), Data2=graft(expression))
expression_5 = Expression(x=deconruletyp.ModuleName, y=trim_6, Expression="x=y")  # -> graft(R)
expression_6 = Expression(x=deconruleexp.TargetModuleName, y=trim_6, Expression="x=y")  # -> graft(R)
merge_3 = Merge(Data1=graft(deconruleexp.TargetModuleName), Data2=graft(expression_3))
merge_4 = Merge(Data1=graft(deconruletyp.ModuleName), Data2=graft(expression_4))
shift = ShiftList(List=panel_3, Shift="3", Wrap=True)
item_2 = ListItem(List=merge_2, Index=expression_2, Wrap=True)
trim_7 = TrimTree(Tree=shift, Depth=1)
item_3 = ListItem(List=merge_3, Index=expression_6, Wrap=True)
item_4 = ListItem(List=merge_4, Index=expression_5, Wrap=True)
trim_8 = TrimTree(Tree=item_2, Depth=1)
replace = ReplaceMembers(Set=txt_2, Find=panel_3, Replace=trim_7)
trim_9 = TrimTree(Tree=item_3, Depth=1)
replace_2 = ReplaceMembers(Set=txt_3, Find=panel_3, Replace=trim_7)
trim_10 = TrimTree(Tree=item_4, Depth=1)
replace_3 = ReplaceMembers(Set=txt, Find=panel_3, Replace=trim_7)
ruletyp = ConstructTypedRule(ModuleName=trim_10, ConnectorIndex=replace_3, Type=deconruletyp.Type)
ruleexp = ConstructExplicitRule(SourceModuleName=trim_8, SourceConnectorIndex=replace, TargetModuleName=trim_9, TargetConnectorIndex=replace_2)
merge_5 = Merge(Data1=ruleexp, Data2=ruletyp)
merge_6 = Merge(Data1=dispatch_2.ListA, Data2=dispatch_2.ListB)
sort = SortList(Keys=merge_6, ValuesA=merge_5)  # -> Keys, ValuesA

expression_7 = Expression(x=deconruleexp.SourceModuleName, y=trim_6, Expression="x=y")  # -> graft(R)
expression_8 = Expression(x=concat_3, y=deconruleexp.SourceModuleName, Expression="x")
expression_9 = Expression(x=concat_3, y=deconruleexp.TargetModuleName, Expression="x")
expression_10 = Expression(x=concat_3, y=deconruletyp.ModuleName, Expression="x")
expression_11 = Expression(x=deconruleexp.TargetModuleName, y=trim_6, Expression="x=y")  # -> graft(R)
expression_12 = Expression(x=deconruletyp.ModuleName, y=trim_6, Expression="x=y")  # -> graft(R)
merge_7 = Merge(Data1=graft(deconruleexp.SourceModuleName), Data2=graft(expression_8))
merge_8 = Merge(Data1=graft(deconruletyp.ModuleName), Data2=graft(expression_10))
merge_9 = Merge(Data1=graft(deconruleexp.TargetModuleName), Data2=graft(expression_9))
shift_2 = ShiftList(List=panel_3, Shift="2", Wrap=True)
trim_11 = TrimTree(Tree=shift_2, Depth=1)
item_5 = ListItem(List=merge_7, Index=expression_7, Wrap=True)
item_6 = ListItem(List=merge_8, Index=expression_12, Wrap=True)
item_7 = ListItem(List=merge_9, Index=expression_11, Wrap=True)
trim_12 = TrimTree(Tree=item_5, Depth=1)
replace_4 = ReplaceMembers(Set=txt, Find=panel_3, Replace=trim_11)
replace_5 = ReplaceMembers(Set=txt_3, Find=panel_3, Replace=trim_11)
replace_6 = ReplaceMembers(Set=txt_2, Find=panel_3, Replace=trim_11)
trim_13 = TrimTree(Tree=item_7, Depth=1)
trim_14 = TrimTree(Tree=item_6, Depth=1)
ruleexp_2 = ConstructExplicitRule(SourceModuleName=trim_12, SourceConnectorIndex=replace_6, TargetModuleName=trim_13, TargetConnectorIndex=replace_5)
ruletyp_2 = ConstructTypedRule(ModuleName=trim_14, ConnectorIndex=replace_4, Type=deconruletyp.Type)
merge_10 = Merge(Data1=ruleexp_2, Data2=ruletyp_2)
merge_11 = Merge(Data1=dispatch_2.ListA, Data2=dispatch_2.ListB)
sort_2 = SortList(Keys=merge_11, ValuesA=merge_10)  # -> Keys, ValuesA

expression_13 = Expression(x=deconruleexp.SourceModuleName, y=trim_6, Expression="x=y")  # -> graft(R)
expression_14 = Expression(x=concat, y=deconruleexp.SourceModuleName, Expression="x")
expression_15 = Expression(x=concat, y=deconruleexp.TargetModuleName, Expression="x")
expression_16 = Expression(x=concat, y=deconruletyp.ModuleName, Expression="x")
expression_17 = Expression(x=deconruletyp.ModuleName, y=trim_6, Expression="x=y")  # -> graft(R)
expression_18 = Expression(x=deconruleexp.TargetModuleName, y=trim_6, Expression="x=y")  # -> graft(R)
merge_12 = Merge(Data1=graft(deconruleexp.SourceModuleName), Data2=graft(expression_14))
merge_13 = Merge(Data1=graft(deconruleexp.TargetModuleName), Data2=graft(expression_15))
merge_14 = Merge(Data1=graft(deconruletyp.ModuleName), Data2=graft(expression_16))
shift_3 = ShiftList(List=panel_3, Shift="1", Wrap=True)
trim_15 = TrimTree(Tree=shift_3, Depth=1)
item_8 = ListItem(List=merge_14, Index=expression_17, Wrap=True)
item_9 = ListItem(List=merge_13, Index=expression_18, Wrap=True)
item_10 = ListItem(List=merge_12, Index=expression_13, Wrap=True)
trim_16 = TrimTree(Tree=item_9, Depth=1)
replace_7 = ReplaceMembers(Set=txt, Find=panel_3, Replace=trim_15)
replace_8 = ReplaceMembers(Set=txt_3, Find=panel_3, Replace=trim_15)
trim_17 = TrimTree(Tree=item_8, Depth=1)
trim_18 = TrimTree(Tree=item_10, Depth=1)
replace_9 = ReplaceMembers(Set=txt_2, Find=panel_3, Replace=trim_15)
ruleexp_3 = ConstructExplicitRule(SourceModuleName=trim_18, SourceConnectorIndex=replace_9, TargetModuleName=trim_16, TargetConnectorIndex=replace_8)
ruletyp_3 = ConstructTypedRule(ModuleName=trim_17, ConnectorIndex=replace_7, Type=deconruletyp.Type)
merge_15 = Merge(Data1=ruleexp_3, Data2=ruletyp_3)
merge_16 = Merge(Data1=dispatch_2.ListA, Data2=dispatch_2.ListB)
sort_3 = SortList(Keys=merge_16, ValuesA=merge_15)  # -> Keys, ValuesA

expression_19 = Expression(x=deconruleexp.SourceModuleName, y=trim_6, Expression="x=y")  # -> graft(R)
expression_20 = Expression(x=concat_6, y=deconruleexp.SourceModuleName, Expression="x")
expression_21 = Expression(x=concat_6, y=deconruleexp.TargetModuleName, Expression="x")
expression_22 = Expression(x=concat_6, y=deconruletyp.ModuleName, Expression="x")
expression_23 = Expression(x=deconruleexp.TargetModuleName, y=trim_6, Expression="x=y")  # -> graft(R)
expression_24 = Expression(x=deconruletyp.ModuleName, y=trim_6, Expression="x=y")  # -> graft(R)
merge_17 = Merge(Data1=graft(deconruleexp.SourceModuleName), Data2=graft(expression_20))
merge_18 = Merge(Data1=graft(deconruleexp.TargetModuleName), Data2=graft(expression_21))
merge_19 = Merge(Data1=graft(deconruletyp.ModuleName), Data2=graft(expression_22))
shift_4 = ShiftList(List=panel_4, Shift="2", Wrap=True)
trim_19 = TrimTree(Tree=shift_4, Depth=1)
item_11 = ListItem(List=merge_18, Index=expression_23, Wrap=True)
item_12 = ListItem(List=merge_19, Index=expression_24, Wrap=True)
item_13 = ListItem(List=merge_17, Index=expression_19, Wrap=True)
trim_20 = TrimTree(Tree=item_11, Depth=1)
replace_10 = ReplaceMembers(Set=txt, Find=panel_4, Replace=trim_19)
replace_11 = ReplaceMembers(Set=txt_3, Find=panel_4, Replace=trim_19)
trim_21 = TrimTree(Tree=item_12, Depth=1)
trim_22 = TrimTree(Tree=item_13, Depth=1)
replace_12 = ReplaceMembers(Set=txt_2, Find=panel_4, Replace=trim_19)
ruletyp_4 = ConstructTypedRule(ModuleName=trim_21, ConnectorIndex=replace_10, Type=deconruletyp.Type)
ruleexp_4 = ConstructExplicitRule(SourceModuleName=trim_22, SourceConnectorIndex=replace_12, TargetModuleName=trim_20, TargetConnectorIndex=replace_11)
merge_20 = Merge(Data1=ruleexp_4, Data2=ruletyp_4)
merge_21 = Merge(Data1=dispatch_2.ListA, Data2=dispatch_2.ListB)
sort_4 = SortList(Keys=merge_21, ValuesA=merge_20)  # -> Keys, ValuesA

expression_25 = Expression(x=concat_5, y=deconruleexp.SourceModuleName, Expression="x")
expression_26 = Expression(x=deconruleexp.SourceModuleName, y=trim_6, Expression="x=y")  # -> graft(R)
expression_27 = Expression(x=concat_5, y=deconruleexp.TargetModuleName, Expression="x")
expression_28 = Expression(x=concat_5, y=deconruletyp.ModuleName, Expression="x")
expression_29 = Expression(x=deconruleexp.TargetModuleName, y=trim_6, Expression="x=y")  # -> graft(R)
expression_30 = Expression(x=deconruletyp.ModuleName, y=trim_6, Expression="x=y")  # -> graft(R)
merge_22 = Merge(Data1=graft(deconruleexp.SourceModuleName), Data2=graft(expression_25))
merge_23 = Merge(Data1=graft(deconruletyp.ModuleName), Data2=graft(expression_28))
merge_24 = Merge(Data1=graft(deconruleexp.TargetModuleName), Data2=graft(expression_27))
shift_5 = ShiftList(List=panel_4, Shift="1", Wrap=True)
item_14 = ListItem(List=merge_22, Index=expression_26, Wrap=True)
trim_23 = TrimTree(Tree=shift_5, Depth=1)
item_15 = ListItem(List=merge_23, Index=expression_30, Wrap=True)
item_16 = ListItem(List=merge_24, Index=expression_29, Wrap=True)
trim_24 = TrimTree(Tree=item_14, Depth=1)
replace_13 = ReplaceMembers(Set=txt, Find=panel_4, Replace=trim_23)
replace_14 = ReplaceMembers(Set=txt_3, Find=panel_4, Replace=trim_23)
trim_25 = TrimTree(Tree=item_16, Depth=1)
trim_26 = TrimTree(Tree=item_15, Depth=1)
replace_15 = ReplaceMembers(Set=txt_2, Find=panel_4, Replace=trim_23)
ruletyp_5 = ConstructTypedRule(ModuleName=trim_26, ConnectorIndex=replace_13, Type=deconruletyp.Type)
ruleexp_5 = ConstructExplicitRule(SourceModuleName=trim_24, SourceConnectorIndex=replace_15, TargetModuleName=trim_25, TargetConnectorIndex=replace_14)
merge_25 = Merge(Data1=ruleexp_5, Data2=ruletyp_5)
merge_26 = Merge(Data1=dispatch_2.ListA, Data2=dispatch_2.ListB)
sort_5 = SortList(Keys=merge_26, ValuesA=merge_25)  # -> Keys, ValuesA

expression_31 = Expression(x=concat_4, y=deconruleexp.SourceModuleName, Expression="x")
expression_32 = Expression(x=deconruleexp.SourceModuleName, y=trim_6, Expression="x=y")  # -> graft(R)
expression_33 = Expression(x=concat_4, y=deconruleexp.TargetModuleName, Expression="x")
expression_34 = Expression(x=concat_4, y=deconruletyp.ModuleName, Expression="x")
expression_35 = Expression(x=deconruleexp.TargetModuleName, y=trim_6, Expression="x=y")  # -> graft(R)
expression_36 = Expression(x=deconruletyp.ModuleName, y=trim_6, Expression="x=y")  # -> graft(R)
merge_27 = Merge(Data1=graft(deconruleexp.SourceModuleName), Data2=graft(expression_31))
merge_28 = Merge(Data1=graft(deconruleexp.TargetModuleName), Data2=graft(expression_33))
merge_29 = Merge(Data1=graft(deconruletyp.ModuleName), Data2=graft(expression_34))
shift_6 = ShiftList(List=panel_4, Shift="3", Wrap=True)
item_17 = ListItem(List=merge_28, Index=expression_35, Wrap=True)
item_18 = ListItem(List=merge_27, Index=expression_32, Wrap=True)
trim_27 = TrimTree(Tree=shift_6, Depth=1)
item_19 = ListItem(List=merge_29, Index=expression_36, Wrap=True)
trim_28 = TrimTree(Tree=item_17, Depth=1)
replace_16 = ReplaceMembers(Set=txt_3, Find=panel_4, Replace=trim_27)
trim_29 = TrimTree(Tree=item_18, Depth=1)
trim_30 = TrimTree(Tree=item_19, Depth=1)
replace_17 = ReplaceMembers(Set=txt, Find=panel_4, Replace=trim_27)
replace_18 = ReplaceMembers(Set=txt_2, Find=panel_4, Replace=trim_27)
ruletyp_6 = ConstructTypedRule(ModuleName=trim_30, ConnectorIndex=replace_17, Type=deconruletyp.Type)
ruleexp_6 = ConstructExplicitRule(SourceModuleName=trim_29, SourceConnectorIndex=replace_18, TargetModuleName=trim_28, TargetConnectorIndex=replace_16)
merge_30 = Merge(Data1=ruleexp_6, Data2=ruletyp_6)
merge_31 = Merge(Data1=dispatch_2.ListA, Data2=dispatch_2.ListB)
sort_6 = SortList(Keys=merge_31, ValuesA=merge_30)  # -> Keys, ValuesA

trim_31 = TrimTree(Tree=mrg_a, Depth=1)
trim_32 = TrimTree(Tree=sort_3.ValuesA, Depth=1)
trim_33 = TrimTree(Tree=sort_2.ValuesA, Depth=1)
trim_34 = TrimTree(Tree=sort.ValuesA, Depth=1)
trim_35 = TrimTree(Tree=sort_5.ValuesA, Depth=1)
trim_36 = TrimTree(Tree=sort_4.ValuesA, Depth=1)
trim_37 = TrimTree(Tree=sort_6.ValuesA, Depth=1)
merge_32 = Merge(Data1="True", Data2=rt_2)

expression_37 = Expression(x=deconruleexp.SourceModuleName, y=trim_6, Expression="x=y")  # -> graft(R)
expression_38 = Expression(x=concat_8, y=deconruleexp.SourceModuleName, Expression="x")
expression_39 = Expression(x=concat_8, y=deconruleexp.TargetModuleName, Expression="x")
expression_40 = Expression(x=concat_8, y=deconruletyp.ModuleName, Expression="x")
expression_41 = Expression(x=deconruletyp.ModuleName, y=trim_6, Expression="x=y")  # -> graft(R)
expression_42 = Expression(x=deconruleexp.TargetModuleName, y=trim_6, Expression="x=y")  # -> graft(R)
merge_33 = Merge(Data1=graft(deconruleexp.SourceModuleName), Data2=graft(expression_38))
merge_34 = Merge(Data1=graft(deconruleexp.TargetModuleName), Data2=graft(expression_39))
merge_35 = Merge(Data1=graft(deconruletyp.ModuleName), Data2=graft(expression_40))
shift_7 = ShiftList(List=panel_2, Shift="2", Wrap=True)
item_20 = ListItem(List=merge_33, Index=expression_37, Wrap=True)
trim_38 = TrimTree(Tree=shift_7, Depth=1)
item_21 = ListItem(List=merge_35, Index=expression_41, Wrap=True)
item_22 = ListItem(List=merge_34, Index=expression_42, Wrap=True)
trim_39 = TrimTree(Tree=item_20, Depth=1)
trim_40 = TrimTree(Tree=item_22, Depth=1)
replace_19 = ReplaceMembers(Set=txt_3, Find=panel_2, Replace=trim_38)
replace_20 = ReplaceMembers(Set=txt_2, Find=panel_2, Replace=trim_38)
trim_41 = TrimTree(Tree=item_21, Depth=1)
replace_21 = ReplaceMembers(Set=txt, Find=panel_2, Replace=trim_38)
ruletyp_7 = ConstructTypedRule(ModuleName=trim_41, ConnectorIndex=replace_21, Type=deconruletyp.Type)
ruleexp_7 = ConstructExplicitRule(SourceModuleName=trim_39, SourceConnectorIndex=replace_20, TargetModuleName=trim_40, TargetConnectorIndex=replace_19)
merge_36 = Merge(Data1=ruleexp_7, Data2=ruletyp_7)
merge_37 = Merge(Data1=dispatch_2.ListA, Data2=dispatch_2.ListB)
sort_7 = SortList(Keys=merge_37, ValuesA=merge_36)  # -> Keys, ValuesA

trim_42 = TrimTree(Tree=sort_7.ValuesA, Depth=1)

expression_43 = Expression(x=deconruleexp.SourceModuleName, y=trim_6, Expression="x=y")  # -> graft(R)
expression_44 = Expression(x=concat_9, y=deconruleexp.SourceModuleName, Expression="x")
expression_45 = Expression(x=concat_9, y=deconruleexp.TargetModuleName, Expression="x")
expression_46 = Expression(x=concat_9, y=deconruletyp.ModuleName, Expression="x")
expression_47 = Expression(x=deconruleexp.TargetModuleName, y=trim_6, Expression="x=y")  # -> graft(R)
expression_48 = Expression(x=deconruletyp.ModuleName, y=trim_6, Expression="x=y")  # -> graft(R)
merge_38 = Merge(Data1=graft(deconruleexp.SourceModuleName), Data2=graft(expression_44))
merge_39 = Merge(Data1=graft(deconruleexp.TargetModuleName), Data2=graft(expression_45))
merge_40 = Merge(Data1=graft(deconruletyp.ModuleName), Data2=graft(expression_46))
shift_8 = ShiftList(List=panel_2, Shift="3", Wrap=True)
trim_43 = TrimTree(Tree=shift_8, Depth=1)
item_23 = ListItem(List=merge_39, Index=expression_47, Wrap=True)
item_24 = ListItem(List=merge_40, Index=expression_48, Wrap=True)
item_25 = ListItem(List=merge_38, Index=expression_43, Wrap=True)
trim_44 = TrimTree(Tree=item_23, Depth=1)
replace_22 = ReplaceMembers(Set=txt_3, Find=panel_2, Replace=trim_43)
trim_45 = TrimTree(Tree=item_25, Depth=1)
replace_23 = ReplaceMembers(Set=txt_2, Find=panel_2, Replace=trim_43)
trim_46 = TrimTree(Tree=item_24, Depth=1)
replace_24 = ReplaceMembers(Set=txt, Find=panel_2, Replace=trim_43)
ruletyp_8 = ConstructTypedRule(ModuleName=trim_46, ConnectorIndex=replace_24, Type=deconruletyp.Type)
ruleexp_8 = ConstructExplicitRule(SourceModuleName=trim_45, SourceConnectorIndex=replace_23, TargetModuleName=trim_44, TargetConnectorIndex=replace_22)
merge_41 = Merge(Data1=ruleexp_8, Data2=ruletyp_8)
merge_42 = Merge(Data1=dispatch_2.ListA, Data2=dispatch_2.ListB)
sort_8 = SortList(Keys=merge_42, ValuesA=merge_41)  # -> Keys, ValuesA

trim_47 = TrimTree(Tree=sort_8.ValuesA, Depth=1)

expression_49 = Expression(x=deconruleexp.SourceModuleName, y=trim_6, Expression="x=y")  # -> graft(R)
expression_50 = Expression(x=concat_7, y=deconruleexp.SourceModuleName, Expression="x")
expression_51 = Expression(x=concat_7, y=deconruleexp.TargetModuleName, Expression="x")
expression_52 = Expression(x=concat_7, y=deconruletyp.ModuleName, Expression="x")
expression_53 = Expression(x=deconruleexp.TargetModuleName, y=trim_6, Expression="x=y")  # -> graft(R)
expression_54 = Expression(x=deconruletyp.ModuleName, y=trim_6, Expression="x=y")  # -> graft(R)
merge_43 = Merge(Data1=graft(deconruleexp.SourceModuleName), Data2=graft(expression_50))
merge_44 = Merge(Data1=graft(deconruleexp.TargetModuleName), Data2=graft(expression_51))
merge_45 = Merge(Data1=graft(deconruletyp.ModuleName), Data2=graft(expression_52))
shift_9 = ShiftList(List=panel_2, Shift="1", Wrap=True)
item_26 = ListItem(List=merge_43, Index=expression_49, Wrap=True)
trim_48 = TrimTree(Tree=shift_9, Depth=1)
item_27 = ListItem(List=merge_45, Index=expression_54, Wrap=True)
item_28 = ListItem(List=merge_44, Index=expression_53, Wrap=True)
trim_49 = TrimTree(Tree=item_26, Depth=1)
trim_50 = TrimTree(Tree=item_28, Depth=1)
trim_51 = TrimTree(Tree=item_27, Depth=1)
replace_25 = ReplaceMembers(Set=txt_3, Find=panel_2, Replace=trim_48)
replace_26 = ReplaceMembers(Set=txt, Find=panel_2, Replace=trim_48)
replace_27 = ReplaceMembers(Set=txt_2, Find=panel_2, Replace=trim_48)
ruletyp_9 = ConstructTypedRule(ModuleName=trim_51, ConnectorIndex=replace_26, Type=deconruletyp.Type)
ruleexp_9 = ConstructExplicitRule(SourceModuleName=trim_49, SourceConnectorIndex=replace_27, TargetModuleName=trim_50, TargetConnectorIndex=replace_25)
merge_46 = Merge(Data1=ruleexp_9, Data2=ruletyp_9)
merge_47 = Merge(Data1=dispatch_2.ListA, Data2=dispatch_2.ListB)
sort_9 = SortList(Keys=merge_47, ValuesA=merge_46)  # -> Keys, ValuesA

trim_52 = TrimTree(Tree=sort_9.ValuesA, Depth=1)
merge_48 = Merge(
    Data1=graft(trim_31),
    Data2=graft(trim_32),
    Data3=graft(trim_33),
    Data4=graft(trim_34),
    Data5=graft(trim_35),
    Data6=graft(trim_36),
    Data7=graft(trim_37),
    Data8=graft(trim_52),
    Data9=graft(trim_42),
    Data10=graft(trim_47))
cull = CullPattern(List=merge, CullPattern=merge_32)
cull_2 = CullPattern(List=merge_48, CullPattern=merge_32)
trim_53 = TrimTree(Tree=cull, Depth=1)
R_3 = Rule(cull_2)
R_4 = ClusterOutput(R_3)
M_3 = Module(trim_53)
M_4 = ClusterOutput(M_3)

# ==== cluster SelectPort: Select a port with the id. If no port matches, null will be returned.
po = ClusterInput()
id = ClusterInput()
id_2 = Id(graft(id))
po_2 = Port(po)
lng = ListLength(List=po_2)
por = ModelPort(Port=po_2)  # -> Port, Valid, Id, Description, Family, CompatibleFamilies, Point, Direction, T, Qualities
series = Series(Start=0, Step=1, Count=lng)
trim = TrimTree(Tree=series, Depth=1)
expression = Expression(x=por.Id, y=id_2, Expression="x=y")
cull = CullPattern(List=po_2, CullPattern=expression)
cull_2 = CullPattern(List=trim, CullPattern=expression)
nulltobranch = AddNullToEmptyBranch(D=cull_2)  # -> R; inputs D: tree; same code as nulltobranch
nulltobranch_2 = AddNullToEmptyBranch(D=cull)  # -> R; inputs D: tree; same code as nulltobranch
trim_2 = TrimTree(Tree=nulltobranch, Depth=1)
trim_3 = TrimTree(Tree=nulltobranch_2, Depth=1)
i = Integer(trim_2)
po_3 = Port(trim_3)
i_2 = ClusterOutput(i)
po_4 = ClusterOutput(po_3)

# ==== cluster ReplaceRule: Replace rules with new ones. They must have the same module name and connector index.
R = ClusterInput()
rule = ClusterInput()
rule_2 = Rule(graft(rule))
R_2 = Rule(R)
isruleexp = IsRuleExplicit(Rule=R_2)
isruleexp_2 = IsRuleExplicit(Rule=rule_2)
dispatch = Dispatch(List=R_2, DispatchPattern=isruleexp)  # -> ListA, ListB
dispatch_2 = Dispatch(List=rule_2, DispatchPattern=isruleexp_2)  # -> ListA, ListB
deconruletyp = DeconstructTypedRule(Rule=dispatch.ListB)  # -> ModuleName, ConnectorIndex, Type
deconruleexp = DeconstructExplicitRule(Rule=dispatch_2.ListA)  # -> SourceModuleName, SourceConnectorIndex, TargetModuleName, TargetConnectorIndex
# TODO: Explicit rules
deconruleexp_2 = DeconstructExplicitRule(Rule=dispatch.ListA)  # -> SourceModuleName, SourceConnectorIndex, TargetModuleName, TargetConnectorIndex
deconruletyp_2 = DeconstructTypedRule(Rule=dispatch_2.ListB)  # -> ModuleName, ConnectorIndex, Type
expression = Expression(x=deconruletyp.ModuleName, y=deconruletyp_2.ModuleName, Expression="x=y")
expression_2 = Expression(x=deconruletyp.ConnectorIndex, y=deconruletyp_2.ConnectorIndex, Expression="x=y")
lng = ListLength(List=dispatch.ListB)
series = Series(Start=0, Step=1, Count=lng)
and = GateAnd(A=expression, B=expression_2)
trim = TrimTree(Tree=series, Depth=1)
cull = CullPattern(List=trim, CullPattern=and)
expression_3 = Expression(x=rule_2, y=cull, Expression="x")
trim_2 = TrimTree(Tree=cull, Depth=1)
trim_3 = TrimTree(Tree=expression_3, Depth=1)
replace = ReplaceItems(List=dispatch.ListB, Item=trim_3, Indices=trim_2, Wrap=False)
trim_4 = TrimTree(Tree=replace, Depth=1)
merge = Merge(Data1=dispatch.ListA, Data2=trim_4)
R_3 = Rule(merge)
R_4 = ClusterOutput(R_3)

# ==== cluster Mod_2
panel = Panel("""1
4""")
panel_2 = Panel("""0
1
3
4""")
M = ClusterInput()
R = ClusterInput()
mi = ClusterInput()
panel_3 = Panel("""2
5""")
rev = ReverseList(List=panel_3)
panel_4 = Panel("""1
4""")
rev_2 = ReverseList(List=panel_4)
panel_5 = Panel("""0
3""")
rev_3 = ReverseList(List=panel_5)
M_2 = Module(graft(M))
R_2 = Rule(R)
mrg_a = MergeSeperatlyAppend(x=R_2)  # -> Mrgd; inputs x: tree; same code as mrg_a
lng = ListLength(List=mrg_a)
series = Series(Start=0, Step=1, Count=lng)
trim = TrimTree(Tree=series, Depth=1)
isruleexp = IsRuleExplicit(Rule=mrg_a)
dispatch = Dispatch(List=mrg_a, DispatchPattern=isruleexp)  # -> ListA, ListB
dispatch_2 = Dispatch(List=trim, DispatchPattern=isruleexp)  # -> ListA, ListB
deconruleexp = DeconstructExplicitRule(Rule=dispatch.ListA)  # -> SourceModuleName, SourceConnectorIndex, TargetModuleName, TargetConnectorIndex
deconruletyp = DeconstructTypedRule(Rule=dispatch.ListB)  # -> ModuleName, ConnectorIndex, Type
txt = Text(deconruletyp.ConnectorIndex)
txt_2 = Text(deconruleexp.SourceConnectorIndex)
txt_3 = Text(deconruleexp.TargetConnectorIndex)
mi_2 = Boolean(mi)

deconmodule = DeconstructModule(Module=M_2, Rules=mrg_a)  # -> ModuleName, ModulePartCenterPoints, Geometry, BasePlane, ModulePartDiagonal, IsCompact, IsValid, Connectors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
trim_2 = TrimTree(Tree=deconmodule.Geometry, Depth=1)
trim_3 = TrimTree(Tree=deconmodule.BasePlane, Depth=1)
trim_4 = TrimTree(Tree=deconmodule.ModulePartDiagonal, Depth=1)
trim_5 = TrimTree(Tree=deconmodule.ModuleName, Depth=1)
trim_6 = TrimTree(Tree=deconmodule.ModulePartCenterPoints, Depth=1)
deplane = DeconstructPlane(Plane=trim_3)  # -> Origin, XAxis, YAxis, ZAxis
pl = ConstructPlane(Origin=deplane.Origin, XAxis=deplane.YAxis, YAxis=deplane.ZAxis)
pl_2 = ConstructPlane(Origin=deplane.Origin, XAxis=deplane.XAxis, YAxis=deplane.ZAxis)
concat = Concatenate(FragmentE=trim_5, FragmentA="↷", FragmentD="YZ")
mirror = Mirror(Geometry=trim_2, Plane=pl)  # -> Geometry, Transform
concat_2 = Concatenate(FragmentE=trim_5, FragmentA="↷", FragmentD="XY")
mirror_2 = Mirror(Geometry=trim_2, Plane=trim_3)  # -> Geometry, Transform
concat_3 = Concatenate(FragmentE=trim_5, FragmentA="↷", FragmentD="XZ")
mirror_3 = Mirror(Geometry=trim_2, Plane=pl_2)  # -> Geometry, Transform
constmodule = ConstructModule(ModuleName=concat, ModulePartPoints=trim_6, Geometry=mirror.Geometry, BasePlane=trim_3, ModulePartDiagonal=trim_4)
constmodule_2 = ConstructModule(ModuleName=concat_3, ModulePartPoints=trim_6, Geometry=mirror_3.Geometry, BasePlane=trim_3, ModulePartDiagonal=trim_4)
constmodule_3 = ConstructModule(ModuleName=concat_2, ModulePartPoints=trim_6, Geometry=mirror_2.Geometry, BasePlane=trim_3, ModulePartDiagonal=trim_4)
merge = Merge(Data1=M_2, Data2=constmodule, Data3=constmodule_2, Data4=constmodule_3)

expression = Expression(x=concat, y=deconruleexp.SourceModuleName, Expression="x")
expression_2 = Expression(x=concat, y=deconruleexp.TargetModuleName, Expression="x")
expression_3 = Expression(x=concat, y=deconruletyp.ModuleName, Expression="x")
expression_4 = Expression(x=deconruleexp.SourceModuleName, y=trim_5, Expression="x=y")  # -> graft(R)
expression_5 = Expression(x=deconruletyp.ModuleName, y=trim_5, Expression="x=y")  # -> graft(R)
expression_6 = Expression(x=deconruleexp.TargetModuleName, y=trim_5, Expression="x=y")  # -> graft(R)
merge_2 = Merge(Data1=graft(deconruleexp.SourceModuleName), Data2=graft(expression))
merge_3 = Merge(Data1=graft(deconruleexp.TargetModuleName), Data2=graft(expression_2))
merge_4 = Merge(Data1=graft(deconruletyp.ModuleName), Data2=graft(expression_3))
item = ListItem(List=merge_4, Index=expression_5, Wrap=True)
item_2 = ListItem(List=merge_3, Index=expression_6, Wrap=True)
item_3 = ListItem(List=merge_2, Index=expression_4, Wrap=True)
trim_7 = TrimTree(Tree=item_2, Depth=1)
replace = ReplaceMembers(Set=txt, Find=panel_3, Replace=rev)
replace_2 = ReplaceMembers(Set=txt_3, Find=panel_3, Replace=rev)
trim_8 = TrimTree(Tree=item, Depth=1)
trim_9 = TrimTree(Tree=item_3, Depth=1)
replace_3 = ReplaceMembers(Set=txt_2, Find=panel_3, Replace=rev)
ruleexp = ConstructExplicitRule(SourceModuleName=trim_9, SourceConnectorIndex=replace_3, TargetModuleName=trim_7, TargetConnectorIndex=replace_2)
ruletyp = ConstructTypedRule(ModuleName=trim_8, ConnectorIndex=replace, Type=deconruletyp.Type)
merge_5 = Merge(Data1=ruleexp, Data2=ruletyp)
merge_6 = Merge(Data1=dispatch_2.ListA, Data2=dispatch_2.ListB)
sort = SortList(Keys=merge_6, ValuesA=merge_5)  # -> Keys, ValuesA

expression_7 = Expression(x=concat, y=deconruleexp.SourceModuleName, Expression="x")
expression_8 = Expression(x=concat, y=deconruleexp.TargetModuleName, Expression="x")
expression_9 = Expression(x=concat, y=deconruletyp.ModuleName, Expression="x")
expression_10 = Expression(x=deconruleexp.SourceModuleName, y=trim_5, Expression="x=y")  # -> graft(R)
expression_11 = Expression(x=deconruletyp.ModuleName, y=trim_5, Expression="x=y")  # -> graft(R)
expression_12 = Expression(x=deconruleexp.TargetModuleName, y=trim_5, Expression="x=y")  # -> graft(R)
merge_7 = Merge(Data1=graft(deconruleexp.SourceModuleName), Data2=graft(expression_7))
merge_8 = Merge(Data1=graft(deconruleexp.TargetModuleName), Data2=graft(expression_8))
merge_9 = Merge(Data1=graft(deconruletyp.ModuleName), Data2=graft(expression_9))
item_4 = ListItem(List=merge_9, Index=expression_11, Wrap=True)
item_5 = ListItem(List=merge_8, Index=expression_12, Wrap=True)
item_6 = ListItem(List=merge_7, Index=expression_10, Wrap=True)
trim_10 = TrimTree(Tree=item_5, Depth=1)
replace_4 = ReplaceMembers(Set=txt, Find=panel_4, Replace=rev_2)
replace_5 = ReplaceMembers(Set=txt_3, Find=panel_4, Replace=rev_2)
trim_11 = TrimTree(Tree=item_4, Depth=1)
trim_12 = TrimTree(Tree=item_6, Depth=1)
replace_6 = ReplaceMembers(Set=txt_2, Find=panel_4, Replace=rev_2)
ruleexp_2 = ConstructExplicitRule(SourceModuleName=trim_12, SourceConnectorIndex=replace_6, TargetModuleName=trim_10, TargetConnectorIndex=replace_5)
ruletyp_2 = ConstructTypedRule(ModuleName=trim_11, ConnectorIndex=replace_4, Type=deconruletyp.Type)
merge_10 = Merge(Data1=ruleexp_2, Data2=ruletyp_2)
merge_11 = Merge(Data1=dispatch_2.ListA, Data2=dispatch_2.ListB)
sort_2 = SortList(Keys=merge_11, ValuesA=merge_10)  # -> Keys, ValuesA

expression_13 = Expression(x=concat, y=deconruleexp.SourceModuleName, Expression="x")
expression_14 = Expression(x=concat, y=deconruleexp.TargetModuleName, Expression="x")
expression_15 = Expression(x=concat, y=deconruletyp.ModuleName, Expression="x")
expression_16 = Expression(x=deconruleexp.SourceModuleName, y=trim_5, Expression="x=y")  # -> graft(R)
expression_17 = Expression(x=deconruletyp.ModuleName, y=trim_5, Expression="x=y")  # -> graft(R)
expression_18 = Expression(x=deconruleexp.TargetModuleName, y=trim_5, Expression="x=y")  # -> graft(R)
merge_12 = Merge(Data1=graft(deconruleexp.SourceModuleName), Data2=graft(expression_13))
merge_13 = Merge(Data1=graft(deconruleexp.TargetModuleName), Data2=graft(expression_14))
merge_14 = Merge(Data1=graft(deconruletyp.ModuleName), Data2=graft(expression_15))
item_7 = ListItem(List=merge_14, Index=expression_17, Wrap=True)
item_8 = ListItem(List=merge_13, Index=expression_18, Wrap=True)
item_9 = ListItem(List=merge_12, Index=expression_16, Wrap=True)
trim_13 = TrimTree(Tree=item_8, Depth=1)
replace_7 = ReplaceMembers(Set=txt, Find=panel_5, Replace=rev_3)
replace_8 = ReplaceMembers(Set=txt_3, Find=panel_5, Replace=rev_3)
trim_14 = TrimTree(Tree=item_7, Depth=1)
trim_15 = TrimTree(Tree=item_9, Depth=1)
replace_9 = ReplaceMembers(Set=txt_2, Find=panel_5, Replace=rev_3)
ruleexp_3 = ConstructExplicitRule(SourceModuleName=trim_15, SourceConnectorIndex=replace_9, TargetModuleName=trim_13, TargetConnectorIndex=replace_8)
ruletyp_3 = ConstructTypedRule(ModuleName=trim_14, ConnectorIndex=replace_7, Type=deconruletyp.Type)
merge_15 = Merge(Data1=ruleexp_3, Data2=ruletyp_3)
merge_16 = Merge(Data1=dispatch_2.ListA, Data2=dispatch_2.ListB)
sort_3 = SortList(Keys=merge_16, ValuesA=merge_15)  # -> Keys, ValuesA

trim_16 = TrimTree(Tree=sort.ValuesA, Depth=1)
trim_17 = TrimTree(Tree=mrg_a, Depth=1)
trim_18 = TrimTree(Tree=sort_3.ValuesA, Depth=1)
trim_19 = TrimTree(Tree=sort_2.ValuesA, Depth=1)
merge_17 = Merge(Data1=graft(trim_17), Data2=graft(trim_18), Data3=graft(trim_19), Data4=graft(trim_16))
merge_18 = Merge(Data1="True", Data2=mi_2)
cull = CullPattern(List=merge, CullPattern=merge_18)
cull_2 = CullPattern(List=merge_17, CullPattern=merge_18)
trim_20 = TrimTree(Tree=cull, Depth=1)
R_3 = Rule(cull_2)
R_4 = ClusterOutput(R_3)
M_3 = Module(trim_20)
M_4 = ClusterOutput(M_3)

# ==== cluster SelectTypeByPiece: Select the type of a piece.
ty = ClusterInput()
pc = ClusterInput()
pc_2 = Piece(graft(pc))
ty_2 = Type(ty)
pce = ModelPiece(Piece=pc_2)  # -> Piece, Valid, Id, Description, TypeName, TypeVariant, Plane, Center, Qualities
typ = SelectType(ty=ty_2, na=pce.TypeName, variant=pce.TypeVariant)  # -> ty_4, i_2
trim = TrimTree(Tree=typ.ty_4, Depth=1)
trim_2 = TrimTree(Tree=typ.i_2, Depth=1)
ty_3 = Type(trim)
i = Integer(trim_2)
ty_4 = ClusterOutput(ty_3)
i_2 = ClusterOutput(i)

# ==== cluster SelectRepresentation: Select exactly one representation based on mime and tags. The tag matching is based on the highest Jaccard index (|∩|/|∪|). If the mime type is not given or does not exist, then all representations are used to search for closest match. If index is equally high the first representation is picked.
mm = ClusterInput()
tags = ClusterInput()
rp = ClusterInput()
rp_2 = Representation(rp)
mm_2 = Mime(mm)
tags_2 = Tags(tags)
l2o = List2Object(L=rp_2)  # -> O; inputs L: tree
# ---------- l2o: Python ----------
#Component Information
#--------------------------------------------------------------------------------------------
if ghenv.Component.RunCount<2:
    #General
    #--------------------------------------------------------------------------------------------
    __author__ = "Ueli Saluz"
    __version__ = "2022.04.24"
    
    ghenv.Component.Name = "List2Object"
    ghenv.Component.NickName = "L2O"
    ghenv.Component.Description = "Wraps a list of objects into a list object."
    ghenv.Component.Message = "VER 1.0"
    ghenv.Component.Category = "Sets"
    ghenv.Component.SubCategory = "Tree"
    
     #Inputs
    #--------------------------------------------------------------------------------------------
    inputIndex=0
    
    ghenv.Component.Params.Input[inputIndex].Name = "List"
    ghenv.Component.Params.Input[inputIndex].NickName = "L"
    ghenv.Component.Params.Input[inputIndex].Description = "Tree with lists to wrap."
    ghenv.Component.Params.Input[inputIndex].Optional = False
    inputIndex+=1
    

    #Outputs
    #--------------------------------------------------------------------------------------------
    outputIndex=0
    
    ghenv.Component.Params.Output[outputIndex].Name =  "ListObject" 
    ghenv.Component.Params.Output[outputIndex].NickName = "O"
    ghenv.Component.Params.Output[outputIndex].Description = "Python list object as single item."
    outputIndex+=1


#Imports
#--------------------------------------------------------------------------------------------
from System import Object
from Grasshopper import DataTree

#Solver - Run with trees to enhance performance drastically
#--------------------------------------------------------------------------------------------
if __name__ == "__main__":
    
    #Initialize trees
    #--------------------------------------------------------------------------------------------
    TreeToWrap = DataTree[Object]()
    
    #Data matching
    #--------------------------------------------------------------------------------------------
    for path in L.Paths:
        listBranch = L.Branch(path)
        TreeToWrap.Add(listBranch,path)
    
     #Assign trees to output
    #--------------------------------------------------------------------------------------------
    O = TreeToWrap
# ---------- end l2o ----------

rep = ModelRepresentation(Representation=graft(rp_2))  # -> Representation, Valid, Url, Description, Mime, Tags, Qualities
lng = ListLength(List=mm_2)
expression = Expression(x=rep.Mime, y=mm_2, Expression="x=y")
null = NullItem(Item=lng)  # -> NullFlags, InvalidFlags, Description
expression_2 = Expression(x=lng, Expression="x=0")
ma = MassAddition(Input=expression)  # -> Result, PartialResults
or = GateOr(A=expression_2, B=null.NullFlags)
cull = CullPattern(List=rep.Representation, CullPattern=ma.Result)
trim = TrimTree(Tree=cull, Depth=1)
mime_match = Representation(trim)
nulltobranch = CSharpScript(D=mime_match)  # -> R; inputs D: tree; same code as nulltobranch
nullrep = ReplaceNulls(Items=nulltobranch, Replacements=l2o)  # -> graft(Items), Count

o2l = Object2List(O=nullrep.Items)  # -> L; inputs O: tree
# ---------- o2l: Python ----------
# Component Information
# --------------------------------------------------------------------------------------------
if ghenv.Component.RunCount < 2:
    # General
    # --------------------------------------------------------------------------------------------
    __author__ = "Ueli Saluz"
    __version__ = "2025.02.19"

    ghenv.Component.Name = "Object2List"
    ghenv.Component.NickName = "O2L"
    ghenv.Component.Description = "Unwraps a list of objects into a list object and returns the object if it is not iterable."
    ghenv.Component.Message = "VER 1.1"
    ghenv.Component.Category = "Sets"
    ghenv.Component.SubCategory = "Tree"

    # Inputs
    # --------------------------------------------------------------------------------------------
    inputIndex = 0

    ghenv.Component.Params.Input[inputIndex].Name = "ListObject"
    ghenv.Component.Params.Input[inputIndex].NickName = "O"
    ghenv.Component.Params.Input[inputIndex].Description = "A python list object that will be unwrapped into a Grasshopper list or returned as is if not iterable."
    ghenv.Component.Params.Input[inputIndex].Optional = False
    inputIndex += 1

    # Outputs
    # --------------------------------------------------------------------------------------------
    outputIndex = 0

    ghenv.Component.Params.Output[outputIndex].Name = "List"
    ghenv.Component.Params.Output[outputIndex].NickName = "L"
    ghenv.Component.Params.Output[outputIndex].Description = "The unwrapped list."
    outputIndex += 1

# Imports
# --------------------------------------------------------------------------------------------
from System import Object
from Grasshopper import DataTree
from collections import Iterable

# Solver - Run with trees to enhance performance drastically
# --------------------------------------------------------------------------------------------
if __name__ == "__main__":

    # Initialize trees
    # --------------------------------------------------------------------------------------------
    OriginalTree = DataTree[Object]()

    # Data matching
    # --------------------------------------------------------------------------------------------
    for path in O.Paths:
        listBranch = O.Branch(path)
        for i, listItem in enumerate(listBranch):
            if isinstance(listItem, Iterable) and not isinstance(listItem, str):
                OriginalTree.AddRange(list(listItem), path.AppendElement(i))
            else:
                OriginalTree.Add(listItem, path.AppendElement(i))

    # Assign trees to output
    # --------------------------------------------------------------------------------------------
    L = OriginalTree
# ---------- end o2l ----------
trim_2 = TrimTree(Tree=o2l, Depth=1)
trim_3 = TrimTree(Tree=trim_2, Depth=1)

filter = StreamFilter(Gate=or, Stream0=trim_3, Stream1=rp_2)
rp_3 = Representation(filter)

rep_2 = ModelRepresentation(Representation=rp_3)  # -> Representation, Valid, Url, Description, Mime, Tags, Qualities
jac = JaccardIndex(set1=tags_2, set2=rep_2.Tags)
trim_4 = TrimTree(Tree=jac, Depth=1)
minmax = MinimumMaximum(L=trim_4)  # -> Max, MaxI, Min, MinI; inputs L: list
# ---------- minmax: Python ----------
#Component Information
#--------------------------------------------------------------------------------------------
if ghenv.Component.RunCount<2:
    #General
    #--------------------------------------------------------------------------------------------
    __author__ = "Ueli Saluz"
    __version__ = "2022.04.22"
    
    ghenv.Component.Name = "MinimumMaximum"
    ghenv.Component.NickName = "MinMax"
    ghenv.Component.Description = "Returns the maximum and mininum of a list and their corresponding index."
    ghenv.Component.Message = "VER 1.0"
    ghenv.Component.Category = "Maths"
    ghenv.Component.SubCategory = "Util"
    
     #Inputs
    #--------------------------------------------------------------------------------------------
    inputIndex=0
    
    ghenv.Component.Params.Input[inputIndex].Name = "L"
    ghenv.Component.Params.Input[inputIndex].NickName = "L"
    ghenv.Component.Params.Input[inputIndex].Description = "A list of numbers."
    ghenv.Component.Params.Input[inputIndex].Optional = False
    inputIndex+=1
    
    
    #Outputs
    #--------------------------------------------------------------------------------------------
    outputIndex=0
    
    ghenv.Component.Params.Output[outputIndex].Name = "Max"
    ghenv.Component.Params.Output[outputIndex].NickName = "Max"
    ghenv.Component.Params.Output[outputIndex].Description = "Maximum of the list"
    outputIndex+=1
    
    ghenv.Component.Params.Output[outputIndex].Name = "MaxI"
    ghenv.Component.Params.Output[outputIndex].NickName = "MaxI"
    ghenv.Component.Params.Output[outputIndex].Description = "Index of the maximum of the list"
    outputIndex+=1
    
    ghenv.Component.Params.Output[outputIndex].Name = "Min"
    ghenv.Component.Params.Output[outputIndex].NickName = "Min"
    ghenv.Component.Params.Output[outputIndex].Description = "Minimum of the list"
    outputIndex+=1
    
    ghenv.Component.Params.Output[outputIndex].Name = "MinI"
    ghenv.Component.Params.Output[outputIndex].NickName = "MinI"
    ghenv.Component.Params.Output[outputIndex].Description = "Index of the minimum of the list"
    outputIndex+=1


#Solver - Run with trees to enhance performance drastically
#--------------------------------------------------------------------------------------------
if __name__ == "__main__":
    
    maximum = max(L)
    MaxI = L.index(maximum)
    Max = maximum
    
    minimum = min(L)
    MinI = L.index(minimum)
    Min = minimum
# ---------- end minmax ----------
item = ListItem(List=rep_2.Representation, Index=minmax.MaxI, Wrap=True)
rep_3 = ModelRepresentation(Representation=item)  # -> Representation, Valid, Url, Description, Mime, Tags, Qualities
sep = Separator()  # -> S
# ---------- sep: C# ----------
#region Usings
using System;
using System.Linq;
using System.Collections;
using System.Collections.Generic;
using System.Drawing;
using System.IO;

using Rhino;
using Rhino.Geometry;

using Grasshopper;
using Grasshopper.Kernel;
using Grasshopper.Kernel.Data;
using Grasshopper.Kernel.Types;
#endregion

public class Script_Instance : GH_ScriptInstance
{
    private void RunScript(ref object S)
    {
        S = Path.DirectorySeparatorChar;
    }
}
# ---------- end sep ----------
txt = Text(rp_2)
txt_2 = Text(item)
rep_4 = ReplaceText(Text=rep_3.Url, Find="/", Replace=sep, RecursiveReplace=False)
itemindex = ItemIndex(L=txt, I=txt_2)  # -> i; inputs L: list; same code as itemindex
rp_4 = Representation(item)
ur = Url(rep_3.Url)
pa_ur = Text(rep_4)

i = Integer(itemindex)
i_2 = ClusterOutput(i)
ur_2 = ClusterOutput(ur)
pa_ur_2 = ClusterOutput(pa_ur)
rp_5 = ClusterOutput(rp_4)

# ==== cluster SelectType: Select a type with a name and an optional variant. If no variant is provided it will select all variants. If you want to select the default type then use the empty text.
ty = ClusterInput()
na = ClusterInput()
variant = ClusterInput()
na_2 = Name(na)
variant_2 = Variant(variant)
ty_2 = Type(ty)
typ = ModelType(Type=ty_2)  # -> Type, Valid, Name, Description, Icon, Image, Variant, Unit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
expression = Expression(x=typ.Name, y=na_2, Expression="x=y")
cull = CullPattern(List=typ.Type, CullPattern=expression)
typ_2 = ModelType(Type=cull)  # -> Type, Valid, Name, Description, Icon, Image, Variant, Unit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
expression_2 = Expression(x=typ_2.Variant, y=variant_2, Expression="x=y")
txt = Text(ty_2)
cull_2 = CullPattern(List=typ_2.Type, CullPattern=expression_2)
null = NullItem(Item=variant_2)  # -> NullFlags, InvalidFlags, Description
filter = StreamFilter(Gate=null.NullFlags, Stream0=cull_2, Stream1=cull)
txt_2 = Text(filter)
mindex = MemberIndex(Set=txt, Member=txt_2)  # -> Index, Count
trim = TrimTree(Tree=mindex.Index, Depth=1)
ty_3 = Type(filter)
i = Integer(trim)
ty_4 = ClusterOutput(ty_3)
i_2 = ClusterOutput(i)

# ==== cluster JaccardIndex: Compute the Jaccard Index of two sets.
set1 = ClusterInput()
set2 = ClusterInput()
set1_2 = Data(set1)
set2_2 = Data(set2)
cset = CreateSet(List=set2_2)  # -> Set, Map
cset_2 = CreateSet(List=set1_2)  # -> Set, Map
lng = ListLength(List=set1_2)
lng_2 = ListLength(List=set2_2)
intersection = SetIntersection(SetA=cset_2.Set, SetB=cset.Set)
expression = Expression(x=lng, Expression="x=0")
expression_2 = Expression(x=lng_2, Expression="x=0")
sunion = SetUnion(SetA=cset_2.Set, SetB=cset.Set)
null = NullItem(Item=lng)  # -> NullFlags, InvalidFlags, Description
null_2 = NullItem(Item=lng_2)  # -> NullFlags, InvalidFlags, Description
lng_3 = ListLength(List=sunion)
lng_4 = ListLength(List=intersection)
or = GateOr(A=null.NullFlags, B=expression)
or_2 = GateOr(A=null_2.NullFlags, B=expression_2)
division = Division(A=lng_4, B=lng_3)
int = Integer(or)
int_2 = Integer(or_2)
concat = Concatenate(FragmentA=int, FragmentB=int_2)
b2d = BinaryToDecimal(Binary=concat)  # -> Decimal
# ---------- b2d: Python ----------
if ghenv.Component.RunCount<2:
    __author__ = "Ueli Saluz"
    __version__ = "2021.11.14"
    
    ghenv.Component.Name = "BinaryToDecimal"
    ghenv.Component.NickName = "B2D"
    ghenv.Component.Description = "Converts a number in binary representation to a number in decimal representation."
    ghenv.Component.Message = "VER 1.0"
    
    ghenv.Component.Params.Input[0].NickName = "Binary"
    
    ghenv.Component.Params.Input[0].Description = "Binary representation of a number."
    
    ghenv.Component.Params.Output[0].NickName = "Decimal"
    
    ghenv.Component.Params.Output[0].Description = "Converted decimal representation of the same number."

if __name__ == "__main__":
    Decimal = int(Binary,2)
# ---------- end b2d ----------
expression_3 = Expression(c=b2d, x=division, Expression="If(c=0,x,If(c=3,1,0))")
N = Number(expression_3)
N_2 = ClusterOutput(N)
