# Grasshopper definition results.gh (Grasshopper 1.0.8)
# Copyright: GNU Lesser General Public License Version 3
# plug-ins: Monoceros, semio

_10_types_groups = Data([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])
_10_types_modules = Module([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])
_10_types = Type([null x10])
S = Slot([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])
_10_types_18x18 = Slot([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])
_10_types_20x20 = Slot([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])
_10_types_19x19 = Slot([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])
S_2 = Slot([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])
slts = SlotsToDesign(S=_10_types_20x20, ty=_10_types)
slts_2 = SlotsToDesign(S=_10_types_19x19, ty=_10_types)
_10_types_20x20_buildings = Brep([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])
grp = PiecesToGroup(dn=slts, ty=_10_types, gr=_10_types_groups)
grp_2 = PiecesToGroup(dn=slts_2, ty=_10_types, gr=_10_types_groups)
compile = Compile(gr=grp_2)  # -> buildings_2, building_segments_2, cars_2, pedestrians_2, green_2
compile_2 = Compile(gr=grp)  # -> buildings_2, building_segments_2, cars_2, pedestrians_2, green_2
materialize = MaterializeSlots(Modules=flatten(_10_types_modules), Slots=S)  # -> Geometry, Transform

# ==== cluster SlotsToDesign: Convert Monoceros slots to a semio design.
S = ClusterInput()
ty = ClusterInput()
S_2 = Slot(S)
ty_2 = Type(ty)
deconslot = DeconstructSlot(Slot=S_2)  # -> Center, BasePlane, Diagonal, AllowedModuleNames, IsDeterministic, AllowsAllModules, AllowsNothing, IsValid
trim = TrimTree(Tree=deconslot.BasePlane, Depth=1)
trim_2 = TrimTree(Tree=deconslot.Center, Depth=1)
txt = Text(deconslot.AllowedModuleNames)

pt = ConstructPoint(XCoordinate=0, YCoordinate=0, ZCoordinate=0)
txt_2 = Text(ty_2)
dup = DuplicateData(Data=graft(ty_2), Number="10", Order=True)
constmodule = ConstructModule(ModuleName=txt_2, ModulePartPoints=pt, BasePlane=PlaneXY(0, 0, 0), ModulePartDiagonal=Vector(1, 1, 1))
trim_3 = TrimTree(Tree=dup, Depth=1)
deconmodule = DeconstructModule(Module=constmodule)  # -> ModuleName, ModulePartCenterPoints, Geometry, BasePlane, ModulePartDiagonal, IsCompact, IsValid, Connectors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
trim_4 = TrimTree(Tree=trim_3, Depth=1)
trim_5 = TrimTree(Tree=deconmodule.ModuleName, Depth=1)
txt_3 = Text(trim_5)
concat = Concatenate(FragmentA=txt_3, FragmentB="↺", FragmentC="90", FragmentD="°", FragmentE="x")
concat_2 = Concatenate(FragmentA=txt_3, FragmentB="↺", FragmentC="90", FragmentD="°", FragmentE="y")
concat_3 = Concatenate(FragmentA=txt_3, FragmentB="↺", FragmentC="90", FragmentD="°", FragmentE="z")
concat_4 = Concatenate(FragmentA=txt_3, FragmentB="↺", FragmentC="180", FragmentD="°", FragmentE="x")
concat_5 = Concatenate(FragmentA=txt_3, FragmentB="↺", FragmentC="180", FragmentD="°", FragmentE="y")
concat_6 = Concatenate(FragmentA=txt_3, FragmentB="↺", FragmentC="180", FragmentD="°", FragmentE="z")
concat_7 = Concatenate(FragmentA=txt_3, FragmentB="↺", FragmentC="270", FragmentD="°", FragmentE="x")
concat_8 = Concatenate(FragmentA=txt_3, FragmentB="↺", FragmentC="270", FragmentD="°", FragmentE="y")
concat_9 = Concatenate(FragmentA=txt_3, FragmentB="↺", FragmentC="270", FragmentD="°", FragmentE="z")
merge = Merge(
    Data1=graft(txt_3),
    Data2=graft(concat),
    Data3=graft(concat_2),
    Data4=graft(concat_3),
    Data5=graft(concat_4),
    Data6=graft(concat_5),
    Data7=graft(concat_6),
    Data8=graft(concat_7),
    Data9=graft(concat_8),
    Data10=graft(concat_9))
item = ListItem(List=txt, Index=0, Wrap=True)
trim_6 = TrimTree(Tree=item, Depth=1)
trim_7 = TrimTree(Tree=merge, Depth=1)
lng = ListLength(List=trim_7)
series = Series(Start=0, Step=1, Count=lng)
expression = Expression(x=trim_6, y=merge, Expression="x=y")
trim_8 = TrimTree(Tree=series, Depth=1)
keysearch = KeyValueSearch(Keys=trim_7, Values=trim_8, Search=trim_6)
expression_2 = Expression(x=keysearch, Expression="x%10")
item_2 = ListItem(List=trim_4, Index=keysearch, Wrap=True)
ty_3 = Type(item_2)
rt = Integer(expression_2)

orient = Orient(Geometry=trim_2, Source=trim, Target=PlaneXY(0, 0, 0))  # -> Geometry, Transform
trim_9 = TrimTree(Tree=orient.Geometry, Depth=1)
xz = XZPlane(Origin=Point(0, 0, 0))
yz = YZPlane(Origin=Point(0, 0, 0))
xy = XYPlane(Origin=Point(0, 0, 0))
transform = Transform(0)
rotate = Rotate(Angle=degrees("90"), Plane=xy)  # -> Geometry, Transform
rotate_2 = Rotate(Angle=degrees("90"), Plane=yz)  # -> Geometry, Transform
rotate_3 = Rotate(Angle=degrees("90"), Plane=xz)  # -> Geometry, Transform
rotate_4 = Rotate(Angle=degrees("180"), Plane=xy)  # -> Geometry, Transform
rotate_5 = Rotate(Angle=degrees("180"), Plane=yz)  # -> Geometry, Transform
rotate_6 = Rotate(Angle=degrees("180"), Plane=xz)  # -> Geometry, Transform
rotate_7 = Rotate(Angle=degrees("270"), Plane=xy)  # -> Geometry, Transform
rotate_8 = Rotate(Angle=degrees("270"), Plane=yz)  # -> Geometry, Transform
rotate_9 = Rotate(Angle=degrees("270"), Plane=xz)  # -> Geometry, Transform
merge_2 = Merge(
    Data1=graft(transform),
    Data2=graft(rotate_2.Transform),
    Data3=graft(rotate_3.Transform),
    Data4=graft(rotate.Transform),
    Data5=graft(rotate_5.Transform),
    Data6=graft(rotate_6.Transform),
    Data7=graft(rotate_4.Transform),
    Data8=graft(rotate_8.Transform),
    Data9=graft(rotate_9.Transform),
    Data10=graft(rotate_7.Transform))
item_3 = ListItem(List=merge_2, Index=rt, Wrap=True)
xy_2 = XYPlane(Origin=Point(0, 0, 0))
c_script = CSharpScript(X=item_3)  # -> T, R, I; inputs X: Transform
# ---------- c_script: C# ----------
// Grasshopper Script Instance
#region Usings
using System;
using System.Linq;
using System.Collections;
using System.Collections.Generic;
using System.Drawing;

using Rhino;
using Rhino.Geometry;

using Grasshopper;
using Grasshopper.Kernel;
using Grasshopper.Kernel.Data;
using Grasshopper.Kernel.Types;
#endregion

public class Script_Instance : GH_ScriptInstance
{
    #region Notes
    /* 
      Members:
        RhinoDoc RhinoDocument
        GH_Document GrasshopperDocument
        IGH_Component Component
        int Iteration

      Methods (Virtual & overridable):
        Print(string text)
        Print(string format, params object[] args)
        Reflect(object obj)
        Reflect(object obj, string method_name)
    */
    #endregion

    private void RunScript(Transform X, ref object T, ref object R, ref object I)
    {
        var i = new Transform();
        T = X.TryGetInverse(out i);
        var translation = new Vector3d();
        var rotation = new Transform();
        var orthogonal = new Transform();
        var diagonal = new Vector3d();
        X.DecomposeAffine(out translation, out rotation, out orthogonal,out diagonal);
        T = translation;
        R = rotation;
        I = i;
    }
}
# ---------- end c_script ----------
transform_2 = Transform(Geometry=xy_2, Transform=c_script.R)
pl_origin = PlaneOrigin(Base=transform_2, Origin=trim_9)
pce = ModelPiece(Piece=ty_3, Id=trim_9, Plane=pl_origin)  # -> Piece, Valid, Id, Description, TypeName, TypeVariant, Plane, Center, Qualities
dsn = ModelDesign(Pieces=pce.Piece)  # -> Design, Valid, Name, Description, Icon, Image, Variant, View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
dn = Design(dsn.Design)
dn_2 = ClusterOutput(dn)

# ==== cluster PiecesToGroup: Convert every piece to a group. If you need more a sophisticated approach where you can switch between represenstations and don't waste space use: Design to Block
dn = ClusterInput()
ty = ClusterInput()
gr = ClusterInput()
dn_2 = Design(graft(dn))
ty_2 = Type(ty)
gr_2 = Group(gr)
fltdsn = FlattenDesign(Design=dn_2, Type=ty_2)
dsn = ModelDesign(Design=fltdsn)  # -> Design, Valid, Name, Description, Icon, Image, Variant, View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
trim = TrimTree(Tree=dsn.Pieces, Depth=1)
typ = SelectTypeByPiece(ty=ty_2, pc=trim)  # -> ty_4, i_2
item = ListItem(List=gr_2, Index=typ.i_2, Wrap=True)
pce = ModelPiece(Piece=dsn.Pieces)  # -> Piece, Valid, Id, Description, TypeName, TypeVariant, Plane, Center, Qualities
trim_2 = TrimTree(Tree=item, Depth=1)
orient = Orient(Geometry=trim_2, Source=PlaneXY(0, 0, 0), Target=pce.Plane)  # -> Geometry, Transform
gr_3 = Group(orient.Geometry)
gr_4 = ClusterOutput(gr_3)

# ==== cluster Compile
gr = ClusterInput()
gr_2 = Group(gr)
ungroup = Ungroup(Group=gr_2)
item = ListItem(List=ungroup, Index=0, Wrap=True)  # -> flatten(Item), flatten(Item1), flatten(Item2), flatten(Item3)
ungroup_2 = Ungroup(Group=item.Item)  # -> flatten(Geometry)
sunion = SolidUnion(Breps=ungroup_2)  # disabled
join = BrepJoin(Breps=item.Item2)  # -> Breps, Closed
join_2 = BrepJoin(Breps=item.Item3)  # -> Breps, Closed
join_3 = BrepJoin(Breps=item.Item1)  # -> Breps, Closed
fmerge = MergeFaces(Brep=sunion)  # -> flatten(Breps), Before, After
fmerge_2 = MergeFaces(Brep=join_3.Breps)  # -> flatten(Breps), Before, After
fmerge_3 = MergeFaces(Brep=join.Breps)  # -> flatten(Breps), Before, After
fmerge_4 = MergeFaces(Brep=join_2.Breps)  # -> flatten(Breps), Before, After
group = Group(Geometry=fmerge.Breps)
group_2 = Group(Geometry=fmerge_2.Breps)
group_3 = Group(Geometry=ungroup_2)
group_4 = Group(Geometry=fmerge_3.Breps)
group_5 = Group(Geometry=fmerge_4.Breps)
buildings = Group(group)
building_segments = Group(group_3)
cars = Group(group_2)
pedestrians = Group(group_4)
green = Group(group_5)
merge = Merge(Data1=fmerge_3.Breps, Data2=fmerge_4.Breps)
buildings_2 = ClusterOutput(buildings)
building_segments_2 = ClusterOutput(building_segments)
cars_2 = ClusterOutput(cars)
pedestrians_2 = ClusterOutput(pedestrians)
green_2 = ClusterOutput(green)
vec = VectorXYZ(XComponent=Slider(0.4, range=-1..1), YComponent=Slider(0.3, range=-1..1), ZComponent=Slider(-1, range=-1..1))  # -> Vector, Length
mshadow = MeshShadow(Mesh=fmerge.Breps, Light=vec.Vector, Plane=PlaneXY(0, 0, 0))
runion = RegionUnion(Curves=mshadow)
Z = UnitZ(Factor="0.1")
srf = Surface(flatten(runion))
move = Move(Geometry=srf, Motion=Z)  # -> Geometry, Transform
geo = PreviewGeometry()
preview = CustomPreview(Geometry=move.Geometry, Material=ColourSwatch(SwatchColor=RGBA(50, 50, 50, 148)))
preview_2 = CustomPreview(Geometry=fmerge_2.Breps, Material=ColourSwatch(SwatchColor=RGBA(0, 17, 23, 64)))
preview_3 = CustomPreview(Geometry=fmerge_3.Breps, Material=ColourSwatch(SwatchColor=RGBA(0, 17, 23, 128)))
preview_4 = CustomPreview(Geometry=fmerge_4.Breps, Material=ColourSwatch(SwatchColor=RGB(50, 171, 50)))
preview_5 = CustomPreview(Geometry=merge, Material=ColourSwatch(SwatchColor=RGB(0, 0, 0)))

# ==== cluster SelectTypeByPiece: Select the type of a piece.
ty = ClusterInput()
pc = ClusterInput()
pc_2 = Piece(graft(pc))
ty_2 = Type(ty)
pce = ModelPiece(Piece=pc_2)  # -> Piece, Valid, Id, Description, TypeName, TypeVariant, Plane, Center, Qualities
typ = SelectType(ty=ty_2, na=pce.TypeName, variant=pce.TypeVariant)  # -> ty_4, i_2
trim = TrimTree(Tree=typ.ty_4, Depth=1)
trim_2 = TrimTree(Tree=typ.i_2, Depth=1)
ty_3 = Type(trim)
i = Integer(trim_2)
ty_4 = ClusterOutput(ty_3)
i_2 = ClusterOutput(i)

# ==== cluster PreviewGeometry: semio styled preview of geometry.
geo = ClusterInput()
swatch = ColourSwatch(SwatchColor=RGB(255, 255, 255))
swatch_2 = ColourSwatch(SwatchColor=RGB(0, 0, 0))
geo_2 = Geometry(flatten(geo))
dispatch = CSharpScript(D=geo_2)  # -> P, C, B, M, R
# ---------- dispatch: C# ----------
// Grasshopper Script Instance
#region Usings
using System;
using System.Linq;
using System.Collections;
using System.Collections.Generic;
using System.Drawing;

using Rhino;
using Rhino.Geometry;

using Grasshopper;
using Grasshopper.Kernel;
using Grasshopper.Kernel.Data;
using Grasshopper.Kernel.Types;
#endregion

public class Script_Instance : GH_ScriptInstance
{
    #region Notes
    /* 
      Members:
        RhinoDoc RhinoDocument
        GH_Document GrasshopperDocument
        IGH_Component Component
        int Iteration

      Methods (Virtual & overridable):
        Print(string text)
        Print(string format, params object[] args)
        Reflect(object obj)
        Reflect(object obj, string method_name)
    */
    #endregion

    private void RunScript(
	object D,
	ref object P,
	ref object C,
	ref object B,
	ref object M,
	ref object R)
    {
        if (D is Curve) C = D; // Curve
        else if (
            D is Rhino.Geometry.Point ||
            D is PointCloud
            )
            P = D; // Point
        else if ( D is Mesh) M = D; // Mesh
        else if (
            D is Surface ||
            D is Extrusion ||
            D is SubD ||
            D is Brep
            )
            B = D; // Brep
        else R = D; // Rest
            
    }
}
# ---------- end dispatch ----------
clean = CleanTree(RemoveNulls=True, RemoveInvalid=True, RemoveEmpty=False, Tree=dispatch.P)
clean_2 = CleanTree(RemoveNulls=True, RemoveInvalid=True, RemoveEmpty=False, Tree=dispatch.C)
clean_3 = CleanTree(RemoveNulls=True, RemoveInvalid=True, RemoveEmpty=False, Tree=dispatch.B)
clean_4 = CleanTree(RemoveNulls=True, RemoveInvalid=True, RemoveEmpty=False, Tree=dispatch.M)
clean_5 = CleanTree(RemoveNulls=True, RemoveInvalid=True, RemoveEmpty=False, Tree=dispatch.R)
debrep = DeconstructBrep(Brep=clean_3)  # -> Faces, Edges, Vertices
preview = CustomPreview(Geometry=flatten(clean_5), Material=swatch_2)
preview_2 = CustomPreview(Geometry=flatten(clean), Material=swatch_2)
preview_3 = CustomPreview(Geometry=flatten(clean_2), Material=swatch_2)
preview_4 = CustomPreview(Geometry=flatten(debrep.Faces), Material=swatch)
preview_5 = CustomPreview(Geometry=flatten(debrep.Edges), Material=swatch_2)
preview_6 = CustomPreview(Geometry=flatten(clean_4), Material=swatch)

# ==== cluster SelectType: Select a type with a name and an optional variant. If no variant is provided it will select all variants. If you want to select the default type then use the empty text.
ty = ClusterInput()
na = ClusterInput()
variant = ClusterInput()
na_2 = Name(na)
variant_2 = Variant(variant)
ty_2 = Type(ty)
typ = ModelType(Type=ty_2)  # -> Type, Valid, Name, Description, Icon, Image, Variant, Unit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
expression = Expression(x=typ.Name, y=na_2, Expression="x=y")
cull = CullPattern(List=typ.Type, CullPattern=expression)
typ_2 = ModelType(Type=cull)  # -> Type, Valid, Name, Description, Icon, Image, Variant, Unit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
expression_2 = Expression(x=typ_2.Variant, y=variant_2, Expression="x=y")
txt = Text(ty_2)
cull_2 = CullPattern(List=typ_2.Type, CullPattern=expression_2)
null = NullItem(Item=variant_2)  # -> NullFlags, InvalidFlags, Description
filter = StreamFilter(Gate=null.NullFlags, Stream0=cull_2, Stream1=cull)
txt_2 = Text(filter)
mindex = MemberIndex(Set=txt, Member=txt_2)  # -> Index, Count
trim = TrimTree(Tree=mindex.Index, Depth=1)
ty_3 = Type(filter)
i = Integer(trim)
ty_4 = ClusterOutput(ty_3)
i_2 = ClusterOutput(i)
