# Grasshopper definition voxels.gh (Grasshopper 1.0.8)
# Copyright: GNU Lesser General Public License Version 3
# plug-ins: Monoceros

pt = Point()
saddle_bottom_south_east = Brep(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)
saddle_bottom_north_east = Brep(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)
saddle_bottom_north_west = Brep(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)
saddle_top_south_west = Brep(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)
saddle_top_south_east = Brep(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)
saddle_top_north_east = Brep(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)
saddle_top_north_west = Brep(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)
gem_bottom_south_east = Brep(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)
gem_bottom_north_east = Brep(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)
gem_top_south_west = Brep(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)
gem_top_south_east = Brep(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)
saddle_bottom_south_west = Brep(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)
gem_bottom_south_west = Brep(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)
gem_bottom_north_west = Brep(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)
gem_top_north_east = Brep(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)
gem_top_north_west = Brep(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)
pillow_bottom_south_east = Brep(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)
pillow_top_south_west = Brep(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)
pillow_bottom_south_west = Brep(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)
pillow_bottom_north_east = Brep(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)
pillow_bottom_north_west = Brep(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)
pillow_top_south_east = Brep(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)
pillow_top_north_east = Brep(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)
pillow_top_north_west = Brep(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)
merge = Merge(Data1=gem_top_south_west, Data2=gem_top_south_east, Data3=gem_top_north_east, Data4=gem_top_north_west)
merge_2 = Merge(Data1=gem_bottom_south_west, Data2=gem_bottom_south_east, Data3=gem_bottom_north_east, Data4=gem_bottom_north_west)
merge_3 = Merge(Data1=saddle_top_south_west, Data2=saddle_top_south_east, Data3=saddle_top_north_east, Data4=saddle_top_north_west)
merge_4 = Merge(
    Data1=saddle_bottom_south_west,
    Data2=saddle_bottom_south_east,
    Data3=saddle_bottom_north_east,
    Data4=saddle_bottom_north_west)
merge_5 = Merge(Data1=pillow_top_south_west, Data2=pillow_top_south_east, Data3=pillow_top_north_east, Data4=pillow_top_north_west)
merge_6 = Merge(
    Data1=pillow_bottom_south_west,
    Data2=pillow_bottom_south_east,
    Data3=pillow_bottom_north_east,
    Data4=pillow_bottom_north_west)
entwine = Entwine(Branch00=merge_2, Branch01=merge, FlattenInputs=True)
entwine_2 = Entwine(Branch00=merge_4, Branch01=merge_3, FlattenInputs=True)
entwine_3 = Entwine(Branch00=merge_6, Branch01=merge_5, FlattenInputs=True)
panel = Panel("""pillow-b-sw
pillow-b-se
pillow-b-ne
pillow-b-nw
pillow-t-sw
pillow-t-se
pillow-t-ne
pillow-t-nw
saddle-b-sw
saddle-b-se
saddle-b-ne
saddle-b-nw
saddle-t-sw
saddle-t-se
saddle-t-ne
saddle-t-nw
gem-b-sw
gem-b-se
gem-b-ne
gem-b-nw
gem-t-sw
gem-t-se
gem-t-ne
gem-t-nw""")
mrg_a = MergeSeperatlyAppend(x=entwine_3, y=entwine_2, z=entwine)  # -> Mrgd; inputs x: tree, y: tree, z: tree
# ---------- mrg_a: Python ----------
if ghenv.Component.RunCount<2:
    __author__ = "Ueli Saluz"
    __version__ = "2020.05.28"
    
    ghenv.Component.Name = "MergeSeperatly(Append)"
    ghenv.Component.NickName = "Mrg(A)"
    ghenv.Component.Description = "Merge inputs seperatly on a new path. Append index of input parameter for distincting."
    ghenv.Component.Message = "VER 1.0"

from System import Object
from Grasshopper import DataTree
from Grasshopper.Kernel import GH_ParamAccess as Access

if __name__ == "__main__":
    Mrgd = DataTree[Object]()
    access = Access()
    
    for input in ghenv.Component.Params.Input:  #set all Inputaccess to Tree Access
        input.Access = access.tree
    
    for i,input in enumerate(ghenv.Component.Params.Input):
        for j,source in enumerate(input.Sources):
            for path in source.VolatileData.Paths:
                Mrgd.AddRange(source.VolatileData[path],path.AppendElement(i))
# ---------- end mrg_a ----------
geo = Geometry(mrg_a)
box = Box(Tree({0;0;0}: [{Plane=PlaneXY(0, 0, 0), X=Domain(0, 0.5), Y=Domain(0, 0.5), Z=Domain(0, 0.25)}, {Plane=PlaneXY(1, 0, 0), X=Domain(0, 0.5), Y=Domain(0, 0.5), Z=Domain(0, 0.25)}, {Plane=PlaneXY(0, 1, 0), X=Domain(0, 0.5), Y=Domain(0, 0.5), Z=Domain(0, 0.25)}, {Plane=PlaneXY(1, 1, 0), X=Domain(0, 0.5), Y=Domain(0, 0.5), Z=Domain(0, 0.25)}], {0;0;1}: [{Plane=PlaneXY(0, 0, 0.5), X=Domain(0, 0.5), Y=Domain(0, 0.5), Z=Domain(0, 0.25)}, {Plane=PlaneXY(1, 0, 0.5), X=Domain(0, 0.5), Y=Domain(0, 0.5), Z=Domain(0, 0.25)}, {Plane=PlaneXY(0, 1, 0.5), X=Domain(0, 0.5), Y=Domain(0, 0.5), Z=Domain(0, 0.25)}, {Plane=PlaneXY(1, 1, 0.5), X=Domain(0, 0.5), Y=Domain(0, 0.5), Z=Domain(0, 0.25)}], {0;0;2}: [{Plane=PlaneXY(0, 0, 1), X=Domain(0, 0.5), Y=Domain(0, 0.5), Z=Domain(0, 0.25)}, {Plane=PlaneXY(1, 0, 1), X=Domain(0, 0.5), Y=Domain(0, 0.5), Z=Domain(0, 0.25)}, {Plane=PlaneXY(0, 1, 1), X=Domain(0, 0.5), Y=Domain(0, 0.5), Z=Domain(0, 0.25)}, {Plane=PlaneXY(1, 1, 1), X=Domain(0, 0.5), Y=Domain(0, 0.5), Z=Domain(0, 0.25)}], {0;1;0}: [{Plane=PlaneXY(0, 0, 1.5), X=Domain(0, 0.5), Y=Domain(0, 0.5), Z=Domain(0, 0.25)}, {Plane=PlaneXY(1, 0, 1.5), X=Domain(0, 0.5), Y=Domain(0, 0.5), Z=Domain(0, 0.25)}, {Plane=PlaneXY(0, 1, 1.5), X=Domain(0, 0.5), Y=Domain(0, 0.5), Z=Domain(0, 0.25)}, {Plane=PlaneXY(1, 1, 1.5), X=Domain(0, 0.5), Y=Domain(0, 0.5), Z=Domain(0, 0.25)}], {0;1;1}: [{Plane=PlaneXY(0, 0, 2), X=Domain(0, 0.5), Y=Domain(0, 0.5), Z=Domain(0, 0.25)}, {Plane=PlaneXY(1, 0, 2), X=Domain(0, 0.5), Y=Domain(0, 0.5), Z=Domain(0, 0.25)}, {Plane=PlaneXY(0, 1, 2), X=Domain(0, 0.5), Y=Domain(0, 0.5), Z=Domain(0, 0.25)}, {Plane=PlaneXY(1, 1, 2), X=Domain(0, 0.5), Y=Domain(0, 0.5), Z=Domain(0, 0.25)}], {0;1;2}: [{Plane=PlaneXY(0, 0, 2.5), X=Domain(0, 0.5), Y=Domain(0, 0.5), Z=Domain(0, 0.25)}, {Plane=PlaneXY(1, 0, 2.5), X=Domain(0, 0.5), Y=Domain(0, 0.5), Z=Domain(0, 0.25)}, {Plane=PlaneXY(0, 1, 2.5), X=Domain(0, 0.5), Y=Domain(0, 0.5), Z=Domain(0, 0.25)}, {Plane=PlaneXY(1, 1, 2.5), X=Domain(0, 0.5), Y=Domain(0, 0.5), Z=Domain(0, 0.25)}]))
pt_2 = Point(Tree({0;0;0}: [Point(0.25, 0.25, 0.125), Point(1.25, 0.25, 0.125), Point(0.25, 1.25, 0.125), Point(1.25, 1.25, 0.125)], {0;0;1}: [Point(0.25, 0.25, 0.625), Point(1.25, 0.25, 0.625), Point(0.25, 1.25, 0.625), Point(1.25, 1.25, 0.625)], {0;0;2}: [Point(0.25, 0.25, 1.125), Point(1.25, 0.25, 1.125), Point(0.25, 1.25, 1.125), Point(1.25, 1.25, 1.125)], {0;1;0}: [Point(0.25, 0.25, 1.625), Point(1.25, 0.25, 1.625), Point(0.25, 1.25, 1.625), Point(1.25, 1.25, 1.625)], {0;1;1}: [Point(0.25, 0.25, 2.125), Point(1.25, 0.25, 2.125), Point(0.25, 1.25, 2.125), Point(1.25, 1.25, 2.125)], {0;1;2}: [Point(0.25, 0.25, 2.625), Point(1.25, 0.25, 2.625), Point(0.25, 1.25, 2.625), Point(1.25, 1.25, 2.625)]))
name = Text(panel)
xy = XYPlane(Origin="-0.25,-0.25,-0.125")
vec = VectorXYZ(XComponent="0.5", YComponent="0.5", ZComponent="0.25")  # -> Vector, Length
unflatten = UnflattenTree(Tree=name, Guide=geo)
geo_2 = Geometry(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)

# ---- group: World
geo_3 = Geometry(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)
popslots = PopulateGeometryWithSlotCenters(Geometry=geo_2, BasePlane=PlaneXY(0, 0, 0), GridSlotDiagonal=vec.Vector, Fill=Slider(0, range=0..2), Precision=0.5)  # disabled
slotall = ConstructSlotWithAllModulesAllowed(SlotPoint=popslots, BasePlane=PlaneXY(0, 0, 0), GridSlotDiagonal=Vector(1, 1, 1))  # disabled

# ----
constmodule = ConstructModule(
    ModuleName=graft(unflatten),
    ModulePartPoints=graft(pt_2),
    Geometry=graft(geo),
    BasePlane=xy,
    ModulePartDiagonal=vec.Vector)  # -> flatten(Module)
geo_4 = Geometry([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])
geo_5 = Geometry([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])
geo_6 = Geometry([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])
pillow_saddle = Curve([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])
saddle_gem = Curve([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])
saddle = Curve([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])
gem = Curve([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])
pillow = Curve([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])
ruleexpcrv = ExplicitRuleFromCurve(Modules=constmodule, ConnectionCurve=pillow_saddle)  # -> flatten(Rules)
ruleexpcrv_2 = ExplicitRuleFromCurve(Modules=constmodule, ConnectionCurve=pillow)  # -> flatten(Rules)
ruleexpcrv_3 = ExplicitRuleFromCurve(Modules=constmodule, ConnectionCurve=gem)  # -> flatten(Rules)
ruleexpcrv_4 = ExplicitRuleFromCurve(Modules=constmodule, ConnectionCurve=saddle)  # -> flatten(Rules)
ruleexpcrv_5 = ExplicitRuleFromCurve(Modules=constmodule, ConnectionCurve=saddle_gem)  # -> flatten(Rules)
deconruleexp = DeconstructExplicitRule(Rule=ruleexpcrv)  # -> SourceModuleName, SourceConnectorIndex, TargetModuleName, TargetConnectorIndex
deconruleexp_2 = DeconstructExplicitRule(Rule=ruleexpcrv_2)  # -> SourceModuleName, SourceConnectorIndex, TargetModuleName, TargetConnectorIndex
deconruleexp_3 = DeconstructExplicitRule(Rule=ruleexpcrv_3)  # -> SourceModuleName, SourceConnectorIndex, TargetModuleName, TargetConnectorIndex
deconruleexp_4 = DeconstructExplicitRule(Rule=ruleexpcrv_4)  # -> SourceModuleName, SourceConnectorIndex, TargetModuleName, TargetConnectorIndex
deconruleexp_5 = DeconstructExplicitRule(Rule=ruleexpcrv_5)  # -> SourceModuleName, SourceConnectorIndex, TargetModuleName, TargetConnectorIndex
wfc = MonocerosWFCSolver(Slots=slotall, RandomSeed=42, MaxAttempts=10, UseShannonEntropy=False, MaxObservations=2147483647)  # -> Out, Slots, Attempts, Deterministic, Contradictory, Observations; disabled
ruletyp = ConstructTypedRule(ModuleName=deconruleexp.SourceModuleName, ConnectorIndex=deconruleexp.SourceConnectorIndex, Type="p-s")
ruletyp_2 = ConstructTypedRule(ModuleName=deconruleexp.TargetModuleName, ConnectorIndex=deconruleexp.TargetConnectorIndex, Type="p-s")
ruletyp_3 = ConstructTypedRule(ModuleName=deconruleexp_2.SourceModuleName, ConnectorIndex=deconruleexp_2.SourceConnectorIndex, Type="p")
ruletyp_4 = ConstructTypedRule(ModuleName=deconruleexp_2.TargetModuleName, ConnectorIndex=deconruleexp_2.TargetConnectorIndex, Type="p")
ruletyp_5 = ConstructTypedRule(ModuleName=deconruleexp_3.SourceModuleName, ConnectorIndex=deconruleexp_3.SourceConnectorIndex, Type="g")
ruletyp_6 = ConstructTypedRule(ModuleName=deconruleexp_3.TargetModuleName, ConnectorIndex=deconruleexp_3.TargetConnectorIndex, Type="g")
ruletyp_7 = ConstructTypedRule(ModuleName=deconruleexp_4.SourceModuleName, ConnectorIndex=deconruleexp_4.SourceConnectorIndex, Type="s")
ruletyp_8 = ConstructTypedRule(ModuleName=deconruleexp_4.TargetModuleName, ConnectorIndex=deconruleexp_4.TargetConnectorIndex, Type="s")
ruletyp_9 = ConstructTypedRule(ModuleName=deconruleexp_5.SourceModuleName, ConnectorIndex=deconruleexp_5.SourceConnectorIndex, Type="s-g")
ruletyp_10 = ConstructTypedRule(ModuleName=deconruleexp_5.TargetModuleName, ConnectorIndex=deconruleexp_5.TargetConnectorIndex, Type="s-g")
materialize = MaterializeModule(Slots=wfc.Slots)  # -> Geometry, Transform; disabled
merge_7 = Merge(Data1=ruletyp, Data2=ruletyp_2)
merge_8 = Merge(Data1=ruletyp_3, Data2=ruletyp_4)
merge_9 = Merge(Data1=ruletyp_5, Data2=ruletyp_6)
merge_10 = Merge(Data1=ruletyp_7, Data2=ruletyp_8)
merge_11 = Merge(Data1=ruletyp_9, Data2=ruletyp_10)
merge_12 = Merge(Data1=merge_8, Data2=merge_7, Data3=merge_10, Data4=merge_11, Data5=merge_9)
rulepreview = PreviewRules(Modules=constmodule, Rules=merge_12)
