# Grasshopper definition assess-perfomance.gh (Grasshopper 1.0.8)
# Copyright: GNU Lesser General Public License Version 3
# plug-ins: semio

kt = Kit("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")
kit = ModelKit(Kit=kt)  # -> Kit, Valid, Name, Description, Icon, Image, Preview, Version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
typ = ModelType(Type=kit.Types)  # -> Type, Valid, Name, Description, Icon, Image, Variant, Stock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
dsn = ModelDesign(Design=kit.Designs)  # -> Design, Valid, Name, Description, Icon, Image, Variant, View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
con = ModelConnection(Connection=dsn.Connections)  # -> Connection, Valid, ConnectedPieceId, ConnectedPieceTypePortId, ConnectingPieceId, ConnectingPieceTypePortId, Description, Gap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
item = ListItem(List=kit.Designs, Index=0, Wrap=True)  # -> Item, Item1
por = ModelPort(Port=typ.Ports)  # -> Port, Valid, Id, Description, Mandatory, Family, CompatibleFamilies, Point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
rep = ModelRepresentation(Representation=typ.Representations)  # -> Representation, Valid, Url, Description, Tags, Qualities
pce = ModelPiece(Piece=dsn.Pieces)  # -> Piece, Valid, Id, Description, TypeName, TypeVariant, Plane, Center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
panel = Panel(dsn.Pieces)
merge = Merge(Data1=item.Item, Data2=item.Item)
dn = Design(flatten(merge))
ty = Type(flatten(kit.Types))
prf = AssessPerformance(dn=dn, ty=ty)  # -> dn_3, interest_2, area_efficiency_eff_m²_m²_2, area_comfort_m²_person_2, income_a_3, expenses_a_3, energy_expenses_a_4, effective_floor_area_m²_12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

# ==== cluster AssessPerformance: Simple performance assement based on the following qualities of the types (No unit conversion is applied for now, so make sure that all your types have the values with the same unit.): floor area, effective floor area, residents, workspaces, construction cost, maintenance expenses, income, transmission heat loss, ventilation heat loss, cooling energy demand, technical equipment energy demand,construction global warming potential, heating load, cooling load, ventilation air flow volume
dn = ClusterInput()
ty = ClusterInput()
technical_equipment_cost = ClusterInput()
technical_equipment_gwp_kgco2e = ClusterInput()
ventilation_heat_recovery_factor = ClusterInput()
heating_efficiency_factor = ClusterInput()
heating_primary_energy_factor = ClusterInput()
heating_energy_price_kwh = ClusterInput()
heating_global_warming_potential_kgco2e = ClusterInput()  # "Heating Global Warming Potential [kgCO2e/kWh]"
cooling_efficiency_factor = ClusterInput()
cooling_primary_energy_factor = ClusterInput()
cooling_global_warming_potential_kgco2e = ClusterInput()  # "Cooling Global Warming Potential [kgCO2e/kWh]"
cooling_energy_price_kwh = ClusterInput()
electrictiy_primary_energy_factor = ClusterInput()
electrictiy_global_warming_potential_kgc = ClusterInput()  # "Electrictiy Global Warming Potential [kgCO2e/kWh]"
electrictiy_energy_price_kwh = ClusterInput()
co2_price_tco2e = ClusterInput()
life_cycle_a = ClusterInput()
dn_2 = Design(graft(dn))
electrictiy_energy_price_kwh_2 = Number(electrictiy_energy_price_kwh)
heating_primary_energy_factor_2 = Number(heating_primary_energy_factor)
heating_energy_price_kwh_2 = Number(heating_energy_price_kwh)
heating_global_warming_potential_kgco2e_2 = Number(heating_global_warming_potential_kgco2e)  # "Heating Global Warming Potential [kgCO2e/kWh]"
cooling_energy_price_kwh_2 = Number(cooling_energy_price_kwh)
electrictiy_primary_energy_factor_2 = Number(electrictiy_primary_energy_factor)
ventilation_heat_recovery_factor_2 = Number(ventilation_heat_recovery_factor)
heating_efficiency_factor_2 = Number(heating_efficiency_factor)
cooling_efficiency_factor_2 = Number(cooling_efficiency_factor)
cooling_primary_energy_factor_2 = Number(cooling_primary_energy_factor)
cooling_global_warming_potential_kgco2e_2 = Number(cooling_global_warming_potential_kgco2e)  # "Cooling Global Warming Potential [kgCO2e/kWh]"
electrictiy_global_warming_potential_kgc_2 = Number(electrictiy_global_warming_potential_kgc)  # "Electrictiy Global Warming Potential [kgCO2e/kWh]"
co2_price_tco2e_2 = Number(co2_price_tco2e)
life_cycle_a_2 = Number(life_cycle_a)
ty_2 = Type(ty)
technical_equipment_cost_2 = Number(technical_equipment_cost)
technical_equipment_gwp_kgco2e_2 = Number(technical_equipment_gwp_kgco2e)
expression = Expression(x=co2_price_tco2e_2, Expression="x/1000")
co2_price_kgco2e = Number(expression)

dsn = ModelDesign(Design=dn_2)  # -> Design, Valid, Name, Description, Icon, Image, Variant, View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
trim = TrimTree(Tree=dsn.Pieces, Depth=1)
typ = SelectTypeByPiece(ty=ty_2, pc=trim)  # -> ty_4, i_2
typ_2 = ModelType(Type=typ.ty_4)  # -> Type, Valid, Name, Description, Icon, Image, Variant, Stock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

panel = Panel("""residents
workspace""")
qal = SumQualities(dn=dn_2, ty=ty_2, na="floor area")  # -> num_2, ql_2; disabled
qal_2 = SumQualities(dn=dn_2, ty=ty_2, na="effective floor area")  # -> num_2, ql_2; disabled
qal_3 = SumQualities(dn=dn_2, ty=ty_2, na="construction cost")  # -> num_2, ql_2; disabled
qal_4 = SumQualities(dn=dn_2, ty=ty_2, na="maintenance expenses")  # -> num_2, ql_2
qal_5 = SumQualities(dn=dn_2, ty=ty_2, na="income")  # -> num_2, ql_2; disabled
qal_6 = SumQualities(dn=dn_2, ty=ty_2, na="transmission heat demand")  # -> num_2, ql_2
qal_7 = SumQualities(dn=dn_2, ty=ty_2, na="ventilation heat demand")  # -> num_2, ql_2; disabled
qal_8 = SumQualities(dn=dn_2, ty=ty_2, na="cooling energy demand")  # -> num_2, ql_2; disabled
qal_9 = SumQualities(dn=dn_2, ty=ty_2, na="technical equipment energy demand")  # -> num_2, ql_2; disabled
qal_10 = SumQualities(dn=dn_2, ty=ty_2, na="construction global warming potential")  # -> num_2, ql_2; disabled
qal_11 = SumQualities(dn=dn_2, ty=ty_2, na="heating load")  # -> num_2, ql_2; disabled
qal_12 = SumQualities(dn=dn_2, ty=ty_2, na="cooling load")  # -> num_2, ql_2; disabled
qal_13 = SumQualities(dn=dn_2, ty=ty_2, na="ventilation air flow volume")  # -> num_2, ql_2; disabled
ql = Quality(typ_2.Qualities)
qal_14 = SumQualitiesByHierachy(ql=ql, na="users", cna=panel, value="0")  # -> value_4, pa_2, ch_2

cooling_efficiency_factor_3 = Number(cooling_efficiency_factor_2)
merge = Merge(Data1="Cooling Energy Demand")
qal_15 = SumQualitiesByHierachy(ql=ql, na="Final Cooling Energy Demand", cna=merge, value="0", cfa=cooling_efficiency_factor_3)  # -> value_4, pa_2, ch_2

# ----
# für jedes Child braucht es einen Faktor!!
# (sobald man einen angibt brauch man für alle
# einen, damit nicht eine Faktor auf alle childs
# angewendet wird)
# Cooling
ventilation_heat_recovery_factor_3 = Number(ventilation_heat_recovery_factor_2)
# Heating
panel_2 = Panel("transmission heat demand")
expression_2 = Expression(x=ventilation_heat_recovery_factor_3, Expression="1-x")
merge_2 = Merge(Data1=panel_2, Data2="ventilation heat demand")
merge_3 = Merge(Data1="1", Data2=expression_2)
qal_16 = SumQualitiesByHierachy(ql=ql, na="heating energy demand", cna=merge_2, value="0", cfa=merge_3)  # -> value_4, pa_2, ch_2

# ----
# Electricity
panel_3 = Panel("Technical Equipment Energy Demand")
electrictiy_energy_price_kwh_3 = Number(electrictiy_energy_price_kwh_2)
merge_4 = Merge(Data1=panel_3)
qal_17 = SumQualitiesByHierachy(ql=ql, na="Electricity Energy Price", cna=merge_4, value="0", cfa=electrictiy_energy_price_kwh_3)  # -> value_4, pa_2, ch_2

cooling_primary_energy_factor_3 = Number(cooling_primary_energy_factor_2)
multiplication = Multiplication(A=qal_15.value_4, B=cooling_primary_energy_factor_3)  # -> graft(Result)
merge_5 = Merge(Data1="Final Cooling Energy Demand")
qal_18 = SumQualitiesByHierachy(ql=ql, na="Primary Cooling Energy Demand", cna=merge_5, value=multiplication, cfa=cooling_primary_energy_factor_3)  # -> value_4, pa_2, ch_2

electrictiy_primary_energy_factor_3 = Number(electrictiy_primary_energy_factor_2)
merge_6 = Merge(Data1="Technical Equipment Energy Demand")
qal_19 = SumQualitiesByHierachy(ql=ql, na="Primary Electricity Energy Demand", cna=merge_6, value="0", cfa=electrictiy_primary_energy_factor_3)  # -> value_4, pa_2, ch_2

users_person = Number(qal_14.value_4)
ventilation_heat_recovery_factor_4 = Number(ventilation_heat_recovery_factor_2)  # disabled
ventiation_heat_loss_kwh_a = Number(qal_7.num_2)  # disabled
expression_3 = Expression(x=ventilation_heat_recovery_factor_4, Expression="1-x")  # disabled
transmission_heat_loss_kwh_a = Number(qal_6.num_2)  # disabled
multiplication_2 = Multiplication(A=ventiation_heat_loss_kwh_a, B=expression_3)  # disabled
heating_global_warming_potential_kgco2e_3 = Number(heating_global_warming_potential_kgco2e_2)  # "Heating Global Warming Potential [kgCO2e/kWh]"; disabled
electrictiy_global_warming_potential_kgc_3 = Number(electrictiy_global_warming_potential_kgc_2)  # "Electrictiy Global Warming Potential [kgCO2e/kWh]"; disabled
cooling_global_warming_potential_kgco2e_3 = Number(cooling_global_warming_potential_kgco2e_2)  # "Cooling Global Warming Potential [kgCO2e/kWh]"; disabled
addition = Addition(A=transmission_heat_loss_kwh_a, B=multiplication_2)  # disabled

cooling_energy_price_kwh_3 = Number(cooling_energy_price_kwh_2)
merge_7 = Merge(Data1="Final Cooling Energy Demand")
qal_20 = SumQualitiesByHierachy(ql=ql, na="Cooling Energy Price", cna=merge_7, value=graft(qal_15.value_4), cfa=cooling_energy_price_kwh_3)  # -> value_4, pa_2, ch_2

cooling_global_warming_potential_kgco2e_4 = Number(cooling_global_warming_potential_kgco2e_2)  # "Cooling Global Warming Potential [kgCO2e/kWh]"
merge_8 = Merge(Data1="Final Cooling Energy Demand")
panel_4 = Panel("0")
qal_21 = SumQualitiesByHierachy(
    ql=ql,
    na="Cooling Global Warming Influence",
    cna=merge_8,
    value=graft(qal_15.value_4),
    cfa=cooling_global_warming_potential_kgco2e_4)  # -> value_4, pa_2, ch_2

technical_equipment_energy_demand_kwh_a = Number(qal_9.num_2)  # disabled

electrictiy_global_warming_potential_kgc_4 = Number(electrictiy_global_warming_potential_kgc_2)  # "Electrictiy Global Warming Potential [kgCO2e/kWh]"
merge_9 = Merge(Data1="Technical Equipment Energy Demand")
qal_22 = SumQualitiesByHierachy(ql=ql, na="Electricity Global Warming Influence", cna=merge_9, value="0", cfa=electrictiy_global_warming_potential_kgc_4)  # -> value_4, pa_2, ch_2

electricity_energy_demand_kwh_a = Number(technical_equipment_energy_demand_kwh_a)  # disabled
cooling_energy_demand_kwh_a = Number(qal_8.num_2)  # disabled
heating_energy_demand_kwh_a = Number(addition)  # disabled
cooling_efficiency_factor_4 = Number(cooling_efficiency_factor_2)  # disabled
heating_efficiency_factor_3 = Number(heating_efficiency_factor_2)  # disabled

heating_efficiency_factor_4 = Number(heating_efficiency_factor_2)
merge_10 = Merge(Data1="heating energy demand")
qal_23 = SumQualitiesByHierachy(ql=ql, na="Final Heating Energy Demand", cna=merge_10, value=graft(qal_16.value_4), cfa=heating_efficiency_factor_4)  # -> value_4, pa_2, ch_2

heating_primary_energy_factor_3 = Number(heating_primary_energy_factor_2)
multiplication_3 = Multiplication(A=qal_23.value_4, B=heating_primary_energy_factor_3)  # -> graft(Result)
merge_11 = Merge(Data1="Final Heating Energy Demand")
qal_24 = SumQualitiesByHierachy(ql=ql, na="Primary Heating Energy Demand", cna=merge_11, value=multiplication_3, cfa=heating_primary_energy_factor_3)  # -> value_4, pa_2, ch_2

addition_2 = Addition(A=qal_24.value_4, B=qal_18.value_4, C=qal_19.value_4)  # -> graft(Result)
merge_12 = Merge(Data1="Final Heating Energy Demand", Data2="Final Cooling Energy Demand", Data3="Technical Equipment Energy Demand")
qal_25 = SumQualitiesByHierachy(ql=ql, na="Primary Energy Demand", cna=merge_12, value=addition_2, cfa=heating_primary_energy_factor_3)  # -> value_4, pa_2, ch_2
primary_energy_demand_kwh_a = Number(qal_25.value_4)

multiplication_4 = Multiplication(A=electricity_energy_demand_kwh_a, B=electrictiy_global_warming_potential_kgc_3)  # disabled
multiplication_5 = Multiplication(A=cooling_energy_demand_kwh_a, B=cooling_efficiency_factor_4)  # disabled
final_cooling_energy_demand_kwh_a = Number(multiplication_5)  # disabled
multiplication_6 = Multiplication(A=final_cooling_energy_demand_kwh_a, B=cooling_global_warming_potential_kgco2e_3)  # disabled
multiplication_7 = Multiplication(A=heating_energy_demand_kwh_a, B=heating_efficiency_factor_3)  # disabled
final_heating_energy_demand_kwh_a = Number(multiplication_7)  # disabled
multiplication_8 = Multiplication(A=final_heating_energy_demand_kwh_a, B=heating_global_warming_potential_kgco2e_3)  # disabled
heating_global_warming_potential_kgco2e_4 = Number(multiplication_8)  # "Heating Global Warming Potential [kgCO2e/a]"; disabled
cooling_global_warming_potential_kgco2e_5 = Number(multiplication_6)  # "Cooling Global Warming Potential [kgCO2e/a]"; disabled
electricity_global_warming_potential_kgc = Number(multiplication_4)  # "Electricity Global Warming Potential [kgCO2e/a]"; disabled
final_heating_energy_demand_kwh_a_2 = Number(multiplication_7)  # disabled
final_cooling_energy_demand_kwh_a_2 = Number(multiplication_5)  # disabled
electricity_energy_demand_kwh_a_2 = Number(technical_equipment_energy_demand_kwh_a)  # disabled
cooling_energy_price_kwh_4 = Number(cooling_energy_price_kwh_2)  # disabled
heating_energy_price_kwh_3 = Number(heating_energy_price_kwh_2)  # disabled
electrictiy_energy_price_kwh_4 = Number(electrictiy_energy_price_kwh_2)  # disabled
co2_price_kgco2e_2 = Number(co2_price_kgco2e)  # disabled
co2_price_kgco2e_3 = Number(co2_price_kgco2e)  # disabled
co2_price_kgco2e_4 = Number(co2_price_kgco2e)  # disabled

co2_price_kgco2e_5 = Number(co2_price_kgco2e)
merge_13 = Merge(Data1="Cooling Global Warming Influence")
qal_26 = SumQualitiesByHierachy(ql=ql, na="Cooling CO2 Price", cna=merge_13, value=graft(qal_21.value_4), cfa=co2_price_kgco2e_5)  # -> value_4, pa_2, ch_2

heating_energy_price_kwh_4 = Number(heating_energy_price_kwh_2)
merge_14 = Merge(Data1="Final Heating Energy Demand")
qal_27 = SumQualitiesByHierachy(ql=ql, na="Heating Energy Price", cna=merge_14, value=graft(qal_23.value_4), cfa=heating_energy_price_kwh_4)  # -> value_4, pa_2, ch_2

heating_global_warming_potential_kgco2e_5 = Number(heating_global_warming_potential_kgco2e_2)  # "Heating Global Warming Potential [kgCO2e/kWh]"
merge_15 = Merge(Data1="Final Heating Energy Demand")
qal_28 = SumQualitiesByHierachy(
    ql=ql,
    na="Heating Global Warming Influence",
    cna=merge_15,
    value=graft(qal_23.value_4),
    cfa=heating_global_warming_potential_kgco2e_5)  # -> value_4, pa_2, ch_2

co2_price_kgco2e_6 = Number(co2_price_kgco2e)
merge_16 = Merge(Data1="Electricity Global Warming Influence")
qal_29 = SumQualitiesByHierachy(ql=ql, na="Electricity CO2 Price", cna=merge_16, value=graft(qal_22.value_4), cfa=co2_price_kgco2e_6)  # -> value_4, pa_2, ch_2

multiplication_9 = Multiplication(A=final_heating_energy_demand_kwh_a_2, B=heating_energy_price_kwh_3)  # disabled
multiplication_10 = Multiplication(A=electricity_energy_demand_kwh_a_2, B=electrictiy_energy_price_kwh_4)  # disabled
multiplication_11 = Multiplication(A=heating_global_warming_potential_kgco2e_4, B=co2_price_kgco2e_2)  # disabled
multiplication_12 = Multiplication(A=final_cooling_energy_demand_kwh_a_2, B=cooling_energy_price_kwh_4)  # disabled
multiplication_13 = Multiplication(A=cooling_global_warming_potential_kgco2e_5, B=co2_price_kgco2e_3)  # disabled
multiplication_14 = Multiplication(A=electricity_global_warming_potential_kgc, B=co2_price_kgco2e_4)  # disabled
electricity_global_warming_potential_kgc_2 = Number(electricity_global_warming_potential_kgc)  # "Electricity Global Warming Potential [kgCO2e/a]"; disabled
heating_global_warming_potential_kgco2e_6 = Number(heating_global_warming_potential_kgco2e_4)  # "Heating Global Warming Potential [kgCO2e/a]"; disabled
cooling_global_warming_potential_kgco2e_6 = Number(cooling_global_warming_potential_kgco2e_5)  # "Cooling Global Warming Potential [kgCO2e/a]"; disabled
heating_co2_price_a = Number(multiplication_11)  # disabled
electricity_energy_price_a = Number(multiplication_10)  # disabled
heating_energy_price_a = Number(multiplication_9)  # disabled
cooling_energy_price_a = Number(multiplication_12)  # disabled
electricity_co2_price_a = Number(multiplication_14)  # disabled
final_heating_energy_demand_kwh_a_3 = Number(final_heating_energy_demand_kwh_a_2)  # disabled
cooling_co2_price_a = Number(multiplication_13)  # disabled
final_cooling_energy_demand_kwh_a_3 = Number(final_cooling_energy_demand_kwh_a_2)  # disabled
electricity_energy_demand_kwh_a_3 = Number(electricity_energy_demand_kwh_a_2)  # disabled
electricity_energy_demand_kwh_a_4 = Number(electricity_energy_demand_kwh_a_2)  # disabled
final_heating_energy_demand_kwh_a_4 = Number(final_heating_energy_demand_kwh_a_2)  # disabled
electrictiy_primary_energy_factor_4 = Number(electrictiy_primary_energy_factor_2)  # disabled
heating_primary_energy_factor_4 = Number(heating_primary_energy_factor_2)  # disabled
final_cooling_energy_demand_kwh_a_4 = Number(final_cooling_energy_demand_kwh_a_2)  # disabled
cooling_primary_energy_factor_4 = Number(cooling_primary_energy_factor_2)  # disabled
building_construction_gwp_kgco2e = Number(qal_10.num_2)  # disabled
technical_equipment_gwp_kgco2e_3 = Number(technical_equipment_gwp_kgco2e_2)  # disabled
addition_3 = Addition(A=cooling_energy_price_a, B=cooling_co2_price_a)  # disabled
addition_4 = Addition(A=heating_energy_price_a, B=heating_co2_price_a)  # disabled
addition_5 = Addition(A=electricity_energy_price_a, B=electricity_co2_price_a)  # disabled
addition_6 = Addition(
    A=heating_global_warming_potential_kgco2e_6,
    B=cooling_global_warming_potential_kgco2e_6,
    C=electricity_global_warming_potential_kgc_2)  # disabled
addition_7 = Addition(A=final_heating_energy_demand_kwh_a_3, B=final_cooling_energy_demand_kwh_a_3, C=electricity_energy_demand_kwh_a_4)  # disabled
multiplication_15 = Multiplication(A=electricity_energy_demand_kwh_a_3, B=electrictiy_primary_energy_factor_4)  # disabled
multiplication_16 = Multiplication(A=final_heating_energy_demand_kwh_a_4, B=heating_primary_energy_factor_4)  # disabled
multiplication_17 = Multiplication(A=final_cooling_energy_demand_kwh_a_4, B=cooling_primary_energy_factor_4)  # disabled
electricity_expenses_a = Number(addition_5)  # disabled
heating_expenses_a = Number(addition_4)  # disabled
cooling_expenses_a = Number(addition_3)  # disabled

co2_price_kgco2e_7 = Number(co2_price_kgco2e)
merge_17 = Merge(Data1="Heating Global Warming Influence")
qal_30 = SumQualitiesByHierachy(ql=ql, na="Heating CO2 Price", cna=merge_17, value=graft(qal_28.value_4), cfa=co2_price_kgco2e_7)  # -> value_4, pa_2, ch_2

energy_global_warming_potential_kgco2e_a = Number(addition_6)  # disabled

electricity_global_warming_influence_kgc = Number(qal_22.value_4)  # "Electricity Global Warming Influence [kgCO2e/a]"
heating_global_warming_influence_kgco2e = Number(qal_28.value_4)  # "Heating Global Warming Influence [kgCO2e/a]"
cooling_global_warming_influence_kgco2e = Number(qal_21.value_4)  # "Cooling Global Warming Influence [kgCO2e/a]"
addition_8 = Addition(
    A=heating_global_warming_influence_kgco2e,
    B=cooling_global_warming_influence_kgco2e,
    C=electricity_global_warming_influence_kgc)
energy_global_warming_potential_kgco2e_a_2 = Number(addition_8)
merge_18 = Merge(Data1="construction global warming potential", Data2="Technical Equipment Energy Demand")
life_cycle_a_3 = Number(life_cycle_a_2)
qal_31 = SumQualitiesByHierachy(ql=ql, na="Construction GWP", cna=merge_18, value="0")  # -> value_4, pa_2, ch_2
multiplication_18 = Multiplication(A=energy_global_warming_potential_kgco2e_a_2, B=life_cycle_a_3)
addition_9 = Addition(A=multiplication_18, B=qal_31.value_4)
life_cycle_gwp_kgco2e = Number(addition_9)

final_energy_demand_kwh_a = Number(addition_7)  # disabled
primary_heating_energy_demand_kwh_a = Number(multiplication_16)  # disabled
primary_cooling_energy_demand_kwh_a = Number(multiplication_17)  # disabled
primary_electricity_energy_demand_kwh_a = Number(multiplication_15)  # disabled
addition_10 = Addition(A=building_construction_gwp_kgco2e, B=technical_equipment_gwp_kgco2e_3)  # disabled
addition_11 = Addition(A=heating_expenses_a, B=cooling_expenses_a, C=electricity_expenses_a)  # disabled
life_cycle_a_4 = Number(life_cycle_a_2)  # disabled
construction_gwp_kgco2e = Number(addition_10)  # disabled
maintenance_expenses_a = Number(qal_4.num_2)  # disabled
energy_expenses_a = Number(addition_11)  # disabled
multiplication_19 = Multiplication(A=energy_global_warming_potential_kgco2e_a, B=life_cycle_a_4)  # disabled

expression_4 = Expression(x="0", y=qal_15.value_4, Expression="x")
merge_19 = Merge(Data1=qal_23.value_4, Data2=qal_15.value_4, Data3=expression_4)  # -> graft(Result)
merge_20 = Merge(Data1="Final Heating Energy Demand", Data2="Final Cooling Energy Demand", Data3="Technical Equipment Energy Demand")
qal_32 = SumQualitiesByHierachy(ql=ql, na="Final Energy Demand", cna=merge_20, value=merge_19)  # -> value_4, pa_2, ch_2
final_energy_demand_kwh_a_2 = Number(qal_32.value_4)

addition_12 = Addition(A=primary_heating_energy_demand_kwh_a, B=primary_cooling_energy_demand_kwh_a, C=primary_electricity_energy_demand_kwh_a)  # disabled
addition_13 = Addition(A=multiplication_19, B=construction_gwp_kgco2e)  # disabled
addition_14 = Addition(A=maintenance_expenses_a, B=energy_expenses_a)  # disabled
building_construction_cost = Number(qal_3.num_2)  # disabled
technical_equipment_cost_3 = Number(technical_equipment_cost_2)  # disabled
primary_energy_demand_kwh_a_2 = Number(addition_12)  # disabled
life_cycle_gwp_kgco2e_2 = Number(addition_13)  # disabled
expenses_a = Number(addition_14)  # disabled
life_cycle_a_5 = Number(life_cycle_a_2)  # disabled

addition_15 = Addition(A=qal_27.value_4, B=qal_30.value_4)  # -> graft(Result)
merge_21 = Merge(Data1="Heating Energy Price", Data2="Heating CO2 Price")
qal_33 = SumQualitiesByHierachy(ql=ql, na="Heating Expenses", cna=merge_21, value=addition_15)  # -> value_4, pa_2, ch_2

addition_16 = Addition(A=qal_20.value_4, B=qal_26.value_4)  # -> graft(Result)
merge_22 = Merge(Data1="Cooling Energy Price", Data2="Cooling CO2 Price")
qal_34 = SumQualitiesByHierachy(ql=ql, na="Cooling Expenses", cna=merge_22, value=addition_16)  # -> value_4, pa_2, ch_2

addition_17 = Addition(A=qal_17.value_4, B=qal_29.value_4)  # -> graft(Result)
merge_23 = Merge(Data1="Electricity Energy Price", Data2="Electricity CO2 Price")
qal_35 = SumQualitiesByHierachy(ql=ql, na="Electricity Expenses", cna=merge_23, value=addition_17)  # -> value_4, pa_2, ch_2

multiplication_20 = Multiplication(A=expenses_a, B=life_cycle_a_5)  # disabled
addition_18 = Addition(A=building_construction_cost, B=technical_equipment_cost_3)  # disabled
life_cycle_expenses = Number(multiplication_20)  # disabled
construction_cost = Number(addition_18)  # disabled
life_cycle_a_6 = Number(life_cycle_a_2)  # disabled
income_a = Number(qal_5.num_2)  # disabled
addition_19 = Addition(A=construction_cost, B=life_cycle_expenses)  # disabled
multiplication_21 = Multiplication(A=income_a, B=life_cycle_a_6)  # disabled
cooling_energy_demand_kwh_a_2 = Number(cooling_energy_demand_kwh_a)  # disabled
heating_energy_demand_kwh_a_2 = Number(heating_energy_demand_kwh_a)  # disabled
heating_energy_demand_kwh_a_3 = Number(heating_energy_demand_kwh_a)  # disabled
cooling_energy_demand_kwh_a_3 = Number(cooling_energy_demand_kwh_a)  # disabled
primary_energy_demand_kwh_a_3 = Number(primary_energy_demand_kwh_a_2)  # disabled
primary_energy_demand_kwh_a_4 = Number(primary_energy_demand_kwh_a_2)  # disabled
final_energy_demand_kwh_a_3 = Number(final_energy_demand_kwh_a)  # disabled
final_energy_demand_kwh_a_4 = Number(final_energy_demand_kwh_a)  # disabled
construction_gwp_kgco2e_2 = Number(construction_gwp_kgco2e)  # disabled
construction_gwp_kgco2e_3 = Number(construction_gwp_kgco2e)  # disabled
life_cycle_gwp_kgco2e_3 = Number(life_cycle_gwp_kgco2e_2)  # disabled
life_cycle_gwp_kgco2e_4 = Number(life_cycle_gwp_kgco2e_2)  # disabled
effective_floor_area_m² = Number(qal_2.num_2)  # disabled
effective_floor_area_m²_2 = Number(qal_2.num_2)  # disabled
effective_floor_area_m²_3 = Number(qal_2.num_2)  # disabled
effective_floor_area_m²_4 = Number(qal_2.num_2)  # disabled
effective_floor_area_m²_5 = Number(qal_2.num_2)  # disabled
effective_floor_area_m²_6 = Number(qal_2.num_2)  # disabled
effective_floor_area_m²_7 = Number(qal_2.num_2)  # disabled
effective_floor_area_m²_8 = Number(qal_2.num_2)  # disabled
effective_floor_area_m²_9 = Number(qal_2.num_2)  # disabled
effective_floor_area_m²_10 = Number(qal_2.num_2)  # disabled
construction_cost_2 = Number(addition_18)  # disabled
life_cycle_income = Number(multiplication_21)  # disabled
construction_cost_3 = Number(addition_18)  # disabled
life_cycle_cost = Number(addition_19)  # disabled
life_cycle_cost_2 = Number(addition_19)  # disabled
life_cycle_cost_3 = Number(addition_19)  # disabled
floor_area_m² = Number(qal.num_2)  # disabled
users_person_2 = Number(users_person)  # disabled
users_person_3 = Number(users_person)  # disabled
users_person_4 = Number(users_person)  # disabled
users_person_5 = Number(users_person)  # disabled
users_person_6 = Number(users_person)  # disabled
users_person_7 = Number(users_person)  # disabled
users_person_8 = Number(users_person)  # disabled
users_person_9 = Number(users_person)  # disabled
users_person_10 = Number(users_person)  # disabled
division = Division(A=effective_floor_area_m²_5, B=users_person_5)  # disabled
division_2 = Division(A=construction_cost_2, B=effective_floor_area_m²_2)  # disabled
division_3 = Division(A=construction_cost_3, B=users_person_6)  # disabled
division_4 = Division(A=life_cycle_cost_2, B=effective_floor_area_m²_3)  # disabled
division_5 = Division(A=life_cycle_cost_3, B=users_person_7)  # disabled
division_6 = Division(A=construction_gwp_kgco2e_2, B=effective_floor_area_m²_6)  # disabled
division_7 = Division(A=construction_gwp_kgco2e_3, B=users_person_8)  # disabled
division_8 = Division(A=life_cycle_gwp_kgco2e_3, B=effective_floor_area_m²_4)  # disabled
division_9 = Division(A=life_cycle_gwp_kgco2e_4, B=users_person_9)  # disabled
division_10 = Division(A=primary_energy_demand_kwh_a_3, B=effective_floor_area_m²_7)  # disabled
division_11 = Division(A=primary_energy_demand_kwh_a_4, B=users_person_10)  # disabled
division_12 = Division(A=final_energy_demand_kwh_a_3, B=effective_floor_area_m²_8)  # disabled
division_13 = Division(A=final_energy_demand_kwh_a_4, B=users_person_2)  # disabled
division_14 = Division(A=heating_energy_demand_kwh_a_3, B=users_person_3)  # disabled
division_15 = Division(A=cooling_energy_demand_kwh_a_2, B=effective_floor_area_m²_10)  # disabled
division_16 = Division(A=cooling_energy_demand_kwh_a_3, B=users_person_4)  # disabled
division_17 = Division(A=effective_floor_area_m², B=floor_area_m²)  # disabled
division_18 = Division(A=heating_energy_demand_kwh_a_2, B=effective_floor_area_m²_9)  # disabled

addition_20 = Addition(A=qal_33.value_4, B=qal_34.value_4, C=qal_35.value_4)  # -> graft(Result)
merge_24 = Merge(Data1="Heating Expenses", Data2="Cooling Expenses", Data3="Electricity Expenses")
qal_36 = SumQualitiesByHierachy(ql=ql, na="Energy Expenses", cna=merge_24, value=addition_20)  # -> value_4, pa_2, ch_2
energy_expenses_a_2 = Number(qal_36.value_4)

expression_5 = Expression(Start=construction_cost, End=life_cycle_income, Expression="((End-Start)/Start)*100")  # disabled
heating_energy_demand_kwh_a_4 = Number(heating_energy_demand_kwh_a)  # disabled
life_cycle_cost_4 = Number(life_cycle_cost)  # disabled
panel_6 = Panel("heating expenses")
panel_7 = Panel("cooling expenses")
area_comfort_m²_person = Number(division)  # disabled
income_a_2 = Number(qal_5.num_2)  # disabled
expenses_a_2 = Number(addition_14)  # disabled
energy_expenses_a_3 = Number(addition_11)  # disabled
effective_floor_area_m²_11 = Number(qal_2.num_2)  # disabled
floor_area_m²_2 = Number(qal.num_2)  # disabled
users_person_11 = Number(users_person)  # disabled
construction_cost_4 = Number(addition_18)  # disabled
construction_cost_per_user_person = Number(division_3)  # disabled
specific_life_cycle_cost_m² = Number(division_4)  # disabled
construction_global_warming_potential_pe = Number(division_7)  # "Construction Global Warming Potential per User [kgCO2e/Person]"; disabled
specific_life_cycle_global_warming_poten = Number(division_8)  # "Specific Life Cycle Global Warming Potential [kgCO2e/m²]"; disabled
life_cycle_global_warming_potential_per = Number(division_9)  # "Life Cycle Global Warming Potential per User [kgCO2e/Person]"; disabled
primary_energy_demand_kwh_a_5 = Number(primary_energy_demand_kwh_a_2)  # disabled
primary_energy_demand_per_user_kwh_perso = Number(division_11)  # "Primary Energy Demand per User [kWh/Person a]"; disabled
final_energy_demand_kwh_a_5 = Number(final_energy_demand_kwh_a)  # disabled
specific_final_energy_demand_kwh_m²a = Number(division_12)  # disabled
heating_load_kw = Number(qal_11.num_2)  # disabled
specific_heating_energy_demand_kwh_m²a = Number(division_18)  # disabled
cooling_load_kw = Number(qal_12.num_2)  # disabled
cooling_energy_demand_kwh_a_4 = Number(cooling_energy_demand_kwh_a)  # disabled
ventilation_air_flow_volume_m³_s = Number(qal_13.num_2)  # disabled
area_efficiency_eff_m²_m² = Number(division_17)  # disabled
specific_construction_cost_m² = Number(division_2)  # disabled
life_cycle_cost_per_user_person = Number(division_5)  # disabled
construction_global_warming_potential_kg = Number(construction_gwp_kgco2e)  # "Construction Global Warming Potential [kgCO2e]"; disabled
specific_construction_global_warming_pot = Number(division_6)  # "Specific Construction Global Warming Potential [kgCO2e/m²]"; disabled
life_cycle_global_warming_potential_kgco = Number(life_cycle_gwp_kgco2e_2)  # "Life Cycle Global Warming Potential [kgCO2e]"; disabled
specific_primary_energy_demand_kwh_m²a = Number(division_10)  # disabled
final_energy_demand_per_user_kwh_person = Number(division_13)  # "Final Energy Demand per User [kWh/Person a]"; disabled
heating_energy_demand_per_user_kwh_perso = Number(division_14)  # "Heating Energy Demand per User [kWh/Person a]"; disabled
specific_cooling_energy_demand_kwh_m²a = Number(division_15)  # disabled
cooling_energy_demand_per_user_kwh_perso = Number(division_16)  # "Cooling Energy Demand per User [kWh/Person a]"; disabled
panel_8 = Panel("electricity expenses")
interest = Number(expression_5)  # disabled
panel_9 = Panel("pre installed furniture")
panel_10 = Panel("heating equipment")
panel_11 = Panel("cooling equipment")
panel_12 = Panel("windows")
panel_13 = Panel("electrical equipment")
panel_14 = Panel("roof")
panel_15 = Panel("shell construction")
panel_16 = Panel("facade")
panel_17 = Panel("insurance")
panel_18 = Panel("staff")
panel_19 = Panel("replacements")
panel_20 = Panel("renovation")
# Water and Waste water
panel_21 = Panel("energy")
panel_22 = Panel("technical equipment")
panel_23 = Panel("outdoor area/facilities")
panel_24 = Panel("building")
panel_25 = Panel("architectual")
panel_26 = Panel("demolition works")
panel_27 = Panel("disposal costs")
panel_28 = Panel("engineering")
panel_29 = Panel("expenses")
panel_30 = Panel("maintance")
merge_25 = Merge(
    Data1=interest,
    Data2=area_efficiency_eff_m²_m²,
    Data3=area_comfort_m²_person,
    Data4=income_a_2,
    Data5=expenses_a_2,
    Data6=energy_expenses_a_3,
    Data7=effective_floor_area_m²_11,
    Data8=floor_area_m²_2,
    Data9=users_person_11,
    Data10=construction_cost_4,
    Data11=specific_construction_cost_m²,
    Data12=construction_cost_per_user_person,
    Data13=life_cycle_cost_4,
    Data14=specific_life_cycle_cost_m²,
    Data15=life_cycle_cost_per_user_person,
    Data16=construction_global_warming_potential_kg,
    Data17=specific_construction_global_warming_pot,
    Data18=construction_global_warming_potential_pe,
    Data19=life_cycle_global_warming_potential_kgco,
    Data20=specific_life_cycle_global_warming_poten,
    Data21=life_cycle_global_warming_potential_per,
    Data22=primary_energy_demand_kwh_a_5,
    Data23=specific_primary_energy_demand_kwh_m²a,
    Data24=primary_energy_demand_per_user_kwh_perso,
    Data25=final_energy_demand_kwh_a_5,
    Data26=specific_final_energy_demand_kwh_m²a,
    Data27=final_energy_demand_per_user_kwh_person,
    Data28=heating_load_kw,
    Data29=heating_energy_demand_kwh_a_4,
    Data30=specific_heating_energy_demand_kwh_m²a,
    Data31=heating_energy_demand_per_user_kwh_perso,
    Data32=cooling_load_kw,
    Data33=cooling_energy_demand_kwh_a_4,
    Data34=specific_cooling_energy_demand_kwh_m²a,
    Data35=cooling_energy_demand_per_user_kwh_perso,
    Data36=ventilation_air_flow_volume_m³_s)  # disabled
panel_31 = Panel(qal_36.value_4)
dsn_2 = ModelDesign(Design=dn_2)  # -> Design, Valid, Name, Description, Icon, Image, Variant, View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; disabled
panel_32 = Panel("demolition")
panel_33 = Panel("planning")
panel_34 = Panel("construction")
panel_35 = Panel("expert opinions")
panel_36 = Panel("property")
panel_37 = Panel("interest")
panel_38 = Panel("running")
trim_2 = TrimTree(Tree=dsn_2.Qualities, Depth=1)  # disabled
panel_39 = Panel(" Life Cycle Cost")
interest_2 = ClusterOutput(interest)  # disabled
area_efficiency_eff_m²_m²_2 = ClusterOutput(area_efficiency_eff_m²_m²)  # disabled
area_comfort_m²_person_2 = ClusterOutput(area_comfort_m²_person)  # disabled
income_a_3 = ClusterOutput(income_a_2)  # disabled
expenses_a_3 = ClusterOutput(expenses_a_2)  # disabled
energy_expenses_a_4 = ClusterOutput(energy_expenses_a_3)  # disabled
effective_floor_area_m²_12 = ClusterOutput(effective_floor_area_m²_11)  # disabled
floor_area_m²_3 = ClusterOutput(floor_area_m²_2)  # disabled
users_person_12 = ClusterOutput(users_person_11)  # disabled
construction_cost_5 = ClusterOutput(construction_cost_4)  # disabled
specific_construction_cost_m²_2 = ClusterOutput(specific_construction_cost_m²)  # disabled
construction_cost_per_user_person_2 = ClusterOutput(construction_cost_per_user_person)  # disabled
life_cycle_cost_5 = ClusterOutput(life_cycle_cost_4)  # disabled
specific_life_cycle_cost_m²_2 = ClusterOutput(specific_life_cycle_cost_m²)  # disabled
life_cycle_cost_per_user_person_2 = ClusterOutput(life_cycle_cost_per_user_person)  # disabled
construction_global_warming_potential_kg_2 = ClusterOutput(construction_global_warming_potential_kg)  # "Construction Global Warming Potential [kgCO2e]"; disabled
specific_construction_global_warming_pot_2 = ClusterOutput(specific_construction_global_warming_pot)  # "Specific Construction Global Warming Potential [kgCO2e/m²]"; disabled
construction_global_warming_potential_pe_2 = ClusterOutput(construction_global_warming_potential_pe)  # "Construction Global Warming Potential per User [kgCO2e/Person]"; disabled
life_cycle_global_warming_potential_kgco_2 = ClusterOutput(life_cycle_global_warming_potential_kgco)  # "Life Cycle Global Warming Potential [kgCO2e]"; disabled
specific_life_cycle_global_warming_poten_2 = ClusterOutput(specific_life_cycle_global_warming_poten)  # "Specific Life Cycle Global Warming Potential [kgCO2e/m²]"; disabled
life_cycle_global_warming_potential_per_2 = ClusterOutput(life_cycle_global_warming_potential_per)  # "Life Cycle Global Warming Potential per User [kgCO2e/Person]"; disabled
primary_energy_demand_kwh_a_6 = ClusterOutput(primary_energy_demand_kwh_a_5)  # disabled
specific_primary_energy_demand_kwh_m²a_2 = ClusterOutput(specific_primary_energy_demand_kwh_m²a)  # disabled
primary_energy_demand_per_user_kwh_perso_2 = ClusterOutput(primary_energy_demand_per_user_kwh_perso)  # "Primary Energy Demand per User [kWh/Person a]"; disabled
final_energy_demand_kwh_a_6 = ClusterOutput(final_energy_demand_kwh_a_5)  # disabled
specific_final_energy_demand_kwh_m²a_2 = ClusterOutput(specific_final_energy_demand_kwh_m²a)  # disabled
final_energy_demand_per_user_kwh_person_2 = ClusterOutput(final_energy_demand_per_user_kwh_person)  # "Final Energy Demand per User [kWh/Person a]"; disabled
heating_load_kw_2 = ClusterOutput(heating_load_kw)  # disabled
heating_energy_demand_kwh_a_5 = ClusterOutput(heating_energy_demand_kwh_a_4)  # disabled
specific_heating_energy_demand_kwh_m²a_2 = ClusterOutput(specific_heating_energy_demand_kwh_m²a)  # disabled
heating_energy_demand_per_user_kwh_perso_2 = ClusterOutput(heating_energy_demand_per_user_kwh_perso)  # "Heating Energy Demand per User [kWh/Person a]"; disabled
cooling_load_kw_2 = ClusterOutput(cooling_load_kw)  # disabled
cooling_energy_demand_kwh_a_5 = ClusterOutput(cooling_energy_demand_kwh_a_4)  # disabled
specific_cooling_energy_demand_kwh_m²a_2 = ClusterOutput(specific_cooling_energy_demand_kwh_m²a)  # disabled
cooling_energy_demand_per_user_kwh_perso_2 = ClusterOutput(cooling_energy_demand_per_user_kwh_perso)  # "Cooling Energy Demand per User [kWh/Person a]"; disabled
ventilation_air_flow_volume_m³_s_2 = ClusterOutput(ventilation_air_flow_volume_m³_s)  # disabled
panel_40 = Panel("market value increase")
panel_41 = Panel("rental Income")
panel_42 = Panel("commercial Income")
panel_43 = Panel(" Life Cycle Income")
panel_44 = Panel("""interest
area efficiency 
area comfort 
income
expenses 
energy expenses 
effective floor area 
floor area 
users 
construction cost 
specific construction cost 
construction cost per user 
life cycle cost 
specific life cycle cost 
life cycle cost per user 
construction global warming potential 
specific construction global warming potential 
construction global warming potential per user 
life cycle global warming potential 
specific life cycle global warming potential 
life cycle global warming potential per user 
primary energy demand 
specific primary energy demand 
primary energy demand per user 
final energy demand 
specific final energy demand 
final energy demand per user 
heating load 
heating energy demand 
specific heating energy demand 
heating energy demand per user 
cooling load 
cooling energy demand 
specific cooling energy demand 
cooling energy demand per user 
ventilation air flow volume  """)
panel_45 = Panel(merge_25)
panel_46 = Panel("""%
eff. m²/m²
m²/Person
€/a
€/a
€/a
m²
m²
Person
€
€/m²
€/Person
€
€/m²
€/Person
kgCO2e
kgCO2e/m²
kgCO2e/Person
kgCO2e
kgCO2e/m²
kgCO2e/Person
kWh/a
kWh/m²a
kWh/Person a
kWh/a
kWh/m²a
kWh/Person a
kW
kWh/a
kWh/m²a
kWh/Person a
kW
kWh/a
kWh/m²a
kWh/Person a
m³/s""")
qal_37 = ModelQuality(Name=panel_44, Value=merge_25, Unit=panel_46)  # -> Quality, Valid, Name, Value, Unit, Definition; disabled
merge_26 = Merge(Data1=trim_2, Data2=qal_37.Quality)  # disabled
dsn_3 = ModelDesign(Design=dsn_2.Design, Qualities=merge_26)  # -> Design, Valid, Name, Description, Icon, Image, Variant, View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; disabled
dn_3 = ClusterOutput(dsn_3.Design)  # disabled

# ==== cluster SumQualities: Sum up the qualities of a type for each piece with this type in a design.
dn = ClusterInput()
ty = ClusterInput()
na = ClusterInput()
dn_2 = Design(dn)
ty_2 = Type(ty)
na_2 = Name(na)
dsn = ModelDesign(Design=dn_2)  # -> Design, Valid, Name, Description, Icon, Image, Variant, View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
typ = ModelType(Type=ty_2)  # -> Type, Valid, Name, Description, Icon, Image, Variant, Stock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
panel = Panel(ty_2)
qal = ModelQuality(Quality=typ.Qualities)  # -> Quality, Valid, Name, Value, Unit, Definition
trim = TrimTree(Tree=dsn.Pieces, Depth=1)
pce = ModelPiece(Piece=trim)  # -> Piece, Valid, Id, Description, TypeName, TypeVariant, Plane, Center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
expression = Expression(x=graft(pce.TypeName), y=typ.Name, Expression="x=y")
expression_2 = Expression(x=na_2, y=qal.Name, Expression="x=y")
expression_3 = Expression(x=graft(pce.TypeVariant), y=typ.Variant, Expression="x=y")
panel_2 = Panel(pce.TypeName)
panel_3 = Panel(typ.Qualities)
cull = CullPattern(List=typ.Qualities, CullPattern=expression_2)
and = GateAnd(A=expression, B=expression_3)
cull_2 = CullPattern(List=ty_2, CullPattern=and)
qal_2 = ModelQuality(Quality=cull)  # -> Quality, Valid, Name, flatten(Value), Unit, Definition
lng = ListLength(List=ty_2)
txt = Text(cull_2)
txt_2 = Text(ty_2)
series = Series(Start=0, Step=1, Count=lng)
expression_4 = Expression(x=txt, y=txt_2, Expression="x=y")
trim_2 = TrimTree(Tree=series, Depth=1)
panel_5 = Panel(qal_2.Quality)
cull_3 = CullPattern(List=trim_2, CullPattern=expression_4)
trim_3 = TrimTree(Tree=cull_3, Depth=1)
item = ListItem(List=qal_2.Value, Index=trim_3, Wrap=True)
clean = CleanTree(RemoveNulls=True, RemoveInvalid=True, RemoveEmpty=False, Tree=item)
ma = MassAddition(Input=clean)  # -> Result, PartialResults
num = Number(ma.Result)
ql = Quality(qal_2.Quality)
num_2 = ClusterOutput(num)
ql_2 = ClusterOutput(ql)

# ==== cluster SelectTypeByPiece: Select the type of a piece.
ty = ClusterInput()
pc = ClusterInput()
pc_2 = Piece(graft(pc))
ty_2 = Type(ty)
pce = ModelPiece(Piece=pc_2)  # -> Piece, Valid, Id, Description, TypeName, TypeVariant, Plane, Center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
typ = SelectType(ty=ty_2, na=pce.TypeName, variant=pce.TypeVariant)  # -> ty_4, i_2
trim = TrimTree(Tree=typ.ty_4, Depth=1)
trim_2 = TrimTree(Tree=typ.i_2, Depth=1)
ty_3 = Type(trim)
i = Integer(trim_2)
ty_4 = ClusterOutput(ty_3)
i_2 = ClusterOutput(i)

# ==== cluster SumQualitiesByHierachy: Return the numeric quality of the parent hierachy. If not defined return the sum of the child qualities. If not defined return the default value.
ql = ClusterInput()
na = ClusterInput()
cna = ClusterInput()
value = ClusterInput()
cfa = ClusterInput()
ql_2 = Quality(ql)
cna_2 = Name(cna)
value_2 = Value(value)
cfa_2 = Number(cfa)
na_2 = Name(na)
item = ListItem(List=flatten(cna_2), Index=0, Wrap=True)
item_2 = ListItem(List=flatten(cfa_2), Index=0, Wrap=True)
expression = Expression(x=cna_2, Expression="1")
qal = SelectQuality(ql=ql_2, na=cna_2)
qal_2 = SelectQuality(ql=ql_2, na=na_2)
null = NullItem(Item=item)  # -> NullFlags, InvalidFlags, Description
null_2 = NullItem(Item=item_2)  # -> NullFlags, InvalidFlags, Description
trim = TrimTree(Tree=qal, Depth=1)
trim_2 = TrimTree(Tree=qal_2, Depth=1)
filter = StreamFilter(Gate=null_2.NullFlags, Stream0=cfa_2, Stream1=expression)
clean = CleanTree(RemoveNulls=True, RemoveInvalid=True, RemoveEmpty=False, Tree=trim_2)
clean_2 = CleanTree(RemoveNulls=True, RemoveInvalid=True, RemoveEmpty=False, Tree=trim)
qal_3 = ModelQuality(Quality=clean)  # -> Quality, Valid, Name, Value, Unit, Definition
null_3 = NullItem(Item=clean_2)  # -> NullFlags, InvalidFlags, Description
qal_4 = ModelQuality(Quality=clean_2)  # -> Quality, Valid, Name, Value, Unit, Definition
null_4 = NullItem(Item=clean)  # -> NullFlags, InvalidFlags, Description
not = GateNot(A=null_4.NullFlags)
mm = MassMultiplication(Input=null_3.NullFlags)  # -> Result, PartialResults
null_5 = EmptyStringToNull(T=qal_4.Value)  # -> NT; inputs T: tree
# ---------- null_5: Python ----------
# Component Information
# --------------------------------------------------------------------------------------------
if ghenv.Component.RunCount < 2:
    # General
    # --------------------------------------------------------------------------------------------
    __author__ = "Ueli Saluz"
    __version__ = "2024.08.08"

    ghenv.Component.Name = "EmptyStringToNull"
    ghenv.Component.NickName = "\"\"->Null"
    ghenv.Component.Description = "Replaces empty strings with Null."
    ghenv.Component.Message = "VER 1.1"
    ghenv.Component.Category = "Sets"
    ghenv.Component.SubCategory = "Text"

    # Inputs
    # --------------------------------------------------------------------------------------------
    inputIndex = 0

    ghenv.Component.Params.Input[inputIndex].Name = "String"
    ghenv.Component.Params.Input[inputIndex].NickName = "T"
    ghenv.Component.Params.Input[inputIndex].Description = "Strings that are potentially empty."
    ghenv.Component.Params.Input[inputIndex].Optional = False
    inputIndex += 1

    # Outputs
    # --------------------------------------------------------------------------------------------
    outputIndex = 0

    ghenv.Component.Params.Output[outputIndex].Name = "NullifiedString"
    ghenv.Component.Params.Output[outputIndex].NickName = "NT"
    ghenv.Component.Params.Output[outputIndex].Description = "Original string if not empty, Null otherwise."
    outputIndex += 1

# Imports
# --------------------------------------------------------------------------------------------
from System import Object
from Grasshopper import DataTree

# Solver - Run with trees to enhance performance drastically
# --------------------------------------------------------------------------------------------
if __name__ == "__main__":
    
    # Initialize trees
    # --------------------------------------------------------------------------------------------
    NullifiedStringTree = DataTree[Object]()
    
    # Data matching
    # --------------------------------------------------------------------------------------------
    for path in T.Paths:
        stringBranch = T.Branch(path)
        for i, string in enumerate(stringBranch):
            nullifiedString = string if string != "" else None
            NullifiedStringTree.Add(nullifiedString, path)
    
    # Assign trees to output
    # --------------------------------------------------------------------------------------------
    NT = NullifiedStringTree
# ---------- end null_5 ----------
not_2 = GateNot(A=null_3.NullFlags)
expression_2 = Expression(x=value_2, y=clean, Expression="x")
not_3 = GateNot(A=mm.Result)
int = Integer(not)
nullrep = ReplaceNulls(Items=null_5, Replacements="0")  # -> Items, Count
multiplication = Multiplication(A=not_3, B="2")
addition = Addition(A=int, B=multiplication)
multiplication_2 = Multiplication(A=nullrep.Items, B=filter)
ma = MassAddition(Input=multiplication_2)  # -> Result, PartialResults
trim_3 = TrimTree(Tree=not, Depth=1)
trim_4 = TrimTree(Tree=not_3, Depth=1)
filter_2 = StreamFilter(Gate=null.NullFlags, Stream0=ma.Result, Stream1=expression_2)
merge = Merge(Data1=expression_2, Data2=qal_3.Value, Data3=filter_2, Data4=qal_3.Value)
item_3 = ListItem(List=merge, Index=addition, Wrap=invert(True))
trim_5 = TrimTree(Tree=item_3, Depth=1)
value_3 = Value(trim_5)
pa = Boolean(trim_3)
ch = Boolean(trim_4)
value_4 = ClusterOutput(value_3)
pa_2 = ClusterOutput(pa)
ch_2 = ClusterOutput(ch)

# ==== cluster SelectType: Select a type with a name and an optional variant. If no variant is provided it will select all variants. If you want to select the default type then use the empty text.
ty = ClusterInput()
na = ClusterInput()
variant = ClusterInput()
na_2 = Name(na)
variant_2 = Variant(variant)
ty_2 = Type(ty)
typ = ModelType(Type=ty_2)  # -> Type, Valid, Name, Description, Icon, Image, Variant, Stock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
expression = Expression(x=typ.Name, y=na_2, Expression="x=y")
cull = CullPattern(List=typ.Type, CullPattern=expression)
typ_2 = ModelType(Type=cull)  # -> Type, Valid, Name, Description, Icon, Image, Variant, Stock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
expression_2 = Expression(x=typ_2.Variant, y=variant_2, Expression="x=y")
txt = Text(ty_2)
cull_2 = CullPattern(List=typ_2.Type, CullPattern=expression_2)
null = NullItem(Item=variant_2)  # -> NullFlags, InvalidFlags, Description
filter = StreamFilter(Gate=null.NullFlags, Stream0=cull_2, Stream1=cull)
txt_2 = Text(filter)
mindex = MemberIndex(Set=txt, Member=txt_2)  # -> Index, Count
trim = TrimTree(Tree=mindex.Index, Depth=1)
ty_3 = Type(filter)
i = Integer(trim)
ty_4 = ClusterOutput(ty_3)
i_2 = ClusterOutput(i)

# ==== cluster SelectQuality: Select a quality by its name. If no quality matches, null is returned.
ql = ClusterInput()
na = ClusterInput()
na_2 = Name(na)
ql_2 = Quality(ql)
flatten = FlattenTree(Tree=ql_2, Path="{0}")
tstat = TreeStatistics(Tree=flatten)  # -> Paths, Length, Count
lng = ListLength(List=tstat.Paths)
qal = ModelQuality(Quality=flatten)  # -> Quality, Valid, Name, Value, Unit, Definition
expression = Expression(x=lng, Expression="x=0")
lng_2 = ListLength(List=na_2)
dup = DuplicateData(Data=graft(flatten), Number=lng_2, Order=True)
filter = StreamFilter(Gate=expression, Stream0=graft(qal.Name), Stream1=qal.Name)
filter_2 = StreamFilter(Gate=expression, Stream0=na_2, Stream1=graft(na_2))
trim = TrimTree(Tree=dup, Depth=1)
expression_2 = Expression(x=filter, y=filter_2, Expression="x=y")
cull = CullPattern(List=graft(trim), CullPattern=graft(expression_2))
dup_2 = DuplicateData(Data=graft(ql_2), Number=lng_2, Order=True)
nulltobranch = AddNullToEmptyBranch(D=cull)  # -> R; inputs D: tree
# ---------- nulltobranch: C# ----------
#region Usings
using System;
using System.Linq;
using System.Collections;
using System.Collections.Generic;
using System.Drawing;

using Rhino;
using Rhino.Geometry;

using Grasshopper;
using Grasshopper.Kernel;
using Grasshopper.Kernel.Data;
using Grasshopper.Kernel.Types;
#endregion

public class Script_Instance : GH_ScriptInstance
{

    private void RunScript(DataTree<object> D, ref object R)
    {
        foreach (GH_Path path in D.Paths)
            if (D.Branch(path).Count == 0)
                D.Add(null, path);

        R = D;
    }
}
# ---------- end nulltobranch ----------
trim_2 = TrimTree(Tree=nulltobranch, Depth=1)
trim_3 = TrimTree(Tree=dup_2, Depth=1)
match = MatchTree(Tree=trim_2, Guide=trim_3)
ql_3 = Quality(match)
ql_4 = ClusterOutput(ql_3)
