# Grasshopper definition empty-get.gh (Grasshopper 1.0.8)
# Copyright: GNU Lesser General Public License Version 3
# plug-ins: semio

kt = Kit("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")
kit = ModelKit(Kit=kt)  # -> Kit, Valid, Name, Description, Icon, Image, Preview, Version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
dsn = ModelDesign(Design=kit.Designs)  # -> Design, Valid, Name, Description, Icon, Image, Variant, View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
typ = ModelType(Type=kit.Types)  # -> Type, Valid, Name, Description, Icon, Image, Variant, Stock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
con = ModelConnection(Connection=dsn.Connections)  # -> Connection, Valid, ConnectedPieceId, ConnectedPieceTypePortId, ConnectingPieceId, ConnectingPieceTypePortId, Description, Gap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
por = ModelPort(Port=typ.Ports)  # -> Port, Valid, Id, Description, Mandatory, Family, CompatibleFamilies, Point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
rep = ModelRepresentation(Representation=typ.Representations)  # -> Representation, Valid, Url, Description, Tags, Qualities
pce = ModelPiece(Piece=dsn.Pieces)  # -> Piece, Valid, Id, Description, TypeName, TypeVariant, Plane, Center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
panel = Panel(dsn.Pieces)
