# Grasshopper definition opionionated-quality.gh (Grasshopper 1.0.8)
# Copyright: GNU Lesser General Public License Version 3
# Copyright: GNU Lesser General Public License v3.0 or later
# plug-ins: RhinoCodePluginGH, semio

floor_area = FloorArea({"Floor Area": "semio.area", "Gross Floor Area": "semio.area.gross", "Net Floor Area": "semio.area.gross.net", "Usable Floor Area": "semio.area.gross.net.usable", "Living And Staying Floor Area": "semio.area.gross.net.usable.living-and-staying", "Living Room Floor Area": "semio.area.gross.net.usable.living-and-staying.living-room"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}, selected="Floor Area")
floor_area_2 = FloorArea({"Floor Area": "semio.area", "Gross Floor Area": "semio.area.gross", "Net Floor Area": "semio.area.gross.net", "Usable Floor Area": "semio.area.gross.net.usable", "Living And Staying Floor Area": "semio.area.gross.net.usable.living-and-staying", "Living Room Floor Area": "semio.area.gross.net.usable.living-and-staying.living-room"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}, selected="Waiting Room Floor Area": "semio.area.gross.net.usable.living-and-staying.waiting-room")
glc = GlobalLifeCycleCosts({"Global Life Cycle Costs": "semio.costs.global life cycle costs", "Life Cycle Costs": "semio.costs.global life cycle costs.life-cycle-costs", "Investment Costs Construction Phase": "semio.costs.global life cycle costs.life-cycle-costs.investment-costs-construction-phase", "Land Costs": "semio.costs.global life cycle costs.life-cycle-costs.investment-costs-construction-phase.land-costs", "Land": "semio.costs.global life cycle costs.life-cycle-costs.investment-costs-construction-phase.land-costs.land", "Land Value": "semio.costs.global life cycle costs.life-cycle-costs.investment-costs-construction-phase.land-costs.land.land-value"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}, selected="Global Life Cycle Costs")
floor_area_3 = FloorArea({"Floor Area": "semio.area", "Gross Floor Area": "semio.area.gross", "Net Floor Area": "semio.area.gross.net", "Usable Floor Area": "semio.area.gross.net.usable", "Living And Staying Floor Area": "semio.area.gross.net.usable.living-and-staying", "Living Room Floor Area": "semio.area.gross.net.usable.living-and-staying.living-room"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}, selected="Living Floor Area": "semio.area.gross.net.usable.living-and-staying.living-room.living")
floor_area_4 = FloorArea({"Floor Area": "semio.area", "Gross Floor Area": "semio.area.gross", "Net Floor Area": "semio.area.gross.net", "Usable Floor Area": "semio.area.gross.net.usable", "Living And Staying Floor Area": "semio.area.gross.net.usable.living-and-staying", "Living Room Floor Area": "semio.area.gross.net.usable.living-and-staying.living-room"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}, selected="Kitchen Floor Area": "semio.area.gross.net.usable.living-and-staying.living-room.kitchen")
roo = SelectRoot()  # -> ro_2, i_2
imperial = BooleanToggle(False)
dsn_bl = DesignToBlock()  # -> block_definition_3, block_instance_3, i_2
grp = PiecesToGroup()
pep = People({"People": "semio.people", "Stationary": "semio.people.stationary", "Living": "semio.people.stationary.living", "Residents": "semio.people.stationary.living.residents", "Guests": "semio.people.stationary.living.guests", "Working": "semio.people.stationary.working", "Office Workers": "semio.people.stationary.working.office", "Production Workers": "semio.people.stationary.working.production", "Service Workers": "semio.people.stationary.working.service", "Education Workers": "semio.people.stationary.working.education", "Healthcare Workers": "semio.people.stationary.working.healthcare", "Other Workers": "semio.people.stationary.working.other", "Students": "semio.people.stationary.students", "Pupils": "semio.people.stationary.students.pupils", "Students": "semio.people.stationary.students.students", "Client": "semio.people.stationary.client", "Customers": "semio.people.stationary.client.customers", "Visitors": "semio.people.stationary.client.visitors", "Patients": "semio.people.stationary.client.patients", "Mobile": "semio.people.mobile", "Mobile Visitors": "semio.people.mobile.visitors", "Mobile Customers": "semio.people.mobile.visitors.customers", "Mobile Guests": "semio.people.mobile.visitors.guests", "Tourists": "semio.people.mobile.visitors.tourists", "Mobile Employees": "semio.people.mobile.employees", "Mobile Workers": "semio.people.mobile.employees.mobile-workers", "Delivery Personnel": "semio.people.mobile.employees.delivery-personnel", "Mobile Students": "semio.people.mobile.students", "Commuters": "semio.people.mobile.students.commuters", "Exchange Students": "semio.people.mobile.students.exchange-students"}, selected="People")
panel = Panel("Outputs a message with a warning info, containing the wrong data and a suggestion for fixing it.")
qal = OpinionatedQuality(na=floor_area_4, value=Slider(175, range=0..1000), imperial=imperial)  # -> ql_2, lg_2
qal_2 = OpinionatedQuality(na=floor_area, value=Slider(114, range=0..1000), imperial=imperial)  # -> ql_2, lg_2
qal_3 = OpinionatedQuality(na=floor_area_2, value=Slider(49, range=0..1000), imperial=imperial)  # -> ql_2, lg_2
mods = TypesToModules(D=Vector(1, 1, 1))  # -> M_3, R_2
qal_4 = OpinionatedQuality(na=pep, value=Slider(9, range=0..1000), imperial=imperial)  # -> ql_2, lg_2
qal_5 = OpinionatedQuality(value=Slider(510, range=0..1000), imperial=imperial)  # -> ql_2, lg_2
qal_6 = OpinionatedQuality(na=floor_area_3, value=Slider(114, range=0..1000), imperial=imperial)  # -> ql_2, lg_2
toggle = BooleanToggle(True)
slts = SlotsToDesign()
merge = Merge(Data1=qal.ql_2, Data2=qal_6.ql_2)
panel_2 = Panel(qal_5.lg_2)
# Icon ändern
kit = SelectKit()  # -> kt_4, i_2
dsn = ModelDesign(Qualities=merge)  # -> Design, Valid, Name, Description, Icon, Image, Variant, View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
prm = ModelParam(Na="Log", NN="Lg", Dc=panel, Op=toggle, Ru=toggle)  # -> Param, Name, NickName, Description, Optional, Success; inputs Pr: tree, Op: Boolean, Ru: Boolean
# ---------- prm: Python ----------
#Component Information
#--------------------------------------------------------------------------------------------
if ghenv.Component.RunCount<2:
    #General
    #--------------------------------------------------------------------------------------------
    __author__ = "Ueli Saluz"
    __version__ = "2025.06.18"
    
    ghenv.Component.Name = "Model Param"
    ghenv.Component.NickName = "~Prm"
    ghenv.Component.Description = "Deconstruct or modify a param."
    ghenv.Component.Message = "VER 1.0"
    ghenv.Component.Category = "semio"
    ghenv.Component.SubCategory = "Scripting"
    
     #Inputs
    #--------------------------------------------------------------------------------------------
    inputIndex=0
    
    ghenv.Component.Params.Input[inputIndex].Name = "Param"
    ghenv.Component.Params.Input[inputIndex].NickName = "Pr"
    ghenv.Component.Params.Input[inputIndex].Description = "Connect the param to desconstruct or modify here with one wire."
    ghenv.Component.Params.Input[inputIndex].Optional = False
    inputIndex+=1

    ghenv.Component.Params.Input[inputIndex].Name = "Name"
    ghenv.Component.Params.Input[inputIndex].NickName = "Na"
    ghenv.Component.Params.Input[inputIndex].Description = "Name of the param."
    ghenv.Component.Params.Input[inputIndex].Optional = False
    inputIndex+=1
    
    ghenv.Component.Params.Input[inputIndex].Name = "NickName"
    ghenv.Component.Params.Input[inputIndex].NickName = "NN"
    ghenv.Component.Params.Input[inputIndex].Description = "Nickname of the param."
    ghenv.Component.Params.Input[inputIndex].Optional = False
    inputIndex+=1
    
    ghenv.Component.Params.Input[inputIndex].Name = "Description"
    ghenv.Component.Params.Input[inputIndex].NickName = "Dc"
    ghenv.Component.Params.Input[inputIndex].Description = "Description of the param."
    ghenv.Component.Params.Input[inputIndex].Optional = True
    inputIndex+=1
    
    ghenv.Component.Params.Input[inputIndex].Name = "Optional"
    ghenv.Component.Params.Input[inputIndex].NickName = "Op"
    ghenv.Component.Params.Input[inputIndex].Description = "Wheather the param is optional."
    ghenv.Component.Params.Input[inputIndex].Optional = True
    inputIndex+=1
    
    ghenv.Component.Params.Input[inputIndex].Name = "Run"
    ghenv.Component.Params.Input[inputIndex].NickName = "Ru"
    ghenv.Component.Params.Input[inputIndex].Description = "Modify the param."
    ghenv.Component.Params.Input[inputIndex].Optional = True
    inputIndex+=1
    
    #Outputs
    #--------------------------------------------------------------------------------------------
    outputIndex=0
    
    ghenv.Component.Params.Output[outputIndex].Name = "Param"
    ghenv.Component.Params.Output[outputIndex].NickName = "Param"
    ghenv.Component.Params.Output[outputIndex].Description = "The desconstruct or modified param"
    ghenv.Component.Params.Output[outputIndex].Optional = False
    outputIndex+=1
    
    ghenv.Component.Params.Output[outputIndex].Name = "Name"
    ghenv.Component.Params.Output[outputIndex].NickName = "Name"
    ghenv.Component.Params.Output[outputIndex].Description = "Name of the param."
    ghenv.Component.Params.Output[outputIndex].Optional = False
    outputIndex+=1
    
    ghenv.Component.Params.Output[outputIndex].Name = "NickName"
    ghenv.Component.Params.Output[outputIndex].NickName = "NickName"
    ghenv.Component.Params.Output[outputIndex].Description = "Nickname of the param."
    ghenv.Component.Params.Output[outputIndex].Optional = False
    outputIndex+=1
    
    ghenv.Component.Params.Output[outputIndex].Name = "Description"
    ghenv.Component.Params.Output[outputIndex].NickName = "Description"
    ghenv.Component.Params.Output[outputIndex].Description = "Description of the param."
    ghenv.Component.Params.Output[outputIndex].Optional = True
    outputIndex+=1
    
    ghenv.Component.Params.Output[outputIndex].Name = "Optional"
    ghenv.Component.Params.Output[outputIndex].NickName = "Optional"
    ghenv.Component.Params.Output[outputIndex].Description = "Wheather the param is optional."
    ghenv.Component.Params.Output[outputIndex].Optional = True
    outputIndex+=1
    
    ghenv.Component.Params.Output[outputIndex].Name = "Success"
    ghenv.Component.Params.Output[outputIndex].NickName = "Success"
    ghenv.Component.Params.Output[outputIndex].Description = "Wheather the operation was successful."
    ghenv.Component.Params.Output[outputIndex].Optional = False
    outputIndex+=1

input = ghenv.Component.Params.Input[0]
param = input.Sources[0]
if Ru:
    if Na:
        param.Name = Na
    if NN:
        param.NickName = NN
    if Dc:
        param.Description = Dc
    if Op:
        param.Optional = Op
    Success = True
else:
    Success = False
Param = param
Name = param.Name
NickName = param.NickName
Description = param.Description
Optional = param.Optional
# ---------- end prm ----------
dsn_2 = LoadDesign(mm="model/vnd.3dm", R=False)  # -> dn_2, object_2, shader_2, ur_2, path_2, id_2, pln_2
kit_2 = CacheKit(R=False)  # -> ty_2, ur_2, objects_2, urpa_2, urpalc_2, urpare_2
merge_2 = Merge(Data1=qal_6.ql_2, Data2=qal_4.ql_2, Data3=qal_5.ql_2)
geo = LoadGeometry()  # -> object_4, col_2, shader_2
typ = LoadType(mm="model/vnd.3dm", R=False)  # -> ty_2, object_2, shader_2, ur_2, path_2
typ_2 = ModelType(Qualities=merge_2)  # -> Type, Valid, Name, Description, Icon, Image, Variant, Stock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
panel_3 = Panel("A simplified design by replaced ids of the pieces with a list of numbers in which the pieces appear first in the design.")
qal_7 = ModelQuality(Quality=typ_2.Qualities)  # -> Quality, Valid, Name, Value, Unit, Definition
panel_4 = Panel("""semio.area
semio.area.gross
semio.area.gross.net
semio.area.gross.net.usable
semio.area.gross.net.usable.living-and-staying
semio.area.gross.net.usable.living-and-staying.living-room
semio.area.gross.net.usable.living-and-staying.living-room.living
semio.area.gross.net.usable.living-and-staying.living-room.kitchen
semio.area.gross.net.usable.living-and-staying.living-room.sanitary
semio.area.gross.net.usable.living-and-staying.living-room.circulation
semio.area.gross.net.usable.living-and-staying.living-room.outdoor-seating
semio.area.gross.net.usable.living-and-staying.living-room.storage
semio.area.gross.net.usable.living-and-staying.common-room
semio.area.gross.net.usable.living-and-staying.break-room
semio.area.gross.net.usable.living-and-staying.waiting-room
semio.area.gross.net.usable.living-and-staying.dining-room
semio.area.gross.net.usable.living-and-staying.detention-room
semio.area.gross.net.usable.office-work
semio.area.gross.net.usable.office-work.office-room
semio.area.gross.net.usable.office-work.open-plan-office
semio.area.gross.net.usable.office-work.meeting-room
semio.area.gross.net.usable.office-work.design-room
semio.area.gross.net.usable.office-work.counter-room
semio.area.gross.net.usable.office-work.control-room
semio.area.gross.net.usable.office-work.supervision-room
semio.area.gross.net.usable.office-work.office-technology-room
semio.area.gross.net.usable.office-work.other
semio.area.gross.net.usable.production-experiments-work
semio.area.gross.net.usable.production-experiments-work.production-hall
semio.area.gross.net.usable.production-experiments-work.workshop
semio.area.gross.net.usable.production-experiments-work.technology-lab
semio.area.gross.net.usable.production-experiments-work.physics-electrical-lab
semio.area.gross.net.usable.production-experiments-work.chemistry-biology-lab
semio.area.gross.net.usable.production-experiments-work.animal-husbandry-room
semio.area.gross.net.usable.production-experiments-work.plant-cultivation-room
semio.area.gross.net.usable.production-experiments-work.kitchen
semio.area.gross.net.usable.production-experiments-work.special-work-room
semio.area.gross.net.usable.storage-distribution-sales
semio.area.gross.net.usable.storage-distribution-sales.storage-room
semio.area.gross.net.usable.storage-distribution-sales.collection-archive
semio.area.gross.net.usable.storage-distribution-sales.cold-storage-room
semio.area.gross.net.usable.storage-distribution-sales.receiving-dispatch-room
semio.area.gross.net.usable.storage-distribution-sales.sales-room
semio.area.gross.net.usable.storage-distribution-sales.exhibition-room
semio.area.gross.net.usable.storage-distribution-sales.other
semio.area.gross.net.usable.education-culture-instruction
semio.area.gross.net.usable.education-culture-instruction.classwith-fixed-seating
semio.area.gross.net.usable.education-culture-instruction.teaching-practice-room
semio.area.gross.net.usable.education-culture-instruction.special-classroom
semio.area.gross.net.usable.education-culture-instruction.library-room
semio.area.gross.net.usable.education-culture-instruction.sports-room
semio.area.gross.net.usable.education-culture-instruction.assembly-room
semio.area.gross.net.usable.education-culture-instruction.stage-studio-room
semio.area.gross.net.usable.education-culture-instruction.display-room
semio.area.gross.net.usable.education-culture-instruction.sacred-room
semio.area.gross.net.usable.healing-and-care
semio.area.gross.net.usable.healing-and-care.general-medical-equipment-room
semio.area.gross.net.usable.healing-and-care.special-medical-equipment-room
semio.area.gross.net.usable.healing-and-care.surgical-room
semio.area.gross.net.usable.healing-and-care.radiation-diagnostic-room
semio.area.gross.net.usable.healing-and-care.radiation-therapy-room
semio.area.gross.net.usable.healing-and-care.rehabilitation-physiotherapy
semio.area.gross.net.usable.healing-and-care.general-patient-room
semio.area.gross.net.usable.healing-and-care.special-patient-room
semio.area.gross.net.usable.healing-and-care.other
semio.area.gross.net.usable.other
semio.area.gross.net.usable.other.sanitary-room
semio.area.gross.net.usable.other.cloakroom
semio.area.gross.net.usable.other.storage-room
semio.area.gross.net.usable.other.vehicle-parking
semio.area.gross.net.usable.other.passenger
semio.area.gross.net.usable.other.central-technical-room
semio.area.gross.net.usable.other.protective-room
semio.area.gross.net.usable.other.laundry-room
semio.area.gross.net.usable.other.other
semio.area.gross.net.technical
semio.area.gross.net.technical.wastewater-gases-water-supply
semio.area.gross.net.technical.heating-hot-water
semio.area.gross.net.technical.ventilation-air-conditioning
semio.area.gross.net.technical.electrical-power-supply
semio.area.gross.net.technical.telecommunications
semio.area.gross.net.technical.elevator-conveyor-systems
semio.area.gross.net.technical.other
semio.area.gross.net.circulation
semio.area.gross.net.circulation.corridor-hall
semio.area.gross.net.circulation.stair
semio.area.gross.net.circulation.shaft-for-conveyor-system
semio.area.gross.net.circulation.vehicle-traffic
semio.area.gross.net.circulation.other
semio.area.gross.net.construction
semio.area.gross.net.construction.exterior-wall-construction
semio.area.gross.net.construction.interior-wall-construction
semio.area.gross.net.construction.partition-wall
semio.area.gross.net.construction.column
semio.area.gross.net.construction.shaft
semio.area.gross.net.construction.beam
semio.area.gross.net.construction.other
semio.area.property
semio.area.property.built-up
semio.area.property.unbuilt
semio.area.property.outdoor-facility
semio.area.property.outdoor-facility.traffic
semio.area.property.outdoor-facility.traffic.sidewalk
semio.area.property.outdoor-facility.traffic.driveway
semio.area.property.outdoor-facility.traffic.parking-space
semio.area.property.outdoor-facility.traffic.bicycle-parking
semio.area.property.outdoor-facility.traffic.turning
semio.area.property.outdoor-facility.traffic.other
semio.area.property.green
semio.area.property.green.lawn
semio.area.property.green.planted-bed
semio.area.property.green.hedge
semio.area.property.green.tree
semio.area.property.green.roof-greening
semio.area.property.green.facade-greening
semio.area.property.green.other
semio.area.property.paved
semio.area.property.paved.terrace
semio.area.property.paved.balcony
semio.area.property.paved.courtyard
semio.area.property.paved.storage-utility
semio.area.property.paved.playground
semio.area.property.paved.other
semio.area.property.technical-facility
semio.area.property.technical-facility.waste-collection-point
semio.area.property.technical-facility.utility-line
semio.area.property.technical-facility.stormwater-management
semio.area.property.technical-facility.lighting-system
semio.area.property.technical-facility.fence-enclosure
semio.area.property.technical-facility.other
semio.area.property.water
semio.area.property.water.pond
semio.area.property.water.fountain
semio.area.property.water.stormwater-retention
semio.area.property.water.other
semio.area.property.other""")
# was macht das ?
jac = JaccardIndex()
toggle_2 = BooleanToggle(True)
unt = ConvertUnit(Value=qal_7.Value, FromUnit=qal_7.Unit, ToUnit="ft²")
panel_5 = Panel("A simplified design by replaced ids of the pieces with a list of numbers in which the pieces appear first in the design.")
# Ein eigener Parameter
blc = ExportBlock()  # -> block_definition_3, path_4, exported_2
block_definition = ModelBlockDefinition()
panel_6 = Panel(qal_7.Name)
toggle_3 = BooleanToggle(True)
filter = StreamFilter(Gate=imperial, Stream0=qal_7.Unit, Stream1=unt)
prm_2 = ModelParam(Na="Design", NN="Dn", Dc=panel_3, Op=toggle_2, Ru=toggle_2)  # -> Param, Name, NickName, Description, Optional, Success; inputs Pr: tree, Op: Boolean, Ru: Boolean; same code as prm
expression = Expression(x=Slider(0, range=0..1), y=panel_4, Expression="x")
expression_2 = Expression(x=Slider(1, range=0..10), y=panel_4, Expression="x")
prm_3 = ModelParam(Na="Design", NN="Dn", Dc=panel_5, Op=toggle_3, Ru=toggle_3)  # -> Param, Name, NickName, Description, Optional, Success; inputs Pr: tree, Op: Boolean, Ru: Boolean; same code as prm
merge_3 = Merge(Data1=graft(qal_7.Name), Data2=graft(qal_7.Value), Data3=graft(filter))  # -> simplify(Result)
py3 = Python3Script(Design=dsn.Design, Names=panel_4, Defaults=expression, Factors=expression_2)  # -> Result; inputs Names: list of String, Defaults: list of Double, Factors: list of Double
# ---------- py3: Python ----------
import collections


def compute_hierachy(design, names, defaults, factors):
    """
    Computes the root value of a hierarchy defined by names, defaults, and factors,
    based on values provided in a design object.
    """
    design_values = {
        q.Name.replace("semio.", ""): float(q.Value)
        for q in design.Qualities
    }

    meta_data = {
        name: {"default": default, "factor": factor}
        for name, default, factor in zip(names, defaults, factors)
    }

    children_map = collections.defaultdict(list)
    name_set = set(names)
    root_names = []

    for n in names:
        name = n.replace("semio.", "")
        parent = ".".join(name.split(".")[:-1])
        if parent in name_set:
            children_map[parent].append(name)
        else:
            # This name is a root of a tree/subtree in the hierarchy
            root_names.append(name)

    memo = {}

    def get_value(path):
        """Recursively computes the value for a given path in the hierarchy."""
        if path in memo:
            return memo[path]

        # Rule 1: If the value is explicitly defined in the design, use it.
        if path in design_values:
            factor = meta_data.get(path, {}).get("factor", 1.0)
            result = design_values[path] * factor
            memo[path] = result
            return result

        # Rule 2: If it's not in the design, but has children, sum their values.
        children = children_map.get(path)
        if children:
            total = sum(get_value(child_name) for child_name in children)
            factor = meta_data.get(path, {}).get("factor", 1.0)
            result = total * factor
            memo[path] = result
            return result

        # Rule 3: If it's a leaf with no design value, use the default.
        meta = meta_data.get(path, {})
        result = meta.get("default", 0.0) * meta.get("factor", 1.0)
        memo[path] = result
        return result

    # The final result is the sum of the values of all root nodes.
    total = sum(get_value(root) for root in root_names)
    return total


Result = compute_hierachy(Design, Names, Defaults, Factors)
# ---------- end py3 ----------
panel_7 = Panel(merge_3)
panel_8 = Panel(py3)

# ==== cluster OpinionatedQuality: Construct an opinionated quality with a standard name.
panel = Panel("""Global Life Cycle Costs
Life Cycle Costs
Investment Costs Construction Phase
Land Costs
Land
Land Value
Ancillary Land Costs
Surveying Fees
Court Fees
Notary Fees
Land Transfer Tax
Investigations
Valuations
Permit Fees
Land Reorganization
Other Ancillary Land Costs
Third Party Rights
Third Party Compensations
Redemption Of Real Rights
Other Third Party Rights
Land Compensations
Land Redemption Of Real Rights
Other Land Costs
Other Land Costs
Development Costs
Preparatory Measures
Site Preparation
Safety Measures
Demolition Measures
Contaminated Site Remediation
Surface Preparation
Explosive Ordnance Clearance
Cultural Heritage Finds
Other Site Preparation
Public Infrastructure Development
Wastewater Disposal
Water Supply
Gas Supply
District Heating Supply
Power Supply
Telecommunications
Traffic Development
Waste Disposal
Other Public Infrastructure Development
Private Infrastructure Development
Compensatory Measures And Levies
Compensatory Measures
Compensatory Levies
Other Compensatory Measures And Levies
Transitional Measures
Structural Measures
Organizational Measures
Other Transitional Measures
Other Development Costs
Building Structural Components
Excavation Earthworks
Foundation Substructure
External Walls Vertical Structural Components Outside
Internal Walls Vertical Structural Components Inside
Ceilings Horizontal Structural Components
Roofs
Infrastructure Facilities
Structural Installations
Other Measures For Structural Components
Technical Systems
Wastewater Water Gas Systems
Heating Supply Systems
Room Air Technology Systems
Electrical Systems
Communication Safety And Information Technology Systems
Conveying Systems
Usage Specific And Process Engineering Systems
Building And Facility Automation
Other Measures For Technical Systems
Outdoor Facilities And Open Spaces
Earthworks
Foundation Substructure
Pavement Surface Courses
Structural Components
Technical Systems
Installations In Outdoor Facilities And Open Spaces
Other Measures For Outdoor Facilities And Open Spaces
Equipment And Artworks
General Equipment
Special Equipment
Information Technology Equipment
Artistic Equipment
Art Objects
Artistic Design Of The Building
Artistic Design Of Outdoor Facilities And Open Spaces
Other Artistic Equipment
Other Equipment And Artworks
Construction Ancillary Costs
Client Tasks
Project Management
Needs Assessment
Project Control
Safety And Health Protection Coordination
Award Procedures
Other Client Tasks
Preparation Of Object Planning
Investigations
Valuations
Urban Planning Services
Landscape Planning Services
Competitions
Other Preparation Of Object Planning
Object Planning
Buildings And Interiors
Open Spaces
Civil Engineering Structures
Traffic Facilities
Other Object Planning
Specialist Planning
Structural Planning
Technical Equipment
Building Physics
Geotechnics
Engineering Surveying
Lighting Technology Daylight Technology
Fire Protection
Contaminated Sites Explosive Ordnance Cultural Heritage Finds
Other Specialist Planning
Artistic Services
Art Competitions
Artistic Service Fees
Other Artistic Services
General Construction Ancillary Costs
Expertise And Consulting
Inspections Approvals Acceptance
Operating Costs
Sampling Costs
Operating Costs After Acceptance
Insurance
Other General Construction Ancillary Costs
Other Construction Ancillary Costs
Documentation Of Existing Conditions
Other Construction Ancillary Costs
Financing
Financing Ancillary Costs
Debt Capital Interest
Equity Capital Interest
Guarantees
Other Financing
Taxes And Duties
Grants Subsidies
Income
Operating Costs Ongoing Use
Operational Management Costs
Property Management Costs
Caretaker Costs
Insurance Costs
Energy Costs
Electricity Costs
Heating Costs
Hot Water Costs
Water Costs Wastewater Fees
Waste Disposal Costs
Security And Maintenance Costs
Costs For Common Facilities
Elevators Common Facility Costs
Underground Garage Common Facility Costs
Technical Rooms Common Facility Costs
Maintenance And Modernization Costs
Regular Maintenance
Elevators Maintenance
Heating Systems Maintenance
Replacement Of Components
Windows Replacement
Facade Replacement
Roofs Replacement
Modernization
Energy Rehabilitation
Barrier Free Conversion
Dismantling And Disposal Costs
Demolition Costs
Disposal Of Contaminated Materials
Renaturation Or Reuse Of The Land
Financing Costs
Financing Interest
Financing Fees
Taxes And Duties
Grants Subsidies
Income""")
panel_2 = Panel("""People
Stationary
Living
Residents
Guests
Working
Office Workers
Production Workers
Service Workers
Education Workers
Healthcare Workers
Other Workers
Students
Pupils
Students
Client
Customers
Visitors
Patients
Mobile
Mobile Visitors
Mobile Customers
Mobile Guests
Tourists
Mobile Employees
Mobile Workers
Delivery Personnel
Mobile Students
Commuters
Exchange Students""")
panel_3 = Panel("""Floor Area                                            
Gross Floor Area                                      
Net Floor Area                                        
Usable Floor Area                                     
Living And Staying Floor Area                         
Living Room Floor Area                                
Living Floor Area                                     
Kitchen Floor Area                                    
Sanitary Floor Area                                   
Circulation Floor Area                                
Outdoor Seating Floor Area                            
Storage Floor Area                                    
Common Room Floor Area                                
Break Room Floor Area                                 
Waiting Room Floor Area                               
Dining Room Floor Area                                
Detention Room Floor Area                             
Office Work Floor Area                                
Office Room Floor Area                                
Open Plan Office Floor Area                           
Meeting Room Floor Area                               
Design Room Floor Area                                
Counter Room Floor Area                               
Control Room Floor Area                               
Supervision Room Floor Area                           
Office Technology Room Floor Area                     
Other Office Work Floor Area                          
Production Experiments Work Floor Area                
Production Hall Floor Area                            
Workshop Floor Area                                   
Technology Lab Floor Area                             
Physics Electrical Lab Floor Area                     
Chemistry Biology Lab Floor Area                      
Animal Husbandry Room Floor Area                      
Plant Cultivation Room Floor Area                     
Kitchen Floor Area                                    
Special Work Room Floor Area                          
Storage Distribution Sales Floor Area                 
Storage Room Floor Area                               
Collection Archive Floor Area                         
Cold Storage Room Floor Area                          
Receiving Dispatch Room Floor Area                    
Sales Room Floor Area                                 
Exhibition Room Floor Area                            
Other Storage Distribution Sales Floor Area           
Education Culture Instruction Floor Area              
Class With Fixed Seating Floor Area                   
Teaching Practice Room Floor Area                     
Special Classroom Floor Area                          
Library Room Floor Area                               
Sports Room Floor Area                                
Assembly Room Floor Area                              
Stage Studio Room Floor Area                          
Display Room Floor Area                               
Sacred Room Floor Area                                
Healing And Care Floor Area                           
General Medical Equipment Room Floor Area             
Special Medical Equipment Room Floor Area             
Surgical Room Floor Area                              
Radiation Diagnostic Room Floor Area                  
Radiation Therapy Room Floor Area                     
Rehabilitation Physiotherapy Floor Area               
General Patient Room Floor Area                       
Special Patient Room Floor Area                       
Other Healing And Care Floor Area                     
Other Usable Floor Area                               
Sanitary Room Floor Area                              
Cloakroom Floor Area                                  
Storage Room Floor Area                               
Vehicle Parking Floor Area                            
Passenger Floor Area                                  
Central Technical Room Floor Area                     
Protective Room Floor Area                            
Laundry Room Floor Area                               
Other Floor Area                                      
Technical Floor Area                                  
Wastewater Gases Water Supply Floor Area              
Heating Hot Water Floor Area                          
Ventilation Air Conditioning Floor Area               
Electrical Power Supply Floor Area                    
Telecommunications Floor Area                         
Elevator Conveyor Systems Floor Area                  
Other Technical Floor Area                            
Circulation Floor Area                                
Corridor Hall Floor Area                              
Stair Floor Area                                      
Shaft For Conveyor System Floor Area                  
Vehicle Traffic Floor Area                            
Other Circulation Floor Area                          
Construction Floor Area                               
Exterior Wall Construction Floor Area                 
Interior Wall Construction Floor Area                 
Partition Wall Floor Area                             
Column Floor Area                                     
Shaft Floor Area                                      
Beam Floor Area                                       
Other Construction Floor Area                         
Property Area                                         
Built Up Area                                         
Unbuilt Area                                          
Outdoor Facility Area                                 
Traffic Area                                          
Sidewalk Area                                         
Driveway Area                                         
Parking Space Area                                    
Bicycle Parking Area                                  
Turning Area                                          
Other Traffic Area                                    
Green Area                                            
Lawn Area                                             
Planted Bed Area                                      
Hedge Area                                            
Tree Area                                             
Roof Greening Area                                    
Facade Greening Area                                  
Other Green Area                                      
Paved Area                                            
Terrace Area                                          
Balcony Area                                          
Courtyard Area                                        
Storage Utility Area                                  
Playground Area                                       
Other Paved Area                                      
Technical Facility Area                               
Waste Collection Point Area                           
Utility Line Area                                     
Stormwater Management Area                            
Lighting System Area                                  
Fence Enclosure Area                                  
Other Technical Facility Area                         
Water Area                                            
Pond Area                                             
Fountain Area                                         
Stormwater Retention Area                             
Other Water Area                                      
Other Outdoor Facility Area   """)
merge = Merge(Data1=panel_3, Data2=panel_2, Data3=panel)
panel_4 = Panel("""semio.costs.global life cycle costs
semio.costs.global life cycle costs.life-cycle-costs
semio.costs.global life cycle costs.life-cycle-costs.investment-costs-construction-phase
semio.costs.global life cycle costs.life-cycle-costs.investment-costs-construction-phase.land-costs
semio.costs.global life cycle costs.life-cycle-costs.investment-costs-construction-phase.land-costs.land
semio.costs.global life cycle costs.life-cycle-costs.investment-costs-construction-phase.land-costs.land.land-value
semio.costs.global life cycle costs.life-cycle-costs.investment-costs-construction-phase.land-costs.land.ancillary-land-costs
semio.costs.global life cycle costs.life-cycle-costs.investment-costs-construction-phase.land-costs.land.ancillary-land-costs.surveying-fees
semio.costs.global life cycle costs.life-cycle-costs.investment-costs-construction-phase.land-costs.land.ancillary-land-costs.court-fees
semio.costs.global life cycle costs.life-cycle-costs.investment-costs-construction-phase.land-costs.land.ancillary-land-costs.notary-fees
semio.costs.global life cycle costs.life-cycle-costs.investment-costs-construction-phase.land-costs.land.ancillary-land-costs.land-transfer-tax
semio.costs.global life cycle costs.life-cycle-costs.investment-costs-construction-phase.land-costs.land.ancillary-land-costs.investigations
semio.costs.global life cycle costs.life-cycle-costs.investment-costs-construction-phase.land-costs.land.ancillary-land-costs.valuations
semio.costs.global life cycle costs.life-cycle-costs.investment-costs-construction-phase.land-costs.land.ancillary-land-costs.permit-fees
semio.costs.global life cycle costs.life-cycle-costs.investment-costs-construction-phase.land-costs.land.ancillary-land-costs.land-reorganization
semio.costs.global life cycle costs.life-cycle-costs.investment-costs-construction-phase.land-costs.land.ancillary-land-costs.other
semio.costs.global life cycle costs.life-cycle-costs.investment-costs-construction-phase.land-costs.land.third-party-rights
semio.costs.global life cycle costs.life-cycle-costs.investment-costs-construction-phase.land-costs.land.third-party-rights.compensations
semio.costs.global life cycle costs.life-cycle-costs.investment-costs-construction-phase.land-costs.land.third-party-rights.redemption-of-real-rights
semio.costs.global life cycle costs.life-cycle-costs.investment-costs-construction-phase.land-costs.land.third-party-rights.other
semio.costs.global life cycle costs.life-cycle-costs.investment-costs-construction-phase.land-costs.land.compensations
semio.costs.global life cycle costs.life-cycle-costs.investment-costs-construction-phase.land-costs.land.redemption-of-real-rights
semio.costs.global life cycle costs.life-cycle-costs.investment-costs-construction-phase.land-costs.land.other
semio.costs.global life cycle costs.life-cycle-costs.investment-costs-construction-phase.land-costs.other
semio.costs.global life cycle costs.life-cycle-costs.investment-costs-construction-phase.development-costs
semio.costs.global life cycle costs.life-cycle-costs.investment-costs-construction-phase.development-costs.preparatory-measures
semio.costs.global life cycle costs.life-cycle-costs.investment-costs-construction-phase.development-costs.preparatory-measures.site-preparation
semio.costs.global life cycle costs.life-cycle-costs.investment-costs-construction-phase.development-costs.preparatory-measures.site-preparation.safety-measures
semio.costs.global life cycle costs.life-cycle-costs.investment-costs-construction-phase.development-costs.preparatory-measures.site-preparation.demolition-measures
semio.costs.global life cycle costs.life-cycle-costs.investment-costs-construction-phase.development-costs.preparatory-measures.site-preparation.contaminated-site-remediation
semio.costs.global life cycle costs.life-cycle-costs.investment-costs-construction-phase.development-costs.preparatory-measures.site-preparation.surface-preparation
semio.costs.global life cycle costs.life-cycle-costs.investment-costs-construction-phase.development-costs.preparatory-measures.site-preparation.explosive-ordnance-clearance
semio.costs.global life cycle costs.life-cycle-costs.investment-costs-construction-phase.development-costs.preparatory-measures.site-preparation.cultural-heritage-finds
semio.costs.global life cycle costs.life-cycle-costs.investment-costs-construction-phase.development-costs.preparatory-measures.site-preparation.other
semio.costs.global life cycle costs.life-cycle-costs.investment-costs-construction-phase.development-costs.preparatory-measures.public-infrastructure-development
semio.costs.global life cycle costs.life-cycle-costs.investment-costs-construction-phase.development-costs.preparatory-measures.public-infrastructure-development.wastewater-disposal
semio.costs.global life cycle costs.life-cycle-costs.investment-costs-construction-phase.development-costs.preparatory-measures.public-infrastructure-development.water-supply
semio.costs.global life cycle costs.life-cycle-costs.investment-costs-construction-phase.development-costs.preparatory-measures.public-infrastructure-development.gas-supply
semio.costs.global life cycle costs.life-cycle-costs.investment-costs-construction-phase.development-costs.preparatory-measures.public-infrastructure-development.district-heating-supply
semio.costs.global life cycle costs.life-cycle-costs.investment-costs-construction-phase.development-costs.preparatory-measures.public-infrastructure-development.power-supply
semio.costs.global life cycle costs.life-cycle-costs.investment-costs-construction-phase.development-costs.preparatory-measures.public-infrastructure-development.telecommunications
semio.costs.global life cycle costs.life-cycle-costs.investment-costs-construction-phase.development-costs.preparatory-measures.public-infrastructure-development.traffic-development
semio.costs.global life cycle costs.life-cycle-costs.investment-costs-construction-phase.development-costs.preparatory-measures.public-infrastructure-development.waste-disposal
semio.costs.global life cycle costs.life-cycle-costs.investment-costs-construction-phase.development-costs.preparatory-measures.public-infrastructure-development.other
semio.costs.global life cycle costs.life-cycle-costs.investment-costs-construction-phase.development-costs.preparatory-measures.private-infrastructure-development
semio.costs.global life cycle costs.life-cycle-costs.investment-costs-construction-phase.development-costs.preparatory-measures.compensatory-measures-and-levies
semio.costs.global life cycle costs.life-cycle-costs.investment-costs-construction-phase.development-costs.preparatory-measures.compensatory-measures-and-levies.compensatory-measures
semio.costs.global life cycle costs.life-cycle-costs.investment-costs-construction-phase.development-costs.preparatory-measures.compensatory-measures-and-levies.compensatory-levies
semio.costs.global life cycle costs.life-cycle-costs.investment-costs-construction-phase.development-costs.preparatory-measures.compensatory-measures-and-levies.other
semio.costs.global life cycle costs.life-cycle-costs.investment-costs-construction-phase.development-costs.preparatory-measures.transitional-measures
semio.costs.global life cycle costs.life-cycle-costs.investment-costs-construction-phase.development-costs.preparatory-measures.transitional-measures.structural-measures
semio.costs.global life cycle costs.life-cycle-costs.investment-costs-construction-phase.development-costs.preparatory-measures.transitional-measures.organizational-measures
semio.costs.global life cycle costs.life-cycle-costs.investment-costs-construction-phase.development-costs.preparatory-measures.transitional-measures.other
semio.costs.global life cycle costs.life-cycle-costs.investment-costs-construction-phase.development-costs.other
semio.costs.global life cycle costs.life-cycle-costs.investment-costs-construction-phase.building-structural-components
semio.costs.global life cycle costs.life-cycle-costs.investment-costs-construction-phase.building-structural-components.excavation-earthworks
semio.costs.global life cycle costs.life-cycle-costs.investment-costs-construction-phase.building-structural-components.foundation-substructure
semio.costs.global life cycle costs.life-cycle-costs.investment-costs-construction-phase.building-structural-components.external-walls-vertical-structural-components-outside
semio.costs.global life cycle costs.life-cycle-costs.investment-costs-construction-phase.building-structural-components.internal-walls-vertical-structural-components-inside
semio.costs.global life cycle costs.life-cycle-costs.investment-costs-construction-phase.building-structural-components.ceilings-horizontal-structural-components
semio.costs.global life cycle costs.life-cycle-costs.investment-costs-construction-phase.building-structural-components.roofs
semio.costs.global life cycle costs.life-cycle-costs.investment-costs-construction-phase.building-structural-components.infrastructure-facilities
semio.costs.global life cycle costs.life-cycle-costs.investment-costs-construction-phase.building-structural-components.structural-installations
semio.costs.global life cycle costs.life-cycle-costs.investment-costs-construction-phase.building-structural-components.other-measures-for-structural-components
semio.costs.global life cycle costs.life-cycle-costs.investment-costs-construction-phase.technical-systems
semio.costs.global life cycle costs.life-cycle-costs.investment-costs-construction-phase.technical-systems.wastewater-water-gas-systems
semio.costs.global life cycle costs.life-cycle-costs.investment-costs-construction-phase.technical-systems.heating-supply-systems
semio.costs.global life cycle costs.life-cycle-costs.investment-costs-construction-phase.technical-systems.room-air-technology-systems
semio.costs.global life cycle costs.life-cycle-costs.investment-costs-construction-phase.technical-systems.electrical-systems
semio.costs.global life cycle costs.life-cycle-costs.investment-costs-construction-phase.technical-systems.communication-safety-and-information-technology-systems
semio.costs.global life cycle costs.life-cycle-costs.investment-costs-construction-phase.technical-systems.conveying-systems
semio.costs.global life cycle costs.life-cycle-costs.investment-costs-construction-phase.technical-systems.usage-specific-and-process-engineering-systems
semio.costs.global life cycle costs.life-cycle-costs.investment-costs-construction-phase.technical-systems.building-and-facility-automation
semio.costs.global life cycle costs.life-cycle-costs.investment-costs-construction-phase.technical-systems.other-measures-for-technical-systems
semio.costs.global life cycle costs.life-cycle-costs.investment-costs-construction-phase.outdoor-facilities-and-open-spaces
semio.costs.global life cycle costs.life-cycle-costs.investment-costs-construction-phase.outdoor-facilities-and-open-spaces.earthworks
semio.costs.global life cycle costs.life-cycle-costs.investment-costs-construction-phase.outdoor-facilities-and-open-spaces.foundation-substructure
semio.costs.global life cycle costs.life-cycle-costs.investment-costs-construction-phase.outdoor-facilities-and-open-spaces.pavement-surface-courses
semio.costs.global life cycle costs.life-cycle-costs.investment-costs-construction-phase.outdoor-facilities-and-open-spaces.structural-components
semio.costs.global life cycle costs.life-cycle-costs.investment-costs-construction-phase.outdoor-facilities-and-open-spaces.technical-systems
semio.costs.global life cycle costs.life-cycle-costs.investment-costs-construction-phase.outdoor-facilities-and-open-spaces.installations-in-outdoor-facilities-and-open-spaces
semio.costs.global life cycle costs.life-cycle-costs.investment-costs-construction-phase.outdoor-facilities-and-open-spaces.other-measures-for-outdoor-facilities-and-open-spaces
semio.costs.global life cycle costs.life-cycle-costs.investment-costs-construction-phase.equipment-and-artworks
semio.costs.global life cycle costs.life-cycle-costs.investment-costs-construction-phase.equipment-and-artworks.general-equipment
semio.costs.global life cycle costs.life-cycle-costs.investment-costs-construction-phase.equipment-and-artworks.special-equipment
semio.costs.global life cycle costs.life-cycle-costs.investment-costs-construction-phase.equipment-and-artworks.information-technology-equipment
semio.costs.global life cycle costs.life-cycle-costs.investment-costs-construction-phase.equipment-and-artworks.artistic-equipment
semio.costs.global life cycle costs.life-cycle-costs.investment-costs-construction-phase.equipment-and-artworks.artistic-equipment.art-objects
semio.costs.global life cycle costs.life-cycle-costs.investment-costs-construction-phase.equipment-and-artworks.artistic-equipment.artistic-design-of-the-building
semio.costs.global life cycle costs.life-cycle-costs.investment-costs-construction-phase.equipment-and-artworks.artistic-equipment.artistic-design-of-outdoor-facilities-and-open-spaces
semio.costs.global life cycle costs.life-cycle-costs.investment-costs-construction-phase.equipment-and-artworks.artistic-equipment.other
semio.costs.global life cycle costs.life-cycle-costs.investment-costs-construction-phase.equipment-and-artworks.other
semio.costs.global life cycle costs.life-cycle-costs.investment-costs-construction-phase.construction-ancillary-costs
semio.costs.global life cycle costs.life-cycle-costs.investment-costs-construction-phase.construction-ancillary-costs.client-tasks
semio.costs.global life cycle costs.life-cycle-costs.investment-costs-construction-phase.construction-ancillary-costs.client-tasks.project-management
semio.costs.global life cycle costs.life-cycle-costs.investment-costs-construction-phase.construction-ancillary-costs.client-tasks.needs-assessment
semio.costs.global life cycle costs.life-cycle-costs.investment-costs-construction-phase.construction-ancillary-costs.client-tasks.project-control
semio.costs.global life cycle costs.life-cycle-costs.investment-costs-construction-phase.construction-ancillary-costs.client-tasks.safety-and-health-protection-coordination
semio.costs.global life cycle costs.life-cycle-costs.investment-costs-construction-phase.construction-ancillary-costs.client-tasks.award-procedures
semio.costs.global life cycle costs.life-cycle-costs.investment-costs-construction-phase.construction-ancillary-costs.client-tasks.other
semio.costs.global life cycle costs.life-cycle-costs.investment-costs-construction-phase.construction-ancillary-costs.preparation-of-object-planning
semio.costs.global life cycle costs.life-cycle-costs.investment-costs-construction-phase.construction-ancillary-costs.preparation-of-object-planning.investigations
semio.costs.global life cycle costs.life-cycle-costs.investment-costs-construction-phase.construction-ancillary-costs.preparation-of-object-planning.valuations
semio.costs.global life cycle costs.life-cycle-costs.investment-costs-construction-phase.construction-ancillary-costs.preparation-of-object-planning.urban-planning-services
semio.costs.global life cycle costs.life-cycle-costs.investment-costs-construction-phase.construction-ancillary-costs.preparation-of-object-planning.landscape-planning-services
semio.costs.global life cycle costs.life-cycle-costs.investment-costs-construction-phase.construction-ancillary-costs.preparation-of-object-planning.competitions
semio.costs.global life cycle costs.life-cycle-costs.investment-costs-construction-phase.construction-ancillary-costs.preparation-of-object-planning.other
semio.costs.global life cycle costs.life-cycle-costs.investment-costs-construction-phase.construction-ancillary-costs.object-planning
semio.costs.global life cycle costs.life-cycle-costs.investment-costs-construction-phase.construction-ancillary-costs.object-planning.buildings-and-interiors
semio.costs.global life cycle costs.life-cycle-costs.investment-costs-construction-phase.construction-ancillary-costs.object-planning.open-spaces
semio.costs.global life cycle costs.life-cycle-costs.investment-costs-construction-phase.construction-ancillary-costs.object-planning.civil-engineering-structures
semio.costs.global life cycle costs.life-cycle-costs.investment-costs-construction-phase.construction-ancillary-costs.object-planning.traffic-facilities
semio.costs.global life cycle costs.life-cycle-costs.investment-costs-construction-phase.construction-ancillary-costs.object-planning.other
semio.costs.global life cycle costs.life-cycle-costs.investment-costs-construction-phase.construction-ancillary-costs.specialist-planning
semio.costs.global life cycle costs.life-cycle-costs.investment-costs-construction-phase.construction-ancillary-costs.specialist-planning.structural-planning
semio.costs.global life cycle costs.life-cycle-costs.investment-costs-construction-phase.construction-ancillary-costs.specialist-planning.technical-equipment
semio.costs.global life cycle costs.life-cycle-costs.investment-costs-construction-phase.construction-ancillary-costs.specialist-planning.building-physics
semio.costs.global life cycle costs.life-cycle-costs.investment-costs-construction-phase.construction-ancillary-costs.specialist-planning.geotechnics
semio.costs.global life cycle costs.life-cycle-costs.investment-costs-construction-phase.construction-ancillary-costs.specialist-planning.engineering-surveying
semio.costs.global life cycle costs.life-cycle-costs.investment-costs-construction-phase.construction-ancillary-costs.specialist-planning.lighting-technology-daylight-technology
semio.costs.global life cycle costs.life-cycle-costs.investment-costs-construction-phase.construction-ancillary-costs.specialist-planning.fire-protection
semio.costs.global life cycle costs.life-cycle-costs.investment-costs-construction-phase.construction-ancillary-costs.specialist-planning.contaminated-sites-explosive-ordnance-cultural-heritage-finds
semio.costs.global life cycle costs.life-cycle-costs.investment-costs-construction-phase.construction-ancillary-costs.specialist-planning.other
semio.costs.global life cycle costs.life-cycle-costs.investment-costs-construction-phase.construction-ancillary-costs.artistic-services
semio.costs.global life cycle costs.life-cycle-costs.investment-costs-construction-phase.construction-ancillary-costs.artistic-services.art-competitions
semio.costs.global life cycle costs.life-cycle-costs.investment-costs-construction-phase.construction-ancillary-costs.artistic-services.fees
semio.costs.global life cycle costs.life-cycle-costs.investment-costs-construction-phase.construction-ancillary-costs.artistic-services.other
semio.costs.global life cycle costs.life-cycle-costs.investment-costs-construction-phase.construction-ancillary-costs.general-construction-ancillary-costs
semio.costs.global life cycle costs.life-cycle-costs.investment-costs-construction-phase.construction-ancillary-costs.general-construction-ancillary-costs.expertise-and-consulting
semio.costs.global life cycle costs.life-cycle-costs.investment-costs-construction-phase.construction-ancillary-costs.general-construction-ancillary-costs.inspections-approvals-acceptance
semio.costs.global life cycle costs.life-cycle-costs.investment-costs-construction-phase.construction-ancillary-costs.general-construction-ancillary-costs.operating-costs
semio.costs.global life cycle costs.life-cycle-costs.investment-costs-construction-phase.construction-ancillary-costs.general-construction-ancillary-costs.sampling-costs
semio.costs.global life cycle costs.life-cycle-costs.investment-costs-construction-phase.construction-ancillary-costs.general-construction-ancillary-costs.operating-costs-after-acceptance
semio.costs.global life cycle costs.life-cycle-costs.investment-costs-construction-phase.construction-ancillary-costs.general-construction-ancillary-costs.insurance
semio.costs.global life cycle costs.life-cycle-costs.investment-costs-construction-phase.construction-ancillary-costs.general-construction-ancillary-costs.other
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""")
panel_5 = Panel("""semio.people
semio.people.stationary
semio.people.stationary.living
semio.people.stationary.living.residents
semio.people.stationary.living.guests
semio.people.stationary.working
semio.people.stationary.working.office
semio.people.stationary.working.production
semio.people.stationary.working.service
semio.people.stationary.working.education
semio.people.stationary.working.healthcare
semio.people.stationary.working.other
semio.people.stationary.students
semio.people.stationary.students.pupils
semio.people.stationary.students.students
semio.people.stationary.client
semio.people.stationary.client.customers
semio.people.stationary.client.visitors
semio.people.stationary.client.patients
semio.people.mobile
semio.people.mobile.visitors
semio.people.mobile.visitors.customers
semio.people.mobile.visitors.guests
semio.people.mobile.visitors.tourists
semio.people.mobile.employees
semio.people.mobile.employees.mobile-workers
semio.people.mobile.employees.delivery-personnel
semio.people.mobile.students
semio.people.mobile.students.commuters
semio.people.mobile.students.exchange-students""")
panel_6 = Panel("""semio.area
semio.area.gross
semio.area.gross.net
semio.area.gross.net.usable
semio.area.gross.net.usable.living-and-staying
semio.area.gross.net.usable.living-and-staying.living-room
semio.area.gross.net.usable.living-and-staying.living-room.living
semio.area.gross.net.usable.living-and-staying.living-room.kitchen
semio.area.gross.net.usable.living-and-staying.living-room.sanitary
semio.area.gross.net.usable.living-and-staying.living-room.circulation
semio.area.gross.net.usable.living-and-staying.living-room.outdoor-seating
semio.area.gross.net.usable.living-and-staying.living-room.storage
semio.area.gross.net.usable.living-and-staying.common-room
semio.area.gross.net.usable.living-and-staying.break-room
semio.area.gross.net.usable.living-and-staying.waiting-room
semio.area.gross.net.usable.living-and-staying.dining-room
semio.area.gross.net.usable.living-and-staying.detention-room
semio.area.gross.net.usable.office-work
semio.area.gross.net.usable.office-work.office-room
semio.area.gross.net.usable.office-work.open-plan-office
semio.area.gross.net.usable.office-work.meeting-room
semio.area.gross.net.usable.office-work.design-room
semio.area.gross.net.usable.office-work.counter-room
semio.area.gross.net.usable.office-work.control-room
semio.area.gross.net.usable.office-work.supervision-room
semio.area.gross.net.usable.office-work.office-technology-room
semio.area.gross.net.usable.office-work.other
semio.area.gross.net.usable.production-experiments-work
semio.area.gross.net.usable.production-experiments-work.production-hall
semio.area.gross.net.usable.production-experiments-work.workshop
semio.area.gross.net.usable.production-experiments-work.technology-lab
semio.area.gross.net.usable.production-experiments-work.physics-electrical-lab
semio.area.gross.net.usable.production-experiments-work.chemistry-biology-lab
semio.area.gross.net.usable.production-experiments-work.animal-husbandry-room
semio.area.gross.net.usable.production-experiments-work.plant-cultivation-room
semio.area.gross.net.usable.production-experiments-work.kitchen
semio.area.gross.net.usable.production-experiments-work.special-work-room
semio.area.gross.net.usable.storage-distribution-sales
semio.area.gross.net.usable.storage-distribution-sales.storage-room
semio.area.gross.net.usable.storage-distribution-sales.collection-archive
semio.area.gross.net.usable.storage-distribution-sales.cold-storage-room
semio.area.gross.net.usable.storage-distribution-sales.receiving-dispatch-room
semio.area.gross.net.usable.storage-distribution-sales.sales-room
semio.area.gross.net.usable.storage-distribution-sales.exhibition-room
semio.area.gross.net.usable.storage-distribution-sales.other
semio.area.gross.net.usable.education-culture-instruction
semio.area.gross.net.usable.education-culture-instruction.classwith-fixed-seating
semio.area.gross.net.usable.education-culture-instruction.teaching-practice-room
semio.area.gross.net.usable.education-culture-instruction.special-classroom
semio.area.gross.net.usable.education-culture-instruction.library-room
semio.area.gross.net.usable.education-culture-instruction.sports-room
semio.area.gross.net.usable.education-culture-instruction.assembly-room
semio.area.gross.net.usable.education-culture-instruction.stage-studio-room
semio.area.gross.net.usable.education-culture-instruction.display-room
semio.area.gross.net.usable.education-culture-instruction.sacred-room
semio.area.gross.net.usable.healing-and-care
semio.area.gross.net.usable.healing-and-care.general-medical-equipment-room
semio.area.gross.net.usable.healing-and-care.special-medical-equipment-room
semio.area.gross.net.usable.healing-and-care.surgical-room
semio.area.gross.net.usable.healing-and-care.radiation-diagnostic-room
semio.area.gross.net.usable.healing-and-care.radiation-therapy-room
semio.area.gross.net.usable.healing-and-care.rehabilitation-physiotherapy
semio.area.gross.net.usable.healing-and-care.general-patient-room
semio.area.gross.net.usable.healing-and-care.special-patient-room
semio.area.gross.net.usable.healing-and-care.other
semio.area.gross.net.usable.other
semio.area.gross.net.usable.other.sanitary-room
semio.area.gross.net.usable.other.cloakroom
semio.area.gross.net.usable.other.storage-room
semio.area.gross.net.usable.other.vehicle-parking
semio.area.gross.net.usable.other.passenger
semio.area.gross.net.usable.other.central-technical-room
semio.area.gross.net.usable.other.protective-room
semio.area.gross.net.usable.other.laundry-room
semio.area.gross.net.usable.other.other
semio.area.gross.net.technical
semio.area.gross.net.technical.wastewater-gases-water-supply
semio.area.gross.net.technical.heating-hot-water
semio.area.gross.net.technical.ventilation-air-conditioning
semio.area.gross.net.technical.electrical-power-supply
semio.area.gross.net.technical.telecommunications
semio.area.gross.net.technical.elevator-conveyor-systems
semio.area.gross.net.technical.other
semio.area.gross.net.circulation
semio.area.gross.net.circulation.corridor-hall
semio.area.gross.net.circulation.stair
semio.area.gross.net.circulation.shaft-for-conveyor-system
semio.area.gross.net.circulation.vehicle-traffic
semio.area.gross.net.circulation.other
semio.area.gross.net.construction
semio.area.gross.net.construction.exterior-wall-construction
semio.area.gross.net.construction.interior-wall-construction
semio.area.gross.net.construction.partition-wall
semio.area.gross.net.construction.column
semio.area.gross.net.construction.shaft
semio.area.gross.net.construction.beam
semio.area.gross.net.construction.other
semio.area.property
semio.area.property.built-up
semio.area.property.unbuilt
semio.area.property.outdoor-facility
semio.area.property.outdoor-facility.traffic
semio.area.property.outdoor-facility.traffic.sidewalk
semio.area.property.outdoor-facility.traffic.driveway
semio.area.property.outdoor-facility.traffic.parking-space
semio.area.property.outdoor-facility.traffic.bicycle-parking
semio.area.property.outdoor-facility.traffic.turning
semio.area.property.outdoor-facility.traffic.other
semio.area.property.green
semio.area.property.green.lawn
semio.area.property.green.planted-bed
semio.area.property.green.hedge
semio.area.property.green.tree
semio.area.property.green.roof-greening
semio.area.property.green.facade-greening
semio.area.property.green.other
semio.area.property.paved
semio.area.property.paved.terrace
semio.area.property.paved.balcony
semio.area.property.paved.courtyard
semio.area.property.paved.storage-utility
semio.area.property.paved.playground
semio.area.property.paved.other
semio.area.property.technical-facility
semio.area.property.technical-facility.waste-collection-point
semio.area.property.technical-facility.utility-line
semio.area.property.technical-facility.stormwater-management
semio.area.property.technical-facility.lighting-system
semio.area.property.technical-facility.fence-enclosure
semio.area.property.technical-facility.other
semio.area.property.water
semio.area.property.water.pond
semio.area.property.water.fountain
semio.area.property.water.stormwater-retention
semio.area.property.water.other
semio.area.property.other""")
panel_7 = Panel("https://identifier.buildingsmart.org/uri/buildingsmart/ifc/4.3/prop/NetFloorArea")
# Raumnutzungsarten nach DIN 277-2: https://search.bsdd.buildingsmart.org/uri/cafmring/din277-2/2024.0.1
na = ClusterInput()
value = ClusterInput()
imperial = ClusterInput()
na_2 = Name(na)
value_2 = Value(value)
imperial_2 = Imperial(imperial)
expression = Expression(x="m²", y=panel_6, Expression="x")
expression_2 = Expression(x="ft²", y=panel_6, Expression="x")
expression_3 = Expression(x="people", y=panel_5, Expression="x")
expression_4 = Expression(x="people", y=panel_5, Expression="x")
expression_5 = Expression(x="€", y=panel_4, Expression="x")
expression_6 = Expression(x="$", y=panel_4, Expression="x")
merge_2 = Merge(Data1=panel_6, Data2=panel_5, Data3=panel_4)
merge_3 = Merge(Data1=expression_2, Data2=expression_3, Data3=expression_6)
merge_4 = Merge(Data1=expression, Data2=expression_4, Data3=expression_5)
itemindex = ItemIndex(L=merge_2, I=na_2)  # -> i; inputs L: list
# ---------- itemindex: Python ----------
#Component Information
#--------------------------------------------------------------------------------------------
if ghenv.Component.RunCount<2:
    #General
    #--------------------------------------------------------------------------------------------
    __author__ = "Ueli Saluz"
    __version__ = "2022.11.18"
    
    ghenv.Component.Name = "ItemIndex"
    ghenv.Component.NickName = "ItemIndex"
    ghenv.Component.Description = "A better IdemIndex"
    ghenv.Component.Message = "VER 1.0"
    ghenv.Component.Category = "Set"
    ghenv.Component.SubCategory = "List"
    
     #Inputs
    #--------------------------------------------------------------------------------------------
    inputIndex=0
    
    ghenv.Component.Params.Input[inputIndex].Name = "List"
    ghenv.Component.Params.Input[inputIndex].NickName = "L"
    ghenv.Component.Params.Input[inputIndex].Description = "Input1 is..."
    ghenv.Component.Params.Input[inputIndex].Optional = False
    inputIndex+=1
    
    ghenv.Component.Params.Input[inputIndex].Name = "Item"
    ghenv.Component.Params.Input[inputIndex].NickName = "I"
    ghenv.Component.Params.Input[inputIndex].Description = "Input2 is..."
    ghenv.Component.Params.Input[inputIndex].Optional = False
    inputIndex+=1
    
    #Outputs
    #--------------------------------------------------------------------------------------------
    outputIndex=0
    
    ghenv.Component.Params.Output[outputIndex].Name = "Index"
    ghenv.Component.Params.Output[outputIndex].NickName = "i"
    ghenv.Component.Params.Output[outputIndex].Description = "Output1 is..."
    outputIndex+=1

i = L.index(I)
# ---------- end itemindex ----------
panel_8 = Panel("""Global Life Cycle Costs = "semio.global-life-cycle-costs"
Life Cycle Costs = "semio.global-life-cycle-costs.life-cycle-costs"
Investment Costs Construction Phase = "semio.global-life-cycle-costs.life-cycle-costs.investment-costs-construction-phase"
Land Costs = "semio.global-life-cycle-costs.life-cycle-costs.investment-costs-construction-phase.land-costs"
Land = "semio.global-life-cycle-costs.life-cycle-costs.investment-costs-construction-phase.land-costs.land"
Land Value = "semio.global-life-cycle-costs.life-cycle-costs.investment-costs-construction-phase.land-costs.land.land-value"
Ancillary Land Costs = "semio.global-life-cycle-costs.life-cycle-costs.investment-costs-construction-phase.land-costs.land.ancillary-land-costs"
Surveying Fees = "semio.global-life-cycle-costs.life-cycle-costs.investment-costs-construction-phase.land-costs.land.ancillary-land-costs.surveying-fees"
Court Fees = "semio.global-life-cycle-costs.life-cycle-costs.investment-costs-construction-phase.land-costs.land.ancillary-land-costs.court-fees"
Notary Fees = "semio.global-life-cycle-costs.life-cycle-costs.investment-costs-construction-phase.land-costs.land.ancillary-land-costs.notary-fees"
Land Transfer Tax = "semio.global-life-cycle-costs.life-cycle-costs.investment-costs-construction-phase.land-costs.land.ancillary-land-costs.land-transfer-tax"
Investigations = "semio.global-life-cycle-costs.life-cycle-costs.investment-costs-construction-phase.land-costs.land.ancillary-land-costs.investigations"
Valuations = "semio.global-life-cycle-costs.life-cycle-costs.investment-costs-construction-phase.land-costs.land.ancillary-land-costs.valuations"
Permit Fees = "semio.global-life-cycle-costs.life-cycle-costs.investment-costs-construction-phase.land-costs.land.ancillary-land-costs.permit-fees"
Land Reorganization = "semio.global-life-cycle-costs.life-cycle-costs.investment-costs-construction-phase.land-costs.land.ancillary-land-costs.land-reorganization"
Other (Ancillary Land Costs) = "semio.global-life-cycle-costs.life-cycle-costs.investment-costs-construction-phase.land-costs.land.ancillary-land-costs.other"
Third Party Rights = "semio.global-life-cycle-costs.life-cycle-costs.investment-costs-construction-phase.land-costs.land.third-party-rights"
Compensations (Third Party Rights) = "semio.global-life-cycle-costs.life-cycle-costs.investment-costs-construction-phase.land-costs.land.third-party-rights.compensations"
Redemption of Real Rights (Third Party Rights) = "semio.global-life-cycle-costs.life-cycle-costs.investment-costs-construction-phase.land-costs.land.third-party-rights.redemption-of-real-rights"
Other (Third Party Rights) = "semio.global-life-cycle-costs.life-cycle-costs.investment-costs-construction-phase.land-costs.land.third-party-rights.other"
Compensations = "semio.global-life-cycle-costs.life-cycle-costs.investment-costs-construction-phase.land-costs.land.compensations"
Redemption of Real Rights = "semio.global-life-cycle-costs.life-cycle-costs.investment-costs-construction-phase.land-costs.land.redemption-of-real-rights"
Other (Land) = "semio.global-life-cycle-costs.life-cycle-costs.investment-costs-construction-phase.land-costs.land.other"
Other (Land Costs) = "semio.global-life-cycle-costs.life-cycle-costs.investment-costs-construction-phase.land-costs.other"
Development Costs = "semio.global-life-cycle-costs.life-cycle-costs.investment-costs-construction-phase.development-costs"
Preparatory Measures = "semio.global-life-cycle-costs.life-cycle-costs.investment-costs-construction-phase.development-costs.preparatory-measures"
Site Preparation = "semio.global-life-cycle-costs.life-cycle-costs.investment-costs-construction-phase.development-costs.preparatory-measures.site-preparation"
Safety Measures (Site Preparation) = "semio.global-life-cycle-costs.life-cycle-costs.investment-costs-construction-phase.development-costs.preparatory-measures.site-preparation.safety-measures"
Demolition Measures (Site Preparation) = "semio.global-life-cycle-costs.life-cycle-costs.investment-costs-construction-phase.development-costs.preparatory-measures.site-preparation.demolition-measures"
Contaminated Site Remediation = "semio.global-life-cycle-costs.life-cycle-costs.investment-costs-construction-phase.development-costs.preparatory-measures.site-preparation.contaminated-site-remediation"
Surface Preparation = "semio.global-life-cycle-costs.life-cycle-costs.investment-costs-construction-phase.development-costs.preparatory-measures.site-preparation.surface-preparation"
Explosive Ordnance Clearance = "semio.global-life-cycle-costs.life-cycle-costs.investment-costs-construction-phase.development-costs.preparatory-measures.site-preparation.explosive-ordnance-clearance"
Cultural Heritage Finds = "semio.global-life-cycle-costs.life-cycle-costs.investment-costs-construction-phase.development-costs.preparatory-measures.site-preparation.cultural-heritage-finds"
Other (Site Preparation) = "semio.global-life-cycle-costs.life-cycle-costs.investment-costs-construction-phase.development-costs.preparatory-measures.site-preparation.other"
Public Infrastructure Development = "semio.global-life-cycle-costs.life-cycle-costs.investment-costs-construction-phase.development-costs.preparatory-measures.public-infrastructure-development"
Wastewater Disposal = "semio.global-life-cycle-costs.life-cycle-costs.investment-costs-construction-phase.development-costs.preparatory-measures.public-infrastructure-development.wastewater-disposal"
Water Supply = "semio.global-life-cycle-costs.life-cycle-costs.investment-costs-construction-phase.development-costs.preparatory-measures.public-infrastructure-development.water-supply"
Gas Supply = "semio.global-life-cycle-costs.life-cycle-costs.investment-costs-construction-phase.development-costs.preparatory-measures.public-infrastructure-development.gas-supply"
District Heating Supply = "semio.global-life-cycle-costs.life-cycle-costs.investment-costs-construction-phase.development-costs.preparatory-measures.public-infrastructure-development.district-heating-supply"
Power Supply = "semio.global-life-cycle-costs.life-cycle-costs.investment-costs-construction-phase.development-costs.preparatory-measures.public-infrastructure-development.power-supply"
Telecommunications = "semio.global-life-cycle-costs.life-cycle-costs.investment-costs-construction-phase.development-costs.preparatory-measures.public-infrastructure-development.telecommunications"
Traffic Development = "semio.global-life-cycle-costs.life-cycle-costs.investment-costs-construction-phase.development-costs.preparatory-measures.public-infrastructure-development.traffic-development"
Waste Disposal (Public Infrastructure) = "semio.global-life-cycle-costs.life-cycle-costs.investment-costs-construction-phase.development-costs.preparatory-measures.public-infrastructure-development.waste-disposal"
Other (Public Infrastructure) = "semio.global-life-cycle-costs.life-cycle-costs.investment-costs-construction-phase.development-costs.preparatory-measures.public-infrastructure-development.other"
Private Infrastructure Development = "semio.global-life-cycle-costs.life-cycle-costs.investment-costs-construction-phase.development-costs.private-infrastructure-development"
Compensatory Measures and Levies = "semio.global-life-cycle-costs.life-cycle-costs.investment-costs-construction-phase.development-costs.compensatory-measures-and-levies"
Compensatory Measures = "semio.global-life-cycle-costs.life-cycle-costs.investment-costs-construction-phase.development-costs.compensatory-measures-and-levies.compensatory-measures"
Compensatory Levies = "semio.global-life-cycle-costs.life-cycle-costs.investment-costs-construction-phase.development-costs.compensatory-measures-and-levies.compensatory-levies"
Other (Compensatory Measures and Levies) = "semio.global-life-cycle-costs.life-cycle-costs.investment-costs-construction-phase.development-costs.compensatory-measures-and-levies.other"
Transitional Measures = "semio.global-life-cycle-costs.life-cycle-costs.investment-costs-construction-phase.development-costs.transitional-measures"
Structural Measures = "semio.global-life-cycle-costs.life-cycle-costs.investment-costs-construction-phase.development-costs.transitional-measures.structural-measures"
Organizational Measures = "semio.global-life-cycle-costs.life-cycle-costs.investment-costs-construction-phase.development-costs.transitional-measures.organizational-measures"
Other (Transitional Measures) = "semio.global-life-cycle-costs.life-cycle-costs.investment-costs-construction-phase.development-costs.transitional-measures.other"
Other (Development Costs) = "semio.global-life-cycle-costs.life-cycle-costs.investment-costs-construction-phase.development-costs.other"
Building Structural Components = "semio.global-life-cycle-costs.life-cycle-costs.investment-costs-construction-phase.building-structural-components"
Excavation Earthworks = "semio.global-life-cycle-costs.life-cycle-costs.investment-costs-construction-phase.building-structural-components.excavation-earthworks"
Construction (Excavation) = "semio.global-life-cycle-costs.life-cycle-costs.investment-costs-construction-phase.building-structural-components.excavation-earthworks.construction"
Enclosure (Excavation) = "semio.global-life-cycle-costs.life-cycle-costs.investment-costs-construction-phase.building-structural-components.excavation-earthworks.enclosure"
Water Management (Excavation) = "semio.global-life-cycle-costs.life-cycle-costs.investment-costs-construction-phase.building-structural-components.excavation-earthworks.water-management"
Conveyance (Excavation) = "semio.global-life-cycle-costs.life-cycle-costs.investment-costs-construction-phase.building-structural-components.excavation-earthworks.conveyance"
Other (Excavation Earthworks) = "semio.global-life-cycle-costs.life-cycle-costs.investment-costs-construction-phase.building-structural-components.excavation-earthworks.other"
Foundation Substructure = "semio.global-life-cycle-costs.life-cycle-costs.investment-costs-construction-phase.building-structural-components.foundation-substructure"
Soil Improvement = "semio.global-life-cycle-costs.life-cycle-costs.investment-costs-construction-phase.building-structural-components.foundation-substructure.soil-improvement"
Shallow Foundations and Slabs = "semio.global-life-cycle-costs.life-cycle-costs.investment-costs-construction-phase.building-structural-components.foundation-substructure.shallow-foundations-and-slabs"
Deep Foundations = "semio.global-life-cycle-costs.life-cycle-costs.investment-costs-construction-phase.building-structural-components.foundation-substructure.deep-foundations"
Foundation Layers = "semio.global-life-cycle-costs.life-cycle-costs.investment-costs-construction-phase.building-structural-components.foundation-substructure.foundation-layers"
Seals and Linings = "semio.global-life-cycle-costs.life-cycle-costs.investment-costs-construction-phase.building-structural-components.foundation-substructure.seals-and-linings"
Drains = "semio.global-life-cycle-costs.life-cycle-costs.investment-costs-construction-phase.building-structural-components.foundation-substructure.drains"
Other (Foundation Substructure) = "semio.global-life-cycle-costs.life-cycle-costs.investment-costs-construction-phase.building-structural-components.foundation-substructure.other"
External Walls Vertical Structural Components Outside = "semio.global-life-cycle-costs.life-cycle-costs.investment-costs-construction-phase.building-structural-components.external-walls-vertical-structural-components-outside"
Load Bearing External Walls = "semio.global-life-cycle-costs.life-cycle-costs.investment-costs-construction-phase.building-structural-components.external-walls-vertical-structural-components-outside.load-bearing-external-walls"
Non Load Bearing External Walls = "semio.global-life-cycle-costs.life-cycle-costs.investment-costs-construction-phase.building-structural-components.external-walls-vertical-structural-components-outside.non-load-bearing-external-walls"
External Columns = "semio.global-life-cycle-costs.life-cycle-costs.investment-costs-construction-phase.building-structural-components.external-walls-vertical-structural-components-outside.external-columns"
External Wall Openings = "semio.global-life-cycle-costs.life-cycle-costs.investment-costs-construction-phase.building-structural-components.external-walls-vertical-structural-components-outside.external-wall-openings"
External Wall Claddings Outside = "semio.global-life-cycle-costs.life-cycle-costs.investment-costs-construction-phase.building-structural-components.external-walls-vertical-structural-components-outside.external-wall-claddings-outside"
External Wall Claddings Inside = "semio.global-life-cycle-costs.life-cycle-costs.investment-costs-construction-phase.building-structural-components.external-walls-vertical-structural-components-outside.external-wall-claddings-inside"
Prefabricated External Wall Structures = "semio.global-life-cycle-costs.life-cycle-costs.investment-costs-construction-phase.building-structural-components.external-walls-vertical-structural-components-outside.prefabricated-external-wall-structures"
Light Protection KG 330 = "semio.global-life-cycle-costs.life-cycle-costs.investment-costs-construction-phase.building-structural-components.external-walls-vertical-structural-components-outside.light-protection-kg-330"
Other (External Walls Outside) = "semio.global-life-cycle-costs.life-cycle-costs.investment-costs-construction-phase.building-structural-components.external-walls-vertical-structural-components-outside.other"
Internal Walls Vertical Structural Components Inside = "semio.global-life-cycle-costs.life-cycle-costs.investment-costs-construction-phase.building-structural-components.internal-walls-vertical-structural-components-inside"
Load Bearing Internal Walls = "semio.global-life-cycle-costs.life-cycle-costs.investment-costs-construction-phase.building-structural-components.internal-walls-vertical-structural-components-inside.load-bearing-internal-walls"
Non Load Bearing Internal Walls = "semio.global-life-cycle-costs.life-cycle-costs.investment-costs-construction-phase.building-structural-components.internal-walls-vertical-structural-components-inside.non-load-bearing-internal-walls"
Internal Columns = "semio.global-life-cycle-costs.life-cycle-costs.investment-costs-construction-phase.building-structural-components.internal-walls-vertical-structural-components-inside.internal-columns"
Internal Wall Openings = "semio.global-life-cycle-costs.life-cycle-costs.investment-costs-construction-phase.building-structural-components.internal-walls-vertical-structural-components-inside.internal-wall-openings"
Internal Wall Claddings = "semio.global-life-cycle-costs.life-cycle-costs.investment-costs-construction-phase.building-structural-components.internal-walls-vertical-structural-components-inside.internal-wall-claddings"
Prefabricated Internal Wall Structures = "semio.global-life-cycle-costs.life-cycle-costs.investment-costs-construction-phase.building-structural-components.internal-walls-vertical-structural-components-inside.prefabricated-internal-wall-structures"
Light Protection KG 340 = "semio.global-life-cycle-costs.life-cycle-costs.investment-costs-construction-phase.building-structural-components.internal-walls-vertical-structural-components-inside.light-protection-kg-340"
Other (Internal Walls Inside) = "semio.global-life-cycle-costs.life-cycle-costs.investment-costs-construction-phase.building-structural-components.internal-walls-vertical-structural-components-inside.other"
Ceilings Horizontal Structural Components = "semio.global-life-cycle-costs.life-cycle-costs.investment-costs-construction-phase.building-structural-components.ceilings-horizontal-structural-components"
Ceiling Structures = "semio.global-life-cycle-costs.life-cycle-costs.investment-costs-construction-phase.building-structural-components.ceilings-horizontal-structural-components.ceiling-structures"
Ceiling Openings = "semio.global-life-cycle-costs.life-cycle-costs.investment-costs-construction-phase.building-structural-components.ceilings-horizontal-structural-components.ceiling-openings"
Ceiling Finishes = "semio.global-life-cycle-costs.life-cycle-costs.investment-costs-construction-phase.building-structural-components.ceilings-horizontal-structural-components.ceiling-finishes"
Ceiling Linings = "semio.global-life-cycle-costs.life-cycle-costs.investment-costs-construction-phase.building-structural-components.ceilings-horizontal-structural-components.ceiling-linings"
Prefabricated Ceiling Structures = "semio.global-life-cycle-costs.life-cycle-costs.investment-costs-construction-phase.building-structural-components.ceilings-horizontal-structural-components.prefabricated-ceiling-structures"
Other (Ceilings) = "semio.global-life-cycle-costs.life-cycle-costs.investment-costs-construction-phase.building-structural-components.ceilings-horizontal-structural-components.other"
Roofs = "semio.global-life-cycle-costs.life-cycle-costs.investment-costs-construction-phase.building-structural-components.roofs"
Roof Structures = "semio.global-life-cycle-costs.life-cycle-costs.investment-costs-construction-phase.building-structural-components.roofs.roof-structures"
Roof Openings = "semio.global-life-cycle-costs.life-cycle-costs.investment-costs-construction-phase.building-structural-components.roofs.roof-openings"
Roof Finishes = "semio.global-life-cycle-costs.life-cycle-costs.investment-costs-construction-phase.building-structural-components.roofs.roof-finishes"
Roof Linings = "semio.global-life-cycle-costs.life-cycle-costs.investment-costs-construction-phase.building-structural-components.roofs.roof-linings"
Prefabricated Roof Structures = "semio.global-life-cycle-costs.life-cycle-costs.investment-costs-construction-phase.building-structural-components.roofs.prefabricated-roof-structures"
Light Protection KG 360 = "semio.global-life-cycle-costs.life-cycle-costs.investment-costs-construction-phase.building-structural-components.roofs.light-protection-kg-360"
Other (Roofs) = "semio.global-life-cycle-costs.life-cycle-costs.investment-costs-construction-phase.building-structural-components.roofs.other"
Infrastructure Facilities = "semio.global-life-cycle-costs.life-cycle-costs.investment-costs-construction-phase.building-structural-components.infrastructure-facilities"
Road Traffic Facilities = "semio.global-life-cycle-costs.life-cycle-costs.investment-costs-construction-phase.building-structural-components.infrastructure-facilities.road-traffic-facilities"
Rail Traffic Facilities = "semio.global-life-cycle-costs.life-cycle-costs.investment-costs-construction-phase.building-structural-components.infrastructure-facilities.rail-traffic-facilities"
Air Traffic Facilities = "semio.global-life-cycle-costs.life-cycle-costs.investment-costs-construction-phase.building-structural-components.infrastructure-facilities.air-traffic-facilities"
Water Construction Facilities = "semio.global-life-cycle-costs.life-cycle-costs.investment-costs-construction-phase.building-structural-components.infrastructure-facilities.water-construction-facilities"
Wastewater Disposal Facilities = "semio.global-life-cycle-costs.life-cycle-costs.investment-costs-construction-phase.building-structural-components.infrastructure-facilities.wastewater-disposal-facilities"
Water Supply Facilities = "semio.global-life-cycle-costs.life-cycle-costs.investment-costs-construction-phase.building-structural-components.infrastructure-facilities.water-supply-facilities"
Energy and Information Supply Facilities = "semio.global-life-cycle-costs.life-cycle-costs.investment-costs-construction-phase.building-structural-components.infrastructure-facilities.energy-and-information-supply-facilities"
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""")
filter = StreamFilter(Gate=imperial_2, Stream0=merge_4, Stream1=merge_3)
item = ListItem(List=panel_7, Index=itemindex, Wrap=True)
expression_7 = Expression(x="kWh/a", Expression="x")
expression_8 = Expression(x="m³", Expression="x")
null = NullItem(Item=itemindex)  # -> NullFlags, InvalidFlags, Description
item_2 = ListItem(List=filter, Index=itemindex, Wrap=True)
panel_9 = Panel("Suggestion: Please use a standard name from one of the § lists")
qal = ModelQuality(Name=na_2, Value=value_2, Unit=item_2, Definition=item)  # -> Quality, Valid, Name, Value, Unit, Definition
expression_9 = Expression(x="kBtu/a", Expression="x")
expression_10 = Expression(x="ft³", Expression="x")
expression_11 = Expression(x="MtCO₂e", Expression="x")
na_3 = Name(na)
filter_2 = StreamFilter(Gate=null.NullFlags, Stream0=qal.Quality)
ql = Quality(filter_2)
concat = Concatenate(
    FragmentF="Error:",
    FragmentE=" QualityNameNotStandard",
    FragmentA="Info: The provided Name (",
    FragmentB=na_3,
    FragmentC=") is not a standard Name",
    FragmentD=panel_9)
log = Text(concat)
filter_3 = StreamFilter(Gate=null.NullFlags, Stream1=log)
lg = Log(filter_3)
ql_2 = ClusterOutput(ql)
lg_2 = ClusterOutput(lg)

# ==== cluster ExportBlock: Export geometry with layer names to a file.
dc = ClusterInput()
layer_n = ClusterInput()
path = ClusterInput()
name = ClusterInput()
url = ClusterInput()
geo = ClusterInput()
export = ClusterInput()
url_2 = Text(url)
path_2 = FilePath(path)
name_2 = Text(name)
geo_2 = Geometry(geo)
export_2 = Boolean(export)
layer_n_2 = Name(layer_n)
dc_2 = DisplayColour(dc)
layer = ModelLayer(Name=layer_n_2, DisplayColour=dc_2)  # -> Layer, Name, Hidden, Locked, DisplayColour, Material, Linetype, PrintColour, PrintWidth
object = ModelObject(Geometry=geo_2, Layer=layer.Layer)  # -> Object, Geometry, Name, Layer, Visibility, Display, Drafting, Render
block_definition = ModelBlockDefinition(Objects=object.Object, Name=name_2, URL=url_2)  # -> BlockDefinition, Objects, Units, Name, Notes, URL, URLDescription
export_definition = ExportModelBlockDefinition(BlockDefinition=block_definition.BlockDefinition, FilePath=path_2, Overwrite="T", Export=export_2)  # -> BlockDefinition, FilePath, Exported
block_definition_2 = ModelBlockDefinition(export_definition.BlockDefinition)
path_3 = FilePath(export_definition.FilePath)
exported = Boolean(export_definition.Exported)
path_4 = ClusterOutput(path_3)
exported_2 = ClusterOutput(exported)
block_definition_3 = ClusterOutput(block_definition_2)

# ==== cluster JaccardIndex: Compute the Jaccard Index of two sets.
set1 = ClusterInput()
set2 = ClusterInput()
set1_2 = Data(set1)
set2_2 = Data(set2)
lng = ListLength(List=flatten(set1_2))
cset = CreateSet(List=set2_2)  # -> Set, Map
cset_2 = CreateSet(List=set1_2)  # -> Set, Map
intersection = SetIntersection(SetA=cset_2.Set, SetB=cset.Set)
expression = Expression(x=lng, Expression="x=0")
sunion = SetUnion(SetA=cset_2.Set, SetB=cset.Set)
null = NullItem(Item=lng)  # -> NullFlags, InvalidFlags, Description
lng_2 = ListLength(List=intersection)
lng_3 = ListLength(List=sunion)
or = GateOr(A=null.NullFlags, B=expression)
better_filter = BetterFilter(i=or, a=lng_2, b="0")  # -> R; inputs i: tree of Int32, a: tree, b: tree, c: tree, d: tree
# ---------- better_filter: C# ----------
// Grasshopper Script Instance
#region Usings
using System;
using System.Linq;
using System.Collections;
using System.Collections.Generic;
using System.Drawing;

using Rhino;
using Rhino.Geometry;

using Grasshopper;
using Grasshopper.Kernel;
using Grasshopper.Kernel.Data;
using Grasshopper.Kernel.Types;
#endregion

public class Script_Instance : GH_ScriptInstance
{
    private void RunScript(
	DataTree<int> i,
	DataTree<object> a,
	DataTree<object> b,
	DataTree<object> c,
	DataTree<object> d,
	ref object R)
    {
        foreach (var branch in i.Branches)
        {
            foreach (var index in branch)
            {
                switch (index)
                {
                    case 0:
                        R = a;
                        break;
                    case 1:
                        R = b;
                        break;
                    case 2:
                        R = c;
                        break;
                    case 3:
                        R = d;
                        break;
                    default:
                        throw new ArgumentOutOfRangeException(nameof(i), "Invalid value for i");
                }
            }
            
        }
       
    }
}
# ---------- end better_filter ----------
division = Division(A=better_filter, B=lng_3)
N = Number(division)
N_2 = ClusterOutput(N)

# ==== cluster SelectRoot: Select a root piece. A piece is a root when it has a plane (and a center).
pc = ClusterInput()
pc_2 = Piece(pc)
lng = ListLength(List=pc_2)
pce = ModelPiece(Piece=pc_2)  # -> Piece, Valid, Id, Description, TypeName, TypeVariant, Plane, Center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
series = Series(Start=0, Step=1, Count=lng)
trim = TrimTree(Tree=series, Depth=1)
null = NullItem(Item=pce.Plane)  # -> NullFlags, InvalidFlags, Description
dispatch = Dispatch(List=pc_2, DispatchPattern=null.NullFlags)  # -> ListA, ListB
dispatch_2 = Dispatch(List=trim, DispatchPattern=null.NullFlags)  # -> ListA, ListB
ro = Piece(dispatch.ListB)
i = Integer(dispatch_2.ListB)
ro_2 = ClusterOutput(ro)
i_2 = ClusterOutput(i)

# ==== cluster DesignToBlock: Bake the design to blocks: by selecting a representation with mime and tags and turn it to block-definitions and flatten the design and turn every piece into a block-definition with the plane as it transform.
dn = ClusterInput()
ty = ClusterInput()
ob = ClusterInput()
mm = ClusterInput()
tags = ClusterInput()
dn_2 = Design(dn)
ob_2 = Data(ob)
ty_2 = Type(ty)
mm_2 = Mime(mm)
tags_2 = Tags(tags)
dsn = ModelDesign(Pieces=ty_2)  # -> Design, Valid, Name, Description, Icon, Image, Variant, View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
fltdsn = FlattenDesign(Design=dn_2, Types=ty_2)
dsn_modified = ShowDesign(dn=dsn.Design, ty=ty_2, ob=ob_2, mm=mm_2, tags=tags_2)  # -> object_2, id_2, rp_2, pln_2
dsn_2 = ModelDesign(Design=fltdsn)  # -> Design, Valid, Name, Description, Icon, Image, Variant, View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
trim = TrimTree(Tree=dsn_2.Pieces, Depth=1)
tstat = TreeStatistics(Tree=dsn_modified.object_2)  # -> Paths, Length, Count
ty_3 = Type(trim)
txt = Text(ty_3)
cset = CreateSet(List=txt)  # -> Set, Map
txt_2 = Text(ty_2)
mindex = MemberIndex(Set=txt_2, Member=cset.Set)  # -> Index, Count
trim_2 = TrimTree(Tree=mindex.Index, Depth=1)
item = ListItem(List=dsn_modified.rp_2, Index=trim_2, Wrap=True)
item_2 = ListItem(List=tstat.Paths, Index=trim_2, Wrap=True)
rep = ModelRepresentation(Representation=item)  # -> Representation, Valid, Url, Description, Tags, Qualities
branch = TreeBranch(Tree=dsn_modified.object_2, Path=item_2, MaintainPaths=False)
item_3 = ListItem(List=ty_2, Index=trim_2, Wrap=True)
typ = SerializeType(Type=item_3)
typ_2 = ModelType(Type=item_3)  # -> Type, Valid, Name, Description, Icon, Image, Variant, Stock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
block_definition = ModelBlockDefinition(Objects=branch, Name=graft(item_3), Notes=graft(typ), URL=graft(rep.Url), URLDescription=graft(typ_2.Description))  # -> BlockDefinition, Objects, Units, Name, Notes, URL, URLDescription
pce = ModelPiece(Piece=trim)  # -> Piece, Valid, Id, Description, TypeName, TypeVariant, Plane, Center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
typ_3 = SelectType(ty=ty_2, na=graft(pce.TypeName), variant=graft(pce.TypeVariant))  # -> ty_4, i_2
orient = Orient(Source=PlaneXY(0, 0, 0), Target=pce.Plane)  # -> Geometry, Transform
trim_3 = TrimTree(Tree=block_definition.BlockDefinition, Depth=1)
trim_4 = TrimTree(Tree=typ_3.i_2, Depth=1)
item_4 = ListItem(List=trim_3, Index=trim_4, Wrap=True)
block_instance = ModelBlockInstance(Transform=orient.Transform, BlockDefinition=item_4)  # -> BlockInstance, Transform, BlockDefinition
block_instance_2 = BlockInstance(block_instance.BlockInstance)
i = Integer(trim_4)
block_definition_2 = ModelBlockDefinition(trim_3)
block_definition_3 = ClusterOutput(block_definition_2)
block_instance_3 = ClusterOutput(block_instance_2)
i_2 = ClusterOutput(i)

# ==== cluster PiecesToGroup: Convert every piece to a group. If you need more a sophisticated approach where you can switch between represenstations and don't waste space use: Design to Block
ty = ClusterInput()
dn = ClusterInput()
gr = ClusterInput()
dn_2 = Design(graft(dn))
ty_2 = Type(ty)
gr_2 = Group(gr)
fltdsn = FlattenDesign(Design=dn_2, Type=ty_2)
dsn = ModelDesign(Design=fltdsn)  # -> Design, Valid, Name, Description, Icon, Image, Variant, View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
trim = TrimTree(Tree=dsn.Pieces, Depth=1)
typ = SelectTypeByPiece(ty=ty_2, pc=trim)  # -> ty_4, i_2
item = ListItem(List=gr_2, Index=typ.i_2, Wrap=True)
pce = ModelPiece(Piece=dsn.Pieces)  # -> Piece, Valid, Id, Description, TypeName, TypeVariant, Plane, Center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
trim_2 = TrimTree(Tree=item, Depth=1)
orient = Orient(Geometry=trim_2, Source=PlaneXY(0, 0, 0), Target=pce.Plane)  # -> Geometry, Transform
gr_3 = Group(orient.Geometry)
gr_4 = ClusterOutput(gr_3)

# ==== cluster TypesToModules: Convert semio types to Monoceros modules.
ty = ClusterInput()
ob = ClusterInput()
D = ClusterInput()
ty_2 = Type(graft(ty))
ob_2 = Data(ob)
D_2 = ModulePartDiagonal(D)
typ = ModelType(Type=ty_2)  # -> Type, Valid, Name, Description, Icon, Image, Variant, Stock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
panel = Panel("""e
n
t
w
s
b""")
trim = TrimTree(Tree=typ.Qualities, Depth=1)
trim_2 = TrimTree(Tree=typ.Ports, Depth=1)
qal = SelectQuality(ql=trim, na="monoceros.module.center")
por = SelectPort(po=trim_2, id="e")  # -> po_4, i_2
por_2 = SelectPort(po=trim_2, id="n")  # -> po_4, i_2
por_3 = SelectPort(po=trim_2, id="t")  # -> po_4, i_2
por_4 = SelectPort(po=trim_2, id="w")  # -> po_4, i_2
por_5 = SelectPort(po=trim_2, id="s")  # -> po_4, i_2
por_6 = SelectPort(po=trim_2, id="b")  # -> po_4, i_2
qal_2 = ModelQuality(Quality=qal)  # -> Quality, Valid, Name, graft(Value), Unit, Definition
merge = Merge(
    Data1=graft(por.po_4),
    Data2=graft(por_2.po_4),
    Data3=graft(por_3.po_4),
    Data4=graft(por_4.po_4),
    Data5=graft(por_5.po_4),
    Data6=graft(por_6.po_4))
txt = Text(ty_2)
constmodule = ConstructModule(ModuleName=txt, ModulePartPoints=qal_2.Value, Geometry=ob_2, BasePlane=qal_2.Value, ModulePartDiagonal=D_2)
por_7 = ModelPort(Port=merge)  # -> Port, Valid, Id, Description, Mandatory, Family, CompatibleFamilies, Point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
M = Module(constmodule)
item = ListItem(List=por_7.CompatibleFamilies, Index=0, Wrap=True)
series = Series(Start=0, Step=1, Count="6")  # -> flatten(Series)
qal_3 = SelectQuality(ql=por_7.Qualities, na="monoceros.connector.out")
chars = Characters(Text=item)  # -> reverse(Result), Unicode
null = NullItem(Item=merge)  # -> NullFlags, InvalidFlags, Description
cull = CullPattern(List=series, CullPattern=invert(null.NullFlags))
cull_2 = CullPattern(List=por_7.Point, CullPattern=invert(null.NullFlags))
cull_3 = CullPattern(List=qal_3, CullPattern=invert(null.NullFlags))
trim_3 = TrimTree(Tree=chars.Result, Depth=1)
join = TextJoin(Text=trim_3)
qal_4 = ModelQuality(Quality=cull_3)  # -> Quality, Valid, Name, Value, Unit, Definition
concat = Concatenate(FragmentA=graft(por_7.Family), FragmentC="##", FragmentB=join)
cull_4 = CullPattern(List=cull_2, CullPattern=qal_4.Value)
trim_4 = TrimTree(Tree=concat, Depth=1)
expression = Expression(x=trim_4, y="indifferent", z="##", Expression="If(x=z,y,x)")
cull_5 = CullPattern(List=expression, CullPattern=invert(null.NullFlags))
ruletyp = ConstructTypedRule(ModuleName=txt, ConnectorIndex=cull, Type=cull_5)
ruleboundpt = RuleAtBoundaryFromPoint(Modules=M, PointTag=cull_4)
trim_5 = TrimTree(Tree=ruleboundpt, Depth=1)
merge_2 = Merge(Data1=ruletyp, Data2=trim_5)
ruleindiffunused = IndifferentRulesForUnusedConnectors(Module=M, Rules=merge_2)
trim_6 = TrimTree(Tree=ruleindiffunused, Depth=1)
merge_3 = Merge(Data1=merge_2, Data2=trim_6)
mod = Mod(M=M, R=merge_3, rt=[False, False, False, False, False, False, True, True, True])  # -> M_4, R_4
trim_7 = TrimTree(Tree=mod.R_4, Depth=1)
isruleexp = IsRuleExplicit(Rule=trim_7)
dispatch = Dispatch(List=trim_7, DispatchPattern=isruleexp)  # -> ListA, ListB
deconruletyp = DeconstructTypedRule(Rule=dispatch.ListB)  # -> ModuleName, ConnectorIndex, Type
equals = Equality(FirstNumber=deconruletyp.ConnectorIndex, SecondNumber="4")  # -> Equality, Inequality
equals_2 = Equality(FirstNumber=deconruletyp.ConnectorIndex, SecondNumber="5")  # -> Equality, Inequality
equals_3 = Equality(FirstNumber=deconruletyp.ConnectorIndex, SecondNumber="1")  # -> Equality, Inequality
equals_4 = Equality(FirstNumber=deconruletyp.ConnectorIndex, SecondNumber="2")  # -> Equality, Inequality
equals_5 = Equality(FirstNumber=deconruletyp.ConnectorIndex, SecondNumber="3")  # -> Equality, Inequality
cull_6 = CullPattern(List=dispatch.ListB, CullPattern=equals_5.Equality)
equals_6 = Equality(FirstNumber=deconruletyp.ConnectorIndex, SecondNumber="0")  # -> Equality, Inequality
cull_7 = CullPattern(List=dispatch.ListB, CullPattern=equals_6.Inequality)
cull_8 = CullPattern(List=deconruletyp.Type, CullPattern=equals.Equality)
cull_9 = CullPattern(List=deconruletyp.Type, CullPattern=equals_2.Equality)
cull_10 = CullPattern(List=deconruletyp.ModuleName, CullPattern=equals.Equality)
cull_11 = CullPattern(List=deconruletyp.ModuleName, CullPattern=equals_2.Equality)
cull_12 = CullPattern(List=deconruletyp.Type, CullPattern=equals_3.Equality)
cull_13 = CullPattern(List=deconruletyp.Type, CullPattern=equals_4.Equality)
cull_14 = CullPattern(List=deconruletyp.Type, CullPattern=equals_5.Equality)
cull_15 = CullPattern(List=deconruletyp.ModuleName, CullPattern=equals_5.Equality)
cull_16 = CullPattern(List=deconruletyp.Type, CullPattern=equals_6.Equality)
chars_2 = Characters(Text=cull_8)  # -> reverse(Result), Unicode
chars_3 = Characters(Text=cull_9)  # -> reverse(Result), Unicode
chars_4 = Characters(Text=cull_14)  # -> reverse(Result), Unicode
cset = CreateSet(List=flatten(cull_12))  # -> Set, Map
cset_2 = CreateSet(List=flatten(cull_13))  # -> Set, Map
cset_3 = CreateSet(List=flatten(cull_16))  # -> Set, Map
join_2 = TextJoin(Text=chars_2.Result)
join_3 = TextJoin(Text=chars_3.Result)
join_4 = TextJoin(Text=chars_4.Result)
trim_8 = TrimTree(Tree=join_4, Depth=1)
expression_2 = Expression(x=graft(cset.Set), y=flatten(join_2), Expression="x=y")
expression_3 = Expression(x=graft(cset_2.Set), y=flatten(join_3), Expression="x=y")
expression_4 = Expression(x=graft(cset_3.Set), y=flatten(join_4), Expression="x=y")
cull_17 = CullPattern(List=flatten(join_2), CullPattern=expression_2)
cull_18 = CullPattern(List=flatten(join_3), CullPattern=expression_3)
cull_19 = CullPattern(List=flatten(join_4), CullPattern=expression_4)
cull_20 = CullPattern(List=flatten(cull_10), CullPattern=expression_2)
cull_21 = CullPattern(List=flatten(cull_11), CullPattern=expression_3)
cull_22 = CullPattern(List=flatten(cull_15), CullPattern=expression_4)
ruletyp_2 = ConstructTypedRule(ModuleName=cull_20, ConnectorIndex="4", Type=cull_17)
ruletyp_3 = ConstructTypedRule(ModuleName=cull_21, ConnectorIndex="5", Type=cull_18)
ruletyp_4 = ConstructTypedRule(ModuleName=cull_22, ConnectorIndex="3", Type=cull_19)
merge_4 = Merge(Data1=graft(ruletyp_4), Data2=graft(ruletyp_2), Data3=graft(ruletyp_3))
merge_5 = Merge(Data1=graft(dispatch.ListA), Data2=mod.R_4)
rule = ReplaceRule(R=flatten(merge_5), rule=flatten(merge_4))
M_2 = Module(mod.M_4)
collectrules = CollectRules(Modules=flatten(M_2), RulesAllowed=rule)
R = Rule(collectrules)
R_2 = ClusterOutput(R)
M_3 = ClusterOutput(M_2)

# ==== cluster SlotsToDesign: Convert Monoceros slots to a semio design.
S = ClusterInput()
ty = ClusterInput()
S_2 = Slot(S)
ty_2 = Type(ty)
deconslot = DeconstructSlot(Slot=S_2)  # -> Center, BasePlane, Diagonal, AllowedModuleNames, IsDeterministic, AllowsAllModules, AllowsNothing, IsValid
trim = TrimTree(Tree=deconslot.BasePlane, Depth=1)
trim_2 = TrimTree(Tree=deconslot.Center, Depth=1)
txt = Text(deconslot.AllowedModuleNames)

pt = ConstructPoint(XCoordinate=0, YCoordinate=0, ZCoordinate=0)
txt_2 = Text(ty_2)
dup = DuplicateData(Data=graft(ty_2), Number="10", Order=True)
constmodule = ConstructModule(ModuleName=txt_2, ModulePartPoints=pt, BasePlane=PlaneXY(0, 0, 0), ModulePartDiagonal=Vector(1, 1, 1))
trim_3 = TrimTree(Tree=dup, Depth=1)
deconmodule = DeconstructModule(Module=constmodule)  # -> ModuleName, ModulePartCenterPoints, Geometry, BasePlane, ModulePartDiagonal, IsCompact, IsValid, Connectors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
trim_4 = TrimTree(Tree=trim_3, Depth=1)
trim_5 = TrimTree(Tree=deconmodule.ModuleName, Depth=1)
txt_3 = Text(trim_5)
concat = Concatenate(FragmentA=txt_3, FragmentB="↺", FragmentC="90", FragmentD="°", FragmentE="x")
concat_2 = Concatenate(FragmentA=txt_3, FragmentB="↺", FragmentC="90", FragmentD="°", FragmentE="y")
concat_3 = Concatenate(FragmentA=txt_3, FragmentB="↺", FragmentC="90", FragmentD="°", FragmentE="z")
concat_4 = Concatenate(FragmentA=txt_3, FragmentB="↺", FragmentC="180", FragmentD="°", FragmentE="x")
concat_5 = Concatenate(FragmentA=txt_3, FragmentB="↺", FragmentC="180", FragmentD="°", FragmentE="y")
concat_6 = Concatenate(FragmentA=txt_3, FragmentB="↺", FragmentC="180", FragmentD="°", FragmentE="z")
concat_7 = Concatenate(FragmentA=txt_3, FragmentB="↺", FragmentC="270", FragmentD="°", FragmentE="x")
concat_8 = Concatenate(FragmentA=txt_3, FragmentB="↺", FragmentC="270", FragmentD="°", FragmentE="y")
concat_9 = Concatenate(FragmentA=txt_3, FragmentB="↺", FragmentC="270", FragmentD="°", FragmentE="z")
merge = Merge(
    Data1=graft(txt_3),
    Data2=graft(concat),
    Data3=graft(concat_2),
    Data4=graft(concat_3),
    Data5=graft(concat_4),
    Data6=graft(concat_5),
    Data7=graft(concat_6),
    Data8=graft(concat_7),
    Data9=graft(concat_8),
    Data10=graft(concat_9))
item = ListItem(List=txt, Index=0, Wrap=True)
trim_6 = TrimTree(Tree=item, Depth=1)
trim_7 = TrimTree(Tree=merge, Depth=1)
lng = ListLength(List=trim_7)
series = Series(Start=0, Step=1, Count=lng)
expression = Expression(x=trim_6, y=merge, Expression="x=y")
trim_8 = TrimTree(Tree=series, Depth=1)
keysearch = KeyValueSearch(Keys=trim_7, Values=trim_8, Search=trim_6)
expression_2 = Expression(x=keysearch, Expression="x%10")
item_2 = ListItem(List=trim_4, Index=keysearch, Wrap=True)
ty_3 = Type(item_2)
rt = Integer(expression_2)

orient = Orient(Geometry=trim_2, Source=trim, Target=PlaneXY(0, 0, 0))  # -> Geometry, Transform
xz = XZPlane(Origin=Point(0, 0, 0))
yz = YZPlane(Origin=Point(0, 0, 0))
xy = XYPlane(Origin=Point(0, 0, 0))
transform = Transform(0)
rotate = Rotate(Angle=degrees("90"), Plane=xy)  # -> Geometry, Transform
rotate_2 = Rotate(Angle=degrees("90"), Plane=yz)  # -> Geometry, Transform
rotate_3 = Rotate(Angle=degrees("90"), Plane=xz)  # -> Geometry, Transform
rotate_4 = Rotate(Angle=degrees("180"), Plane=xy)  # -> Geometry, Transform
rotate_5 = Rotate(Angle=degrees("180"), Plane=yz)  # -> Geometry, Transform
rotate_6 = Rotate(Angle=degrees("180"), Plane=xz)  # -> Geometry, Transform
rotate_7 = Rotate(Angle=degrees("270"), Plane=xy)  # -> Geometry, Transform
rotate_8 = Rotate(Angle=degrees("270"), Plane=yz)  # -> Geometry, Transform
rotate_9 = Rotate(Angle=degrees("270"), Plane=xz)  # -> Geometry, Transform
merge_2 = Merge(
    Data1=graft(transform),
    Data2=graft(rotate_2.Transform),
    Data3=graft(rotate_3.Transform),
    Data4=graft(rotate.Transform),
    Data5=graft(rotate_5.Transform),
    Data6=graft(rotate_6.Transform),
    Data7=graft(rotate_4.Transform),
    Data8=graft(rotate_8.Transform),
    Data9=graft(rotate_9.Transform),
    Data10=graft(rotate_7.Transform))
item_3 = ListItem(List=merge_2, Index=rt, Wrap=True)
xy_2 = XYPlane(Origin=Point(0, 0, 0))
c_script = CSharpScript(X=item_3)  # -> T, R, I; inputs X: Transform
# ---------- c_script: C# ----------
// Grasshopper Script Instance
#region Usings
using System;
using System.Linq;
using System.Collections;
using System.Collections.Generic;
using System.Drawing;

using Rhino;
using Rhino.Geometry;

using Grasshopper;
using Grasshopper.Kernel;
using Grasshopper.Kernel.Data;
using Grasshopper.Kernel.Types;
#endregion

public class Script_Instance : GH_ScriptInstance
{
    #region Notes
    /* 
      Members:
        RhinoDoc RhinoDocument
        GH_Document GrasshopperDocument
        IGH_Component Component
        int Iteration

      Methods (Virtual & overridable):
        Print(string text)
        Print(string format, params object[] args)
        Reflect(object obj)
        Reflect(object obj, string method_name)
    */
    #endregion

    private void RunScript(Transform X, ref object T, ref object R, ref object I)
    {
        var i = new Transform();
        T = X.TryGetInverse(out i);
        var translation = new Vector3d();
        var rotation = new Transform();
        var orthogonal = new Transform();
        var diagonal = new Vector3d();
        X.DecomposeAffine(out translation, out rotation, out orthogonal,out diagonal);
        T = translation;
        R = rotation;
        I = i;
    }
}
# ---------- end c_script ----------
transform_2 = Transform(Geometry=xy_2, Transform=c_script.R)
pl_origin = PlaneOrigin(Base=transform_2, Origin=orient.Geometry)
pce = ModelPiece(Piece=ty_3, Id=orient.Geometry, Plane=pl_origin)  # -> Piece, Valid, Id, Description, TypeName, TypeVariant, Plane, Center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
dsn = ModelDesign(Pieces=pce.Piece)  # -> Design, Valid, Name, Description, Icon, Image, Variant, View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
dn = Design(dsn.Design)
dn_2 = ClusterOutput(dn)

# ==== cluster CacheKit: Cache a kit by downloading the remote kit with all remote representations.
uri = ClusterInput()
R = ClusterInput()
R_2 = Run(R)
uri_2 = Uri(uri)
kit = LoadKit(Uri=uri_2, Run=R_2)  # -> Success, Kit, LocalDirectory
sep = Separator()  # -> S; same code as sep
kit_2 = ModelKit(Kit=kit.Kit)  # -> Kit, Valid, Name, Description, Icon, Image, Preview, Version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
trim = TrimTree(Tree=kit_2.Types, Depth=1)
typ = ModelType(Type=trim)  # -> Type, Valid, Name, Description, Icon, Image, Variant, Stock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
rep = ModelRepresentation(Representation=typ.Representations)  # -> Representation, Valid, Url, Description, Tags, Qualities
tmatch = MatchText(Text=rep.Url, Pattern="http*", Case=True)
dispatch = Dispatch(List=rep.Url, DispatchPattern=tmatch)  # -> ListA, ListB
rep_2 = ReplaceText(Text=dispatch.ListB, Find="/", Replace=sep, RecursiveReplace=False)
rep_3 = CacheRepresentation(Url=dispatch.ListA, Run=R_2)  # -> Path, Success
concat = Concatenate(FragmentA=kit.LocalDirectory, FragmentB=sep, FragmentC=rep_2)
weave = Weave(Pattern=tmatch, Stream0=concat, Stream1=rep_3.Path, NullGaps=False)
import = ImportContent(FilePath=weave, Import=R_2)  # -> ModelTransform, Objects, Layers, Linetypes, HatchPatterns, AnnotationStyles, Materials, BlockDefinitions
objects = Data(import.Objects)
ur = Url(rep.Url)
urpa = Url(weave)
urpalc = Url(concat)
urpare = Url(rep_3.Path)
ty = Type(trim)
objects_2 = ClusterOutput(objects)
urpa_2 = ClusterOutput(urpa)
urpalc_2 = ClusterOutput(urpalc)
urpare_2 = ClusterOutput(urpare)
ty_2 = ClusterOutput(ty)
ur_2 = ClusterOutput(ur)

# ==== cluster LoadDesign: Load the design. If the representations are urls to files then the objects are loaded for a certain level of details and tags.
uri = ClusterInput()
na = ClusterInput()
variant = ClusterInput()
view = ClusterInput()
mm = ClusterInput()
lod = ClusterInput()
tags = ClusterInput()
R = ClusterInput()
view_2 = View(view)
uri_2 = Uri(uri)
na_2 = Name(na)
variant_2 = Variant(variant)
mm_2 = Mime(mm)
lod_2 = Lod(lod)
tags_2 = Tags(tags)
R_2 = Run(R)
kit = LoadKit(Uri=uri_2, Run=R_2)  # -> Success, Kit, LocalDirectory
kit_2 = ModelKit(Kit=kit.Kit)  # -> Kit, Valid, Name, Description, Icon, Image, Preview, Version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
trim = TrimTree(Tree=kit_2.Designs, Depth=1)
seldsn = SelectDesign(dn=trim, na=na_2, variant=variant_2, view=view_2)
trim_2 = TrimTree(Tree=kit_2.Types, Depth=1)
shwdsn = ShowDesign_2(dn=seldsn, ty=trim_2, mm=mm_2, lod=lod_2, tags=tags_2)  # -> id_2, ur_2, pa_ur_2, pln_2
sep = Separator()  # -> S; same code as sep
concat = Concatenate(FragmentA=kit.LocalDirectory, FragmentB=sep, FragmentC=shwdsn.pa_ur_2)
geo = LoadGeometry(path=concat, pln=shwdsn.pln_2, run=R_2)  # -> object_4, col_2, shader_2
pln = Plane(flatten(shwdsn.pln_2))
dn = Design(seldsn)
object = ModelObject(geo.object_4)
shader = Shader(geo.shader_2)
ur = Url(shwdsn.ur_2)
path = FilePath(concat)
id = Id(shwdsn.id_2)
dn_2 = ClusterOutput(dn)
object_2 = ClusterOutput(object)
shader_2 = ClusterOutput(shader)
ur_2 = ClusterOutput(ur)
path_2 = ClusterOutput(path)
id_2 = ClusterOutput(id)
pln_2 = ClusterOutput(pln)

# ==== cluster LoadType: Load the type. If the representations are urls to files then the geometry is loaded for a certain level of details and tags.
uri = ClusterInput()
na = ClusterInput()
variant = ClusterInput()
mm = ClusterInput()
lod = ClusterInput()
tags = ClusterInput()
R = ClusterInput()
uri_2 = Uri(uri)
na_2 = Name(na)
variant_2 = Variant(variant)
mm_2 = Mime(mm)
lod_2 = Lod(lod)
tags_2 = Tags(tags)
R_2 = Run(R)
kit = LoadKit(Uri=uri_2, Run=R_2)  # -> Success, Kit, LocalDirectory
kit_2 = ModelKit(Kit=kit.Kit)  # -> Kit, Valid, Name, Description, Icon, Image, Preview, Version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
trim = TrimTree(Tree=kit_2.Types, Depth=1)
typ = SelectType(ty=trim, na=na_2, variant=variant_2)  # -> ty_4, i_2
typ_2 = ModelType(Type=typ.ty_4)  # -> Type, Valid, Name, Description, Icon, Image, Variant, Stock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
trim_2 = TrimTree(Tree=typ_2.Representations, Depth=1)
selrep = SelectRepresentation_4(rp=trim_2, mm=mm_2, lod=lod_2, tags=tags_2)  # -> rp_4, ur_2, pa_ur_2
rep = SelectRepresentation_2()  # -> rp_4, i_2
sep = Separator()  # -> S; same code as sep
concat = Concatenate(FragmentA=kit.LocalDirectory, FragmentB=sep, FragmentC=selrep.pa_ur_2)
xy = XYPlane(Origin=Point(0, 0, 0))
geo = LoadGeometry(path=concat, pln=xy, run=R_2)  # -> object_4, col_2, shader_2
object = ModelObject(geo.object_4)
ty = Type(typ_2.Type)
shader = Shader(geo.shader_2)
ur = Url(selrep.ur_2)
path = FilePath(concat)
path_2 = ClusterOutput(path)
ty_2 = ClusterOutput(ty)
object_2 = ClusterOutput(object)
shader_2 = ClusterOutput(shader)
ur_2 = ClusterOutput(ur)

# ==== cluster SelectKit: Select a kit with a name and an optional version. If no version is provided it will select all variants. If you want to select the default version then use the empty text.
kt = ClusterInput()
na = ClusterInput()
version = ClusterInput()
kt_2 = Kit(kt)
na_2 = Name(na)
version_2 = Version(version)
kit = ModelKit(Kit=kt_2, Name=na_2)  # -> Kit, Valid, Name, Description, Icon, Image, Preview, Version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
expression = Expression(x=kit.Name, y=na_2, Expression="x=y")
cull = CullPattern(List=kit.Kit, CullPattern=expression)
kit_2 = ModelKit(Kit=cull)  # -> Kit, Valid, Name, Description, Icon, Image, Preview, Version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
expression_2 = Expression(x=kit_2.Version, y=version_2, Expression="x=y")
txt = Text(kt_2)
null = NullItem(Item=version_2)  # -> NullFlags, InvalidFlags, Description
cull_2 = CullPattern(List=cull, CullPattern=expression_2)
filter = StreamFilter(Gate=null.NullFlags, Stream0=cull_2, Stream1=cull)
txt_2 = Text(filter)
mindex = MemberIndex(Set=txt, Member=txt_2)  # -> Index, Count
trim = TrimTree(Tree=mindex.Index, Depth=1)
kt_3 = Kit(filter)
i = Index(trim)
kt_4 = ClusterOutput(kt_3)
i_2 = ClusterOutput(i)

# ==== cluster ShowDesign: Show a design by flattening it and selecting representations based on mime and tags. Select exactly one representation based on mime and tags. The tag matching is based on the highest Jaccard index (|∩|/|∪|). If the mime type is not given or does not exist, then all representations are used to search for closest match. If index is equally high the first representation is picked.
dn = ClusterInput()
ty = ClusterInput()
ob = ClusterInput()
mm = ClusterInput()
tags = ClusterInput()
ty_2 = Type(ty)
dn_2 = Design(dn)
ob_2 = Data(ob)
mm_2 = Mime(mm)
tags_2 = Tags(tags)
dsn = ModelDesign(Design=dn_2)  # -> Design, Valid, Name, Description, Icon, Image, Variant, View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
typ = ModelType(Type=ty_2)  # -> Type, Valid, Name, Description, Icon, Image, Variant, Unit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
trim = TrimTree(Tree=dsn.Pieces, Depth=1)
xy = XYPlane(Origin=Point(0, 0, 0))
pce = ModelPiece(Piece=trim, Plane=xy)  # -> Piece, Valid, Id, Description, TypeName, TypeVariant, Plane, Center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
rep = ModelRepresentation(Representation=typ.Representations)  # -> Representation, Valid, Url, Description, Tags, Qualities
tstat = TreeStatistics(Tree=typ.Representations)  # -> Paths, Length, Count
tstat_2 = TreeStatistics(Tree=graft(rep.Url))  # -> Paths, Length, Count
expression = Expression(x=graft(pce.TypeName), y=typ.Name, Expression="x=y")
expression_2 = Expression(x=graft(pce.TypeVariant), y=typ.Variant, Expression="x=y")
trim_2 = TrimTree(Tree=rep.Url, Depth=1)
and = GateAnd(A=expression, B=expression_2)
cull = CullPattern(List=ty_2, CullPattern=and)
lng = ListLength(List=ty_2)
series = Series(Start=0, Step=1, Count=lng)
txt = Text(cull)
txt_2 = Text(ty_2)
expression_3 = Expression(x=txt, y=txt_2, Expression="x=y")
trim_3 = TrimTree(Tree=series, Depth=1)
cull_2 = CullPattern(List=trim_3, CullPattern=expression_3)
trim_4 = TrimTree(Tree=cull_2, Depth=1)
item = ListItem(List=tstat.Paths, Index=trim_4, Wrap=True)
branch = TreeBranch(Tree=typ.Representations, Path=item, MaintainPaths=False)
mrg_p = MergeSeperatlyPrepend(x=branch)  # -> Mrgd; inputs x: tree
# ---------- mrg_p: Python ----------
if ghenv.Component.RunCount<2:
    __author__ = "Ueli Saluz"
    __version__ = "2020.05.28"
    
    ghenv.Component.Name = "MergeSeperatly(Prepend)"
    ghenv.Component.NickName = "Mrg(P)"
    ghenv.Component.Description = "Merge inputs seperatly on a new path. Prepend index of input parameter for distincting."
    ghenv.Component.Message = "VER 1.0"

from System import Object
from Grasshopper import DataTree
from Grasshopper.Kernel import GH_ParamAccess as Access

if __name__ == "__main__":
    Mrgd = DataTree[Object]()
    access = Access()
    
    for input in ghenv.Component.Params.Input:  #set all Inputaccess to Tree Access
        input.Access = access.tree
    
    for i,input in enumerate(ghenv.Component.Params.Input):
        for j,source in enumerate(input.Sources):
            for path in source.VolatileData.Paths:
                Mrgd.AddRange(source.VolatileData[path],path.PrependElement(i))
# ---------- end mrg_p ----------
rep_2 = SelectRepresentation(mm=mm_2)  # -> rp_5, i_2, ur_2, pa_ur_2
rep_3 = SelectRepresentation_2(rp=mrg_p, tags=tags_2)  # -> rp_4, i_2
trim_5 = TrimTree(Tree=rep_3.rp_4, Depth=1)
trim_6 = TrimTree(Tree=rep_2.ur_2, Depth=1)
itemindex = ItemIndex(L=trim_2, I=trim_6)  # -> i; inputs L: list; same code as itemindex
item_2 = ListItem(List=tstat_2.Paths, Index=itemindex, Wrap=True)
branch_2 = TreeBranch(Tree=ob_2, Path=item_2, MaintainPaths=False)
mrg_p_2 = MergeSeperatlyPrepend(x=branch_2)  # -> Mrgd; inputs x: tree; same code as mrg_p
trim_7 = TrimTree(Tree=rep_2.pa_ur_2, Depth=1)
pln = Plane(pce.Plane)
id = Id(pce.Id)
orient = Orient(Geometry=mrg_p_2, Source=PlaneXY(0, 0, 0), Target=graft(pln))  # -> Geometry, Transform
object = Data(orient.Geometry)
rp = Representation(trim_5)
object_2 = ClusterOutput(object)
rp_2 = ClusterOutput(rp)
pln_2 = ClusterOutput(pln)
id_2 = ClusterOutput(id)

# ==== cluster SelectType: Select a type with a name and an optional variant. If no variant is provided it will select all variants. If you want to select the default type then use the empty text.
ty = ClusterInput()
na = ClusterInput()
variant = ClusterInput()
na_2 = Name(na)
variant_2 = Variant(variant)
ty_2 = Type(ty)
typ = ModelType(Type=ty_2)  # -> Type, Valid, Name, Description, Icon, Image, Variant, Stock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
expression = Expression(x=typ.Name, y=na_2, Expression="x=y")
cull = CullPattern(List=typ.Type, CullPattern=expression)
typ_2 = ModelType(Type=cull)  # -> Type, Valid, Name, Description, Icon, Image, Variant, Stock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
expression_2 = Expression(x=typ_2.Variant, y=variant_2, Expression="x=y")
txt = Text(ty_2)
cull_2 = CullPattern(List=typ_2.Type, CullPattern=expression_2)
null = NullItem(Item=variant_2)  # -> NullFlags, InvalidFlags, Description
filter = StreamFilter(Gate=null.NullFlags, Stream0=cull_2, Stream1=cull)
txt_2 = Text(filter)
mindex = MemberIndex(Set=txt, Member=txt_2)  # -> Index, Count
trim = TrimTree(Tree=mindex.Index, Depth=1)
ty_3 = Type(filter)
i = Integer(trim)
ty_4 = ClusterOutput(ty_3)
i_2 = ClusterOutput(i)

# ==== cluster SelectTypeByPiece: Select the type of a piece.
ty = ClusterInput()
pc = ClusterInput()
pc_2 = Piece(graft(pc))
ty_2 = Type(ty)
pce = ModelPiece(Piece=pc_2)  # -> Piece, Valid, Id, Description, TypeName, TypeVariant, Plane, Center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
typ = SelectType(ty=ty_2, na=pce.TypeName, variant=pce.TypeVariant)  # -> ty_4, i_2
trim = TrimTree(Tree=typ.ty_4, Depth=1)
trim_2 = TrimTree(Tree=typ.i_2, Depth=1)
ty_3 = Type(trim)
i = Integer(trim_2)
ty_4 = ClusterOutput(ty_3)
i_2 = ClusterOutput(i)

# ==== cluster SelectQuality: Select a quality by its name. If no quality matches, null is returned.
ql = ClusterInput()
na = ClusterInput()
na_2 = Name(graft(na))
ql_2 = Quality(ql)
qal = ModelQuality(Quality=ql_2)  # -> Quality, Valid, Name, Value, Unit, Definition
expression = Expression(x=qal.Name, y=na_2, Expression="x=y")
cull = CullPattern(List=qal.Quality, CullPattern=expression)
nulltobranch = AddNullToEmptyBranch(D=cull)  # -> R; inputs D: tree; same code as nulltobranch
trim = TrimTree(Tree=nulltobranch, Depth=1)
ql_3 = Quality(trim)
ql_4 = ClusterOutput(ql_3)

# ==== cluster Mod
panel = Panel("""False
False
False
False
False
False
True
True
True""")
panel_2 = Panel("""0
1
3
4""")
panel_3 = Panel("""1
2
4
5""")
panel_4 = Panel("""0
2
3
5""")
M = ClusterInput()
R = ClusterInput()
rt = ClusterInput()
M_2 = Module(graft(M))
R_2 = Rule(R)
mrg_a = MergeSeperatlyAppend(x=R_2)  # -> Mrgd; inputs x: tree
# ---------- mrg_a: Python ----------
if ghenv.Component.RunCount<2:
    __author__ = "Ueli Saluz"
    __version__ = "2020.05.28"
    
    ghenv.Component.Name = "MergeSeperatly(Append)"
    ghenv.Component.NickName = "Mrg(A)"
    ghenv.Component.Description = "Merge inputs seperatly on a new path. Append index of input parameter for distincting."
    ghenv.Component.Message = "VER 1.0"

from System import Object
from Grasshopper import DataTree
from Grasshopper.Kernel import GH_ParamAccess as Access

if __name__ == "__main__":
    Mrgd = DataTree[Object]()
    access = Access()
    
    for input in ghenv.Component.Params.Input:  #set all Inputaccess to Tree Access
        input.Access = access.tree
    
    for i,input in enumerate(ghenv.Component.Params.Input):
        for j,source in enumerate(input.Sources):
            for path in source.VolatileData.Paths:
                Mrgd.AddRange(source.VolatileData[path],path.AppendElement(i))
# ---------- end mrg_a ----------
lng = ListLength(List=mrg_a)
series = Series(Start=0, Step=1, Count=lng)
trim = TrimTree(Tree=series, Depth=1)
isruleexp = IsRuleExplicit(Rule=mrg_a)
dispatch = Dispatch(List=mrg_a, DispatchPattern=isruleexp)  # -> ListA, ListB
dispatch_2 = Dispatch(List=trim, DispatchPattern=isruleexp)  # -> ListA, ListB
deconruleexp = DeconstructExplicitRule(Rule=dispatch.ListA)  # -> SourceModuleName, SourceConnectorIndex, TargetModuleName, TargetConnectorIndex
deconruletyp = DeconstructTypedRule(Rule=dispatch.ListB)  # -> ModuleName, ConnectorIndex, Type
txt = Text(deconruletyp.ConnectorIndex)
txt_2 = Text(deconruleexp.SourceConnectorIndex)
txt_3 = Text(deconruleexp.TargetConnectorIndex)
rt_2 = Boolean(rt)
item = ListItem(List=rt_2, Index=0, Wrap=True)  # -> Item, Item1, Item2, Item3, Item4, Item5, Item6, Item7, Item8
x_90 = Boolean(item.Item)
x_180 = Boolean(item.Item1)
x_270 = Boolean(item.Item2)
y_90 = Boolean(item.Item3)
y_180 = Boolean(item.Item4)
y_270 = Boolean(item.Item5)
z_90 = Boolean(item.Item6)
z_180 = Boolean(item.Item7)
z_270 = Boolean(item.Item8)

deconmodule = DeconstructModule(Module=M_2, Rules=mrg_a)  # -> ModuleName, ModulePartCenterPoints, Geometry, BasePlane, ModulePartDiagonal, IsCompact, IsValid, Connectors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
trim_2 = TrimTree(Tree=deconmodule.ModulePartCenterPoints, Depth=1)
trim_3 = TrimTree(Tree=deconmodule.Geometry, Depth=1)
trim_4 = TrimTree(Tree=deconmodule.BasePlane, Depth=1)
trim_5 = TrimTree(Tree=deconmodule.ModulePartDiagonal, Depth=1)
trim_6 = TrimTree(Tree=deconmodule.ModuleName, Depth=1)
deplane = DeconstructPlane(Plane=trim_4)  # -> Origin, XAxis, YAxis, ZAxis
pl = ConstructPlane(Origin=deplane.Origin, XAxis=deplane.XAxis, YAxis=deplane.ZAxis)
pl_2 = ConstructPlane(Origin=deplane.Origin, XAxis=deplane.YAxis, YAxis=deplane.ZAxis)
rotate = Rotate(Geometry=trim_3, Angle=degrees("180"), Plane=pl_2)  # -> Geometry, Transform
rotate_2 = Rotate(Geometry=trim_3, Angle=degrees("90"), Plane=pl_2)  # -> Geometry, Transform
rotate_3 = Rotate(Geometry=trim_3, Angle=degrees("270"), Plane=pl_2)  # -> Geometry, Transform
concat = Concatenate(FragmentE=trim_6, FragmentA="↺", FragmentB="90", FragmentC="°", FragmentD="X")
concat_2 = Concatenate(FragmentE=trim_6, FragmentA="↺", FragmentB="270", FragmentC="°", FragmentD="X")
concat_3 = Concatenate(FragmentE=trim_6, FragmentA="↺", FragmentB="180", FragmentC="°", FragmentD="X")
constmodule = ConstructModule(ModuleName=concat_3, ModulePartPoints=trim_2, Geometry=rotate.Geometry, BasePlane=pl_2, ModulePartDiagonal=trim_5)
constmodule_2 = ConstructModule(ModuleName=concat, ModulePartPoints=trim_2, Geometry=rotate_2.Geometry, BasePlane=pl_2, ModulePartDiagonal=trim_5)
constmodule_3 = ConstructModule(ModuleName=concat_2, ModulePartPoints=trim_2, Geometry=rotate_3.Geometry, BasePlane=pl_2, ModulePartDiagonal=trim_5)
rotate_4 = Rotate(Geometry=trim_3, Angle=degrees("180"), Plane=pl)  # -> Geometry, Transform
rotate_5 = Rotate(Geometry=trim_3, Angle=degrees("90"), Plane=pl)  # -> Geometry, Transform
rotate_6 = Rotate(Geometry=trim_3, Angle=degrees("270"), Plane=pl)  # -> Geometry, Transform
concat_4 = Concatenate(FragmentE=trim_6, FragmentA="↺", FragmentB="270", FragmentC="°", FragmentD="Y")
concat_5 = Concatenate(FragmentE=trim_6, FragmentA="↺", FragmentB="90", FragmentC="°", FragmentD="Y")
concat_6 = Concatenate(FragmentE=trim_6, FragmentA="↺", FragmentB="180", FragmentC="°", FragmentD="Y")
constmodule_4 = ConstructModule(ModuleName=concat_6, ModulePartPoints=trim_2, Geometry=rotate_4.Geometry, BasePlane=pl, ModulePartDiagonal=trim_5)
constmodule_5 = ConstructModule(ModuleName=concat_5, ModulePartPoints=trim_2, Geometry=rotate_5.Geometry, BasePlane=pl, ModulePartDiagonal=trim_5)
constmodule_6 = ConstructModule(ModuleName=concat_4, ModulePartPoints=trim_2, Geometry=rotate_6.Geometry, BasePlane=pl, ModulePartDiagonal=trim_5)
rotate_7 = Rotate(Geometry=trim_3, Angle=degrees("180"), Plane=trim_4)  # -> Geometry, Transform
rotate_8 = Rotate(Geometry=trim_3, Angle=degrees("90"), Plane=trim_4)  # -> Geometry, Transform
rotate_9 = Rotate(Geometry=trim_3, Angle=degrees("270"), Plane=trim_4)  # -> Geometry, Transform
concat_7 = Concatenate(FragmentE=trim_6, FragmentA="↺", FragmentB="90", FragmentC="°", FragmentD="Z")
concat_8 = Concatenate(FragmentE=trim_6, FragmentA="↺", FragmentB="180", FragmentC="°", FragmentD="Z")
concat_9 = Concatenate(FragmentE=trim_6, FragmentA="↺", FragmentB="270", FragmentC="°", FragmentD="Z")
constmodule_7 = ConstructModule(ModuleName=concat_8, ModulePartPoints=trim_2, Geometry=rotate_7.Geometry, BasePlane=trim_4, ModulePartDiagonal=trim_5)
constmodule_8 = ConstructModule(ModuleName=concat_7, ModulePartPoints=trim_2, Geometry=rotate_8.Geometry, BasePlane=trim_4, ModulePartDiagonal=trim_5)
constmodule_9 = ConstructModule(ModuleName=concat_9, ModulePartPoints=trim_2, Geometry=rotate_9.Geometry, BasePlane=trim_4, ModulePartDiagonal=trim_5)
merge = Merge(
    Data1=M_2,
    Data2=constmodule_2,
    Data3=constmodule,
    Data4=constmodule_3,
    Data5=constmodule_5,
    Data6=constmodule_4,
    Data7=constmodule_6,
    Data8=constmodule_8,
    Data9=constmodule_7,
    Data10=constmodule_9)

expression = Expression(x=concat_2, y=deconruleexp.SourceModuleName, Expression="x")
expression_2 = Expression(x=deconruleexp.SourceModuleName, y=trim_6, Expression="x=y")  # -> graft(R)
expression_3 = Expression(x=concat_2, y=deconruleexp.TargetModuleName, Expression="x")
expression_4 = Expression(x=concat_2, y=deconruletyp.ModuleName, Expression="x")
merge_2 = Merge(Data1=graft(deconruleexp.SourceModuleName), Data2=graft(expression))
expression_5 = Expression(x=deconruletyp.ModuleName, y=trim_6, Expression="x=y")  # -> graft(R)
expression_6 = Expression(x=deconruleexp.TargetModuleName, y=trim_6, Expression="x=y")  # -> graft(R)
merge_3 = Merge(Data1=graft(deconruleexp.TargetModuleName), Data2=graft(expression_3))
merge_4 = Merge(Data1=graft(deconruletyp.ModuleName), Data2=graft(expression_4))
shift = ShiftList(List=panel_3, Shift="3", Wrap=True)
item_2 = ListItem(List=merge_2, Index=expression_2, Wrap=True)
trim_7 = TrimTree(Tree=shift, Depth=1)
item_3 = ListItem(List=merge_3, Index=expression_6, Wrap=True)
item_4 = ListItem(List=merge_4, Index=expression_5, Wrap=True)
trim_8 = TrimTree(Tree=item_2, Depth=1)
replace = ReplaceMembers(Set=txt_2, Find=panel_3, Replace=trim_7)
trim_9 = TrimTree(Tree=item_3, Depth=1)
replace_2 = ReplaceMembers(Set=txt_3, Find=panel_3, Replace=trim_7)
trim_10 = TrimTree(Tree=item_4, Depth=1)
replace_3 = ReplaceMembers(Set=txt, Find=panel_3, Replace=trim_7)
ruletyp = ConstructTypedRule(ModuleName=trim_10, ConnectorIndex=replace_3, Type=deconruletyp.Type)
ruleexp = ConstructExplicitRule(SourceModuleName=trim_8, SourceConnectorIndex=replace, TargetModuleName=trim_9, TargetConnectorIndex=replace_2)
merge_5 = Merge(Data1=ruleexp, Data2=ruletyp)
merge_6 = Merge(Data1=dispatch_2.ListA, Data2=dispatch_2.ListB)
sort = SortList(Keys=merge_6, ValuesA=merge_5)  # -> Keys, ValuesA

expression_7 = Expression(x=deconruleexp.SourceModuleName, y=trim_6, Expression="x=y")  # -> graft(R)
expression_8 = Expression(x=concat_3, y=deconruleexp.SourceModuleName, Expression="x")
expression_9 = Expression(x=concat_3, y=deconruleexp.TargetModuleName, Expression="x")
expression_10 = Expression(x=concat_3, y=deconruletyp.ModuleName, Expression="x")
expression_11 = Expression(x=deconruleexp.TargetModuleName, y=trim_6, Expression="x=y")  # -> graft(R)
expression_12 = Expression(x=deconruletyp.ModuleName, y=trim_6, Expression="x=y")  # -> graft(R)
merge_7 = Merge(Data1=graft(deconruleexp.SourceModuleName), Data2=graft(expression_8))
merge_8 = Merge(Data1=graft(deconruletyp.ModuleName), Data2=graft(expression_10))
merge_9 = Merge(Data1=graft(deconruleexp.TargetModuleName), Data2=graft(expression_9))
shift_2 = ShiftList(List=panel_3, Shift="2", Wrap=True)
trim_11 = TrimTree(Tree=shift_2, Depth=1)
item_5 = ListItem(List=merge_7, Index=expression_7, Wrap=True)
item_6 = ListItem(List=merge_8, Index=expression_12, Wrap=True)
item_7 = ListItem(List=merge_9, Index=expression_11, Wrap=True)
trim_12 = TrimTree(Tree=item_5, Depth=1)
replace_4 = ReplaceMembers(Set=txt, Find=panel_3, Replace=trim_11)
replace_5 = ReplaceMembers(Set=txt_3, Find=panel_3, Replace=trim_11)
replace_6 = ReplaceMembers(Set=txt_2, Find=panel_3, Replace=trim_11)
trim_13 = TrimTree(Tree=item_7, Depth=1)
trim_14 = TrimTree(Tree=item_6, Depth=1)
ruleexp_2 = ConstructExplicitRule(SourceModuleName=trim_12, SourceConnectorIndex=replace_6, TargetModuleName=trim_13, TargetConnectorIndex=replace_5)
ruletyp_2 = ConstructTypedRule(ModuleName=trim_14, ConnectorIndex=replace_4, Type=deconruletyp.Type)
merge_10 = Merge(Data1=ruleexp_2, Data2=ruletyp_2)
merge_11 = Merge(Data1=dispatch_2.ListA, Data2=dispatch_2.ListB)
sort_2 = SortList(Keys=merge_11, ValuesA=merge_10)  # -> Keys, ValuesA

expression_13 = Expression(x=deconruleexp.SourceModuleName, y=trim_6, Expression="x=y")  # -> graft(R)
expression_14 = Expression(x=concat, y=deconruleexp.SourceModuleName, Expression="x")
expression_15 = Expression(x=concat, y=deconruleexp.TargetModuleName, Expression="x")
expression_16 = Expression(x=concat, y=deconruletyp.ModuleName, Expression="x")
expression_17 = Expression(x=deconruletyp.ModuleName, y=trim_6, Expression="x=y")  # -> graft(R)
expression_18 = Expression(x=deconruleexp.TargetModuleName, y=trim_6, Expression="x=y")  # -> graft(R)
merge_12 = Merge(Data1=graft(deconruleexp.SourceModuleName), Data2=graft(expression_14))
merge_13 = Merge(Data1=graft(deconruleexp.TargetModuleName), Data2=graft(expression_15))
merge_14 = Merge(Data1=graft(deconruletyp.ModuleName), Data2=graft(expression_16))
shift_3 = ShiftList(List=panel_3, Shift="1", Wrap=True)
trim_15 = TrimTree(Tree=shift_3, Depth=1)
item_8 = ListItem(List=merge_14, Index=expression_17, Wrap=True)
item_9 = ListItem(List=merge_13, Index=expression_18, Wrap=True)
item_10 = ListItem(List=merge_12, Index=expression_13, Wrap=True)
trim_16 = TrimTree(Tree=item_9, Depth=1)
replace_7 = ReplaceMembers(Set=txt, Find=panel_3, Replace=trim_15)
replace_8 = ReplaceMembers(Set=txt_3, Find=panel_3, Replace=trim_15)
trim_17 = TrimTree(Tree=item_8, Depth=1)
trim_18 = TrimTree(Tree=item_10, Depth=1)
replace_9 = ReplaceMembers(Set=txt_2, Find=panel_3, Replace=trim_15)
ruleexp_3 = ConstructExplicitRule(SourceModuleName=trim_18, SourceConnectorIndex=replace_9, TargetModuleName=trim_16, TargetConnectorIndex=replace_8)
ruletyp_3 = ConstructTypedRule(ModuleName=trim_17, ConnectorIndex=replace_7, Type=deconruletyp.Type)
merge_15 = Merge(Data1=ruleexp_3, Data2=ruletyp_3)
merge_16 = Merge(Data1=dispatch_2.ListA, Data2=dispatch_2.ListB)
sort_3 = SortList(Keys=merge_16, ValuesA=merge_15)  # -> Keys, ValuesA

expression_19 = Expression(x=deconruleexp.SourceModuleName, y=trim_6, Expression="x=y")  # -> graft(R)
expression_20 = Expression(x=concat_6, y=deconruleexp.SourceModuleName, Expression="x")
expression_21 = Expression(x=concat_6, y=deconruleexp.TargetModuleName, Expression="x")
expression_22 = Expression(x=concat_6, y=deconruletyp.ModuleName, Expression="x")
expression_23 = Expression(x=deconruleexp.TargetModuleName, y=trim_6, Expression="x=y")  # -> graft(R)
expression_24 = Expression(x=deconruletyp.ModuleName, y=trim_6, Expression="x=y")  # -> graft(R)
merge_17 = Merge(Data1=graft(deconruleexp.SourceModuleName), Data2=graft(expression_20))
merge_18 = Merge(Data1=graft(deconruleexp.TargetModuleName), Data2=graft(expression_21))
merge_19 = Merge(Data1=graft(deconruletyp.ModuleName), Data2=graft(expression_22))
shift_4 = ShiftList(List=panel_4, Shift="2", Wrap=True)
trim_19 = TrimTree(Tree=shift_4, Depth=1)
item_11 = ListItem(List=merge_18, Index=expression_23, Wrap=True)
item_12 = ListItem(List=merge_19, Index=expression_24, Wrap=True)
item_13 = ListItem(List=merge_17, Index=expression_19, Wrap=True)
trim_20 = TrimTree(Tree=item_11, Depth=1)
replace_10 = ReplaceMembers(Set=txt, Find=panel_4, Replace=trim_19)
replace_11 = ReplaceMembers(Set=txt_3, Find=panel_4, Replace=trim_19)
trim_21 = TrimTree(Tree=item_12, Depth=1)
trim_22 = TrimTree(Tree=item_13, Depth=1)
replace_12 = ReplaceMembers(Set=txt_2, Find=panel_4, Replace=trim_19)
ruletyp_4 = ConstructTypedRule(ModuleName=trim_21, ConnectorIndex=replace_10, Type=deconruletyp.Type)
ruleexp_4 = ConstructExplicitRule(SourceModuleName=trim_22, SourceConnectorIndex=replace_12, TargetModuleName=trim_20, TargetConnectorIndex=replace_11)
merge_20 = Merge(Data1=ruleexp_4, Data2=ruletyp_4)
merge_21 = Merge(Data1=dispatch_2.ListA, Data2=dispatch_2.ListB)
sort_4 = SortList(Keys=merge_21, ValuesA=merge_20)  # -> Keys, ValuesA

expression_25 = Expression(x=concat_5, y=deconruleexp.SourceModuleName, Expression="x")
expression_26 = Expression(x=deconruleexp.SourceModuleName, y=trim_6, Expression="x=y")  # -> graft(R)
expression_27 = Expression(x=concat_5, y=deconruleexp.TargetModuleName, Expression="x")
expression_28 = Expression(x=concat_5, y=deconruletyp.ModuleName, Expression="x")
expression_29 = Expression(x=deconruleexp.TargetModuleName, y=trim_6, Expression="x=y")  # -> graft(R)
expression_30 = Expression(x=deconruletyp.ModuleName, y=trim_6, Expression="x=y")  # -> graft(R)
merge_22 = Merge(Data1=graft(deconruleexp.SourceModuleName), Data2=graft(expression_25))
merge_23 = Merge(Data1=graft(deconruletyp.ModuleName), Data2=graft(expression_28))
merge_24 = Merge(Data1=graft(deconruleexp.TargetModuleName), Data2=graft(expression_27))
shift_5 = ShiftList(List=panel_4, Shift="1", Wrap=True)
item_14 = ListItem(List=merge_22, Index=expression_26, Wrap=True)
trim_23 = TrimTree(Tree=shift_5, Depth=1)
item_15 = ListItem(List=merge_23, Index=expression_30, Wrap=True)
item_16 = ListItem(List=merge_24, Index=expression_29, Wrap=True)
trim_24 = TrimTree(Tree=item_14, Depth=1)
replace_13 = ReplaceMembers(Set=txt, Find=panel_4, Replace=trim_23)
replace_14 = ReplaceMembers(Set=txt_3, Find=panel_4, Replace=trim_23)
trim_25 = TrimTree(Tree=item_16, Depth=1)
trim_26 = TrimTree(Tree=item_15, Depth=1)
replace_15 = ReplaceMembers(Set=txt_2, Find=panel_4, Replace=trim_23)
ruletyp_5 = ConstructTypedRule(ModuleName=trim_26, ConnectorIndex=replace_13, Type=deconruletyp.Type)
ruleexp_5 = ConstructExplicitRule(SourceModuleName=trim_24, SourceConnectorIndex=replace_15, TargetModuleName=trim_25, TargetConnectorIndex=replace_14)
merge_25 = Merge(Data1=ruleexp_5, Data2=ruletyp_5)
merge_26 = Merge(Data1=dispatch_2.ListA, Data2=dispatch_2.ListB)
sort_5 = SortList(Keys=merge_26, ValuesA=merge_25)  # -> Keys, ValuesA

expression_31 = Expression(x=concat_4, y=deconruleexp.SourceModuleName, Expression="x")
expression_32 = Expression(x=deconruleexp.SourceModuleName, y=trim_6, Expression="x=y")  # -> graft(R)
expression_33 = Expression(x=concat_4, y=deconruleexp.TargetModuleName, Expression="x")
expression_34 = Expression(x=concat_4, y=deconruletyp.ModuleName, Expression="x")
expression_35 = Expression(x=deconruleexp.TargetModuleName, y=trim_6, Expression="x=y")  # -> graft(R)
expression_36 = Expression(x=deconruletyp.ModuleName, y=trim_6, Expression="x=y")  # -> graft(R)
merge_27 = Merge(Data1=graft(deconruleexp.SourceModuleName), Data2=graft(expression_31))
merge_28 = Merge(Data1=graft(deconruleexp.TargetModuleName), Data2=graft(expression_33))
merge_29 = Merge(Data1=graft(deconruletyp.ModuleName), Data2=graft(expression_34))
shift_6 = ShiftList(List=panel_4, Shift="3", Wrap=True)
item_17 = ListItem(List=merge_28, Index=expression_35, Wrap=True)
item_18 = ListItem(List=merge_27, Index=expression_32, Wrap=True)
trim_27 = TrimTree(Tree=shift_6, Depth=1)
item_19 = ListItem(List=merge_29, Index=expression_36, Wrap=True)
trim_28 = TrimTree(Tree=item_17, Depth=1)
replace_16 = ReplaceMembers(Set=txt_3, Find=panel_4, Replace=trim_27)
trim_29 = TrimTree(Tree=item_18, Depth=1)
trim_30 = TrimTree(Tree=item_19, Depth=1)
replace_17 = ReplaceMembers(Set=txt, Find=panel_4, Replace=trim_27)
replace_18 = ReplaceMembers(Set=txt_2, Find=panel_4, Replace=trim_27)
ruletyp_6 = ConstructTypedRule(ModuleName=trim_30, ConnectorIndex=replace_17, Type=deconruletyp.Type)
ruleexp_6 = ConstructExplicitRule(SourceModuleName=trim_29, SourceConnectorIndex=replace_18, TargetModuleName=trim_28, TargetConnectorIndex=replace_16)
merge_30 = Merge(Data1=ruleexp_6, Data2=ruletyp_6)
merge_31 = Merge(Data1=dispatch_2.ListA, Data2=dispatch_2.ListB)
sort_6 = SortList(Keys=merge_31, ValuesA=merge_30)  # -> Keys, ValuesA

trim_31 = TrimTree(Tree=mrg_a, Depth=1)
trim_32 = TrimTree(Tree=sort_3.ValuesA, Depth=1)
trim_33 = TrimTree(Tree=sort_2.ValuesA, Depth=1)
trim_34 = TrimTree(Tree=sort.ValuesA, Depth=1)
trim_35 = TrimTree(Tree=sort_5.ValuesA, Depth=1)
trim_36 = TrimTree(Tree=sort_4.ValuesA, Depth=1)
trim_37 = TrimTree(Tree=sort_6.ValuesA, Depth=1)
merge_32 = Merge(Data1="True", Data2=rt_2)

expression_37 = Expression(x=deconruleexp.SourceModuleName, y=trim_6, Expression="x=y")  # -> graft(R)
expression_38 = Expression(x=concat_8, y=deconruleexp.SourceModuleName, Expression="x")
expression_39 = Expression(x=concat_8, y=deconruleexp.TargetModuleName, Expression="x")
expression_40 = Expression(x=concat_8, y=deconruletyp.ModuleName, Expression="x")
expression_41 = Expression(x=deconruletyp.ModuleName, y=trim_6, Expression="x=y")  # -> graft(R)
expression_42 = Expression(x=deconruleexp.TargetModuleName, y=trim_6, Expression="x=y")  # -> graft(R)
merge_33 = Merge(Data1=graft(deconruleexp.SourceModuleName), Data2=graft(expression_38))
merge_34 = Merge(Data1=graft(deconruleexp.TargetModuleName), Data2=graft(expression_39))
merge_35 = Merge(Data1=graft(deconruletyp.ModuleName), Data2=graft(expression_40))
shift_7 = ShiftList(List=panel_2, Shift="2", Wrap=True)
item_20 = ListItem(List=merge_33, Index=expression_37, Wrap=True)
trim_38 = TrimTree(Tree=shift_7, Depth=1)
item_21 = ListItem(List=merge_35, Index=expression_41, Wrap=True)
item_22 = ListItem(List=merge_34, Index=expression_42, Wrap=True)
trim_39 = TrimTree(Tree=item_20, Depth=1)
trim_40 = TrimTree(Tree=item_22, Depth=1)
replace_19 = ReplaceMembers(Set=txt_3, Find=panel_2, Replace=trim_38)
replace_20 = ReplaceMembers(Set=txt_2, Find=panel_2, Replace=trim_38)
trim_41 = TrimTree(Tree=item_21, Depth=1)
replace_21 = ReplaceMembers(Set=txt, Find=panel_2, Replace=trim_38)
ruletyp_7 = ConstructTypedRule(ModuleName=trim_41, ConnectorIndex=replace_21, Type=deconruletyp.Type)
ruleexp_7 = ConstructExplicitRule(SourceModuleName=trim_39, SourceConnectorIndex=replace_20, TargetModuleName=trim_40, TargetConnectorIndex=replace_19)
merge_36 = Merge(Data1=ruleexp_7, Data2=ruletyp_7)
merge_37 = Merge(Data1=dispatch_2.ListA, Data2=dispatch_2.ListB)
sort_7 = SortList(Keys=merge_37, ValuesA=merge_36)  # -> Keys, ValuesA

trim_42 = TrimTree(Tree=sort_7.ValuesA, Depth=1)

expression_43 = Expression(x=deconruleexp.SourceModuleName, y=trim_6, Expression="x=y")  # -> graft(R)
expression_44 = Expression(x=concat_9, y=deconruleexp.SourceModuleName, Expression="x")
expression_45 = Expression(x=concat_9, y=deconruleexp.TargetModuleName, Expression="x")
expression_46 = Expression(x=concat_9, y=deconruletyp.ModuleName, Expression="x")
expression_47 = Expression(x=deconruleexp.TargetModuleName, y=trim_6, Expression="x=y")  # -> graft(R)
expression_48 = Expression(x=deconruletyp.ModuleName, y=trim_6, Expression="x=y")  # -> graft(R)
merge_38 = Merge(Data1=graft(deconruleexp.SourceModuleName), Data2=graft(expression_44))
merge_39 = Merge(Data1=graft(deconruleexp.TargetModuleName), Data2=graft(expression_45))
merge_40 = Merge(Data1=graft(deconruletyp.ModuleName), Data2=graft(expression_46))
shift_8 = ShiftList(List=panel_2, Shift="3", Wrap=True)
trim_43 = TrimTree(Tree=shift_8, Depth=1)
item_23 = ListItem(List=merge_39, Index=expression_47, Wrap=True)
item_24 = ListItem(List=merge_40, Index=expression_48, Wrap=True)
item_25 = ListItem(List=merge_38, Index=expression_43, Wrap=True)
trim_44 = TrimTree(Tree=item_23, Depth=1)
replace_22 = ReplaceMembers(Set=txt_3, Find=panel_2, Replace=trim_43)
trim_45 = TrimTree(Tree=item_25, Depth=1)
replace_23 = ReplaceMembers(Set=txt_2, Find=panel_2, Replace=trim_43)
trim_46 = TrimTree(Tree=item_24, Depth=1)
replace_24 = ReplaceMembers(Set=txt, Find=panel_2, Replace=trim_43)
ruletyp_8 = ConstructTypedRule(ModuleName=trim_46, ConnectorIndex=replace_24, Type=deconruletyp.Type)
ruleexp_8 = ConstructExplicitRule(SourceModuleName=trim_45, SourceConnectorIndex=replace_23, TargetModuleName=trim_44, TargetConnectorIndex=replace_22)
merge_41 = Merge(Data1=ruleexp_8, Data2=ruletyp_8)
merge_42 = Merge(Data1=dispatch_2.ListA, Data2=dispatch_2.ListB)
sort_8 = SortList(Keys=merge_42, ValuesA=merge_41)  # -> Keys, ValuesA

trim_47 = TrimTree(Tree=sort_8.ValuesA, Depth=1)

expression_49 = Expression(x=deconruleexp.SourceModuleName, y=trim_6, Expression="x=y")  # -> graft(R)
expression_50 = Expression(x=concat_7, y=deconruleexp.SourceModuleName, Expression="x")
expression_51 = Expression(x=concat_7, y=deconruleexp.TargetModuleName, Expression="x")
expression_52 = Expression(x=concat_7, y=deconruletyp.ModuleName, Expression="x")
expression_53 = Expression(x=deconruleexp.TargetModuleName, y=trim_6, Expression="x=y")  # -> graft(R)
expression_54 = Expression(x=deconruletyp.ModuleName, y=trim_6, Expression="x=y")  # -> graft(R)
merge_43 = Merge(Data1=graft(deconruleexp.SourceModuleName), Data2=graft(expression_50))
merge_44 = Merge(Data1=graft(deconruleexp.TargetModuleName), Data2=graft(expression_51))
merge_45 = Merge(Data1=graft(deconruletyp.ModuleName), Data2=graft(expression_52))
shift_9 = ShiftList(List=panel_2, Shift="1", Wrap=True)
item_26 = ListItem(List=merge_43, Index=expression_49, Wrap=True)
trim_48 = TrimTree(Tree=shift_9, Depth=1)
item_27 = ListItem(List=merge_45, Index=expression_54, Wrap=True)
item_28 = ListItem(List=merge_44, Index=expression_53, Wrap=True)
trim_49 = TrimTree(Tree=item_26, Depth=1)
trim_50 = TrimTree(Tree=item_28, Depth=1)
trim_51 = TrimTree(Tree=item_27, Depth=1)
replace_25 = ReplaceMembers(Set=txt_3, Find=panel_2, Replace=trim_48)
replace_26 = ReplaceMembers(Set=txt, Find=panel_2, Replace=trim_48)
replace_27 = ReplaceMembers(Set=txt_2, Find=panel_2, Replace=trim_48)
ruletyp_9 = ConstructTypedRule(ModuleName=trim_51, ConnectorIndex=replace_26, Type=deconruletyp.Type)
ruleexp_9 = ConstructExplicitRule(SourceModuleName=trim_49, SourceConnectorIndex=replace_27, TargetModuleName=trim_50, TargetConnectorIndex=replace_25)
merge_46 = Merge(Data1=ruleexp_9, Data2=ruletyp_9)
merge_47 = Merge(Data1=dispatch_2.ListA, Data2=dispatch_2.ListB)
sort_9 = SortList(Keys=merge_47, ValuesA=merge_46)  # -> Keys, ValuesA

trim_52 = TrimTree(Tree=sort_9.ValuesA, Depth=1)
merge_48 = Merge(
    Data1=graft(trim_31),
    Data2=graft(trim_32),
    Data3=graft(trim_33),
    Data4=graft(trim_34),
    Data5=graft(trim_35),
    Data6=graft(trim_36),
    Data7=graft(trim_37),
    Data8=graft(trim_52),
    Data9=graft(trim_42),
    Data10=graft(trim_47))
cull = CullPattern(List=merge, CullPattern=merge_32)
cull_2 = CullPattern(List=merge_48, CullPattern=merge_32)
trim_53 = TrimTree(Tree=cull, Depth=1)
R_3 = Rule(cull_2)
R_4 = ClusterOutput(R_3)
M_3 = Module(trim_53)
M_4 = ClusterOutput(M_3)

# ==== cluster SelectPort: Select a port with the id. If no port matches, null will be returned.
po = ClusterInput()
id = ClusterInput()
id_2 = Id(graft(id))
po_2 = Port(po)
lng = ListLength(List=po_2)
por = ModelPort(Port=po_2)  # -> Port, Valid, Id, Description, Family, CompatibleFamilies, Point, Direction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
series = Series(Start=0, Step=1, Count=lng)
trim = TrimTree(Tree=series, Depth=1)
expression = Expression(x=por.Id, y=id_2, Expression="x=y")
cull = CullPattern(List=po_2, CullPattern=expression)
cull_2 = CullPattern(List=trim, CullPattern=expression)
nulltobranch = AddNullToEmptyBranch(D=cull_2)  # -> R; inputs D: tree; same code as nulltobranch
nulltobranch_2 = AddNullToEmptyBranch(D=cull)  # -> R; inputs D: tree; same code as nulltobranch
trim_2 = TrimTree(Tree=nulltobranch, Depth=1)
trim_3 = TrimTree(Tree=nulltobranch_2, Depth=1)
i = Integer(trim_2)
po_3 = Port(trim_3)
i_2 = ClusterOutput(i)
po_4 = ClusterOutput(po_3)

# ==== cluster ReplaceRule: Replace rules with new ones. They must have the same module name and connector index.
R = ClusterInput()
rule = ClusterInput()
rule_2 = Rule(graft(rule))
R_2 = Rule(R)
isruleexp = IsRuleExplicit(Rule=R_2)
isruleexp_2 = IsRuleExplicit(Rule=rule_2)
dispatch = Dispatch(List=R_2, DispatchPattern=isruleexp)  # -> ListA, ListB
dispatch_2 = Dispatch(List=rule_2, DispatchPattern=isruleexp_2)  # -> ListA, ListB
deconruletyp = DeconstructTypedRule(Rule=dispatch.ListB)  # -> ModuleName, ConnectorIndex, Type
deconruleexp = DeconstructExplicitRule(Rule=dispatch_2.ListA)  # -> SourceModuleName, SourceConnectorIndex, TargetModuleName, TargetConnectorIndex
# TODO: Explicit rules
deconruleexp_2 = DeconstructExplicitRule(Rule=dispatch.ListA)  # -> SourceModuleName, SourceConnectorIndex, TargetModuleName, TargetConnectorIndex
deconruletyp_2 = DeconstructTypedRule(Rule=dispatch_2.ListB)  # -> ModuleName, ConnectorIndex, Type
expression = Expression(x=deconruletyp.ModuleName, y=deconruletyp_2.ModuleName, Expression="x=y")
expression_2 = Expression(x=deconruletyp.ConnectorIndex, y=deconruletyp_2.ConnectorIndex, Expression="x=y")
lng = ListLength(List=dispatch.ListB)
series = Series(Start=0, Step=1, Count=lng)
and = GateAnd(A=expression, B=expression_2)
trim = TrimTree(Tree=series, Depth=1)
cull = CullPattern(List=trim, CullPattern=and)
expression_3 = Expression(x=rule_2, y=cull, Expression="x")
trim_2 = TrimTree(Tree=cull, Depth=1)
trim_3 = TrimTree(Tree=expression_3, Depth=1)
replace = ReplaceItems(List=dispatch.ListB, Item=trim_3, Indices=trim_2, Wrap=False)
trim_4 = TrimTree(Tree=replace, Depth=1)
merge = Merge(Data1=dispatch.ListA, Data2=trim_4)
R_3 = Rule(merge)
R_4 = ClusterOutput(R_3)

# ==== cluster ShowDesign_2: Show a design by flattening it and selecting only representations with the same mime, lod and tags.
ty = ClusterInput()
dn = ClusterInput()
mm = ClusterInput()
lod = ClusterInput()
tags = ClusterInput()
ty_2 = Type(ty)
mm_2 = Mime(mm)
tags_2 = Tags(tags)
dn_2 = Design(dn)
lod_2 = Lod(lod)
fltdsn = FlattenDesign(Design=dn_2, Type=ty_2)
typ = ModelType(Type=ty_2)  # -> Type, Valid, Name, Description, Icon, Image, Variant, Stock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
dsn = ModelDesign(Design=fltdsn)  # -> Design, Valid, Name, Description, Icon, Image, Variant, View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
trim = TrimTree(Tree=dsn.Pieces, Depth=1)
tstat = TreeStatistics(Tree=typ.Representations)  # -> Paths, Length, Count
pce = ModelPiece(Piece=trim)  # -> Piece, Valid, Id, TypeName, TypeVariant, Plane, ScreenPoint, Center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
expression = Expression(x=graft(pce.TypeName), y=typ.Name, Expression="x=y")
expression_2 = Expression(x=graft(pce.TypeVariant), y=typ.Variant, Expression="x=y")
and = GateAnd(A=expression, B=expression_2)
cull = CullPattern(List=ty_2, CullPattern=and)
lng = ListLength(List=ty_2)
txt = Text(cull)
series = Series(Start=0, Step=1, Count=lng)
txt_2 = Text(ty_2)
expression_3 = Expression(x=txt, y=txt_2, Expression="x=y")
trim_2 = TrimTree(Tree=series, Depth=1)
cull_2 = CullPattern(List=trim_2, CullPattern=expression_3)
trim_3 = TrimTree(Tree=cull_2, Depth=1)
item = ListItem(List=tstat.Paths, Index=trim_3, Wrap=True)
branch = TreeBranch(Tree=typ.Representations, Path=item, MaintainPaths=False)
mrg_p = MergeSeperatlyPrepend(x=branch)  # -> Mrgd; inputs x: tree; same code as mrg_p
selrep = SelectRepresentation_3(rp=mrg_p, mm=mm_2, lod=lod_2, tags=tags_2)  # -> rp_4, ur_2, pa_ur_2
rep = SelectRepresentation_2()  # -> rp_4, i_2
trim_4 = TrimTree(Tree=selrep.ur_2, Depth=1)
trim_5 = TrimTree(Tree=selrep.pa_ur_2, Depth=1)
id = Id(pce.Id)
ur = Url(trim_4)
pa_ur = Url(trim_5)
pln = Plane(pce.Plane)
id_2 = ClusterOutput(id)
ur_2 = ClusterOutput(ur)
pa_ur_2 = ClusterOutput(pa_ur)
pln_2 = ClusterOutput(pln)

# ==== cluster LoadGeometry: Load local geometry from absolute file paths to planes.
path = ClusterInput()
pln = ClusterInput()
run = ClusterInput()
pln_2 = Plane(graft(pln))
path_2 = FilePath(path)
run_2 = Boolean(run)
import = ImportContent(
    FilePath=path_2,
    Name="*",
    Layer="*",
    Linetype="*",
    HatchPattern="*",
    AnnotationStyles="*",
    Materials="*",
    BlockDefinitions="*",
    Import=run_2)  # -> ModelTransform, Objects, Layers, Linetypes, HatchPatterns, AnnotationStyles, Materials, BlockDefinitions
object = ModelObject(Object=import.Objects)  # -> Object, Geometry, Name, Layer, Visibility, Display, Drafting, Render
orient = Orient(Geometry=object.Geometry, Source=PlaneXY(0, 0, 0), Target=pln_2)  # -> Geometry, Transform
object_2 = ModelObject(Object=object.Object, Geometry=orient.Geometry)  # -> Object, Geometry, Name, Layer, Visibility, Display, Drafting, Render
layer = ModelLayer(Layer=object_2.Layer)  # -> Layer, Name, Hidden, Locked, DisplayColour, Material, Linetype
display = DisplayAttributes(Display=object_2.Display)  # -> Display, DisplayColour, DisplayMode
display_colour = DisplayColour(DisplayColour=layer.DisplayColour)  # -> DisplayColour, Source, Colour
material = ModelMaterial(Material=layer.Material)  # -> Material, Name, Shader
display_colour_2 = DisplayColour(DisplayColour=display.DisplayColour)  # -> DisplayColour, Source, Colour
object_3 = ModelObject(object_2.Object)
col = Colour(display_colour.DisplayColour)
shader = Shader(material.Shader)
preview = CustomPreview(Geometry=object_3, Material=material.Shader)
object_4 = ClusterOutput(object_3)
shader_2 = ClusterOutput(shader)
col_2 = ClusterOutput(col)

# ==== cluster SelectDesign: Select a design with a name, an optional variant and an optional view. If no variant is provided it will select all variants. If you want to select the default variant then use the empty text. If no view is provided it will select all views. If you want to select the default view then use the empty text.
dn = ClusterInput()
na = ClusterInput()
variant = ClusterInput()
view = ClusterInput()
dn_2 = Design(dn)
na_2 = Name(na)
variant_2 = Variant(variant)
view_2 = View(view)
dsn = ModelDesign(Design=dn_2)  # -> Design, Valid, Name, Description, Icon, Image, Variant, View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
expression = Expression(x=dsn.Name, y=na_2, Expression="x=y")
cull = CullPattern(List=dsn.Design, CullPattern=expression)
dsn_2 = ModelDesign(Design=cull)  # -> Design, Valid, Name, Description, Icon, Image, Variant, View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
expression_2 = Expression(x=dsn_2.Variant, y=variant_2, Expression="x=y")
null = NullItem(Item=view_2)  # -> NullFlags, InvalidFlags, Description
cull_2 = CullPattern(List=dsn_2.Design, CullPattern=expression_2)
not = GateNot(A=null.NullFlags)
null_2 = NullItem(Item=variant_2)  # -> NullFlags, InvalidFlags, Description
and = GateAnd(A=not, B=null_2.NullFlags)
filter = StreamFilter(Gate=and, Stream0=cull_2, Stream1=cull)
dsn_3 = ModelDesign(Design=filter)  # -> Design, Valid, Name, Description, Icon, Image, Variant, View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
expression_3 = Expression(x=view_2, y=dsn_3.View, Expression="x=y")
cull_3 = CullPattern(List=dsn_3.Design, CullPattern=expression_3)
filter_2 = StreamFilter(Gate=null.NullFlags, Stream0=cull_3, Stream1=cull_2)
filter_3 = StreamFilter(Gate=null_2.NullFlags, Stream0=filter_2, Stream1=cull)
filter_4 = StreamFilter(Gate=and, Stream0=filter_3, Stream1=cull_3)
dn_3 = Design(filter_4)
dn_4 = ClusterOutput(dn_3)

# ==== cluster SelectRepresentation_4: Select a representation based on mime, lod and tags. The mime and lod must be equal and the tags must contain all the given tags.
rp = ClusterInput()
mm = ClusterInput()
lod = ClusterInput()
tags = ClusterInput()
rp_2 = Representation(rp)
mm_2 = Mime(mm)
lod_2 = Lod(lod)
tags_2 = Tags(tags)
rep = ModelRepresentation(Representation=rp_2)  # -> Representation, Valid, Url, Mime, Lod, Tags
expression = Expression(x=rep.Mime, y=mm_2, Expression="x=y")
cull = CullPattern(List=rep.Representation, CullPattern=expression)
rep_2 = ModelRepresentation(Representation=cull)  # -> Representation, Valid, Url, Mime, Lod, Tags
expression_2 = Expression(x=rep_2.Lod, y=lod_2, Expression="x=y")
cull_2 = CullPattern(List=rep_2.Representation, CullPattern=expression_2)
rep_3 = ModelRepresentation(Representation=cull_2)  # -> Representation, Valid, Url, Mime, Lod, Tags
trim = TrimTree(Tree=rep_3.Tags, Depth=1)
contains = Contains(L=trim, I=tags_2)  # -> R; inputs L: list, I: list; same code as contains
ma = MassAddition(Input=contains)  # -> Result, PartialResults
lng = ListLength(List=contains)
equals = Equality(FirstNumber=ma.Result, SecondNumber=lng)  # -> Equality, Inequality
cull_3 = CullPattern(List=rep_3.Representation, CullPattern=equals.Equality)
rep_4 = ModelRepresentation(Representation=cull_3)  # -> Representation, Valid, Url, Mime, Lod, Tags
sep = Separator()  # -> S; same code as sep
rep_5 = ReplaceText(Text=rep_4.Url, Find="/", Replace=sep, RecursiveReplace=False)
rp_3 = Representation(rep_4.Representation)
pa_ur = Text(rep_5)
ur = Url(rep_4.Url)
rp_4 = ClusterOutput(rp_3)
ur_2 = ClusterOutput(ur)
pa_ur_2 = ClusterOutput(pa_ur)

# ==== cluster SelectRepresentation: Select exactly one representation based on mime and tags. The tag matching is based on the highest Jaccard index (|∩|/|∪|). If the mime type is not given or does not exist, then all representations are used to search for closest match. If index is equally high the first representation is picked.
mm = ClusterInput()
tags = ClusterInput()
rp = ClusterInput()
rp_2 = Representation(rp)
mm_2 = Mime(mm)
tags_2 = Tags(tags)
l2o = List2Object(L=rp_2)  # -> O; inputs L: tree
# ---------- l2o: Python ----------
#Component Information
#--------------------------------------------------------------------------------------------
if ghenv.Component.RunCount<2:
    #General
    #--------------------------------------------------------------------------------------------
    __author__ = "Ueli Saluz"
    __version__ = "2022.04.24"
    
    ghenv.Component.Name = "List2Object"
    ghenv.Component.NickName = "L2O"
    ghenv.Component.Description = "Wraps a list of objects into a list object."
    ghenv.Component.Message = "VER 1.0"
    ghenv.Component.Category = "Sets"
    ghenv.Component.SubCategory = "Tree"
    
     #Inputs
    #--------------------------------------------------------------------------------------------
    inputIndex=0
    
    ghenv.Component.Params.Input[inputIndex].Name = "List"
    ghenv.Component.Params.Input[inputIndex].NickName = "L"
    ghenv.Component.Params.Input[inputIndex].Description = "Tree with lists to wrap."
    ghenv.Component.Params.Input[inputIndex].Optional = False
    inputIndex+=1
    

    #Outputs
    #--------------------------------------------------------------------------------------------
    outputIndex=0
    
    ghenv.Component.Params.Output[outputIndex].Name =  "ListObject" 
    ghenv.Component.Params.Output[outputIndex].NickName = "O"
    ghenv.Component.Params.Output[outputIndex].Description = "Python list object as single item."
    outputIndex+=1


#Imports
#--------------------------------------------------------------------------------------------
from System import Object
from Grasshopper import DataTree

#Solver - Run with trees to enhance performance drastically
#--------------------------------------------------------------------------------------------
if __name__ == "__main__":
    
    #Initialize trees
    #--------------------------------------------------------------------------------------------
    TreeToWrap = DataTree[Object]()
    
    #Data matching
    #--------------------------------------------------------------------------------------------
    for path in L.Paths:
        listBranch = L.Branch(path)
        TreeToWrap.Add(listBranch,path)
    
     #Assign trees to output
    #--------------------------------------------------------------------------------------------
    O = TreeToWrap
# ---------- end l2o ----------

rep = ModelRepresentation(Representation=graft(rp_2))  # -> Representation, Valid, Url, Description, Mime, Tags
lng = ListLength(List=mm_2)
expression = Expression(x=rep.Mime, y=mm_2, Expression="x=y")
null = NullItem(Item=lng)  # -> NullFlags, InvalidFlags, Description
expression_2 = Expression(x=lng, Expression="x=0")
ma = MassAddition(Input=expression)  # -> Result, PartialResults
or = GateOr(A=expression_2, B=null.NullFlags)
cull = CullPattern(List=rep.Representation, CullPattern=ma.Result)
trim = TrimTree(Tree=cull, Depth=1)
mime_match = Representation(trim)
nulltobranch = CSharpScript(D=mime_match)  # -> R; inputs D: tree
# ---------- nulltobranch: C# ----------
#region Usings
using System;
using System.Linq;
using System.Collections;
using System.Collections.Generic;
using System.Drawing;

using Rhino;
using Rhino.Geometry;

using Grasshopper;
using Grasshopper.Kernel;
using Grasshopper.Kernel.Data;
using Grasshopper.Kernel.Types;
#endregion

public class Script_Instance : GH_ScriptInstance
{

    private void RunScript(DataTree<object> D, ref object R)
    {
        foreach (GH_Path path in D.Paths)
            if (D.Branch(path).Count == 0)
                D.Add(null, path);

        R = D;
    }
}
# ---------- end nulltobranch ----------
nullrep = ReplaceNulls(Items=nulltobranch, Replacements=l2o)  # -> graft(Items), Count

o2l = Object2List(O=nullrep.Items)  # -> L; inputs O: tree
# ---------- o2l: Python ----------
# Component Information
# --------------------------------------------------------------------------------------------
if ghenv.Component.RunCount < 2:
    # General
    # --------------------------------------------------------------------------------------------
    __author__ = "Ueli Saluz"
    __version__ = "2025.02.19"

    ghenv.Component.Name = "Object2List"
    ghenv.Component.NickName = "O2L"
    ghenv.Component.Description = "Unwraps a list of objects into a list object and returns the object if it is not iterable."
    ghenv.Component.Message = "VER 1.1"
    ghenv.Component.Category = "Sets"
    ghenv.Component.SubCategory = "Tree"

    # Inputs
    # --------------------------------------------------------------------------------------------
    inputIndex = 0

    ghenv.Component.Params.Input[inputIndex].Name = "ListObject"
    ghenv.Component.Params.Input[inputIndex].NickName = "O"
    ghenv.Component.Params.Input[inputIndex].Description = "A python list object that will be unwrapped into a Grasshopper list or returned as is if not iterable."
    ghenv.Component.Params.Input[inputIndex].Optional = False
    inputIndex += 1

    # Outputs
    # --------------------------------------------------------------------------------------------
    outputIndex = 0

    ghenv.Component.Params.Output[outputIndex].Name = "List"
    ghenv.Component.Params.Output[outputIndex].NickName = "L"
    ghenv.Component.Params.Output[outputIndex].Description = "The unwrapped list."
    outputIndex += 1

# Imports
# --------------------------------------------------------------------------------------------
from System import Object
from Grasshopper import DataTree
from collections import Iterable

# Solver - Run with trees to enhance performance drastically
# --------------------------------------------------------------------------------------------
if __name__ == "__main__":

    # Initialize trees
    # --------------------------------------------------------------------------------------------
    OriginalTree = DataTree[Object]()

    # Data matching
    # --------------------------------------------------------------------------------------------
    for path in O.Paths:
        listBranch = O.Branch(path)
        for i, listItem in enumerate(listBranch):
            if isinstance(listItem, Iterable) and not isinstance(listItem, str):
                OriginalTree.AddRange(list(listItem), path.AppendElement(i))
            else:
                OriginalTree.Add(listItem, path.AppendElement(i))

    # Assign trees to output
    # --------------------------------------------------------------------------------------------
    L = OriginalTree
# ---------- end o2l ----------
trim_2 = TrimTree(Tree=o2l, Depth=1)
trim_3 = TrimTree(Tree=trim_2, Depth=1)

filter = StreamFilter(Gate=or, Stream0=trim_3, Stream1=rp_2)
rp_3 = Representation(filter)

rep_2 = ModelRepresentation(Representation=rp_3)  # -> Representation, Valid, Url, Description, Mime, Tags
jac = JaccardIndex_2(set1=tags_2, set2=rep_2.Tags)
trim_4 = TrimTree(Tree=jac, Depth=1)
minmax = MinimumMaximum(L=trim_4)  # -> Max, MaxI, Min, MinI; inputs L: list
# ---------- minmax: Python ----------
#Component Information
#--------------------------------------------------------------------------------------------
if ghenv.Component.RunCount<2:
    #General
    #--------------------------------------------------------------------------------------------
    __author__ = "Ueli Saluz"
    __version__ = "2022.04.22"
    
    ghenv.Component.Name = "MinimumMaximum"
    ghenv.Component.NickName = "MinMax"
    ghenv.Component.Description = "Returns the maximum and mininum of a list and their corresponding index."
    ghenv.Component.Message = "VER 1.0"
    ghenv.Component.Category = "Maths"
    ghenv.Component.SubCategory = "Util"
    
     #Inputs
    #--------------------------------------------------------------------------------------------
    inputIndex=0
    
    ghenv.Component.Params.Input[inputIndex].Name = "L"
    ghenv.Component.Params.Input[inputIndex].NickName = "L"
    ghenv.Component.Params.Input[inputIndex].Description = "A list of numbers."
    ghenv.Component.Params.Input[inputIndex].Optional = False
    inputIndex+=1
    
    
    #Outputs
    #--------------------------------------------------------------------------------------------
    outputIndex=0
    
    ghenv.Component.Params.Output[outputIndex].Name = "Max"
    ghenv.Component.Params.Output[outputIndex].NickName = "Max"
    ghenv.Component.Params.Output[outputIndex].Description = "Maximum of the list"
    outputIndex+=1
    
    ghenv.Component.Params.Output[outputIndex].Name = "MaxI"
    ghenv.Component.Params.Output[outputIndex].NickName = "MaxI"
    ghenv.Component.Params.Output[outputIndex].Description = "Index of the maximum of the list"
    outputIndex+=1
    
    ghenv.Component.Params.Output[outputIndex].Name = "Min"
    ghenv.Component.Params.Output[outputIndex].NickName = "Min"
    ghenv.Component.Params.Output[outputIndex].Description = "Minimum of the list"
    outputIndex+=1
    
    ghenv.Component.Params.Output[outputIndex].Name = "MinI"
    ghenv.Component.Params.Output[outputIndex].NickName = "MinI"
    ghenv.Component.Params.Output[outputIndex].Description = "Index of the minimum of the list"
    outputIndex+=1


#Solver - Run with trees to enhance performance drastically
#--------------------------------------------------------------------------------------------
if __name__ == "__main__":
    
    maximum = max(L)
    MaxI = L.index(maximum)
    Max = maximum
    
    minimum = min(L)
    MinI = L.index(minimum)
    Min = minimum
# ---------- end minmax ----------
item = ListItem(List=rep_2.Representation, Index=minmax.MaxI, Wrap=True)
rep_3 = ModelRepresentation(Representation=item)  # -> Representation, Valid, Url, Description, Mime, Tags
sep = Separator()  # -> S
# ---------- sep: C# ----------
#region Usings
using System;
using System.Linq;
using System.Collections;
using System.Collections.Generic;
using System.Drawing;
using System.IO;

using Rhino;
using Rhino.Geometry;

using Grasshopper;
using Grasshopper.Kernel;
using Grasshopper.Kernel.Data;
using Grasshopper.Kernel.Types;
#endregion

public class Script_Instance : GH_ScriptInstance
{
    private void RunScript(ref object S)
    {
        S = Path.DirectorySeparatorChar;
    }
}
# ---------- end sep ----------
txt = Text(rp_2)
txt_2 = Text(item)
rep_4 = ReplaceText(Text=rep_3.Url, Find="/", Replace=sep, RecursiveReplace=False)
itemindex = ItemIndex(L=txt, I=txt_2)  # -> i; inputs L: list; same code as itemindex
rp_4 = Representation(item)
ur = Url(rep_3.Url)
pa_ur = Text(rep_4)

i = Integer(itemindex)
i_2 = ClusterOutput(i)
ur_2 = ClusterOutput(ur)
pa_ur_2 = ClusterOutput(pa_ur)
rp_5 = ClusterOutput(rp_4)

# ==== cluster SelectRepresentation_2: Select exactly one representation based on tags. The tag matching is based on the highest Jaccard index (|∩|/|∪|).
rp = ClusterInput()
tags = ClusterInput()
rp_2 = Representation(rp)
tags_2 = Tags(tags)
rep = ModelRepresentation(Representation=rp_2)  # -> Representation, Valid, Url, Description, Tags, Qualities
jac = JaccardIndex_2(set1=tags_2, set2=rep.Tags)
trim = TrimTree(Tree=jac, Depth=1)
minmax = MinimumMaximum(L=trim)  # -> Max, MaxI, Min, MinI; inputs L: list; same code as minmax
txt = Text(rp_2)
item = ListItem(List=rep.Representation, Index=minmax.MaxI, Wrap=True)
txt_2 = Text(item)
itemindex = ItemIndex(L=txt, I=txt_2)  # -> i; inputs L: list; same code as itemindex
trim_2 = TrimTree(Tree=itemindex, Depth=1)
trim_3 = TrimTree(Tree=item, Depth=1)
i = Integer(trim_2)
rp_3 = Representation(trim_3)
i_2 = ClusterOutput(i)
rp_4 = ClusterOutput(rp_3)

# ==== cluster SelectRepresentation_3: Select a representation based on mime, lod and tags. The mime and lod must be equal and the tags must contain all the given tags.
rp = ClusterInput()
mm = ClusterInput()
lod = ClusterInput()
tags = ClusterInput()
rp_2 = Representation(rp)
mm_2 = Mime(mm)
lod_2 = Lod(lod)
tags_2 = Tags(tags)
rep = ModelRepresentation(Representation=rp_2)  # -> Representation, Valid, Url, Mime, Lod, Tags
expression = Expression(x=rep.Mime, y=mm_2, Expression="x=y")
cull = CullPattern(List=rep.Representation, CullPattern=expression)
rep_2 = ModelRepresentation(Representation=cull)  # -> Representation, Valid, Url, Mime, Lod, Tags
expression_2 = Expression(x=rep_2.Lod, y=lod_2, Expression="x=y")
cull_2 = CullPattern(List=rep_2.Representation, CullPattern=expression_2)
rep_3 = ModelRepresentation(Representation=cull_2)  # -> Representation, Valid, Url, Mime, Lod, Tags
trim = TrimTree(Tree=rep_3.Tags, Depth=1)
contains = Contains(L=trim, I=tags_2)  # -> R; inputs L: list, I: list
# ---------- contains: Python ----------
#Component Information
#--------------------------------------------------------------------------------------------
if ghenv.Component.RunCount<2:
    #General
    #--------------------------------------------------------------------------------------------
    __author__ = "Ueli Saluz"
    __version__ = "2023.02.04"
    
    ghenv.Component.Name = "Contains"
    ghenv.Component.NickName = "Contains"
    ghenv.Component.Description = "True if list contains one of the items."
    ghenv.Component.Message = "VER 1.0"
    ghenv.Component.Category = "Set"
    ghenv.Component.SubCategory = "List"
    
     #Inputs
    #--------------------------------------------------------------------------------------------
    inputIndex=0
    
    ghenv.Component.Params.Input[inputIndex].Name = "List"
    ghenv.Component.Params.Input[inputIndex].NickName = "L"
    ghenv.Component.Params.Input[inputIndex].Description = ""
    ghenv.Component.Params.Input[inputIndex].Optional = False
    inputIndex+=1
    
    ghenv.Component.Params.Input[inputIndex].Name = "Items"
    ghenv.Component.Params.Input[inputIndex].NickName = "I"
    ghenv.Component.Params.Input[inputIndex].Description = ""
    ghenv.Component.Params.Input[inputIndex].Optional = False
    inputIndex+=1
    
    #Outputs
    #--------------------------------------------------------------------------------------------
    outputIndex=0
    
    ghenv.Component.Params.Output[outputIndex].Name = "Contains"
    ghenv.Component.Params.Output[outputIndex].NickName = "R"
    ghenv.Component.Params.Output[outputIndex].Description = ""
    outputIndex+=1

R = False
for i in I:
    if i in L:
        R = True
# ---------- end contains ----------
ma = MassAddition(Input=contains)  # -> Result, PartialResults
lng = ListLength(List=contains)
equals = Equality(FirstNumber=ma.Result, SecondNumber=lng)  # -> Equality, Inequality
cull_3 = CullPattern(List=rep_3.Representation, CullPattern=equals.Equality)
rep_4 = ModelRepresentation(Representation=cull_3)  # -> Representation, Valid, Url, Mime, Lod, Tags
curdir = CSharpScript()  # -> D, S
# ---------- curdir: C# ----------
#region Usings
using System;
using System.Linq;
using System.Collections;
using System.Collections.Generic;
using System.Drawing;
using System.IO;

using Rhino;
using Rhino.Geometry;

using Grasshopper;
using Grasshopper.Kernel;
using Grasshopper.Kernel.Data;
using Grasshopper.Kernel.Types;
#endregion

public class Script_Instance : GH_ScriptInstance
{
    private void RunScript(ref object D, ref object S)
    {
        D = Path.GetDirectoryName(this.GrasshopperDocument.FilePath);
        S = Path.DirectorySeparatorChar;
    }
}
# ---------- end curdir ----------
rep_5 = ReplaceText(Text=rep_4.Url, Find="/", Replace=curdir.S, RecursiveReplace=False)
rp_3 = Representation(rep_4.Representation)
pa_ur = Text(rep_5)
ur = Url(rep_4.Url)
rp_4 = ClusterOutput(rp_3)
ur_2 = ClusterOutput(ur)
pa_ur_2 = ClusterOutput(pa_ur)

# ==== cluster JaccardIndex_2: Compute the Jaccard Index of two sets.
set1 = ClusterInput()
set2 = ClusterInput()
set1_2 = Data(set1)
set2_2 = Data(set2)
cset = CreateSet(List=set2_2)  # -> Set, Map
cset_2 = CreateSet(List=set1_2)  # -> Set, Map
lng = ListLength(List=set1_2)
lng_2 = ListLength(List=set2_2)
intersection = SetIntersection(SetA=cset_2.Set, SetB=cset.Set)
expression = Expression(x=lng, Expression="x=0")
expression_2 = Expression(x=lng_2, Expression="x=0")
sunion = SetUnion(SetA=cset_2.Set, SetB=cset.Set)
null = NullItem(Item=lng)  # -> NullFlags, InvalidFlags, Description
null_2 = NullItem(Item=lng_2)  # -> NullFlags, InvalidFlags, Description
lng_3 = ListLength(List=sunion)
lng_4 = ListLength(List=intersection)
or = GateOr(A=null.NullFlags, B=expression)
or_2 = GateOr(A=null_2.NullFlags, B=expression_2)
division = Division(A=lng_4, B=lng_3)
int = Integer(or)
int_2 = Integer(or_2)
concat = Concatenate(FragmentA=int, FragmentB=int_2)
b2d = BinaryToDecimal(Binary=concat)  # -> Decimal
# ---------- b2d: Python ----------
if ghenv.Component.RunCount<2:
    __author__ = "Ueli Saluz"
    __version__ = "2021.11.14"
    
    ghenv.Component.Name = "BinaryToDecimal"
    ghenv.Component.NickName = "B2D"
    ghenv.Component.Description = "Converts a number in binary representation to a number in decimal representation."
    ghenv.Component.Message = "VER 1.0"
    
    ghenv.Component.Params.Input[0].NickName = "Binary"
    
    ghenv.Component.Params.Input[0].Description = "Binary representation of a number."
    
    ghenv.Component.Params.Output[0].NickName = "Decimal"
    
    ghenv.Component.Params.Output[0].Description = "Converted decimal representation of the same number."

if __name__ == "__main__":
    Decimal = int(Binary,2)
# ---------- end b2d ----------
expression_3 = Expression(c=b2d, x=division, Expression="If(c=0,x,If(c=3,1,0))")
N = Number(expression_3)
N_2 = ClusterOutput(N)
