# Grasshopper definition hexagonal-cut-concrete-forest.gh (Grasshopper 1.0.8)

subtraction = Subtraction(A=Slider(1, range=0..10), B="0.1340")
_2d = _2D(raster=Slider(5.2, range=0..10), corridor=Slider(2, range=0..10), offset=subtraction, shift=Slider(0.25, range=0..1))  # -> columns_3, slab_2, beams_2, offset_4
panel = Panel(_2d.offset_4)
_3d = _3D(
    columns=_2d.columns_3,
    slabs=_2d.slab_2,
    beams=_2d.beams_2,
    floor=Slider(3, range=0..10),
    slab=Slider(0.265, range=0..1),
    beam=Slider(0.45, range=0..1),
    width=Slider(0.56, range=0..1))  # -> tiles_2, slabs_5, columns_7, beams_7, slabs_6, columns_8, beams_8, points_3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
txt = Text(_3d.points_3)
txt_2 = Text(_3d.vec_3)
txt_3 = Text(_3d.port_3)
concat = Concatenate(
    FragmentE="Connector(Id=\"",
    FragmentD=_3d.ids_3,
    FragmentA="\",Point=",
    FragmentB=txt,
    FragmentC=",Direction=",
    FragmentF=txt_2,
    FragmentH=",Port=\"",
    FragmentI=txt_3,
    FragmentG="\")")
bang = ExplodeTree(Data=concat)  # -> Branch0, Branch1
panel_2 = Panel(bang.Branch1)
panel_3 = Panel(bang.Branch0)
bang_2 = ExplodeTree(Data=_3d.slabs_5)  # -> Branch0, Branch1
bang_3 = ExplodeTree(Data=_3d.tiles_2)  # -> Branch0, Branch1
bang_4 = ExplodeTree(Data=_3d.beams_7)  # -> Branch0, Branch1
bang_5 = ExplodeTree(Data=_3d.columns_7)  # -> Branch0, Branch1
geo = Geometry(_3d.tiles_2)
bang_6 = ExplodeTree(Data=_3d.slabs_6)  # -> Branch0, Branch1
bang_7 = ExplodeTree(Data=_3d.beams_8)  # -> Branch0, Branch1
bang_8 = ExplodeTree(Data=_3d.columns_8)  # -> Branch0, Branch1
item = ListItem(Index=0, Wrap=True)

# ==== cluster _2D
raster = ClusterInput()
corridor = ClusterInput()
offset = ClusterInput()
shift = ClusterInput()
raster_2 = Number(raster)
corridor_2 = Number(corridor)
offset_2 = Number(offset)
shift_2 = Number(shift)
expression = Expression(x=raster_2, Expression="x*Sqrt(3)/2")
expression_2 = Expression(x=offset_2, Expression="x*2/Sqrt(3)")
expression_3 = Expression(x=raster_2, Expression="x*Sqrt(3)/6")
expression_4 = Expression(x=raster_2, Expression="x/Sqrt(3)")
expression_5 = Expression(x=raster_2, Expression="x/2")
expression_6 = Expression(x=corridor_2, Expression="x/2")
expression_7 = Expression(x=raster_2, Expression="x/4")
addition = Addition(A=raster_2, B=corridor_2)
X = UnitX(Factor=expression_6)
X_2 = UnitX(Factor=raster_2)
triangle_height = Number(expression)
X_3 = UnitX(Factor=expression_5)
rev = Reverse(Vector=X_3)
Y = UnitY(Factor=triangle_height)
rev_2 = Reverse(Vector=Y)
X_4 = UnitX(Factor=raster_2)
Y_2 = UnitY(Factor=triangle_height)
X_5 = UnitX(Factor=expression_5)
pt = ConstructPoint(XCoordinate=0, YCoordinate=0, ZCoordinate=0)
addition_2 = Addition(A=rev, B=rev_2)
rev_3 = Reverse(Vector=Y_2)
rev_4 = Reverse(Vector=X_5)
addition_3 = Addition(A=X_3, B=Y)
X_6 = UnitX(Factor=expression_2)
rev_5 = Reverse(Vector=X_6)
multiplication = Multiplication(A=shift_2, B=rev_3)
move = Move(Geometry=pt, Motion=addition_3)  # -> Geometry, Transform
multiplication_2 = Multiplication(A=shift_2, B=rev_4)
move_2 = Move(Geometry=pt, Motion=X_4)  # -> Geometry, Transform
column_1 = Point(pt)
column_2 = Point(move_2.Geometry)
column_3 = Point(move.Geometry)
addition_4 = Addition(A=multiplication, B=multiplication_2)
merge = Merge(Data1=pt, Data2=move_2.Geometry, Data3=move.Geometry)
merge_2 = Merge(Data1=pt, Data2=move_2.Geometry)
columns_1 = Point(merge_2)
X_7 = UnitX(Factor=addition)
pline = PolyLine(Vertices=merge, Closed=invert(False))
move_3 = Move(Geometry=columns_1, Motion=X_7)  # -> Geometry, Transform
triangle_1 = Curve(pline)
move_4 = Move(Geometry=triangle_1, Motion=X_2)  # -> Geometry, Transform
rotate = Rotate(Geometry=move_4.Geometry, Angle=degrees("60"), Plane=move_2.Geometry)  # -> Geometry, Transform
triangle_2 = Curve(rotate.Geometry)
merge_3 = Merge(Data1=triangle_1, Data2=triangle_2)
triangles_1 = Curve(merge_3)
move_5 = Move(Geometry=triangles_1, Motion=X_7)  # -> Geometry, Transform
triangles_2 = Curve(move_5.Geometry)
columns_2 = Point(move_3.Geometry)
merge_4 = Merge(Data1=columns_1, Data2=columns_2)
item = ListItem(List=columns_2, Index=0, Wrap=True)  # -> Item, Item1
columns = Point(merge_4)
columns_3 = ClusterOutput(columns)
Z = UnitZ(Factor=1)
merge_5 = Merge(Data1=triangle_1, Data2=triangle_2)
merge_6 = Merge(Data1=triangles_1, Data2=triangles_2)
move_6 = Move(Geometry=merge_6, Motion=addition_2)  # -> Geometry, Transform
runion = RegionUnion(Curves=merge_5)
triangles_b = Curve(move_6.Geometry)
triangles_a = Curve(merge_6)
trim = TrimTree(Tree=runion, Depth=1)
merge_7 = Merge(Data1=triangles_a, Data2=triangles_b)
parallelogram_1 = Curve(trim)
merge_8 = Merge(Data1=parallelogram_1)
move_7 = Move(Geometry=merge_8, Motion=rev_5)  # -> Geometry, Transform
move_8 = Move(Geometry=parallelogram_1, Motion=X_7)  # -> Geometry, Transform
parallelogram_2 = Curve(move_8.Geometry)
merge_9 = Merge(Data1=parallelogram_2)
move_9 = Move(Geometry=merge_9, Motion=X_6)  # -> Geometry, Transform
merge_10 = Merge(Data1=move_7.Geometry, Data2=move_9.Geometry)
cp = ControlPoints(Curve=merge_10)  # -> Points, Weights, Knots
trim_2 = TrimTree(Tree=cp.Points, Depth=1)
hull2d = ConvexHull(Points=trim_2, Plane=PlaneXY(0, 0, 0))  # -> Hull, HullZ, Indices
outline_1 = Curve(hull2d.Hull)
bbox = BoundingBox(Content=outline_1, Plane=PlaneXY(0, 0, 0))  # -> Box, Box_2
debox = DeconstructBox(Box=bbox.Box_2)  # -> Plane, X, Y, Z
trim_3 = TrimTree(Tree=debox.Plane, Depth=1)
trim_4 = TrimTree(Tree=debox.Y, Depth=1)
trim_5 = TrimTree(Tree=debox.X, Depth=1)
rectangle = Rectangle(Plane=trim_3, XSize=trim_5, YSize=trim_4, Radius=0)  # -> Rectangle, Length
move_10 = Move(Geometry=outline_1, Motion=addition_2)  # -> Geometry, Transform
move_11 = Move(Geometry=rectangle.Rectangle, Motion=addition_4)  # -> Geometry, Transform
outline_2 = Curve(move_10.Geometry)
cutter = Curve(move_11.Geometry)
merge_11 = Merge(Data1=outline_1, Data2=outline_2)
srf = Surface(cutter)
runion_2 = RegionUnion(Curves=merge_11)
extr = Extrude(Base=srf, Direction=Z)
trim_6 = TrimTree(Tree=runion_2, Depth=1)
rint = RegionIntersection(CurvesA=trim_6, CurvesB=cutter)
merge_12 = Merge(Data1=parallelogram_1, Data2=parallelogram_2)
parallelograms_1 = Curve(merge_12)
move_12 = Move(Geometry=parallelograms_1, Motion=addition_2)  # -> Geometry, Transform
parallelograms_2 = Curve(move_12.Geometry)
item_2 = ListItem(List=parallelograms_2, Index=0, Wrap=True)  # -> Item, Item1
parallelogram_a = Curve(item_2.Item)
parallelogram_b = Curve(item_2.Item1)
triangles = Curve(merge_7)
trim_7 = TrimWithBrep(Curve=triangles, Brep=extr)  # -> Inside, Outside
trim_8 = TrimTree(Tree=trim_7.Inside, Depth=1)
item_3 = ListItem(List=trim_8, Index=0, Wrap=True)  # -> Item, Item1, Item2, Item3, Item4, Item5, Item6, Item7
crv_cp = CurveClosestPoint(Point=columns_1, Curve=item_3.Item)  # -> Point, Parameter, Distance
crv_cp_2 = CurveClosestPoint(Point=column_2, Curve=item_3.Item1)  # -> Point, Parameter, Distance
crv_cp_3 = CurveClosestPoint(Point=columns_2, Curve=item_3.Item2)  # -> Point, Parameter, Distance
crv_cp_4 = CurveClosestPoint(Point=item.Item1, Curve=item_3.Item3)  # -> Point, Parameter, Distance
crv_cp_5 = CurveClosestPoint(Point=column_1, Curve=item_3.Item4)  # -> Point, Parameter, Distance
crv_cp_6 = CurveClosestPoint(Point=columns_1, Curve=item_3.Item5)  # -> Point, Parameter, Distance
crv_cp_7 = CurveClosestPoint(Point=item.Item, Curve=item_3.Item6)  # -> Point, Parameter, Distance
crv_cp_8 = CurveClosestPoint(Point=columns_2, Curve=item_3.Item7)  # -> Point, Parameter, Distance
shatter = Shatter(Curve=item_3.Item, Parameters=crv_cp.Parameter)
shatter_2 = Shatter(Curve=item_3.Item1, Parameters=crv_cp_2.Parameter)
shatter_3 = Shatter(Curve=item_3.Item2, Parameters=crv_cp_3.Parameter)
shatter_4 = Shatter(Curve=item_3.Item3, Parameters=crv_cp_4.Parameter)
shatter_5 = Shatter(Curve=item_3.Item4, Parameters=crv_cp_5.Parameter)
shatter_6 = Shatter(Curve=item_3.Item5, Parameters=crv_cp_6.Parameter)
shatter_7 = Shatter(Curve=item_3.Item6, Parameters=crv_cp_7.Parameter)
shatter_8 = Shatter(Curve=item_3.Item7, Parameters=crv_cp_8.Parameter)
trim_9 = TrimTree(Tree=shatter, Depth=1)
trim_10 = TrimTree(Tree=shatter_2, Depth=1)
trim_11 = TrimTree(Tree=shatter_3, Depth=1)
trim_12 = TrimTree(Tree=shatter_4, Depth=1)
trim_13 = TrimTree(Tree=shatter_5, Depth=1)
trim_14 = TrimTree(Tree=shatter_6, Depth=1)
trim_15 = TrimTree(Tree=shatter_7, Depth=1)
trim_16 = TrimTree(Tree=shatter_8, Depth=1)
item_4 = ListItem(List=trim_9, Index=0, Wrap=invert(True))  # -> Item, Item1, Item2
item_5 = ListItem(List=trim_10, Index=0, Wrap=invert(True))  # -> Item, Item1
move_13 = Move(Geometry=item_5.Item1, Motion=X)  # -> Geometry, Transform
ext = ExtendCurve(Curve=move_13.Geometry, Type=0, Start=raster_2, End="0")
end = EndPoints(Curve=move_13.Geometry)  # -> Start, End
item_6 = ListItem(List=trim_11, Index=0, Wrap=invert(True))  # -> Item, Item1, Item2
item_7 = ListItem(List=trim_12, Index=0, Wrap=invert(True))  # -> Item, Item1
item_8 = ListItem(List=trim_13, Index=0, Wrap=invert(True))  # -> Item, Item1
item_9 = ListItem(List=trim_14, Index=0, Wrap=invert(True))  # -> Item, Item1, Item2
item_10 = ListItem(List=trim_15, Index=0, Wrap=invert(True))  # -> Item, Item1
item_11 = ListItem(List=trim_16, Index=0, Wrap=invert(True))  # -> Item, Item1, Item2
srfsplit = SurfaceSplit(Surface=rint, Curves=ext)
flip = FlipCurve(Curve=item_4.Item)  # -> Curve, Flag
flip_2 = FlipCurve(Curve=item_9.Item)  # -> Curve, Flag
flip_3 = FlipCurve(Curve=item_11.Item)  # -> Curve, Flag
flip_4 = FlipCurve(Curve=item_5.Item)  # -> Curve, Flag
flip_5 = FlipCurve(Curve=item_6.Item)  # -> Curve, Flag
flip_6 = FlipCurve(Curve=item_7.Item)  # -> Curve, Flag
ln = Line(StartPoint=column_2, EndPoint=end.Start)
ln_2 = Line(StartPoint=item.Item, EndPoint=end.Start)
trim_17 = TrimTree(Tree=srfsplit, Depth=1)
merge_13 = Merge(
    Data1=flip.Curve,
    Data2=flip_4.Curve,
    Data3=item_5.Item1,
    Data4=flip_5.Curve,
    Data5=flip_6.Curve,
    Data6=item_7.Item1,
    Data7=flip_2.Curve,
    Data8=item_9.Item2,
    Data9=item_10.Item1,
    Data10=flip_3.Curve,
    Data11=item_11.Item2,
    Data12=item_8.Item1,
    Data13=ln,
    Data14=ln_2)
merge_14 = Merge(Data1=item_9.Item1, Data2=item_11.Item1)
trim_18 = TrimTree(Tree=trim_17, Depth=1)
entwine = Entwine(Branch00=merge_14, Branch01=merge_13, FlattenInputs=True)
len = Length(Curve=ln)
slab = Surface(trim_18)
division = Division(A=len, B=expression_2)
beams = Curve(entwine)
slab_2 = ClusterOutput(slab)
beams_2 = ClusterOutput(beams)
subtraction = Subtraction(A="1", B=division)
offset_3 = Number(subtraction)
offset_4 = ClusterOutput(offset_3)

# ==== cluster _3D
column_parallelogram_left_right_bottom_t = Panel("""c-p1-l-b
c-p1-l-t
c-p1-r-b
c-p1-r-t
c-p2-l-b
c-p2-l-t
c-p2-r-b
c-p2-r-t""")  # "column parallelogram left|right bottom|top"
Z = UnitZ(Factor=1)
rev = Reverse(Vector=Z)
merge = Merge(Data1=rev, Data2=Z, Data3=rev, Data4=Z)
column_bottom_top = Panel("""c-b
c-t
c-b
c-t
c-b
c-t
c-b
c-t""")
split = SplitList(List=column_parallelogram_left_right_bottom_t, Index="4")  # -> ListA, ListB
split_2 = SplitList(List=column_bottom_top, Index="4")  # -> ListA, ListB
trim = TrimTree(Tree=split.ListA, Depth=1)
trim_2 = TrimTree(Tree=split.ListB, Depth=1)
trim_3 = TrimTree(Tree=split_2.ListA, Depth=1)
trim_4 = TrimTree(Tree=split_2.ListB, Depth=1)
columns = ClusterInput()
slabs = ClusterInput()
beams = ClusterInput()
floor = ClusterInput()
slab = ClusterInput()
beam = ClusterInput()
width = ClusterInput()
slabs_2 = Surface(slabs)
columns_2 = Point(columns)
beams_2 = Curve(beams)
floor_2 = Number(floor)
slab_2 = Number(slab)
beam_2 = Number(beam)
width_2 = Number(width)
beam_parallelogram_top_bottom_triangle_c = Panel("""b-p1-t-t1-c3-l
b-p1-t-t1-c3-r
b-p1-t-t2-c3-l
b-p2-t-t1-c3-l
b-p2-t-t1-c3-r
b-p2-t-t2-c3-l
b-p1-b-t1-c2-l
b-p1-b-t1-c1-r
b-p2-b-t1-c1-l
b-p2-b-t1-c2-l
b-p2-b-t1-c1-r
b-p1-b-t1-c1-l
b-p1-t-t2-c1-l
b-p2-t-t1-c1-l""")  # "beam parallelogram top|bottom triangle column left|right"
expression = Expression(x=width_2, Expression="x/2")
expression_2 = Expression(x=expression, Expression="x/2")
expression_3 = Expression(x=beam_2, Expression="x/2")
beam_width = Number(expression)
polygon = Polygon(Plane=columns_2, Radius=expression, Segments=6, FilletRadius=0)  # -> Polygon, Length
neg = Negative(Value=expression_2)
neg_2 = Negative(Value=expression_3)
Z_2 = UnitZ(Factor=1)
xz = XZPlane(Origin=Point(0, 0, 0))
dom = ConstructDomain(DomainStart=expression_3, DomainEnd=neg_2)
bang = ExplodeTree(Data=beams_2)  # -> Branch0, Branch1
dom_2 = ConstructDomain(DomainStart=expression_2, DomainEnd=neg)
rotate = Rotate(Geometry=polygon.Polygon, Angle=degrees("30"), Plane=columns_2)  # -> Geometry, Transform
subtraction = Subtraction(A=floor_2, B=slab_2)
line = LineSDL(Start=columns_2, Direction=Z_2, Length=floor_2)
rectangle = Rectangle(Plane=xz, XSize=dom_2, YSize=dom, Radius=0)  # -> Rectangle, Length
runion = RegionUnion(Curves=slabs_2)
crv = Curve(slabs_2)
Z_3 = UnitZ(Factor=subtraction)
srf = Surface(rotate.Geometry)
columns_3 = Line(line)
end = EndPoints(Curve=columns_3)  # -> Start, End
merge_2 = Merge(Data1=graft(end.Start), Data2=graft(end.End))
trim_5 = TrimTree(Tree=merge_2, Depth=1)
split_3 = SplitList(List=trim_5, Index="4")  # -> ListA, ListB
trim_6 = TrimTree(Tree=split_3.ListA, Depth=1)
trim_7 = TrimTree(Tree=split_3.ListB, Depth=1)
ext = ExtendCurve(Curve=bang.Branch1, Type=0, Start="0", End=expression)
Z_4 = UnitZ(Factor=slab_2)
trim_8 = TrimTree(Tree=runion, Depth=1)
extr = Extrude(Base=srf, Direction=Z_3)
merge_3 = Merge(Data1=bang.Branch0, Data2=ext)
pframe = PerpFrame(Curve=reparameterize(merge_3), Parameter="0")
Z_5 = UnitZ(Factor=floor_2)
move = Move(Geometry=slabs_2, Motion=Z_3)  # -> Geometry, Transform
Z_6 = UnitZ(Factor=slab_2)
Z_7 = UnitZ(Factor=floor_2)
extr_2 = Extrude(Base=crv, Direction=Z_7)
crv_2 = Curve(trim_8)
beam_parallelogram_top_bottom_triangle_c_2 = Panel("""b-l
b-l-m
b-l
b-l
b-l-m
b-l
b-s-m
b-s
b-s-m
b-s-m
b-s
b-s-m
b-s
b-s-m""")  # "beam parallelogram top|bottom triangle column left|right"
prot = RotatePlane(Plane=pframe, Angle=degrees("90"))
Z_8 = UnitZ(Factor=beam_2)
columns_4 = Brep(extr)
move_2 = Move(Geometry=move.Geometry, Motion=Z_6)  # -> Geometry, Transform
move_3 = Move(Geometry=beams_2, Motion=Z_5)  # -> Geometry, Transform
extr_3 = Extrude(Base=move.Geometry, Direction=Z_4)
extr_4 = Extrude(Base=crv_2, Direction=Z_7)
orient = Orient(Geometry=rectangle.Rectangle, Source=xz, Target=prot)  # -> Geometry, Transform
subtraction_2 = Subtraction(A=Z_3, B=Z_8)
slabs_3 = Surface(graft(move_2.Geometry))
ids = Text(beam_parallelogram_top_bottom_triangle_c)
slabs_4 = Brep(graft(extr_3))
beams_3 = Line(move_3.Geometry)
bang_2 = ExplodeTree(Data=beams_3)  # -> Branch0, Branch1
end_2 = EndPoints(Curve=bang_2.Branch1)  # -> Start, End
split_4 = SplitList(List=end_2.End, Index="5")  # -> ListA, ListB
trim_9 = TrimTree(Tree=split_4.ListA, Depth=1)
expression_4 = Expression(x=trim_9, Expression="1")
Y = UnitY(Factor=expression_4)
trim_10 = TrimTree(Tree=split_4.ListB, Depth=1)
split_5 = SplitList(List=trim_10, Index="6")  # -> ListA, ListB
trim_11 = TrimTree(Tree=split_5.ListA, Depth=1)
trim_12 = TrimTree(Tree=split_5.ListB, Depth=1)
item = ListItem(List=trim_12, Index=0, Wrap=True)  # -> Item, Item1, Item2
expression_5 = Expression(x=item.Item, Expression="1")
expression_6 = Expression(x=trim_11, Expression="1")
expression_7 = Expression(x=item.Item2, Expression="1")
expression_8 = Expression(x=item.Item1, Expression="1")
Y_2 = UnitY(Factor=expression_6)
X = UnitX(Factor=expression_7)
Y_3 = UnitY(Factor=expression_5)
X_2 = UnitX(Factor=expression_8)
rev_2 = Reverse(Vector=Y_2)
rev_3 = Reverse(Vector=X)
rev_4 = Reverse(Vector=Y_3)
merge_4 = Merge(Data1=Y, Data2=rev_2, Data3=rev_4, Data4=X_2, Data5=rev_3)
points = Point(end_2.End)
vec = Vector(merge_4)
port = Text(beam_parallelogram_top_bottom_triangle_c_2)
swp1 = Sweep1(Rail=graft(merge_3), Sections=graft(orient.Geometry), Miter=1)
Z_9 = UnitZ(Factor=expression_3)
trim_13 = TrimTree(Tree=swp1, Depth="3")
move_4 = Move(Geometry=trim_13, Motion=Z_9)  # -> Geometry, Transform
trim_14 = TrimSolid(Shape=move_4.Geometry, Cutters=columns_4)
trim_15 = TrimTree(Tree=trim_14, Depth=1)
cap = CapHoles(Brep=trim_15)
split_6 = SplitList(List=cap, Index="14")  # -> ListA, ListB
trim_16 = TrimTree(Tree=split_6.ListA, Depth=1)
trim_17 = TrimTree(Tree=split_6.ListB, Depth=1)
split_7 = SplitBrep(Brep=trim_16, Cutter=extr_4)
split_8 = SplitBrep(Brep=trim_17, Cutter=extr_2)
item_2 = ListItem(List=split_8, Index=0, Wrap=True)
item_3 = ListItem(List=split_7, Index=0, Wrap=True)
cap_2 = CapHoles(Brep=item_3)
cap_3 = CapHoles(Brep=item_2)
merge_5 = Merge(Data1=cap_2, Data2=cap_3)
trim_18 = TrimTree(Tree=merge_5, Depth=1)
move_5 = Move(Geometry=trim_18, Motion=subtraction_2)  # -> Geometry, Transform
beams_4 = Brep(move_5.Geometry)
tag = TextTag(Location=points, Text=beam_parallelogram_top_bottom_triangle_c)
tag_2 = TextTag(Location=points, Text=beam_parallelogram_top_bottom_triangle_c_2)
trim_19 = TrimTree(Tree=points, Depth=1)
panel = Panel("""0
1
4
5
6
10
11""")
item_4 = ListItem(List=trim_19, Index=0, Wrap=invert(True))  # -> Item, Item1, Item2, Item3, Item4, Item5, Item6, Item7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
item_5 = ListItem(List=beams_4, Index=0, Wrap=invert(True))  # -> Item, Item1, Item2, Item3, Item4, Item5, Item6, Item7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
item_6 = ListItem(List=ids, Index=0, Wrap=invert(True))  # -> Item, Item1, Item2, Item3, Item4, Item5, Item6, Item7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
item_7 = ListItem(List=columns_4, Index=0, Wrap=invert(True))  # -> Item, Item1, Item2, Item3
merge_6 = Merge(
    Data1=item_4.Item3,
    Data2=item_4.Item4,
    Data3=item_4.Item5,
    Data4=item_4.Item8,
    Data5=item_4.Item9,
    Data6=item_4.Item10,
    Data7=item_4.Item13)
merge_7 = Merge(
    Data1=item_5.Item,
    Data2=item_5.Item1,
    Data3=item_5.Item4,
    Data4=item_5.Item6,
    Data5=item_5.Item10,
    Data6=item_5.Item11,
    Data7=item_5.Item15,
    Data8=item_5.Item5)
merge_8 = Merge(
    Data1=item_4.Item,
    Data2=item_4.Item1,
    Data3=item_4.Item2,
    Data4=item_4.Item6,
    Data5=item_4.Item7,
    Data6=item_4.Item11,
    Data7=item_4.Item12)
merge_9 = Merge(
    Data1=item_5.Item2,
    Data2=item_5.Item7,
    Data3=item_5.Item12,
    Data4=item_5.Item8,
    Data5=item_5.Item9,
    Data6=item_5.Item13,
    Data7=item_5.Item14,
    Data8=item_5.Item3)
merge_10 = Merge(
    Data1=item_6.Item3,
    Data2=item_6.Item4,
    Data3=item_6.Item5,
    Data4=item_6.Item8,
    Data5=item_6.Item9,
    Data6=item_6.Item10,
    Data7=item_6.Item13)
merge_11 = Merge(
    Data1=item_6.Item,
    Data2=item_6.Item1,
    Data3=item_6.Item2,
    Data4=item_6.Item6,
    Data5=item_6.Item7,
    Data6=item_6.Item11,
    Data7=item_6.Item12)
merge_12 = Merge(Data1=item_7.Item, Data2=item_7.Item1)
merge_13 = Merge(Data1=item_7.Item2, Data2=item_7.Item3)
entwine = Entwine(Branch00=merge_7, Branch01=merge_9, FlattenInputs=True)
merge_14 = Merge(Data1=merge_8, Data2=trim_6)
merge_15 = Merge(Data1=merge_6, Data2=trim_7)
merge_16 = Merge(Data1=merge_11, Data2=trim)
merge_17 = Merge(Data1=merge_10, Data2=trim_2)
entwine_2 = Entwine(Branch00=merge_12, Branch01=merge_13, FlattenInputs=True)
entwine_3 = Entwine(Branch00=merge_14, Branch01=merge_15, FlattenInputs=True)
trim_20 = TrimTree(Tree=beams_3, Depth=1)
entwine_4 = Entwine(Branch00=merge_16, Branch01=merge_17, FlattenInputs=True)
item_8 = ListItem(List=trim_20, Index=0, Wrap=invert(True))  # -> Item, Item1, Item2, Item3, Item4, Item5, Item6, Item7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
trim_21 = TrimTree(Tree=vec, Depth=1)
item_9 = ListItem(List=columns_3, Index=0, Wrap=invert(True))  # -> Item, Item1, Item2, Item3
item_10 = ListItem(List=port, Index=0, Wrap=invert(True))  # -> Item, Item1, Item2, Item3, Item4, Item5, Item6, Item7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
item_11 = ListItem(List=trim_21, Index=0, Wrap=invert(True))  # -> Item, Item1, Item2, Item3, Item4, Item5, Item6, Item7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
merge_18 = Merge(
    Data1=item_8.Item1,
    Data2=item_8.Item6,
    Data3=item_8.Item10,
    Data4=item_8.Item11,
    Data5=item_8.Item15,
    Data6=item_8.Item5,
    Data7=item_8.Item7,
    Data8=item_8.Item12)
merge_19 = Merge(
    Data1=item_8.Item,
    Data2=item_8.Item4,
    Data3=item_8.Item2,
    Data4=item_8.Item8,
    Data5=item_8.Item9,
    Data6=item_8.Item13,
    Data7=item_8.Item14,
    Data8=item_8.Item3)
merge_20 = Merge(Data1=item_9.Item, Data2=item_9.Item1)
merge_21 = Merge(Data1=item_9.Item2, Data2=item_9.Item3)
merge_22 = Merge(
    Data1=item_10.Item,
    Data2=item_10.Item1,
    Data3=item_10.Item2,
    Data4=item_10.Item6,
    Data5=item_10.Item7,
    Data6=item_10.Item11,
    Data7=item_10.Item12)
merge_23 = Merge(
    Data1=item_10.Item3,
    Data2=item_10.Item4,
    Data3=item_10.Item5,
    Data4=item_10.Item8,
    Data5=item_10.Item9,
    Data6=item_10.Item10,
    Data7=item_10.Item13)
merge_24 = Merge(
    Data1=item_11.Item,
    Data2=item_11.Item1,
    Data3=item_11.Item2,
    Data4=item_11.Item6,
    Data5=item_11.Item7,
    Data6=item_11.Item11,
    Data7=item_11.Item12)
merge_25 = Merge(
    Data1=item_11.Item3,
    Data2=item_11.Item4,
    Data3=item_11.Item5,
    Data4=item_11.Item8,
    Data5=item_11.Item9,
    Data6=item_11.Item10,
    Data7=item_11.Item13)
entwine_5 = Entwine(Branch00=merge_18, Branch01=merge_19, FlattenInputs=True)
entwine_6 = Entwine(Branch00=merge_20, Branch01=merge_21, FlattenInputs=True)
merge_26 = Merge(Data1=merge_23, Data2=trim_4)
merge_27 = Merge(Data1=merge_22, Data2=trim_3)
merge_28 = Merge(Data1=merge_24, Data2=merge)
merge_29 = Merge(Data1=merge_25, Data2=merge)
merge_30 = Merge(Data1=entwine_2, Data2=entwine, Data3=slabs_4)
sunion = SolidUnion(Breps=merge_30)
entwine_7 = Entwine(Branch00=merge_27, Branch01=merge_26, FlattenInputs=True)
entwine_8 = Entwine(Branch00=merge_28, Branch01=merge_29, FlattenInputs=True)
tiles = Geometry(sunion)
beams_5 = Brep(entwine)
beams_6 = Line(entwine_5)
columns_5 = Brep(entwine_2)
columns_6 = Line(entwine_6)
points_2 = Point(entwine_3)
vec_2 = Vector(entwine_8)
ids_2 = Text(entwine_4)
port_2 = Text(entwine_7)
expression_9 = Expression(x=entwine_8, Expression="x/2")
slabs_5 = ClusterOutput(slabs_4)
columns_7 = ClusterOutput(columns_5)
beams_7 = ClusterOutput(beams_5)
slabs_6 = ClusterOutput(slabs_3)
columns_8 = ClusterOutput(columns_6)
beams_8 = ClusterOutput(beams_6)
points_3 = ClusterOutput(points_2)
vec_3 = ClusterOutput(vec_2)
ids_3 = ClusterOutput(ids_2)
port_3 = ClusterOutput(port_2)
tiles_2 = ClusterOutput(tiles)
move_6 = Move(Geometry=entwine_3, Motion=expression_9)  # -> Geometry, Transform
move_7 = Move(Geometry=entwine_3, Motion=entwine_8)  # -> Geometry, Transform
tag_3 = TextTag(Location=move_7.Geometry, Text=entwine_4)
points_4 = PointList(Points=end.Start, Size=Slider(1, range=0..10))
vdis = VectorDisplay(Anchor=entwine_3, Vector=entwine_8)
tag_4 = TextTag(Location=move_6.Geometry, Text=entwine_7)
