# Grasshopper definition tests.gh (Grasshopper 1.0.8)
# Copyright: GNU Lesser General Public License Version 3
# plug-ins: semio

panel = Panel("C:\git\semio\semio\examples\metabolism\representations\base.3dm")
file = ReadFile(File="C:\git\semio\semio\assets\semio\kit_metabolism.json", PerLineParse=False)
import = ImportContent(FilePath=panel, Import=Toggle(True))  # -> ModelTransform, Objects, Layers, Linetypes, HatchPatterns, AnnotationStyles, Materials, BlockDefinitions
dkx = DeserializeKit(Text=file)
mog = ModelObjectToGroup(RhinoModelObject=import.Objects)
pkx = PassthroughKit(Kit=dkx)  # -> Kit, Valid, Guid, Name, Version, Description, Icon, Image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
mog_2 = ModelObjectToGroup(RhinoModelObject=import.Objects)
item = ListItem(List=pkx.Design, Index=0, Wrap=True)
pdx = PassthroughDesign(Design=item)  # -> Design, Valid, Guid, Name, DesignId, IsAbstract, Folder, Description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
pfx = PassthroughFile(File=pkx.File)  # -> File, Valid, Guid, Name, Mime, FolderId, FolderId_2, Size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
fdx = FlattenDesign(Kit=dkx, DesignId=pdx.Guid)
imx = ImportModel()
item_2 = ListItem(List=pkx.File, Index=0, Wrap=True)  # -> Item, Item1
imx_2 = ImportModel(File=item_2.Item1)
imx_3 = ImportModel(File=item_2.Item)
pdd = PassthroughDesignDiff(DesignDiff=fdx)  # -> DesignDiff, Valid, Guid, Name, DesignId, IsAbstract, Folder, Description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
add = ApplyDesignDiff(Design=pdx.Design, DesignDiff=fdx)
mog_3 = ModelObjectToGroup(RhinoModelObject=imx_2)
ppd = PassthroughPiecesDiff(PiecesDiff=pdd.PiecesDiff)  # -> PiecesDiff, Valid, PieceId, PieceDiff, Piece
ppd_2 = PassthroughPieceDiff(PieceDiff=ppd.PieceDiff)  # -> PieceDiff, Valid, Guid, Name, Description, TypeId, DesignId, Plane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
object = ModelObject(Object=imx_3)  # -> Object, Geometry, Name, Layer, Visibility, Display, Drafting, Render
ppd_3 = PassthroughPiecesDiff()  # -> PiecesDiff, Valid, PieceId, PieceDiff, Piece
pdx_2 = PassthroughDesign(Design=add)  # -> Design, Valid, Guid, Name, DesignId, IsAbstract, Folder, Description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
pln = Plane(ppd_2.Plane)
pfd = PassthroughFileDiff(FileDiff=ppd.PieceDiff)  # -> FileDiff, Valid, Guid, Name, Remote, FolderId, Size, Hash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
pfd_2 = PassthroughFileDiff()  # -> FileDiff, Valid, Guid, Name, Remote, FolderId, Size, Hash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
ppx = PassthroughPiece(Piece=pdx_2.Piece)  # -> Piece, Valid, Guid, Name, Description, TypeId, DesignId, Plane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
ppd_4 = PassthroughPieceDiff()  # -> PieceDiff, Valid, Guid, Name, Description, TypeId, DesignId, Plane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
pln_2 = Plane(ppx.Plane)
