# Grasshopper definition CapsuleTest.gh (Grasshopper 1.0.7)
# plug-ins: Semio, Swiftlet, Hops

pt = ConstructPoint(
    XCoordinate=Slider(84, range=-1000..1000),
    YCoordinate=Slider(51, range=-1000..1000),
    ZCoordinate=Slider(125, range=-1000..1000))
panel = Panel("C:\Git\Studium\PhD\semio\tests\elements\Capsule_Simple.gh")
serialize = Serialize(Input=pt)
list = ValueList({"Back", "Side"}, selected="Back")
list_2 = ValueList({"Front", "Side"}, selected="Front")
list_3 = ValueList({"Back", "Side"}, selected="Back")
representation = ConstructRepresentation(Body=serialize)
panel_2 = Panel("Door")
parameter = ConstructParameter(Name="Entrance", Value=list)
compress = Compress(Input=representation)
cluster = Cluster(
    X=Slider(0, range=-1000..1000),
    Y=Slider(-300, range=-1000..1000),
    Z=Slider(0, range=-1000..1000),
    yaw=Slider(165, range=-360..360),
    pitch=Slider(-17, range=-360..360),
    roll=Slider(150, range=-360..360))
cluster_2 = Cluster(
    X=Slider(600, range=-1000..1000),
    Y=Slider(0, range=-1000..1000),
    Z=Slider(300, range=-1000..1000),
    yaw=Slider(0, range=-360..360),
    pitch=Slider(0, range=-360..360),
    roll=Slider(0, range=-360..360))
cluster_3 = Cluster(
    X=Slider(300, range=-1000..1000),
    Y=Slider(0, range=-1000..1000),
    Z=Slider(0, range=-1000..1000),
    yaw=Slider(0, range=-360..360),
    pitch=Slider(0, range=-360..360),
    roll=Slider(0, range=-360..360))
cluster_4 = Cluster(
    X=Slider(600, range=-1000..1000),
    Y=Slider(0, range=-1000..1000),
    Z=Slider(0, range=-1000..1000),
    yaw=Slider(0, range=-360..360),
    pitch=Slider(0, range=-360..360),
    roll=Slider(0, range=-360..360))
plan = ConstructPlan(Url=panel, Parameters=parameter)  # -> Plan, Hash
sobject = ConstructSobject(Plan=panel)
parameter_2 = ConstructParameter(Name="Width", Value=Slider(300, range=0..1000))
parameter_3 = ConstructParameter(Name="Length", Value=Slider(550, range=0..1000))
parameter_4 = ConstructParameter(Name="Gap", Value=Slider(0, range=0..50))
hops = Hops(
    _Path=panel,
    Length=Slider(420, range=0..1000),
    Width=Slider(270, range=0..1000),
    Height=Slider(275, range=0..1000),
    Entrance=list_3,
    Window=list_2,
    Mirror=Toggle(False),
    ShellThickness=Slider(20, range=0..100),
    SightProtection=Toggle(False),
    CONNECTIONPORTS=" ",
    CONNECTIONPOINT=pt,
    CONNECTIONBIASGap=Slider(20, range=0..100),
    CONNECTIONBIASCorner=Toggle(False),
    CacheResultsInMemory=True,
    CacheSolveResults=True,
    RemoteDefinitionLocation="C:\Git\Studium\PhD\semio\tests\elements\Capsule_Simple.gh",
    RemoteSolveVersion=(0, 1, 0),
    ShowInput_Enabled=False,
    ShowInput_Path=True,
    SynchronousSolve=True)  # -> REPRESENTATIONS, CONNECTIONPOINT
layout = ConstructLayout(Sobjects=sobject)
sobject_2 = ConstructSobject(Pose=cluster_2, Plan=panel)
link = ConstructLink(Bias=[parameter_3, parameter_2])
sobject_3 = ConstructSobject(Pose=cluster_4, Plan=panel)
link_2 = ConstructLink(Bias=parameter_4)
sobject_4 = ConstructSobject(Pose=cluster, Plan=plan.Plan)
sobject_5 = ConstructSobject(Pose=cluster_3, Plan=panel)
link_3 = ConstructLink()
connectable = ConstructConnectable(Sobject=sobject_2, Link=link)
connectable_2 = ConstructConnectable(Sobject=sobject_3, Link=link_2)
connection = ConstructConnection(Connecting=sobject, Connected=sobject_4)
connectable_3 = ConstructConnectable(Sobject=sobject_5, Link=link_3)
layout_2 = ConstructLayout(Sobjects=[sobject, sobject_4], Connections=connection, Assembly=sobject)
connection_2 = ConstructConnection(Connecting=sobject, Connected=connectable_3)
connection_3 = ConstructConnection(Connecting=sobject_4, Connected=connectable_3)
connection_4 = ConstructConnection(Connecting=connectable_3, Connected=connectable_2)
connection_5 = ConstructConnection(Connecting=connectable_2, Connected=connectable)
layout_design = LayoutDesign(Url="http://localhost:2999", Layout=layout, Run=Toggle(False))
layout_design_2 = LayoutDesign(Url="http://localhost:2999", Layout=layout_2, Run=Toggle(True))
layout_3 = ConstructLayout(Sobjects=[sobject, sobject_4], Connections=[connection, connection_2, connection_3], Assembly=sobject)
layout_4 = ConstructLayout(Sobjects=[sobject, sobject_4, sobject_3], Connections=[connection, connection_2, connection_4], Assembly=sobject)
R = Representation()
layout_5 = ConstructLayout(Sobjects=[sobject, sobject_4, sobject_2], Connections=[connection, connection_2, connection_5], Assembly=sobject)
derepresentation = DeconstructRepresentation(Representation=R)  # -> Body, FileType, Platform, Description, Concepts, LevelOfDetail
layout_design_3 = LayoutDesign(Url="http://localhost:2999", Layout=layout_3, Run=Toggle(False))
design = ShowDesign()
layout_design_4 = LayoutDesign(Url="http://localhost:2999", Layout=layout_4, Run=Toggle(False))
layout_design_5 = LayoutDesign(Url="http://localhost:2999", Layout=layout_5, Run=Toggle(False))
dedesign = DeconstructDesign(Design=layout_design_2)  # -> Prototypes, Elements
deserialize = Deserialize(Serialized=derepresentation.Body)
deprototype = DeconstructPrototype(Prototype=dedesign.Prototypes)  # -> PlanHash, Representations, Description
derepresentation_2 = DeconstructRepresentation(Representation=deprototype.Representations)  # -> Body, FileType, Platform, Description, Concepts, LevelOfDetail
item = ListItem(List=derepresentation_2.Body, Index=0, Wrap=True)  # -> Item, Item1, Item2
fjs = FormatJsonString(JSONString=layout_2)
deserialize_2 = Deserialize(Serialized=item.Item)
panel_4 = Panel(fjs)

# ==== cluster Cluster
X = ClusterInput()
Y = ClusterInput()
Z = ClusterInput()
yaw = ClusterInput()
pitch = ClusterInput()
roll = ClusterInput()
yawpitchroll = NAME(yaw=yaw, pitch=pitch, roll=roll)  # -> t
# ---------- yawpitchroll: Python ----------
from Rhino.Geometry import Transform
from math import radians

t = Transform.RotationZYX(radians(yaw),radians(pitch),radians(roll))
# ---------- end yawpitchroll ----------
pt = ConstructPoint(XCoordinate=X, YCoordinate=Y, ZCoordinate=Z)
xy = XYPlane(Origin=Point(0, 0, 0))
transform = Transform(Geometry=xy, Transform=yawpitchroll)
pl_origin = PlaneOrigin(Base=transform, Origin=pt)
pln = Plane(pl_origin)
pln_2 = ClusterOutput(pln)
