# Grasshopper definition Hybrid.gh (Grasshopper 1.0.7)
# plug-ins: Semio, Swiftlet

list = ValueList({"Back", "Side"}, selected="Back")
panel = Panel("Height")
parameter = ConstructParameter(Name="Entrance", Value=list)
list_2 = ValueList({"Back", "Side"}, selected="Side")
parameter_2 = ConstructParameter(Name="Length", Value=Slider(440, range=0..1000))
parameter_3 = ConstructParameter(Name="Length", Value=Slider(330, range=0..1000))
parameter_4 = ConstructParameter(Name="Entrance", Value=list_2)
parameter_5 = ConstructParameter(Name="Height", Value=Slider(350, range=0..1000))
cluster = Cluster(
    X=Slider(0, range=-1000..1000),
    Y=Slider(0, range=-1000..1000),
    Z=Slider(0, range=-1000..1000),
    yaw=Slider(45, range=-360..360),
    pitch=Slider(-45, range=-360..360),
    roll=Slider(90, range=-360..360))
cluster_2 = Cluster(
    X=Slider(366, range=-1000..1000),
    Y=Slider(155, range=-1000..1000),
    Z=Slider(425, range=-1000..1000),
    yaw=Slider(-180, range=-360..360),
    pitch=Slider(0, range=-360..360),
    roll=Slider(-180, range=-360..360))
panel_2 = Panel("C:\Git\Studium\PhD\semio\tests\elements\RectangleWithMiter.gh")
panel_3 = Panel("C:\Git\Studium\PhD\semio\tests\elements\Capsule_Simple.gh")
plan = ConstructPlan(Url=panel_3, Parameters=parameter_2)  # -> Plan, Hash
plan_2 = ConstructPlan(Uri=panel_3, Parameters=parameter_3)  # -> Plan, Hash
panel_4 = Panel("Door")
panel_5 = Panel("Simple")
sobject = ConstructSobject(Plan=plan.Plan)
sobject_2 = ConstructSobject(Pose=cluster_2, Plan=plan_2.Plan)
link = ConstructLink()
connectable = ConstructConnectable(Sobject=sobject_2, Link=link)
connectable_2 = ConstructConnectable(Sobject=sobject, Link=link)
connection = ConstructConnection(Connecting=connectable_2, Connected=connectable)
layout = ConstructLayout(Sobjects=sobject)
layout_2 = ConstructLayout(Sobjects=[sobject, sobject_2], Assembly=sobject)
layout_design = LayoutDesign(Url="http://localhost:2999", Layout=layout, Run=Toggle(True))
panel_6 = Panel("Detailed")
dedesign = DeconstructDesign(Design=layout_design)  # -> Prototypes, Elements
design = ShowDesign(Design=layout_design, Concepts="Wireframe")
fjs = FormatJsonString(JSONString=dedesign.Elements)
panel_7 = Panel(fjs)

# ==== cluster Cluster
X = ClusterInput()
Y = ClusterInput()
Z = ClusterInput()
yaw = ClusterInput()
pitch = ClusterInput()
roll = ClusterInput()
yawpitchroll = NAME(yaw=yaw, pitch=pitch, roll=roll)  # -> t
# ---------- yawpitchroll: Python ----------
from Rhino.Geometry import Transform
from math import radians

t = Transform.RotationZYX(radians(yaw),radians(pitch),radians(roll))
# ---------- end yawpitchroll ----------
pt = ConstructPoint(XCoordinate=X, YCoordinate=Y, ZCoordinate=Z)
xy = XYPlane(Origin=Point(0, 0, 0))
transform = Transform(Geometry=xy, Transform=yawpitchroll)
pl_origin = PlaneOrigin(Base=transform, Origin=pt)
pln = Plane(pl_origin)
pln_2 = ClusterOutput(pln)
